# Grasshopper definition Topography.gh (Grasshopper 1.0.7)
# plug-ins: Pufferfish, Bifocals

outer_walls = OffsetCurve(
    Curve=Tree({0;0}: [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], {0;0;0}: [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], {0;0;0;0;0;0}: [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], {0;0;0;0;0;0;0}: [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], {0;0;0;0;0;0;0;0}: [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], {0;0;0;0;0;0;0;0;0}: [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], {0;0;0;0;0;0;0;0;0;0;0;0}: [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], {0;0;0;0;0;0;0;0;0;0;0;0;0;0;0}: [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], {6}: [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], {6;0;0}: [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]),
    Distance=0.5,
    Plane=PlaneXY(0, 0, 0),
    Corners=1)  # -> flatten(Curve)

# ----
# TO CONTROL THE SLOPE
number_slider = Slider(0.125, range=0..1)

# ----
# INPUT CURVES DOMES
curve = Curve([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])
# INPUT CURVES STREETS
curve_2 = Curve([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])
# INPUT MESH DOMES
mesh = Mesh(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)

circle = Circle(flatten(outer_walls))

# ----
# INPUT OPENINGS
curve_3 = Curve(graft(Tree({0;0;0}: [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], {0;0;1}: [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], {0;0;2}: [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], {0;0;3}: [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], {0;0;4}: [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], {0;0;5}: [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])))
curve_4 = Curve(graft(Tree({0;0}: [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], {0;1}: [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], {0;2}: [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], {0;3}: [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], {0;4}: [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], {0;5}: [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], {0;6}: [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], {0;7}: [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])))
brep = Brep(flatten([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]))
brep_2 = Brep(flatten([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]))

mesh_2 = Mesh(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)

# ----
# Street
number_slider_2 = Slider(3, range=0..5)
list_item = ListItem(List=curve_2, Index=number_slider_2, Wrap=True)
panel = Panel(curve_2)
list_item_2 = ListItem(List=curve_2, Index=Slider(0, range=0..5), Wrap=True)
end_points = EndPoints(Curve=list_item)  # -> Start, End
end_points_2 = EndPoints(Curve=list_item_2)  # -> Start, End
line = Line(StartPoint=end_points.Start, EndPoint=end_points_2.Start)
line_2 = Line(StartPoint=end_points.End, EndPoint=end_points_2.End)
join_curves = JoinCurves(Curves=flatten([line, line_2, list_item, list_item_2]), Preserve=False)

# ----
# Square #1
number_slider_3 = Slider(4, range=0..5)
list_item_3 = ListItem(List=curve_2, Index=number_slider_3, Wrap=True)
curve_curve = CurveCurve(CurveA=list_item_3, CurveB=list_item_2)  # -> Points, ParamsA, ParamsB
trim_curve_with_points = TrimCurveWithPoints(Curve=list_item_3, Points=curve_curve.Points, Alternate=True)  # -> Trimmed, SubDomains
close_curve = CloseCurve(Curve=trim_curve_with_points.Trimmed, CloseType=0, Bulge=0.5, Tolerance=0)  # -> Closed, ResultBoolean

# ----
# Square #2
number_slider_4 = Slider(1, range=0..5)
list_item_4 = ListItem(List=curve_2, Index=Slider(2, range=0..5), Wrap=True)
list_item_5 = ListItem(List=curve_2, Index=number_slider_4, Wrap=True)
flip_curve = FlipCurve(Curve=list_item_5)  # -> Curve, Flag
end_points_3 = EndPoints(Curve=flip_curve.Curve)  # -> Start, End
end_points_4 = EndPoints(Curve=list_item_4)  # -> Start, End
line_3 = Line(StartPoint=end_points_3.Start, EndPoint=end_points_4.Start)
line_4 = Line(StartPoint=end_points_3.End, EndPoint=end_points_4.End)
join_curves_2 = JoinCurves(Curves=flatten([line_3, line_4, list_item_5, list_item_4]), Preserve=False)

# ----
# Square #3
number_slider_5 = Slider(5, range=0..5)
list_item_6 = ListItem(List=curve_2, Index=number_slider_5, Wrap=True)
close_curve_2 = CloseCurve(Curve=list_item_6, CloseType=0, Bulge=0.5, Tolerance=0)  # -> Closed, ResultBoolean

bounding_box = BoundingBox(Content=mesh, Plane=PlaneXY(0, 0, 0))  # -> Box, Box_2
deconstruct_box = DeconstructBox(Box=bounding_box.Box)  # -> Plane, X, Y, Z
unit_z = UnitZ(Factor=deconstruct_box.Z)
extrude = Extrude(Base=curve, Direction=unit_z)
cap_holes = CapHoles(Brep=extrude)  # -> graft(Brep)
mesh_3 = Mesh(cap_holes)
mesh_split = MeshSplit(Mesh=mesh, Splitters=mesh_3)

# ----
# Apex of each dome
mesh_4 = Mesh()
deconstruct_mesh = DeconstructMesh(Mesh=mesh_split)  # -> simplify(Vertices), Faces, Colours, Normals
deconstruct = Deconstruct(Point=deconstruct_mesh.Vertices)  # -> XComponent, YComponent, ZComponent
sort_list = SortList(Keys=deconstruct.ZComponent, ValuesValuesA=deconstruct_mesh.Vertices)  # -> Keys, reverse(ValuesValuesA)
unit_z_2 = UnitZ(Factor=Slider(0.5, range=0..1))
list_item_7 = ListItem(List=sort_list.ValuesValuesA, Index=0, Wrap=True)
move = Move(Geometry=list_item_7, Motion=unit_z_2)  # -> Geometry, Transform

region_union = RegionUnion(Curves=flatten([join_curves_2, close_curve.Closed, join_curves, close_curve_2.Closed]))
unit_z_3 = UnitZ(Factor=Slider(4.5, range=0..10))
number_slider_6 = Slider(3, range=0..10)
move_2 = Move(Geometry=region_union, Motion=unit_z_3)  # -> Geometry, Transform
unit_z_4 = UnitZ(Factor=Slider(4.5, range=0..10))
divide_distance = DivideDistance(Curve=move_2.Geometry, Distance=Slider(1, range=0..10))  # -> Points, Tangents, Parameters
extrude_2 = Extrude(Base=region_union, Direction=unit_z_4)
multiplication = Multiplication(A=number_slider_6, B=-1)
unit_z_5 = UnitZ(Factor=multiplication)
scale_nu = ScaleNU(Geometry=extrude_2, Plane=PlaneXY(0, 0, 0), ScaleX=1, ScaleY=1, ScaleZ=number_slider_6)  # -> Geometry, Transform
move_3 = Move(Geometry=scale_nu.Geometry, Motion=unit_z_5)  # -> Geometry, Transform

panel_2 = Panel("""0
1
6
11
20
21
22
23
24
25
26
27
28
29""")
data = Data(["HEIGHT (m)", "", "3.6", "3", "3", "3", "", "4.2", "4.2", "3", "3", "", "3.6", "3.6", "3", "3", "3.6", "3.6", "3.6", "3", "", "", "", "", "", "", "", "", "", ""])
cull_index = CullIndex(List=data, Indices=panel_2, Wrap=True)
curve_5 = Curve(flatten(curve))
division = Division(A=number_slider, B=cull_index)
deconstruct_arc = DeconstructArc(Arc=curve_5)  # -> BasePlane, Radius, Angle
one_over_x = OneOverX(Value=division)
subtraction = Subtraction(A=one_over_x, B=deconstruct_arc.Radius)  # -> flatten(Result)
offset_curve = OffsetCurve(Curve=curve_5, Distance=subtraction, Plane=PlaneXY(0, 0, 0), Corners=1)  # -> flatten(Curve)

# ----
# Boundry on the Ground
number_slider_7 = Slider(6, range=0..100)
offset_curve_2 = OffsetCurve(Curve=circle, Distance=number_slider_7, Plane=PlaneXY(0, 0, 0), Corners=1)
region_union_2 = RegionUnion(Curves=flatten(offset_curve))
divide_curve = DivideCurve(Curve=region_union_2, Count=Slider(98, range=0..100), Kinks=False)  # -> Points, Tangents, Parameters

# ----
# Create a Mound
delaunay_mesh = DelaunayMesh(Points=flatten([move.Geometry, divide_curve.Points, divide_distance.Points]), Plane=PlaneXY(0, 0, 0))
deconstruct_mesh_2 = DeconstructMesh(Mesh=delaunay_mesh)  # -> Vertices, Faces, Colours, Normals
number_slider_8 = Slider(100, range=0..100)
patch = Patch(Points=deconstruct_mesh_2.Vertices, Spans=20, Flexibility=Slider(17, range=0..100), Trim=True)
surface_split = SurfaceSplit(Surface=patch, Curves=region_union_2)  # -> reverse(Fragments)
list_item_8 = ListItem(List=surface_split, Index=0, Wrap=True)

# ----
# Measure distance between inner and outer surface
mesh_5 = Mesh(mesh_2)
mesh_edges = MeshEdges(Mesh=mesh_5)  # -> NakedEdges, InteriorEdges, NonManifoldEdges
curve_6 = Curve([mesh_edges.InteriorEdges, mesh_edges.NakedEdges])
# Creating the entrances
project = Project(Curve=curve_6, Brep=list_item_8, Direction=Vector(0, 0, 1))
end_points_5 = EndPoints(Curve=project)  # -> graft(Start), End
end_points_6 = EndPoints(Curve=curve_6)  # -> graft(Start), End
line_5 = Line(StartPoint=end_points_5.Start, EndPoint=end_points_6.Start)
distance = Distance(PointA=end_points_5.Start, PointB=end_points_6.Start)

brep_3 = Brep(list_item_8)

# ----
# SUBTRACT STREETS AND SQUARES
bounding_box_2 = BoundingBox(Content=brep_3, Plane=PlaneXY(0, 0, 0))  # -> Box, Box_2
curve_7 = Curve(region_union)
deconstruct_box_2 = DeconstructBox(Box=bounding_box_2.Box)  # -> Plane, X, Y, Z
deconstruct_brep = DeconstructBrep(Brep=bounding_box_2.Box)  # -> Faces, Edges, Vertices
deconstruct_2 = Deconstruct(Point=deconstruct_brep.Vertices)  # -> XComponent, YComponent, ZComponent
unit_z_6 = UnitZ(Factor=deconstruct_box_2.Z)
sort_list_2 = SortList(Keys=deconstruct_2.ZComponent)  # -> Keys, ValuesValuesA
list_item_9 = ListItem(List=sort_list_2.Keys, Index=0, Wrap=True)
unit_z_7 = UnitZ(Factor=list_item_9)
move_4 = Move(Geometry=curve_7, Motion=unit_z_7)  # -> Geometry, Transform
extrude_3 = Extrude(Base=move_4.Geometry, Direction=unit_z_6)  # -> flatten(Extrusion)
cap_holes_2 = CapHoles(Brep=flatten(extrude_3))

solid_union = SolidUnion(Breps=cap_holes_2)

split_brep = SplitBrep(Brep=brep_3, Cutter=solid_union)  # -> flatten(Result)
populate_geometry = PopulateGeometry(Geometry=split_brep, Count=1, Seed=1)  # -> flatten(Population)
point_in_brep = PointInBrep(Brep=cap_holes_2, Point=populate_geometry, Strict=False)
cull_pattern = CullPattern(List=split_brep, CullPattern=point_in_brep)

# ----
# TOPOGROPHY SURFACE
cull_pattern_2 = CullPattern(List=split_brep, CullPattern=invert(point_in_brep))

brep_brep = BrepBrep(BrepA=cull_pattern_2, BrepB=cull_pattern)  # -> Curves, Points
project_2 = Project(Geometry=brep_brep.Curves, Plane=PlaneXY(0, 0, 0))  # -> Geometry, Transform
# GRID A
# *UPDATE FILE PATH*
# (excel file: Plan Generator Inputs)
loft = Loft(
    Curves=[project_2.Geometry, brep_brep.Curves],
    Options={Adjust=False, Closed=False, LoftEnds=0, LoftSimp=0, LoftType=0, Rebuild=10, Refit=0.01})
