# Grasshopper definition OptimisingCatenaryArch.gh (Grasshopper 0.9.76)
# plug-ins: Heteroptera, Anemone, Kangaroo2 Components

# ----
# Optimising a catenary arch: The script optimises an catenary arch according to the loads that act on the arch. The inputs of the script consist of an initial catenary arch, and three types of loads. The output of the scipt is the optimised shape of the arch.
# Creating the chain in its initial shape
number_slider = Slider(5, range=0..10)
construct_point = ConstructPoint(XCoordinate=0, YCoordinate=0, ZCoordinate=0)
construct_point_2 = ConstructPoint(XCoordinate=number_slider, YCoordinate=0, ZCoordinate=0)
unit_z = UnitZ(Factor=1)
catenary = Catenary(PointA=construct_point, PointB=construct_point_2, Length=Slider(7, range=0..10), Gravity=unit_z)

# ----
# The more divisions the more accurate the result
number_slider_2 = Slider(50, range=0..100)
divide_curve = DivideCurve(Curve=catenary, Count=number_slider_2, Kinks=False)  # -> Points, Tangents, Parameters

# ----
# The more iterations, the more accurate the result
number_slider_3 = Slider(1000, range=0..1000)

polyline = PolyLine(Vertices=divide_curve.Points, Closed=False)

fast_loop_start = FastLoopStart(Iterations=number_slider_3, Data=polyline)  # -> port, Counter, Data

curve = Curve(fast_loop_start.Data)
explode = Explode(Curve=curve, Recursive=True)  # -> Segments, Vertices

# ----
# Projected distributed load due to a pack of soil on top of the chain. The pack of soil has a height equal to the top of the chain plus 0.2 meters. This load changes as the the shape of the chain changes.
divide_curve_2 = DivideCurve(Curve=explode.Segments, Count=2, Kinks=False)  # -> Points, Tangents, Parameters
project = Project(Geometry=explode.Segments, Plane=PlaneXY(0, 0, 0))  # -> Geometry, Transform
list_item = ListItem(List=divide_curve_2.Points, Index=1, Wrap=True)
deconstruct = Deconstruct(Point=list_item)  # -> XComponent, YComponent, flatten(ZComponent)
min_max = MinMax(Number=deconstruct.ZComponent)  # -> Minimum, Maximum
length = Length(Curve=project.Geometry)
addition = Addition(A=min_max.Maximum, B="0.2")
subtraction = Subtraction(A=addition, B=deconstruct.ZComponent)  # -> flatten(Result)
soil_density_n_m_3 = Slider(20, range=0..100)
multiplication = Multiplication(A=length, B=subtraction)
multiplication_2 = Multiplication(A=multiplication, B=soil_density_n_m_3)
division = Division(A=multiplication_2, B=2)  # -> simplify(Result)
insert_items = InsertItems(List=division, Indices=0, Wrap=True)  # -> simplify(List)
insert_items_2 = InsertItems(List=division, Indices=-1, Wrap=True)  # -> simplify(List)
addition_2 = Addition(A=insert_items, B=insert_items_2)
unit_z_2 = UnitZ(Factor=addition_2)  # -> simplify(UnitVector)
load = Load(Point=explode.Vertices, ForceVector=unit_z_2)  # -> flatten(Unary)
vector_display = VectorDisplay(Anchor=explode.Vertices, Vector=unit_z_2)

# ----
# Distributed load due to the weight of the chain
weight_of_the_chain_n_m = Slider(2, range=0..10)
length_2 = Length(Curve=curve)
point = Point(explode.Vertices)
list_length = ListLength(List=point)
multiplication_3 = Multiplication(A=weight_of_the_chain_n_m, B=length_2)
division_2 = Division(A=multiplication_3, B=list_length)
unit_z_3 = UnitZ(Factor=division_2)
load_2 = Load(Point=point, ForceVector=unit_z_3)
vector_display_2 = VectorDisplay(Anchor=point, Vector=unit_z_3)

# ----
# Reset the length of the chain back the the original length after each Kangaroo iteration
explode_2 = Explode(Curve=polyline, Recursive=True)  # -> Segments, Vertices
length_3 = Length(Curve=explode_2.Segments)
length_line = LengthLine(Line=explode.Segments, Length=length_3, Strength=Slider(100000, range=0..100000))

# ----
# Point load exterted at x=4
deconstruct_2 = Deconstruct(Point=explode.Vertices)  # -> XComponent, YComponent, ZComponent
subtraction_2 = Subtraction(A=deconstruct_2.XComponent, B="4")
load_n = Slider(25, range=0..100)
absolute = Absolute(Value=subtraction_2)
sort_list = SortList(Keys=absolute, ValuesValuesA=explode.Vertices)  # -> Keys, ValuesValuesA
unit_z_4 = UnitZ(Factor=load_n)
list_item_2 = ListItem(List=sort_list.ValuesValuesA, Index=0, Wrap=True)
load_3 = Load(Point=list_item_2, ForceVector=unit_z_4)

end_points = EndPoints(Curve=curve)  # -> Start, End
power_of_10 = PowerOf10(Value=Slider(100, range=0..100))
anchor = Anchor(Point=[end_points.End, end_points.Start], Strength=power_of_10)

vector_display_3 = VectorDisplay(Anchor=list_item_2, Vector=unit_z_4)
zombiesolver = ZombieSolver(
    GoalObjects=[anchor, load_3, length_line, load, load_2],
    Threshold=1e-10,
    Tolerance=0.01,
    MaxIterations=Slider(2500, range=0..10000))  # -> I, V, O
clean_tree = CleanTree(RemoveNulls=True, RemoveInvalid=True, RemoveEmpty=False, Tree=zombiesolver.O)
join_curves = JoinCurves(Curves=clean_tree, Preserve=False)

fast_loop_end = FastLoopEnd(port=fast_loop_start.port, Exit=False, Data=join_curves, RecordData=False, TimeOutVal=1200000)  # -> flatten(Data)

curve_2 = Curve(fast_loop_end)
