# Grasshopper definition First Floor Plan Generator.gh (Grasshopper 1.0.7)
# plug-ins: treesloth01, Pufferfish, LunchBox

# ----
# DOME FOOTPRINT
# COURTYARD 1
# COURTYARD 2
# COURTYARD 3
outer_walls = OffsetCurve(
    Curve=Tree({0;0}: [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], {0;0;0}: [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], {0;0;0;0;0;0}: [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], {0;0;0;0;0;0;0}: [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], {0;0;0;0;0;0;0;0}: [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], {0;0;0;0;0;0;0;0;0}: [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], {0;0;0;0;0;0;0;0;0;0;0;0}: [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], {0;0;0;0;0;0;0;0;0;0;0;0;0;0;0}: [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], {6}: [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], {6;0;0}: [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]),
    Distance=0.5,
    Plane=PlaneXY(0, 0, 0),
    Corners=1)  # -> flatten(Curve)
circle = Circle(flatten(outer_walls))
curve = Curve(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)
curve_2 = Curve(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)
curve_3 = Curve(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)

curve_4 = Curve([curve_2, curve, curve_3])
curve_5 = Curve(circle)
curve_6 = Curve(flatten([curve_4, curve_5]))
file_path = FilePath("C:\Users\Idil Gumruk\Google Drive (idilgumruk.earthy@gmail.com)\Earthy\09 Scripts\181019 Plan Generator Inputs.xlsx")
excel_reader = ExcelReader(ReadExcelData=Toggle(True), WorkbookPath=file_path, WorksheetName="MODULES")  # -> Exceptions, ExcelData
cull_index = CullIndex(List=excel_reader.ExcelData, Indices=0, Wrap=True)  # -> simplify(List)
list_item = ListItem(List=excel_reader.ExcelData, Index=0, Wrap=True)  # -> flatten(Item)
cull_index_2 = CullIndex(List=list_item, Indices=0, Wrap=True)  # -> simplify(List)
explode_tree = ExplodeTree(Data=cull_index)  # -> Branch0, Branch1, Branch2, Branch3, Branch4
panel = Panel(cull_index_2)
width = Data(explode_tree.Branch1)
data = Data(explode_tree.Branch2)
data_2 = Data(explode_tree.Branch3)
data_3 = Data(explode_tree.Branch4)

# ----
# GRID
street_width = Slider(2.25, range=0..10)
curve_7 = Curve([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])
grid_size = Slider(1.75, range=0..10)
number_of_grid = Slider(20, range=0..20)
list_item_2 = ListItem(List=curve_7, Index=1, Wrap=True)
list_item_3 = ListItem(List=curve_7, Index=0, Wrap=True)
tween_curve = TweenCurve(CurveA=list_item_3, CurveB=list_item_2, Factor=0.5, BlendType=0)
series = Series(Start=street_width, Step=grid_size, Count=number_of_grid)
negative = Negative(Value=series)
offset_curve = OffsetCurve(Curve=tween_curve, Distance=negative, Plane=PlaneXY(0, 0, 0), Corners=1)
offset_curve_2 = OffsetCurve(Curve=tween_curve, Distance=series, Plane=PlaneXY(0, 0, 0), Corners=1)
explode = Explode(Curve=offset_curve, Recursive=True)  # -> Segments, Vertices
explode_2 = Explode(Curve=offset_curve_2, Recursive=True)  # -> Segments, Vertices
list_item_4 = ListItem(List=explode.Segments, Index=0, Wrap=True)
list_item_5 = ListItem(List=explode.Segments, Index=1, Wrap=True)
list_item_6 = ListItem(List=explode_2.Segments, Index=0, Wrap=True)
list_item_7 = ListItem(List=explode_2.Segments, Index=1, Wrap=True)
flip_curve = FlipCurve(Curve=list_item_5)  # -> Curve, Flag
flip_curve_2 = FlipCurve(Curve=list_item_7)  # -> Curve, Flag
curve_8 = Curve(simplify([flip_curve.Curve, list_item_4, flip_curve_2.Curve, list_item_6]))
flip_matrix = FlipMatrix(Data=curve_8)
list_length = ListLength(List=flip_matrix)
subtraction = Subtraction(A=list_length, B=1)
list_item_8 = ListItem(List=flip_matrix, Index=subtraction, Wrap=True)
list_item_9 = ListItem(List=flip_matrix, Index=0, Wrap=True)
edge_surface = EdgeSurface(CurveA=list_item_8, CurveB=list_item_9)
plane_surface = PlaneSurface(Plane=edge_surface, XSize=Domain(-10, 10), YSize=Domain(-10, 10))
bounding_box = BoundingBox(Content=edge_surface, Plane=plane_surface)  # -> Box, Box_2
deconstruct_box = DeconstructBox(Box=bounding_box.Box)  # -> Plane, X, Y, Z
plane_surface_2 = PlaneSurface(Plane=deconstruct_box.Plane, XSize=deconstruct_box.X, YSize=deconstruct_box.Y)
multiplication = Multiplication(A=grid_size, B=number_of_grid)
division = Division(A=multiplication, B=2)
square = Square(Plane=plane_surface_2, Size=grid_size, ExtentX=deconstruct_box.X, ExtentY=division)  # -> simplify(Cells), Points
curve_9 = Curve(square.Cells)
area = Area(Geometry=curve_9)  # -> Area, Centroid
trim_tree = TrimTree(Tree=square.Cells, Depth=1)
trim_tree_2 = TrimTree(Tree=area.Centroid, Depth=1)
point_in_curves = PointInCurves(Point=trim_tree_2, Curves=edge_surface)  # -> simplify(Relationship), Index, Point
expression = Expression(x=point_in_curves.Relationship, Expression="If(x=2, True, False)")

subtraction_2 = Subtraction(A=number_of_grid, B=2)
partition_list = PartitionList(List=trim_tree, Size=subtraction_2)
partition_list_2 = PartitionList(List=expression, Size=subtraction_2)

cull_pattern = CullPattern(List=partition_list, CullPattern=partition_list_2)
area_2 = Area(Geometry=cull_pattern)  # -> Area, Centroid

point_in_curves_2 = PointInCurves(Point=area_2.Centroid, Curves=flatten(curve_4))  # -> Relationship, Index, Point
expression_2 = Expression(x=point_in_curves_2.Relationship, Expression="If(x=0,False,True)")
division_2 = Division(A=grid_size, B=2)
offset_curve_3 = OffsetCurve(Curve=curve_6, Distance=division_2, Plane=PlaneXY(0, 0, 0), Corners=1)
dispatch_multiple = DispatchMultiple(List=area_2.Centroid, DispatchPattern=expression_2)  # -> Data0, Data1
region_union = RegionUnion(Curves=flatten(offset_curve_3))
point = Point(reverse(dispatch_multiple.Data0))

# ----
# DOMES BELOW
point_in_curves_3 = PointInCurves(Point=point, Curves=region_union)  # -> Relationship, Index, Point
expression_3 = Expression(x=point_in_curves_3.Relationship, Expression="If(x=2,True,False)")
dispatch_multiple_2 = DispatchMultiple(List=point, DispatchPattern=expression_3)  # -> Data0, Data1

# ----
# FOR 1 STOREY DWELLINGS
prune_tree = PruneTree(Tree=dispatch_multiple_2.Data1, Minimum=2, Maximum=0)
last_index = LastIndex(List=prune_tree)
cull_index_3 = CullIndex(List=prune_tree, Indices=last_index, Wrap=True)
point_2 = Point(cull_index_3)

# ----
# FOR 2 STOREY DWELLINGS
prune_tree_2 = PruneTree(Tree=dispatch_multiple_2.Data0, Minimum=2, Maximum=0)
point_3 = Point(prune_tree_2)

# ----
# COURTYARD
point_4 = Point(dispatch_multiple.Data1)

point_list = PointList(Points=point_3)
point_list_2 = PointList(Points=point_2)
point_list_3 = PointList(Points=point_4)
deconstruct = Deconstruct(Point=point_2)  # -> XComponent, YComponent, ZComponent
# GRID A
# *UPDATE FILE PATH*
# (excel file: Plan Generator Inputs)
module_1 = GhPythonScript(x=point_2, y=deconstruct.YComponent, res=grid_size, width=width, depth=data, height=data_2, quantity=data_3)  # -> out, m1, pos1, board; inputs x: list, y: list, width: list of Int32, depth: list, height: list, quantity: list
# ---------- module_1: Python ----------
import rhinoscriptsyntax as rs
import Rhino.Geometry as rg
import random as rn


res = float(res)
board = [[0 for i in range(int(y))] for i in range(int(x))]
pals = []


# define modules
modules = []

# retreiving the length of the list of the modules
len = len(width)
id = 0
poses = []
# iterating over the list and creating modules
for mc in range(1,len):
    
    # retrieving width, depth, height and quantity for this module
    w = [-float(width[mc])/2, float(width[mc])/2]
    d = [-float(depth[mc])/2, float(depth[mc])/2]
    h = [0, float(height[mc])]
    q = int(quantity[mc])
    
    # repeating the creation process for q times which is the quantity of this module
    for qc in range(q):
        # randomizing initial position
        pos = [rn.randint(0, x),rn.randint(0, y)]
        poses.append(pos)
        # aligning initial position to board
        for ranpal in poses:
            pal = rs.CreatePoint(ranpal)
            palx = res * int(pal.X/res)
            paly = res * int(pal.Y/res)
            pal = rg.Point3d(palx + res/2, paly + res/2, 0)
            pals.append(pal)
            gridposes = pals
        # initiating the mesh
        module = rg.Mesh()
        #iterating through verticies of the box
        for i in range(2):
            for j in range(2):
                for k in range(2):
                    #creating the point (vertex)
                    point = rg.Point3d(w[i], d[j], h[k])
                    #adding the point to the mesh as verticies
                    module.Vertices.Add(point)
                    
        #Add all faces to the mesh
        #Faces are defined counter-clockwise
        #Bottom
        module.Faces.AddFace(0,4,6,2)
        #Top
        module.Faces.AddFace(1,5,7,3)
        #Sides
        module.Faces.AddFace(0,4,5,1)
        module.Faces.AddFace(4,6,7,5)
        module.Faces.AddFace(6,2,3,7)
        module.Faces.AddFace(2,0,1,3)
        
        # adding the mesh to the list of meshes
        modules.append(module)
        
        # determing the points occupied by the module
        ws = int(float(width[mc])/(res*2))
        ds = int(float(depth[mc])/(res*2))
        
#        for gridpos in gridposes:
#            for i in range(gridpos[0]-ws, gridpos[0]+ws):
#                for j in range(d[1]-ds, d[1]+ds):
#                    board[i][j] = id
#                    id += 1

# Output the mesh you constructed


m1 = modules
pos1 = gridposes

print gridposes
# ---------- end module_1 ----------
