# Grasshopper definition Plan Generator.gh (Grasshopper 1.0.7)
# plug-ins: LunchBox, Wombat

file_path = FilePath("C:\Users\Hayley\Documents\1_TU Delft\4_Earthy\181019 Plan Generator Inputs.xlsx")
excel_reader = ExcelReader(ReadExcelData=Toggle(True), WorkbookPath=file_path, WorksheetName="SCRIPT")  # -> Exceptions, ExcelData

# ----
# STREET
number_slider = Slider(35, range=0..40)
vector_xyz = VectorXYZ(XComponent=10, YComponent=0, ZComponent=0)  # -> Vector, Length
street_length = Number(number_slider)
point_0_0_0 = Point(Point(0, 0, 0))
radians = Radians(Degrees=210)
line_sdl = LineSDL(Start=point_0_0_0, Direction=vector_xyz.Vector, Length=street_length)
rotate = Rotate(Geometry=line_sdl, Angle=radians, Plane=PlaneXY(0, 0, 0))  # -> Geometry, Transform
street_wall_thickness = Number(1)
street_width = Number(3.5)
negative = Negative(Value=street_wall_thickness)
join_curves = JoinCurves(Curves=flatten([line_sdl, rotate.Geometry]), Preserve=False)
offset_curve = OffsetCurve(Curve=join_curves, Distance=street_width, Plane=PlaneXY(0, 0, 0), Corners=1)
offset_curve_2 = OffsetCurve(Curve=join_curves, Distance=negative, Plane=PlaneXY(0, 0, 0), Corners=1)
offset_curve_3 = OffsetCurve(Curve=offset_curve, Distance=street_wall_thickness, Plane=PlaneXY(0, 0, 0), Corners=1)

# ----
# COURTYARD (SMALL)
depth = Slider(7, range=0..20)
width = Slider(5.25, range=0..20)
unit_x = UnitX(Factor=-1)
unit_z = UnitZ(Factor=1)
radians_2 = Radians(Degrees=30)
line_sdl_2 = LineSDL(Start=point_0_0_0, Direction=unit_x, Length=width)
line_sdl_3 = LineSDL(Start=point_0_0_0, Direction=unit_z, Length=1)
rotate_axis = RotateAxis(Geometry=line_sdl_2, Angle=radians_2, Axis=line_sdl_3)  # -> Geometry, Transform
explode = Explode(Curve=rotate_axis.Geometry, Recursive=True)  # -> Segments, Vertices
list_item = ListItem(List=explode.Vertices, Index=1, Wrap=True)
unit_x_2 = UnitX(Factor=-1)
unit_z_2 = UnitZ(Factor=1)
unit_x_3 = UnitX(Factor=-1)
unit_z_3 = UnitZ(Factor=1)
radians_3 = Radians(Degrees=30)
line_sdl_4 = LineSDL(Start=list_item, Direction=unit_x_2, Length=width)
line_sdl_5 = LineSDL(Start=list_item, Direction=unit_z_2, Length=1)
radians_4 = Radians(Degrees=120)
line_sdl_6 = LineSDL(Start=list_item, Direction=unit_z_3, Length=1)
line_sdl_7 = LineSDL(Start=list_item, Direction=unit_x_3, Length=depth)
rotate_axis_2 = RotateAxis(Geometry=line_sdl_4, Angle=radians_3, Axis=line_sdl_5)  # -> Geometry, Transform
rotate_axis_3 = RotateAxis(Geometry=line_sdl_7, Angle=radians_4, Axis=line_sdl_6)  # -> Geometry, Transform
unit_z_4 = UnitZ(Factor=1)
explode_2 = Explode(Curve=rotate_axis_2.Geometry, Recursive=True)  # -> Segments, Vertices
radians_5 = Radians(Degrees=30)
line_sdl_8 = LineSDL(Start=point_0_0_0, Direction=unit_z_4, Length=1)
explode_3 = Explode(Curve=rotate_axis_3.Geometry, Recursive=True)  # -> Segments, Vertices
plane = Plane(point_0_0_0)
list_item_2 = ListItem(List=explode_2.Vertices, Index=1, Wrap=True)
rotate_axis_4 = RotateAxis(Geometry=plane, Angle=radians_5, Axis=line_sdl_8)  # -> Geometry, Transform
list_item_3 = ListItem(List=explode_3.Vertices, Index=1, Wrap=True)
rectangle_2pt = Rectangle2Pt(Plane=rotate_axis_4.Geometry, PointA=list_item_2, PointB=list_item_3, Radius=0)  # -> Rectangle, Length
explode_4 = Explode(Curve=rectangle_2pt.Rectangle, Recursive=True)  # -> Segments, Vertices
list_item_4 = ListItem(List=explode_4.Segments, Index=1, Wrap=True)
list_item_5 = ListItem(List=explode_4.Segments, Index=3, Wrap=True)
list_item_6 = ListItem(List=explode_4.Segments, Index=0, Wrap=True)
polygon_center = PolygonCenter(Polyline=rectangle_2pt.Rectangle)  # -> CenterV, CenterE, CenterA
join_curves_2 = JoinCurves(Curves=[list_item_4, list_item_5, list_item_6], Preserve=False)
text_tag = TextTag(Location=polygon_center.CenterV, Text="COURTYARD")
offset_curve_4 = OffsetCurve(Curve=join_curves_2, Distance=street_wall_thickness, Plane=PlaneXY(0, 0, 0), Corners=1)  # -> flatten(Curve)

# ----
# COURTYARD (LARGE)
depth_2 = Slider(14, range=0..20)
width_2 = Slider(10.5, range=0..20)
vector_xyz_2 = VectorXYZ(XComponent=width_2, YComponent=street_width, ZComponent=0)  # -> Vector, Length
vector_xyz_3 = VectorXYZ(XComponent=0, YComponent=depth_2, ZComponent=0)  # -> Vector, Length
move = Move(Geometry=point_0_0_0, Motion=vector_xyz_3.Vector)  # -> Geometry, Transform
move_2 = Move(Geometry=point_0_0_0, Motion=vector_xyz_2.Vector)  # -> Geometry, Transform
rectangle_2pt_2 = Rectangle2Pt(Plane=PlaneXY(0, 0, 0), PointA=move.Geometry, PointB=move_2.Geometry, Radius=0)  # -> Rectangle, Length
polygon_center_2 = PolygonCenter(Polyline=rectangle_2pt_2.Rectangle)  # -> CenterV, CenterE, CenterA
text_tag_2 = TextTag(Location=polygon_center_2.CenterV, Text="COURTYARD")
explode_5 = Explode(Curve=rectangle_2pt_2.Rectangle, Recursive=True)  # -> Segments, Vertices
list_item_7 = ListItem(List=explode_5.Segments, Index=3, Wrap=True)
list_item_8 = ListItem(List=explode_5.Segments, Index=1, Wrap=True)
offset_curve_5 = OffsetCurve(Curve=[list_item_8, list_item_7], Distance=street_wall_thickness, Plane=PlaneXY(0, 0, 0), Corners=1)  # -> flatten(Curve)

# ----
# COURTYARD (MEDIUM)
depth_3 = Slider(10.5, range=0..20)
width_3 = Slider(7, range=0..20)
multiplication = Multiplication(A=depth_3, B=-1)
vector_xyz_4 = VectorXYZ(XComponent=width_2, YComponent=0, ZComponent=0)  # -> Vector, Length
vector_xyz_5 = VectorXYZ(XComponent=width_3, YComponent=multiplication, ZComponent=0)  # -> Vector, Length
move_3 = Move(Geometry=point_0_0_0, Motion=vector_xyz_4.Vector)  # -> Geometry, Transform
move_4 = Move(Geometry=move_3.Geometry, Motion=vector_xyz_5.Vector)  # -> Geometry, Transform
rectangle_2pt_3 = Rectangle2Pt(Plane=PlaneXY(0, 0, 0), PointA=move_3.Geometry, PointB=move_4.Geometry, Radius=0)  # -> Rectangle, Length
explode_6 = Explode(Curve=rectangle_2pt_3.Rectangle, Recursive=True)  # -> Segments, Vertices
polygon_center_3 = PolygonCenter(Polyline=rectangle_2pt_3.Rectangle)  # -> CenterV, CenterE, CenterA
text_tag_3 = TextTag(Location=polygon_center_3.CenterV, Text="COURTYARD")
list_item_9 = ListItem(List=explode_6.Segments, Index=0, Wrap=True)
list_item_10 = ListItem(List=explode_6.Segments, Index=3, Wrap=True)
list_item_11 = ListItem(List=explode_6.Segments, Index=1, Wrap=True)
join_curves_3 = JoinCurves(Curves=[list_item_11, list_item_9, list_item_10], Preserve=False)
offset_curve_6 = OffsetCurve(Curve=join_curves_3, Distance=street_wall_thickness, Plane=PlaneXY(0, 0, 0), Corners=1)  # -> flatten(Curve)

explode_tree = ExplodeTree(Data=excel_reader.ExcelData)  # -> Branch0, Branch1, Branch2, Branch3, Branch4, Branch5, Branch6, Branch7

# ----
# CLUSTER B
kitchen_large = Number(8)
kitchen_small = Number(13)
dining_small = Number(12)
kitchen_large_storage = Number(9)
kitchen_small_storage = Number(14)
clothes_washing_area = Number(19)
dining_large = Number(7)
iwan_medium = Number(10)
list_item_12 = ListItem(List=explode_tree.Branch6, Index=kitchen_large, Wrap=True)
list_item_13 = ListItem(List=explode_tree.Branch6, Index=dining_small, Wrap=True)
list_item_14 = ListItem(List=explode_tree.Branch6, Index=kitchen_small, Wrap=True)
list_item_15 = ListItem(List=explode_tree.Branch6, Index=kitchen_large_storage, Wrap=True)
list_item_16 = ListItem(List=explode_tree.Branch6, Index=clothes_washing_area, Wrap=True)
list_item_17 = ListItem(List=explode_tree.Branch6, Index=dining_large, Wrap=True)
list_item_18 = ListItem(List=explode_tree.Branch6, Index=iwan_medium, Wrap=True)
list_item_19 = ListItem(List=explode_tree.Branch6, Index=kitchen_small_storage, Wrap=True)
area_m2 = Number(list_item_12)
area_m2_2 = Number(list_item_14)
area_m2_3 = Number(list_item_13)
area_m2_4 = Number(list_item_15)
area_m2_5 = Number(list_item_17)
area_m2_6 = Number(list_item_16)
area_m2_7 = Number(list_item_18)
area_m2_8 = Number(list_item_19)

# ----
# CLUSTER D
iwan_small = Number(15)
male_showers = Number(16)
female_showers = Number(17)
iwan_small_2 = Number(5)
building_utility_room = Number(18)
list_item_20 = ListItem(List=explode_tree.Branch6, Index=iwan_small, Wrap=True)
list_item_21 = ListItem(List=explode_tree.Branch6, Index=male_showers, Wrap=True)
list_item_22 = ListItem(List=explode_tree.Branch6, Index=iwan_small_2, Wrap=True)
list_item_23 = ListItem(List=explode_tree.Branch6, Index=female_showers, Wrap=True)
list_item_24 = ListItem(List=explode_tree.Branch6, Index=building_utility_room, Wrap=True)
area_m2_9 = Number(list_item_20)
area_m2_10 = Number(list_item_21)
area_m2_11 = Number(list_item_23)
area_m2_12 = Number(list_item_22)
area_m2_13 = Number(list_item_24)

# ----
# CLUSTER A
work_room = Number(3)
iwan_large = Number(2)
building_storage = Number(4)
list_item_25 = ListItem(List=explode_tree.Branch6, Index=work_room, Wrap=True)
list_item_26 = ListItem(List=explode_tree.Branch6, Index=iwan_large, Wrap=True)
list_item_27 = ListItem(List=explode_tree.Branch6, Index=building_storage, Wrap=True)
area_m2_14 = Number(list_item_26)
area_m2_15 = Number(list_item_25)
area_m2_16 = Number(list_item_27)

unit_z_5 = UnitZ(Factor=1)
radians_6 = Radians(Degrees=210)
line_sdl_9 = LineSDL(Start=point_0_0_0, Direction=unit_z_5, Length=1)
plane_2 = Plane(point_0_0_0)
rotate_axis_5 = RotateAxis(Geometry=plane_2, Angle=radians_6, Axis=line_sdl_9)  # -> Geometry, Transform
square = Square(
    Plane=rotate_axis_5.Geometry,
    Size=Slider(1.75, range=0..100),
    ExtentX=Slider(17, range=0..26),
    ExtentY=Slider(12, range=0..100))  # -> Cells, Points
area = Area(Geometry=square.Cells)  # -> Area, Centroid

square_2 = Square(Plane=point_0_0_0, Size=Slider(1.75, range=0..100), ExtentX=Slider(18, range=0..100), ExtentY=Slider(14, range=0..100))  # -> Cells, Points
area_2 = Area(Geometry=square_2.Cells)  # -> Area, Centroid

unit_z_6 = UnitZ(Factor=1)
radians_7 = Radians(Degrees=270)
plane_3 = Plane(point_0_0_0)
rotate_2 = Rotate(Geometry=plane_3, Angle=radians_7, Plane=PlaneXY(0, 0, 0))  # -> Geometry, Transform
radians_8 = Radians(Degrees=210)
line_sdl_10 = LineSDL(Start=point_0_0_0, Direction=unit_z_6, Length=1)
rotate_axis_6 = RotateAxis(Geometry=rotate_2.Geometry, Angle=radians_8, Axis=line_sdl_10)  # -> Geometry, Transform
square_3 = Square(
    Plane=rotate_axis_6.Geometry,
    Size=Slider(1.75, range=0..100),
    ExtentX=Slider(12, range=0..26),
    ExtentY=Slider(17, range=0..100))  # -> Cells, Points
area_3 = Area(Geometry=square_3.Cells)  # -> Area, Centroid

# ----
# GRIDS
radians_9 = Radians(Degrees=270)
plane_4 = Plane(point_0_0_0)
rotate_3 = Rotate(Geometry=plane_4, Angle=radians_9, Plane=PlaneXY(0, 0, 0))  # -> Geometry, Transform

unit_z_7 = UnitZ(Factor=1)
radians_10 = Radians(Degrees=120)
line_sdl_11 = LineSDL(Start=point_0_0_0, Direction=unit_z_7, Length=1)
rotate_axis_7 = RotateAxis(Geometry=rotate_3.Geometry, Angle=radians_10, Axis=line_sdl_11)  # -> Geometry, Transform
square_4 = Square(
    Plane=rotate_axis_7.Geometry,
    Size=Slider(1.75, range=0..100),
    ExtentX=Slider(7, range=0..26),
    ExtentY=Slider(12, range=0..100))  # -> Cells, Points
area_4 = Area(Geometry=square_4.Cells)  # -> Area, Centroid

radians_11 = Radians(Degrees=270)
plane_5 = Plane(point_0_0_0)
rotate_4 = Rotate(Geometry=plane_5, Angle=radians_11, Plane=PlaneXY(0, 0, 0))  # -> Geometry, Transform
square_5 = Square(
    Plane=rotate_4.Geometry,
    Size=Slider(1.75, range=0..100),
    ExtentX=Slider(14, range=0..100),
    ExtentY=Slider(18, range=0..100))  # -> Cells, Points
area_5 = Area(Geometry=square_5.Cells)  # -> Area, Centroid

unit_x_4 = UnitX(Factor=-1)
explode_7 = Explode(Curve=offset_curve_2, Recursive=True)  # -> Segments, Vertices
list_item_28 = ListItem(List=explode_7.Segments, Index=1, Wrap=True)
addition = Addition(A=1.5)
unit_y = UnitY(Factor=-1)
unit_z_8 = UnitZ(Factor=1)
radians_12 = Radians(Degrees=30)
wall_thickness = Slider(0.5, range=0..1)

# ----
# WORK ROOM
expression = Expression(x=area_m2_15, Expression="sqrt(x/π)")
addition_2 = Addition(A=expression, B=wall_thickness)
vector_xyz_6 = VectorXYZ(XComponent=expression, YComponent=addition_2, ZComponent=0)  # -> Vector, Length
move_5 = Move(Geometry=move_2.Geometry, Motion=vector_xyz_6.Vector)  # -> Geometry, Transform
text_tag_4 = TextTag(Location=move_5.Geometry, Text="WORK ROOM")
circle_cnr = CircleCNR(Center=move_5.Geometry, Normal=Vector(0, 0, 1), Radius=expression)  # -> flatten(Circle)
height = ListItem(List=explode_tree.Branch7, Index=work_room, Wrap=True)  # -> flatten(Item)

# ----
# KITCHEN (LARGE)
expression_2 = Expression(x=area_m2, Expression="sqrt(x/π)")
division = Division(A=depth_3, B=2)
addition_3 = Addition(A=expression_2, B=division, C=wall_thickness)
negative_2 = Negative(Value=addition_3)
vector_xyz_7 = VectorXYZ(XComponent=0, YComponent=negative_2, ZComponent=0)  # -> Vector, Length
move_6 = Move(Geometry=polygon_center_3.CenterV, Motion=vector_xyz_7.Vector)  # -> Geometry, Transform
text_tag_5 = TextTag(Location=move_6.Geometry, Text="KITCHEN")
circle = Circle(Plane=move_6.Geometry, Radius=expression_2)  # -> flatten(Circle)
height_2 = ListItem(List=explode_tree.Branch7, Index=kitchen_large, Wrap=True)  # -> flatten(Item)

# ----
# IWAN (SMALL)
explode_8 = Explode(Curve=offset_curve, Recursive=True)  # -> Segments, Vertices
unit_y_2 = UnitY(Factor=10)
expression_3 = Expression(x=area_m2_9, Expression="sqrt(x/π)")
list_item_29 = ListItem(List=explode_8.Vertices, Index=1, Wrap=True)
move_7 = Move(Geometry=list_item_29, Motion=unit_y_2)  # -> Geometry, Transform
line = Line(StartPoint=list_item_29, EndPoint=move_7.Geometry)
multiplication_2 = Multiplication(A=wall_thickness, B=-2)
multiplication_3 = Multiplication(A=expression_3, B=-1)
addition_4 = Addition(A=multiplication_2, B=multiplication_3)
offset_curve_7 = OffsetCurve(Curve=line, Distance=addition_4, Plane=PlaneXY(0, 0, 0), Corners=1)
offset_curve_8 = OffsetCurve(Curve=offset_curve, Distance=expression_3, Plane=PlaneXY(0, 0, 0), Corners=1)
multiplication_4 = Multiplication(A=wall_thickness, B=-1)
curve_curve = CurveCurve(CurveA=offset_curve_7, CurveB=offset_curve_8)  # -> Points, ParamsA, ParamsB
unit_y_3 = UnitY(Factor=multiplication_4)
move_8 = Move(Geometry=curve_curve.Points, Motion=unit_y_3)  # -> Geometry, Transform
text_tag_6 = TextTag(Location=move_8.Geometry, Text="IWAN")
circle_cnr_2 = CircleCNR(Center=move_8.Geometry, Normal=Vector(0, 0, 1), Radius=expression_3)  # -> flatten(Circle)
height_3 = ListItem(List=explode_tree.Branch7, Index=iwan_small, Wrap=True)  # -> flatten(Item)

# ----
# FEMALE SHOWERS
expression_4 = Expression(x=area_m2_11, Expression="sqrt(x/π)")
unit_x_5 = UnitX(Factor=-1)
unit_z_9 = UnitZ(Factor=1)
line_sdl_12 = LineSDL(Start=move_8.Geometry, Direction=unit_x_5, Length=expression_4)
radians_13 = Radians(Degrees=30)
line_sdl_13 = LineSDL(Start=move_8.Geometry, Direction=unit_z_9, Length=1)
rotate_axis_8 = RotateAxis(Geometry=line_sdl_12, Angle=radians_13, Axis=line_sdl_13)  # -> Geometry, Transform
multiplication_5 = Multiplication(A=wall_thickness, B=2)
curve_curve_2 = CurveCurve(CurveA=rotate_axis_8.Geometry, CurveB=circle_cnr_2)  # -> Points, ParamsA, ParamsB
addition_5 = Addition(A=expression_4, B=multiplication_5)
curve_closest_point = CurveClosestPoint(Point=curve_curve_2.Points, Curve=offset_curve)  # -> Point, Parameter, Distance
line_2 = Line(StartPoint=curve_curve_2.Points, EndPoint=curve_closest_point.Point)
addition_6 = Addition(A=expression_4, B=wall_thickness)
offset_curve_9 = OffsetCurve(Curve=offset_curve, Distance=addition_6, Plane=PlaneXY(0, 0, 0), Corners=1)
extend_curve = ExtendCurve(Curve=line_2, Type=0, Start=expression_4, End=expression_4)
offset_curve_10 = OffsetCurve(Curve=extend_curve, Distance=addition_5, Plane=PlaneXY(0, 0, 0), Corners=1)
curve_curve_3 = CurveCurve(CurveA=offset_curve_10, CurveB=offset_curve_9)  # -> Points, ParamsA, ParamsB
panel = Panel("""FEMALE
SHOWERS""")
text_tag_7 = TextTag(Location=curve_curve_3.Points, Text=panel)
circle_cnr_3 = CircleCNR(Center=curve_curve_3.Points, Normal=Vector(0, 0, 1), Radius=expression_4)  # -> flatten(Circle)
height_4 = ListItem(List=explode_tree.Branch7, Index=female_showers, Wrap=True)  # -> flatten(Item)

# ----
# MALE SHOWERS
expression_5 = Expression(x=area_m2_10, Expression="sqrt(x/π)")
unit_x_6 = UnitX(Factor=-1)
unit_z_10 = UnitZ(Factor=1)
line_sdl_14 = LineSDL(Start=curve_curve_3.Points, Direction=unit_x_6, Length=expression_4)
radians_14 = Radians(Degrees=30)
line_sdl_15 = LineSDL(Start=curve_curve_3.Points, Direction=unit_z_10, Length=1)
rotate_axis_9 = RotateAxis(Geometry=line_sdl_14, Angle=radians_14, Axis=line_sdl_15)  # -> Geometry, Transform
multiplication_6 = Multiplication(A=wall_thickness, B=2.1)
curve_curve_4 = CurveCurve(CurveA=rotate_axis_9.Geometry, CurveB=circle_cnr_3)  # -> Points, ParamsA, ParamsB
curve_closest_point_2 = CurveClosestPoint(Point=curve_curve_4.Points, Curve=offset_curve)  # -> Point, Parameter, Distance
addition_7 = Addition(A=expression_5, B=multiplication_6)
line_3 = Line(StartPoint=curve_curve_4.Points, EndPoint=curve_closest_point_2.Point)
addition_8 = Addition(A=expression_5, B=wall_thickness)
offset_curve_11 = OffsetCurve(Curve=offset_curve, Distance=addition_8, Plane=PlaneXY(0, 0, 0), Corners=1)
extend_curve_2 = ExtendCurve(Curve=line_3, Type=0, Start=expression_5, End=expression_5)
offset_curve_12 = OffsetCurve(Curve=extend_curve_2, Distance=addition_7, Plane=PlaneXY(0, 0, 0), Corners=1)
curve_curve_5 = CurveCurve(CurveA=offset_curve_12, CurveB=offset_curve_11)  # -> Points, ParamsA, ParamsB
panel_2 = Panel("""MALE
SHOWERS""")
text_tag_8 = TextTag(Location=curve_curve_5.Points, Text=panel_2)
circle_cnr_4 = CircleCNR(Center=curve_curve_5.Points, Normal=Vector(0, 0, 1), Radius=expression_5)  # -> flatten(Circle)
height_5 = ListItem(List=explode_tree.Branch7, Index=male_showers, Wrap=True)  # -> flatten(Item)

# ----
# IWAN
expression_6 = Expression(x=area_m2_12, Expression="sqrt(x/π)")
unit_x_7 = UnitX(Factor=-1)
unit_z_11 = UnitZ(Factor=1)
line_sdl_16 = LineSDL(Start=curve_curve_5.Points, Direction=unit_x_7, Length=expression_5)
radians_15 = Radians(Degrees=30)
line_sdl_17 = LineSDL(Start=curve_curve_5.Points, Direction=unit_z_11, Length=1)
multiplication_7 = Multiplication(A=wall_thickness, B=2)
rotate_axis_10 = RotateAxis(Geometry=line_sdl_16, Angle=radians_15, Axis=line_sdl_17)  # -> Geometry, Transform
addition_9 = Addition(A=expression_6, B=multiplication_7)
curve_curve_6 = CurveCurve(CurveA=rotate_axis_10.Geometry, CurveB=circle_cnr_4)  # -> Points, ParamsA, ParamsB
multiplication_8 = Multiplication(A=wall_thickness, B=-1)
curve_closest_point_3 = CurveClosestPoint(Point=curve_curve_6.Points, Curve=offset_curve)  # -> Point, Parameter, Distance
addition_10 = Addition(A=expression_6, B=multiplication_8)
line_4 = Line(StartPoint=curve_curve_6.Points, EndPoint=curve_closest_point_3.Point)
offset_curve_13 = OffsetCurve(Curve=offset_curve, Distance=addition_10, Plane=PlaneXY(0, 0, 0), Corners=1)
extend_curve_3 = ExtendCurve(Curve=line_4, Type=0, Start=expression_6, End=expression_6)
offset_curve_14 = OffsetCurve(Curve=extend_curve_3, Distance=addition_9, Plane=PlaneXY(0, 0, 0), Corners=1)
curve_curve_7 = CurveCurve(CurveA=offset_curve_14, CurveB=offset_curve_13)  # -> Points, ParamsA, ParamsB
text_tag_9 = TextTag(Location=curve_curve_7.Points, Text="IWAN")
circle_cnr_5 = CircleCNR(Center=curve_curve_7.Points, Normal=Vector(0, 0, 1), Radius=expression_6)  # -> flatten(Circle)
height_6 = ListItem(List=explode_tree.Branch7, Index=iwan_small_2, Wrap=True)  # -> flatten(Item)

negative_3 = Negative(Value=wall_thickness)
courtyards_and_streets = Curve([join_curves, offset_curve, list_item_8, list_item_7, join_curves_3, join_curves_2])

outer_walls = OffsetCurve(Curve=[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], Distance=0.5, Plane=PlaneXY(0, 0, 0), Corners=1)  # -> flatten(Curve)
courtyards_and_streets_2 = Curve(Tree({0;0}: [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], {0;0;0}: [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], {0;0;0;0;0}: [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]))
heights = Number([3.6, 3, 3, 4.2, 4.2, 3, 3, 3.6, 3.6, 3, 3, 3.6, 3.6, 3.6, 3, 3])

# ----
# IWAN (LARGE)
expression_7 = Expression(x=area_m2_14, Expression="sqrt(x/π)")
expression_8 = Expression(x=expression, y=expression_7, Expression="x+Sqrt((x+y)*(x+y)-(x-y)*(x-y))")
height_7 = ListItem(List=explode_tree.Branch7, Index=iwan_large, Wrap=True)  # -> flatten(Item)

addition_11 = Addition(A=expression_7, B=-1)
addition_12 = Addition(A=expression_8, B=1)

vector_xyz_8 = VectorXYZ(XComponent=addition_12, YComponent=addition_11, ZComponent=0)  # -> Vector, Length
move_9 = Move(Geometry=move_2.Geometry, Motion=vector_xyz_8.Vector)  # -> Geometry, Transform
text_tag_10 = TextTag(Location=move_9.Geometry, Text="IWAN")
circle_2 = Circle(Plane=move_9.Geometry, Radius=expression_7)  # -> flatten(Circle)

# ----
# BUILDING STORAGE
expression_9 = Expression(x=area_m2_16, Expression="sqrt(x/π)")
panel_3 = Panel("""BUILDING
STORAGE""")
height_8 = ListItem(List=explode_tree.Branch7, Index=building_storage, Wrap=True)  # -> flatten(Item)

addition_13 = Addition(A=expression, B=expression_9)
addition_14 = Addition(A=expression_7, B=expression_9)
circle_3 = Circle(Plane=move_9.Geometry, Radius=addition_14)
circle_4 = Circle(Plane=move_5.Geometry, Radius=addition_13)
offset_curve_15 = OffsetCurve(Curve=circle_3, Distance=addition, Plane=PlaneXY(0, 0, 0), Corners=1)
offset_curve_16 = OffsetCurve(Curve=circle_4, Distance=1, Plane=PlaneXY(0, 0, 0), Corners=1)
curve_curve_8 = CurveCurve(CurveA=offset_curve_16, CurveB=offset_curve_15)  # -> Points, ParamsA, ParamsB
deconstruct = Deconstruct(Point=curve_curve_8.Points)  # -> XComponent, YComponent, ZComponent
sort_list = SortList(Keys=deconstruct.XComponent, ValuesValuesA=reverse(curve_curve_8.Points))  # -> Keys, ValuesValuesA
list_item_30 = ListItem(List=sort_list.ValuesValuesA, Index=0, Wrap=True)

text_tag_11 = TextTag(Location=list_item_30, Text=panel_3)
circle_5 = Circle(Plane=list_item_30, Radius=expression_9)  # -> flatten(Circle)

inner_circles = Merge(Data1=circle_2, Data2=circle_cnr, Data3=circle_5)
heights_2 = Merge(Data1=height_7, Data2=height, Data3=height_8)
panel_4 = Panel(inner_circles)
panel_5 = Panel(heights_2)

# ----
# KITCHEN (LARGE) STORAGE
expression_10 = Expression(x=area_m2_4, Expression="sqrt(x/π)")
panel_6 = Panel("""KITCHEN
STORAGE""")
height_9 = ListItem(List=explode_tree.Branch7, Index=kitchen_large_storage, Wrap=True)  # -> flatten(Item)

addition_15 = Addition(A=expression_10, B=wall_thickness)

# ----
# KITCHEN (SMALL)
explode_9 = Explode(Curve=rectangle_2pt.Rectangle, Recursive=True)  # -> Segments, Vertices
# KITCHEN (SMALL) STORAGE
expression_11 = Expression(x=area_m2_2, Expression="sqrt(x/π)")
list_item_31 = ListItem(List=explode_9.Vertices, Index=0, Wrap=True)
list_item_32 = ListItem(List=explode_9.Vertices, Index=1, Wrap=True)
unit_y_4 = UnitY(Factor=1)
unit_z_12 = UnitZ(Factor=1)
radians_16 = Radians(Degrees=30)
list_item_33 = ListItem(List=explode_9.Segments, Index=0, Wrap=True)
offset_curve_17 = OffsetCurve(Curve=list_item_33, Distance=expression_11, Plane=PlaneXY(0, 0, 0), Corners=1)
height_10 = ListItem(List=explode_tree.Branch7, Index=kitchen_small, Wrap=True)  # -> flatten(Item)

line_5 = Line(StartPoint=list_item_31, EndPoint=list_item_32)
midpoint = Midpoint(Curve=line_5)

line_sdl_18 = LineSDL(Start=midpoint, Direction=unit_z_12, Length=1)
line_sdl_19 = LineSDL(Start=midpoint, Direction=unit_y_4, Length=-10)
rotate_axis_11 = RotateAxis(Geometry=line_sdl_19, Angle=radians_16, Axis=line_sdl_18)  # -> Geometry, Transform
curve_curve_9 = CurveCurve(CurveA=offset_curve_17, CurveB=rotate_axis_11.Geometry)  # -> Points, ParamsA, ParamsB
text_tag_12 = TextTag(Location=curve_curve_9.Points, Text="KITCHEN")
circle_6 = Circle(Plane=curve_curve_9.Points, Radius=expression_11)  # -> flatten(Circle)

expression_12 = Expression(x=area_m2_8, Expression="sqrt(x/π)")
addition_16 = Addition(A=expression_11, B=expression_12)
circle_7 = Circle(Plane=curve_curve_9.Points, Radius=addition_16)
offset_curve_18 = OffsetCurve(Curve=circle_7, Distance=wall_thickness, Plane=PlaneXY(0, 0, 0), Corners=1)
panel_7 = Panel("""KITCHEN
STORAGE""")
height_11 = ListItem(List=explode_tree.Branch7, Index=kitchen_small_storage, Wrap=True)  # -> flatten(Item)

# ----
# DINING (LARGE)
expression_13 = Expression(x=area_m2_5, Expression="sqrt(x/π)")
list_item_34 = ListItem(List=explode_6.Vertices, Index=3, Wrap=True)
line_6 = Line(StartPoint=point_0_0_0, EndPoint=list_item_34)
midpoint_2 = Midpoint(Curve=line_6)
height_12 = ListItem(List=explode_tree.Branch7, Index=dining_large, Wrap=True)  # -> flatten(Item)

addition_17 = Addition(A=wall_thickness, B=expression_13)

negative_4 = Negative(Value=addition_17)
vector_xyz_9 = VectorXYZ(XComponent=0, YComponent=negative_4, ZComponent=0)  # -> Vector, Length
move_10 = Move(Geometry=midpoint_2, Motion=vector_xyz_9.Vector)  # -> Geometry, Transform
text_tag_13 = TextTag(Location=move_10.Geometry, Text="DINING")
circle_cnr_6 = CircleCNR(Center=move_10.Geometry, Normal=Vector(0, 0, 1), Radius=expression_13)  # -> flatten(Circle)

addition_18 = Addition(A=expression_13, B=addition_15)
addition_19 = Addition(A=expression_2, B=addition_15)
circle_8 = Circle(Plane=move_6.Geometry, Radius=addition_19)
circle_9 = Circle(Plane=move_10.Geometry, Radius=addition_18)
curve_curve_10 = CurveCurve(CurveA=circle_9, CurveB=circle_8)  # -> Points, ParamsA, ParamsB
deconstruct_2 = Deconstruct(Point=curve_curve_10.Points)  # -> XComponent, YComponent, ZComponent
sort_list_2 = SortList(Keys=deconstruct_2.YComponent, ValuesValuesA=reverse(curve_curve_10.Points))  # -> Keys, ValuesValuesA
list_item_35 = ListItem(List=sort_list_2.ValuesValuesA, Index=1, Wrap=True)
circle_10 = Circle(Plane=list_item_35, Radius=expression_10)  # -> flatten(Circle)
text_tag_14 = TextTag(Location=list_item_35, Text=panel_6)

# ----
# IWAN (MEDIUM)
expression_14 = Expression(x=area_m2_7, Expression="sqrt(x/π)")
height_13 = ListItem(List=explode_tree.Branch7, Index=iwan_medium, Wrap=True)  # -> flatten(Item)

addition_20 = Addition(A=expression_2, B=expression_14, C=negative, D=negative_3)
vector_xyz_10 = VectorXYZ(XComponent=addition_20, YComponent=0, ZComponent=0)  # -> Vector, Length
move_11 = Move(Geometry=polygon_center_3.CenterV, Motion=vector_xyz_10.Vector)  # -> Geometry, Transform

text_tag_15 = TextTag(Location=move_11.Geometry, Text="IWAN")
circle_11 = Circle(Plane=move_11.Geometry, Radius=expression_14)  # -> flatten(Circle)

# ----
# DINING (SMALL)
expression_15 = Expression(x=area_m2_3, Expression="sqrt(x/π)")
list_item_36 = ListItem(List=explode_4.Vertices, Index=3, Wrap=True)
unit_z_13 = UnitZ(Factor=1)
radians_17 = Radians(Degrees=30)
line_sdl_20 = LineSDL(Start=list_item_36, Direction=unit_z_13, Length=1)
height_14 = ListItem(List=explode_tree.Branch7, Index=dining_small, Wrap=True)  # -> flatten(Item)

line_sdl_21 = LineSDL(Start=list_item_36, Direction=unit_x_4, Length=expression_15)
addition_21 = Addition(A=street_wall_thickness, B=expression_15)

# ----
# CLOTHES WASHING AREA
expression_16 = Expression(x=area_m2_6, Expression="sqrt(x/π)")
height_15 = ListItem(List=explode_tree.Branch7, Index=clothes_washing_area, Wrap=True)  # -> flatten(Item)

negative_5 = Negative(Value=expression_16)
offset_curve_19 = OffsetCurve(Curve=list_item_28, Distance=negative_5, Plane=rotate_axis_4.Geometry, Corners=1)
offset_curve_20 = OffsetCurve(Curve=list_item_4, Distance=expression_16, Plane=rotate_axis_4.Geometry, Corners=1)
curve_curve_11 = CurveCurve(CurveA=offset_curve_19, CurveB=offset_curve_20)  # -> Points, ParamsA, ParamsB

text_tag_16 = TextTag(Location=curve_curve_11.Points, Text="WASH")
circle_cnr_7 = CircleCNR(Center=curve_curve_11.Points, Normal=Vector(0, 0, 1), Radius=expression_16)  # -> flatten(Circle)

heights_3 = Merge(
    Data1=height_12,
    Data2=height_2,
    Data3=height_9,
    Data4=height_13,
    Data5=height_14,
    Data6=height_10,
    Data7=height_11,
    Data8=height_15)
panel_8 = Panel(heights_3)

# ----
# BUILDING UTILITY ROOM
expression_17 = Expression(x=area_m2_13, Expression="sqrt(x/π)")
panel_9 = Panel("""BUILDING 
UTILITY 
ROOM""")
height_16 = ListItem(List=explode_tree.Branch7, Index=building_utility_room, Wrap=True)  # -> flatten(Item)

addition_22 = Addition(A=expression_17, B=wall_thickness)
negative_6 = Negative(Value=addition_22)
addition_23 = Addition(A=expression_17, B=expression_15, C=Slider(1.2, range=0..10))
offset_curve_21 = OffsetCurve(Curve=join_curves, Distance=negative_6, Plane=rotate_axis_4.Geometry, Corners=1)
heights_4 = Merge(Data1=height_5, Data2=height_4, Data3=height_16, Data4=height_6, Data5=height_3)
panel_10 = Panel(heights_4)
heights_5 = Number([heights_2, heights_3, heights_4])

addition_24 = Addition(A=expression_15, B=expression_12)

rotate_axis_12 = RotateAxis(Geometry=line_sdl_21, Angle=radians_17, Axis=line_sdl_20)  # -> Geometry, Transform
explode_10 = Explode(Curve=rotate_axis_12.Geometry, Recursive=True)  # -> Segments, Vertices
list_item_37 = ListItem(List=explode_10.Vertices, Index=1, Wrap=True)

line_sdl_22 = LineSDL(Start=list_item_37, Direction=unit_y, Length=addition_21)
line_sdl_23 = LineSDL(Start=list_item_37, Direction=unit_z_8, Length=1)
rotate_axis_13 = RotateAxis(Geometry=line_sdl_22, Angle=radians_12, Axis=line_sdl_23)  # -> Geometry, Transform
offset_curve_22 = OffsetCurve(Curve=rotate_axis_13.Geometry, Distance=addition_23, Plane=rotate_axis_4.Geometry, Corners=1)
curve_curve_12 = CurveCurve(CurveA=offset_curve_22, CurveB=offset_curve_21)  # -> Points, ParamsA, ParamsB
explode_11 = Explode(Curve=rotate_axis_13.Geometry, Recursive=True)  # -> Segments, Vertices
list_item_38 = ListItem(List=explode_11.Vertices, Index=1, Wrap=True)

text_tag_17 = TextTag(Location=curve_curve_12.Points, Text=panel_9)
circle_12 = Circle(Plane=curve_curve_12.Points, Radius=expression_17)  # -> flatten(Circle)

text_tag_18 = TextTag(Location=list_item_38, Text="DINING")
circle_cnr_8 = CircleCNR(Center=list_item_38, Normal=Vector(0, 0, 1), Radius=expression_15)  # -> flatten(Circle)

circle_13 = Circle(Plane=circle_cnr_8, Radius=addition_24)
offset_curve_23 = OffsetCurve(Curve=circle_13, Distance=wall_thickness, Plane=PlaneXY(0, 0, 0), Corners=1)
curve_curve_13 = CurveCurve(CurveA=offset_curve_18, CurveB=offset_curve_23)  # -> Points, ParamsA, ParamsB
deconstruct_3 = Deconstruct(Point=curve_curve_13.Points)  # -> XComponent, YComponent, ZComponent
sort_list_3 = SortList(Keys=deconstruct_3.XComponent, ValuesValuesA=curve_curve_13.Points)  # -> Keys, ValuesValuesA
list_item_39 = ListItem(List=sort_list_3.ValuesValuesA, Index=0, Wrap=True)  # -> flatten(Item)
text_tag_19 = TextTag(Location=list_item_39, Text=panel_7)
circle_14 = Circle(Plane=list_item_39, Radius=expression_12)  # -> flatten(Circle)

inner_circles_2 = Merge(Data1=circle_cnr_4, Data2=circle_cnr_3, Data3=circle_12, Data4=circle_cnr_5, Data5=circle_cnr_2)
inner_circles_3 = Merge(
    Data1=circle_cnr_6,
    Data2=circle,
    Data3=circle_10,
    Data4=circle_11,
    Data5=circle_cnr_8,
    Data6=circle_6,
    Data7=circle_14,
    Data8=circle_cnr_7)
panel_11 = Panel(inner_circles_2)
panel_12 = Panel(inner_circles_3)
outer_walls_2 = OffsetCurve(Curve=[inner_circles, inner_circles_3, inner_circles_2], Distance=wall_thickness, Plane=PlaneXY(0, 0, 0), Corners=1)  # -> flatten(Curve)
