# Grasshopper definition form finding and optimising.gh (Grasshopper 1.0.7)
# plug-ins: Karamba, Anemone, Kangaroo Components, Weaverbird, Kangaroo2 Components

# streets and courtyards
curve = Curve()
# topography
surface = Surface([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])
# circles
curve_2 = Curve()
# first floor dwellings
curve_3 = Curve([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])
curve_4 = Curve([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])

trim_with_region = TrimWithRegion(Curve=curve_2, Region=curve)  # -> Inside, Outside
curve_curve = CurveCurve(CurveA=graft(curve_2), CurveB=curve)  # -> flatten(Points), ParamsA, ParamsB
curve_5 = Curve(flatten(trim_with_region.Outside))
sort_along_curve = SortAlongCurve(Points=curve_curve.Points, Curve=curve)  # -> flatten(Points), Indices
sort_along_curve_2 = SortAlongCurve(Points=sort_along_curve.Points, Curve=curve)  # -> Points, Indices
shift_list = ShiftList(List=sort_along_curve_2.Points, Shift=1, Wrap=True)
ghpython_script = GhPythonScript(x=sort_along_curve_2.Points, y=shift_list)  # -> out, a; inputs x: list, y: list
# ---------- ghpython_script: Python ----------
__author__ = "Gautam"
__version__ = "2018.10.23"

import rhinoscriptsyntax as rs
i=0
a=[]
len=len(x)
while i <(len):
    z=rs.AddLine(x[i],y[i])
    a.append(z)
    i=i+2
# ---------- end ghpython_script ----------
curve_6 = Curve(ghpython_script.a)
join_curves = JoinCurves(Curves=flatten([curve_6, curve_5]), Preserve=False)

number_slider = Slider(0.3, range=0.1..1)
region_union = RegionUnion(Curves=join_curves)  # -> flatten(Result)
# maing a mesh from circles after subtracting intersections with street and courtyards
multiple_curves = MultipleCurves(Curves=[curve, curve_2])  # -> Points, IndexA, IndexB, ParamA, ParamB
circle_cnr = CircleCNR(Center=multiple_curves.Points, Normal=Vector(0, 0, 1), Radius=0.05)
divide_length = DivideLength(Curve=region_union, Length=number_slider)  # -> flatten(Points), Tangents, Parameters
point_in_curves = PointInCurves(Point=divide_length.Points, Curves=circle_cnr)  # -> Relationship, Index, Point
cull_pattern = CullPattern(List=divide_length.Points, CullPattern=invert(point_in_curves.Relationship))
point = Point(flatten([cull_pattern, multiple_curves.Points]))
mesh_breps = MeshBreps(
    Brep=graft(region_union),
    InclusionPoints=simplify(point),
    MeshResolution=number_slider,
    EdgeRefinementFactor=0.67,
    PointReduction=False,
    SmoothingStepSize=0,
    SmoothingIterations=5)  # -> flatten(Mesh), Info
combine_clean = CombineClean(Meshes=mesh_breps.Mesh)
weaverbird_s_naked_boundary = WeaverbirdsNakedBoundary(MeshClosedPolylines=combine_clean)  # -> graft(NakedCurves)
weaverbird_s_vertices_component = WeaverbirdsVerticesComponent(MeshClosedPolylinesGroup=combine_clean, Weld=True)  # -> flatten(Points)
point_in_curve = PointInCurve(Point=weaverbird_s_vertices_component, Curve=weaverbird_s_naked_boundary)  # -> Relationship, Point
deconstruct_mesh = DeconstructMesh(Mesh=combine_clean)  # -> flatten(Vertices), Faces, Colours, Normals
expression = Expression(x=point_in_curve.Relationship, Expression="if(x≠1,0,1)")
cull_pattern_2 = CullPattern(List=point_in_curve.Point, CullPattern=expression)

fast_loop_start = FastLoopStart(Iterations=Slider(15, range=0..16), Data=curve_2)  # -> port, Counter, Data
shift_list_2 = ShiftList(List=fast_loop_start.Data, Shift=1, Wrap=True)
list_item = ListItem(List=shift_list_2, Index=0, Wrap=True)
fast_loop_end = FastLoopEnd(port=fast_loop_start.port, Exit=False, Data=flatten(shift_list_2), RecordData=True, TimeOutVal=0)  # -> simplify(Data)

area = Area(Geometry=curve_2)  # -> Area, Centroid

# ----
# assign different spring stiffness to every circle and intersections
weaverbird_s_mesh_edges = WeaverbirdsMeshEdges(MeshOrPolylines=combine_clean)
divide_curve = DivideCurve(Curve=weaverbird_s_mesh_edges, Count=2, Kinks=False)  # -> Points, Tangents, Parameters
ghpython_script_2 = GhPythonScript(x=area.Area)  # -> out, a; inputs x: list
# ---------- ghpython_script_2: Python ----------
__author__ = "Gautam"
__version__ = "2018.10.18"

import rhinoscriptsyntax as rs
import math as math
i=0
a=x[i]

while i<(len(x)-1):
    if a < x[i]:
        a=x[i]
    i=i+1
print a
# ---------- end ghpython_script_2 ----------
list_item_2 = ListItem(List=divide_curve.Points, Index=1, Wrap=True)  # -> flatten(Item)
cluster = Cluster_4(
    A=ghpython_script_2.a,
    list=weaverbird_s_mesh_edges,
    point=list_item_2,
    point_2=list_item_2,
    tree=fast_loop_end,
    list_2=weaverbird_s_mesh_edges)  # -> spring, list_3
cluster_2 = Cluster_3(
    A=ghpython_script_2.a,
    list=weaverbird_s_mesh_edges,
    point=list_item_2,
    point_2=list_item_2,
    tree=fast_loop_end,
    list_2=weaverbird_s_mesh_edges)  # -> spring, list_3
cluster_3 = Cluster(
    A=ghpython_script_2.a,
    list=weaverbird_s_mesh_edges,
    point=list_item_2,
    point_2=list_item_2,
    tree=fast_loop_end,
    list_2=weaverbird_s_mesh_edges)  # -> spring, list_3
cluster_4 = Cluster_2(
    A=ghpython_script_2.a,
    list=weaverbird_s_mesh_edges,
    point=list_item_2,
    point_2=list_item_2,
    tree=fast_loop_end,
    list_2=weaverbird_s_mesh_edges)  # -> spring, list_3
cluster_5 = Cluster_5(
    A=ghpython_script_2.a,
    list=weaverbird_s_mesh_edges,
    point=list_item_2,
    point_2=list_item_2,
    tree=fast_loop_end,
    list_2=weaverbird_s_mesh_edges)  # -> spring, list_3
cluster_6 = Cluster_9(
    A=ghpython_script_2.a,
    list=weaverbird_s_mesh_edges,
    point=list_item_2,
    point_2=list_item_2,
    tree=fast_loop_end,
    list_2=weaverbird_s_mesh_edges)  # -> spring, list_3
cluster_7 = Cluster_6(
    A=ghpython_script_2.a,
    list=weaverbird_s_mesh_edges,
    point=list_item_2,
    point_2=list_item_2,
    tree=fast_loop_end,
    list_2=weaverbird_s_mesh_edges)  # -> spring, list_3
cluster_8 = Cluster_7(
    A=ghpython_script_2.a,
    list=weaverbird_s_mesh_edges,
    point=list_item_2,
    point_2=list_item_2,
    tree=fast_loop_end,
    list_2=weaverbird_s_mesh_edges)  # -> spring, list_3
cluster_9 = Cluster_8(
    A=ghpython_script_2.a,
    list=weaverbird_s_mesh_edges,
    point=list_item_2,
    point_2=list_item_2,
    tree=fast_loop_end,
    list_2=weaverbird_s_mesh_edges)  # -> spring, list_3
cluster_10 = Cluster_14(
    A=ghpython_script_2.a,
    list=weaverbird_s_mesh_edges,
    point=list_item_2,
    point_2=list_item_2,
    tree=fast_loop_end,
    list_2=weaverbird_s_mesh_edges)  # -> spring, list_3
cluster_11 = Cluster_13(
    A=ghpython_script_2.a,
    list=weaverbird_s_mesh_edges,
    point=list_item_2,
    point_2=list_item_2,
    tree=fast_loop_end,
    list_2=weaverbird_s_mesh_edges)  # -> spring, list_3
cluster_12 = Cluster_15(
    A=ghpython_script_2.a,
    list=weaverbird_s_mesh_edges,
    point=list_item_2,
    point_2=list_item_2,
    tree=fast_loop_end,
    list_2=weaverbird_s_mesh_edges)  # -> spring, list_3
cluster_13 = Cluster_16(
    A=ghpython_script_2.a,
    list=weaverbird_s_mesh_edges,
    point=list_item_2,
    point_2=list_item_2,
    tree=fast_loop_end,
    list_2=weaverbird_s_mesh_edges)  # -> spring, list_3
cluster_14 = Cluster_10(
    A=ghpython_script_2.a,
    list=weaverbird_s_mesh_edges,
    point=list_item_2,
    point_2=list_item_2,
    tree=fast_loop_end,
    list_2=weaverbird_s_mesh_edges)  # -> spring, list_3
cluster_15 = Cluster_12(
    A=ghpython_script_2.a,
    list=weaverbird_s_mesh_edges,
    point=list_item_2,
    point_2=list_item_2,
    tree=fast_loop_end,
    list_2=weaverbird_s_mesh_edges)  # -> spring, list_3
cluster_16 = Cluster_11(
    A=ghpython_script_2.a,
    list=weaverbird_s_mesh_edges,
    point=list_item_2,
    point_2=list_item_2,
    tree=fast_loop_end,
    list_2=weaverbird_s_mesh_edges)  # -> spring, list_3

# ----
# load from first floor dwellings
line_23_3_kn_m = Line(flatten(curve_3))
line_16_5_kn_m = Line(flatten(curve_4))
length = Length(Curve=line_23_3_kn_m)
length_2 = Length(Curve=line_16_5_kn_m)
division = Division(A=length, B=Slider(0.2, range=0..1))
division_2 = Division(A=length_2, B=Slider(0.2, range=0..1))
round = Round(Number=division)  # -> Nearest, Floor, Ceiling
round_2 = Round(Number=division_2)  # -> Nearest, Floor, Ceiling
multiplication = Multiplication(A="23.3", B=length)
divide_curve_2 = DivideCurve(Curve=line_16_5_kn_m, Count=round_2.Floor, Kinks=False)  # -> simplify(Points), Tangents, Parameters
addition = Addition(A=round.Floor, B=1)
multiplication_2 = Multiplication(A="16.5", B=length_2)
addition_2 = Addition(A=round_2.Floor, B=1)
divide_curve_3 = DivideCurve(Curve=line_23_3_kn_m, Count=round.Floor, Kinks=False)  # -> simplify(Points), Tangents, Parameters
division_3 = Division(A=multiplication, B=addition)  # -> graft(Result)
division_4 = Division(A=multiplication_2, B=addition_2)  # -> graft(Result)
unit_z = UnitZ(Factor=division_3)
point_2 = Point(divide_curve_3.Points)
unit_z_2 = UnitZ(Factor=division_4)
point_3 = Point(divide_curve_2.Points)
division_5 = Division(A=unit_z, B=5)
division_6 = Division(A=unit_z_2, B=5)
vector_display = VectorDisplay(Anchor=point_2, Vector=division_5)
vector_display_2 = VectorDisplay(Anchor=point_3, Vector=division_6)
number_slider_2 = Slider(0.09, range=0..1)
closest_points = ClosestPoints(Point=point_2, Cloud=deconstruct_mesh.Vertices, Count=5)  # -> ClosestPoint, CPIndex, Distance
closest_points_2 = ClosestPoints(Point=point_3, Cloud=deconstruct_mesh.Vertices, Count=5)  # -> ClosestPoint, CPIndex, Distance
multiplication_3 = Multiplication(A=division_6, B=number_slider_2)
multiplication_4 = Multiplication(A=division_5, B=number_slider_2)
load = Load(Point=closest_points_2.ClosestPoint, ForceVector=multiplication_3)
load_2 = Load(Point=closest_points.ClosestPoint, ForceVector=multiplication_4)

# ----
# form finding optimised shell
number_slider_3 = Slider(5, range=0..50)
line = Line([cluster_3.list_3, cluster_4.list_3, cluster_2.list_3, cluster.list_3, cluster_5.list_3, cluster_7.list_3, cluster_8.list_3, cluster_9.list_3, cluster_6.list_3, cluster_14.list_3, cluster_16.list_3, cluster_15.list_3, cluster_11.list_3, cluster_10.list_3, cluster_12.list_3, cluster_13.list_3])
length_line = LengthLine(Line=line, Strength=number_slider_3)

region_difference = RegionDifference(CurvesA=curve, CurvesB=curve_2)
point_4 = Point(flatten(cull_pattern_2))
point_in_curve_2 = PointInCurve(Point=weaverbird_s_vertices_component, Curve=region_difference)  # -> Relationship, Point
cull_pattern_3 = CullPattern(List=point_in_curve_2.Point, CullPattern=point_in_curve_2.Relationship)
point_in_curve_3 = PointInCurve(Point=point_4, Curve=curve)  # -> Relationship, Point
cull_pattern_4 = CullPattern(List=point_in_curve_3.Point, CullPattern=invert(point_in_curve_3.Relationship))
cull_pattern_5 = CullPattern(List=point_in_curve_3.Point, CullPattern=point_in_curve_3.Relationship)
point_5 = Point([cull_pattern_3, cull_pattern_4])
anchor = Anchor(Point=point_5, Strength=10000)

region_difference_2 = RegionDifference(CurvesA=curve, CurvesB=curve_2)
point_6 = Point(flatten(cull_pattern_2))
point_in_curve_4 = PointInCurve(Point=weaverbird_s_vertices_component, Curve=region_difference_2)  # -> Relationship, Point
point_in_curve_5 = PointInCurve(Point=point_6, Curve=curve)  # -> Relationship, Point
cull_pattern_6 = CullPattern(List=point_in_curve_4.Point, CullPattern=point_in_curve_4.Relationship)
cull_pattern_7 = CullPattern(List=point_in_curve_5.Point, CullPattern=invert(point_in_curve_5.Relationship))
cull_pattern_8 = CullPattern(List=point_in_curve_5.Point, CullPattern=point_in_curve_5.Relationship)
point_7 = Point([cull_pattern_6, cull_pattern_7])
anchor_2 = Anchor(Point=point_7, Strength=10000)

number_slider_4 = Slider(0.09, range=0..1)
mesh = Mesh(combine_clean)

weaverbird_s_face_polylines = WeaverbirdsFacePolylines(Mesh=combine_clean)  # -> flatten(Polygons)
explode = Explode(Curve=weaverbird_s_face_polylines, Recursive=True)  # -> Segments, Vertices
mesh_breps_2 = MeshBreps(
    Brep=surface,
    MeshResolution=number_slider,
    EdgeRefinementFactor=0.67,
    PointReduction=False,
    SmoothingStepSize=0,
    SmoothingIterations=5)  # -> Mesh, Info
end_points = EndPoints(Curve=simplify(explode.Segments))  # -> Start, End
combine_clean_2 = CombineClean(Meshes=mesh_breps_2.Mesh)
weaverbird_s_face_polylines_2 = WeaverbirdsFacePolylines(Mesh=combine_clean_2)
area_2 = Area(Geometry=weaverbird_s_face_polylines)  # -> Area, flatten(Centroid)
area_3 = Area(Geometry=weaverbird_s_face_polylines_2)  # -> Area, Centroid
project = Project(Geometry=area_3.Centroid, Plane=PlaneXY(0, 0, 0))  # -> flatten(Geometry), Transform
closest_point = ClosestPoint(Point=area_2.Centroid, Cloud=project.Geometry)  # -> ClosestPoint, flatten(CPIndex), Distance
list_item_3 = ListItem(List=flatten(area_3.Centroid), Index=closest_point.CPIndex, Wrap=True)

weaverbird_s_face_polylines_3 = WeaverbirdsFacePolylines(Mesh=combine_clean)  # -> flatten(Polygons)
surface_2 = Surface([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])
explode_2 = Explode(Curve=weaverbird_s_face_polylines_3, Recursive=True)  # -> Segments, Vertices
mesh_breps_3 = MeshBreps(
    Brep=surface_2,
    MeshResolution=number_slider,
    EdgeRefinementFactor=0.67,
    PointReduction=False,
    SmoothingStepSize=0,
    SmoothingIterations=5)  # -> Mesh, Info
end_points_2 = EndPoints(Curve=simplify(explode_2.Segments))  # -> Start, End
combine_clean_3 = CombineClean(Meshes=mesh_breps_3.Mesh)
area_4 = Area(Geometry=weaverbird_s_face_polylines_3)  # -> Area, flatten(Centroid)
weaverbird_s_face_polylines_4 = WeaverbirdsFacePolylines(Mesh=combine_clean_3)
area_5 = Area(Geometry=weaverbird_s_face_polylines_4)  # -> Area, Centroid
project_2 = Project(Geometry=area_5.Centroid, Plane=PlaneXY(0, 0, 0))  # -> flatten(Geometry), Transform
closest_point_2 = ClosestPoint(Point=area_4.Centroid, Cloud=project_2.Geometry)  # -> ClosestPoint, flatten(CPIndex), Distance
list_item_4 = ListItem(List=flatten(area_5.Centroid), Index=closest_point_2.CPIndex, Wrap=True)

# ----
# form finding unoptimised shell
point_in_curve_6 = PointInCurve(Point=deconstruct_mesh.Vertices, Curve=curve)  # -> Relationship, Point
cull_pattern_9 = CullPattern(List=point_in_curve_6.Point, CullPattern=invert(point_in_curve_6.Relationship))
cull_pattern_10 = CullPattern(List=point_in_curve_6.Point, CullPattern=point_in_curve_6.Relationship)
number_slider_5 = Slider(0.25, range=0..1)
unit_z_3 = UnitZ(Factor=number_slider_5)
unit_z_4 = UnitZ(Factor=number_slider_5)
anchorxyz = AnchorXYZ(Point=cull_pattern_8, X=True, Y=True, Z=False, Strength=1000)
load_3 = Load(Point=cull_pattern_9, ForceVector=unit_z_3)
load_4 = Load(Point=cull_pattern_10, ForceVector=unit_z_4)
show = Show(G=combine_clean)
data = Data([cluster_3.spring, cluster_4.spring, cluster_2.spring, cluster.spring, cluster_5.spring, cluster_7.spring, cluster_8.spring, cluster_9.spring, cluster_6.spring, cluster_14.spring, cluster_16.spring, cluster_15.spring, cluster_11.spring, cluster_10.spring, cluster_12.spring, cluster_13.spring])
merge = Merge(Data1=show, Data2=[load_3, load_4], Data3=[data, length_line], Data4=anchor_2, Data5=anchorxyz)
solver = Solver(GoalObjects=merge, Reset=Button(), Threshold=1e-06, Tolerance=0.01, On=Toggle(False))  # -> I, V, O
panel = Panel(solver.O)
clean_tree = CleanTree(RemoveNulls=True, RemoveInvalid=True, RemoveEmpty=False, Tree=solver.O)  # -> flatten(Tree)
list_item_5 = ListItem(List=clean_tree, Index=0, Wrap=True)  # -> flatten(Item)

# ----
# load from soil on unoptimises shell
weaverbird_s_face_polylines_5 = WeaverbirdsFacePolylines(Mesh=list_item_5)  # -> flatten(Polygons)
area_6 = Area(Geometry=weaverbird_s_face_polylines_5)  # -> Area, Centroid
project_3 = Project(Geometry=weaverbird_s_face_polylines_5, Plane=PlaneXY(0, 0, 0))  # -> Geometry, Transform
explode_3 = Explode(Curve=weaverbird_s_face_polylines_5, Recursive=True)  # -> Segments, Vertices
area_7 = Area(Geometry=project_3.Geometry)  # -> Area, Centroid
distance = Distance(PointA=area_6.Centroid, PointB=list_item_3)
multiplication_5 = Multiplication(A=area_7.Area, B=20)
multiplication_6 = Multiplication(A=distance, B=multiplication_5)
unit_z_5 = UnitZ(Factor=distance)
division_7 = Division(A=multiplication_6, B=3)
multiplication_7 = Multiplication(A=division_7, B=number_slider_4)
multiplication_8 = Multiplication(A=unit_z_5, B=-1)
unit_z_6 = UnitZ(Factor=multiplication_7)  # -> graft(UnitVector)
vector_display_3 = VectorDisplay(Anchor=flatten(list_item_3), Vector=flatten(multiplication_8))

deconstruct_mesh_2 = DeconstructMesh(Mesh=list_item_5)  # -> Vertices, Faces, Colours, Normals

deconstruct = Deconstruct(Point=deconstruct_mesh_2.Vertices)  # -> XComponent, YComponent, ZComponent
ghpython_script_3 = GhPythonScript(x=deconstruct.ZComponent)  # -> out, a; inputs x: list; same code as ghpython_script_2

panel_2 = Panel(ghpython_script_3.a)

mesh_2 = Mesh(list_item_5)
weaverbird_s_face_polylines_6 = WeaverbirdsFacePolylines(Mesh=mesh_2)
deconstruct_mesh_3 = DeconstructMesh(Mesh=mesh_2)  # -> flatten(Vertices), Faces, Colours, Normals
explode_4 = Explode(Curve=weaverbird_s_face_polylines_6, Recursive=True)  # -> Segments, Vertices
unit_z_7 = UnitZ(Factor=division_7)  # -> graft(UnitVector)
deconstruct_2 = Deconstruct(Point=deconstruct_mesh_3.Vertices)  # -> XComponent, YComponent, ZComponent
end_points_3 = EndPoints(Curve=simplify(explode_4.Segments))  # -> Start, End
expression_2 = Expression(x=deconstruct_2.ZComponent, Expression="If(x< 0.1, 0, 1)")
cull_pattern_11 = CullPattern(List=deconstruct_mesh_3.Vertices, CullPattern=invert(expression_2))
cull_pattern_12 = CullPattern(List=deconstruct_mesh_3.Vertices, CullPattern=expression_2)
remove_duplicate_points_karamba = RemoveDuplicatePointsKaramba(Point=cull_pattern_11, LimitDistance=0.005)  # -> OutPoint, Info, Indexes

number_slider_6 = Slider(10, range=0..1000)
area_8 = Area(Geometry=mesh)  # -> Area, Centroid
list_length = ListLength(List=deconstruct_mesh_3.Vertices)
# finite element analysis for unoptimized domes
number_slider_7 = Slider(50, range=0..1000)
division_8 = Division(A=area_8.Area, B=list_length)
division_9 = Division(A=number_slider_6, B=2.5)
list_item_6 = ListItem(List=deconstruct_mesh_3.Vertices, Index=closest_points.CPIndex, Wrap=True)
list_item_7 = ListItem(List=deconstruct_mesh_3.Vertices, Index=closest_points_2.CPIndex, Wrap=True)
multiplication_9 = Multiplication(A=division_8, B=1.1)
multiplication_10 = Multiplication(A=multiplication_9, B=1.5)
material_properties_karamba = MaterialPropertiesKaramba(
    FamilyOfMaterial="brick",
    Name="brick",
    ElementsIdentifiers="catenary",
    YoungsModulus_kN_cm2=number_slider_6,
    InPlaneShearModulus_kN_cm2=division_9,
    TransverseShearModulus_kN_cm2=division_9,
    SpecificWeight_kN_m3=Slider(20, range=0..100),
    CoefficientOfThermalExpansion_1_C=1e-05,
    YieldStrength_kN_cm2=Slider(0.2, range=0..1),
    mode="Isotrop")
unit_z_8 = UnitZ(Factor=multiplication_10)
multiplication_11 = Multiplication(A=unit_z_7, B=1.2)
multiplication_12 = Multiplication(A=division_5, B=1.2)
multiplication_13 = Multiplication(A=division_6, B=1.2)
multiplication_14 = Multiplication(A=multiplication_13, B=-1)
multiplication_15 = Multiplication(A=multiplication_14, B=-3)
multiplication_16 = Multiplication(A=multiplication_12, B=-1)
multiplication_17 = Multiplication(A=multiplication_16, B=-3)
multiplication_18 = Multiplication(A=unit_z_8, B=-1)
cross_sections_karamba = CrossSectionsKaramba(
    FamilyNameOfCrossSection="DefaultCroSec",
    ElementsIdentifiers="catenary",
    Material=material_properties_karamba,
    Height_cm=Slider(33, range=0..100),
    mode="Shell - Const")
multiplication_19 = Multiplication(A=multiplication_11, B=-1)
loads_karamba = LoadsKaramba(ForceVector=multiplication_14, Local=False, PosInd=list_item_7, LCase=0, mode="Point")  # -> flatten(Load)
loads_karamba_2 = LoadsKaramba(ForceVector=multiplication_18, Local=False, PosInd=deconstruct_mesh_3.Vertices, LCase=0, mode="Point")  # -> flatten(Load)
loads_karamba_3 = LoadsKaramba(ForceVector=multiplication_19, Local=False, PosInd=end_points_3.Start, LCase=0, mode="Point")  # -> flatten(Load)
loads_karamba_4 = LoadsKaramba(ForceVector=multiplication_16, Local=False, PosInd=list_item_6, LCase=0, mode="Point")  # -> flatten(Load)
multiplication_20 = Multiplication(A=multiplication_14, B=3)
move = Move(Geometry=list_item_6, Motion=multiplication_17)  # -> Geometry, Transform
move_2 = Move(Geometry=list_item_7, Motion=multiplication_15)  # -> Geometry, Transform
multiplication_21 = Multiplication(A=multiplication_16, B=3)
mesh_to_shell_karamba = MeshToShellKaramba(Mesh=mesh_2, Identifier="catenary", CrossSection=cross_sections_karamba, LimitDistance_m=0.005)  # -> Element, Points, Info
support_karamba = SupportKaramba(PosInd=remove_duplicate_points_karamba.OutPoint, menu=[buttons(on, on, on, off, off, off)])
vector_display_4 = VectorDisplay(Anchor=move_2.Geometry, Vector=multiplication_20)
vector_display_5 = VectorDisplay(Anchor=move.Geometry, Vector=multiplication_21)
element_karamba = ElementKaramba(flatten(mesh_to_shell_karamba.Element))
support_karamba_2 = SupportKaramba(flatten(support_karamba))
load_karamba = LoadKaramba([loads_karamba_3, loads_karamba_4, loads_karamba, loads_karamba_2])
assemble_model_karamba = AssembleModelKaramba(Elem=element_karamba, Support=support_karamba_2, Load=load_karamba, LimitDistance_m=0.005)  # -> Model, Info, Mass_kg, CenterOfGravity
analyzethi_karamba = AnalyzeThIKaramba(Model=assemble_model_karamba.Model)  # -> CalculatedModel, MaximumDisplacement_m, ResultingForceOfGravity_kN, ElasticEnergy_kNm
panel_3 = Panel(analyzethi_karamba.MaximumDisplacement_m)
model_view_karamba = ModelViewKaramba(Model=analyzethi_karamba.CalculatedModel, LoadCaseFactorsForLinearSuperposition=1, IndexOfVisibleLoadcase=-1)  # -> Model, DeformedMesh, DeformedAxes, DeformedModel
shell_view_karamba = ShellViewKaramba(Model=model_view_karamba.Model, IndexOfLayer=0)  # -> Model, MeshesOfRenderedShells, LegendColors, LegendTags
legend = Legend(Colour=shell_view_karamba.LegendColors, Tags=shell_view_karamba.LegendTags, LegendType=1)

data_2 = Data([cluster_3.spring, cluster_4.spring, cluster_2.spring, cluster.spring, cluster_5.spring, cluster_7.spring, cluster_8.spring, cluster_9.spring, cluster_6.spring, cluster_14.spring, cluster_16.spring, cluster_15.spring, cluster_11.spring, cluster_10.spring, cluster_12.spring, cluster_13.spring])
unit_z_9 = UnitZ(Factor=1)
anchorxyz_2 = AnchorXYZ(Point=cull_pattern_5, X=True, Y=True, Z=False, Strength=1000)
load_5 = Load(Point=deconstruct_mesh.Vertices, ForceVector=unit_z_9)
load_6 = Load(Point=end_points.Start, ForceVector=unit_z_6)
show_2 = Show(G=combine_clean)
data_3 = Data([load_2, load])
merge_2 = Merge(Data1=show_2, Data2=[data_3, load_6], Data3=[data_2, length_line], Data4=anchor, Data5=anchorxyz_2)
solver_2 = Solver(GoalObjects=merge_2, Reset=Button(), Threshold=1e-08, Tolerance=0.01, On=Toggle(False))  # -> I, V, O
panel_4 = Panel(solver_2.O)
clean_tree_2 = CleanTree(RemoveNulls=True, RemoveInvalid=True, RemoveEmpty=False, Tree=solver_2.O)  # -> flatten(Tree)
list_item_8 = ListItem(List=clean_tree_2, Index=0, Wrap=True)  # -> flatten(Item)

# ----
# load from soil on optimised shell
weaverbird_s_face_polylines_7 = WeaverbirdsFacePolylines(Mesh=list_item_8)  # -> flatten(Polygons)
explode_5 = Explode(Curve=weaverbird_s_face_polylines_7, Recursive=True)  # -> Segments, Vertices
project_4 = Project(Geometry=weaverbird_s_face_polylines_7, Plane=PlaneXY(0, 0, 0))  # -> Geometry, Transform
area_9 = Area(Geometry=weaverbird_s_face_polylines_7)  # -> Area, Centroid
area_10 = Area(Geometry=project_4.Geometry)  # -> Area, Centroid
distance_2 = Distance(PointA=area_9.Centroid, PointB=list_item_4)
line_2 = Line(StartPoint=area_9.Centroid, EndPoint=list_item_4)
multiplication_22 = Multiplication(A=area_10.Area, B=20)
multiplication_23 = Multiplication(A=distance_2, B=multiplication_22)
unit_z_10 = UnitZ(Factor=distance_2)
division_10 = Division(A=multiplication_23, B=3)
multiplication_24 = Multiplication(A=division_10, B=number_slider_4)
multiplication_25 = Multiplication(A=unit_z_10, B=-1)
unit_z_11 = UnitZ(Factor=multiplication_24)  # -> graft(UnitVector)
vector_display_6 = VectorDisplay(Anchor=flatten(list_item_4), Vector=flatten(multiplication_25))

deconstruct_mesh_4 = DeconstructMesh(Mesh=list_item_8)  # -> flatten(Vertices), Faces, Colours, Normals
deconstruct_3 = Deconstruct(Point=deconstruct_mesh_4.Vertices)  # -> XComponent, YComponent, ZComponent
ghpython_script_4 = GhPythonScript(x=deconstruct_3.ZComponent)  # -> out, a; inputs x: list; same code as ghpython_script_2

panel_5 = Panel(ghpython_script_4.a)

# ----
# to get back to original height of domes
subtraction = Subtraction(A=ghpython_script_3.a, B=ghpython_script_4.a)
expression_3 = Expression(x=subtraction, Expression="if (x<0,x*(-1),x)")
galapagos = Galapagos(fitness=expression_3, gene=number_slider_4)
panel_6 = Panel(expression_3)

mesh_3 = Mesh(flatten(list_item_8))

deconstruct_mesh_5 = DeconstructMesh(Mesh=mesh_3)  # -> flatten(Vertices), Faces, Colours, Normals
deconstruct_4 = Deconstruct(Point=deconstruct_mesh_5.Vertices)  # -> XComponent, YComponent, ZComponent
weaverbird_s_face_polylines_8 = WeaverbirdsFacePolylines(Mesh=mesh_3)
expression_4 = Expression(x=deconstruct_4.ZComponent, Expression="If(x< 0.1, 0, 1)")
explode_6 = Explode(Curve=weaverbird_s_face_polylines_8, Recursive=True)  # -> Segments, Vertices
unit_z_12 = UnitZ(Factor=division_10)  # -> graft(UnitVector)
end_points_4 = EndPoints(Curve=simplify(explode_6.Segments))  # -> Start, End
cull_pattern_13 = CullPattern(List=deconstruct_mesh_5.Vertices, CullPattern=invert(expression_4))
cull_pattern_14 = CullPattern(List=deconstruct_mesh_5.Vertices, CullPattern=expression_4)
removeduplicatepts = RemoveDuplicatePts(Points=cull_pattern_13, Tolerance=0.01)

number_slider_8 = Slider(10, range=0..1000)
division_11 = Division(A=number_slider_8, B=2.5)
# finite element analysis for optimized domes
panel_7 = Panel("catenary")
area_11 = Area(Geometry=mesh)  # -> Area, Centroid
list_length_2 = ListLength(List=deconstruct_mesh_5.Vertices)
material_properties_karamba_2 = MaterialPropertiesKaramba(
    FamilyOfMaterial="brick",
    Name="brick",
    ElementsIdentifiers=panel_7,
    YoungsModulus_kN_cm2=number_slider_8,
    InPlaneShearModulus_kN_cm2=division_11,
    TransverseShearModulus_kN_cm2=division_11,
    SpecificWeight_kN_m3=Slider(20, range=0..100),
    CoefficientOfThermalExpansion_1_C=1e-05,
    YieldStrength_kN_cm2=Slider(0.2, range=0..1),
    mode="Isotrop")
division_12 = Division(A=area_11.Area, B=list_length_2)
list_item_9 = ListItem(List=deconstruct_mesh_5.Vertices, Index=closest_points.CPIndex, Wrap=True)
list_item_10 = ListItem(List=deconstruct_mesh_5.Vertices, Index=closest_points_2.CPIndex, Wrap=True)
multiplication_26 = Multiplication(A=division_12, B=1.1)
cross_sections_karamba_2 = CrossSectionsKaramba(
    FamilyNameOfCrossSection="DefaultCroSec",
    ElementsIdentifiers=panel_7,
    Material=material_properties_karamba_2,
    Height_cm=Slider(33, range=0..100),
    mode="Shell - Const")
multiplication_27 = Multiplication(A=unit_z_12, B=1.2)
multiplication_28 = Multiplication(A=multiplication_26, B=1.5)
multiplication_29 = Multiplication(A=division_5, B=1.2)
unit_z_13 = UnitZ(Factor=multiplication_28)
multiplication_30 = Multiplication(A=division_6, B=1.2)
multiplication_31 = Multiplication(A=multiplication_29, B=-1)
multiplication_32 = Multiplication(A=multiplication_30, B=-1)
multiplication_33 = Multiplication(A=unit_z_13, B=-1)
multiplication_34 = Multiplication(A=multiplication_27, B=-1)
multiplication_35 = Multiplication(A=multiplication_31, B=-3)
multiplication_36 = Multiplication(A=multiplication_32, B=-3)
loads_karamba_5 = LoadsKaramba(ForceVector=multiplication_32, Local=False, PosInd=list_item_10, LCase=0, mode="Point")  # -> flatten(Load)
mesh_to_shell_karamba_2 = MeshToShellKaramba(Mesh=mesh_3, Identifier=panel_7, CrossSection=cross_sections_karamba_2, LimitDistance_m=0.005)  # -> Element, Points, Info
support_karamba_3 = SupportKaramba(PosInd=removeduplicatepts, menu=[buttons(on, on, on, off, off, off)])
loads_karamba_6 = LoadsKaramba(ForceVector=multiplication_33, Local=False, PosInd=deconstruct_mesh_5.Vertices, LCase=0, mode="Point")  # -> flatten(Load)
loads_karamba_7 = LoadsKaramba(ForceVector=multiplication_34, Local=False, PosInd=end_points_4.Start, LCase=0, mode="Point")  # -> flatten(Load)
loads_karamba_8 = LoadsKaramba(ForceVector=multiplication_31, Local=False, PosInd=list_item_9, LCase=0, mode="Point")  # -> flatten(Load)
vector_display_7 = VectorDisplay(Anchor=list_item_10, Vector=multiplication_36)
vector_display_8 = VectorDisplay(Anchor=list_item_9, Vector=multiplication_35)
element_karamba_2 = ElementKaramba(flatten(mesh_to_shell_karamba_2.Element))
support_karamba_4 = SupportKaramba(flatten(support_karamba_3))
load_karamba_2 = LoadKaramba([loads_karamba_7, loads_karamba_8, loads_karamba_5, loads_karamba_6])
assemble_model_karamba_2 = AssembleModelKaramba(Elem=element_karamba_2, Support=support_karamba_4, Load=load_karamba_2, LimitDistance_m=0.005)  # -> Model, Info, Mass_kg, CenterOfGravity
analyzethi_karamba_2 = AnalyzeThIKaramba(Model=assemble_model_karamba_2.Model)  # -> CalculatedModel, MaximumDisplacement_m, ResultingForceOfGravity_kN, ElasticEnergy_kNm
panel_8 = Panel(analyzethi_karamba_2.MaximumDisplacement_m)
model_view_karamba_2 = ModelViewKaramba(Model=analyzethi_karamba_2.CalculatedModel, LoadCaseFactorsForLinearSuperposition=1, IndexOfVisibleLoadcase=-1)  # -> Model, DeformedMesh, DeformedAxes, DeformedModel
shell_view_karamba_2 = ShellViewKaramba(Model=model_view_karamba_2.Model, IndexOfLayer=0)  # -> Model, MeshesOfRenderedShells, LegendColors, LegendTags
legend_2 = Legend(Colour=shell_view_karamba_2.LegendColors, Tags=shell_view_karamba_2.LegendTags, LegendType=1)

# ==== cluster Cluster
tree = ClusterInput()
point = ClusterInput()
list = ClusterInput()
A = ClusterInput()
list_2 = ClusterInput()
point_2 = ClusterInput()

tree_branch = TreeBranch(Tree=tree, Path=Slider(0, range=0..15), MaintainPaths=True)
list_item = ListItem(List=tree_branch, Index=0, Wrap=True)
area = Area(Geometry=list_item)  # -> Area, Centroid
multiple_curves = MultipleCurves(Curves=tree_branch)  # -> Points, IndexA, IndexB, ParamA, ParamB
cull_pattern = CullPattern(List=multiple_curves.ParamA, CullPattern=invert(multiple_curves.IndexA))
shatter = Shatter(Curve=list_item, Parameters=cull_pattern)
list_length = ListLength(List=cull_pattern)
list_item_2 = ListItem(List=shatter, Index=Slider(0, range=0..10), Wrap=True)
divide_curve = DivideCurve(Curve=shatter, Count=2, Kinks=False)  # -> Points, Tangents, Parameters
list_item_3 = ListItem(List=divide_curve.Points, Index=1, Wrap=True)
point_in_curves = PointInCurves(Point=list_item_3, Curves=reverse(tree_branch))  # -> Relationship, Index, Point
expression = Expression(x=point_in_curves.Relationship, Expression="If(x=2, 0, 1)")
cull_pattern_2 = CullPattern(List=point_in_curves.Point, CullPattern=invert(expression))
cull_pattern_3 = CullPattern(List=point_in_curves.Point, CullPattern=expression)  # -> flatten(List)
curve_closest_point = CurveClosestPoint(Point=cull_pattern_2, Curve=shatter)  # -> Point, Parameter, Distance
list_length_2 = ListLength(List=cull_pattern_3)
panel = Panel(curve_closest_point.Distance)
flip_matrix = FlipMatrix(Data=panel)
panel_2 = Panel(flip_matrix)
clean_tree = CleanTree(RemoveNulls=True, RemoveInvalid=True, RemoveEmpty=False, Tree=panel_2)  # -> simplify(Tree)
integer = Integer(clean_tree)
expression_2 = Expression(x=integer, Expression="If(x=0,0,1)")
panel_3 = Panel(expression_2)
mass_addition = MassAddition(Input=panel_3)  # -> Result, PartialResults
panel_4 = Panel(mass_addition.Result)
integer_2 = Integer(panel_4)
expression_3 = Expression(x=integer_2, y=list_length_2, Expression="if (x=y,1,0)")  # -> flatten(Result)
panel_5 = Panel(expression_3)
cull_pattern_4 = CullPattern(List=shatter, CullPattern=panel_5)
subtraction = Subtraction(A=list_length_2, B=1)
end_points = EndPoints(Curve=cull_pattern_4)  # -> Start, End
shift_list = ShiftList(List=end_points.End, Shift=subtraction, Wrap=True)
point_3 = Point(end_points.Start)
line = Line(StartPoint=point_3, EndPoint=shift_list)  # -> flatten(Line)
length = Length(Curve=line)
divide_curve_2 = DivideCurve(Curve=line, Count=2, Kinks=False)  # -> Points, Tangents, Parameters
division = Division(A=length, B=2)
list_item_4 = ListItem(List=divide_curve_2.Points, Index=1, Wrap=True)
circle_cnr = CircleCNR(Center=flatten(list_item_4), Normal=Vector(0, 0, 1), Radius=division)  # -> graft(Circle)
curve_curve = CurveCurve(CurveA=circle_cnr, CurveB=list_item)  # -> Points, ParamsA, ParamsB
shatter_2 = Shatter(Curve=circle_cnr, Parameters=curve_curve.ParamsA)
divide_curve_3 = DivideCurve(Curve=shatter_2, Count=2, Kinks=False)  # -> Points, Tangents, Parameters
list_item_5 = ListItem(List=divide_curve_3.Points, Index=1, Wrap=True)  # -> flatten(Item)
point_in_curve = PointInCurve(Point=list_item_5, Curve=list_item)  # -> flatten(Relationship), Point
cull_pattern_5 = CullPattern(List=flatten(shatter_2), CullPattern=point_in_curve.Relationship)
join_curves = JoinCurves(Curves=flatten([cull_pattern_4, cull_pattern_5]), Preserve=False)
ghpython_script = GhPythonScript(x=list_length, y=list_item, z=join_curves)  # -> out, a; inputs x: Int32, y: Curve, z: Curve
# ---------- ghpython_script: Python ----------
__author__ = "Gautam"
__version__ = "2018.10.23"

import rhinoscriptsyntax as rs
if x>0:
    a=z
else:
    a=y
# ---------- end ghpython_script ----------
point_in_curve_2 = PointInCurve(Point=point, Curve=ghpython_script.a)  # -> Relationship, Point
cull_pattern_6 = CullPattern(List=list, CullPattern=point_in_curve_2.Relationship)  # -> flatten(List)
join_curves_2 = JoinCurves(Curves=flatten([cull_pattern_5, line]), Preserve=False)
division_2 = Division(A=A, B=area.Area)
point_in_curve_3 = PointInCurve(Point=point_2, Curve=graft(join_curves_2))  # -> Relationship, Point
division_3 = Division(A=Slider(15, range=0..50), B=division_2)
length_line = LengthLine(Line=cull_pattern_6, Strength=division_3)
expression_4 = Expression(x=point_in_curve_3.Relationship, Expression="if(x=2,1,0)")
cull_pattern_7 = CullPattern(List=list_2, CullPattern=expression_4)

spring = ClusterOutput(length_line)
list_3 = ClusterOutput(cull_pattern_7)

# ==== cluster Cluster_2
tree = ClusterInput()
point = ClusterInput()
list = ClusterInput()
A = ClusterInput()
list_2 = ClusterInput()
point_2 = ClusterInput()

tree_branch = TreeBranch(Tree=tree, Path=Slider(1, range=0..15), MaintainPaths=True)
list_item = ListItem(List=tree_branch, Index=0, Wrap=True)
area = Area(Geometry=list_item)  # -> Area, Centroid
multiple_curves = MultipleCurves(Curves=tree_branch)  # -> Points, IndexA, IndexB, ParamA, ParamB
cull_pattern = CullPattern(List=multiple_curves.ParamA, CullPattern=invert(multiple_curves.IndexA))
shatter = Shatter(Curve=list_item, Parameters=cull_pattern)
list_length = ListLength(List=cull_pattern)
list_item_2 = ListItem(List=shatter, Index=Slider(0, range=0..10), Wrap=True)
divide_curve = DivideCurve(Curve=shatter, Count=2, Kinks=False)  # -> Points, Tangents, Parameters
list_item_3 = ListItem(List=divide_curve.Points, Index=1, Wrap=True)
point_in_curves = PointInCurves(Point=list_item_3, Curves=reverse(tree_branch))  # -> Relationship, Index, Point
expression = Expression(x=point_in_curves.Relationship, Expression="If(x=2, 0, 1)")
cull_pattern_2 = CullPattern(List=point_in_curves.Point, CullPattern=invert(expression))
cull_pattern_3 = CullPattern(List=point_in_curves.Point, CullPattern=expression)  # -> flatten(List)
curve_closest_point = CurveClosestPoint(Point=cull_pattern_2, Curve=shatter)  # -> Point, Parameter, Distance
list_length_2 = ListLength(List=cull_pattern_3)
panel = Panel(curve_closest_point.Distance)
flip_matrix = FlipMatrix(Data=panel)
panel_2 = Panel(flip_matrix)
clean_tree = CleanTree(RemoveNulls=True, RemoveInvalid=True, RemoveEmpty=False, Tree=panel_2)  # -> simplify(Tree)
integer = Integer(clean_tree)
expression_2 = Expression(x=integer, Expression="If(x=0,0,1)")
panel_3 = Panel(expression_2)
mass_addition = MassAddition(Input=panel_3)  # -> Result, PartialResults
panel_4 = Panel(mass_addition.Result)
integer_2 = Integer(panel_4)
expression_3 = Expression(x=integer_2, y=list_length_2, Expression="if (x=y,1,0)")  # -> flatten(Result)
panel_5 = Panel(expression_3)
cull_pattern_4 = CullPattern(List=shatter, CullPattern=panel_5)
subtraction = Subtraction(A=list_length_2, B=1)
end_points = EndPoints(Curve=cull_pattern_4)  # -> Start, End
shift_list = ShiftList(List=end_points.End, Shift=subtraction, Wrap=True)
point_3 = Point(end_points.Start)
line = Line(StartPoint=point_3, EndPoint=shift_list)  # -> flatten(Line)
length = Length(Curve=line)
divide_curve_2 = DivideCurve(Curve=line, Count=2, Kinks=False)  # -> Points, Tangents, Parameters
division = Division(A=length, B=2)
list_item_4 = ListItem(List=divide_curve_2.Points, Index=1, Wrap=True)
circle_cnr = CircleCNR(Center=flatten(list_item_4), Normal=Vector(0, 0, 1), Radius=division)  # -> graft(Circle)
curve_curve = CurveCurve(CurveA=circle_cnr, CurveB=list_item)  # -> Points, ParamsA, ParamsB
shatter_2 = Shatter(Curve=circle_cnr, Parameters=curve_curve.ParamsA)
divide_curve_3 = DivideCurve(Curve=shatter_2, Count=2, Kinks=False)  # -> Points, Tangents, Parameters
list_item_5 = ListItem(List=divide_curve_3.Points, Index=1, Wrap=True)  # -> flatten(Item)
point_in_curve = PointInCurve(Point=list_item_5, Curve=list_item)  # -> flatten(Relationship), Point
cull_pattern_5 = CullPattern(List=flatten(shatter_2), CullPattern=point_in_curve.Relationship)
join_curves = JoinCurves(Curves=flatten([cull_pattern_4, cull_pattern_5]), Preserve=False)
ghpython_script = GhPythonScript(x=list_length, y=list_item, z=join_curves)  # -> out, a; inputs x: Int32, y: Curve, z: Curve; same code as ghpython_script
point_in_curve_2 = PointInCurve(Point=point, Curve=ghpython_script.a)  # -> Relationship, Point
cull_pattern_6 = CullPattern(List=list, CullPattern=point_in_curve_2.Relationship)  # -> flatten(List)
join_curves_2 = JoinCurves(Curves=flatten([cull_pattern_5, line]), Preserve=False)
division_2 = Division(A=A, B=area.Area)
point_in_curve_3 = PointInCurve(Point=point_2, Curve=graft(join_curves_2))  # -> Relationship, Point
division_3 = Division(A=Slider(15, range=0..50), B=division_2)
length_line = LengthLine(Line=cull_pattern_6, Strength=division_3)
expression_4 = Expression(x=point_in_curve_3.Relationship, Expression="if(x=2,1,0)")
cull_pattern_7 = CullPattern(List=list_2, CullPattern=expression_4)

spring = ClusterOutput(length_line)
list_3 = ClusterOutput(cull_pattern_7)

# ==== cluster Cluster_3
tree = ClusterInput()
point = ClusterInput()
list = ClusterInput()
A = ClusterInput()
list_2 = ClusterInput()
point_2 = ClusterInput()

tree_branch = TreeBranch(Tree=tree, Path=Slider(2, range=0..15), MaintainPaths=True)
list_item = ListItem(List=tree_branch, Index=0, Wrap=True)
area = Area(Geometry=list_item)  # -> Area, Centroid
multiple_curves = MultipleCurves(Curves=tree_branch)  # -> Points, IndexA, IndexB, ParamA, ParamB
cull_pattern = CullPattern(List=multiple_curves.ParamA, CullPattern=invert(multiple_curves.IndexA))
shatter = Shatter(Curve=list_item, Parameters=cull_pattern)
list_length = ListLength(List=cull_pattern)
list_item_2 = ListItem(List=shatter, Index=Slider(0, range=0..10), Wrap=True)
divide_curve = DivideCurve(Curve=shatter, Count=2, Kinks=False)  # -> Points, Tangents, Parameters
list_item_3 = ListItem(List=divide_curve.Points, Index=1, Wrap=True)
point_in_curves = PointInCurves(Point=list_item_3, Curves=reverse(tree_branch))  # -> Relationship, Index, Point
expression = Expression(x=point_in_curves.Relationship, Expression="If(x=2, 0, 1)")
cull_pattern_2 = CullPattern(List=point_in_curves.Point, CullPattern=invert(expression))
cull_pattern_3 = CullPattern(List=point_in_curves.Point, CullPattern=expression)  # -> flatten(List)
curve_closest_point = CurveClosestPoint(Point=cull_pattern_2, Curve=shatter)  # -> Point, Parameter, Distance
list_length_2 = ListLength(List=cull_pattern_3)
panel = Panel(curve_closest_point.Distance)
flip_matrix = FlipMatrix(Data=panel)
panel_2 = Panel(flip_matrix)
clean_tree = CleanTree(RemoveNulls=True, RemoveInvalid=True, RemoveEmpty=False, Tree=panel_2)  # -> simplify(Tree)
integer = Integer(clean_tree)
expression_2 = Expression(x=integer, Expression="If(x=0,0,1)")
panel_3 = Panel(expression_2)
mass_addition = MassAddition(Input=panel_3)  # -> Result, PartialResults
panel_4 = Panel(mass_addition.Result)
integer_2 = Integer(panel_4)
expression_3 = Expression(x=integer_2, y=list_length_2, Expression="if (x=y,1,0)")  # -> flatten(Result)
panel_5 = Panel(expression_3)
cull_pattern_4 = CullPattern(List=shatter, CullPattern=panel_5)
subtraction = Subtraction(A=list_length_2, B=1)
end_points = EndPoints(Curve=cull_pattern_4)  # -> Start, End
shift_list = ShiftList(List=end_points.End, Shift=subtraction, Wrap=True)
point_3 = Point(end_points.Start)
line = Line(StartPoint=point_3, EndPoint=shift_list)  # -> flatten(Line)
length = Length(Curve=line)
divide_curve_2 = DivideCurve(Curve=line, Count=2, Kinks=False)  # -> Points, Tangents, Parameters
division = Division(A=length, B=2)
list_item_4 = ListItem(List=divide_curve_2.Points, Index=1, Wrap=True)
circle_cnr = CircleCNR(Center=flatten(list_item_4), Normal=Vector(0, 0, 1), Radius=division)  # -> graft(Circle)
curve_curve = CurveCurve(CurveA=circle_cnr, CurveB=list_item)  # -> Points, ParamsA, ParamsB
shatter_2 = Shatter(Curve=circle_cnr, Parameters=curve_curve.ParamsA)
divide_curve_3 = DivideCurve(Curve=shatter_2, Count=2, Kinks=False)  # -> Points, Tangents, Parameters
list_item_5 = ListItem(List=divide_curve_3.Points, Index=1, Wrap=True)  # -> flatten(Item)
point_in_curve = PointInCurve(Point=list_item_5, Curve=list_item)  # -> flatten(Relationship), Point
cull_pattern_5 = CullPattern(List=flatten(shatter_2), CullPattern=point_in_curve.Relationship)
join_curves = JoinCurves(Curves=flatten([cull_pattern_4, cull_pattern_5]), Preserve=False)
ghpython_script = GhPythonScript(x=list_length, y=list_item, z=join_curves)  # -> out, a; inputs x: Int32, y: Curve, z: Curve; same code as ghpython_script
point_in_curve_2 = PointInCurve(Point=point, Curve=ghpython_script.a)  # -> Relationship, Point
cull_pattern_6 = CullPattern(List=list, CullPattern=point_in_curve_2.Relationship)  # -> flatten(List)
join_curves_2 = JoinCurves(Curves=flatten([cull_pattern_5, line]), Preserve=False)
division_2 = Division(A=A, B=area.Area)
point_in_curve_3 = PointInCurve(Point=point_2, Curve=graft(join_curves_2))  # -> Relationship, Point
division_3 = Division(A=Slider(15, range=0..50), B=division_2)
length_line = LengthLine(Line=cull_pattern_6, Strength=division_3)
expression_4 = Expression(x=point_in_curve_3.Relationship, Expression="if(x=2,1,0)")
cull_pattern_7 = CullPattern(List=list_2, CullPattern=expression_4)

spring = ClusterOutput(length_line)
list_3 = ClusterOutput(cull_pattern_7)

# ==== cluster Cluster_4
tree = ClusterInput()
point = ClusterInput()
list = ClusterInput()
A = ClusterInput()
list_2 = ClusterInput()
point_2 = ClusterInput()

tree_branch = TreeBranch(Tree=tree, Path=Slider(3, range=0..15), MaintainPaths=True)
list_item = ListItem(List=tree_branch, Index=0, Wrap=True)
area = Area(Geometry=list_item)  # -> Area, Centroid
multiple_curves = MultipleCurves(Curves=tree_branch)  # -> Points, IndexA, IndexB, ParamA, ParamB
cull_pattern = CullPattern(List=multiple_curves.ParamA, CullPattern=invert(multiple_curves.IndexA))
shatter = Shatter(Curve=list_item, Parameters=cull_pattern)
list_length = ListLength(List=cull_pattern)
list_item_2 = ListItem(List=shatter, Index=Slider(0, range=0..10), Wrap=True)
divide_curve = DivideCurve(Curve=shatter, Count=2, Kinks=False)  # -> Points, Tangents, Parameters
list_item_3 = ListItem(List=divide_curve.Points, Index=1, Wrap=True)
point_in_curves = PointInCurves(Point=list_item_3, Curves=reverse(tree_branch))  # -> Relationship, Index, Point
expression = Expression(x=point_in_curves.Relationship, Expression="If(x=2, 0, 1)")
cull_pattern_2 = CullPattern(List=point_in_curves.Point, CullPattern=invert(expression))
cull_pattern_3 = CullPattern(List=point_in_curves.Point, CullPattern=expression)  # -> flatten(List)
curve_closest_point = CurveClosestPoint(Point=cull_pattern_2, Curve=shatter)  # -> Point, Parameter, Distance
list_length_2 = ListLength(List=cull_pattern_3)
panel = Panel(curve_closest_point.Distance)
flip_matrix = FlipMatrix(Data=panel)
panel_2 = Panel(flip_matrix)
clean_tree = CleanTree(RemoveNulls=True, RemoveInvalid=True, RemoveEmpty=False, Tree=panel_2)  # -> simplify(Tree)
integer = Integer(clean_tree)
expression_2 = Expression(x=integer, Expression="If(x=0,0,1)")
panel_3 = Panel(expression_2)
mass_addition = MassAddition(Input=panel_3)  # -> Result, PartialResults
panel_4 = Panel(mass_addition.Result)
integer_2 = Integer(panel_4)
expression_3 = Expression(x=integer_2, y=list_length_2, Expression="if (x=y,1,0)")  # -> flatten(Result)
panel_5 = Panel(expression_3)
cull_pattern_4 = CullPattern(List=shatter, CullPattern=panel_5)
subtraction = Subtraction(A=list_length_2, B=1)
end_points = EndPoints(Curve=cull_pattern_4)  # -> Start, End
shift_list = ShiftList(List=end_points.End, Shift=subtraction, Wrap=True)
point_3 = Point(end_points.Start)
line = Line(StartPoint=point_3, EndPoint=shift_list)  # -> flatten(Line)
length = Length(Curve=line)
divide_curve_2 = DivideCurve(Curve=line, Count=2, Kinks=False)  # -> Points, Tangents, Parameters
division = Division(A=length, B=2)
list_item_4 = ListItem(List=divide_curve_2.Points, Index=1, Wrap=True)
circle_cnr = CircleCNR(Center=flatten(list_item_4), Normal=Vector(0, 0, 1), Radius=division)  # -> graft(Circle)
curve_curve = CurveCurve(CurveA=circle_cnr, CurveB=list_item)  # -> Points, ParamsA, ParamsB
shatter_2 = Shatter(Curve=circle_cnr, Parameters=curve_curve.ParamsA)
divide_curve_3 = DivideCurve(Curve=shatter_2, Count=2, Kinks=False)  # -> Points, Tangents, Parameters
list_item_5 = ListItem(List=divide_curve_3.Points, Index=1, Wrap=True)  # -> flatten(Item)
point_in_curve = PointInCurve(Point=list_item_5, Curve=list_item)  # -> flatten(Relationship), Point
cull_pattern_5 = CullPattern(List=flatten(shatter_2), CullPattern=point_in_curve.Relationship)
join_curves = JoinCurves(Curves=flatten([cull_pattern_4, cull_pattern_5]), Preserve=False)
ghpython_script = GhPythonScript(x=list_length, y=list_item, z=join_curves)  # -> out, a; inputs x: Int32, y: Curve, z: Curve; same code as ghpython_script
point_in_curve_2 = PointInCurve(Point=point, Curve=ghpython_script.a)  # -> Relationship, Point
cull_pattern_6 = CullPattern(List=list, CullPattern=point_in_curve_2.Relationship)  # -> flatten(List)
join_curves_2 = JoinCurves(Curves=flatten([cull_pattern_5, line]), Preserve=False)
division_2 = Division(A=A, B=area.Area)
point_in_curve_3 = PointInCurve(Point=point_2, Curve=graft(join_curves_2))  # -> Relationship, Point
division_3 = Division(A=Slider(15, range=0..50), B=division_2)
expression_4 = Expression(x=point_in_curve_3.Relationship, Expression="if(x=2,1,0)")
cull_pattern_7 = CullPattern(List=list_2, CullPattern=expression_4)
length_line = LengthLine(Line=cull_pattern_6, Strength=division_3)

spring = ClusterOutput(length_line)
list_3 = ClusterOutput(cull_pattern_7)

# ==== cluster Cluster_5
tree = ClusterInput()
point = ClusterInput()
list = ClusterInput()
A = ClusterInput()
list_2 = ClusterInput()
point_2 = ClusterInput()

tree_branch = TreeBranch(Tree=tree, Path=Slider(4, range=0..15), MaintainPaths=True)
list_item = ListItem(List=tree_branch, Index=0, Wrap=True)
area = Area(Geometry=list_item)  # -> Area, Centroid
multiple_curves = MultipleCurves(Curves=tree_branch)  # -> Points, IndexA, IndexB, ParamA, ParamB
cull_pattern = CullPattern(List=multiple_curves.ParamA, CullPattern=invert(multiple_curves.IndexA))
shatter = Shatter(Curve=list_item, Parameters=cull_pattern)
list_length = ListLength(List=cull_pattern)
list_item_2 = ListItem(List=shatter, Index=Slider(0, range=0..10), Wrap=True)
divide_curve = DivideCurve(Curve=shatter, Count=2, Kinks=False)  # -> Points, Tangents, Parameters
list_item_3 = ListItem(List=divide_curve.Points, Index=1, Wrap=True)
point_in_curves = PointInCurves(Point=list_item_3, Curves=reverse(tree_branch))  # -> Relationship, Index, Point
expression = Expression(x=point_in_curves.Relationship, Expression="If(x=2, 0, 1)")
cull_pattern_2 = CullPattern(List=point_in_curves.Point, CullPattern=invert(expression))
cull_pattern_3 = CullPattern(List=point_in_curves.Point, CullPattern=expression)  # -> flatten(List)
curve_closest_point = CurveClosestPoint(Point=cull_pattern_2, Curve=shatter)  # -> Point, Parameter, Distance
list_length_2 = ListLength(List=cull_pattern_3)
panel = Panel(curve_closest_point.Distance)
flip_matrix = FlipMatrix(Data=panel)
panel_2 = Panel(flip_matrix)
clean_tree = CleanTree(RemoveNulls=True, RemoveInvalid=True, RemoveEmpty=False, Tree=panel_2)  # -> simplify(Tree)
integer = Integer(clean_tree)
expression_2 = Expression(x=integer, Expression="If(x=0,0,1)")
panel_3 = Panel(expression_2)
mass_addition = MassAddition(Input=panel_3)  # -> Result, PartialResults
panel_4 = Panel(mass_addition.Result)
integer_2 = Integer(panel_4)
expression_3 = Expression(x=integer_2, y=list_length_2, Expression="if (x=y,1,0)")  # -> flatten(Result)
panel_5 = Panel(expression_3)
cull_pattern_4 = CullPattern(List=shatter, CullPattern=panel_5)
subtraction = Subtraction(A=list_length_2, B=1)
end_points = EndPoints(Curve=cull_pattern_4)  # -> Start, End
shift_list = ShiftList(List=end_points.End, Shift=subtraction, Wrap=True)
point_3 = Point(end_points.Start)
line = Line(StartPoint=point_3, EndPoint=shift_list)  # -> flatten(Line)
length = Length(Curve=line)
divide_curve_2 = DivideCurve(Curve=line, Count=2, Kinks=False)  # -> Points, Tangents, Parameters
division = Division(A=length, B=2)
list_item_4 = ListItem(List=divide_curve_2.Points, Index=1, Wrap=True)
circle_cnr = CircleCNR(Center=flatten(list_item_4), Normal=Vector(0, 0, 1), Radius=division)  # -> graft(Circle)
curve_curve = CurveCurve(CurveA=circle_cnr, CurveB=list_item)  # -> Points, ParamsA, ParamsB
shatter_2 = Shatter(Curve=circle_cnr, Parameters=curve_curve.ParamsA)
divide_curve_3 = DivideCurve(Curve=shatter_2, Count=2, Kinks=False)  # -> Points, Tangents, Parameters
list_item_5 = ListItem(List=divide_curve_3.Points, Index=1, Wrap=True)  # -> flatten(Item)
point_in_curve = PointInCurve(Point=list_item_5, Curve=list_item)  # -> flatten(Relationship), Point
cull_pattern_5 = CullPattern(List=flatten(shatter_2), CullPattern=point_in_curve.Relationship)
join_curves = JoinCurves(Curves=flatten([cull_pattern_4, cull_pattern_5]), Preserve=False)
ghpython_script = GhPythonScript(x=list_length, y=list_item, z=join_curves)  # -> out, a; inputs x: Int32, y: Curve, z: Curve; same code as ghpython_script
point_in_curve_2 = PointInCurve(Point=point, Curve=ghpython_script.a)  # -> Relationship, Point
cull_pattern_6 = CullPattern(List=list, CullPattern=point_in_curve_2.Relationship)  # -> flatten(List)
join_curves_2 = JoinCurves(Curves=flatten([cull_pattern_5, line]), Preserve=False)
division_2 = Division(A=A, B=area.Area)
point_in_curve_3 = PointInCurve(Point=point_2, Curve=graft(join_curves_2))  # -> Relationship, Point
division_3 = Division(A=Slider(15, range=0..50), B=division_2)
length_line = LengthLine(Line=cull_pattern_6, Strength=division_3)
expression_4 = Expression(x=point_in_curve_3.Relationship, Expression="if(x=2,1,0)")
cull_pattern_7 = CullPattern(List=list_2, CullPattern=expression_4)

spring = ClusterOutput(length_line)
list_3 = ClusterOutput(cull_pattern_7)

# ==== cluster Cluster_6
tree = ClusterInput()
point = ClusterInput()
list = ClusterInput()
A = ClusterInput()
list_2 = ClusterInput()
point_2 = ClusterInput()

tree_branch = TreeBranch(Tree=tree, Path=Slider(5, range=0..15), MaintainPaths=True)
list_item = ListItem(List=tree_branch, Index=0, Wrap=True)
area = Area(Geometry=list_item)  # -> Area, Centroid
multiple_curves = MultipleCurves(Curves=tree_branch)  # -> Points, IndexA, IndexB, ParamA, ParamB
cull_pattern = CullPattern(List=multiple_curves.ParamA, CullPattern=invert(multiple_curves.IndexA))
shatter = Shatter(Curve=list_item, Parameters=cull_pattern)
list_length = ListLength(List=cull_pattern)
list_item_2 = ListItem(List=shatter, Index=Slider(0, range=0..10), Wrap=True)
divide_curve = DivideCurve(Curve=shatter, Count=2, Kinks=False)  # -> Points, Tangents, Parameters
list_item_3 = ListItem(List=divide_curve.Points, Index=1, Wrap=True)
point_in_curves = PointInCurves(Point=list_item_3, Curves=reverse(tree_branch))  # -> Relationship, Index, Point
expression = Expression(x=point_in_curves.Relationship, Expression="If(x=2, 0, 1)")
cull_pattern_2 = CullPattern(List=point_in_curves.Point, CullPattern=invert(expression))
cull_pattern_3 = CullPattern(List=point_in_curves.Point, CullPattern=expression)  # -> flatten(List)
curve_closest_point = CurveClosestPoint(Point=cull_pattern_2, Curve=shatter)  # -> Point, Parameter, Distance
list_length_2 = ListLength(List=cull_pattern_3)
panel = Panel(curve_closest_point.Distance)
flip_matrix = FlipMatrix(Data=panel)
panel_2 = Panel(flip_matrix)
clean_tree = CleanTree(RemoveNulls=True, RemoveInvalid=True, RemoveEmpty=False, Tree=panel_2)  # -> simplify(Tree)
integer = Integer(clean_tree)
expression_2 = Expression(x=integer, Expression="If(x=0,0,1)")
panel_3 = Panel(expression_2)
mass_addition = MassAddition(Input=panel_3)  # -> Result, PartialResults
panel_4 = Panel(mass_addition.Result)
integer_2 = Integer(panel_4)
expression_3 = Expression(x=integer_2, y=list_length_2, Expression="if (x=y,1,0)")  # -> flatten(Result)
panel_5 = Panel(expression_3)
cull_pattern_4 = CullPattern(List=shatter, CullPattern=panel_5)
subtraction = Subtraction(A=list_length_2, B=1)
end_points = EndPoints(Curve=cull_pattern_4)  # -> Start, End
shift_list = ShiftList(List=end_points.End, Shift=subtraction, Wrap=True)
point_3 = Point(end_points.Start)
line = Line(StartPoint=point_3, EndPoint=shift_list)  # -> flatten(Line)
length = Length(Curve=line)
divide_curve_2 = DivideCurve(Curve=line, Count=2, Kinks=False)  # -> Points, Tangents, Parameters
division = Division(A=length, B=2)
list_item_4 = ListItem(List=divide_curve_2.Points, Index=1, Wrap=True)
circle_cnr = CircleCNR(Center=flatten(list_item_4), Normal=Vector(0, 0, 1), Radius=division)  # -> graft(Circle)
curve_curve = CurveCurve(CurveA=circle_cnr, CurveB=list_item)  # -> Points, ParamsA, ParamsB
shatter_2 = Shatter(Curve=circle_cnr, Parameters=curve_curve.ParamsA)
divide_curve_3 = DivideCurve(Curve=shatter_2, Count=2, Kinks=False)  # -> Points, Tangents, Parameters
list_item_5 = ListItem(List=divide_curve_3.Points, Index=1, Wrap=True)  # -> flatten(Item)
point_in_curve = PointInCurve(Point=list_item_5, Curve=list_item)  # -> flatten(Relationship), Point
cull_pattern_5 = CullPattern(List=flatten(shatter_2), CullPattern=point_in_curve.Relationship)
join_curves = JoinCurves(Curves=flatten([cull_pattern_4, cull_pattern_5]), Preserve=False)
ghpython_script = GhPythonScript(x=list_length, y=list_item, z=join_curves)  # -> out, a; inputs x: Int32, y: Curve, z: Curve; same code as ghpython_script
point_in_curve_2 = PointInCurve(Point=point, Curve=ghpython_script.a)  # -> Relationship, Point
cull_pattern_6 = CullPattern(List=list, CullPattern=point_in_curve_2.Relationship)  # -> flatten(List)
join_curves_2 = JoinCurves(Curves=flatten([cull_pattern_5, line]), Preserve=False)
division_2 = Division(A=A, B=area.Area)
point_in_curve_3 = PointInCurve(Point=point_2, Curve=graft(join_curves_2))  # -> Relationship, Point
division_3 = Division(A=Slider(15, range=0..50), B=division_2)
length_line = LengthLine(Line=cull_pattern_6, Strength=division_3)
expression_4 = Expression(x=point_in_curve_3.Relationship, Expression="if(x=2,1,0)")
cull_pattern_7 = CullPattern(List=list_2, CullPattern=expression_4)

spring = ClusterOutput(length_line)
list_3 = ClusterOutput(cull_pattern_7)

# ==== cluster Cluster_7
tree = ClusterInput()
point = ClusterInput()
list = ClusterInput()
A = ClusterInput()
list_2 = ClusterInput()
point_2 = ClusterInput()

tree_branch = TreeBranch(Tree=tree, Path=Slider(6, range=0..15), MaintainPaths=True)
list_item = ListItem(List=tree_branch, Index=0, Wrap=True)
area = Area(Geometry=list_item)  # -> Area, Centroid
multiple_curves = MultipleCurves(Curves=tree_branch)  # -> Points, IndexA, IndexB, ParamA, ParamB
cull_pattern = CullPattern(List=multiple_curves.ParamA, CullPattern=invert(multiple_curves.IndexA))
shatter = Shatter(Curve=list_item, Parameters=cull_pattern)
list_length = ListLength(List=cull_pattern)
list_item_2 = ListItem(List=shatter, Index=Slider(0, range=0..10), Wrap=True)
divide_curve = DivideCurve(Curve=shatter, Count=2, Kinks=False)  # -> Points, Tangents, Parameters
list_item_3 = ListItem(List=divide_curve.Points, Index=1, Wrap=True)
point_in_curves = PointInCurves(Point=list_item_3, Curves=reverse(tree_branch))  # -> Relationship, Index, Point
expression = Expression(x=point_in_curves.Relationship, Expression="If(x=2, 0, 1)")
cull_pattern_2 = CullPattern(List=point_in_curves.Point, CullPattern=invert(expression))
cull_pattern_3 = CullPattern(List=point_in_curves.Point, CullPattern=expression)  # -> flatten(List)
curve_closest_point = CurveClosestPoint(Point=cull_pattern_2, Curve=shatter)  # -> Point, Parameter, Distance
list_length_2 = ListLength(List=cull_pattern_3)
panel = Panel(curve_closest_point.Distance)
flip_matrix = FlipMatrix(Data=panel)
panel_2 = Panel(flip_matrix)
clean_tree = CleanTree(RemoveNulls=True, RemoveInvalid=True, RemoveEmpty=False, Tree=panel_2)  # -> simplify(Tree)
integer = Integer(clean_tree)
expression_2 = Expression(x=integer, Expression="If(x=0,0,1)")
panel_3 = Panel(expression_2)
mass_addition = MassAddition(Input=panel_3)  # -> Result, PartialResults
panel_4 = Panel(mass_addition.Result)
integer_2 = Integer(panel_4)
expression_3 = Expression(x=integer_2, y=list_length_2, Expression="if (x=y,1,0)")  # -> flatten(Result)
panel_5 = Panel(expression_3)
cull_pattern_4 = CullPattern(List=shatter, CullPattern=panel_5)
subtraction = Subtraction(A=list_length_2, B=1)
end_points = EndPoints(Curve=cull_pattern_4)  # -> Start, End
shift_list = ShiftList(List=end_points.End, Shift=subtraction, Wrap=True)
point_3 = Point(end_points.Start)
line = Line(StartPoint=point_3, EndPoint=shift_list)  # -> flatten(Line)
length = Length(Curve=line)
divide_curve_2 = DivideCurve(Curve=line, Count=2, Kinks=False)  # -> Points, Tangents, Parameters
division = Division(A=length, B=2)
list_item_4 = ListItem(List=divide_curve_2.Points, Index=1, Wrap=True)
circle_cnr = CircleCNR(Center=flatten(list_item_4), Normal=Vector(0, 0, 1), Radius=division)  # -> graft(Circle)
curve_curve = CurveCurve(CurveA=circle_cnr, CurveB=list_item)  # -> Points, ParamsA, ParamsB
shatter_2 = Shatter(Curve=circle_cnr, Parameters=curve_curve.ParamsA)
divide_curve_3 = DivideCurve(Curve=shatter_2, Count=2, Kinks=False)  # -> Points, Tangents, Parameters
list_item_5 = ListItem(List=divide_curve_3.Points, Index=1, Wrap=True)  # -> flatten(Item)
point_in_curve = PointInCurve(Point=list_item_5, Curve=list_item)  # -> flatten(Relationship), Point
cull_pattern_5 = CullPattern(List=flatten(shatter_2), CullPattern=point_in_curve.Relationship)
join_curves = JoinCurves(Curves=flatten([cull_pattern_4, cull_pattern_5]), Preserve=False)
ghpython_script = GhPythonScript(x=list_length, y=list_item, z=join_curves)  # -> out, a; inputs x: Int32, y: Curve, z: Curve; same code as ghpython_script
point_in_curve_2 = PointInCurve(Point=point, Curve=ghpython_script.a)  # -> Relationship, Point
cull_pattern_6 = CullPattern(List=list, CullPattern=point_in_curve_2.Relationship)  # -> flatten(List)
join_curves_2 = JoinCurves(Curves=flatten([cull_pattern_5, line]), Preserve=False)
division_2 = Division(A=A, B=area.Area)
point_in_curve_3 = PointInCurve(Point=point_2, Curve=graft(join_curves_2))  # -> Relationship, Point
division_3 = Division(A=Slider(15, range=0..50), B=division_2)
length_line = LengthLine(Line=cull_pattern_6, Strength=division_3)
expression_4 = Expression(x=point_in_curve_3.Relationship, Expression="if(x=2,1,0)")
cull_pattern_7 = CullPattern(List=list_2, CullPattern=expression_4)

spring = ClusterOutput(length_line)
list_3 = ClusterOutput(cull_pattern_7)

# ==== cluster Cluster_8
tree = ClusterInput()
point = ClusterInput()
list = ClusterInput()
A = ClusterInput()
list_2 = ClusterInput()
point_2 = ClusterInput()

tree_branch = TreeBranch(Tree=tree, Path=Slider(7, range=0..15), MaintainPaths=True)
list_item = ListItem(List=tree_branch, Index=0, Wrap=True)
area = Area(Geometry=list_item)  # -> Area, Centroid
multiple_curves = MultipleCurves(Curves=tree_branch)  # -> Points, IndexA, IndexB, ParamA, ParamB
cull_pattern = CullPattern(List=multiple_curves.ParamA, CullPattern=invert(multiple_curves.IndexA))
shatter = Shatter(Curve=list_item, Parameters=cull_pattern)
list_length = ListLength(List=cull_pattern)
list_item_2 = ListItem(List=shatter, Index=Slider(0, range=0..10), Wrap=True)
divide_curve = DivideCurve(Curve=shatter, Count=2, Kinks=False)  # -> Points, Tangents, Parameters
list_item_3 = ListItem(List=divide_curve.Points, Index=1, Wrap=True)
point_in_curves = PointInCurves(Point=list_item_3, Curves=reverse(tree_branch))  # -> Relationship, Index, Point
expression = Expression(x=point_in_curves.Relationship, Expression="If(x=2, 0, 1)")
cull_pattern_2 = CullPattern(List=point_in_curves.Point, CullPattern=invert(expression))
cull_pattern_3 = CullPattern(List=point_in_curves.Point, CullPattern=expression)  # -> flatten(List)
curve_closest_point = CurveClosestPoint(Point=cull_pattern_2, Curve=shatter)  # -> Point, Parameter, Distance
list_length_2 = ListLength(List=cull_pattern_3)
panel = Panel(curve_closest_point.Distance)
flip_matrix = FlipMatrix(Data=panel)
panel_2 = Panel(flip_matrix)
clean_tree = CleanTree(RemoveNulls=True, RemoveInvalid=True, RemoveEmpty=False, Tree=panel_2)  # -> simplify(Tree)
integer = Integer(clean_tree)
expression_2 = Expression(x=integer, Expression="If(x=0,0,1)")
panel_3 = Panel(expression_2)
mass_addition = MassAddition(Input=panel_3)  # -> Result, PartialResults
panel_4 = Panel(mass_addition.Result)
integer_2 = Integer(panel_4)
expression_3 = Expression(x=integer_2, y=list_length_2, Expression="if (x=y,1,0)")  # -> flatten(Result)
panel_5 = Panel(expression_3)
cull_pattern_4 = CullPattern(List=shatter, CullPattern=panel_5)
subtraction = Subtraction(A=list_length_2, B=1)
end_points = EndPoints(Curve=cull_pattern_4)  # -> Start, End
shift_list = ShiftList(List=end_points.End, Shift=subtraction, Wrap=True)
point_3 = Point(end_points.Start)
line = Line(StartPoint=point_3, EndPoint=shift_list)  # -> flatten(Line)
length = Length(Curve=line)
divide_curve_2 = DivideCurve(Curve=line, Count=2, Kinks=False)  # -> Points, Tangents, Parameters
division = Division(A=length, B=2)
list_item_4 = ListItem(List=divide_curve_2.Points, Index=1, Wrap=True)
circle_cnr = CircleCNR(Center=flatten(list_item_4), Normal=Vector(0, 0, 1), Radius=division)  # -> graft(Circle)
curve_curve = CurveCurve(CurveA=circle_cnr, CurveB=list_item)  # -> Points, ParamsA, ParamsB
shatter_2 = Shatter(Curve=circle_cnr, Parameters=curve_curve.ParamsA)
divide_curve_3 = DivideCurve(Curve=shatter_2, Count=2, Kinks=False)  # -> Points, Tangents, Parameters
list_item_5 = ListItem(List=divide_curve_3.Points, Index=1, Wrap=True)  # -> flatten(Item)
point_in_curve = PointInCurve(Point=list_item_5, Curve=list_item)  # -> flatten(Relationship), Point
cull_pattern_5 = CullPattern(List=flatten(shatter_2), CullPattern=point_in_curve.Relationship)
join_curves = JoinCurves(Curves=flatten([cull_pattern_4, cull_pattern_5]), Preserve=False)
ghpython_script = GhPythonScript(x=list_length, y=list_item, z=join_curves)  # -> out, a; inputs x: Int32, y: Curve, z: Curve; same code as ghpython_script
point_in_curve_2 = PointInCurve(Point=point, Curve=ghpython_script.a)  # -> Relationship, Point
cull_pattern_6 = CullPattern(List=list, CullPattern=point_in_curve_2.Relationship)  # -> flatten(List)
join_curves_2 = JoinCurves(Curves=flatten([cull_pattern_5, line]), Preserve=False)
division_2 = Division(A=A, B=area.Area)
point_in_curve_3 = PointInCurve(Point=point_2, Curve=graft(join_curves_2))  # -> Relationship, Point
division_3 = Division(A=Slider(15, range=0..50), B=division_2)
length_line = LengthLine(Line=cull_pattern_6, Strength=division_3)
expression_4 = Expression(x=point_in_curve_3.Relationship, Expression="if(x=2,1,0)")
cull_pattern_7 = CullPattern(List=list_2, CullPattern=expression_4)

spring = ClusterOutput(length_line)
list_3 = ClusterOutput(cull_pattern_7)

# ==== cluster Cluster_9
tree = ClusterInput()
point = ClusterInput()
list = ClusterInput()
A = ClusterInput()
list_2 = ClusterInput()
point_2 = ClusterInput()

tree_branch = TreeBranch(Tree=tree, Path=Slider(8, range=0..15), MaintainPaths=True)
list_item = ListItem(List=tree_branch, Index=0, Wrap=True)
area = Area(Geometry=list_item)  # -> Area, Centroid
multiple_curves = MultipleCurves(Curves=tree_branch)  # -> Points, IndexA, IndexB, ParamA, ParamB
cull_pattern = CullPattern(List=multiple_curves.ParamA, CullPattern=invert(multiple_curves.IndexA))
shatter = Shatter(Curve=list_item, Parameters=cull_pattern)
list_length = ListLength(List=cull_pattern)
list_item_2 = ListItem(List=shatter, Index=Slider(0, range=0..10), Wrap=True)
divide_curve = DivideCurve(Curve=shatter, Count=2, Kinks=False)  # -> Points, Tangents, Parameters
list_item_3 = ListItem(List=divide_curve.Points, Index=1, Wrap=True)
point_in_curves = PointInCurves(Point=list_item_3, Curves=reverse(tree_branch))  # -> Relationship, Index, Point
expression = Expression(x=point_in_curves.Relationship, Expression="If(x=2, 0, 1)")
cull_pattern_2 = CullPattern(List=point_in_curves.Point, CullPattern=invert(expression))
cull_pattern_3 = CullPattern(List=point_in_curves.Point, CullPattern=expression)  # -> flatten(List)
curve_closest_point = CurveClosestPoint(Point=cull_pattern_2, Curve=shatter)  # -> Point, Parameter, Distance
list_length_2 = ListLength(List=cull_pattern_3)
panel = Panel(curve_closest_point.Distance)
flip_matrix = FlipMatrix(Data=panel)
panel_2 = Panel(flip_matrix)
clean_tree = CleanTree(RemoveNulls=True, RemoveInvalid=True, RemoveEmpty=False, Tree=panel_2)  # -> simplify(Tree)
integer = Integer(clean_tree)
expression_2 = Expression(x=integer, Expression="If(x=0,0,1)")
panel_3 = Panel(expression_2)
mass_addition = MassAddition(Input=panel_3)  # -> Result, PartialResults
panel_4 = Panel(mass_addition.Result)
integer_2 = Integer(panel_4)
expression_3 = Expression(x=integer_2, y=list_length_2, Expression="if (x=y,1,0)")  # -> flatten(Result)
panel_5 = Panel(expression_3)
cull_pattern_4 = CullPattern(List=shatter, CullPattern=panel_5)
subtraction = Subtraction(A=list_length_2, B=1)
end_points = EndPoints(Curve=cull_pattern_4)  # -> Start, End
shift_list = ShiftList(List=end_points.End, Shift=subtraction, Wrap=True)
point_3 = Point(end_points.Start)
line = Line(StartPoint=point_3, EndPoint=shift_list)  # -> flatten(Line)
length = Length(Curve=line)
divide_curve_2 = DivideCurve(Curve=line, Count=2, Kinks=False)  # -> Points, Tangents, Parameters
division = Division(A=length, B=2)
list_item_4 = ListItem(List=divide_curve_2.Points, Index=1, Wrap=True)
circle_cnr = CircleCNR(Center=flatten(list_item_4), Normal=Vector(0, 0, 1), Radius=division)  # -> graft(Circle)
curve_curve = CurveCurve(CurveA=circle_cnr, CurveB=list_item)  # -> Points, ParamsA, ParamsB
shatter_2 = Shatter(Curve=circle_cnr, Parameters=curve_curve.ParamsA)
divide_curve_3 = DivideCurve(Curve=shatter_2, Count=2, Kinks=False)  # -> Points, Tangents, Parameters
list_item_5 = ListItem(List=divide_curve_3.Points, Index=1, Wrap=True)  # -> flatten(Item)
point_in_curve = PointInCurve(Point=list_item_5, Curve=list_item)  # -> flatten(Relationship), Point
cull_pattern_5 = CullPattern(List=flatten(shatter_2), CullPattern=point_in_curve.Relationship)
join_curves = JoinCurves(Curves=flatten([cull_pattern_4, cull_pattern_5]), Preserve=False)
ghpython_script = GhPythonScript(x=list_length, y=list_item, z=join_curves)  # -> out, a; inputs x: Int32, y: Curve, z: Curve; same code as ghpython_script
point_in_curve_2 = PointInCurve(Point=point, Curve=ghpython_script.a)  # -> Relationship, Point
cull_pattern_6 = CullPattern(List=list, CullPattern=point_in_curve_2.Relationship)  # -> flatten(List)
join_curves_2 = JoinCurves(Curves=flatten([cull_pattern_5, line]), Preserve=False)
division_2 = Division(A=A, B=area.Area)
point_in_curve_3 = PointInCurve(Point=point_2, Curve=graft(join_curves_2))  # -> Relationship, Point
division_3 = Division(A=Slider(15, range=0..50), B=division_2)
length_line = LengthLine(Line=cull_pattern_6, Strength=division_3)
expression_4 = Expression(x=point_in_curve_3.Relationship, Expression="if(x=2,1,0)")
cull_pattern_7 = CullPattern(List=list_2, CullPattern=expression_4)

spring = ClusterOutput(length_line)
list_3 = ClusterOutput(cull_pattern_7)

# ==== cluster Cluster_10
tree = ClusterInput()
point = ClusterInput()
list = ClusterInput()
A = ClusterInput()
list_2 = ClusterInput()
point_2 = ClusterInput()

tree_branch = TreeBranch(Tree=tree, Path=Slider(9, range=0..15), MaintainPaths=True)
list_item = ListItem(List=tree_branch, Index=0, Wrap=True)
area = Area(Geometry=list_item)  # -> Area, Centroid
multiple_curves = MultipleCurves(Curves=tree_branch)  # -> Points, IndexA, IndexB, ParamA, ParamB
cull_pattern = CullPattern(List=multiple_curves.ParamA, CullPattern=invert(multiple_curves.IndexA))
shatter = Shatter(Curve=list_item, Parameters=cull_pattern)
list_length = ListLength(List=cull_pattern)
list_item_2 = ListItem(List=shatter, Index=Slider(0, range=0..10), Wrap=True)
divide_curve = DivideCurve(Curve=shatter, Count=2, Kinks=False)  # -> Points, Tangents, Parameters
list_item_3 = ListItem(List=divide_curve.Points, Index=1, Wrap=True)
point_in_curves = PointInCurves(Point=list_item_3, Curves=reverse(tree_branch))  # -> Relationship, Index, Point
expression = Expression(x=point_in_curves.Relationship, Expression="If(x=2, 0, 1)")
cull_pattern_2 = CullPattern(List=point_in_curves.Point, CullPattern=invert(expression))
cull_pattern_3 = CullPattern(List=point_in_curves.Point, CullPattern=expression)  # -> flatten(List)
curve_closest_point = CurveClosestPoint(Point=cull_pattern_2, Curve=shatter)  # -> Point, Parameter, Distance
list_length_2 = ListLength(List=cull_pattern_3)
panel = Panel(curve_closest_point.Distance)
flip_matrix = FlipMatrix(Data=panel)
panel_2 = Panel(flip_matrix)
clean_tree = CleanTree(RemoveNulls=True, RemoveInvalid=True, RemoveEmpty=False, Tree=panel_2)  # -> simplify(Tree)
integer = Integer(clean_tree)
expression_2 = Expression(x=integer, Expression="If(x=0,0,1)")
panel_3 = Panel(expression_2)
mass_addition = MassAddition(Input=panel_3)  # -> Result, PartialResults
panel_4 = Panel(mass_addition.Result)
integer_2 = Integer(panel_4)
expression_3 = Expression(x=integer_2, y=list_length_2, Expression="if (x=y,1,0)")  # -> flatten(Result)
panel_5 = Panel(expression_3)
cull_pattern_4 = CullPattern(List=shatter, CullPattern=panel_5)
subtraction = Subtraction(A=list_length_2, B=1)
end_points = EndPoints(Curve=cull_pattern_4)  # -> Start, End
shift_list = ShiftList(List=end_points.End, Shift=subtraction, Wrap=True)
point_3 = Point(end_points.Start)
line = Line(StartPoint=point_3, EndPoint=shift_list)  # -> flatten(Line)
length = Length(Curve=line)
divide_curve_2 = DivideCurve(Curve=line, Count=2, Kinks=False)  # -> Points, Tangents, Parameters
division = Division(A=length, B=2)
list_item_4 = ListItem(List=divide_curve_2.Points, Index=1, Wrap=True)
circle_cnr = CircleCNR(Center=flatten(list_item_4), Normal=Vector(0, 0, 1), Radius=division)  # -> graft(Circle)
curve_curve = CurveCurve(CurveA=circle_cnr, CurveB=list_item)  # -> Points, ParamsA, ParamsB
shatter_2 = Shatter(Curve=circle_cnr, Parameters=curve_curve.ParamsA)
divide_curve_3 = DivideCurve(Curve=shatter_2, Count=2, Kinks=False)  # -> Points, Tangents, Parameters
list_item_5 = ListItem(List=divide_curve_3.Points, Index=1, Wrap=True)  # -> flatten(Item)
point_in_curve = PointInCurve(Point=list_item_5, Curve=list_item)  # -> flatten(Relationship), Point
cull_pattern_5 = CullPattern(List=flatten(shatter_2), CullPattern=point_in_curve.Relationship)
join_curves = JoinCurves(Curves=flatten([cull_pattern_4, cull_pattern_5]), Preserve=False)
ghpython_script = GhPythonScript(x=list_length, y=list_item, z=join_curves)  # -> out, a; inputs x: Int32, y: Curve, z: Curve; same code as ghpython_script
point_in_curve_2 = PointInCurve(Point=point, Curve=ghpython_script.a)  # -> Relationship, Point
cull_pattern_6 = CullPattern(List=list, CullPattern=point_in_curve_2.Relationship)  # -> flatten(List)
join_curves_2 = JoinCurves(Curves=flatten([cull_pattern_5, line]), Preserve=False)
division_2 = Division(A=A, B=area.Area)
point_in_curve_3 = PointInCurve(Point=point_2, Curve=graft(join_curves_2))  # -> Relationship, Point
division_3 = Division(A=Slider(15, range=0..50), B=division_2)
length_line = LengthLine(Line=cull_pattern_6, Strength=division_3)
expression_4 = Expression(x=point_in_curve_3.Relationship, Expression="if(x=2,1,0)")
cull_pattern_7 = CullPattern(List=list_2, CullPattern=expression_4)

spring = ClusterOutput(length_line)
list_3 = ClusterOutput(cull_pattern_7)

# ==== cluster Cluster_11
tree = ClusterInput()
point = ClusterInput()
list = ClusterInput()
A = ClusterInput()
list_2 = ClusterInput()
point_2 = ClusterInput()

tree_branch = TreeBranch(Tree=tree, Path=Slider(10, range=0..15), MaintainPaths=True)
list_item = ListItem(List=tree_branch, Index=0, Wrap=True)
area = Area(Geometry=list_item)  # -> Area, Centroid
multiple_curves = MultipleCurves(Curves=tree_branch)  # -> Points, IndexA, IndexB, ParamA, ParamB
cull_pattern = CullPattern(List=multiple_curves.ParamA, CullPattern=invert(multiple_curves.IndexA))
shatter = Shatter(Curve=list_item, Parameters=cull_pattern)
list_length = ListLength(List=cull_pattern)
list_item_2 = ListItem(List=shatter, Index=Slider(0, range=0..10), Wrap=True)
divide_curve = DivideCurve(Curve=shatter, Count=2, Kinks=False)  # -> Points, Tangents, Parameters
list_item_3 = ListItem(List=divide_curve.Points, Index=1, Wrap=True)
point_in_curves = PointInCurves(Point=list_item_3, Curves=reverse(tree_branch))  # -> Relationship, Index, Point
expression = Expression(x=point_in_curves.Relationship, Expression="If(x=2, 0, 1)")
cull_pattern_2 = CullPattern(List=point_in_curves.Point, CullPattern=invert(expression))
cull_pattern_3 = CullPattern(List=point_in_curves.Point, CullPattern=expression)  # -> flatten(List)
curve_closest_point = CurveClosestPoint(Point=cull_pattern_2, Curve=shatter)  # -> Point, Parameter, Distance
list_length_2 = ListLength(List=cull_pattern_3)
panel = Panel(curve_closest_point.Distance)
flip_matrix = FlipMatrix(Data=panel)
panel_2 = Panel(flip_matrix)
clean_tree = CleanTree(RemoveNulls=True, RemoveInvalid=True, RemoveEmpty=False, Tree=panel_2)  # -> simplify(Tree)
integer = Integer(clean_tree)
expression_2 = Expression(x=integer, Expression="If(x=0,0,1)")
panel_3 = Panel(expression_2)
mass_addition = MassAddition(Input=panel_3)  # -> Result, PartialResults
panel_4 = Panel(mass_addition.Result)
integer_2 = Integer(panel_4)
expression_3 = Expression(x=integer_2, y=list_length_2, Expression="if (x=y,1,0)")  # -> flatten(Result)
panel_5 = Panel(expression_3)
cull_pattern_4 = CullPattern(List=shatter, CullPattern=panel_5)
subtraction = Subtraction(A=list_length_2, B=1)
end_points = EndPoints(Curve=cull_pattern_4)  # -> Start, End
shift_list = ShiftList(List=end_points.End, Shift=subtraction, Wrap=True)
point_3 = Point(end_points.Start)
line = Line(StartPoint=point_3, EndPoint=shift_list)  # -> flatten(Line)
length = Length(Curve=line)
divide_curve_2 = DivideCurve(Curve=line, Count=2, Kinks=False)  # -> Points, Tangents, Parameters
division = Division(A=length, B=2)
list_item_4 = ListItem(List=divide_curve_2.Points, Index=1, Wrap=True)
circle_cnr = CircleCNR(Center=flatten(list_item_4), Normal=Vector(0, 0, 1), Radius=division)  # -> graft(Circle)
curve_curve = CurveCurve(CurveA=circle_cnr, CurveB=list_item)  # -> Points, ParamsA, ParamsB
shatter_2 = Shatter(Curve=circle_cnr, Parameters=curve_curve.ParamsA)
divide_curve_3 = DivideCurve(Curve=shatter_2, Count=2, Kinks=False)  # -> Points, Tangents, Parameters
list_item_5 = ListItem(List=divide_curve_3.Points, Index=1, Wrap=True)  # -> flatten(Item)
point_in_curve = PointInCurve(Point=list_item_5, Curve=list_item)  # -> flatten(Relationship), Point
cull_pattern_5 = CullPattern(List=flatten(shatter_2), CullPattern=point_in_curve.Relationship)
join_curves = JoinCurves(Curves=flatten([cull_pattern_4, cull_pattern_5]), Preserve=False)
ghpython_script = GhPythonScript(x=list_length, y=list_item, z=join_curves)  # -> out, a; inputs x: Int32, y: Curve, z: Curve; same code as ghpython_script
point_in_curve_2 = PointInCurve(Point=point, Curve=ghpython_script.a)  # -> Relationship, Point
cull_pattern_6 = CullPattern(List=list, CullPattern=point_in_curve_2.Relationship)  # -> flatten(List)
join_curves_2 = JoinCurves(Curves=flatten([cull_pattern_5, line]), Preserve=False)
division_2 = Division(A=A, B=area.Area)
point_in_curve_3 = PointInCurve(Point=point_2, Curve=graft(join_curves_2))  # -> Relationship, Point
division_3 = Division(A=Slider(15, range=0..50), B=division_2)
length_line = LengthLine(Line=cull_pattern_6, Strength=division_3)
expression_4 = Expression(x=point_in_curve_3.Relationship, Expression="if(x=2,1,0)")
cull_pattern_7 = CullPattern(List=list_2, CullPattern=expression_4)

spring = ClusterOutput(length_line)
list_3 = ClusterOutput(cull_pattern_7)

# ==== cluster Cluster_12
tree = ClusterInput()
point = ClusterInput()
list = ClusterInput()
A = ClusterInput()
list_2 = ClusterInput()
point_2 = ClusterInput()

tree_branch = TreeBranch(Tree=tree, Path=Slider(11, range=0..15), MaintainPaths=True)
list_item = ListItem(List=tree_branch, Index=0, Wrap=True)
area = Area(Geometry=list_item)  # -> Area, Centroid
multiple_curves = MultipleCurves(Curves=tree_branch)  # -> Points, IndexA, IndexB, ParamA, ParamB
cull_pattern = CullPattern(List=multiple_curves.ParamA, CullPattern=invert(multiple_curves.IndexA))
shatter = Shatter(Curve=list_item, Parameters=cull_pattern)
list_length = ListLength(List=cull_pattern)
list_item_2 = ListItem(List=shatter, Index=Slider(0, range=0..10), Wrap=True)
divide_curve = DivideCurve(Curve=shatter, Count=2, Kinks=False)  # -> Points, Tangents, Parameters
list_item_3 = ListItem(List=divide_curve.Points, Index=1, Wrap=True)
point_in_curves = PointInCurves(Point=list_item_3, Curves=reverse(tree_branch))  # -> Relationship, Index, Point
expression = Expression(x=point_in_curves.Relationship, Expression="If(x=2, 0, 1)")
cull_pattern_2 = CullPattern(List=point_in_curves.Point, CullPattern=invert(expression))
cull_pattern_3 = CullPattern(List=point_in_curves.Point, CullPattern=expression)  # -> flatten(List)
curve_closest_point = CurveClosestPoint(Point=cull_pattern_2, Curve=shatter)  # -> Point, Parameter, Distance
list_length_2 = ListLength(List=cull_pattern_3)
panel = Panel(curve_closest_point.Distance)
flip_matrix = FlipMatrix(Data=panel)
panel_2 = Panel(flip_matrix)
clean_tree = CleanTree(RemoveNulls=True, RemoveInvalid=True, RemoveEmpty=False, Tree=panel_2)  # -> simplify(Tree)
integer = Integer(clean_tree)
expression_2 = Expression(x=integer, Expression="If(x=0,0,1)")
panel_3 = Panel(expression_2)
mass_addition = MassAddition(Input=panel_3)  # -> Result, PartialResults
panel_4 = Panel(mass_addition.Result)
integer_2 = Integer(panel_4)
expression_3 = Expression(x=integer_2, y=list_length_2, Expression="if (x=y,1,0)")  # -> flatten(Result)
panel_5 = Panel(expression_3)
cull_pattern_4 = CullPattern(List=shatter, CullPattern=panel_5)
subtraction = Subtraction(A=list_length_2, B=1)
end_points = EndPoints(Curve=cull_pattern_4)  # -> Start, End
shift_list = ShiftList(List=end_points.End, Shift=subtraction, Wrap=True)
point_3 = Point(end_points.Start)
line = Line(StartPoint=point_3, EndPoint=shift_list)  # -> flatten(Line)
length = Length(Curve=line)
divide_curve_2 = DivideCurve(Curve=line, Count=2, Kinks=False)  # -> Points, Tangents, Parameters
division = Division(A=length, B=2)
list_item_4 = ListItem(List=divide_curve_2.Points, Index=1, Wrap=True)
circle_cnr = CircleCNR(Center=flatten(list_item_4), Normal=Vector(0, 0, 1), Radius=division)  # -> graft(Circle)
curve_curve = CurveCurve(CurveA=circle_cnr, CurveB=list_item)  # -> Points, ParamsA, ParamsB
shatter_2 = Shatter(Curve=circle_cnr, Parameters=curve_curve.ParamsA)
divide_curve_3 = DivideCurve(Curve=shatter_2, Count=2, Kinks=False)  # -> Points, Tangents, Parameters
list_item_5 = ListItem(List=divide_curve_3.Points, Index=1, Wrap=True)  # -> flatten(Item)
point_in_curve = PointInCurve(Point=list_item_5, Curve=list_item)  # -> flatten(Relationship), Point
cull_pattern_5 = CullPattern(List=flatten(shatter_2), CullPattern=point_in_curve.Relationship)
join_curves = JoinCurves(Curves=flatten([cull_pattern_4, cull_pattern_5]), Preserve=False)
ghpython_script = GhPythonScript(x=list_length, y=list_item, z=join_curves)  # -> out, a; inputs x: Int32, y: Curve, z: Curve; same code as ghpython_script
point_in_curve_2 = PointInCurve(Point=point, Curve=ghpython_script.a)  # -> Relationship, Point
cull_pattern_6 = CullPattern(List=list, CullPattern=point_in_curve_2.Relationship)  # -> flatten(List)
join_curves_2 = JoinCurves(Curves=flatten([cull_pattern_5, line]), Preserve=False)
division_2 = Division(A=A, B=area.Area)
point_in_curve_3 = PointInCurve(Point=point_2, Curve=graft(join_curves_2))  # -> Relationship, Point
division_3 = Division(A=Slider(15, range=0..50), B=division_2)
length_line = LengthLine(Line=cull_pattern_6, Strength=division_3)
expression_4 = Expression(x=point_in_curve_3.Relationship, Expression="if(x=2,1,0)")
cull_pattern_7 = CullPattern(List=list_2, CullPattern=expression_4)

spring = ClusterOutput(length_line)
list_3 = ClusterOutput(cull_pattern_7)

# ==== cluster Cluster_13
tree = ClusterInput()
point = ClusterInput()
list = ClusterInput()
A = ClusterInput()
list_2 = ClusterInput()
point_2 = ClusterInput()

tree_branch = TreeBranch(Tree=tree, Path=Slider(12, range=0..15), MaintainPaths=True)
list_item = ListItem(List=tree_branch, Index=0, Wrap=True)
area = Area(Geometry=list_item)  # -> Area, Centroid
multiple_curves = MultipleCurves(Curves=tree_branch)  # -> Points, IndexA, IndexB, ParamA, ParamB
cull_pattern = CullPattern(List=multiple_curves.ParamA, CullPattern=invert(multiple_curves.IndexA))
shatter = Shatter(Curve=list_item, Parameters=cull_pattern)
list_length = ListLength(List=cull_pattern)
list_item_2 = ListItem(List=shatter, Index=Slider(0, range=0..10), Wrap=True)
divide_curve = DivideCurve(Curve=shatter, Count=2, Kinks=False)  # -> Points, Tangents, Parameters
list_item_3 = ListItem(List=divide_curve.Points, Index=1, Wrap=True)
point_in_curves = PointInCurves(Point=list_item_3, Curves=reverse(tree_branch))  # -> Relationship, Index, Point
expression = Expression(x=point_in_curves.Relationship, Expression="If(x=2, 0, 1)")
cull_pattern_2 = CullPattern(List=point_in_curves.Point, CullPattern=invert(expression))
cull_pattern_3 = CullPattern(List=point_in_curves.Point, CullPattern=expression)  # -> flatten(List)
curve_closest_point = CurveClosestPoint(Point=cull_pattern_2, Curve=shatter)  # -> Point, Parameter, Distance
list_length_2 = ListLength(List=cull_pattern_3)
panel = Panel(curve_closest_point.Distance)
flip_matrix = FlipMatrix(Data=panel)
panel_2 = Panel(flip_matrix)
clean_tree = CleanTree(RemoveNulls=True, RemoveInvalid=True, RemoveEmpty=False, Tree=panel_2)  # -> simplify(Tree)
integer = Integer(clean_tree)
expression_2 = Expression(x=integer, Expression="If(x=0,0,1)")
panel_3 = Panel(expression_2)
mass_addition = MassAddition(Input=panel_3)  # -> Result, PartialResults
panel_4 = Panel(mass_addition.Result)
integer_2 = Integer(panel_4)
expression_3 = Expression(x=integer_2, y=list_length_2, Expression="if (x=y,1,0)")  # -> flatten(Result)
panel_5 = Panel(expression_3)
cull_pattern_4 = CullPattern(List=shatter, CullPattern=panel_5)
subtraction = Subtraction(A=list_length_2, B=1)
end_points = EndPoints(Curve=cull_pattern_4)  # -> Start, End
shift_list = ShiftList(List=end_points.End, Shift=subtraction, Wrap=True)
point_3 = Point(end_points.Start)
line = Line(StartPoint=point_3, EndPoint=shift_list)  # -> flatten(Line)
length = Length(Curve=line)
divide_curve_2 = DivideCurve(Curve=line, Count=2, Kinks=False)  # -> Points, Tangents, Parameters
division = Division(A=length, B=2)
list_item_4 = ListItem(List=divide_curve_2.Points, Index=1, Wrap=True)
circle_cnr = CircleCNR(Center=flatten(list_item_4), Normal=Vector(0, 0, 1), Radius=division)  # -> graft(Circle)
curve_curve = CurveCurve(CurveA=circle_cnr, CurveB=list_item)  # -> Points, ParamsA, ParamsB
shatter_2 = Shatter(Curve=circle_cnr, Parameters=curve_curve.ParamsA)
divide_curve_3 = DivideCurve(Curve=shatter_2, Count=2, Kinks=False)  # -> Points, Tangents, Parameters
list_item_5 = ListItem(List=divide_curve_3.Points, Index=1, Wrap=True)  # -> flatten(Item)
point_in_curve = PointInCurve(Point=list_item_5, Curve=list_item)  # -> flatten(Relationship), Point
cull_pattern_5 = CullPattern(List=flatten(shatter_2), CullPattern=point_in_curve.Relationship)
join_curves = JoinCurves(Curves=flatten([cull_pattern_4, cull_pattern_5]), Preserve=False)
ghpython_script = GhPythonScript(x=list_length, y=list_item, z=join_curves)  # -> out, a; inputs x: Int32, y: Curve, z: Curve; same code as ghpython_script
point_in_curve_2 = PointInCurve(Point=point, Curve=ghpython_script.a)  # -> Relationship, Point
cull_pattern_6 = CullPattern(List=list, CullPattern=point_in_curve_2.Relationship)  # -> flatten(List)
join_curves_2 = JoinCurves(Curves=flatten([cull_pattern_5, line]), Preserve=False)
division_2 = Division(A=A, B=area.Area)
point_in_curve_3 = PointInCurve(Point=point_2, Curve=graft(join_curves_2))  # -> Relationship, Point
division_3 = Division(A=Slider(15, range=0..50), B=division_2)
length_line = LengthLine(Line=cull_pattern_6, Strength=division_3)
expression_4 = Expression(x=point_in_curve_3.Relationship, Expression="if(x=2,1,0)")
cull_pattern_7 = CullPattern(List=list_2, CullPattern=expression_4)

spring = ClusterOutput(length_line)
list_3 = ClusterOutput(cull_pattern_7)

# ==== cluster Cluster_14
tree = ClusterInput()
point = ClusterInput()
list = ClusterInput()
A = ClusterInput()
list_2 = ClusterInput()
point_2 = ClusterInput()

tree_branch = TreeBranch(Tree=tree, Path=Slider(13, range=0..15), MaintainPaths=True)
list_item = ListItem(List=tree_branch, Index=0, Wrap=True)
area = Area(Geometry=list_item)  # -> Area, Centroid
multiple_curves = MultipleCurves(Curves=tree_branch)  # -> Points, IndexA, IndexB, ParamA, ParamB
cull_pattern = CullPattern(List=multiple_curves.ParamA, CullPattern=invert(multiple_curves.IndexA))
shatter = Shatter(Curve=list_item, Parameters=cull_pattern)
list_length = ListLength(List=cull_pattern)
list_item_2 = ListItem(List=shatter, Index=Slider(0, range=0..10), Wrap=True)
divide_curve = DivideCurve(Curve=shatter, Count=2, Kinks=False)  # -> Points, Tangents, Parameters
list_item_3 = ListItem(List=divide_curve.Points, Index=1, Wrap=True)
point_in_curves = PointInCurves(Point=list_item_3, Curves=reverse(tree_branch))  # -> Relationship, Index, Point
expression = Expression(x=point_in_curves.Relationship, Expression="If(x=2, 0, 1)")
cull_pattern_2 = CullPattern(List=point_in_curves.Point, CullPattern=invert(expression))
cull_pattern_3 = CullPattern(List=point_in_curves.Point, CullPattern=expression)  # -> flatten(List)
curve_closest_point = CurveClosestPoint(Point=cull_pattern_2, Curve=shatter)  # -> Point, Parameter, Distance
list_length_2 = ListLength(List=cull_pattern_3)
panel = Panel(curve_closest_point.Distance)
flip_matrix = FlipMatrix(Data=panel)
panel_2 = Panel(flip_matrix)
clean_tree = CleanTree(RemoveNulls=True, RemoveInvalid=True, RemoveEmpty=False, Tree=panel_2)  # -> simplify(Tree)
integer = Integer(clean_tree)
expression_2 = Expression(x=integer, Expression="If(x=0,0,1)")
panel_3 = Panel(expression_2)
mass_addition = MassAddition(Input=panel_3)  # -> Result, PartialResults
panel_4 = Panel(mass_addition.Result)
integer_2 = Integer(panel_4)
expression_3 = Expression(x=integer_2, y=list_length_2, Expression="if (x=y,1,0)")  # -> flatten(Result)
panel_5 = Panel(expression_3)
cull_pattern_4 = CullPattern(List=shatter, CullPattern=panel_5)
subtraction = Subtraction(A=list_length_2, B=1)
end_points = EndPoints(Curve=cull_pattern_4)  # -> Start, End
shift_list = ShiftList(List=end_points.End, Shift=subtraction, Wrap=True)
point_3 = Point(end_points.Start)
line = Line(StartPoint=point_3, EndPoint=shift_list)  # -> flatten(Line)
length = Length(Curve=line)
divide_curve_2 = DivideCurve(Curve=line, Count=2, Kinks=False)  # -> Points, Tangents, Parameters
division = Division(A=length, B=2)
list_item_4 = ListItem(List=divide_curve_2.Points, Index=1, Wrap=True)
circle_cnr = CircleCNR(Center=flatten(list_item_4), Normal=Vector(0, 0, 1), Radius=division)  # -> graft(Circle)
curve_curve = CurveCurve(CurveA=circle_cnr, CurveB=list_item)  # -> Points, ParamsA, ParamsB
shatter_2 = Shatter(Curve=circle_cnr, Parameters=curve_curve.ParamsA)
divide_curve_3 = DivideCurve(Curve=shatter_2, Count=2, Kinks=False)  # -> Points, Tangents, Parameters
list_item_5 = ListItem(List=divide_curve_3.Points, Index=1, Wrap=True)  # -> flatten(Item)
point_in_curve = PointInCurve(Point=list_item_5, Curve=list_item)  # -> flatten(Relationship), Point
cull_pattern_5 = CullPattern(List=flatten(shatter_2), CullPattern=point_in_curve.Relationship)
join_curves = JoinCurves(Curves=flatten([cull_pattern_4, cull_pattern_5]), Preserve=False)
ghpython_script = GhPythonScript(x=list_length, y=list_item, z=join_curves)  # -> out, a; inputs x: Int32, y: Curve, z: Curve; same code as ghpython_script
point_in_curve_2 = PointInCurve(Point=point, Curve=ghpython_script.a)  # -> Relationship, Point
cull_pattern_6 = CullPattern(List=list, CullPattern=point_in_curve_2.Relationship)  # -> flatten(List)
join_curves_2 = JoinCurves(Curves=flatten([cull_pattern_5, line]), Preserve=False)
division_2 = Division(A=A, B=area.Area)
point_in_curve_3 = PointInCurve(Point=point_2, Curve=graft(join_curves_2))  # -> Relationship, Point
division_3 = Division(A=Slider(15, range=0..50), B=division_2)
length_line = LengthLine(Line=cull_pattern_6, Strength=division_3)
expression_4 = Expression(x=point_in_curve_3.Relationship, Expression="if(x=2,1,0)")
cull_pattern_7 = CullPattern(List=list_2, CullPattern=expression_4)

spring = ClusterOutput(length_line)
list_3 = ClusterOutput(cull_pattern_7)

# ==== cluster Cluster_15
tree = ClusterInput()
point = ClusterInput()
list = ClusterInput()
A = ClusterInput()
list_2 = ClusterInput()
point_2 = ClusterInput()

tree_branch = TreeBranch(Tree=tree, Path=Slider(14, range=0..15), MaintainPaths=True)
list_item = ListItem(List=tree_branch, Index=0, Wrap=True)
area = Area(Geometry=list_item)  # -> Area, Centroid
multiple_curves = MultipleCurves(Curves=tree_branch)  # -> Points, IndexA, IndexB, ParamA, ParamB
cull_pattern = CullPattern(List=multiple_curves.ParamA, CullPattern=invert(multiple_curves.IndexA))
shatter = Shatter(Curve=list_item, Parameters=cull_pattern)
list_length = ListLength(List=cull_pattern)
list_item_2 = ListItem(List=shatter, Index=Slider(0, range=0..10), Wrap=True)
divide_curve = DivideCurve(Curve=shatter, Count=2, Kinks=False)  # -> Points, Tangents, Parameters
list_item_3 = ListItem(List=divide_curve.Points, Index=1, Wrap=True)
point_in_curves = PointInCurves(Point=list_item_3, Curves=reverse(tree_branch))  # -> Relationship, Index, Point
expression = Expression(x=point_in_curves.Relationship, Expression="If(x=2, 0, 1)")
cull_pattern_2 = CullPattern(List=point_in_curves.Point, CullPattern=invert(expression))
cull_pattern_3 = CullPattern(List=point_in_curves.Point, CullPattern=expression)  # -> flatten(List)
curve_closest_point = CurveClosestPoint(Point=cull_pattern_2, Curve=shatter)  # -> Point, Parameter, Distance
list_length_2 = ListLength(List=cull_pattern_3)
panel = Panel(curve_closest_point.Distance)
flip_matrix = FlipMatrix(Data=panel)
panel_2 = Panel(flip_matrix)
clean_tree = CleanTree(RemoveNulls=True, RemoveInvalid=True, RemoveEmpty=False, Tree=panel_2)  # -> simplify(Tree)
integer = Integer(clean_tree)
expression_2 = Expression(x=integer, Expression="If(x=0,0,1)")
panel_3 = Panel(expression_2)
mass_addition = MassAddition(Input=panel_3)  # -> Result, PartialResults
panel_4 = Panel(mass_addition.Result)
integer_2 = Integer(panel_4)
expression_3 = Expression(x=integer_2, y=list_length_2, Expression="if (x=y,1,0)")  # -> flatten(Result)
panel_5 = Panel(expression_3)
cull_pattern_4 = CullPattern(List=shatter, CullPattern=panel_5)
subtraction = Subtraction(A=list_length_2, B=1)
end_points = EndPoints(Curve=cull_pattern_4)  # -> Start, End
shift_list = ShiftList(List=end_points.End, Shift=subtraction, Wrap=True)
point_3 = Point(end_points.Start)
line = Line(StartPoint=point_3, EndPoint=shift_list)  # -> flatten(Line)
length = Length(Curve=line)
divide_curve_2 = DivideCurve(Curve=line, Count=2, Kinks=False)  # -> Points, Tangents, Parameters
division = Division(A=length, B=2)
list_item_4 = ListItem(List=divide_curve_2.Points, Index=1, Wrap=True)
circle_cnr = CircleCNR(Center=flatten(list_item_4), Normal=Vector(0, 0, 1), Radius=division)  # -> graft(Circle)
curve_curve = CurveCurve(CurveA=circle_cnr, CurveB=list_item)  # -> Points, ParamsA, ParamsB
shatter_2 = Shatter(Curve=circle_cnr, Parameters=curve_curve.ParamsA)
divide_curve_3 = DivideCurve(Curve=shatter_2, Count=2, Kinks=False)  # -> Points, Tangents, Parameters
list_item_5 = ListItem(List=divide_curve_3.Points, Index=1, Wrap=True)  # -> flatten(Item)
point_in_curve = PointInCurve(Point=list_item_5, Curve=list_item)  # -> flatten(Relationship), Point
cull_pattern_5 = CullPattern(List=flatten(shatter_2), CullPattern=point_in_curve.Relationship)
join_curves = JoinCurves(Curves=flatten([cull_pattern_4, cull_pattern_5]), Preserve=False)
ghpython_script = GhPythonScript(x=list_length, y=list_item, z=join_curves)  # -> out, a; inputs x: Int32, y: Curve, z: Curve; same code as ghpython_script
point_in_curve_2 = PointInCurve(Point=point, Curve=ghpython_script.a)  # -> Relationship, Point
cull_pattern_6 = CullPattern(List=list, CullPattern=point_in_curve_2.Relationship)  # -> flatten(List)
join_curves_2 = JoinCurves(Curves=flatten([cull_pattern_5, line]), Preserve=False)
division_2 = Division(A=A, B=area.Area)
point_in_curve_3 = PointInCurve(Point=point_2, Curve=graft(join_curves_2))  # -> Relationship, Point
division_3 = Division(A=Slider(15, range=0..50), B=division_2)
length_line = LengthLine(Line=cull_pattern_6, Strength=division_3)
expression_4 = Expression(x=point_in_curve_3.Relationship, Expression="if(x=2,1,0)")
cull_pattern_7 = CullPattern(List=list_2, CullPattern=expression_4)

spring = ClusterOutput(length_line)
list_3 = ClusterOutput(cull_pattern_7)

# ==== cluster Cluster_16
tree = ClusterInput()
point = ClusterInput()
list = ClusterInput()
A = ClusterInput()
list_2 = ClusterInput()
point_2 = ClusterInput()

tree_branch = TreeBranch(Tree=tree, Path=Slider(15, range=0..15), MaintainPaths=True)
list_item = ListItem(List=tree_branch, Index=0, Wrap=True)
area = Area(Geometry=list_item)  # -> Area, Centroid
multiple_curves = MultipleCurves(Curves=tree_branch)  # -> Points, IndexA, IndexB, ParamA, ParamB
cull_pattern = CullPattern(List=multiple_curves.ParamA, CullPattern=invert(multiple_curves.IndexA))
shatter = Shatter(Curve=list_item, Parameters=cull_pattern)
list_length = ListLength(List=cull_pattern)
list_item_2 = ListItem(List=shatter, Index=Slider(0, range=0..10), Wrap=True)
divide_curve = DivideCurve(Curve=shatter, Count=2, Kinks=False)  # -> Points, Tangents, Parameters
list_item_3 = ListItem(List=divide_curve.Points, Index=1, Wrap=True)
point_in_curves = PointInCurves(Point=list_item_3, Curves=reverse(tree_branch))  # -> Relationship, Index, Point
expression = Expression(x=point_in_curves.Relationship, Expression="If(x=2, 0, 1)")
cull_pattern_2 = CullPattern(List=point_in_curves.Point, CullPattern=invert(expression))
cull_pattern_3 = CullPattern(List=point_in_curves.Point, CullPattern=expression)  # -> flatten(List)
curve_closest_point = CurveClosestPoint(Point=cull_pattern_2, Curve=shatter)  # -> Point, Parameter, Distance
list_length_2 = ListLength(List=cull_pattern_3)
panel = Panel(curve_closest_point.Distance)
flip_matrix = FlipMatrix(Data=panel)
panel_2 = Panel(flip_matrix)
clean_tree = CleanTree(RemoveNulls=True, RemoveInvalid=True, RemoveEmpty=False, Tree=panel_2)  # -> simplify(Tree)
integer = Integer(clean_tree)
expression_2 = Expression(x=integer, Expression="If(x=0,0,1)")
panel_3 = Panel(expression_2)
mass_addition = MassAddition(Input=panel_3)  # -> Result, PartialResults
panel_4 = Panel(mass_addition.Result)
integer_2 = Integer(panel_4)
expression_3 = Expression(x=integer_2, y=list_length_2, Expression="if (x=y,1,0)")  # -> flatten(Result)
panel_5 = Panel(expression_3)
cull_pattern_4 = CullPattern(List=shatter, CullPattern=panel_5)
subtraction = Subtraction(A=list_length_2, B=1)
end_points = EndPoints(Curve=cull_pattern_4)  # -> Start, End
shift_list = ShiftList(List=end_points.End, Shift=subtraction, Wrap=True)
point_3 = Point(end_points.Start)
line = Line(StartPoint=point_3, EndPoint=shift_list)  # -> flatten(Line)
length = Length(Curve=line)
divide_curve_2 = DivideCurve(Curve=line, Count=2, Kinks=False)  # -> Points, Tangents, Parameters
division = Division(A=length, B=2)
list_item_4 = ListItem(List=divide_curve_2.Points, Index=1, Wrap=True)
circle_cnr = CircleCNR(Center=flatten(list_item_4), Normal=Vector(0, 0, 1), Radius=division)  # -> graft(Circle)
curve_curve = CurveCurve(CurveA=circle_cnr, CurveB=list_item)  # -> Points, ParamsA, ParamsB
shatter_2 = Shatter(Curve=circle_cnr, Parameters=curve_curve.ParamsA)
divide_curve_3 = DivideCurve(Curve=shatter_2, Count=2, Kinks=False)  # -> Points, Tangents, Parameters
list_item_5 = ListItem(List=divide_curve_3.Points, Index=1, Wrap=True)  # -> flatten(Item)
point_in_curve = PointInCurve(Point=list_item_5, Curve=list_item)  # -> flatten(Relationship), Point
cull_pattern_5 = CullPattern(List=flatten(shatter_2), CullPattern=point_in_curve.Relationship)
join_curves = JoinCurves(Curves=flatten([cull_pattern_4, cull_pattern_5]), Preserve=False)
ghpython_script = GhPythonScript(x=list_length, y=list_item, z=join_curves)  # -> out, a; inputs x: Int32, y: Curve, z: Curve; same code as ghpython_script
point_in_curve_2 = PointInCurve(Point=point, Curve=ghpython_script.a)  # -> Relationship, Point
cull_pattern_6 = CullPattern(List=list, CullPattern=point_in_curve_2.Relationship)  # -> flatten(List)
join_curves_2 = JoinCurves(Curves=flatten([cull_pattern_5, line]), Preserve=False)
division_2 = Division(A=A, B=area.Area)
point_in_curve_3 = PointInCurve(Point=point_2, Curve=graft(join_curves_2))  # -> Relationship, Point
division_3 = Division(A=Slider(15, range=0..50), B=division_2)
length_line = LengthLine(Line=cull_pattern_6, Strength=division_3)
expression_4 = Expression(x=point_in_curve_3.Relationship, Expression="if(x=2,1,0)")
cull_pattern_7 = CullPattern(List=list_2, CullPattern=expression_4)

spring = ClusterOutput(length_line)
list_3 = ClusterOutput(cull_pattern_7)
