# Grasshopper definition Bouza_Assignment.gh (Grasshopper 1.0.7)

coneradius = Slider(2889, range=0..10000)
brickdepth = Slider(203, range=0..300)
brickheight = Slider(57, range=0..300)
brickwidth = Slider(92, range=0..300)
coneheight = Slider(4250, range=0..10000)
define_brick = PythonScript(brickheight=brickheight, brickwidth=brickwidth, brickdepth=brickdepth)  # -> out, brick, brickplane, brickpoint
# ---------- define_brick: Python ----------
import rhinoscriptsyntax as rs
import Rhino.Geometry as rg

# define brick
brick = rg.Mesh()

# define the basic coordinates of the cube
point0 = rg.Point3d(0,0,0)
point1 = rg.Point3d(brickwidth,0,0)
point2 = rg.Point3d(brickwidth,brickdepth,0)
point3 = rg.Point3d(0,brickdepth,0)
point4 = rg.Point3d(0,0,brickheight)
point5 = rg.Point3d(brickwidth,0,brickheight)
point6 = rg.Point3d(brickwidth,brickdepth,brickheight)
point7 = rg.Point3d(0,brickdepth,brickheight)

# add all points to the mesh
points = [point0,point1,point2,point3,point4,point5,point6,point7]

# define a new list for the output points
outputpoints = []

# loop through what?
for point in points:
    outputpoints.append(point)
    brick.Vertices.Add(point)

# add all faces to the mesh
# faces are defined counter-clockwise
# bottom
brick.Faces.AddFace(0,1,2,3)
# top
brick.Faces.AddFace(4,5,6,7)
# sides
brick.Faces.AddFace(0,1,5,4)
brick.Faces.AddFace(1,2,6,5)
brick.Faces.AddFace(2,3,7,6)
brick.Faces.AddFace(3,0,4,7)

# output the mesh you constructed
mesh_output = brick

# create vector for brick orientation
point_a = rg.Point3d(0,(brickdepth/2),(brickheight/2))
point_b = rg.Point3d(brickwidth,(brickdepth/2),(brickheight/2))
point_c = rg.Point3d((brickwidth/2),(brickdepth/2),(brickheight/2))
brickvector = rs.VectorCreate(point_a, point_b)

# get plane at center point 
brickplane = rs.PlaneFromNormal(point_c, brickvector)

brickpoint = point_c
# ---------- end define_brick ----------
python_script = PythonScript(
    brickheight=brickheight,
    brickwidth=brickwidth,
    brickdepth=brickdepth,
    coneheight=coneheight,
    coneradius=coneradius,
    brick=define_brick.brick,
    brickplane=define_brick.brickplane,
    brickpoint=define_brick.brickpoint)  # -> out, a, b, c; inputs brickplane: Vector3d
# ---------- python_script: Python ----------
import rhinoscriptsyntax as rs
import Rhino.Geometry as rg
import Grasshopper as gh

# cone surface
plane = rs.PlaneFromPoints([0,0,0],[1,0,0],[0,1,0])
cone = rs.AddCone(plane, -coneheight, coneradius) 

# contour curves
startpoint = [0,0,(-coneheight+(brickheight/2))]
endpoint = [0,0,0]
curves = rs.AddSrfContourCrvs(cone,(startpoint,endpoint),interval = (brickheight))

# divide curve into points
points = []
for i in range(0,curves.Count):
    if rs.CurveLength(curves[i]) > (brickwidth + brickdepth):
        amount = rs.CurveLength(curves[i]) // (brickwidth + (brickdepth / 2))
        length = rs.CurveLength(curves[i]) / amount
        division_points = rs.DivideCurveLength(curves[i], length)
        points.append(division_points)

# get planes at points on curve 
planes = []
for i in range(0,points.Count):
    for j in range(0,points[i].Count):
        param = rs.CurveClosestPoint(curves[i],points[i][j])
        normal = rs.CurveTangent(curves[i], param)
        each_plane = rs.PlaneFromNormal(points[i][j], normal)
        planes.append(each_plane)

# create vectors for brick translation
vectors = []
for i in range(0,points.Count):
    for j in range(0,points[i].Count):
        each_vector = rs.VectorCreate(brickpoint, points[i][j])
        vectors.append(each_vector)

# move bricks to points
bricks = []
for i in range(0,points.Count):
    for j in range(0,points[i].Count):
        brick_copy = rg.Transform.PlaneToPlane(brick, planes[i][j])
        bricks.append(brick_copy)


a = curves
b = points
c = bricks
# ---------- end python_script ----------
