# Grasshopper definition Assignment3_IdilGumruk.gh (Grasshopper 1.0.7)

L = Slider(230, range=0..300)
W = Slider(76, range=0..300)
H = Slider(76, range=0..300)
curve = Curve(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)
curve_2 = Curve(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)
loft = Loft(
    Curves=[curve, curve_2],
    Options={Adjust=False, Closed=False, LoftEnds=0, LoftSimp=0, LoftType=0, Rebuild=10, Refit=0.01})
python_script = PythonScript(length=L, width=W, height=H, surface=loft)  # -> out, contours, b; inputs length: Int32, width: Int32, height: Int32, surface: Brep
# ---------- python_script: Python ----------
import rhinoscriptsyntax as rs
import Rhino.Geometry as rg
import Rhino 
import math as math
import scriptcontext as sc

#inputs // brick dimensions // wall surface

brickL=length
brickW=width
brickH=height

srf=surface

#bounding box for srf

Bbox=surface.GetBoundingBox(True)
H = Bbox.Diagonal.Z
H=int(H)

#contours

crv = rs.AddSrfContourCrvs(srf,([0,0,0], [0,0,H]), interval=brickH)
contours=crv

#divide contours into segments

points=[]
pointsAll=[]

for i in range(len(contours)) :
    points= rs.DivideCurveLength(contours[i],brickL,True,True)
    pointsAll.extend(points)

#bricks

    placedBricks=[]
    b=[]
    j=1
    for j in range(len(pointsAll)-2):
        x=[]
        y=[]
        z=[]
        rectangle=[]
        curve=[]
        plane=rg.Plane(pointsAll[j],rs.VectorCreate(pointsAll[j-1],pointsAll[j]),rg.Vector3d(0,0,1))
        x=pointsAll[j].X
        y=pointsAll[j].Y
        z=pointsAll[j].Z
        rectangle = rg.Rectangle3d(plane, brickL,brickW)
        rectangleCrv=rg.Rectangle3d.ToNurbsCurve(rectangle)
        curve = rs.AddLine((x+brickL,y,z), (x+brickL,y,z+brickH))
        placedBrick=rg.Extrusion.Create(rectangleCrv,brickH,True)
        placedBricks.append(placedBrick)
b=placedBricks
# ---------- end python_script ----------
brep = Brep(python_script.b)
