# Grasshopper definition Individual Cone Assignment_Ujjwal Dawar_4745620.gh (Grasshopper 1.0.7)

python_script = PythonScript()  # -> out, bricks; inputs x: Surface, y: Int32
# ---------- python_script: Python ----------
__author__ = "Ujjwal Dawar"
#this script has been refered from the script of 'Gautam Tanwar'
__version__ = "2018.9.20"

import rhinoscriptsyntax as rs
import Rhino.Geometry as rg


#construct cone 
pt1 = rs.AddPoint(0,0,0)
pt2 = rs.AddPoint(0,0,1)
height = 6000
radius = 1500
spiral1 = rs.AddSpiral(pt1,pt2,0,1,1000,3000)
spiral2 = rs.AddSpiral(pt1,pt2,0,1,30,90)
rs.MoveObject(spiral2,[0,0,height])

cone1 = rs.AddLoftSrf([spiral1,spiral2])

#Setting up the brick size and brick vertices
brickHeight = 75
brickLength = 225
brickWidth = 112.5
pointA = rs.AddPoint(0,0,0)
pointB = rs.AddPoint(brickLength,0,0)
pointC = rs.AddPoint(brickLength,brickWidth,0)
pointD = rs.AddPoint(0,brickWidth,0)
pointE = rs.AddPoint(0,0,brickHeight)
pointF = rs.AddPoint(brickLength,0,brickHeight)
pointG = rs.AddPoint(brickLength,brickWidth,brickHeight)
pointH = rs.AddPoint(0,brickWidth,brickHeight)
brickVertexes = [pointA, pointB, pointC, pointD, pointE, pointF, pointG, pointH]


#Set up of points in x, y and z plane for placement of bricks
contours=[]
contours = rs.AddSrfContourCrvs(cone1,([0,0,0], [0,0,6000]), interval=75)
length = 225
mycurvesA=[]
framesA=[]
i=0
while i < len(contours) :
    if i%2 == 0:
        rs.ExtendCurveLength(contours[i],2,0,0.5*brickLength)
    mycurves= rs.DivideCurveEquidistant(contours[i],length*1.25-((i*9)%7),True,True)
    mycurvesA.extend(mycurves)
    i+=1

#Placement of Bricks
mycurvesB = mycurvesA[1:]
numberOfBricks = len(mycurvesB)
bricks = []
n=0
while n<numberOfBricks:
    A = mycurvesA [n]
    B = mycurvesB [n]
    Distance = rs.Distance(A,B)
    if Distance < (225+100):
        translationVector = rs.VectorCreate(A,pointA)
        rs.MoveObjects(brickVertexes,translationVector)
        myBrick = rs.AddBox(brickVertexes)
        rAngle = rs.Angle(A,B)
        rs.RotateObject(myBrick, A, (rAngle[0]))
        bricks.append(myBrick)
    n +=1
# ---------- end python_script ----------
