# Grasshopper definition brick placement.gh (Grasshopper 1.0.7)
# plug-ins: Pufferfish, Wombat

brickw = Slider(0.3, range=0..1)
brickh = Slider(0.1, range=0..1)
brickd = Slider(0.3, range=0..1)
mesh = Mesh(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)
contour = Contour(Shape=mesh, Point=Point(0, 0, 0), Direction=Vector(0, 0, 1), Distance=Slider(1, range=0..1))
ghpython_script = GhPythonScript(mesh=mesh, brickW=brickw, brickH=brickh, brickD=brickd)  # -> out, contour, bW, endPoint; inputs mesh: Mesh
# ---------- ghpython_script: Python ----------
__author__ = "Idil Gumruk"
__version__ = "2018.11.05"

import rhinoscriptsyntax as rs
import Rhino
import Rhino.Geometry as rg
import scriptcontext as sc

contSt=rg.Point3d(0,0,0)
contEnd=rg.Point3d(0,0,1)

contour=mesh.CreateContourCurves(mesh,contSt,contEnd,2)

startPoint=contour[0].PointAtStart
bW=rg.Circle(startPoint,brickW)
bWCrv=rg.Circle.ToNurbsCurve(bW)
event=rs.CurveCurveIntersection(bWCrv,contour[0],2)
# ---------- end ghpython_script ----------
list_item = ListItem(List=flatten(contour), Index=0, Wrap=True)
point = Point(ghpython_script.endPoint)
panel = Panel(ghpython_script.endPoint)
end_points = EndPoints(Curve=list_item)  # -> Start, End
circle_cnr = CircleCNR(Center=end_points.Start, Normal=Vector(0, 0, 1), Radius=Slider(0.3, range=0..1))
curve_curve = CurveCurve(CurveA=list_item, CurveB=circle_cnr)  # -> Points, ParamsA, ParamsB
point_2 = Point(end_points.Start)
line = Line(StartPoint=point_2, EndPoint=curve_curve.Points)
midpoint = Midpoint(Curve=line)
circle_cnr_2 = CircleCNR(Center=midpoint, Normal="0,1,0", Radius=Slider(0.1, range=0..0.1))
mesh_curve = MeshCurve(Mesh=mesh, Curve=circle_cnr_2)  # -> Points, Faces
deconstruct = Deconstruct(Point=mesh_curve.Points)  # -> XComponent, YComponent, ZComponent
sort_list = SortList(Keys=deconstruct.ZComponent, ValuesValuesA=mesh_curve.Points)  # -> Keys, reverse(ValuesValuesA)
list_item_2 = ListItem(List=sort_list.ValuesValuesA, Index=0, Wrap=True)
panel_2 = Panel(sort_list.ValuesValuesA)
rectangle_3pt = Rectangle3Pt(PointA=point_2, PointB=curve_curve.Points, PointC=list_item_2)  # -> Rectangle, Length
surface = Surface(rectangle_3pt.Rectangle)
offset_surface = OffsetSurface(Surface=surface, Distance=Slider(0.3, range=0..1), BothSides=False, CreateSolid=True)
