# Grasshopper definition configuration of circlular spaces using kangaroo.gh (Grasshopper 1.0.7)
# plug-ins: Kangaroo2 Components

number_slider = Slider(4, range=1..10)
construct_point = ConstructPoint(XCoordinate=Slider(48, range=1..101), YCoordinate=Slider(71, range=1..101), ZCoordinate=0)
circle_cnr = CircleCNR(Center=construct_point, Normal=Vector(0, 0, 1), Radius=number_slider)

number_slider_2 = Slider(7, range=1..10)
construct_point_2 = ConstructPoint(XCoordinate=Slider(46, range=1..101), YCoordinate=Slider(48, range=1..101), ZCoordinate=0)
circle_cnr_2 = CircleCNR(Center=construct_point_2, Normal=Vector(0, 0, 1), Radius=number_slider_2)

number_slider_3 = Slider(3, range=1..10)
construct_point_3 = ConstructPoint(XCoordinate=Slider(59, range=1..101), YCoordinate=Slider(16, range=1..101), ZCoordinate=0)
circle_cnr_3 = CircleCNR(Center=construct_point_3, Normal=Vector(0, 0, 1), Radius=number_slider_3)

number_slider_4 = Slider(4, range=1..10)
construct_point_4 = ConstructPoint(XCoordinate=Slider(34, range=1..101), YCoordinate=Slider(19, range=1..101), ZCoordinate=0)
circle_cnr_4 = CircleCNR(Center=construct_point_4, Normal=Vector(0, 0, 1), Radius=number_slider_4)

number_slider_5 = Slider(4, range=1..10)
construct_point_5 = ConstructPoint(XCoordinate=Slider(9, range=1..101), YCoordinate=Slider(24, range=1..101), ZCoordinate=0)
circle_cnr_5 = CircleCNR(Center=construct_point_5, Normal=Vector(0, 0, 1), Radius=number_slider_5)

number_slider_6 = Slider(4, range=1..10)
construct_point_6 = ConstructPoint(XCoordinate=Slider(67, range=1..101), YCoordinate=Slider(66, range=1..101), ZCoordinate=0)
circle_cnr_6 = CircleCNR(Center=construct_point_6, Normal=Vector(0, 0, 1), Radius=number_slider_6)

number_slider_7 = Slider(4, range=1..10)
construct_point_7 = ConstructPoint(XCoordinate=Slider(22, range=1..101), YCoordinate=Slider(46, range=1..101), ZCoordinate=0)
circle_cnr_7 = CircleCNR(Center=construct_point_7, Normal=Vector(0, 0, 1), Radius=number_slider_7)

number_slider_8 = Slider(5, range=1..10)
construct_point_8 = ConstructPoint(XCoordinate=Slider(20, range=1..101), YCoordinate=Slider(73, range=1..101), ZCoordinate=0)
circle_cnr_8 = CircleCNR(Center=construct_point_8, Normal=Vector(0, 0, 1), Radius=number_slider_8)

line = Line(StartPoint=construct_point_8, EndPoint=circle_cnr_2)
line_2 = Line(StartPoint=construct_point_4, EndPoint=construct_point_2)
line_3 = Line(StartPoint=construct_point_2, EndPoint=construct_point)
line_4 = Line(StartPoint=construct_point_7, EndPoint=construct_point_2)
line_5 = Line(StartPoint=construct_point_2, EndPoint=construct_point_3)
line_6 = Line(StartPoint=construct_point_3, EndPoint=construct_point)
line_7 = Line(StartPoint=construct_point_6, EndPoint=construct_point_5)
line_8 = Line(StartPoint=construct_point_2, EndPoint=construct_point_5)
addition = Addition(A=number_slider_7, B=number_slider_2)
addition_2 = Addition(A=number_slider_4, B=number_slider_2)
addition_3 = Addition(A=number_slider_2, B=number_slider_3)
addition_4 = Addition(A=number_slider_2, B=number_slider)
addition_5 = Addition(A=number_slider_3, B=number_slider)
addition_6 = Addition(A=number_slider_2, B=number_slider_8)
addition_7 = Addition(A=number_slider_2, B=number_slider_5)
addition_8 = Addition(A=number_slider_6, B=number_slider_5)
length_line = LengthLine(Line=line_7, Length=addition_8, Strength=10)
length_line_2 = LengthLine(Line=line_6, Length=addition_5, Strength=10)
length_line_3 = LengthLine(Line=line_8, Length=addition_7, Strength=10)
length_line_4 = LengthLine(Line=line_2, Length=addition_2, Strength=10)
length_line_5 = LengthLine(Line=line_3, Length=addition_4, Strength=10)
length_line_6 = LengthLine(Line=line_4, Length=addition, Strength=10)
length_line_7 = LengthLine(Line=line_5, Length=addition_3, Strength=10)
anchor = Anchor(Point=construct_point_2, Strength=10000)
length_line_8 = LengthLine(Line=line, Length=addition_6, Strength=10)
show = Show(G=[construct_point_4, construct_point_2, construct_point_3, construct_point, construct_point_8, construct_point_7, construct_point_6, construct_point_5])
rads = Data([number_slider_4, number_slider_2, number_slider_3, number_slider, number_slider_8, number_slider_7, number_slider_6, number_slider_5])
point = Point([construct_point_5, construct_point_6, construct_point_7, construct_point_8, construct_point, construct_point_3, construct_point_2, construct_point_4])
python_script = PythonScript(x=point, y=rads)  # -> out, a, b; inputs x: list of Point3d, y: list of Int32
# ---------- python_script: Python ----------
import rhinoscriptsyntax as rs
import Rhino.Geometry as rg

NumOfRooms = len(y)
LinesLength=[]
Lines=[]
i=0
j=0
while i < NumOfRooms:
    j=i+1
    while j<NumOfRooms:
        value = y[i]+y[j]
        a=rg.Line(x[i],x[j])
        LinesLength.append(value)
        Lines.append(a)
        j=j+1
    i=i+1

a = Lines
b = LinesLength
# ---------- end python_script ----------
clamplength = ClampLength(Line=python_script.a, LowerLimit=python_script.b, UpperLimit=10000, Strength=1)
merge = Merge(
    Data1=show,
    Data2=anchor,
    Data3=clamplength,
    Data5=[length_line_2, length_line_5, length_line_7, length_line_4, length_line_8, length_line_6, length_line_3, length_line])
bouncysolver = BouncySolver(GoalObjects=merge, Reset=Button(), Threshold=1e-15, Tolerance=0.01, Damping=0.99, Iterations=100, On=Toggle(True))  # -> I, V, O
sub_list = SubList(List=bouncysolver.O, Domain=Domain(0, 7), Wrap=True)  # -> List, Index
sub_list_2 = SubList(List=bouncysolver.O, Domain=Domain(0, 3), Wrap=True)  # -> List, Index
circle_cnr_9 = CircleCNR(
    Center=sub_list.List,
    Normal=Vector(0, 0, 1),
    Radius=[number_slider_4, number_slider_2, number_slider_3, number_slider, number_slider_8, number_slider_7, number_slider_6, number_slider_5])
shift_list = ShiftList(List=circle_cnr_9, Shift=1, Wrap=True)
curve_closest_point = CurveClosestPoint(Point=sub_list.List, Curve=circle_cnr_9)  # -> Point, Parameter, Distance
curve_curve = CurveCurve(CurveA=circle_cnr_9, CurveB=shift_list)  # -> Points, ParamsA, ParamsB
