# Grasshopper definition configuration of rectangular spaces using galapogas.gh (Grasshopper 0.9.76)

number_slider = Slider(4, range=-10..20)
number_slider_2 = Slider(6, range=-10..20)
multiplication = Multiplication(A=number_slider_2, B=1000)
multiplication_2 = Multiplication(A=number_slider, B=1000)
construct_point = ConstructPoint(XCoordinate=multiplication_2, YCoordinate=multiplication, ZCoordinate=0)
plane_origin = PlaneOrigin(Base=construct_point, Origin=construct_point)
multiplication_3 = Multiplication(A=Slider(2, range=0..10), B=1000)
multiplication_4 = Multiplication(A=Slider(2, range=0..10), B=1000)
rectangle = Rectangle(Plane=plane_origin, XSize=multiplication_3, YSize=multiplication_4, Radius=0)  # -> Rectangle, Length
area = Area(Geometry=rectangle.Rectangle)  # -> Area, Centroid
text_tag = TextTag(Location=area.Centroid, Text="WC")

number_slider_3 = Slider(6, range=-10..20)
number_slider_4 = Slider(4, range=-10..20)
multiplication_5 = Multiplication(A=number_slider_3, B=1000)
multiplication_6 = Multiplication(A=number_slider_4, B=1000)
construct_point_2 = ConstructPoint(XCoordinate=multiplication_5, YCoordinate=multiplication_6, ZCoordinate=0)
plane_origin_2 = PlaneOrigin(Base=construct_point_2, Origin=construct_point_2)
multiplication_7 = Multiplication(A=Slider(4, range=0..10), B=1000)
multiplication_8 = Multiplication(A=Slider(4, range=0..10), B=1000)
rectangle_2 = Rectangle(Plane=plane_origin_2, XSize=multiplication_7, YSize=multiplication_8, Radius=0)  # -> Rectangle, Length
area_2 = Area(Geometry=rectangle_2.Rectangle)  # -> Area, Centroid
text_tag_2 = TextTag(Location=area_2.Centroid, Text="Bedroom")

multiplication_9 = Multiplication(A=Slider(0, range=0..10), B=1000)
multiplication_10 = Multiplication(A=Slider(0, range=0..10), B=1000)
construct_point_3 = ConstructPoint(XCoordinate=multiplication_9, YCoordinate=multiplication_10, ZCoordinate=0)
plane_origin_3 = PlaneOrigin(Base=construct_point_3, Origin=construct_point_3)
multiplication_11 = Multiplication(A=Slider(6, range=0..10), B=1000)
multiplication_12 = Multiplication(A=Slider(6, range=0..10), B=1000)
rectangle_3 = Rectangle(Plane=plane_origin_3, XSize=multiplication_11, YSize=multiplication_12, Radius=0)  # -> Rectangle, Length
area_3 = Area(Geometry=rectangle_3.Rectangle)  # -> Area, Centroid
text_tag_3 = TextTag(Location=area_3.Centroid, Text="Courtyard")

number_slider_5 = Slider(6, range=-10..20)
number_slider_6 = Slider(0, range=-10..20)
multiplication_13 = Multiplication(A=number_slider_5, B=1000)
multiplication_14 = Multiplication(A=number_slider_6, B=1000)
construct_point_4 = ConstructPoint(XCoordinate=multiplication_13, YCoordinate=multiplication_14, ZCoordinate=0)
plane_origin_4 = PlaneOrigin(Base=construct_point_4, Origin=construct_point_4)
multiplication_15 = Multiplication(A=Slider(4, range=0..10), B=1000)
multiplication_16 = Multiplication(A=Slider(4, range=0..10), B=1000)
rectangle_4 = Rectangle(Plane=plane_origin_4, XSize=multiplication_15, YSize=multiplication_16, Radius=0)  # -> Rectangle, Length
area_4 = Area(Geometry=rectangle_4.Rectangle)  # -> Area, Centroid
text_tag_4 = TextTag(Location=area_4.Centroid, Text="Ivan")

number_slider_7 = Slider(-4, range=-10..20)
number_slider_8 = Slider(1, range=-10..20)
multiplication_17 = Multiplication(A=number_slider_7, B=1000)
multiplication_18 = Multiplication(A=number_slider_8, B=1000)
construct_point_5 = ConstructPoint(XCoordinate=multiplication_17, YCoordinate=multiplication_18, ZCoordinate=0)
plane_origin_5 = PlaneOrigin(Base=construct_point_5, Origin=construct_point_5)
multiplication_19 = Multiplication(A=Slider(4, range=0..10), B=1000)
multiplication_20 = Multiplication(A=Slider(4, range=0..10), B=1000)
rectangle_5 = Rectangle(Plane=plane_origin_5, XSize=multiplication_19, YSize=multiplication_20, Radius=0)  # -> Rectangle, Length
area_5 = Area(Geometry=rectangle_5.Rectangle)  # -> Area, Centroid
text_tag_5 = TextTag(Location=area_5.Centroid, Text="Kitchen")

solid_union = SolidUnion(Breps=[rectangle_3.Rectangle, rectangle_5.Rectangle, rectangle_4.Rectangle, rectangle.Rectangle, rectangle_2.Rectangle])
area_6 = Area(Geometry=solid_union)  # -> Area, Centroid
mass_addition = MassAddition(Input=area_6.Area)  # -> Result, PartialResults
panel = Panel(mass_addition.Result)

line = Line(StartPoint=area_3.Centroid, EndPoint=area.Centroid)
line_2 = Line(StartPoint=area_3.Centroid, EndPoint=area_5.Centroid)
line_3 = Line(StartPoint=area_3.Centroid, EndPoint=area_2.Centroid)
line_4 = Line(StartPoint=area_3.Centroid, EndPoint=area_4.Centroid)
line_5 = Line(StartPoint=area.Centroid, EndPoint=area_2.Centroid)
line_6 = Line(StartPoint=area_4.Centroid, EndPoint=area_2.Centroid)
length = Length(Curve=line_2)
length_2 = Length(Curve=line_4)
length_3 = Length(Curve=line)
length_4 = Length(Curve=line_3)
length_5 = Length(Curve=line_5)
length_6 = Length(Curve=line_6)
mass_addition_2 = MassAddition(Input=[length, length_2, length_3, length_4, length_5, length_6])  # -> Result, PartialResults

mass_addition_3 = MassAddition(Input=[area_3.Area, area_5.Area, area_4.Area, area.Area, area_2.Area])  # -> Result, PartialResults
panel_2 = Panel(mass_addition_3.Result)

brep_edges = BrepEdges(Brep=solid_union)  # -> Naked, Interior, NonManifold
curve = Curve(brep_edges.Naked)
join_curves = JoinCurves(Curves=curve, Preserve=False)
length_7 = Length(Curve=join_curves)  # -> flatten(Length)
mass_addition_4 = MassAddition(Input=length_7)  # -> Result, PartialResults
division = Division(A=mass_addition_4.Result, B=10)
addition = Addition(A=division, B=mass_addition_2.Result)

panel_3 = Panel(mass_addition_2.Result)

subtraction = Subtraction(A=mass_addition_3.Result, B=mass_addition.Result)
expression = Expression(x=subtraction, Expression="If(x=0, 1, 10000)")

panel_4 = Panel(division)
multiplication_21 = Multiplication(A=mass_addition_2.Result, B=expression)
galapagos = Galapagos(
    fitness=multiplication_21,
    gene=[number_slider_7, number_slider_8, number_slider_5, number_slider_6, number_slider, number_slider_2, number_slider_3, number_slider_4])
