# Grasshopper definition structure alternative approach.gh (Grasshopper 1.0.7)
# plug-ins: Karamba, Pufferfish, Kangaroo2 Components, TT Toolbox

courtyard_location = ConstructPoint(XCoordinate=Slider(20, range=0..25), YCoordinate=Slider(20, range=0..25), ZCoordinate=0)

# ----
# COURTYARD
number_slider = Slider(7.7, range=0..15)
number_slider_2 = Slider(10, range=0..15)
division = Division(A=number_slider, B=Slider(-5, range=-5..1))
division_2 = Division(A=number_slider_2, B=Slider(-5, range=-5..1))
vector_xyz = VectorXYZ(XComponent=division, YComponent=division_2, ZComponent=0)  # -> Vector, Length
move = Move(Geometry=courtyard_location, Motion=vector_xyz.Vector)  # -> Geometry, Transform
rectangle = Rectangle(Plane=move.Geometry, XSize=number_slider, YSize=number_slider_2, Radius=0)  # -> Rectangle, Length

# ----
# MAIN AXIS
number_slider_3 = Slider(210, range=0..360)
unit_x = UnitX(Factor=1)
rotate = Rotate(Geometry=unit_x, Angle=degrees(number_slider_3), Plane=PlaneXY(0, 0, 0))  # -> Geometry, Transform
line_sdl = LineSDL(Start=courtyard_location, Direction=unit_x, Length=Slider(25, range=0..30))
line_sdl_2 = LineSDL(Start=courtyard_location, Direction=rotate.Geometry, Length=Slider(25, range=0..30))
join_curves = JoinCurves(Curves=[line_sdl_2, line_sdl], Preserve=False)
number_slider_4 = Slider(1, range=0..2)
multiplication = Multiplication(A=number_slider_4, B=-1)
offset_curve = OffsetCurve(Curve=join_curves, Distance=[number_slider_4, multiplication], Plane=PlaneXY(0, 0, 0), Corners=1)

trim_with_region = TrimWithRegion(Curve=offset_curve, Region=rectangle.Rectangle)  # -> Inside, flatten(Outside)
curve = Curve(trim_with_region.Outside)
list_item = ListItem(List=curve, Index=Slider(3, range=0..3), Wrap=True)

number_slider_5 = Slider(3, range=0..10)
curve_curve = CurveCurve(CurveA=list_item, CurveB=rectangle.Rectangle)  # -> Points, ParamsA, ParamsB
vector_xyz_2 = VectorXYZ(XComponent=number_slider_5, YComponent=number_slider_5, ZComponent=0)  # -> Vector, Length
move_2 = Move(Geometry=curve_curve.Points, Motion=vector_xyz_2.Vector)  # -> Geometry, Transform
circle = Circle(Plane=move_2.Geometry, Radius=number_slider_5)

number_slider_6 = Slider(1.35, range=0..10)
expression = Expression(x=number_slider_5, y=number_slider_6, Expression="x+Sqrt((x+y)*(x+y)-(x-y)*(x-y))")
vector_xyz_3 = VectorXYZ(XComponent=expression, YComponent=number_slider_6, ZComponent=0)  # -> Vector, Length
move_3 = Move(Geometry=curve_curve.Points, Motion=vector_xyz_3.Vector)  # -> Geometry, Transform
circle_2 = Circle(Plane=move_3.Geometry, Radius=number_slider_6)

number_slider_7 = Slider(3, range=0..10)
expression_2 = Expression(x=number_slider_6, z=expression, y=number_slider_7, Expression="z+Sqrt((x+y)*(x+y)-(x-y)*(x-y))")
vector_xyz_4 = VectorXYZ(XComponent=expression_2, YComponent=number_slider_7, ZComponent=0)  # -> Vector, Length
move_4 = Move(Geometry=curve_curve.Points, Motion=vector_xyz_4.Vector)  # -> Geometry, Transform
circle_3 = Circle(Plane=move_4.Geometry, Radius=number_slider_7)

number_slider_8 = Slider(2, range=0..6)
addition = Addition(A=number_slider_5, B=number_slider_8)
addition_2 = Addition(A=number_slider_7, B=number_slider_8)
circle_4 = Circle(Plane=move_2.Geometry, Radius=addition)
circle_5 = Circle(Plane=move_4.Geometry, Radius=addition_2)
curve_curve_2 = CurveCurve(CurveA=circle_4, CurveB=circle_5)  # -> Points, ParamsA, ParamsB
deconstruct = Deconstruct(Point=curve_curve_2.Points)  # -> XComponent, YComponent, ZComponent
sort_list = SortList(Keys=deconstruct.YComponent, ValuesValuesA=reverse(curve_curve_2.Points))  # -> Keys, ValuesValuesA
list_item_2 = ListItem(List=sort_list.ValuesValuesA, Index=0, Wrap=True)
circle_6 = Circle(Plane=list_item_2, Radius=number_slider_8)

number_slider_9 = Slider(3, range=0..10)
number_slider_10 = Slider(4, range=0..10)
area = Area(Geometry=circle)  # -> Area, Centroid
division_3 = Division(A=number_slider_10, B=2)
division_4 = Division(A=number_slider_9, B=2)
vector_xyz_5 = VectorXYZ(XComponent=expr("x*-1", division_4), YComponent=expr("x*-1", division_3), ZComponent=0)  # -> Vector, Length
move_5 = Move(Geometry=area.Centroid, Motion=vector_xyz_5.Vector)  # -> Geometry, Transform
rectangle_2 = Rectangle(Plane=move_5.Geometry, XSize=number_slider_9, YSize=number_slider_10, Radius=0)  # -> Rectangle, Length

number_slider_11 = Slider(2, range=0..10)
number_slider_12 = Slider(2, range=0..10)
area_2 = Area(Geometry=circle_2)  # -> Area, Centroid
division_5 = Division(A=number_slider_11, B=2)
division_6 = Division(A=number_slider_12, B=2)
vector_xyz_6 = VectorXYZ(XComponent=expr("x*-1", division_5), YComponent=expr("x*-1", division_6), ZComponent=0)  # -> Vector, Length
move_6 = Move(Geometry=area_2.Centroid, Motion=vector_xyz_6.Vector)  # -> Geometry, Transform
rectangle_3 = Rectangle(Plane=move_6.Geometry, XSize=number_slider_11, YSize=number_slider_12, Radius=0)  # -> Rectangle, Length

number_slider_13 = Slider(4, range=0..10)
number_slider_14 = Slider(4, range=0..10)
area_3 = Area(Geometry=circle_3)  # -> Area, Centroid
division_7 = Division(A=number_slider_13, B=2)
division_8 = Division(A=number_slider_14, B=2)
vector_xyz_7 = VectorXYZ(XComponent=expr("x*-1", division_7), YComponent=expr("x*-1", division_8), ZComponent=0)  # -> Vector, Length
move_7 = Move(Geometry=area_3.Centroid, Motion=vector_xyz_7.Vector)  # -> Geometry, Transform
rectangle_4 = Rectangle(Plane=move_7.Geometry, XSize=number_slider_13, YSize=number_slider_14, Radius=0)  # -> Rectangle, Length

deconstruct_brep = DeconstructBrep(Brep=rectangle_2.Rectangle)  # -> Faces, Edges, Vertices
deconstruct_brep_2 = DeconstructBrep(Brep=rectangle_3.Rectangle)  # -> Faces, Edges, Vertices
deconstruct_brep_3 = DeconstructBrep(Brep=rectangle_4.Rectangle)  # -> Faces, Edges, Vertices
point = Point(deconstruct_brep.Vertices)
point_2 = Point(deconstruct_brep_2.Vertices)
point_3 = Point(deconstruct_brep_3.Vertices)
curve_2 = Curve([circle_3, circle, circle_2, circle_6])
geometry = Geometry([rectangle_2.Rectangle, rectangle_3.Rectangle, rectangle_4.Rectangle])
geometry_2 = Geometry([geometry, curve_2])

# ----
# RADIUS
female_showers = Number(number_slider_7)
male_showers = Number(number_slider_5)
wash = Number(number_slider_6)
building_utility = Number(number_slider_8)

number_slider_15 = Slider(17, range=0..100)
mesh_surface = MeshSurface(
    Surface=<geometry referenced from the Rhino model>,
    UCount=number_slider_15,
    VCount=number_slider_15,
    Overhang=True,
    Equalize=False)
deconstruct_mesh = DeconstructMesh(Mesh=mesh_surface)  # -> Vertices, Faces, Colours, Normals
point_4 = Point([<point referenced from the Rhino model> x3])
distance = Distance(PointA=graft(deconstruct_mesh.Vertices), PointB=point_4)
sort_list_2 = SortList(Keys=distance)  # -> Keys, ValuesValuesA
list_item_3 = ListItem(List=sort_list_2.Keys, Index=0, Wrap=True)
point_5 = Point(deconstruct_mesh.Vertices)
number = Number(flatten(list_item_3))
bounds = Bounds(Numbers=number)
deconstruct_domain = DeconstructDomain(Domain=bounds)  # -> Start, End
gradient = Gradient(
    LowerLimit=deconstruct_domain.Start,
    UpperLimit=deconstruct_domain.End,
    Parameter=number,
    stops=[0: RGB(234, 38, 0), 0.25: RGB(234, 126, 0), 0.5: RGB(254, 244, 84), 0.75: RGB(173, 203, 249), 1: RGB(75, 107, 169)])
cloud_display = CloudDisplay(Points=point_5, Colours=gradient, Size=Slider(0.2, range=0..1), SpriteType=0)

area_4 = Area(Geometry=curve_2)  # -> Area, Centroid
merge = Merge(Data1=female_showers, Data2=male_showers, Data3=wash, Data4=building_utility)

bounding_rectangle = BoundingRectangle(Geometry=flatten(geometry_2), Plane=PlaneXY(0, 0, 0), Axis=0, Slide=0, Union=True)
merge_2 = Merge(Data1=point, Data2=point_2, Data3=point_3)  # -> simplify(Result)
mesh_breps_karamba3d = MeshBrepsKaramba3D(
    Brep=bounding_rectangle,
    InclusionPoints=area_4.Centroid,
    MeshResolution=Slider(0.27, range=0..1),
    EdgeRefinementFactor=0.67,
    PointReduction=False,
    SmoothingStepSize=0,
    SmoothingIterations=5)  # -> Mesh, Info
area_5 = Area(Geometry=curve_2)  # -> Area, Centroid
point_6 = Point(flatten(area_5.Centroid))

list_item_4 = ListItem(List=mesh_breps_karamba3d.Mesh, Index=1, Wrap=True)
mesh = Mesh(list_item_4)

deconstruct_mesh_2 = DeconstructMesh(Mesh=list_item_4)  # -> Vertices, Faces, Colours, Normals
distance_2 = Distance(PointA=graft(deconstruct_mesh_2.Vertices), PointB=point_6)  # -> simplify(Distance)
point_7 = Point(deconstruct_mesh_2.Vertices)

division_9 = Division(A=distance_2, B=merge)

distance_3 = Distance(PointA=graft(deconstruct_mesh_2.Vertices), PointB=merge_2)  # -> simplify(Distance)
panel = Panel(distance_3)
sort_list_3 = SortList(Keys=distance_3)  # -> Keys, ValuesValuesA; disabled
list_item_5 = ListItem(List=sort_list_3.Keys, Index=0, Wrap=True)  # disabled
number_2 = Number(flatten(list_item_5))  # disabled

sort_list_4 = SortList(Keys=division_9)  # -> Keys, flatten(ValuesValuesA)
list_item_6 = ListItem(List=sort_list_4.Keys, Index=0, Wrap=True)
number_3 = Number(flatten(list_item_6))
bounds_2 = Bounds(Numbers=[number_3, number_2])
# WHERE THE SUPPORT STRUCTURES SHOULD BE
deconstruct_domain_2 = DeconstructDomain(Domain=bounds_2)  # -> Start, End
gradient_2 = Gradient(
    LowerLimit=deconstruct_domain_2.End,
    UpperLimit=deconstruct_domain_2.Start,
    Parameter=number_3,
    stops=[0: RGB(234, 38, 0), 0.25: RGB(234, 126, 0), 0.5: RGB(254, 244, 84), 0.75: RGB(173, 203, 249), 1: RGB(75, 107, 169)])
cloud_display_2 = CloudDisplay(Points=point_7, Colours=gradient_2, Size=Slider(0.2, range=0..1), SpriteType=0)

multiplication_2 = Multiplication(A=number_3, B=number_2)

# ----
# ANCHOR POINTS
merge_3 = Merge(Data1=simplify(graft(point_7)), Data2=list_item_6)
list_item_7 = ListItem(List=merge_3, Index=0, Wrap=True)
list_item_8 = ListItem(List=merge_3, Index=1, Wrap=True)  # -> flatten(Item)
average = Average(Input=list_item_8)
multiplication_3 = Multiplication(A=average, B=Slider(1.2, range=0..2))
larger_than = LargerThan(FirstNumber=list_item_8, SecondNumber=multiplication_3)  # -> LargerThan, OrEqualTo
cull_pattern = CullPattern(List=flatten(list_item_7), CullPattern=larger_than.LargerThan)
point_8 = Point(cull_pattern)

# ----
# STRUCTURE
mesh_curve = MeshCurve(Mesh=mesh, Curve=offset_curve)  # -> Points, Faces
remove_duplicate_points = RemoveDuplicatePoints(InputPoints=mesh_curve.Points, Tolerance=0.001)  # -> OutputPoints, FirstPointIndexes
panel_2 = Panel("""True
False""")
sort_list_5 = SortList(Keys=remove_duplicate_points.OutputPoints, ValuesValuesA=remove_duplicate_points.OutputPoints)  # -> Keys, ValuesValuesA
cull_pattern_2 = CullPattern(List=sort_list_5.ValuesValuesA, CullPattern=panel_2)
point_9 = Point(cull_pattern_2)
nakedvertices = NakedVertices(Mesh=mesh)  # -> ClothedIndex, NakedIndex, ClothedPts, NakedPts
unit_z = UnitZ(Factor=Slider(0.1, range=0..1))
load = Load(Point=nakedvertices.ClothedPts, ForceVector=unit_z)
edgelengths = EdgeLengths(Mesh=mesh, LengthFactor=Slider(0, range=0..1), Strength=1)
show = Show(G=mesh)
anchor = Anchor(Point=point_8, Strength=10000)
solver = Solver(GoalObjects=[show, edgelengths, anchor, load], Reset=Button(), Threshold=1e-15, Tolerance=0.01, On=Toggle(True))  # -> I, V, flatten(O)
clean_tree = CleanTree(RemoveNulls=True, RemoveInvalid=False, RemoveEmpty=False, Tree=solver.O)

unit_z_2 = UnitZ(Factor=Slider(3, range=0..10))
move_8 = Move(Geometry=point_9, Motion=unit_z_2)  # -> Geometry, Transform
