# Grasshopper definition 5.11_AnchorWall_BIG__MEDIUM_SMALL_Bricked.gh (Grasshopper 1.0.7)
# plug-ins: Pufferfish, Weaverbird

brick_width = Slider(0, range=0..1)
brick_length = Slider(0.3, range=0..1)
mortar_gap = Slider(0.017, range=0..2)
brick_height = Slider(0.12, range=0..1)

# ----
# MEDIUM Anchor wall
plug_curve = Curve([<curve referenced from the Rhino model> x4])
loft_options = LoftOptions(Closed=False, Adjust=False, Rebuild=0, Refit=0, Type=0)

list_length = ListLength(List=plug_curve)
series = Series(Start=0, Step=1, Count=list_length)

# ----
# Adjust Lenght
evaluate_length = EvaluateLength(Curve=plug_curve, Length=0.5, Normalized=True)  # -> Point, Tangent, Parameter
deconstruct_arc = DeconstructArc(Arc=plug_curve)  # -> BasePlane, Radius, Angle
center = Point(deconstruct_arc.BasePlane)
line = Line(StartPoint=evaluate_length.Point, EndPoint=center)
bottom_lenght = Slider(4, range=0..4.8)
extend_curve = ExtendCurve(Curve=line, Type=0, Start=0, End=3)
divide_length = DivideLength(Curve=extend_curve, Length=bottom_lenght)  # -> flatten(Points), Tangents, Parameters

# ----
# Control
# Adjust EACH half of Width from CenterAxis
dispatch = Dispatch(List=divide_length.Points, DispatchPattern=[True, False])  # -> ListA, ListB
list_item = ListItem(List=dispatch.ListA, Index=series, Wrap=True)  # -> graft(Item)
list_item_2 = ListItem(List=dispatch.ListB, Index=series, Wrap=True)  # -> graft(Item)
line_2 = Line(StartPoint=list_item, EndPoint=list_item_2)
length = Length(Curve=line_2)
offset_curve = OffsetCurve(Curve=line_2, Distance=Slider(-0.5, range=-1..1), Plane=PlaneXY(0, 0, 0), Corners=1)
offset_curve_2 = OffsetCurve(Curve=line_2, Distance=Slider(0.5, range=-1..1), Plane=PlaneXY(0, 0, 0), Corners=1)
panel = Panel(length)
end_points = EndPoints(Curve=[offset_curve, offset_curve_2])  # -> Start, graft(End)
curve = Curve(flatten([offset_curve, offset_curve_2]))
multiple_curves = MultipleCurves(Curves=[plug_curve, curve])  # -> flatten(Points), IndexA, IndexB, ParamA, ParamB
dispatch_2 = Dispatch(List=end_points.End, DispatchPattern=[True, False])  # -> ListA, ListB
shatter = Shatter(Curve=plug_curve, Parameters=[multiple_curves.ParamA, multiple_curves.ParamB])
point_in_curves = PointInCurves(Point=multiple_curves.Points, Curves=plug_curve)  # -> Relationship, Index, Point
list_item_3 = ListItem(List=dispatch_2.ListA, Index=0, Wrap=True)  # -> flatten(Item)
dispatch_3 = Dispatch(List=list_item_3, DispatchPattern=[True, False])  # -> graft(ListA), graft(ListB)
dispatch_4 = Dispatch(List=point_in_curves.Point, DispatchPattern=[True, False])  # -> graft(ListA), graft(ListB)
dispatch_5 = Dispatch(List=shatter, DispatchPattern=[True, False])  # -> graft(ListA), graft(ListB)
startpoints_wall = Point(dispatch_4.ListB)
startpoints_wall_2 = Point(dispatch_4.ListA)
endpoints_anchorwall = Point(dispatch_3.ListA)
endpoints_anchorwall_2 = Point(dispatch_3.ListB)
line_3 = Line(StartPoint=startpoints_wall, EndPoint=endpoints_anchorwall_2)
line_4 = Line(StartPoint=startpoints_wall_2, EndPoint=endpoints_anchorwall)
line_5 = Line(StartPoint=endpoints_anchorwall, EndPoint=endpoints_anchorwall_2)
curve_2 = Curve(dispatch_5.ListB)

# ----
# Adjust Height
# Adjust Corners
layout_bottom = Curve(flatten([line_3, line_4, line_5, curve_2]))
join_curves = JoinCurves(Curves=layout_bottom, Preserve=False)
height = Slider(6, range=0..10)
radius_fillet = Slider(0.4, range=0..1)
close_curve = CloseCurve(Curve=join_curves, CloseType=0, Bulge=0.5, Tolerance=0)  # -> Closed, ResultBoolean
unit_z = UnitZ(Factor=height)
fillet = Fillet(Curve=close_curve.Closed, Radius=radius_fillet)  # -> flatten(Curve)
move = Move(Geometry=fillet, Motion=unit_z)  # -> Geometry, Transform

control_points = ControlPoints(Curve=fillet)  # -> Points, Weights, Knots
dispatch_6 = Dispatch(
    List=control_points.Points,
    DispatchPattern=[False, False, False, True, False, False, False, True, False, False, False, True, False, False, False, True])  # -> ListA, ListB
dispatch_7 = Dispatch(List=dispatch_6.ListA, DispatchPattern=[True, False])  # -> ListA, ListB
dispatch_8 = Dispatch(List=dispatch_7.ListB, DispatchPattern=[True, False])  # -> ListA, ListB
dispatch_9 = Dispatch(List=dispatch_7.ListA, DispatchPattern=[True, False])  # -> ListA, ListB
distance = Distance(PointA=dispatch_8.ListA, PointB=dispatch_8.ListB)
distance_2 = Distance(PointA=dispatch_9.ListA, PointB=dispatch_9.ListB)
smaller_than = SmallerThan(FirstNumber=2, SecondNumber=distance_2)  # -> flatten(SmallerThan), OrEqualTo
smaller_than_2 = SmallerThan(FirstNumber=2, SecondNumber=distance)  # -> flatten(SmallerThan), OrEqualTo

# ----
# Adjust Layout Scale Factor
# Adjust Endpoints as Scale Origin
cull_pattern = CullPattern(List=flatten(dispatch_9.ListA), CullPattern=smaller_than.SmallerThan)
cull_pattern_2 = CullPattern(List=flatten(dispatch_8.ListA), CullPattern=smaller_than_2.SmallerThan)
cull_pattern_3 = CullPattern(List=flatten(dispatch_9.ListB), CullPattern=smaller_than.SmallerThan)
cull_pattern_4 = CullPattern(List=flatten(dispatch_8.ListB), CullPattern=smaller_than_2.SmallerThan)
scale_top_in_relation_to_bottom = Slider(0.67, range=0..1)
point = Point(flatten([cull_pattern, cull_pattern_4]))
curve_nearest_object = CurveNearestObject(Curve=fillet, Geometry=point)  # -> PointA, PointB, Index
scale_nu = ScaleNU(
    Geometry=move.Geometry,
    Plane=curve_nearest_object.PointA,
    ScaleX=scale_top_in_relation_to_bottom,
    ScaleY=scale_top_in_relation_to_bottom,
    ScaleZ=1)  # -> Geometry, Transform

top = Curve(graft(scale_nu.Geometry))
bottom = Curve(graft(fillet))
loft = Loft(Curves=[bottom, top], Options=loft_options)

# ----
# BIG Anchor wall
plug_curve_2 = Curve([<curve referenced from the Rhino model> x6])
loft_options_2 = LoftOptions(Closed=False, Adjust=False, Rebuild=0, Refit=0, Type=0)

list_length_2 = ListLength(List=plug_curve_2)
series_2 = Series(Start=0, Step=1, Count=list_length_2)

# ----
# Adjust Lenght
evaluate_length_2 = EvaluateLength(Curve=plug_curve_2, Length=0.5, Normalized=True)  # -> Point, Tangent, Parameter
deconstruct_arc_2 = DeconstructArc(Arc=plug_curve_2)  # -> BasePlane, Radius, Angle
center_2 = Point(deconstruct_arc_2.BasePlane)
line_6 = Line(StartPoint=evaluate_length_2.Point, EndPoint=center_2)
bottom_lenght_2 = Slider(4.8, range=0..4.8)
extend_curve_2 = ExtendCurve(Curve=line_6, Type=0, Start=0, End=3)
divide_length_2 = DivideLength(Curve=extend_curve_2, Length=bottom_lenght_2)  # -> flatten(Points), Tangents, Parameters

# ----
# Control
# Adjust EACH half of Width from CenterAxis
dispatch_10 = Dispatch(List=divide_length_2.Points, DispatchPattern=[True, False])  # -> ListA, ListB
list_item_4 = ListItem(List=dispatch_10.ListA, Index=series_2, Wrap=True)  # -> graft(Item)
list_item_5 = ListItem(List=dispatch_10.ListB, Index=series_2, Wrap=True)  # -> graft(Item)
line_7 = Line(StartPoint=list_item_4, EndPoint=list_item_5)
length_2 = Length(Curve=line_7)
offset_curve_3 = OffsetCurve(Curve=line_7, Distance=Slider(-0.5, range=-1..1), Plane=PlaneXY(0, 0, 0), Corners=1)
offset_curve_4 = OffsetCurve(Curve=line_7, Distance=Slider(0.5, range=-1..1), Plane=PlaneXY(0, 0, 0), Corners=1)
panel_2 = Panel(length_2)
end_points_2 = EndPoints(Curve=[offset_curve_3, offset_curve_4])  # -> Start, graft(End)
curve_3 = Curve(flatten([offset_curve_3, offset_curve_4]))
multiple_curves_2 = MultipleCurves(Curves=[plug_curve_2, curve_3])  # -> flatten(Points), IndexA, IndexB, ParamA, ParamB
dispatch_11 = Dispatch(List=end_points_2.End, DispatchPattern=[True, False])  # -> ListA, ListB
shatter_2 = Shatter(Curve=plug_curve_2, Parameters=[multiple_curves_2.ParamA, multiple_curves_2.ParamB])
point_in_curves_2 = PointInCurves(Point=multiple_curves_2.Points, Curves=plug_curve_2)  # -> Relationship, Index, Point
list_item_6 = ListItem(List=dispatch_11.ListA, Index=0, Wrap=True)  # -> flatten(Item)
dispatch_12 = Dispatch(List=list_item_6, DispatchPattern=[True, False])  # -> graft(ListA), graft(ListB)
dispatch_13 = Dispatch(List=point_in_curves_2.Point, DispatchPattern=[True, False])  # -> graft(ListA), graft(ListB)
dispatch_14 = Dispatch(List=shatter_2, DispatchPattern=[True, False])  # -> graft(ListA), graft(ListB)
startpoints_wall_3 = Point(dispatch_13.ListB)
startpoints_wall_4 = Point(dispatch_13.ListA)
endpoints_anchorwall_3 = Point(dispatch_12.ListB)
endpoints_anchorwall_4 = Point(dispatch_12.ListA)
line_8 = Line(StartPoint=startpoints_wall_3, EndPoint=endpoints_anchorwall_3)
line_9 = Line(StartPoint=startpoints_wall_4, EndPoint=endpoints_anchorwall_4)
line_10 = Line(StartPoint=endpoints_anchorwall_4, EndPoint=endpoints_anchorwall_3)
curve_4 = Curve(dispatch_14.ListB)

# ----
# Adjust Height
# Adjust Corners
layout_bottom_2 = Curve(flatten([line_8, line_9, line_10, curve_4]))
join_curves_2 = JoinCurves(Curves=layout_bottom_2, Preserve=False)
height_2 = Slider(8, range=0..10)
radius_fillet_2 = Slider(0.4, range=0..1)
close_curve_2 = CloseCurve(Curve=join_curves_2, CloseType=0, Bulge=0.5, Tolerance=0)  # -> Closed, ResultBoolean
unit_z_2 = UnitZ(Factor=height_2)
fillet_2 = Fillet(Curve=close_curve_2.Closed, Radius=radius_fillet_2)  # -> flatten(Curve)
move_2 = Move(Geometry=fillet_2, Motion=unit_z_2)  # -> Geometry, Transform

control_points_2 = ControlPoints(Curve=fillet_2)  # -> Points, Weights, Knots
dispatch_15 = Dispatch(
    List=control_points_2.Points,
    DispatchPattern=[False, False, False, True, False, False, False, True, False, False, False, True, False, False, False, True])  # -> ListA, ListB
dispatch_16 = Dispatch(List=dispatch_15.ListA, DispatchPattern=[True, False])  # -> ListA, ListB
dispatch_17 = Dispatch(List=dispatch_16.ListB, DispatchPattern=[True, False])  # -> ListA, ListB
dispatch_18 = Dispatch(List=dispatch_16.ListA, DispatchPattern=[True, False])  # -> ListA, ListB
distance_3 = Distance(PointA=dispatch_17.ListA, PointB=dispatch_17.ListB)
distance_4 = Distance(PointA=dispatch_18.ListA, PointB=dispatch_18.ListB)
smaller_than_3 = SmallerThan(FirstNumber=2, SecondNumber=distance_4)  # -> flatten(SmallerThan), OrEqualTo
smaller_than_4 = SmallerThan(FirstNumber=2, SecondNumber=distance_3)  # -> flatten(SmallerThan), OrEqualTo

# ----
# Adjust Layout Scale Factor
# Adjust Endpoints as Scale Origin
cull_pattern_5 = CullPattern(List=flatten(dispatch_18.ListA), CullPattern=smaller_than_3.SmallerThan)
cull_pattern_6 = CullPattern(List=flatten(dispatch_17.ListA), CullPattern=smaller_than_4.SmallerThan)
cull_pattern_7 = CullPattern(List=flatten(dispatch_18.ListB), CullPattern=smaller_than_3.SmallerThan)
cull_pattern_8 = CullPattern(List=flatten(dispatch_17.ListB), CullPattern=smaller_than_4.SmallerThan)
scale_top_in_relation_to_bottom_2 = Slider(0.67, range=0..1)
point_2 = Point(flatten([cull_pattern_5, cull_pattern_8]))
curve_nearest_object_2 = CurveNearestObject(Curve=fillet_2, Geometry=point_2)  # -> PointA, PointB, Index
scale_nu_2 = ScaleNU(
    Geometry=move_2.Geometry,
    Plane=curve_nearest_object_2.PointA,
    ScaleX=scale_top_in_relation_to_bottom_2,
    ScaleY=scale_top_in_relation_to_bottom_2,
    ScaleZ=1)  # -> Geometry, Transform

top_2 = Curve(graft(scale_nu_2.Geometry))
bottom_2 = Curve(graft(fillet_2))
loft_2 = Loft(Curves=[bottom_2, top_2], Options=loft_options_2)

# ----
# SMALL Anchor wall
plug_curve_3 = Curve([<curve referenced from the Rhino model> x4])
loft_options_3 = LoftOptions(Closed=False, Adjust=False, Rebuild=0, Refit=0, Type=0)

# ----
# Brick Unit
# Create Geometry Based on Curve
list_length_3 = ListLength(List=plug_curve_3)
series_3 = Series(Start=0, Step=1, Count=list_length_3)

# ----
# Adjust Lenght
evaluate_length_3 = EvaluateLength(Curve=plug_curve_3, Length=0.5, Normalized=True)  # -> Point, Tangent, Parameter
deconstruct_arc_3 = DeconstructArc(Arc=plug_curve_3)  # -> BasePlane, Radius, Angle
center_3 = Point(deconstruct_arc_3.BasePlane)
line_11 = Line(StartPoint=evaluate_length_3.Point, EndPoint=center_3)
bottom_lenght_3 = Slider(3, range=0..4.8)
extend_curve_3 = ExtendCurve(Curve=line_11, Type=0, Start=0, End=3)
divide_length_3 = DivideLength(Curve=extend_curve_3, Length=bottom_lenght_3)  # -> flatten(Points), Tangents, Parameters

# ----
# Control
# Adjust EACH half of Width from CenterAxis
dispatch_19 = Dispatch(List=divide_length_3.Points, DispatchPattern=[True, False])  # -> ListA, ListB
list_item_7 = ListItem(List=dispatch_19.ListA, Index=series_3, Wrap=True)  # -> graft(Item)
list_item_8 = ListItem(List=dispatch_19.ListB, Index=series_3, Wrap=True)  # -> graft(Item)
line_12 = Line(StartPoint=list_item_7, EndPoint=list_item_8)
length_3 = Length(Curve=line_12)
offset_curve_5 = OffsetCurve(Curve=line_12, Distance=Slider(-0.5, range=-1..1), Plane=PlaneXY(0, 0, 0), Corners=1)
offset_curve_6 = OffsetCurve(Curve=line_12, Distance=Slider(0.5, range=-1..1), Plane=PlaneXY(0, 0, 0), Corners=1)
panel_3 = Panel(length_3)
end_points_3 = EndPoints(Curve=[offset_curve_5, offset_curve_6])  # -> Start, graft(End)
curve_5 = Curve(flatten([offset_curve_5, offset_curve_6]))
multiple_curves_3 = MultipleCurves(Curves=[plug_curve_3, curve_5])  # -> flatten(Points), IndexA, IndexB, ParamA, ParamB
dispatch_20 = Dispatch(List=end_points_3.End, DispatchPattern=[True, False])  # -> ListA, ListB
shatter_3 = Shatter(Curve=plug_curve_3, Parameters=[multiple_curves_3.ParamA, multiple_curves_3.ParamB])
point_in_curves_3 = PointInCurves(Point=multiple_curves_3.Points, Curves=plug_curve_3)  # -> Relationship, Index, Point
list_item_9 = ListItem(List=dispatch_20.ListA, Index=0, Wrap=True)  # -> flatten(Item)
dispatch_21 = Dispatch(List=list_item_9, DispatchPattern=[True, False])  # -> graft(ListA), graft(ListB)
dispatch_22 = Dispatch(List=point_in_curves_3.Point, DispatchPattern=[True, False])  # -> graft(ListA), graft(ListB)
dispatch_23 = Dispatch(List=shatter_3, DispatchPattern=[True, False])  # -> graft(ListA), graft(ListB)
startpoints_wall_5 = Point(dispatch_22.ListB)
startpoints_wall_6 = Point(dispatch_22.ListA)
endpoints_anchorwall_5 = Point(dispatch_21.ListB)
endpoints_anchorwall_6 = Point(dispatch_21.ListA)
line_13 = Line(StartPoint=startpoints_wall_5, EndPoint=endpoints_anchorwall_5)
line_14 = Line(StartPoint=startpoints_wall_6, EndPoint=endpoints_anchorwall_6)
line_15 = Line(StartPoint=endpoints_anchorwall_6, EndPoint=endpoints_anchorwall_5)
curve_6 = Curve(dispatch_23.ListB)

# ----
# Adjust Height
# Adjust Corners
layout_bottom_3 = Curve(flatten([line_13, line_14, line_15, curve_6]))
join_curves_3 = JoinCurves(Curves=layout_bottom_3, Preserve=False)
height_3 = Slider(5, range=0..10)
radius_fillet_3 = Slider(0.4, range=0..1)
close_curve_3 = CloseCurve(Curve=join_curves_3, CloseType=0, Bulge=0.5, Tolerance=0)  # -> Closed, ResultBoolean
unit_z_3 = UnitZ(Factor=height_3)
fillet_3 = Fillet(Curve=close_curve_3.Closed, Radius=radius_fillet_3)  # -> flatten(Curve)
move_3 = Move(Geometry=fillet_3, Motion=unit_z_3)  # -> Geometry, Transform

control_points_3 = ControlPoints(Curve=fillet_3)  # -> Points, Weights, Knots
dispatch_24 = Dispatch(
    List=control_points_3.Points,
    DispatchPattern=[False, False, False, True, False, False, False, True, False, False, False, True, False, False, False, True])  # -> ListA, ListB
dispatch_25 = Dispatch(List=dispatch_24.ListA, DispatchPattern=[True, False])  # -> ListA, ListB
dispatch_26 = Dispatch(List=dispatch_25.ListB, DispatchPattern=[True, False])  # -> ListA, ListB
dispatch_27 = Dispatch(List=dispatch_25.ListA, DispatchPattern=[True, False])  # -> ListA, ListB
# Lenght of Bottom
# Position and Lenght of Curve
# Height / Top Offset
distance_5 = Distance(PointA=dispatch_26.ListA, PointB=dispatch_26.ListB)
distance_6 = Distance(PointA=dispatch_27.ListA, PointB=dispatch_27.ListB)
smaller_than_5 = SmallerThan(FirstNumber=2, SecondNumber=distance_6)  # -> flatten(SmallerThan), OrEqualTo
smaller_than_6 = SmallerThan(FirstNumber=2, SecondNumber=distance_5)  # -> flatten(SmallerThan), OrEqualTo

# ----
# Adjust Layout Scale Factor
# Adjust Endpoints as Scale Origin
cull_pattern_9 = CullPattern(List=flatten(dispatch_27.ListA), CullPattern=smaller_than_5.SmallerThan)
cull_pattern_10 = CullPattern(List=flatten(dispatch_26.ListA), CullPattern=smaller_than_6.SmallerThan)
cull_pattern_11 = CullPattern(List=flatten(dispatch_27.ListB), CullPattern=smaller_than_5.SmallerThan)
cull_pattern_12 = CullPattern(List=flatten(dispatch_26.ListB), CullPattern=smaller_than_6.SmallerThan)
scale_top_in_relation_to_bottom_3 = Slider(0.67, range=0..1)
point_3 = Point(flatten([cull_pattern_9, cull_pattern_12]))
curve_nearest_object_3 = CurveNearestObject(Curve=fillet_3, Geometry=point_3)  # -> PointA, PointB, Index
scale_nu_3 = ScaleNU(
    Geometry=move_3.Geometry,
    Plane=curve_nearest_object_3.PointA,
    ScaleX=scale_top_in_relation_to_bottom_3,
    ScaleY=scale_top_in_relation_to_bottom_3,
    ScaleZ=1)  # -> Geometry, Transform

top_3 = Curve(graft(scale_nu_3.Geometry))
bottom_3 = Curve(graft(fillet_3))
loft_3 = Loft(Curves=[bottom_3, top_3], Options=loft_options_3)

# ----
# ANCHOR POINTS
amount_of_anchor_points = Slider(10, range=0..10)
divide_curve = DivideCurve(Curve=[top_2, top, top_3], Count=amount_of_anchor_points, Kinks=False)  # -> Points, Tangents, Parameters

# ----
# LOFT WALLS
merge = Merge(Data1=loft_2, Data2=loft, Data3=loft_3)

division = Division(A=brick_height, B=2)
contour = Contour(Shape=merge, Point=Point(0, 0, 0), Direction=Vector(0, 0, 1), Distance=division)
closed = Closed(Curve=contour)  # -> Closed, Periodic
cull_pattern_13 = CullPattern(List=contour, CullPattern=closed.Closed)
curve_7 = Curve(flatten(cull_pattern_13))
list_length_4 = ListLength(List=curve_7)
integer = Integer(list_length_4)
addition = Addition(A=brick_length, B=mortar_gap)
cull_index = CullIndex(List=curve_7, Indices=integer, Wrap=True)
cull_pattern_14 = CullPattern(List=cull_index, CullPattern=[True, False, True, False])
cull_pattern_15 = CullPattern(List=cull_pattern_14, CullPattern=[False, True])
cull_pattern_16 = CullPattern(List=cull_pattern_14, CullPattern=[True, False])
length_4 = Length(Curve=cull_pattern_16)
length_5 = Length(Curve=cull_pattern_15)
division_2 = Division(A=brick_length, B=2)
division_3 = Division(A=brick_width, B=2)
division_4 = Division(A=brick_height, B=2)
division_5 = Division(A=length_5, B=addition)
division_6 = Division(A=length_4, B=addition)
round = Round(Number=division_5)  # -> Nearest, Floor, Ceiling
round_2 = Round(Number=division_6)  # -> Nearest, Floor, Ceiling
multiplication = Multiplication(A=round.Floor, B=2)
horizontal_frames = HorizontalFrames(Curve=cull_pattern_16, Count=round_2.Floor)  # -> Frames, Parameters
horizontal_frames_2 = HorizontalFrames(Curve=cull_pattern_15, Count=multiplication)  # -> Frames, Parameters
cull_pattern_17 = CullPattern(List=horizontal_frames_2.Frames, CullPattern=[False, True, False, True])
center_box = CenterBox(Base=[cull_pattern_17, horizontal_frames.Frames], X=division_2, Y=division_3, Z=division_4)

# ----
# brick arrangement for continuous curves in a mesh
# convert brick to earth bag
# ouput earth bag
# ouput brick arrangment
brep = Brep(center_box)
smoothness_of_earth_bag = Slider(2, range=1..3)

settings_custom = SettingsCustom(
    StitchSeams=True,
    SimplePlanes=False,
    Refine=True,
    MinCount=16,
    MaxCount=400,
    AspectRatio=20,
    MaxDistance=0,
    MaxAngle=20,
    MinEdge=0,
    MaxEdge=0)
mesh_brep = MeshBrep(Brep=brep, Settings=settings_custom)
weaverbird_s_catmull_clark_subdivision = WeaverbirdsCatmullClarkSubdivision(MeshCurves=mesh_brep, Level=Slider(1, range=0..3), SmoothNakedEdges=1)

weaverbird_s_laplacian_smoothing = WeaverbirdsLaplacianSmoothing(MeshCurves=weaverbird_s_catmull_clark_subdivision, Level=smoothness_of_earth_bag, SmoothNakedEdges=1, Thin=1)
