# Grasshopper definition 5.11_Cellular Automata_SpacePlanning.gh (Grasshopper 1.0.7)
# plug-ins: Pufferfish, Google Drive for GH , Kangaroo2 Components

# ----
# Excel
toggle = BooleanToggle(True)
gauth = GoogleAuthenticator(Authenticate=toggle, ClearCredentials=False)
spreadsheetlist = SpreadsheetList(Token=gauth, Refresh=Toggle(True))
panel = Panel(spreadsheetlist)
list_item = ListItem(List=panel, Index=Slider(0, range=0..10), Wrap=True)
readspreadsheet = ReadFromSpreadsheet(
    Token=gauth,
    Name=list_item,
    Worksheet="Sheet3",
    IncludeBlankCells=False,
    SpreadsheetRange="B4:C22",
    OrganizeByRowsOrColumns=Toggle(True),
    ReadFormulasOrValues=False,
    Refresh=True)  # -> Values, CellAddresses, SheetInfo

# ----
# Colours:
# Rosa 310 - Control Geometry
# Green 120 - Important Decisions
# https://drive.google.com/open?id=1wnW8g-QhhaDBKm-oYcc2NXxmsnXbddcuEXhpo9Dcnfw
panel_2 = Panel("thenewearthypython@gmail.com")

# ----
# Retrieve Data from Excel - NORTH
toggle_2 = BooleanToggle(False)
read_from_spreadsheet = ReadFromSpreadsheet(
    Token=gauth,
    Name="Areas",
    Worksheet="NORTH",
    IncludeBlankCells=False,
    OrganizeByRowsOrColumns=toggle_2,
    ReadFormulasOrValues=False,
    Refresh=True)  # -> Values, CellAddresses, SheetInfo
tree_branch = TreeBranch(Tree=read_from_spreadsheet.Values, Path="{0;1}", MaintainPaths=True)
tree_branch_2 = TreeBranch(Tree=read_from_spreadsheet.Values, Path="{0;2}", MaintainPaths=True)
tree_branch_3 = TreeBranch(Tree=read_from_spreadsheet.Values, Path="{0;3}", MaintainPaths=True)
panel_3 = Panel(tree_branch)
panel_4 = Panel(tree_branch_2)
panel_5 = Panel(tree_branch_3)

# ----
# Retrieve Data from Excel - WEST / SOUTH
panel_6 = Panel("Areas")
read_from_spreadsheet_2 = ReadFromSpreadsheet(
    Token=gauth,
    Name=panel_6,
    Worksheet="WEST / SOUTH",
    IncludeBlankCells=False,
    OrganizeByRowsOrColumns=Toggle(False),
    ReadFormulasOrValues=False,
    Refresh=True)  # -> Values, CellAddresses, SheetInfo
tree_branch_4 = TreeBranch(Tree=read_from_spreadsheet_2.Values, Path="{0;1}", MaintainPaths=True)
tree_branch_5 = TreeBranch(Tree=read_from_spreadsheet_2.Values, Path="{0;2}", MaintainPaths=True)
tree_branch_6 = TreeBranch(Tree=read_from_spreadsheet_2.Values, Path="{0;3}", MaintainPaths=True)
panel_7 = Panel(tree_branch_4)
panel_8 = Panel(tree_branch_5)
panel_9 = Panel(tree_branch_6)

# ----
# Grid
x_grid = Slider(24, range=0..100)
x_y_cells = Slider(6, range=0..10)
y_grid = Slider(20, range=0..20)
rectangular = Rectangular(Plane=PlaneXY(0, 0, 0), SizeX=x_y_cells, SizeY=x_y_cells, ExtentX=x_grid, ExtentY=y_grid)  # -> Cells, Points

# ----
# Corner points (SW SE NW NE)
# List of points with highest Y value
# (North)
# List of points with lowest Y value
# (South)
# Internal points
# List of points with lowest X value
# (West)
# List of points with highest X value
# (East)
point = Point(rectangular.Points)
pdecon = Deconstruct(Point=point)  # -> XComponent, YComponent, ZComponent
item = ListItem(List=point, Index=0, Wrap=True)  # -> graft(Item)

# ----
# Organisation of points on grid
panel_10 = Panel(point)
points = PointList(Points=point, Size=1)

pt = ConstructPoint(XCoordinate=0, YCoordinate=pdecon.YComponent, ZCoordinate=0)
tree_branch_7 = TreeBranch(Tree=pt, Path="{0;0;1}", MaintainPaths=True)

panel_11 = Panel(pdecon.YComponent)
lstdex = LastIndex(List=panel_11)  # -> graft(Index)
item_2 = ListItem(List=point, Index=lstdex, Wrap=True)

hilo = HighestLowestNumbers(Numbers=flatten(pdecon.XComponent))  # -> graft(Highest), Lowest
pt_2 = ConstructPoint(XCoordinate=hilo.Highest, YCoordinate=pdecon.YComponent, ZCoordinate=0)
panel_12 = Panel(hilo.Highest)
tree_branch_8 = TreeBranch(Tree=pt_2, Path="{0;0;1}", MaintainPaths=True)

# ----
# Southwest
# Northwest
# Southeast
# Northeast
pdecon_2 = Deconstruct(Point=item)  # -> XComponent, YComponent, ZComponent
pdecon_3 = Deconstruct(Point=item)  # -> XComponent, YComponent, ZComponent
pt_3 = ConstructPoint(XCoordinate=0, YCoordinate=pdecon_3.YComponent, ZCoordinate=0)
pt_4 = ConstructPoint(XCoordinate=hilo.Highest, YCoordinate=pdecon_2.YComponent, ZCoordinate=0)
pdecon_4 = Deconstruct(Point=item_2)  # -> XComponent, YComponent, ZComponent
pdecon_5 = Deconstruct(Point=pt_2)  # -> XComponent, YComponent, ZComponent
pt_5 = ConstructPoint(XCoordinate=pdecon_5.XComponent, YCoordinate=pdecon_4.YComponent, ZCoordinate=0)
pt_6 = ConstructPoint(XCoordinate=0, YCoordinate=pdecon_4.YComponent, ZCoordinate=0)

# ----
# GRID
# Orientation on the Grid
addition = Addition(A=x_grid, _1ForIndex0=1)
addition_2 = Addition(A=y_grid, _1ForIndex0=1)

# ----
# Amount of Y - InternalPoints
_1_north_row_1_south_row = Slider(2, range=0..10)
amount_of_y = Subtraction(A=addition_2, B=_1_north_row_1_south_row)

# ----
# Amount of X - InternalPoints
_1_west_row_1_east_row = Slider(2, range=0..10)
domain_of_y = Subtraction(A=addition, B=_1_west_row_1_east_row)

subtraction = Subtraction(A=lstdex, B=1)
dom = ConstructDomain(DomainStart=1, DomainEnd=subtraction)
subset = SubList(List=point, Domain=dom, Wrap=True)  # -> List, Index

east = Point(flatten(tree_branch_8))
west = Point(flatten(tree_branch_7))
north = Point(flatten(item_2))
south = Point(flatten(item))
all_orientation_points = Point(flatten([west, north, east, south]))
internal_points = Point(flatten(subset.List))

# ----
# List and Amount of 1
number_slider = Slider(0, range=0..100)
equality = Equality(FirstNumber=number_slider, SecondNumber=panel_5)  # -> Equality, Inequality
dispatch = Dispatch(List=panel_5, DispatchPattern=equality.Equality)  # -> ListOf0, ListOf1
_0 = ListLength(List=dispatch.ListOf0)
rest = ListLength(List=dispatch.ListOf1)
panel_13 = Panel(dispatch.ListOf0)

# ----
# List and Amount of 2
number_slider_2 = Slider(2, range=0..100)
equality_2 = Equality(FirstNumber=number_slider_2, SecondNumber=panel_5)  # -> Equality, Inequality
dispatch_2 = Dispatch(List=panel_5, DispatchPattern=equality_2.Equality)  # -> ListOf2, ListOf10
panel_14 = Panel(dispatch_2.ListOf2)
_2 = ListLength(List=dispatch_2.ListOf2)
rest_2 = ListLength(List=dispatch_2.ListOf10)

# ----
# List and Amount of 3
number_slider_3 = Slider(3, range=0..100)
equality_3 = Equality(FirstNumber=number_slider_3, SecondNumber=panel_5)  # -> Equality, Inequality
dispatch_3 = Dispatch(List=panel_5, DispatchPattern=equality_3.Equality)  # -> ListOf3, ListOf10
panel_15 = Panel(dispatch_3.ListOf3)
_3 = ListLength(List=dispatch_3.ListOf3)
rest_3 = ListLength(List=dispatch_3.ListOf10)

# ----
# List and Amount of 4
number_slider_4 = Slider(4, range=0..100)
equality_4 = Equality(FirstNumber=number_slider_4, SecondNumber=panel_5)  # -> Equality, Inequality
dispatch_4 = Dispatch(List=panel_5, DispatchPattern=equality_4.Equality)  # -> ListOf4, ListOf10
_4 = ListLength(List=dispatch_4.ListOf4)
panel_16 = Panel(dispatch_4.ListOf4)
rest_4 = ListLength(List=dispatch_4.ListOf10)

# ----
# List and Amount of 0
number_slider_5 = Slider(1, range=0..100)
equality_5 = Equality(FirstNumber=number_slider_5, SecondNumber=panel_5)  # -> Equality, Inequality
dispatch_5 = Dispatch(List=panel_5, DispatchPattern=equality_5.Equality)  # -> ListOf0, ListOf1
_1 = ListLength(List=dispatch_5.ListOf0)
rest_5 = ListLength(List=dispatch_5.ListOf1)
panel_17 = Panel(dispatch_5.ListOf0)

# ----
# List and Amount of 5
number_slider_6 = Slider(5, range=0..100)
equality_6 = Equality(FirstNumber=number_slider_6, SecondNumber=panel_5)  # -> Equality, Inequality
dispatch_6 = Dispatch(List=panel_5, DispatchPattern=equality_6.Equality)  # -> ListOf4, ListOf10
_5 = ListLength(List=dispatch_6.ListOf4)
panel_18 = Panel(dispatch_6.ListOf4)
rest_6 = ListLength(List=dispatch_6.ListOf10)

# ----
# List and Amount of 6
number_slider_7 = Slider(6, range=0..100)
equality_7 = Equality(FirstNumber=number_slider_7, SecondNumber=panel_5)  # -> Equality, Inequality
dispatch_7 = Dispatch(List=panel_5, DispatchPattern=equality_7.Equality)  # -> ListOf4, ListOf10
_6 = ListLength(List=dispatch_7.ListOf4)
panel_19 = Panel(dispatch_7.ListOf4)
rest_7 = ListLength(List=dispatch_7.ListOf10)

# ----
# List and Amount of 7
number_slider_8 = Slider(7, range=0..100)
equality_8 = Equality(FirstNumber=number_slider_8, SecondNumber=panel_5)  # -> Equality, Inequality
dispatch_8 = Dispatch(List=panel_5, DispatchPattern=equality_8.Equality)  # -> ListOf4, ListOf10
_7 = ListLength(List=dispatch_8.ListOf4)
rest_8 = ListLength(List=dispatch_8.ListOf10)
panel_20 = Panel(dispatch_8.ListOf4)

# ----
# List and Amount of 1
number_slider_9 = Slider(1, range=0..100)
equality_9 = Equality(FirstNumber=number_slider_9, SecondNumber=panel_9)  # -> Equality, Inequality
dispatch_9 = Dispatch(List=panel_9, DispatchPattern=equality_9.Equality)  # -> ListOf0, ListOf1
_1_2 = ListLength(List=dispatch_9.ListOf0)
rest_9 = ListLength(List=dispatch_9.ListOf1)
panel_21 = Panel(dispatch_9.ListOf0)

# ----
# List and Amount of 0
number_slider_10 = Slider(0, range=0..100)
equality_10 = Equality(FirstNumber=number_slider_10, SecondNumber=panel_9)  # -> Equality, Inequality
dispatch_10 = Dispatch(List=panel_9, DispatchPattern=equality_10.Equality)  # -> ListOf0, ListOf1
_0_2 = ListLength(List=dispatch_10.ListOf0)
rest_10 = ListLength(List=dispatch_10.ListOf1)
panel_22 = Panel(dispatch_10.ListOf0)

# ----
# List and Amount of 2
number_slider_11 = Slider(2, range=0..100)
equality_11 = Equality(FirstNumber=number_slider_11, SecondNumber=panel_9)  # -> Equality, Inequality
dispatch_11 = Dispatch(List=panel_9, DispatchPattern=equality_11.Equality)  # -> ListOf2, ListOf10
_2_2 = ListLength(List=dispatch_11.ListOf2)
panel_23 = Panel(dispatch_11.ListOf2)
rest_11 = ListLength(List=dispatch_11.ListOf10)

# ----
# List and Amount of 3
number_slider_12 = Slider(3, range=0..100)
equality_12 = Equality(FirstNumber=number_slider_12, SecondNumber=panel_9)  # -> Equality, Inequality
dispatch_12 = Dispatch(List=panel_9, DispatchPattern=equality_12.Equality)  # -> ListOf3, ListOf10
_3_2 = ListLength(List=dispatch_12.ListOf3)
panel_24 = Panel(dispatch_12.ListOf3)
rest_12 = ListLength(List=dispatch_12.ListOf10)

# ----
# List and Amount of 4
number_slider_13 = Slider(4, range=0..100)
equality_13 = Equality(FirstNumber=number_slider_13, SecondNumber=panel_9)  # -> Equality, Inequality
dispatch_13 = Dispatch(List=panel_9, DispatchPattern=equality_13.Equality)  # -> ListOf4, ListOf10
_4_2 = ListLength(List=dispatch_13.ListOf4)
rest_13 = ListLength(List=dispatch_13.ListOf10)
panel_25 = Panel(dispatch_13.ListOf4)

# ----
# List and Amount of 5
number_slider_14 = Slider(5, range=0..100)
equality_14 = Equality(FirstNumber=number_slider_14, SecondNumber=panel_9)  # -> Equality, Inequality
dispatch_14 = Dispatch(List=panel_9, DispatchPattern=equality_14.Equality)  # -> ListOf5, ListOf10
rest_14 = ListLength(List=dispatch_14.ListOf10)
panel_26 = Panel(dispatch_14.ListOf5)
_5_2 = ListLength(List=dispatch_14.ListOf5)

# ----
# List and Amount of 6
number_slider_15 = Slider(6, range=0..100)
equality_15 = Equality(FirstNumber=number_slider_15, SecondNumber=panel_9)  # -> Equality, Inequality
dispatch_15 = Dispatch(List=panel_9, DispatchPattern=equality_15.Equality)  # -> ListOf6, ListOf10
_6_2 = ListLength(List=dispatch_15.ListOf6)
rest_15 = ListLength(List=dispatch_15.ListOf10)
panel_27 = Panel(dispatch_15.ListOf6)

# ----
# List and Amount of 7
number_slider_16 = Slider(7, range=0..100)
equality_16 = Equality(FirstNumber=number_slider_16, SecondNumber=panel_9)  # -> Equality, Inequality
dispatch_16 = Dispatch(List=panel_9, DispatchPattern=equality_16.Equality)  # -> ListOf7, ListOf10
_7_2 = ListLength(List=dispatch_16.ListOf7)
rest_16 = ListLength(List=dispatch_16.ListOf10)
panel_28 = Panel(dispatch_16.ListOf7)

# ----
# List and Amount of 9
number_slider_17 = Slider(9, range=0..100)
equality_17 = Equality(FirstNumber=number_slider_17, SecondNumber=panel_9)  # -> Equality, Inequality
dispatch_17 = Dispatch(List=panel_9, DispatchPattern=equality_17.Equality)  # -> ListOf7, ListOf10
_9 = ListLength(List=dispatch_17.ListOf7)
rest_17 = ListLength(List=dispatch_17.ListOf10)
panel_29 = Panel(dispatch_17.ListOf7)

# ----
# List and Amount of 8
number_slider_18 = Slider(8, range=0..100)
equality_18 = Equality(FirstNumber=number_slider_18, SecondNumber=panel_9)  # -> Equality, Inequality
dispatch_18 = Dispatch(List=panel_9, DispatchPattern=equality_18.Equality)  # -> ListOf7, ListOf10
_8 = ListLength(List=dispatch_18.ListOf7)
rest_18 = ListLength(List=dispatch_18.ListOf10)
panel_30 = Panel(dispatch_18.ListOf7)

# ----
# List and Amount of 10
number_slider_19 = Slider(10, range=0..100)
# Choose the right spreadsheet
equality_19 = Equality(FirstNumber=number_slider_19, SecondNumber=panel_9)  # -> Equality, Inequality
dispatch_19 = Dispatch(List=panel_9, DispatchPattern=equality_19.Equality)  # -> ListOf7, ListOf10
_10 = ListLength(List=dispatch_19.ListOf7)
# CY1,2,3
# CY1 Functions - Ankerpoints
# Radius
# Press to Recalculate -
# If Any Change!
# Press that Mchod! :)
rest_19 = ListLength(List=dispatch_19.ListOf10)
panel_31 = Panel(dispatch_19.ListOf7)

# ----
# START
# Original North Anchor point
number_slider_20 = Slider(0, range=0..10)
list_item_2 = ListItem(List=north, Index=number_slider_20, Wrap=True)
n_anchorpoint = Point(list_item_2)

# ----
# 1 !!!!!!!!! Decide Direction of ClosestAnchorPoints !!!!!!!
# 
# Smaller Than or Larger Than the Origin??
deconstruct_northp = Deconstruct(Point=north)  # -> XComponent, YComponent, ZComponent
# STEP BY STEP PATH WITH RESPECTIVE FUNCTIONS ACCORDING TO EXCEL
deconstructanchorp = Deconstruct(Point=n_anchorpoint)  # -> XComponent, YComponent, ZComponent
smaller_than = SmallerThan(FirstNumber=deconstructanchorp.XComponent, SecondNumber=deconstruct_northp.XComponent)  # -> SmallerThan, OrEqualTo
dispatch_20 = Dispatch(List=deconstruct_northp.XComponent, DispatchPattern=smaller_than.SmallerThan)  # -> ListA, Smaller

last_index = LastIndex(List=deconstruct_northp.ZComponent)
last_index_2 = LastIndex(List=deconstruct_northp.YComponent)
list_item_3 = ListItem(List=deconstruct_northp.YComponent, Index=last_index_2, Wrap=True)
list_item_4 = ListItem(List=deconstruct_northp.ZComponent, Index=last_index, Wrap=True)

# ----
# CONTINUE
# Original West Anchor point
number_slider_21 = Slider(16, range=0..30)
list_item_5 = ListItem(List=west, Index=number_slider_21, Wrap=True)
w_anchorpoint = Point(list_item_5)

constructnewcloudpoint = ConstructPoint(XCoordinate=dispatch_20.ListA, YCoordinate=list_item_3, ZCoordinate=list_item_4)

closest_points = ClosestPoints(Point=n_anchorpoint, Cloud=constructnewcloudpoint, CountOfONES=_1)  # -> ClosestPoint, CPIndex, Distance
explode_tree = ExplodeTree(Data=graft(closest_points.ClosestPoint))  # -> _0300, _0301, _0302, Branch3, Branch4, Branch5, Branch6
point_2 = Point(explode_tree._0300)
point_3 = Point(explode_tree._0302)
point_4 = Point(explode_tree._0301)
line = Line(StartPoint=point_2, EndPoint=point_3)

# ----
# CLOUD
internal_points_2 = Point(internal_points)

# ----
# 1 !!!!!!!!! Decide Direction of ClosestAnchorPoints !!!!!!!
# 
# Smaller Than or Larger Than the Origin??
deconstructanchorp_2 = Deconstruct(Point=w_anchorpoint)  # -> XComponent, YComponent, ZComponent
deconstruct_northp_2 = Deconstruct(Point=west)  # -> XComponent, YComponent, ZComponent
smaller_than_2 = SmallerThan(FirstNumber=deconstructanchorp_2.YComponent, SecondNumber=deconstruct_northp_2.YComponent)  # -> SmallerThan, OrEqualTo
dispatch_21 = Dispatch(List=deconstruct_northp_2.YComponent, DispatchPattern=smaller_than_2.SmallerThan)  # -> ListA, Smaller

# ----
# Remaining Northpoints
find_similar_member = FindSimilarMember(Data=closest_points.ClosestPoint, Set=constructnewcloudpoint)  # -> Hit, Index
cull_index = CullIndex(List=constructnewcloudpoint, Indices=find_similar_member.Index, Wrap=True)

# ----
# !Decide Size of Opening ! Idea stayed on the way
# 
# Redefine with a limit, or standards
point_on_curve = PointOnCurve(line, parameter=0)
point_on_curve_2 = PointOnCurve(line, parameter=1)
line_2 = Line(StartPoint=point_on_curve, EndPoint=point_on_curve_2)
length = Length(Curve=line_2)
panel_32 = Panel(length)

last_index_3 = LastIndex(List=deconstruct_northp_2.ZComponent)
last_index_4 = LastIndex(List=deconstruct_northp_2.XComponent)
list_item_6 = ListItem(List=deconstruct_northp_2.XComponent, Index=last_index_4, Wrap=True)
list_item_7 = ListItem(List=deconstruct_northp_2.ZComponent, Index=last_index_3, Wrap=True)

# ----
# Anchor from 1
# 
# "Persons location"
point_on_curve_3 = PointOnCurve(line_2, parameter=0.311)

closest_points_2 = ClosestPoints(Point=point_on_curve_3, Cloud=internal_points_2, CountOfZEROS=_0)  # -> ClosestPoint, CPIndex, Distance
explode_tree_2 = ExplodeTree(Data=graft(closest_points_2.ClosestPoint))  # -> _030000, _030001, _030002
point_5 = Point(explode_tree_2._030002)
point_6 = Point(explode_tree_2._030001)
point_7 = Point(explode_tree_2._030000)
line_3 = Line(StartPoint=point_6, EndPoint=point_5)

constructnewcloudpoint_2 = ConstructPoint(XCoordinate=list_item_6, YCoordinate=dispatch_21.Smaller, ZCoordinate=list_item_7)

closest_points_3 = ClosestPoints(Point=w_anchorpoint, Cloud=constructnewcloudpoint_2, CountOfONES=_1_2)  # -> ClosestPoint, CPIndex, Distance
explode_tree_3 = ExplodeTree(Data=graft(closest_points_3.ClosestPoint))  # -> _0300, _0301, _0302, Branch3, Branch4, Branch5, Branch6
point_8 = Point(explode_tree_3._0301)
point_9 = Point(explode_tree_3._0300)
point_10 = Point(explode_tree_3._0302)
point_11 = Point(explode_tree_3.Branch3)
line_4 = Line(StartPoint=point_9, EndPoint=point_8)

# ----
# CLOUD
cull_index_2 = CullIndex(List=internal_points_2, Indices=closest_points_2.CPIndex, Wrap=True)

# ----
# Anchor from 0 to n+1
point_on_curve_4 = PointOnCurve(line_3, parameter=0.494)

closest_point = ClosestPoint(Point=point_on_curve_4, Cloud=cull_index_2)  # -> ClosestPoint, CPIndex, Distance
deconstruct = Deconstruct(Point=closest_point.ClosestPoint)  # -> XComponent, YComponent, ZComponent

# ----
# Finding Courtyard - 3 Points
# Get cloud of points - achieve the range direction south
cloud = ClosestPoints(Point=point_on_curve_4, Cloud=cull_index_2, Count=Slider(26, range=0..100))  # -> ClosestPoint, CPIndex, Distance
deconstruct_2 = Deconstruct(Point=cloud.ClosestPoint)  # -> XComponent, YComponent, ZComponent
sort_list = SortList(Keys=deconstruct_2.YComponent)  # -> Keys, ValuesValuesA
delete_consecutive = DeleteConsecutive(Set=sort_list.Keys, Wrap=False)  # -> Set, Count
last_index_5 = LastIndex(List=delete_consecutive.Set)
cull_index_3 = CullIndex(List=delete_consecutive.Set, Indices=last_index_5, Wrap=True)
filter = ConstructPoint(XCoordinate=deconstruct.XComponent, YCoordinate=cull_index_3, ZCoordinate=0)

point_on_curve_5 = PointOnCurve(line_4, parameter=0.578)

closest_points_4 = ClosestPoints(Point=point_on_curve_5, Cloud=constructnewcloudpoint_2, CountOfONES=_1_2)  # -> ClosestPoint, CPIndex, Distance
explode_tree_4 = ExplodeTree(Data=graft(closest_points_4.ClosestPoint))  # -> _030000, _030001, _030002, Branch3, Branch4, Branch5
point_12 = Point(explode_tree_4._030001)
point_13 = Point(explode_tree_4._030000)
point_14 = Point(explode_tree_4._030002)
line_5 = Line(StartPoint=point_13, EndPoint=point_12)

point_on_curve_6 = PointOnCurve(line_5, parameter=0.814)

explode_tree_5 = ExplodeTree(Data=graft(filter))  # -> _0300010000, _0300010001, _0300010002, _0300010003
point_15 = Point(explode_tree_5._0300010002)
point_16 = Point(explode_tree_5._0300010000)
point_17 = Point(explode_tree_5._0300010001)
point_18 = Point(explode_tree_5._0300010003)
line_6 = Line(StartPoint=point_16, EndPoint=point_15)

find_similar_member_2 = FindSimilarMember(Data=filter, Set=cull_index_2)  # -> Hit, Index
# CLOUD
cull_index_4 = CullIndex(List=cull_index_2, Indices=find_similar_member_2.Index, Wrap=True)

point_on_curve_7 = PointOnCurve(line_6, parameter=1)

closest_points_5 = ClosestPoints(Point=point_on_curve_7, Cloud=cull_index_4, Count=_2)  # -> ClosestPoint, CPIndex, Distance
explode_tree_6 = ExplodeTree(Data=graft(closest_points_5.ClosestPoint))  # -> _030001000000, _030001000001, _030001000002, _030001000003, _030001000004, Branch5, Branch6, Branch7
point_19 = Point(explode_tree_6._030001000000)
point_20 = Point(explode_tree_6._030001000004)
point_21 = Point(explode_tree_6._030001000001)
point_22 = Point(explode_tree_6._030001000002)
point_23 = Point(explode_tree_6._030001000003)
line_7 = Line(StartPoint=point_5, EndPoint=point_19)
line_8 = Line(StartPoint=point_21, EndPoint=point_20)

# ----
# CLOUD
cull_index_5 = CullIndex(List=cull_index_4, Indices=closest_points_5.CPIndex, Wrap=True)

point_24 = Point(point_23)
closest_points_6 = ClosestPoints(Point=point_24, Cloud=cull_index_5, Count=_3)  # -> ClosestPoint, CPIndex, Distance

point_on_curve_8 = PointOnCurve(line_7, parameter=0.414)
point_on_curve_9 = PointOnCurve(line_8, parameter=0.573)

# ----
# CLOUD
cull_index_6 = CullIndex(List=cull_index_5, Indices=closest_points_6.CPIndex, Wrap=True)

# ----
# Finding Courtyard - 3 Points
closest_point_2 = ClosestPoint(Point=point_on_curve_8, Cloud=cull_index_6)  # -> ClosestPoint, CPIndex, Distance
deconstruct_3 = Deconstruct(Point=closest_point_2.ClosestPoint)  # -> XComponent, YComponent, ZComponent

# ----
# Get cloud of points - achieve the range direction south
number_slider_22 = Slider(6, range=0..100)
cloud_2 = ClosestPoints(Point=point_on_curve_8, Cloud=cull_index_6, Count=number_slider_22)  # -> ClosestPoint, CPIndex, Distance
deconstruct_4 = Deconstruct(Point=cloud_2.ClosestPoint)  # -> XComponent, YComponent, ZComponent
sort_list_2 = SortList(Keys=deconstruct_4.YComponent)  # -> Keys, ValuesValuesA
delete_consecutive_2 = DeleteConsecutive(Set=sort_list_2.Keys, Wrap=False)  # -> Set, Count
filter_2 = ConstructPoint(XCoordinate=deconstruct_3.XComponent, YCoordinate=delete_consecutive_2.Set, ZCoordinate=0)

explode_tree_7 = ExplodeTree(Data=graft(filter_2))  # -> _03000100000300000, _03000100000300001, _03000100000300002, Branch3, Branch4, Branch5, Branch6, Branch7, Branch8, Branch9
point_25 = Point(explode_tree_7.Branch3)
point_26 = Point(explode_tree_7._03000100000300000)
point_27 = Point(explode_tree_7._03000100000300001)
point_28 = Point(explode_tree_7._03000100000300002)
point_29 = Point(explode_tree_7.Branch4)
line_9 = Line(StartPoint=point_26, EndPoint=point_28)

find_similar_member_3 = FindSimilarMember(Data=filter_2, Set=cull_index_6)  # -> Hit, Index
# CLOUD
cull_index_7 = CullIndex(List=cull_index_6, Indices=find_similar_member_3.Index, Wrap=True)

remaining_northpoints = Point(cull_index)
merge = Merge(Data1=remaining_northpoints, Data2=cull_index_7)  # -> flatten(Result)

point_on_curve_10 = PointOnCurve(line_9, parameter=0.153)
point_on_curve_11 = PointOnCurve(line_9, parameter=0.82)

closest_points_7 = ClosestPoints(Point=point_on_curve_11, Cloud=merge, Count=_4)  # -> ClosestPoint, CPIndex, Distance
explode_tree_8 = ExplodeTree(Data=graft(closest_points_7.ClosestPoint))  # -> _0300010000030000000, _0300010000030000001, _0300010000030000002, _0300010000030000003, Branch4, Branch5, Branch6, Branch7, Branch8, Branch9
point_30 = Point(explode_tree_8._0300010000030000000)
point_31 = Point(explode_tree_8._0300010000030000001)
point_32 = Point(explode_tree_8._0300010000030000002)
point_33 = Point(explode_tree_8._0300010000030000003)

# ----
# CLOUD
cull_index_8 = CullIndex(List=merge, Indices=closest_points_7.CPIndex, Wrap=True)

closest_points_8 = ClosestPoints(Point=point_on_curve_10, Cloud=cull_index_8, Count=_5)  # -> ClosestPoint, CPIndex, Distance
explode_tree_9 = ExplodeTree(Data=graft(closest_points_8.ClosestPoint))  # -> _030001000003000000000, _030001000003000000001, _030001000003000000002, _030001000003000000003, Branch4, Branch5, Branch6, Branch7, Branch8, Branch9
point_34 = Point(explode_tree_9._030001000003000000000)
point_35 = Point(explode_tree_9._030001000003000000001)
point_36 = Point(explode_tree_9._030001000003000000002)
point_37 = Point(explode_tree_9._030001000003000000003)
line_10 = Line(StartPoint=point_35, EndPoint=point_37)

# ----
# CLOUD
cull_index_9 = CullIndex(List=cull_index_8, Indices=closest_points_8.CPIndex, Wrap=True)

point_on_curve_12 = PointOnCurve(line_10, parameter=0.561)

closest_points_9 = ClosestPoints(Point=point_on_curve_12, Cloud=cull_index_9, Count=_6)  # -> ClosestPoint, CPIndex, Distance
explode_tree_10 = ExplodeTree(Data=graft(closest_points_9.ClosestPoint))  # -> _03000100000300000000100, Branch1, Branch2, Branch3, Branch4, Branch5, Branch6, Branch7, Branch8, Branch9
point_38 = Point(explode_tree_10._03000100000300000000100)

# ----
# CLOUD
cull_index_10 = CullIndex(List=cull_index_9, Indices=closest_points_9.CPIndex, Wrap=True)

closest_points_10 = ClosestPoints(Point=point_38, Cloud=cull_index_10, Count=_7)  # -> ClosestPoint, CPIndex, Distance

cull_index_11 = CullIndex(List=cull_index_10, Indices=closest_points_10.CPIndex, Wrap=True)

# ----
# CLOUD
west_2 = Point(flatten(west))
available_internal_points = Point(cull_index_11)
find_similar_member_4 = FindSimilarMember(Data=west_2, Set=available_internal_points)  # -> Hit, Index
cull_index_12 = CullIndex(List=available_internal_points, Indices=find_similar_member_4.Index, Wrap=True)

closest_points_11 = ClosestPoints(Point=point_on_curve_6, Cloud=cull_index_12, Count=_0_2)  # -> ClosestPoint, CPIndex, Distance
explode_tree_11 = ExplodeTree(Data=graft(closest_points_11.ClosestPoint))  # -> _0300010000030000000010000000, _0300010000030000000010000001
point_39 = Point(explode_tree_11._0300010000030000000010000001)
point_40 = Point(explode_tree_11._0300010000030000000010000000)
line_11 = Line(StartPoint=point_40, EndPoint=point_39)

# ----
# CLOUD
cull_index_13 = CullIndex(List=cull_index_12, Indices=closest_points_11.CPIndex, Wrap=True)

point_on_curve_13 = PointOnCurve(line_11, parameter=0.513)

closest_points_12 = ClosestPoints(Point=point_on_curve_13, Cloud=cull_index_13, Count=_2_2)  # -> ClosestPoint, CPIndex, Distance
explode_tree_12 = ExplodeTree(Data=graft(closest_points_12.ClosestPoint))  # -> _030001000003000000001000000000, _030001000003000000001000000001, _030001000003000000001000000002, _030001000003000000001000000003
point_41 = Point(explode_tree_12._030001000003000000001000000000)
point_42 = Point(explode_tree_12._030001000003000000001000000001)
point_43 = Point(explode_tree_12._030001000003000000001000000002)
point_44 = Point(explode_tree_12._030001000003000000001000000003)
line_12 = Line(StartPoint=point_41, EndPoint=point_44)

# ----
# CLOUD
cull_index_14 = CullIndex(List=cull_index_13, Indices=closest_points_12.CPIndex, Wrap=True)

point_on_curve_14 = PointOnCurve(line_12, parameter=0.571)

closest_point_3 = ClosestPoint(Point=point_on_curve_14, Cloud=cull_index_14)  # -> ClosestPoint, CPIndex, Distance
deconstruct_5 = Deconstruct(Point=closest_point_3.ClosestPoint)  # -> XComponent, YComponent, ZComponent

# ----
# Finding Courtyard - 3 Points
# Get cloud of points - achieve the range direction south
cloud_3 = ClosestPoints(Point=point_on_curve_14, Cloud=cull_index_14, Count=Slider(5, range=0..100))  # -> ClosestPoint, CPIndex, Distance
deconstruct_6 = Deconstruct(Point=cloud_3.ClosestPoint)  # -> XComponent, YComponent, ZComponent
sort_list_3 = SortList(Keys=deconstruct_6.YComponent)  # -> Keys, ValuesValuesA
delete_consecutive_3 = DeleteConsecutive(Set=sort_list_3.Keys, Wrap=False)  # -> Set, Count
last_index_6 = LastIndex(List=delete_consecutive_3.Set)
cull_index_15 = CullIndex(List=delete_consecutive_3.Set, Indices=last_index_6, Wrap=True)
filter_3 = ConstructPoint(XCoordinate=deconstruct_5.XComponent, YCoordinate=cull_index_15, ZCoordinate=0)

# ----
# CLOUD
find_similar_member_5 = FindSimilarMember(Data=filter_3, Set=cull_index_14)  # -> Hit, Index
cull_index_16 = CullIndex(List=cull_index_14, Indices=find_similar_member_5.Index, Wrap=True)

explode_tree_13 = ExplodeTree(Data=graft(filter_3))  # -> _0300010000030000000010000000000000, _0300010000030000000010000000000001, Branch2, Branch3
point_45 = Point(explode_tree_13._0300010000030000000010000000000000)
point_46 = Point(explode_tree_13._0300010000030000000010000000000001)
line_13 = Line(StartPoint=point_45, EndPoint=point_46)

point_47 = Point(point_14)
closest_points_13 = ClosestPoints(Point=point_47, Cloud=cull_index_16, Count=_3_2)  # -> ClosestPoint, CPIndex, Distance
explode_tree_14 = ExplodeTree(Data=graft(closest_points_13.ClosestPoint))  # -> _030001000003000000001000000000000000, _030001000003000000001000000000000001, Branch2, Branch3, Branch4
point_48 = Point(explode_tree_14._030001000003000000001000000000000000)
point_49 = Point(explode_tree_14._030001000003000000001000000000000001)
line_14 = Line(StartPoint=point_45, EndPoint=point_49)

# ----
# CLOUD
cull_index_17 = CullIndex(List=cull_index_16, Indices=closest_points_13.CPIndex, Wrap=True)

line_15 = Line(StartPoint=point_43, EndPoint=point_44)
point_on_curve_15 = PointOnCurve(line_14, parameter=0)

closest_points_14 = ClosestPoints(Point=point_on_curve_15, Cloud=cull_index_17, Count=_4_2)  # -> ClosestPoint, CPIndex, Distance
explode_tree_15 = ExplodeTree(Data=graft(closest_points_14.ClosestPoint))  # -> _03000100000300000000100000000000000100, _03000100000300000000100000000000000101, _03000100000300000000100000000000000102, Branch3
point_50 = Point(explode_tree_15._03000100000300000000100000000000000102)
point_51 = Point(explode_tree_15._03000100000300000000100000000000000100)
point_52 = Point(explode_tree_15._03000100000300000000100000000000000101)
line_16 = Line(StartPoint=point_51, EndPoint=point_52)

# ----
# CLOUD
cull_index_18 = CullIndex(List=cull_index_17, Indices=closest_points_14.CPIndex, Wrap=True)

# ----
# Compare with Excel, desired Areas
# Distribute Points in Curve
point_on_curve_16 = PointOnCurve(line_16, parameter=0.248)
closest_points_15 = ClosestPoints(Point=point_on_curve_16, Cloud=cull_index_18, Count=_5_2)  # -> ClosestPoint, CPIndex, Distance
explode_tree_16 = ExplodeTree(Data=graft(closest_points_15.ClosestPoint))  # -> _0300010000030000000010000000000000010000, _0300010000030000000010000000000000010001, _0300010000030000000010000000000000010002, Branch3
point_53 = Point(explode_tree_16._0300010000030000000010000000000000010000)
point_54 = Point(explode_tree_16._0300010000030000000010000000000000010001)
point_55 = Point(explode_tree_16._0300010000030000000010000000000000010002)

line_17 = Line(StartPoint=point_54, EndPoint=point_55)

# ----
# CLOUD
cull_index_19 = CullIndex(List=cull_index_18, Indices=closest_points_15.CPIndex, Wrap=True)

point_on_curve_17 = PointOnCurve(line_15, parameter=0.195)

explode_tree_17 = ExplodeTree(Data=graft(closest_points_10.ClosestPoint))  # -> _0300010000030000000010000, _0300010000030000000010001, _0300010000030000000010002, Branch3, Branch4, Branch5, Branch6, Branch7, Branch8, Branch9
point_56 = Point(explode_tree_17._0300010000030000000010000)
point_57 = Point(explode_tree_17._0300010000030000000010001)
point_58 = Point(explode_tree_17._0300010000030000000010002)
point_59 = Point(explode_tree_17.Branch3)

point_on_curve_18 = PointOnCurve(line_17, parameter=0)
lobby = Point(flatten([point_6, point_2]))

range = Range(Domain=Slider(13, range=0..100), Steps=Slider(79, range=0..100))
unit_z = UnitZ(Factor=range)
xy_plane = XYPlane(Origin=Point(0, 0, 0))
move = Move(Geometry=xy_plane, Motion=unit_z)  # -> Geometry, Transform

closest_point_4 = ClosestPoint(Point=point_on_curve_17, Cloud=cull_index_19)  # -> ClosestPoint, CPIndex, Distance
deconstruct_7 = Deconstruct(Point=closest_point_4.ClosestPoint)  # -> XComponent, YComponent, ZComponent

# ----
# Finding Courtyard - 3 Points
# Get cloud of points - achieve the range direction south
cloud_4 = ClosestPoints(Point=point_on_curve_17, Cloud=cull_index_19, Count=Slider(3, range=0..100))  # -> ClosestPoint, CPIndex, Distance
deconstruct_8 = Deconstruct(Point=cloud_4.ClosestPoint)  # -> XComponent, YComponent, ZComponent
sort_list_4 = SortList(Keys=deconstruct_8.YComponent)  # -> Keys, ValuesValuesA
delete_consecutive_4 = DeleteConsecutive(Set=sort_list_4.Keys, Wrap=False)  # -> Set, Count
filter_4 = ConstructPoint(XCoordinate=deconstruct_7.XComponent, YCoordinate=delete_consecutive_4.Set, ZCoordinate=0)

cull_index_20 = CullIndex(List=cull_index_18, Indices=closest_points_15.CPIndex, Wrap=True)
find_similar_member_6 = FindSimilarMember(Data=filter_4, Set=cull_index_20)  # -> Hit, Index
cull_index_21 = CullIndex(List=cull_index_20, Indices=find_similar_member_6.Index, Wrap=True)

closest_points_16 = ClosestPoints(Point=point_on_curve_18, Cloud=cull_index_21, Count=_6_2)  # -> ClosestPoint, CPIndex, Distance
explode_tree_18 = ExplodeTree(Data=graft(closest_points_16.ClosestPoint))  # -> _030001000003000000001000000000000001000000000, _030001000003000000001000000000000001000000001, _030001000003000000001000000000000001000000002, _030001000003000000001000000000000001000000003
point_60 = Point(explode_tree_18._030001000003000000001000000000000001000000002)
point_61 = Point(explode_tree_18._030001000003000000001000000000000001000000001)
point_62 = Point(explode_tree_18._030001000003000000001000000000000001000000000)
line_18 = Line(StartPoint=point_60, EndPoint=point_61)

# ----
# CLOUD
cull_index_22 = CullIndex(List=cull_index_21, Indices=closest_points_16.CPIndex, Wrap=True)

point_on_curve_19 = PointOnCurve(line_18, parameter=0.34)

closest_points_17 = ClosestPoints(Point=point_on_curve_19, Cloud=cull_index_22, Count=_7_2)  # -> ClosestPoint, CPIndex, Distance
explode_tree_19 = ExplodeTree(Data=graft(closest_points_17.ClosestPoint))  # -> _03000100000300000000100000000000000100000000200, _03000100000300000000100000000000000100000000201, Branch2, Branch3
point_63 = Point(explode_tree_19._03000100000300000000100000000000000100000000200)
point_64 = Point(explode_tree_19._03000100000300000000100000000000000100000000201)
line_19 = Line(StartPoint=point_63, EndPoint=point_64)

# ----
# CLOUD
cull_index_23 = CullIndex(List=cull_index_22, Indices=closest_points_17.CPIndex, Wrap=True)

point_on_curve_20 = PointOnCurve(line_19, parameter=1)

explode_tree_20 = ExplodeTree(Data=graft(filter_4))  # -> _0300010000030000000010000000000000010000000, _0300010000030000000010000000000000010000001, _0300010000030000000010000000000000010000002, Branch3
point_65 = Point(explode_tree_20._0300010000030000000010000000000000010000000)
point_66 = Point(explode_tree_20._0300010000030000000010000000000000010000001)

point_67 = Point(explode_tree_20._0300010000030000000010000000000000010000002)

line_20 = Line(StartPoint=point_65, EndPoint=point_67)

point_on_curve_21 = PointOnCurve(line_20, parameter=0.695)

point_68 = Point(graft(lobby))
# COMPACTING - Missing for each step
explode_tree_21 = ExplodeTree(Data=point_68)  # -> Branch0, Branch1
number_slider_23 = Slider(3, range=0..10)
number_slider_24 = Slider(2, range=0..10)
circle_cnr = CircleCNR(Center=explode_tree_21.Branch1, Normal=Vector(0, 0, 1), Radius=number_slider_24)
circle_cnr_2 = CircleCNR(Center=explode_tree_21.Branch0, Normal=Vector(0, 0, 1), Radius=number_slider_23)
addition_3 = Addition(A=number_slider_23, B=number_slider_24)
# Line from Anker
# to Unit-center
# Multiplied Units
data = Data(explode_tree_21.Branch0)
# Define
# - Ancherpoint
# - Springlenght (2*r)
anchor = Anchor(Point=data, Strength=10000)

line_21 = Line(StartPoint=data, EndPoint=explode_tree_21.Branch1)

length_line = LengthLine(Line=line_21, Length=addition_3, Strength=10)
# Merge, Button and Solve
merge_2 = Merge(Data1=anchor, Data2=length_line)
solver = Solver(GoalObjects=merge_2, Reset=Button(), Threshold=1e-15, Tolerance=0.01, On=Toggle(True))  # -> I, V, O
# Create New Circle
sub_list = SubList(List=solver.V, Domain=Domain(1, 1), Wrap=True)  # -> List, Index

circle_cnr_3 = CircleCNR(Center=sub_list.List, Normal=Vector(0, 0, 1), Radius=number_slider_24)

geometry = Geometry(flatten([circle_cnr_3, circle_cnr_2]))
area = Area(Geometry=geometry)  # -> Area, Centroid

closest_point_5 = ClosestPoint(Point=point_on_curve_21, Cloud=cull_index_23)  # -> ClosestPoint, CPIndex, Distance
deconstruct_9 = Deconstruct(Point=closest_point_5.ClosestPoint)  # -> XComponent, YComponent, ZComponent

# ----
# Finding Courtyard - 3 Points
# Get cloud of points - achieve the range direction south
cloud_5 = ClosestPoints(Point=point_on_curve_21, Cloud=cull_index_23, Count=Slider(6, range=0..100))  # -> ClosestPoint, CPIndex, Distance
filter_5 = ConstructPoint(XCoordinate=deconstruct_9.XComponent, YCoordinate=0, ZCoordinate=0)

# ----
# CLOUD
cull_index_24 = CullIndex(List=cull_index_23, Indices=cloud_5.CPIndex, Wrap=True)

closest_points_18 = ClosestPoints(Point=point_on_curve_20, Cloud=cull_index_24, Count=_8)  # -> ClosestPoint, CPIndex, Distance
explode_tree_22 = ExplodeTree(Data=graft(closest_points_18.ClosestPoint))  # -> _030001000003000000001000000000000001000000002000000, _030001000003000000001000000000000001000000002000001, _030001000003000000001000000000000001000000002000002, _030001000003000000001000000000000001000000002000003
point_69 = Point(explode_tree_22._030001000003000000001000000000000001000000002000003)
point_70 = Point(explode_tree_22._030001000003000000001000000000000001000000002000001)
point_71 = Point(explode_tree_22._030001000003000000001000000000000001000000002000000)
point_72 = Point(explode_tree_22._030001000003000000001000000000000001000000002000002)
line_22 = Line(StartPoint=point_70, EndPoint=point_72)

# ----
# CLOUD
cull_index_25 = CullIndex(List=cull_index_24, Indices=closest_points_18.CPIndex, Wrap=True)

explode_tree_23 = ExplodeTree(Data=graft(cloud_5.ClosestPoint))  # -> _0300010000030000000010000000000000010000000020000, _0300010000030000000010000000000000010000000020001, _0300010000030000000010000000000000010000000020002, _0300010000030000000010000000000000010000000020003, _0300010000030000000010000000000000010000000020004, _0300010000030000000010000000000000010000000020005
point_73 = Point(explode_tree_23._0300010000030000000010000000000000010000000020000)
point_74 = Point(explode_tree_23._0300010000030000000010000000000000010000000020001)
point_75 = Point(explode_tree_23._0300010000030000000010000000000000010000000020002)
point_76 = Point(explode_tree_23._0300010000030000000010000000000000010000000020003)
point_77 = Point(explode_tree_23._0300010000030000000010000000000000010000000020004)
point_78 = Point(explode_tree_23._0300010000030000000010000000000000010000000020005)
line_23 = Line(StartPoint=point_73, EndPoint=point_76)

point_on_curve_22 = PointOnCurve(line_22, parameter=1)

closest_points_19 = ClosestPoints(Point=point_on_curve_22, Cloud=cull_index_25, Count=_9)  # -> ClosestPoint, CPIndex, Distance
explode_tree_24 = ExplodeTree(Data=graft(closest_points_19.ClosestPoint))  # -> _03000100000300000000100000000000000100000000200000100, _03000100000300000000100000000000000100000000200000101
point_79 = Point(explode_tree_24._03000100000300000000100000000000000100000000200000100)
point_80 = Point(explode_tree_24._03000100000300000000100000000000000100000000200000101)
line_24 = Line(StartPoint=point_79, EndPoint=point_80)

point_on_curve_23 = PointOnCurve(line_23, parameter=0.312)

# ----
# CLOUD
cull_index_26 = CullIndex(List=cull_index_25, Indices=closest_points_19.CPIndex, Wrap=True)

point_on_curve_24 = PointOnCurve(line_24, parameter=0.638)

closest_points_20 = ClosestPoints(Point=point_on_curve_24, Cloud=cull_index_26, Count=_10)  # -> ClosestPoint, CPIndex, Distance
explode_tree_25 = ExplodeTree(Data=graft(closest_points_20.ClosestPoint))  # -> _0300010000030000000010000000000000010000000020000010000, _0300010000030000000010000000000000010000000020000010001, _0300010000030000000010000000000000010000000020000010002, _0300010000030000000010000000000000010000000020000010003, _0300010000030000000010000000000000010000000020000010004, _0300010000030000000010000000000000010000000020000010005
point_81 = Point(explode_tree_25._0300010000030000000010000000000000010000000020000010000)
point_82 = Point(explode_tree_25._0300010000030000000010000000000000010000000020000010001)
point_83 = Point(explode_tree_25._0300010000030000000010000000000000010000000020000010002)
point_84 = Point(explode_tree_25._0300010000030000000010000000000000010000000020000010003)
point_85 = Point(explode_tree_25._0300010000030000000010000000000000010000000020000010005)
point_86 = Point(explode_tree_25._0300010000030000000010000000000000010000000020000010004)

tentbag_masonry = Point(flatten([point_47, point_48, point_49]))
t_tailoring = Point(flatten([point_41, point_42, point_43, point_44]))
office = Point(flatten([point_24, closest_points_6.ClosestPoint]))
pet_bottles = Point(flatten(closest_points_16.ClosestPoint))
kitchen_facilities = Point(flatten([closest_points_10.ClosestPoint, closest_points_9.ClosestPoint]))
soils = Point(flatten([point_51, point_52, point_53, point_54, point_55, point_50]))
tentbags = Point(flatten([point_13, point_39]))
toilets = Point(flatten([point_22, point_19]))
cloakroom = Point(flatten([point_20, point_21]))
tents = Point(flatten([point_12, point_40]))
expo = Point(flatten([point_5, point_7, point_3, point_4]))
classroom = Point(flatten([point_30, point_31]))
library = Point(flatten([point_32, point_33]))
adobe_bricks = Point(flatten([point_72, point_69, point_70, point_71]))
pet_bot_masonry = Point(flatten([point_64, point_63]))
adobeb_masonry = Point(flatten(closest_points_19.ClosestPoint))
dinning = Point(flatten(closest_points_8.ClosestPoint))
brick_drying = Point(flatten(closest_points_20.ClosestPoint))
metaball_t = MetaBallT(Points=tentbag_masonry, Plane=PlaneXY(0, 0, 0), Threshold=Slider(0.12, range=0..1))
metaball_t_2 = MetaBallT(Points=tents, Plane=PlaneXY(0, 0, 0), Threshold=Slider(0.19, range=0..1))
metaball_t_3 = MetaBallT(Points=soils, Plane=PlaneXY(0, 0, 0), Threshold=Slider(0.19, range=0..1))
metaball_t_4 = MetaBallT(Points=tentbags, Plane=PlaneXY(0, 0, 0), Threshold=Slider(0.18, range=0..1))
metaball_t_5 = MetaBallT(Points=t_tailoring, Plane=PlaneXY(0, 0, 0), Threshold=Slider(0.18, range=0..1))
metaball_t_6 = MetaBallT(Points=adobeb_masonry, Plane=PlaneXY(0, 0, 0), Threshold=Slider(0.09, range=0..1))
# METABALL
metaball_t_7 = MetaBallT(Points=area.Centroid, Plane=PlaneXY(0, 0, 0), Threshold=Slider(0.18, range=0..1))
metaball_t_8 = MetaBallT(Points=pet_bot_masonry, Plane=PlaneXY(0, 0, 0), Threshold=Slider(0.19, range=0..1))
metaball_t_9 = MetaBallT(Points=brick_drying, Plane=PlaneXY(0, 0, 0), Threshold=Slider(0.13, range=0..1))
metaball_t_10 = MetaBallT(Points=expo, Plane=PlaneXY(0, 0, 0), Threshold=Slider(0.19, range=0..1))
metaball_t_11 = MetaBallT(Points=pet_bottles, Plane=PlaneXY(0, 0, 0), Threshold=Slider(0.19, range=0..1))
metaball_t_12 = MetaBallT(Points=library, Plane=PlaneXY(0, 0, 0), Threshold=Slider(0.16, range=0..1))
metaball_t_13 = MetaBallT(Points=adobe_bricks, Plane=PlaneXY(0, 0, 0), Threshold=Slider(0.19, range=0..1))
metaball_t_14 = MetaBallT(Points=classroom, Plane=PlaneXY(0, 0, 0), Threshold=Slider(0.17, range=0..1))
metaball_t_15 = MetaBallT(Points=kitchen_facilities, Plane=PlaneXY(0, 0, 0), Threshold=Slider(0.19, range=0..1))
metaball_t_16 = MetaBallT(Points=dinning, Plane=PlaneXY(0, 0, 0), Threshold=Slider(0.19, range=0..1))
metaball_t_17 = MetaBallT(Points=cloakroom, Plane=PlaneXY(0, 0, 0), Threshold=Slider(0.19, range=0..1))
metaball_t_18 = MetaBallT(Points=toilets, Plane=PlaneXY(0, 0, 0), Threshold=Slider(0.19, range=0..1))
metaball_t_19 = MetaBallT(Points=office, Plane=PlaneXY(0, 0, 0), Threshold=Slider(0.19, range=0..1))

# ----
# GROUPS
number_slider_25 = Slider(0.22, range=0..1)
metaball_t_20 = MetaBallT(
    Points=[kitchen_facilities, dinning, classroom, library, cloakroom, toilets, office, expo, area.Centroid],
    Plane=PlaneXY(0, 0, 0),
    Threshold=number_slider_25)

metaball_t_21 = MetaBallT(Points=[pet_bot_masonry, pet_bottles], Plane=PlaneXY(0, 0, 0), Threshold=Slider(0.15, range=0..1))

metaball_t_22 = MetaBallT(
    Points=[tents, tentbags, t_tailoring, tentbag_masonry, soils],
    Plane=PlaneXY(0, 0, 0),
    Threshold=Slider(0.17, range=0..1))

metaball_t_23 = MetaBallT(Points=[adobeb_masonry, brick_drying, adobe_bricks], Plane=PlaneXY(0, 0, 0), Threshold=Slider(0.12, range=0..1))

point_87 = Point([pet_bottles, pet_bot_masonry])
point_88 = Point([tentbags, tents, t_tailoring, tentbag_masonry, soils])
point_89 = Point([brick_drying, adobeb_masonry, adobe_bricks])
point_90 = Point([kitchen_facilities, dinning, classroom, library, cloakroom, toilets, office, expo, area.Centroid])
metaball_t_24 = MetaBallT(Points=[point_88, point_89, point_87, point_90], Plane=move.Geometry, Threshold=Slider(0.29, range=0..1))  # -> flatten(Isocurve)
