# Grasshopper definition Form finding script for tent roof.gh (Grasshopper 1.0.7)
# plug-ins: Kangaroo2 Components

line = Line([Line((22.20579845, 131.1654195, 2), (22.20281475, 132.9078118, 2)), Line((21.95251714, 141.701653, 2), (22.66681667, 143.5967724, 2)), Line((41.55241251, 140.2926194, 2), (42.58750109, 138.9460449, 2)), Line((43.24766758, 127.053979, 2), (41.78075361, 125.6482838, 2))])
line_2 = Line([Line((64.73452752, 131.5265646, 1.997458946), (66.05595207, 131.1751319, 2.018092999)), Line((78.23936208, 135.6554679, 1.996940915), (78.17087192, 137.3306059, 1.997415832)), Line((67.50257513, 144.8893807, 2.000105041), (66.19926569, 144.6250971, 2.018580247)), Line((60.70256263, 140.438149, 1.99986098), (60.55073153, 139.0759179, 2.015170713))])
line_3 = Line([Line((52.71618565, 147.4195885, 2.000126726), (51.34319873, 147.0117847, 1.999629481)), Line((41.6746895, 149.61845, 1.996398208), (40.41405326, 150.3436706, 1.995995909)), Line((45.82829828, 169.5771443, 1.998826357), (47.12361567, 169.7939009, 1.999287184)), Line((56.27674808, 169.1234192, 2.002434888), (57.65807802, 168.6216063, 2.002890152))])
line_4 = Line([Line((94.86921681, 140.9458836, 2.031686401), (95.27323314, 142.5507889, 2)), Line((84.00758968, 157.1186291, 2.013850192), (82.51974229, 157.0357671, 2.010896714)), Line((72.59331988, 143.7598193, 2), (73.39110954, 142.3771963, 2))])

# ----
# Group 1
# Input boundary of the
# required of the required tent
# Input anchor lines
# on the ground
# Input curve of top surface
# of anchor walls
curve = Curve([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])
curve_2 = Curve([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])
curve_3 = Curve(line)

number_slider = Slider(2000, range=0..2000)
number_slider_2 = Slider(85, range=0..100)
boundary_surfaces = BoundarySurfaces(Edges=curve)
project = Project(Curve=curve_2, Brep=boundary_surfaces, Direction=Vector(0, 0, 1))
settings_custom = SettingsCustom(
    StitchSeams=True,
    SimplePlanes=False,
    Refine=True,
    MinCount=number_slider,
    MaxCount=number_slider,
    AspectRatio=20,
    MaxDistance=0,
    MaxAngle=20,
    MinEdge=0,
    MaxEdge=0)
divide_curve = DivideCurve(Curve=project, Count=number_slider_2, Kinks=False)  # -> Points, Tangents, Parameters
divide_curve_2 = DivideCurve(Curve=curve_2, Count=number_slider_2, Kinks=False)  # -> Points, Tangents, Parameters
mesh_brep = MeshBrep(Brep=boundary_surfaces, Settings=settings_custom)
divide_curve_3 = DivideCurve(Curve=curve_3, Count=10, Kinks=False)  # -> Points, Tangents, Parameters
deconstruct_mesh = DeconstructMesh(Mesh=mesh_brep)  # -> Vertices, Faces, Colours, Normals
point = Point(divide_curve_3.Points)
closest_point = ClosestPoint(Point=point, Cloud=deconstruct_mesh.Vertices)  # -> ClosestPoint, CPIndex, Distance
closest_point_2 = ClosestPoint(Point=divide_curve.Points, Cloud=deconstruct_mesh.Vertices)  # -> ClosestPoint, CPIndex, Distance
edgelengths = EdgeLengths(Mesh=mesh_brep, LengthFactor=Slider(0.703, range=0..1), Strength=Slider(91, range=0..1000))
anchor = Anchor(Point=closest_point.ClosestPoint, Strength=10000)
vertexloads = VertexLoads(Mesh=mesh_brep, Strength=Slider(-0.131, range=-1..1))
anchor_2 = Anchor(Point=closest_point_2.ClosestPoint, Target=divide_curve_2.Points, Strength=10000)
show = Show(G=mesh_brep)
solver = Solver(
    GoalObjects=flatten([show, edgelengths, vertexloads, anchor_2, anchor]),
    Reset=Toggle(False),
    Threshold=1e-15,
    Tolerance=0.01,
    On=True)  # -> I, V, O

geometry = Geometry(solver.O)

# ----
# Group 2
# Input boundary of the
# required of the required tent
# Input anchor lines
# on the ground
# Input curve of top surface
# of anchor walls
curve_4 = Curve(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)
curve_5 = Curve([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])
curve_6 = Curve(line_3)

number_slider_3 = Slider(2000, range=0..2000)
number_slider_4 = Slider(85, range=0..100)
boundary_surfaces_2 = BoundarySurfaces(Edges=curve_4)
project_2 = Project(Curve=curve_5, Brep=boundary_surfaces_2, Direction=Vector(0, 0, 1))
settings_custom_2 = SettingsCustom(
    StitchSeams=True,
    SimplePlanes=False,
    Refine=True,
    MinCount=number_slider_3,
    MaxCount=number_slider_3,
    AspectRatio=20,
    MaxDistance=0,
    MaxAngle=20,
    MinEdge=0,
    MaxEdge=0)
divide_curve_4 = DivideCurve(Curve=project_2, Count=number_slider_4, Kinks=False)  # -> Points, Tangents, Parameters
divide_curve_5 = DivideCurve(Curve=curve_5, Count=number_slider_4, Kinks=False)  # -> Points, Tangents, Parameters
mesh_brep_2 = MeshBrep(Brep=boundary_surfaces_2, Settings=settings_custom_2)
divide_curve_6 = DivideCurve(Curve=curve_6, Count=10, Kinks=False)  # -> Points, Tangents, Parameters
deconstruct_mesh_2 = DeconstructMesh(Mesh=mesh_brep_2)  # -> Vertices, Faces, Colours, Normals
point_2 = Point(divide_curve_6.Points)
closest_point_3 = ClosestPoint(Point=point_2, Cloud=deconstruct_mesh_2.Vertices)  # -> ClosestPoint, CPIndex, Distance
closest_point_4 = ClosestPoint(Point=divide_curve_4.Points, Cloud=deconstruct_mesh_2.Vertices)  # -> ClosestPoint, CPIndex, Distance
edgelengths_2 = EdgeLengths(Mesh=mesh_brep_2, LengthFactor=Slider(0.703, range=0..1), Strength=Slider(91, range=0..1000))
anchor_3 = Anchor(Point=closest_point_3.ClosestPoint, Strength=10000)
vertexloads_2 = VertexLoads(Mesh=mesh_brep_2, Strength=Slider(-0.131, range=-1..1))
anchor_4 = Anchor(Point=closest_point_4.ClosestPoint, Target=divide_curve_5.Points, Strength=10000)
show_2 = Show(G=mesh_brep_2)
solver_2 = Solver(
    GoalObjects=flatten([show_2, edgelengths_2, vertexloads_2, anchor_4, anchor_3]),
    Reset=Toggle(False),
    Threshold=1e-15,
    Tolerance=0.01,
    On=True)  # -> I, V, O

geometry_2 = Geometry(solver_2.O)

# ----
# Group 4
# Input boundary of the
# required of the required tent
# Input anchor lines
# on the ground
# Input curve of top surface
# of anchor walls
curve_7 = Curve(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)
curve_8 = Curve([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])
curve_9 = Curve(line_2)

number_slider_5 = Slider(2000, range=0..2000)
number_slider_6 = Slider(85, range=0..100)
boundary_surfaces_3 = BoundarySurfaces(Edges=curve_7)
project_3 = Project(Curve=curve_8, Brep=boundary_surfaces_3, Direction=Vector(0, 0, 1))
settings_custom_3 = SettingsCustom(
    StitchSeams=True,
    SimplePlanes=False,
    Refine=True,
    MinCount=number_slider_5,
    MaxCount=number_slider_5,
    AspectRatio=20,
    MaxDistance=0,
    MaxAngle=20,
    MinEdge=0,
    MaxEdge=0)
divide_curve_7 = DivideCurve(Curve=project_3, Count=number_slider_6, Kinks=False)  # -> Points, Tangents, Parameters
divide_curve_8 = DivideCurve(Curve=curve_8, Count=number_slider_6, Kinks=False)  # -> Points, Tangents, Parameters
mesh_brep_3 = MeshBrep(Brep=boundary_surfaces_3, Settings=settings_custom_3)
divide_curve_9 = DivideCurve(Curve=curve_9, Count=10, Kinks=False)  # -> Points, Tangents, Parameters
deconstruct_mesh_3 = DeconstructMesh(Mesh=mesh_brep_3)  # -> Vertices, Faces, Colours, Normals
point_3 = Point(divide_curve_9.Points)
closest_point_5 = ClosestPoint(Point=point_3, Cloud=deconstruct_mesh_3.Vertices)  # -> ClosestPoint, CPIndex, Distance
closest_point_6 = ClosestPoint(Point=divide_curve_7.Points, Cloud=deconstruct_mesh_3.Vertices)  # -> ClosestPoint, CPIndex, Distance
edgelengths_3 = EdgeLengths(Mesh=mesh_brep_3, LengthFactor=Slider(0.703, range=0..1), Strength=Slider(91, range=0..1000))
anchor_5 = Anchor(Point=closest_point_5.ClosestPoint, Strength=10000)
vertexloads_3 = VertexLoads(Mesh=mesh_brep_3, Strength=Slider(-0.131, range=-1..1))
anchor_6 = Anchor(Point=closest_point_6.ClosestPoint, Target=divide_curve_8.Points, Strength=10000)
show_3 = Show(G=mesh_brep_3)
solver_3 = Solver(
    GoalObjects=flatten([show_3, edgelengths_3, vertexloads_3, anchor_6, anchor_5]),
    Reset=Toggle(False),
    Threshold=1e-15,
    Tolerance=0.01,
    On=True)  # -> I, V, O

geometry_3 = Geometry(solver_3.O)

# ----
# Group 3
# Input boundary of the
# required of the required tent
# Input anchor lines
# on the ground
# Input curve of top surface
# of anchor walls
curve_10 = Curve([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])
curve_11 = Curve([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])
curve_12 = Curve(line_4)

number_slider_7 = Slider(2000, range=0..2000)
number_slider_8 = Slider(85, range=0..100)
boundary_surfaces_4 = BoundarySurfaces(Edges=curve_10)
project_4 = Project(Curve=curve_11, Brep=boundary_surfaces_4, Direction=Vector(0, 0, 1))
settings_custom_4 = SettingsCustom(
    StitchSeams=True,
    SimplePlanes=False,
    Refine=True,
    MinCount=number_slider_7,
    MaxCount=number_slider_7,
    AspectRatio=20,
    MaxDistance=0,
    MaxAngle=20,
    MinEdge=0,
    MaxEdge=0)
divide_curve_10 = DivideCurve(Curve=project_4, Count=number_slider_8, Kinks=False)  # -> Points, Tangents, Parameters
divide_curve_11 = DivideCurve(Curve=curve_11, Count=number_slider_8, Kinks=False)  # -> Points, Tangents, Parameters
mesh_brep_4 = MeshBrep(Brep=boundary_surfaces_4, Settings=settings_custom_4)
divide_curve_12 = DivideCurve(Curve=curve_12, Count=10, Kinks=False)  # -> Points, Tangents, Parameters
deconstruct_mesh_4 = DeconstructMesh(Mesh=mesh_brep_4)  # -> Vertices, Faces, Colours, Normals
point_4 = Point(divide_curve_12.Points)
closest_point_7 = ClosestPoint(Point=point_4, Cloud=deconstruct_mesh_4.Vertices)  # -> ClosestPoint, CPIndex, Distance
closest_point_8 = ClosestPoint(Point=divide_curve_10.Points, Cloud=deconstruct_mesh_4.Vertices)  # -> ClosestPoint, CPIndex, Distance
edgelengths_4 = EdgeLengths(Mesh=mesh_brep_4, LengthFactor=Slider(0.703, range=0..1), Strength=Slider(91, range=0..1000))
anchor_7 = Anchor(Point=closest_point_7.ClosestPoint, Strength=10000)
vertexloads_4 = VertexLoads(Mesh=mesh_brep_4, Strength=Slider(-0.131, range=-1..1))
anchor_8 = Anchor(Point=closest_point_8.ClosestPoint, Target=divide_curve_11.Points, Strength=10000)
show_4 = Show(G=mesh_brep_4)
solver_4 = Solver(
    GoalObjects=flatten([show_4, edgelengths_4, vertexloads_4, anchor_8, anchor_7]),
    Reset=Toggle(False),
    Threshold=1e-15,
    Tolerance=0.01,
    On=True)  # -> I, V, O

geometry_4 = Geometry(solver_4.O)
