# Grasshopper definition brick patterns.gh (Grasshopper 1.0.7)

brick_length = Slider(0.2, range=0..1)
brick_height = Slider(0.07, range=0..1)
brick_width = Slider(0.3, range=0..1)

brick_height_2 = Slider(0.07, range=0..1)
brick_width_2 = Slider(0.3, range=0..1)
brick_length_2 = Slider(0.2, range=0..1)

brick_length_3 = Slider(0.2, range=0..1)
brick_width_3 = Slider(0.3, range=0..1)
brick_height_3 = Slider(0.07, range=0..1)

# ----
# Pattern 1
# Input brick size
# Input surface
brep = Brep(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)

contour = Contour(Shape=brep, Point=Point(0, 0, 0), Direction=Vector(0, 0, 1), Distance=brick_height)
division = Division(A=brick_height, B=2)
division_2 = Division(A=brick_length, B=Slider(4, range=0..10))
division_3 = Division(A=brick_width, B=2)
curve = Curve(flatten(contour))
list_length = ListLength(List=curve)
number_slider = Slider(6, range=0..10)
integer = Integer(list_length)
cull_index = CullIndex(List=curve, Indices=integer, Wrap=True)
list_length_2 = ListLength(List=cull_index)
division_4 = Division(A=list_length_2, B=number_slider)
series = Series(Start=Slider(1, range=0..10), Step=number_slider, Count=division_4)
series_2 = Series(Start=0, Step=number_slider, Count=division_4)
series_3 = Series(Start=Slider(2, range=0..10), Step=number_slider, Count=division_4)
series_4 = Series(Start=Slider(3, range=0..10), Step=number_slider, Count=division_4)
series_5 = Series(Start=Slider(4, range=0..10), Step=number_slider, Count=division_4)
series_6 = Series(Start=Slider(5, range=0..10), Step=number_slider, Count=division_4)
list_item = ListItem(List=cull_index, Index=series_2, Wrap=True)
list_item_2 = ListItem(List=cull_index, Index=series_3, Wrap=True)
list_item_3 = ListItem(List=cull_index, Index=series, Wrap=True)
list_item_4 = ListItem(List=cull_index, Index=series_4, Wrap=True)
list_item_5 = ListItem(List=cull_index, Index=series_5, Wrap=True)
list_item_6 = ListItem(List=cull_index, Index=series_6, Wrap=True)
length = Length(Curve=list_item)
length_2 = Length(Curve=list_item_2)
length_3 = Length(Curve=list_item_3)
length_4 = Length(Curve=list_item_4)
length_5 = Length(Curve=list_item_5)
length_6 = Length(Curve=list_item_6)
division_5 = Division(A=length, B=division_2)
division_6 = Division(A=length_2, B=division_2)
division_7 = Division(A=length_3, B=division_2)
division_8 = Division(A=length_4, B=division_2)
division_9 = Division(A=length_5, B=division_2)
division_10 = Division(A=length_6, B=division_2)
horizontal_frames = HorizontalFrames(Curve=list_item, Count=division_5)  # -> Frames, Parameters
horizontal_frames_2 = HorizontalFrames(Curve=list_item_2, Count=division_6)  # -> Frames, Parameters
horizontal_frames_3 = HorizontalFrames(Curve=list_item_3, Count=division_7)  # -> Frames, Parameters
horizontal_frames_4 = HorizontalFrames(Curve=list_item_4, Count=division_8)  # -> Frames, Parameters
horizontal_frames_5 = HorizontalFrames(Curve=list_item_5, Count=division_9)  # -> Frames, Parameters
horizontal_frames_6 = HorizontalFrames(Curve=list_item_6, Count=division_10)  # -> Frames, Parameters
cull_pattern = CullPattern(List=horizontal_frames_2.Frames, CullPattern=[False, True, True, True, True, False])
cull_pattern_2 = CullPattern(List=horizontal_frames_4.Frames, CullPattern=[False, False, True, True, False, False])
cull_pattern_3 = CullPattern(List=horizontal_frames_5.Frames, CullPattern=[False, True, True, True, True, False])
cull_pattern_4 = CullPattern(List=horizontal_frames.Frames, CullPattern=[True, False, False, False, False, True])
cull_pattern_5 = CullPattern(List=horizontal_frames_3.Frames, CullPattern=[True, True, False, False, True, True])
cull_pattern_6 = CullPattern(List=horizontal_frames_6.Frames, CullPattern=[True, True, False, False, True, True])
center_box = CenterBox(Base=cull_pattern_4, X=expr("x/2", division_2), Y=division_3, Z=division)  # -> simplify(Box)
center_box_2 = CenterBox(Base=cull_pattern_5, X=expr("x/2", division_2), Y=division_3, Z=division)  # -> simplify(Box)
center_box_3 = CenterBox(Base=cull_pattern, X=expr("x/2", division_2), Y=division_3, Z=division)  # -> simplify(Box)
center_box_4 = CenterBox(Base=cull_pattern_2, X=expr("x/2", division_2), Y=division_3, Z=division)  # -> simplify(Box)
center_box_5 = CenterBox(Base=cull_pattern_3, X=expr("x/2", division_2), Y=division_3, Z=division)  # -> simplify(Box)
center_box_6 = CenterBox(Base=cull_pattern_6, X=expr("x/2", division_2), Y=division_3, Z=division)  # -> simplify(Box)

merge = Merge(Data1=center_box, Data2=center_box_2, Data3=center_box_3, Data4=center_box_4, Data5=center_box_5, Data6=center_box_6)  # -> reverse(Result)

# ----
# Pattern 2
# Input brick size
# Input surface
brep_2 = Brep(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)

contour_2 = Contour(Shape=brep_2, Point=Point(0, 0, 0), Direction=Vector(0, 0, 1), Distance=brick_height_2)  # -> reverse(Contours)
division_11 = Division(A=brick_height_2, B=2)
division_12 = Division(A=brick_length_2, B=Slider(3, range=0..10))
division_13 = Division(A=brick_width_2, B=2)
curve_2 = Curve(flatten(contour_2))
list_length_3 = ListLength(List=curve_2)
number_slider_2 = Slider(4, range=0..10)
division_14 = Division(A=list_length_3, B=number_slider_2)
series_7 = Series(Start=0, Step=number_slider_2, Count=division_14)
series_8 = Series(Start=Slider(1, range=0..10), Step=number_slider_2, Count=division_14)
series_9 = Series(Start=Slider(2, range=0..10), Step=number_slider_2, Count=division_14)
series_10 = Series(Start=Slider(3, range=0..10), Step=number_slider_2, Count=division_14)
list_item_7 = ListItem(List=curve_2, Index=series_8, Wrap=True)
list_item_8 = ListItem(List=curve_2, Index=series_7, Wrap=True)
list_item_9 = ListItem(List=curve_2, Index=series_9, Wrap=True)
list_item_10 = ListItem(List=curve_2, Index=series_10, Wrap=False)
length_7 = Length(Curve=list_item_7)
length_8 = Length(Curve=list_item_8)
length_9 = Length(Curve=list_item_9)
length_10 = Length(Curve=list_item_10)
division_15 = Division(A=length_7, B=division_12)
division_16 = Division(A=length_8, B=division_12)
division_17 = Division(A=length_9, B=division_12)
division_18 = Division(A=length_10, B=division_12)
horizontal_frames_7 = HorizontalFrames(Curve=list_item_7, Count=division_15)  # -> Frames, Parameters
horizontal_frames_8 = HorizontalFrames(Curve=list_item_8, Count=division_16)  # -> Frames, Parameters
horizontal_frames_9 = HorizontalFrames(Curve=list_item_9, Count=expr("x*2", division_17))  # -> Frames, Parameters
horizontal_frames_10 = HorizontalFrames(Curve=list_item_10, Count=expr("x*2", division_18))  # -> Frames, Parameters
cull_pattern_7 = CullPattern(List=horizontal_frames_8.Frames, CullPattern=[True, True, False, True])
cull_pattern_8 = CullPattern(List=horizontal_frames_7.Frames, CullPattern=[True, True, False, True])
cull_pattern_9 = CullPattern(List=horizontal_frames_9.Frames, CullPattern=[False, True])
cull_pattern_10 = CullPattern(List=horizontal_frames_10.Frames, CullPattern=[False, True])
cull_pattern_11 = CullPattern(List=cull_pattern_9, CullPattern=[False, True, True, True])
cull_pattern_12 = CullPattern(List=cull_pattern_10, CullPattern=[False, True, True, True])
center_box_7 = CenterBox(Base=cull_pattern_11, X=expr("x/2", division_12), Y=division_13, Z=division_11)  # -> simplify(Box)
center_box_8 = CenterBox(Base=cull_pattern_12, X=expr("x/2", division_12), Y=division_13, Z=division_11)  # -> simplify(Box)
center_box_9 = CenterBox(Base=cull_pattern_7, X=expr("x/2", division_12), Y=division_13, Z=division_11)
center_box_10 = CenterBox(Base=cull_pattern_8, X=expr("x/2", division_12), Y=division_13, Z=division_11)

merge_2 = Merge(Data1=center_box_9, Data2=center_box_10, Data3=center_box_7, Data4=center_box_8)

# ----
# Pattern 3
# Input brick size
# Input surface
brep_3 = Brep(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)

contour_3 = Contour(Shape=brep_3, Point=Point(0, 0, 0), Direction=Vector(0, 0, 1), Distance=brick_height_3)
division_19 = Division(A=brick_height_3, B=2)
division_20 = Division(A=brick_length_3, B=Slider(6, range=0..10))
division_21 = Division(A=brick_width_3, B=2)
number_slider_3 = Slider(2, range=0..10)
curve_3 = Curve(flatten(contour_3))
list_length_4 = ListLength(List=curve_3)
division_22 = Division(A=list_length_4, B=number_slider_3)
series_11 = Series(Start=0, Step=number_slider_3, Count=division_22)
series_12 = Series(Start=Slider(1, range=0..10), Step=number_slider_3, Count=division_22)
list_item_11 = ListItem(List=curve_3, Index=series_11, Wrap=False)
list_item_12 = ListItem(List=curve_3, Index=series_12, Wrap=False)
length_11 = Length(Curve=list_item_11)
length_12 = Length(Curve=list_item_12)
division_23 = Division(A=length_11, B=division_20)
division_24 = Division(A=length_12, B=division_20)
horizontal_frames_11 = HorizontalFrames(Curve=list_item_11, Count=division_23)  # -> Frames, Parameters
horizontal_frames_12 = HorizontalFrames(Curve=list_item_12, Count=division_24)  # -> Frames, Parameters
cull_pattern_13 = CullPattern(List=horizontal_frames_11.Frames, CullPattern=[True, True, True, True, False, False])
cull_pattern_14 = CullPattern(List=horizontal_frames_12.Frames, CullPattern=[True, False, False, True, True, True])
center_box_11 = CenterBox(Base=cull_pattern_13, X=expr("x/2", division_20), Y=division_21, Z=division_19)  # -> simplify(Box)
center_box_12 = CenterBox(Base=cull_pattern_14, X=expr("x/2", division_20), Y=division_21, Z=division_19)  # -> simplify(Box)

merge_3 = Merge(Data1=center_box_11, Data2=center_box_12)
