# Grasshopper definition earth bag and bottle arrangement.gh (Grasshopper 1.0.7)
# plug-ins: Anemone, Weaverbird

# Input dome mesh
mesh = Mesh(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)
weaverbird_s_catmull_clark_subdivision = WeaverbirdsCatmullClarkSubdivision(MeshCurves=mesh, Level=3, SmoothNakedEdges=1)

brep = Brep(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)
bounding_box = BoundingBox(Content=brep, Plane=PlaneXY(0, 0, 0))  # -> Box, Box_2
deconstruct_box = DeconstructBox(Box=bounding_box.Box)  # -> Plane, X, Y, Z
deconstruct_domain = DeconstructDomain(Domain=deconstruct_box.Z)  # -> Start, End
deconstruct_domain_2 = DeconstructDomain(Domain=deconstruct_box.X)  # -> Start, End
subtraction = Subtraction(A=deconstruct_domain.Start, B=deconstruct_domain.End)
subtraction_2 = Subtraction(A=deconstruct_domain_2.Start, B=deconstruct_domain_2.End)
absolute = Absolute(Value=subtraction)
absolute_2 = Absolute(Value=subtraction_2)
division = Division(A=absolute, B=2)

brick_width = Slider(0.5, range=0..1)
brick_length = Slider(0.3, range=0..1)
mortar_gap = Slider(0.017, range=0..2)
brick_height = Slider(0.12, range=0..1)

plane = Plane(deconstruct_box.Plane)

division_2 = Division(A=brick_height, B=2)
contour = Contour(Shape=weaverbird_s_catmull_clark_subdivision, Point=Point(0, 0, 0), Direction=Vector(0, 0, 1), Distance=division_2)
closed = Closed(Curve=contour)  # -> Closed, Periodic
cull_pattern = CullPattern(List=contour, CullPattern=closed.Closed)
curve = Curve(flatten(cull_pattern))
list_length = ListLength(List=curve)
integer = Integer(list_length)
addition = Addition(A=brick_length, B=mortar_gap)
cull_index = CullIndex(List=curve, Indices=integer, Wrap=True)
cull_pattern_2 = CullPattern(List=cull_index, CullPattern=[True, False, True, False])
cull_pattern_3 = CullPattern(List=cull_pattern_2, CullPattern=[False, True])
cull_pattern_4 = CullPattern(List=cull_pattern_2, CullPattern=[True, False])
length = Length(Curve=cull_pattern_4)
length_2 = Length(Curve=cull_pattern_3)
division_3 = Division(A=brick_length, B=2)
division_4 = Division(A=brick_width, B=2)
division_5 = Division(A=brick_height, B=2)
division_6 = Division(A=length_2, B=addition)
division_7 = Division(A=length, B=addition)
round = Round(Number=division_6)  # -> Nearest, Floor, Ceiling
round_2 = Round(Number=division_7)  # -> Nearest, Floor, Ceiling
multiplication = Multiplication(A=round.Floor, B=2)
horizontal_frames = HorizontalFrames(Curve=cull_pattern_4, Count=round_2.Floor)  # -> Frames, Parameters
horizontal_frames_2 = HorizontalFrames(Curve=cull_pattern_3, Count=multiplication)  # -> Frames, Parameters
cull_pattern_5 = CullPattern(List=horizontal_frames_2.Frames, CullPattern=[False, True, False, True])
center_box = CenterBox(Base=[cull_pattern_5, horizontal_frames.Frames], X=division_3, Y=division_4, Z=division_5)

cull_index_2 = CullIndex(List=contour, Indices=cull_pattern, Wrap=True)
clean_tree = CleanTree(RemoveNulls=True, RemoveInvalid=True, RemoveEmpty=True, Tree=cull_index_2)
flip_matrix = FlipMatrix(Data=clean_tree)  # -> simplify(Data)
cull_pattern_6 = CullPattern(List=flip_matrix, CullPattern=[False, True, False, True])
cull_pattern_7 = CullPattern(List=cull_pattern_6, CullPattern=[True, False, True, False])
cull_pattern_8 = CullPattern(List=cull_pattern_6, CullPattern=[False, True, False, True])
flip_matrix_2 = FlipMatrix(Data=cull_pattern_8)
flip_matrix_3 = FlipMatrix(Data=cull_pattern_7)
tree_statistics = TreeStatistics(Tree=flip_matrix_2)  # -> Paths, Length, Count
curve_2 = Curve(flip_matrix_2)
tree_statistics_2 = TreeStatistics(Tree=flip_matrix_3)  # -> Paths, Length, Count
curve_3 = Curve(flip_matrix_3)
simplify_tree = SimplifyTree(Tree=curve_2, Front=False)
simplify_tree_2 = SimplifyTree(Tree=curve_3, Front=False)
sort_list = SortList(Keys=tree_statistics.Length)  # -> reverse(Keys), ValuesValuesA
sort_list_2 = SortList(Keys=tree_statistics_2.Length)  # -> reverse(Keys), ValuesValuesA
list_length_2 = ListLength(List=sort_list.Keys)
list_length_3 = ListLength(List=sort_list_2.Keys)
loop_start = LoopStart(Repeat=expr("x-1", list_length_2), Trigger=Button())  # -> port, Counter, Data
loop_start_2 = LoopStart(Repeat=expr("x-1", list_length_3), Trigger=Button())  # -> port, Counter, Data
tree_branch = TreeBranch(Tree=simplify_tree_2, Path=loop_start_2.Counter, MaintainPaths=True)
tree_branch_2 = TreeBranch(Tree=simplify_tree, Path=loop_start.Counter, MaintainPaths=True)
length_3 = Length(Curve=tree_branch)
length_4 = Length(Curve=tree_branch_2)
division_8 = Division(A=length_3, B=brick_length)
division_9 = Division(A=length_4, B=brick_length)
round_3 = Round(Number=division_8)  # -> Nearest, Floor, Ceiling
round_4 = Round(Number=division_9)  # -> Nearest, Floor, Ceiling
multiplication_2 = Multiplication(A=round_4.Floor, B=2)
horizontal_frames_3 = HorizontalFrames(Curve=tree_branch, Count=round_3.Floor)  # -> simplify(Frames), Parameters
horizontal_frames_4 = HorizontalFrames(Curve=tree_branch_2, Count=multiplication_2)  # -> Frames, Parameters
cull_pattern_9 = CullPattern(List=horizontal_frames_4.Frames, CullPattern=[False, True, False, True])
loop_end = LoopEnd(port=loop_start.port, Exit=False, Data=cull_pattern_9, TimeOutVal=0, pausedState=False, state="Constant & Record")
plane_2 = Plane(loop_end)
loop_end_2 = LoopEnd(
    port=loop_start_2.port,
    Exit=False,
    Data=horizontal_frames_3.Frames,
    TimeOutVal=0,
    pausedState=False,
    state="Constant & Record")
plane_3 = Plane(loop_end_2)
center_box_2 = CenterBox(Base=plane_3, X=division_3, Y=division_4, Z=division_5)
center_box_3 = CenterBox(Base=plane_2, X=division_3, Y=division_4, Z=division_5)

# ----
# Bottle arrangement output
# Input bottle geometry
contour_2 = Contour(Shape=weaverbird_s_catmull_clark_subdivision, Point=Point(0, 0, 0), Direction=Vector(0, 0, 1), Distance=division)

clean_tree_2 = CleanTree(RemoveNulls=True, RemoveInvalid=True, RemoveEmpty=True, Tree=contour_2)
flip_matrix_4 = FlipMatrix(Data=clean_tree_2)  # -> simplify(Data)
cull_pattern_10 = CullPattern(List=flip_matrix_4, CullPattern=[False, True, False, True])
cull_pattern_11 = CullPattern(List=cull_pattern_10, CullPattern=[True, False, True, False])
cull_pattern_12 = CullPattern(List=cull_pattern_10, CullPattern=[False, True, False, True])
flip_matrix_5 = FlipMatrix(Data=cull_pattern_12)
flip_matrix_6 = FlipMatrix(Data=cull_pattern_11)
tree_statistics_3 = TreeStatistics(Tree=flip_matrix_5)  # -> Paths, Length, Count
curve_4 = Curve(flip_matrix_5)
tree_statistics_4 = TreeStatistics(Tree=flip_matrix_6)  # -> Paths, Length, Count
curve_5 = Curve(flip_matrix_6)
simplify_tree_3 = SimplifyTree(Tree=curve_4, Front=False)
simplify_tree_4 = SimplifyTree(Tree=curve_5, Front=False)
sort_list_3 = SortList(Keys=tree_statistics_3.Length)  # -> reverse(Keys), ValuesValuesA
sort_list_4 = SortList(Keys=tree_statistics_4.Length)  # -> reverse(Keys), ValuesValuesA
list_length_4 = ListLength(List=sort_list_3.Keys)
list_length_5 = ListLength(List=sort_list_4.Keys)
loop_start_3 = LoopStart(Repeat=expr("x-1", list_length_4), Trigger=Button())  # -> port, Counter, Data
loop_start_4 = LoopStart(Repeat=expr("x-1", list_length_5), Trigger=Button())  # -> port, Counter, Data
tree_branch_3 = TreeBranch(Tree=simplify_tree_4, Path=loop_start_4.Counter, MaintainPaths=True)
tree_branch_4 = TreeBranch(Tree=simplify_tree_3, Path=loop_start_3.Counter, MaintainPaths=True)
length_5 = Length(Curve=tree_branch_3)
length_6 = Length(Curve=tree_branch_4)
division_10 = Division(A=length_5, B=absolute_2)
division_11 = Division(A=length_6, B=absolute_2)
round_5 = Round(Number=division_10)  # -> Nearest, Floor, Ceiling
round_6 = Round(Number=division_11)  # -> Nearest, Floor, Ceiling
multiplication_3 = Multiplication(A=round_6.Floor, B=2)
horizontal_frames_5 = HorizontalFrames(Curve=tree_branch_3, Count=round_5.Floor)  # -> simplify(Frames), Parameters
horizontal_frames_6 = HorizontalFrames(Curve=tree_branch_4, Count=multiplication_3)  # -> Frames, Parameters
cull_pattern_13 = CullPattern(List=horizontal_frames_6.Frames, CullPattern=[False, True, False, True])
loop_end_3 = LoopEnd(port=loop_start_3.port, Exit=False, Data=cull_pattern_13, TimeOutVal=0, pausedState=False, state="Constant & Record")
plane_4 = Plane(loop_end_3)
loop_end_4 = LoopEnd(
    port=loop_start_4.port,
    Exit=False,
    Data=horizontal_frames_5.Frames,
    TimeOutVal=0,
    pausedState=False,
    state="Constant & Record")
plane_5 = Plane(loop_end_4)

merge = Merge(Data1=plane_4, Data2=plane_5)
orient = Orient(Geometry=brep, Source=deconstruct_box.Plane, Target=merge)  # -> Geometry, Transform

# ----
# brick arrangement for continuous curves in a mesh
# convert brick to earth bag
# ouput brick arrangment
# ouput earth bag
# Input brick/earthbag sizes
# brick arrangement for discontinuous curves (openings) in a mesh
brep_2 = Brep([center_box, center_box_3, center_box_2])
smoothness_of_earth_bag = Slider(2, range=1..3)

settings_custom = SettingsCustom(
    StitchSeams=True,
    SimplePlanes=False,
    Refine=True,
    MinCount=16,
    MaxCount=400,
    AspectRatio=20,
    MaxDistance=0,
    MaxAngle=20,
    MinEdge=0,
    MaxEdge=0)
mesh_brep = MeshBrep(Brep=brep_2, Settings=settings_custom)
weaverbird_s_catmull_clark_subdivision_2 = WeaverbirdsCatmullClarkSubdivision(MeshCurves=mesh_brep, Level=Slider(1, range=0..3), SmoothNakedEdges=1)

weaverbird_s_laplacian_smoothing = WeaverbirdsLaplacianSmoothing(MeshCurves=mesh_brep, Level=smoothness_of_earth_bag, SmoothNakedEdges=1, Thin=1)
