# Grasshopper definition Form finding script for domes.gh (Grasshopper 1.0.7)
# plug-ins: Pufferfish, Kangaroo Components, Weaverbird, Kangaroo2 Components

# ----
# Group 2/7/8/9/10/12/13
# Input center lines
#  for the connecting arches.
# Input circles for domes
# Input center line arcs for
# all openings doors/windows.
line = Line([Line((2341.906076, 1597.770349, 0), (2341.906076, 1595.370349, 0)), Line((2343.956079, 1593.320355, 0), (2346.356079, 1593.320355, 0)), Line((2348.406091, 1591.270355, 0), (2348.406091, 1588.870355, 0)), Line((2354.906083, 1591.270355, 0), (2354.906083, 1588.870355, 0)), Line((2361.15433, 1588.466307, 0), (2359.733976, 1587.058262, 0))])
curve = Curve([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])
openings = Curve([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])
curve_2 = Curve(graft(line))
series = Series(Start=0, Step=1, Count=Slider(5, range=0..10))

number_slider = Slider(263, range=0..500)
settings_custom = SettingsCustom(
    StitchSeams=True,
    SimplePlanes=False,
    Refine=True,
    MinCount=number_slider,
    MaxCount=number_slider,
    AspectRatio=Slider(17, range=0..100),
    MaxDistance=0,
    MaxAngle=20,
    MinEdge=0,
    MaxEdge=0)
boundary_surfaces = BoundarySurfaces(Edges=curve)
mesh_brep = MeshBrep(Brep=boundary_surfaces, Settings=settings_custom)
deconstruct_mesh = DeconstructMesh(Mesh=mesh_brep)  # -> Vertices, Faces, Colours, Normals
weaverbird_s_mesh_edges = WeaverbirdsMeshEdges(MeshOrPolylines=mesh_brep)
nakedvertices = NakedVertices(Mesh=mesh_brep)  # -> ClothedIndex, NakedIndex, ClothedPts, NakedPts
force_value = Slider(101, range=0..1000)
unit_z = UnitZ(Factor=force_value)
stiffness = Slider(32, range=0..1000)
springsfromline = SpringsFromLine(
    Connection=weaverbird_s_mesh_edges,
    Stiffness=stiffness,
    Damping=10,
    RestLength=weaverbird_s_mesh_edges,
    UpperCutoff=0,
    LowerCutoff=0,
    Plasticity=0)
unaryforce = UnaryForce(Point=deconstruct_mesh.Vertices, Force=unit_z)
list_item = ListItem(List=deconstruct_mesh.Vertices, Index=nakedvertices.NakedIndex, Wrap=True)
timer = Timer(TimerInterval=20, Target=kangaroophysics)
kangaroophysics = KangarooPhysics(
    ForceObjects=flatten([unaryforce, springsfromline]),
    AnchorPoints=flatten(list_item),
    Settings=null,
    Geometry=mesh_brep,
    SimulationReset=Toggle(False))  # -> Out, Iterations, ParticlesOut, GeometryOut, KE; disabled
mesh = Mesh(simplify([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]))

end_points = EndPoints(Curve=openings)  # -> Start, End
curve_3 = Curve(flatten(curve))
point_in_curve = PointInCurve(Point=end_points.End, Curve=curve_3)  # -> Relationship, Point
point_in_curve_2 = PointInCurve(Point=end_points.Start, Curve=curve_3)  # -> Relationship, Point
reference_anchor = Point(point_in_curve_2.Point)
point = Point(point_in_curve.Point)
line_2 = Line(StartPoint=reference_anchor, EndPoint=point)
length = Length(Curve=line_2)
value_list = ValueList({"One": 1.2, "Two": 2.4, "Three": 3.6, "Four": 4.8}, selected="One")
value_list_2 = ValueList({"One": 1.2, "Two": 2.4, "Three": 3.6, "Four": 4.8}, selected="Two")
value_list_3 = ValueList({"One": 1.2, "Two": 2.4, "Three": 3.6, "Four": 4.8}, selected="Three")
value_list_4 = ValueList({"One": 1.2, "Two": 2.4, "Three": 3.6, "Four": 4.8}, selected="Four")
divide_curve = DivideCurve(Curve=line_2, Count=2, Kinks=False)  # -> Points, Tangents, Parameters
point_2 = Point(flatten(divide_curve.Points))
round_to_nearest = RoundToNearest(NumbersX=length, NumbersY=[value_list_2, value_list_3, value_list_4, value_list], RemapNumberX=False)  # -> Nearest, RemappedNumberX
find_similar_member = FindSimilarMember(Data=[end_points.Start, end_points.End], Set=point_2)  # -> Hit, Index
midpoints = CullIndex(List=divide_curve.Points, Indices=find_similar_member.Index, Wrap=True)  # -> flatten(List)
expression = Expression(x=round_to_nearest.Nearest, y=value_list, Expression="If(x=y,True,False)")
expression_2 = Expression(x=round_to_nearest.Nearest, y=value_list_3, Expression="If(x=y,True,False)")
expression_3 = Expression(x=round_to_nearest.Nearest, y=value_list_2, Expression="If(x=y,True,False)")
expression_4 = Expression(x=round_to_nearest.Nearest, y=value_list_4, Expression="If(x=y,True,False)")
cull_pattern = CullPattern(List=midpoints, CullPattern=expression)
cull_pattern_2 = CullPattern(List=midpoints, CullPattern=expression_3)
cull_pattern_3 = CullPattern(List=midpoints, CullPattern=expression_2)
cull_pattern_4 = CullPattern(List=midpoints, CullPattern=expression_4)
cull_pattern_5 = CullPattern(List=line_2, CullPattern=expression)
cull_pattern_6 = CullPattern(List=line_2, CullPattern=expression_2)
cull_pattern_7 = CullPattern(List=line_2, CullPattern=expression_4)
cull_pattern_8 = CullPattern(List=line_2, CullPattern=expression_3)
division = Division(A=Slider(2.4, range=1.2..2.4), B=2)
division_2 = Division(A=Slider(1, range=0.8..1.2), B=2)
division_3 = Division(A=Slider(4.8, range=3.6..4.8), B=2)
division_4 = Division(A=Slider(3.6, range=2.4..3.6), B=2)
circle_cnr = CircleCNR(Center=cull_pattern_2, Normal=Vector(0, 0, 1), Radius=division)
circle_cnr_2 = CircleCNR(Center=cull_pattern, Normal=Vector(0, 0, 1), Radius=division_2)
circle_cnr_3 = CircleCNR(Center=cull_pattern_3, Normal=Vector(0, 0, 1), Radius=division_4)
circle_cnr_4 = CircleCNR(Center=cull_pattern_4, Normal=Vector(0, 0, 1), Radius=division_3)
surface = Surface(circle_cnr)
line_3 = Line(cull_pattern_8)
surface_2 = Surface(circle_cnr_2)
line_4 = Line(cull_pattern_5)
surface_3 = Surface(circle_cnr_3)
line_5 = Line(cull_pattern_6)
surface_4 = Surface(circle_cnr_4)
line_6 = Line(cull_pattern_7)
surface_curve = SurfaceCurve(Surface=surface, Curve=line_3)  # -> Curves, Points, UVPoints, Normals, Parameters, Tangents
surface_curve_2 = SurfaceCurve(Surface=surface_2, Curve=line_4)  # -> Curves, Points, UVPoints, Normals, Parameters, Tangents
surface_curve_3 = SurfaceCurve(Surface=surface_3, Curve=line_5)  # -> Curves, Points, UVPoints, Normals, Parameters, Tangents
surface_curve_4 = SurfaceCurve(Surface=surface_4, Curve=line_6)  # -> Curves, Points, UVPoints, Normals, Parameters, Tangents
line_7 = Line(surface_curve.Curves)
line_8 = Line(surface_curve_2.Curves)
line_9 = Line(surface_curve_3.Curves)
line_10 = Line(surface_curve_4.Curves)

divide_curve_2 = DivideCurve(Curve=curve_2, Count=10, Kinks=False)  # -> Points, Tangents, Parameters
shatter = Shatter(Curve=curve_2, Parameters=divide_curve_2.Parameters)
unit_z_2 = UnitZ(Factor=Slider(78, range=0..100))
line_11 = Line(shatter)
point_3 = Point(divide_curve_2.Points)
springsfromline_2 = SpringsFromLine(
    Connection=line_11,
    Stiffness=Slider(747, range=0..1000),
    Damping=10,
    RestLength=line_11,
    UpperCutoff=0,
    LowerCutoff=0,
    Plasticity=0)
unaryforce_2 = UnaryForce(Point=point_3, Force=unit_z_2)
list_item_2 = ListItem(List=divide_curve_2.Points, Index=[0, 10], Wrap=True)
kangaroophysics_2 = KangarooPhysics(
    ForceObjects=flatten([springsfromline_2, unaryforce_2]),
    AnchorPoints=flatten(list_item_2),
    Settings=null,
    Geometry=line_11,
    SimulationReset=Toggle(False))  # -> Out, Iterations, ParticlesOut, GeometryOut, KE; disabled
timer_2 = Timer(TimerInterval=20, Target=kangaroophysics_2)
line_12 = Line(Tree({0;0;0}: [Line((2341.906076, 1597.770349, 0), (2341.906076, 1597.591079, 0.7021372686)), Line((2341.906076, 1597.591079, 0.7021372686), (2341.906076, 1597.396318, 1.295369377)), Line((2341.906076, 1597.396318, 1.295369377), (2341.906076, 1597.176181, 1.774274751)), Line((2341.906076, 1597.176181, 1.774274751), (2341.906076, 1596.910318, 2.121281026)), Line((2341.906076, 1596.910318, 2.121281026), (2341.906076, 1596.570349, 2.269197063)), Line((2341.906076, 1596.570349, 2.269197063), (2341.906076, 1596.23038, 2.121281026))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], {0;1;0}: [Line((2343.956079, 1593.320355, 0), (2344.135349, 1593.320355, 0.7021372686)), Line((2344.135349, 1593.320355, 0.7021372686), (2344.33011, 1593.320355, 1.295369377)), Line((2344.33011, 1593.320355, 1.295369377), (2344.550247, 1593.320355, 1.774274751)), Line((2344.550247, 1593.320355, 1.774274751), (2344.81611, 1593.320355, 2.121281026)), Line((2344.81611, 1593.320355, 2.121281026), (2345.156079, 1593.320355, 2.269197063)), Line((2345.156079, 1593.320355, 2.269197063), (2345.496048, 1593.320355, 2.121281026))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], {0;2;0}: [Line((2348.406091, 1591.270355, 0), (2348.406091, 1591.091084, 0.7021372686)), Line((2348.406091, 1591.091084, 0.7021372686), (2348.406091, 1590.896323, 1.295369377)), Line((2348.406091, 1590.896323, 1.295369377), (2348.406091, 1590.676187, 1.774274751)), Line((2348.406091, 1590.676187, 1.774274751), (2348.406091, 1590.410324, 2.121281026)), Line((2348.406091, 1590.410324, 2.121281026), (2348.406091, 1590.070355, 2.269197063)), Line((2348.406091, 1590.070355, 2.269197063), (2348.406091, 1589.730386, 2.121281026))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], {0;3;0}: [Line((2354.906083, 1591.270355, 0), (2354.906083, 1591.091084, 0.7021372686)), Line((2354.906083, 1591.091084, 0.7021372686), (2354.906083, 1590.896323, 1.295369377)), Line((2354.906083, 1590.896323, 1.295369377), (2354.906083, 1590.676187, 1.774274751)), Line((2354.906083, 1590.676187, 1.774274751), (2354.906083, 1590.410324, 2.121281026)), Line((2354.906083, 1590.410324, 2.121281026), (2354.906083, 1590.070355, 2.269197063)), Line((2354.906083, 1590.070355, 2.269197063), (2354.906083, 1589.730386, 2.121281026))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], {0;4;0}: [Line((2361.15433, 1588.466307, 0), (2361.047309, 1588.360214, 0.6648900396)), Line((2361.047309, 1588.360214, 0.6648900396), (2360.931955, 1588.245859, 1.222330561)), Line((2360.931955, 1588.245859, 1.222330561), (2360.802703, 1588.117727, 1.668538588)), Line((2360.802703, 1588.117727, 1.668538588), (2360.647262, 1587.963633, 1.990566481)), Line((2360.647262, 1587.963633, 1.990566481), (2360.444153, 1587.762285, 2.130859542)), Line((2360.444153, 1587.762285, 2.130859542), (2360.241044, 1587.560936, 1.990566481))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]))

offset = Offset(Curve=curve_2, Distance=-1.2, Plane=PlaneXY(0, 0, 0), Corners=1)
offset_2 = Offset(Curve=curve_2, Distance=1.2, Plane=PlaneXY(0, 0, 0), Corners=1)
divide_curve_3 = DivideCurve(Curve=curve_2, Count=2, Kinks=False)  # -> Points, Tangents, Parameters
divide_curve_4 = DivideCurve(Curve=curve_2, Count=2, Kinks=False)  # -> Points, Tangents, Parameters
divide_curve_5 = DivideCurve(Curve=offset, Count=2, Kinks=False)  # -> Points, Tangents, Parameters
divide_curve_6 = DivideCurve(Curve=curve_2, Count=2, Kinks=False)  # -> Points, Tangents, Parameters
divide_curve_7 = DivideCurve(Curve=offset_2, Count=2, Kinks=False)  # -> Points, Tangents, Parameters
list_item_3 = ListItem(List=divide_curve_3.Points, Index=1, Wrap=True)
list_item_4 = ListItem(List=divide_curve_4.Points, Index=1, Wrap=True)
list_item_5 = ListItem(List=divide_curve_5.Points, Index=1, Wrap=True)
list_item_6 = ListItem(List=divide_curve_6.Points, Index=1, Wrap=True)
list_item_7 = ListItem(List=divide_curve_7.Points, Index=1, Wrap=True)
vector_2pt = Vector2Pt(PointA=list_item_4, PointB=list_item_5, Unitize=False)  # -> Vector, Length
vector_2pt_2 = Vector2Pt(PointA=list_item_6, PointB=list_item_7, Unitize=False)  # -> Vector, Length
number_slider_2 = Slider(1.262, range=0..10)
move = Move(Geometry=line_12, Motion=vector_2pt.Vector)  # -> Geometry, Transform
move_2 = Move(Geometry=line_12, Motion=vector_2pt_2.Vector)  # -> Geometry, Transform
scale = Scale(Geometry=move.Geometry, Center=list_item_3, Factor=number_slider_2)  # -> Geometry, Transform
scale_2 = Scale(Geometry=move_2.Geometry, Center=list_item_3, Factor=number_slider_2)  # -> Geometry, Transform
ruled_surface = RuledSurface(CurveA=line_12, CurveB=scale.Geometry)  # -> flatten(Surface)
ruled_surface_2 = RuledSurface(CurveA=line_12, CurveB=scale_2.Geometry)  # -> flatten(Surface)
number_slider_3 = Slider(46, range=0..100)
brep_join = BrepJoin(Breps=ruled_surface_2)  # -> Breps, Closed
brep_join_2 = BrepJoin(Breps=ruled_surface)  # -> Breps, Closed
settings_custom_2 = SettingsCustom(
    StitchSeams=True,
    SimplePlanes=False,
    Refine=True,
    MinCount=number_slider_3,
    MaxCount=number_slider_3,
    AspectRatio=20,
    MaxDistance=0,
    MaxAngle=20,
    MinEdge=0,
    MaxEdge=0)
brep_join_3 = BrepJoin(Breps=[brep_join_2.Breps, brep_join.Breps])  # -> Breps, Closed
mesh_brep_2 = MeshBrep(Brep=brep_join_3.Breps, Settings=settings_custom_2)

# ----
# Group 1/3/4/5/6/11
# Input circles for domes
# Input center line arcs for
# all openings doors/windows.
curve_4 = Curve([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])
curve_5 = Curve(flatten(curve_4))
openings_2 = Curve([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])
end_points_2 = EndPoints(Curve=openings_2)  # -> Start, End
mesh_2 = Mesh(simplify([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]))
mesh_3 = Mesh(mesh_2)
series_2 = Series(Start=0, Step=1, Count=Slider(2, range=0..10))

number_slider_4 = Slider(144, range=0..500)
settings_custom_3 = SettingsCustom(
    StitchSeams=True,
    SimplePlanes=False,
    Refine=True,
    MinCount=number_slider_4,
    MaxCount=number_slider_4,
    AspectRatio=Slider(17, range=0..100),
    MaxDistance=0,
    MaxAngle=20,
    MinEdge=0,
    MaxEdge=0)
boundary_surfaces_2 = BoundarySurfaces(Edges=curve_4)
mesh_brep_3 = MeshBrep(Brep=boundary_surfaces_2, Settings=settings_custom_3)
weaverbird_s_mesh_edges_2 = WeaverbirdsMeshEdges(MeshOrPolylines=mesh_brep_3)
nakedvertices_2 = NakedVertices(Mesh=mesh_brep_3)  # -> ClothedIndex, NakedIndex, ClothedPts, NakedPts
deconstruct_mesh_2 = DeconstructMesh(Mesh=mesh_brep_3)  # -> Vertices, Faces, Colours, Normals
unit_z_3 = UnitZ(Factor=Slider(101, range=0..1000))
springsfromline_3 = SpringsFromLine(
    Connection=weaverbird_s_mesh_edges_2,
    Stiffness=Slider(5, range=0..1000),
    Damping=10,
    RestLength=weaverbird_s_mesh_edges_2,
    UpperCutoff=0,
    LowerCutoff=0,
    Plasticity=0)
unaryforce_3 = UnaryForce(Point=deconstruct_mesh_2.Vertices, Force=unit_z_3)
list_item_8 = ListItem(List=deconstruct_mesh_2.Vertices, Index=nakedvertices_2.NakedIndex, Wrap=True)
kangaroophysics_3 = KangarooPhysics(
    ForceObjects=flatten([unaryforce_3, springsfromline_3]),
    AnchorPoints=flatten(list_item_8),
    Settings=null,
    Geometry=mesh_brep_3,
    SimulationReset=Toggle(False))  # -> Out, Iterations, ParticlesOut, GeometryOut, KE
timer_3 = Timer(TimerInterval=20, Target=kangaroophysics_3)

point_in_curve_3 = PointInCurve(Point=end_points_2.Start, Curve=curve_5)  # -> Relationship, Point
point_in_curve_4 = PointInCurve(Point=end_points_2.End, Curve=curve_5)  # -> Relationship, Point
point_4 = Point(point_in_curve_4.Point)
reference_anchor_2 = Point(point_in_curve_3.Point)
line_13 = Line(StartPoint=reference_anchor_2, EndPoint=point_4)
divide_curve_8 = DivideCurve(Curve=line_13, Count=2, Kinks=False)  # -> Points, Tangents, Parameters
point_5 = Point(flatten(divide_curve_8.Points))
find_similar_member_2 = FindSimilarMember(Data=[end_points_2.Start, end_points_2.End], Set=point_5)  # -> Hit, Index
midpoints_2 = CullIndex(List=divide_curve_8.Points, Indices=find_similar_member_2.Index, Wrap=True)  # -> flatten(List)

length_2 = Length(Curve=line_13)
value_list_5 = ValueList({"One": 1.2, "Two": 2.4, "Three": 3.6, "Four": 4.8}, selected="Two")
value_list_6 = ValueList({"One": 1.2, "Two": 2.4, "Three": 3.6, "Four": 4.8}, selected="One")
value_list_7 = ValueList({"One": 1.2, "Two": 2.4, "Three": 3.6, "Four": 4.8}, selected="Three")
value_list_8 = ValueList({"One": 1.2, "Two": 2.4, "Three": 3.6, "Four": 4.8}, selected="Four")
round_to_nearest_2 = RoundToNearest(NumbersX=length_2, NumbersY=[value_list_5, value_list_7, value_list_8, value_list_6], RemapNumberX=False)  # -> Nearest, RemappedNumberX
expression_5 = Expression(x=round_to_nearest_2.Nearest, y=value_list_6, Expression="If(x=y,True,False)")
expression_6 = Expression(x=round_to_nearest_2.Nearest, y=value_list_7, Expression="If(x=y,True,False)")
expression_7 = Expression(x=round_to_nearest_2.Nearest, y=value_list_5, Expression="If(x=y,True,False)")
expression_8 = Expression(x=round_to_nearest_2.Nearest, y=value_list_8, Expression="If(x=y,True,False)")

cull_pattern_9 = CullPattern(List=midpoints_2, CullPattern=expression_5)
cull_pattern_10 = CullPattern(List=midpoints_2, CullPattern=expression_8)
cull_pattern_11 = CullPattern(List=midpoints_2, CullPattern=expression_7)
cull_pattern_12 = CullPattern(List=midpoints_2, CullPattern=expression_6)
cull_pattern_13 = CullPattern(List=line_13, CullPattern=expression_5)
cull_pattern_14 = CullPattern(List=line_13, CullPattern=expression_7)
cull_pattern_15 = CullPattern(List=line_13, CullPattern=expression_6)
cull_pattern_16 = CullPattern(List=line_13, CullPattern=expression_8)

division_5 = Division(A=Slider(0.8, range=0.8..1.2), B=2)
circle_cnr_5 = CircleCNR(Center=cull_pattern_9, Normal=Vector(0, 0, 1), Radius=division_5)
surface_5 = Surface(circle_cnr_5)
line_14 = Line(cull_pattern_13)
surface_curve_5 = SurfaceCurve(Surface=surface_5, Curve=line_14)  # -> Curves, Points, UVPoints, Normals, Parameters, Tangents
line_15 = Line(surface_curve_5.Curves)

division_6 = Division(A=Slider(2.4, range=1.2..2.4), B=2)
circle_cnr_6 = CircleCNR(Center=cull_pattern_11, Normal=Vector(0, 0, 1), Radius=division_6)
surface_6 = Surface(circle_cnr_6)
line_16 = Line(cull_pattern_14)
surface_curve_6 = SurfaceCurve(Surface=surface_6, Curve=line_16)  # -> Curves, Points, UVPoints, Normals, Parameters, Tangents
line_17 = Line(surface_curve_6.Curves)

division_7 = Division(A=Slider(4.8, range=3.6..4.8), B=2)
circle_cnr_7 = CircleCNR(Center=cull_pattern_10, Normal=Vector(0, 0, 1), Radius=division_7)
line_18 = Line(cull_pattern_16)
surface_7 = Surface(circle_cnr_7)
surface_curve_7 = SurfaceCurve(Surface=surface_7, Curve=line_18)  # -> Curves, Points, UVPoints, Normals, Parameters, Tangents
line_19 = Line(surface_curve_7.Curves)

division_8 = Division(A=Slider(3.6, range=2.4..3.6), B=2)
circle_cnr_8 = CircleCNR(Center=cull_pattern_12, Normal=Vector(0, 0, 1), Radius=division_8)
surface_8 = Surface(circle_cnr_8)
line_20 = Line(cull_pattern_15)
surface_curve_8 = SurfaceCurve(Surface=surface_8, Curve=line_20)  # -> Curves, Points, UVPoints, Normals, Parameters, Tangents
line_21 = Line(surface_curve_8.Curves)

curve_6 = Curve(graft([line_19, line_21, line_17, line_15]))
divide_curve_9 = DivideCurve(Curve=curve_6, Count=10, Kinks=False)  # -> Points, Tangents, Parameters
unit_z_4 = UnitZ(Factor=Slider(78, range=0..100))
shatter_2 = Shatter(Curve=curve_6, Parameters=divide_curve_9.Parameters)
point_6 = Point(divide_curve_9.Points)
unaryforce_4 = UnaryForce(Point=point_6, Force=unit_z_4)
list_item_9 = ListItem(List=divide_curve_9.Points, Index=[0, 10], Wrap=True)
line_22 = Line(shatter_2)
timer_4 = Timer(TimerInterval=20, Target=kangaroophysics_4)
springsfromline_4 = SpringsFromLine(
    Connection=line_22,
    Stiffness=Slider(490, range=0..1000),
    Damping=10,
    RestLength=line_22,
    UpperCutoff=0,
    LowerCutoff=0,
    Plasticity=0)
kangaroophysics_4 = KangarooPhysics(
    ForceObjects=flatten([springsfromline_4, unaryforce_4]),
    AnchorPoints=flatten(list_item_9),
    Settings=null,
    Geometry=line_22,
    SimulationReset=Toggle(False))  # -> Out, Iterations, ParticlesOut, GeometryOut, KE
line_23 = Line(Tree({0;0;0;0;0}: [Line((2356.523072, 1600.414609, 0), (2356.523072, 1600.482205, 0.7960396574)), Line((2356.523072, 1600.482205, 0.7960396574), (2356.523072, 1600.551714, 1.432709953)), Line((2356.523072, 1600.551714, 1.432709953), (2356.523072, 1600.624629, 1.909750705)), Line((2356.523072, 1600.624629, 1.909750705), (2356.523072, 1600.705205, 2.226050278)), Line((2356.523072, 1600.705205, 2.226050278), (2356.523072, 1600.814609, 2.369205124)), Line((2356.523072, 1600.814609, 2.369205124), (2356.523072, 1600.924013, 2.226050278))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], {0;0;1;0;0}: [Line((2356.523072, 1597.914609, 0), (2356.523072, 1597.982205, 0.7960396574)), Line((2356.523072, 1597.982205, 0.7960396574), (2356.523072, 1598.051714, 1.432709953)), Line((2356.523072, 1598.051714, 1.432709953), (2356.523072, 1598.124629, 1.909750705)), Line((2356.523072, 1598.124629, 1.909750705), (2356.523072, 1598.205205, 2.226050278)), Line((2356.523072, 1598.205205, 2.226050278), (2356.523072, 1598.314609, 2.369205124)), Line((2356.523072, 1598.314609, 2.369205124), (2356.523072, 1598.424013, 2.226050278))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]))
join_curves = JoinCurves(Curves=[line_23, curve_6], Preserve=False)

offset_3 = Offset(Curve=curve_6, Distance=-1, Plane=PlaneXY(0, 0, 0), Corners=1)
divide_curve_10 = DivideCurve(Curve=curve_6, Count=2, Kinks=False)  # -> Points, Tangents, Parameters
divide_curve_11 = DivideCurve(Curve=offset_3, Count=2, Kinks=False)  # -> Points, Tangents, Parameters
list_item_10 = ListItem(List=divide_curve_11.Points, Index=1, Wrap=True)
list_item_11 = ListItem(List=divide_curve_10.Points, Index=1, Wrap=True)
vector_2pt_3 = Vector2Pt(PointA=list_item_11, PointB=list_item_10, Unitize=False)  # -> Vector, Length
move_3 = Move(Geometry=join_curves, Motion=vector_2pt_3.Vector)  # -> Geometry, Transform

offset_4 = Offset(Curve=curve_6, Distance=1, Plane=PlaneXY(0, 0, 0), Corners=1)
divide_curve_12 = DivideCurve(Curve=curve_6, Count=2, Kinks=False)  # -> Points, Tangents, Parameters
divide_curve_13 = DivideCurve(Curve=offset_4, Count=2, Kinks=False)  # -> Points, Tangents, Parameters
list_item_12 = ListItem(List=divide_curve_13.Points, Index=1, Wrap=True)
list_item_13 = ListItem(List=divide_curve_12.Points, Index=1, Wrap=True)
vector_2pt_4 = Vector2Pt(PointA=list_item_13, PointB=list_item_12, Unitize=False)  # -> Vector, Length
move_4 = Move(Geometry=join_curves, Motion=vector_2pt_4.Vector)  # -> Geometry, Transform

ruled_surface_3 = RuledSurface(CurveA=join_curves, CurveB=move_3.Geometry)  # -> flatten(Surface)
ruled_surface_4 = RuledSurface(CurveA=join_curves, CurveB=move_4.Geometry)  # -> flatten(Surface)
brep_join_4 = BrepJoin(Breps=[ruled_surface_3, ruled_surface_4])  # -> Breps, Closed
settings_custom_4 = SettingsCustom(
    StitchSeams=True,
    SimplePlanes=False,
    Refine=True,
    MinCount=16,
    MaxCount=400,
    AspectRatio=20,
    MaxDistance=0,
    MaxAngle=20,
    MinEdge=0,
    MaxEdge=0)
mesh_brep_4 = MeshBrep(Brep=brep_join_4.Breps, Settings=settings_custom_4)

mesh_split = MeshSplit(Mesh=mesh_3, Splitters=mesh_brep_4)  # -> flatten(Result)
area = Area(Geometry=mesh_split)  # -> Area, Centroid
sort_list = SortList(Keys=area.Area, ValuesValuesA=mesh_split)  # -> Keys, ValuesValuesA
list_length = ListLength(List=sort_list.Keys)
expression_9 = Expression(X=list_length, N=series_2, Expression="(X-1)-N")
list_item_14 = ListItem(List=flatten(sort_list.ValuesValuesA), Index=expression_9, Wrap=True)
mesh_4 = Mesh(list_item_14)

mesh_split_2 = MeshSplit(Mesh=mesh_brep_2, Splitters=mesh)  # -> flatten(Result)
mesh_split_3 = MeshSplit(Mesh=flatten(mesh), Splitters=[brep_join_2.Breps, brep_join.Breps])
area_2 = Area(Geometry=mesh_split_3)  # -> Area, Centroid
list_item_15 = ListItem(
    List=mesh_split_2,
    Index=[Slider(10, range=0..15), Slider(1, range=0..15), Slider(4, range=0..15), Slider(13, range=0..15), Slider(7, range=0..15)],
    Wrap=True)
sort_list_2 = SortList(Keys=area_2.Area, ValuesValuesA=mesh_split_3)  # -> Keys, reverse(ValuesValuesA)
weaverbird_s_laplacian_smoothing = WeaverbirdsLaplacianSmoothing(MeshCurves=list_item_15, Level=Slider(5, range=0..20), SmoothNakedEdges=0, Thin=Slider(1, range=0..1))
list_item_16 = ListItem(List=sort_list_2.ValuesValuesA, Index=0, Wrap=True)
mesh_5 = Mesh(flatten(list_item_16))
list_item_17 = ListItem(
    List=mesh_5,
    Index=[Slider(0, range=0..5), Slider(2, range=0..5), Slider(3, range=0..5), Slider(4, range=0..5), Slider(5, range=0..5)],
    Wrap=True)
list_item_18 = ListItem(List=mesh_5, Index=Slider(1, range=0..5), Wrap=True)

curve_7 = Curve(graft([line_10, line_9, line_7, line_8]))
offset_5 = Offset(Curve=curve_7, Distance=-1, Plane=PlaneXY(0, 0, 0), Corners=1)
offset_6 = Offset(Curve=curve_7, Distance=1, Plane=PlaneXY(0, 0, 0), Corners=1)
divide_curve_14 = DivideCurve(Curve=curve_7, Count=2, Kinks=False)  # -> Points, Tangents, Parameters
divide_curve_15 = DivideCurve(Curve=offset_5, Count=2, Kinks=False)  # -> Points, Tangents, Parameters
divide_curve_16 = DivideCurve(Curve=curve_7, Count=2, Kinks=False)  # -> Points, Tangents, Parameters
divide_curve_17 = DivideCurve(Curve=offset_6, Count=2, Kinks=False)  # -> Points, Tangents, Parameters
list_item_19 = ListItem(List=divide_curve_14.Points, Index=1, Wrap=True)
list_item_20 = ListItem(List=divide_curve_15.Points, Index=1, Wrap=True)
list_item_21 = ListItem(List=divide_curve_17.Points, Index=1, Wrap=True)
list_item_22 = ListItem(List=divide_curve_16.Points, Index=1, Wrap=True)
vector_2pt_5 = Vector2Pt(PointA=list_item_19, PointB=list_item_20, Unitize=False)  # -> Vector, Length
vector_2pt_6 = Vector2Pt(PointA=list_item_22, PointB=list_item_21, Unitize=False)  # -> Vector, Length
settings_custom_5 = SettingsCustom(
    StitchSeams=True,
    SimplePlanes=False,
    Refine=True,
    MinCount=16,
    MaxCount=400,
    AspectRatio=20,
    MaxDistance=0,
    MaxAngle=20,
    MinEdge=0,
    MaxEdge=0)

divide_curve_18 = DivideCurve(Curve=curve_7, Count=10, Kinks=False)  # -> Points, Tangents, Parameters
shatter_3 = Shatter(Curve=curve_7, Parameters=divide_curve_18.Parameters)
point_7 = Point(divide_curve_18.Points)
unit_z_5 = UnitZ(Factor=Slider(78, range=0..100))
line_24 = Line(shatter_3)
springsfromline_5 = SpringsFromLine(
    Connection=line_24,
    Stiffness=Slider(723, range=0..1000),
    Damping=10,
    RestLength=line_24,
    UpperCutoff=0,
    LowerCutoff=0,
    Plasticity=0)
unaryforce_5 = UnaryForce(Point=point_7, Force=unit_z_5)
list_item_23 = ListItem(List=divide_curve_18.Points, Index=[0, 10], Wrap=True)
kangaroophysics_5 = KangarooPhysics(
    ForceObjects=flatten([springsfromline_5, unaryforce_5]),
    AnchorPoints=flatten(list_item_23),
    Settings=null,
    Geometry=line_24,
    SimulationReset=Toggle(False))  # -> Out, Iterations, ParticlesOut, GeometryOut, KE; disabled
timer_5 = Timer(TimerInterval=20, Target=kangaroophysics_5)
line_25 = Line(Tree({0;0;0;0;0}: [Line((2335.559386, 1596.599407, 0), (2335.712269, 1596.381068, 0.8281656625)), Line((2335.712269, 1596.381068, 0.8281656625), (2335.880843, 1596.140321, 1.538403887)), Line((2335.880843, 1596.140321, 1.538403887), (2336.073973, 1595.864505, 2.11961593)), Line((2336.073973, 1595.864505, 2.11961593), (2336.307022, 1595.531678, 2.54042311)), Line((2336.307022, 1595.531678, 2.54042311), (2336.591827, 1595.124936, 2.711843923)), Line((2336.591827, 1595.124936, 2.711843923), (2336.876633, 1594.718194, 2.54042311))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], {0;0;0;1;0}: [Line((2350.456091, 1587.183332, 0), (2350.635612, 1587.183332, 0.7183157491)), Line((2350.635612, 1587.183332, 0.7183157491), (2350.830364, 1587.183332, 1.324402793)), Line((2350.830364, 1587.183332, 1.324402793), (2351.050156, 1587.183332, 1.812985259)), Line((2351.050156, 1587.183332, 1.812985259), (2351.315457, 1587.183332, 2.166833046)), Line((2351.315457, 1587.183332, 2.166833046), (2351.656091, 1587.183332, 2.318274171)), Line((2351.656091, 1587.183332, 2.318274171), (2351.996724, 1587.183332, 2.166833046))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], {0;0;0;2;0}: [Line((2358.656086, 1593.106294, 0), (2358.576553, 1593.106294, 0.5845642871)), Line((2358.576553, 1593.106294, 0.5845642871), (2358.493271, 1593.106294, 1.060661905)), Line((2358.493271, 1593.106294, 1.060661905), (2358.403432, 1593.106294, 1.427501163)), Line((2358.403432, 1593.106294, 1.427501163), (2358.299591, 1593.106295, 1.681911615)), Line((2358.299591, 1593.106295, 1.681911615), (2358.156086, 1593.106295, 1.799106868)), Line((2358.156086, 1593.106295, 1.799106868), (2358.012581, 1593.106295, 1.681911615))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], {0;0;1;0;0}: [Line((2342.636068, 1591.870348, 0), (2342.636069, 1591.603805, 0.8281656625)), Line((2342.636069, 1591.603805, 0.8281656625), (2342.63607, 1591.309906, 1.538403887)), Line((2342.63607, 1591.309906, 1.538403887), (2342.636071, 1590.973196, 2.11961593)), Line((2342.636071, 1590.973196, 2.11961593), (2342.636072, 1590.566889, 2.54042311)), Line((2342.636072, 1590.566889, 2.54042311), (2342.636073, 1590.070348, 2.711843923)), Line((2342.636073, 1590.070348, 2.711843923), (2342.636075, 1589.573806, 2.54042311))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], {0;0;1;1;0}: [Line((2355.673341, 1588.170122, 0), (2355.828811, 1588.080361, 0.7183157491)), Line((2355.828811, 1588.080361, 0.7183157491), (2355.997471, 1587.982986, 1.324402793)), Line((2355.997471, 1587.982986, 1.324402793), (2356.187817, 1587.87309, 1.812985259)), Line((2356.187817, 1587.87309, 1.812985259), (2356.417574, 1587.74044, 2.166833046)), Line((2356.417574, 1587.74044, 2.166833046), (2356.712572, 1587.570123, 2.318274171)), Line((2356.712572, 1587.570123, 2.318274171), (2357.00757, 1587.399807, 2.166833046))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], {0;0;1;2;0}: [Line((2356.642336, 1592.832802, 0), (2356.587251, 1592.792109, 0.569642247)), Line((2356.587251, 1592.792109, 0.569642247), (2356.529888, 1592.749733, 1.031011799)), Line((2356.529888, 1592.749733, 1.031011799), (2356.468519, 1592.704398, 1.383574578)), Line((2356.468519, 1592.704398, 1.383574578), (2356.398438, 1592.652627, 1.625143071)), Line((2356.398438, 1592.652627, 1.625143071), (2356.301417, 1592.580954, 1.736620423)), Line((2356.301417, 1592.580954, 1.736620423), (2356.204396, 1592.509281, 1.625143071))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], {0;0;2;0;0}: [Line((2360.267805, 1584.953649, 0), (2360.435177, 1584.88873, 0.7183157491)), Line((2360.435177, 1584.88873, 0.7183157491), (2360.616748, 1584.818302, 1.324402793)), Line((2360.616748, 1584.818302, 1.324402793), (2360.821665, 1584.738819, 1.812985259)), Line((2360.821665, 1584.738819, 1.812985259), (2361.069011, 1584.642879, 2.166833046)), Line((2361.069011, 1584.642879, 2.166833046), (2361.386592, 1584.519697, 2.318274171)), Line((2361.386592, 1584.519697, 2.318274171), (2361.704173, 1584.396515, 2.166833046))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], {0;0;2;1;0}: [Line((2353.851673, 1592.329097, 0), (2353.796587, 1592.369791, 0.5696419954)), Line((2353.796587, 1592.369791, 0.5696419954), (2353.739224, 1592.412167, 1.031011298)), Line((2353.739224, 1592.412167, 1.031011298), (2353.677856, 1592.457502, 1.383573836)), Line((2353.677856, 1592.457502, 1.383573836), (2353.607776, 1592.509273, 1.625142108)), Line((2353.607776, 1592.509273, 1.625142108), (2353.510755, 1592.580946, 1.736619357)), Line((2353.510755, 1592.580946, 1.736619357), (2353.413734, 1592.652619, 1.625142108))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], {0;0;3;0;0}: [Line((2364.090315, 1586.534746, 0), (2363.963374, 1586.661687, 0.7183157491)), Line((2363.963374, 1586.661687, 0.7183157491), (2363.825664, 1586.799397, 1.324402793)), Line((2363.825664, 1586.799397, 1.324402793), (2363.670247, 1586.954813, 1.812985259)), Line((2363.670247, 1586.954813, 1.812985259), (2363.482651, 1587.142409, 2.166833046)), Line((2363.482651, 1587.142409, 2.166833046), (2363.241787, 1587.383274, 2.318274171)), Line((2363.241787, 1587.383274, 2.318274171), (2363.000922, 1587.624138, 2.166833046))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], {0;0;3;1;0}: [Line((2352.156091, 1593.106289, 0), (2352.076558, 1593.106289, 0.5845642871)), Line((2352.076558, 1593.106289, 0.5845642871), (2351.993275, 1593.106289, 1.060661905)), Line((2351.993275, 1593.106289, 1.060661905), (2351.903437, 1593.106289, 1.427501163)), Line((2351.903437, 1593.106289, 1.427501163), (2351.799595, 1593.106289, 1.681911615)), Line((2351.799595, 1593.106289, 1.681911615), (2351.656091, 1593.106289, 1.799106868)), Line((2351.656091, 1593.106289, 1.799106868), (2351.512586, 1593.106289, 1.681911615))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]))

join_curves_2 = JoinCurves(Curves=[line_25, curve_7], Preserve=False)
move_5 = Move(Geometry=join_curves_2, Motion=vector_2pt_5.Vector)  # -> Geometry, Transform
move_6 = Move(Geometry=join_curves_2, Motion=vector_2pt_6.Vector)  # -> Geometry, Transform
ruled_surface_5 = RuledSurface(CurveA=join_curves_2, CurveB=move_6.Geometry)  # -> flatten(Surface)
ruled_surface_6 = RuledSurface(CurveA=join_curves_2, CurveB=move_5.Geometry)  # -> flatten(Surface)
brep_join_5 = BrepJoin(Breps=[ruled_surface_6, ruled_surface_5])  # -> Breps, Closed
mesh_brep_5 = MeshBrep(Brep=brep_join_5.Breps, Settings=settings_custom_5)  # -> flatten(Mesh)

mesh_split_4 = MeshSplit(Mesh=list_item_17, Splitters=mesh_brep_5)  # -> flatten(Result)
area_3 = Area(Geometry=mesh_split_4)  # -> Area, Centroid
sort_list_3 = SortList(Keys=area_3.Area, ValuesValuesA=mesh_split_4)  # -> Keys, ValuesValuesA
list_length_2 = ListLength(List=sort_list_3.Keys)
expression_10 = Expression(X=list_length_2, N=series, Expression="(X-1)-N")
list_item_24 = ListItem(List=flatten(sort_list_3.ValuesValuesA), Index=expression_10, Wrap=True)
weaverbird_s_join_meshes_and_weld = WeaverbirdsJoinMeshesAndWeld(Mesh=flatten([weaverbird_s_laplacian_smoothing, list_item_24, list_item_18]), Weld=True)
mesh_6 = Mesh(weaverbird_s_join_meshes_and_weld)
