# Grasshopper definition Karamba basic script.gh (Grasshopper 1.0.7)
# plug-ins: Karamba

mesh = Mesh(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)
# Mesh input
mesh_2 = Mesh(flatten(mesh))

demesh = DeconstructMesh(Mesh=mesh_2)  # -> Vertices, Faces, Colours, Normals
pdecon = Deconstruct(Point=demesh.Vertices)  # -> XComponent, YComponent, ZComponent
bnd = Bounds(Numbers=flatten(pdecon.ZComponent))
dedomain = DeconstructDomain(Domain=bnd)  # -> Start, End
equals = Equality(FirstNumber=pdecon.ZComponent, SecondNumber=dedomain.Start)  # -> Equality, Inequality
dispatch = Dispatch(List=demesh.Vertices, DispatchPattern=equals.Equality)  # -> ListA, ListB
cullpt = CullDuplicates(Points=dispatch.ListA, Tolerance=0.1, CullMode=3)  # -> flatten(Points), Indices, Valence
cps = ClosestPointsKaramba(Point=cullpt.Points, Cloud=demesh.Vertices, NumberOfNeighbors=1, LimitDistance="0.008")  # -> flatten(Points), Index, Distance
pt = Point(dispatch.ListA)
# Support
supp = SupportKaramba(PosInd=flatten(cps.Points), menu=[buttons(on, on, on, on, on, on)])

# ----
# Material
division = Division(A="0.24", B="1.5")
matprops = MaterialPropertiesKaramba(
    FamilyOfMaterial="earth bag",
    Name="earth bag",
    YoungsModulus_kN_cm2="2",
    InPlaneShearModulus_kN_cm2="0.77",
    TransverseShearModulus_kN_cm2="0.77",
    SpecificWeight_kN_m3="17",
    CoefficientOfThermalExpansion_1_C=1e-05,
    YieldStrength_kN_cm2=division,
    mode="Isotrop")

bbox = BoundingBox(Content=mesh_2, Plane=PlaneXY(0, 0, 0))  # -> Box, Box_2
debox = DeconstructBox(Box=bbox.Box)  # -> Plane, X, Y, Z
# Height
panel = Panel(debox.Z)

# ----
# Load
# live load
number_slider = Slider(1.4, range=0..10)
multiplication = Multiplication(A=Slider(-0.6, range=-1..1), B=number_slider)
Z = UnitZ(Factor="-1.2")
Z_2 = UnitZ(Factor=multiplication)
loads = LoadsKaramba(Vector=Z, LCase="0", mode="Gravity")
loads_2 = LoadsKaramba(Vector=Z_2, Mesh=mesh_2, LCase="1", mode="MeshLoad -Const.", menu=[buttons(off, off, on), buttons(on, off)])

# ----
# Cross section
number_slider_2 = Slider(80, range=40..80)
cross_sections = CrossSectionsKaramba(FamilyNameOfCrossSection="DefaultCroSec", Material=matprops, Height_cm=number_slider_2, mode="Shell - Const")

meshtoshell = MeshToShellKaramba(Mesh=mesh_2, Identifier="whole", LimitDistance_m=0.005)  # -> Element, Points, Info
load = LoadKaramba([loads_2, loads])
assemble = AssembleModelKaramba(
    Points=meshtoshell.Points,
    Elem=meshtoshell.Element,
    Support=supp,
    Load=load,
    CrossSection=cross_sections,
    LimitDistance_m=0.005)  # -> Model, Info, Mass_kg, CenterOfGravity
# Assembly
galapagos = Galapagos(fitness=num, gene=number_slider_2)
# Analysis
analyzethi = AnalyzeThIKaramba(Model=assemble.Model)  # -> CalculatedModel, MaximumDisplacement_m, ResultingForceOfGravity_kN, ElasticEnergy_kNm
num = Number(analyzethi.MaximumDisplacement_m)
# Display
modelview = ModelViewKaramba(Model=analyzethi.CalculatedModel, LoadCaseFactorsForLinearSuperposition=1, IndexOfVisibleLoadcase=-1)  # -> Model, DeformedMesh, DeformedAxes, DeformedModel
shellview = ShellViewKaramba(Model=modelview.Model, IndexOfLayer=0)  # -> Model, MeshesOfRenderedShells, LegendColors, LegendTags
# Support reaction
react = ReactionForcesKaramba(AnalyzedModel=modelview.Model, LoadCase=0)  # -> AnalyzedModel, ReactionForces_kN, ReactionMoments_kNm, SupportPosition, SumOfReactionForces_kN, SumOfReactionMoments_kNm
multiplication_2 = Multiplication(A=shellview.LegendTags, B="10")
s_forces = ShellForcesKaramba(AnalyzedModel=shellview.Model, LCase=0, mode="Principal")  # -> AnalyzedModel, FirstPrincipalNormalForce_kN_m, SecondPrincipalNormalForce_kN_m, FirstPrincipalMoment_kN, SecondPrincipalMoment_kN, ShearForceInLocalXDirection_kN_m, ShearForceInLocalYDirection_kN_m
legend = Legend(Colour=shellview.LegendColors, Tags=multiplication_2, LegendType=1)

# ----
# Maximum defomation
number_slider_3 = Slider(0, range=0..100)
series = Series(Start=number_slider_3, Step="1", Count=Slider(2, range=0..10))
nodedisp = NodalDisplacementsKaramba(AnalyzedModel=shellview.Model, LoadCase=series)  # -> AnalyzedModel, NodalTranslations_m, NodalRotations_rad
devec = DeconstructVector(Vector=nodedisp.NodalTranslations_m)  # -> XComponent, YComponent, ZComponent
project = Project(Geometry=nodedisp.NodalTranslations_m, Plane=PlaneXY(0, 0, 0))  # -> Geometry, Transform
vlen = VectorLength(Vector=project.Geometry)
abs = Absolute(Value=devec.ZComponent)
bnd_2 = Bounds(Numbers=abs)
bnd_3 = Bounds(Numbers=vlen)
dedomain_2 = DeconstructDomain(Domain=bnd_2)  # -> Start, End
dedomain_3 = DeconstructDomain(Domain=bnd_3)  # -> Start, End
panel_2 = Panel(dedomain_2.End)
panel_3 = Panel(dedomain_3.End)

# ----
# Maximum stress
shellvecresults = ResultVectorsOnShellsKaramba(AnalyzedModel=shellview.Model, LayerOfResults=0, mode="PrincStress")  # -> AnalyzedModel, Points, FirstPrincipalStressVector_kN_cm2, SecondPrincipalStressVector_kN_cm2, FirstPrincipalStressValue_kN_cm2, SecondPrincipalStressValue_kN_cm2
bnd_4 = Bounds(Numbers=[shellvecresults.FirstPrincipalStressValue_kN_cm2, shellvecresults.SecondPrincipalStressValue_kN_cm2])
num_2 = Number(shellvecresults.FirstPrincipalStressValue_kN_cm2)
larger = LargerThan(FirstNumber=num_2, SecondNumber="0")  # -> LargerThan, OrEqualTo
dedomain_4 = DeconstructDomain(Domain=bnd_4)  # -> Start, End
dispatch_2 = Dispatch(List=num_2, DispatchPattern=larger.LargerThan)  # -> ListA, ListB
panel_4 = Panel(dedomain_4.Start)
num_3 = Number(dispatch_2.ListA)
panel_5 = Panel(num_3)

# ---- group: reduce mesh point density with cull pattern
# Stress line
panel_6 = Panel("""0
0
0
0
0
1""")
cull = CullPattern(List=meshtoshell.Points, CullPattern=panel_6)

# ---- group: map principal stress lines at each point
shelllineresults = LineResultsOnShellsKaramba(
    AnalyzedModel=analyzethi.CalculatedModel,
    Layer=0,
    ListOfSourcesOfPrincipalStressLinesLinesPoints=cull,
    SegmentLength_m=0.5,
    DA_deg=5,
    mode="PrincStress")  # -> AnalyzedModel, Lines1, Lines2

# ----
panel_7 = Panel(dedomain_4.End)

# ---- group: blue
rgb = ColourRGB(Alpha=255, Red=0, Green=0, Blue="250")
preview = CustomPreview(Geometry=shelllineresults.Lines1, Shader=rgb)

# ---- group: red
rgb_2 = ColourRGB(Alpha=255, Red="250", Green=0, Blue=0)
preview_2 = CustomPreview(Geometry=shelllineresults.Lines2, Shader=rgb_2)
