# Grasshopper definition 20.10_group 10 gh-earthbag-level 0(change openning sizes,  for report only ).gh (Grasshopper 1.0.7)
# plug-ins: Karamba, Pufferfish, Kangaroo Components, Weaverbird, Kangaroo2 Components

curve = Curve([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])
curve_2 = Curve(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)
# Doubleclick Me!
curve_3 = Curve([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])
merge = Merge(Data1=curve, Data2=curve_2, Data3=curve_3)
curve_4 = Curve(merge)
curve_5 = Curve(flatten(curve_4))

openings = Curve([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])
end_points = EndPoints(Curve=openings)  # -> Start, End

boundary_surfaces = BoundarySurfaces(Edges=curve_3)
number_slider = Slider(247, range=0..500)
settings_custom = SettingsCustom(
    StitchSeams=True,
    SimplePlanes=False,
    Refine=True,
    MinCount=number_slider,
    MaxCount=number_slider,
    AspectRatio=Slider(17, range=0..100),
    MaxDistance=0,
    MaxAngle=20,
    MinEdge=0,
    MaxEdge=0)
mesh_brep = MeshBrep(Brep=boundary_surfaces, Settings=settings_custom)
area = Area(Geometry=mesh_brep)  # -> Area, Centroid
panel = Panel(area.Area)
multiplication = Multiplication(A=panel, B=Slider(28, range=0..720))
division = Division(A=multiplication, B=Slider(101, range=0..1000))
weaverbird_s_mesh_edges = WeaverbirdsMeshEdges(MeshOrPolylines=mesh_brep)
nakedvertices = NakedVertices(Mesh=mesh_brep)  # -> ClothedIndex, NakedIndex, ClothedPts, NakedPts
deconstruct_mesh = DeconstructMesh(Mesh=mesh_brep)  # -> Vertices, Faces, Colours, Normals
panel_2 = Panel(deconstruct_mesh.Vertices)
unit_z = UnitZ(Factor=division)
list_item = ListItem(List=deconstruct_mesh.Vertices, Index=nakedvertices.NakedIndex, Wrap=True)
springsfromline = SpringsFromLine(
    Connection=weaverbird_s_mesh_edges,
    Stiffness=Slider(46, range=0..1000),
    Damping=10,
    RestLength=weaverbird_s_mesh_edges,
    UpperCutoff=0,
    LowerCutoff=0,
    Plasticity=0)
unaryforce = UnaryForce(Point=deconstruct_mesh.Vertices, Force=unit_z)
timer = Timer(TimerInterval=20, Target=kangaroophysics)
kangaroophysics = KangarooPhysics(
    ForceObjects=flatten([unaryforce, springsfromline]),
    AnchorPoints=flatten(list_item),
    Settings=null,
    Geometry=mesh_brep,
    SimulationReset=Toggle(False))  # -> Out, Iterations, ParticlesOut, GeometryOut, KE; disabled

point_in_curve = PointInCurve(Point=end_points.Start, Curve=curve_5)  # -> Relationship, Point
point_in_curve_2 = PointInCurve(Point=end_points.End, Curve=curve_5)  # -> Relationship, Point
point = Point(point_in_curve_2.Point)
reference_anchor = Point(point_in_curve.Point)
line = Line(StartPoint=reference_anchor, EndPoint=point)
divide_curve = DivideCurve(Curve=line, Count=2, Kinks=False)  # -> Points, Tangents, Parameters
point_2 = Point(flatten(divide_curve.Points))
find_similar_member = FindSimilarMember(Data=[end_points.Start, end_points.End], Set=point_2)  # -> Hit, Index
midpoints = CullIndex(List=divide_curve.Points, Indices=find_similar_member.Index, Wrap=True)  # -> flatten(List)

value_list = ValueList({"One": 1.2, "Two": 2.4, "Three": 3.6, "Four": 4.8}, selected="One")
value_list_2 = ValueList({"One": 1.2, "Two": 2.4, "Three": 3.6, "Four": 4.8}, selected="Two")
value_list_3 = ValueList({"One": 1.2, "Two": 2.4, "Three": 3.6, "Four": 4.8}, selected="Three")
value_list_4 = ValueList({"One": 1.2, "Two": 2.4, "Three": 3.6, "Four": 4.8}, selected="Four")
length = Length(Curve=line)
round_to_nearest = RoundToNearest(NumbersX=length, NumbersY=[value_list_2, value_list_3, value_list_4, value_list], RemapNumberX=False)  # -> Nearest, RemappedNumberX
expression = Expression(x=round_to_nearest.Nearest, y=value_list, Expression="If(x=y,True,False)")
expression_2 = Expression(x=round_to_nearest.Nearest, y=value_list_3, Expression="If(x=y,True,False)")
expression_3 = Expression(x=round_to_nearest.Nearest, y=value_list_2, Expression="If(x=y,True,False)")
expression_4 = Expression(x=round_to_nearest.Nearest, y=value_list_4, Expression="If(x=y,True,False)")

boundary_surfaces_2 = BoundarySurfaces(Edges=curve)
number_slider_2 = Slider(247, range=0..500)
settings_custom_2 = SettingsCustom(
    StitchSeams=True,
    SimplePlanes=False,
    Refine=True,
    MinCount=number_slider_2,
    MaxCount=number_slider_2,
    AspectRatio=Slider(17, range=0..100),
    MaxDistance=0,
    MaxAngle=20,
    MinEdge=0,
    MaxEdge=0)
mesh_brep_2 = MeshBrep(Brep=boundary_surfaces_2, Settings=settings_custom_2)
area_2 = Area(Geometry=mesh_brep_2)  # -> Area, Centroid
panel_3 = Panel(area_2.Area)
multiplication_2 = Multiplication(A=panel_3, B=Slider(28, range=0..720))
division_2 = Division(A=multiplication_2, B=Slider(101, range=0..1000))
number_slider_3 = Slider(106, range=0..1000)
weaverbird_s_mesh_edges_2 = WeaverbirdsMeshEdges(MeshOrPolylines=mesh_brep_2)
nakedvertices_2 = NakedVertices(Mesh=mesh_brep_2)  # -> ClothedIndex, NakedIndex, ClothedPts, NakedPts
deconstruct_mesh_2 = DeconstructMesh(Mesh=mesh_brep_2)  # -> Vertices, Faces, Colours, Normals
panel_4 = Panel(deconstruct_mesh_2.Vertices)
unit_z_2 = UnitZ(Factor=division_2)
list_item_2 = ListItem(List=deconstruct_mesh_2.Vertices, Index=nakedvertices_2.NakedIndex, Wrap=True)
springsfromline_2 = SpringsFromLine(
    Connection=weaverbird_s_mesh_edges_2,
    Stiffness=Slider(64, range=0..1000),
    Damping=10,
    RestLength=weaverbird_s_mesh_edges_2,
    UpperCutoff=0,
    LowerCutoff=0,
    Plasticity=0)
unaryforce_2 = UnaryForce(Point=deconstruct_mesh_2.Vertices, Force=unit_z_2)
timer_2 = Timer(TimerInterval=20, Target=kangaroophysics_2)
kangaroophysics_2 = KangarooPhysics(
    ForceObjects=flatten([unaryforce_2, springsfromline_2]),
    AnchorPoints=flatten(list_item_2),
    Settings=null,
    Geometry=mesh_brep_2,
    SimulationReset=Toggle(False))  # -> Out, Iterations, ParticlesOut, GeometryOut, KE; disabled

boundary_surfaces_3 = BoundarySurfaces(Edges=curve_2)
number_slider_4 = Slider(247, range=0..500)
settings_custom_3 = SettingsCustom(
    StitchSeams=True,
    SimplePlanes=False,
    Refine=True,
    MinCount=number_slider_4,
    MaxCount=number_slider_4,
    AspectRatio=Slider(17, range=0..100),
    MaxDistance=0,
    MaxAngle=20,
    MinEdge=0,
    MaxEdge=0)
mesh_brep_3 = MeshBrep(Brep=boundary_surfaces_3, Settings=settings_custom_3)
area_3 = Area(Geometry=mesh_brep_3)  # -> Area, Centroid
panel_5 = Panel(area_3.Area)
multiplication_3 = Multiplication(A=panel_5, B=Slider(28, range=0..720))
division_3 = Division(A=multiplication_3, B=Slider(101, range=0..1000))
number_slider_5 = Slider(87, range=0..1000)
weaverbird_s_mesh_edges_3 = WeaverbirdsMeshEdges(MeshOrPolylines=mesh_brep_3)
nakedvertices_3 = NakedVertices(Mesh=mesh_brep_3)  # -> ClothedIndex, NakedIndex, ClothedPts, NakedPts
deconstruct_mesh_3 = DeconstructMesh(Mesh=mesh_brep_3)  # -> Vertices, Faces, Colours, Normals
panel_6 = Panel(deconstruct_mesh_3.Vertices)
unit_z_3 = UnitZ(Factor=division_3)
list_item_3 = ListItem(List=deconstruct_mesh_3.Vertices, Index=nakedvertices_3.NakedIndex, Wrap=True)
springsfromline_3 = SpringsFromLine(
    Connection=weaverbird_s_mesh_edges_3,
    Stiffness=Slider(70, range=0..1000),
    Damping=10,
    RestLength=weaverbird_s_mesh_edges_3,
    UpperCutoff=0,
    LowerCutoff=0,
    Plasticity=0)
unaryforce_3 = UnaryForce(Point=deconstruct_mesh_3.Vertices, Force=unit_z_3)
timer_3 = Timer(TimerInterval=20, Target=kangaroophysics_3)
kangaroophysics_3 = KangarooPhysics(
    ForceObjects=flatten([unaryforce_3, springsfromline_3]),
    AnchorPoints=flatten(list_item_3),
    Settings=null,
    Geometry=mesh_brep_3,
    SimulationReset=Toggle(False))  # -> Out, Iterations, ParticlesOut, GeometryOut, KE; disabled

cull_pattern = CullPattern(List=midpoints, CullPattern=expression)
cull_pattern_2 = CullPattern(List=midpoints, CullPattern=expression_3)
cull_pattern_3 = CullPattern(List=midpoints, CullPattern=expression_2)
cull_pattern_4 = CullPattern(List=midpoints, CullPattern=expression_4)
cull_pattern_5 = CullPattern(List=line, CullPattern=expression)
cull_pattern_6 = CullPattern(List=line, CullPattern=expression_4)
cull_pattern_7 = CullPattern(List=line, CullPattern=expression_2)
cull_pattern_8 = CullPattern(List=line, CullPattern=expression_3)

number_slider_6 = Slider(0.8, range=0.8..1.2)
division_4 = Division(A=number_slider_6, B=2)
circle_cnr = CircleCNR(Center=cull_pattern, Normal=Vector(0, 0, 1), Radius=division_4)
line_2 = Line(cull_pattern_5)
surface = Surface(circle_cnr)
surface_curve = SurfaceCurve(Surface=surface, Curve=line_2)  # -> Curves, Points, UVPoints, Normals, Parameters, Tangents
line_3 = Line(surface_curve.Curves)

number_slider_7 = Slider(2.6, range=2.4..3.6)
division_5 = Division(A=Slider(2.4, range=2.4..3.6), B=2)
circle_cnr_2 = CircleCNR(Center=cull_pattern_3, Normal=Vector(0, 0, 1), Radius=division_5)
line_4 = Line(cull_pattern_7)
surface_2 = Surface(circle_cnr_2)
surface_curve_2 = SurfaceCurve(Surface=surface_2, Curve=line_4)  # -> Curves, Points, UVPoints, Normals, Parameters, Tangents
line_5 = Line(surface_curve_2.Curves)

number_slider_8 = Slider(0.9, range=0.8..1.2)
number_slider_9 = Slider(1.8, range=1.2..2.4)

division_6 = Division(A=Slider(1.4, range=1.2..2.4), B=2)
circle_cnr_3 = CircleCNR(Center=cull_pattern_2, Normal=Vector(0, 0, 1), Radius=division_6)
line_6 = Line(cull_pattern_8)
surface_3 = Surface(circle_cnr_3)
surface_curve_3 = SurfaceCurve(Surface=surface_3, Curve=line_6)  # -> Curves, Points, UVPoints, Normals, Parameters, Tangents
line_7 = Line(surface_curve_3.Curves)

division_7 = Division(A=Slider(4.8, range=3.6..4.8), B=2)
circle_cnr_4 = CircleCNR(Center=cull_pattern_4, Normal=Vector(0, 0, 1), Radius=division_7)
line_8 = Line(cull_pattern_6)
surface_4 = Surface(circle_cnr_4)
surface_curve_4 = SurfaceCurve(Surface=surface_4, Curve=line_8)  # -> Curves, Points, UVPoints, Normals, Parameters, Tangents
line_9 = Line(surface_curve_4.Curves)

merge_2 = Merge(Data1=kangaroophysics_2.GeometryOut, Data2=kangaroophysics_3.GeometryOut, Data3=kangaroophysics.GeometryOut)  # disabled
mesh = Mesh(simplify([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]))
line_10 = Line([Line((2391.826112, 1566.397015, 0), (2391.566544, 1564.011093, 0)), Line((2397.557893, 1567.105849, 0), (2398.391011, 1564.85509, 0)), Line((2404.368977, 1568.000445, 0), (2404.145407, 1565.610881, 0)), Line((2406.100036, 1569.546423, 0), (2407.666458, 1569.844109, 0)), Line((2404.650015, 1573.456867, 0), (2406.036626, 1574.255184, 0)), Line((2402.070466, 1576.8445, 0), (2401.89742, 1575.253885, 0)), Line((2397.491474, 1575.512893, 0), (2398.490818, 1574.263368, 0))])
curve_6 = Curve(graft(line_10))
divide_curve_2 = DivideCurve(Curve=curve_6, Count=2, Kinks=False)  # -> Points, Tangents, Parameters
number_slider_10 = Slider(2, range=0..10)
divide_curve_3 = DivideCurve(Curve=curve_6, Count=10, Kinks=False)  # -> Points, Tangents, Parameters

curve_7 = Curve(graft([line_9, line_5, line_7, line_3]))
divide_curve_4 = DivideCurve(Curve=curve_7, Count=10, Kinks=False)  # -> Points, Tangents, Parameters
unit_z_4 = UnitZ(Factor=Slider(78, range=0..100))
shatter = Shatter(Curve=curve_7, Parameters=divide_curve_4.Parameters)
point_3 = Point(divide_curve_4.Points)
unaryforce_4 = UnaryForce(Point=point_3, Force=unit_z_4)
list_item_4 = ListItem(List=divide_curve_4.Points, Index=[0, 10], Wrap=True)
line_11 = Line(shatter)
timer_4 = Timer(TimerInterval=20, Target=kangaroophysics_4)
springsfromline_4 = SpringsFromLine(
    Connection=line_11,
    Stiffness=Slider(604, range=0..1000),
    Damping=10,
    RestLength=line_11,
    UpperCutoff=0,
    LowerCutoff=0,
    Plasticity=0)
kangaroophysics_4 = KangarooPhysics(
    ForceObjects=flatten([springsfromline_4, unaryforce_4]),
    AnchorPoints=flatten(list_item_4),
    Settings=null,
    Geometry=line_11,
    SimulationReset=Toggle(False))  # -> Out, Iterations, ParticlesOut, GeometryOut, KE; disabled
line_12 = Line(Tree({0;0;0;0;0}: [Line((2394.055524, 1562.124906, 0), (2394.235762, 1562.147546, 0.8239796304)), Line((2394.235762, 1562.147546, 0.8239796304), (2394.429525, 1562.170898, 1.514611402)), Line((2394.429525, 1562.170898, 1.514611402), (2394.645886, 1562.196989, 2.066865149)), Line((2394.645886, 1562.196989, 2.066865149), (2394.905359, 1562.230154, 2.46522039)), Line((2394.905359, 1562.230154, 2.46522039), (2395.246447, 1562.272221, 2.640060709)), Line((2395.246447, 1562.272221, 2.640060709), (2395.587536, 1562.314288, 2.46522039))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], {0;0;0;1;0}: [Line((2386.831264, 1563.454319, 0), (2386.932161, 1563.411987, 0.724716055)), Line((2386.932161, 1563.411987, 0.724716055), (2387.038491, 1563.367108, 1.318769276)), Line((2387.038491, 1563.367108, 1.318769276), (2387.154486, 1563.318669, 1.780356316)), Line((2387.154486, 1563.318669, 1.780356316), (2387.290269, 1563.261892, 2.103786354)), Line((2387.290269, 1563.261892, 2.103786354), (2387.477391, 1563.185023, 2.251805901)), Line((2387.477391, 1563.185023, 2.251805901), (2387.664512, 1563.108153, 2.103786354))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], {0;0;0;2;0}: [Line((2390.432423, 1567.376407, 0), (2390.379757, 1567.418286, 0.663541264)), Line((2390.379757, 1567.418286, 0.663541264), (2390.32564, 1567.461489, 1.197420585)), Line((2390.32564, 1567.461489, 1.197420585), (2390.269041, 1567.506571, 1.601062966)), Line((2390.269041, 1567.506571, 1.601062966), (2390.206208, 1567.557017, 1.872782181)), Line((2390.206208, 1567.557017, 1.872782181), (2390.119936, 1567.62611, 1.997714014)), Line((2390.119936, 1567.62611, 1.997714014), (2390.033663, 1567.695202, 1.872782181))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], {0;0;1;0;0}: [Line((2406.018585, 1564.047976, 0), (2406.199134, 1564.027993, 0.8239794084)), Line((2406.199134, 1564.027993, 0.8239794084), (2406.393224, 1564.007459, 1.514609416)), Line((2406.393224, 1564.007459, 1.514609416), (2406.609951, 1563.984512, 2.066862173)), Line((2406.609951, 1563.984512, 2.066862173), (2406.869875, 1563.955221, 2.46522225)), Line((2406.869875, 1563.955221, 2.46522225), (2407.211546, 1563.918192, 2.640057652)), Line((2407.211546, 1563.918192, 2.640057652), (2407.553217, 1563.881162, 2.46522225))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], {0;0;1;1;0}: [Line((2395.627265, 1567.831229, 0), (2395.517507, 1567.831229, 0.7246684013)), Line((2395.517507, 1567.831229, 0.7246684013), (2395.401926, 1567.831229, 1.318693105)), Line((2395.401926, 1567.831229, 1.318693105), (2395.276206, 1567.831229, 1.780273038)), Line((2395.276206, 1567.831229, 1.780273038), (2395.129287, 1567.831229, 2.10377889)), Line((2395.129287, 1567.831229, 2.10377889), (2394.927265, 1567.831229, 2.251889531)), Line((2394.927265, 1567.831229, 2.251889531), (2394.725243, 1567.831229, 2.10377889))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], {0;0;1;2;0}: [Line((2403.051757, 1568.920964, 0), (2402.999956, 1568.963937, 0.6635400241)), Line((2402.999956, 1568.963937, 0.6635400241), (2402.946721, 1569.008241, 1.197418585)), Line((2402.946721, 1569.008241, 1.197418585), (2402.891057, 1569.054477, 1.601061054)), Line((2402.891057, 1569.054477, 1.601061054), (2402.829247, 1569.106147, 1.872781992)), Line((2402.829247, 1569.106147, 1.872781992), (2402.744392, 1569.176946, 1.997718468)), Line((2402.744392, 1569.176946, 1.997718468), (2402.659537, 1569.247745, 1.872781992))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]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))
join_curves = JoinCurves(Curves=[line_12, curve_7], Preserve=False)

offset = Offset(Curve=curve_6, Distance=expr("x*-1", number_slider_10), Plane=PlaneXY(0, 0, 0), Corners=1)
shatter_2 = Shatter(Curve=curve_6, Parameters=divide_curve_3.Parameters)
offset_2 = Offset(Curve=curve_6, Distance=number_slider_10, Plane=PlaneXY(0, 0, 0), Corners=1)
unit_z_5 = UnitZ(Factor=Slider(78, range=0..100))
point_4 = Point(divide_curve_3.Points)
divide_curve_5 = DivideCurve(Curve=curve_6, Count=2, Kinks=False)  # -> Points, Tangents, Parameters
divide_curve_6 = DivideCurve(Curve=curve_6, Count=2, Kinks=False)  # -> Points, Tangents, Parameters
list_item_5 = ListItem(List=divide_curve_3.Points, Index=[0, 10], Wrap=True)
divide_curve_7 = DivideCurve(Curve=offset, Count=2, Kinks=False)  # -> Points, Tangents, Parameters
divide_curve_8 = DivideCurve(Curve=offset_2, Count=2, Kinks=False)  # -> Points, Tangents, Parameters
line_13 = Line(shatter_2)
unaryforce_5 = UnaryForce(Point=point_4, Force=unit_z_5)
list_item_6 = ListItem(List=divide_curve_5.Points, Index=1, Wrap=True)
list_item_7 = ListItem(List=divide_curve_6.Points, Index=1, Wrap=True)
list_item_8 = ListItem(List=divide_curve_7.Points, Index=1, Wrap=True)
list_item_9 = ListItem(List=divide_curve_8.Points, Index=1, Wrap=True)
timer_5 = Timer(TimerInterval=20, Target=kangaroophysics_5)
springsfromline_5 = SpringsFromLine(
    Connection=line_13,
    Stiffness=Slider(838, range=0..1000),
    Damping=10,
    RestLength=line_13,
    UpperCutoff=0,
    LowerCutoff=0,
    Plasticity=0)
vector_2pt = Vector2Pt(PointA=list_item_6, PointB=list_item_8, Unitize=False)  # -> Vector, Length
vector_2pt_2 = Vector2Pt(PointA=list_item_7, PointB=list_item_9, Unitize=False)  # -> Vector, Length
kangaroophysics_5 = KangarooPhysics(
    ForceObjects=flatten([springsfromline_5, unaryforce_5]),
    AnchorPoints=flatten(list_item_5),
    Settings=null,
    Geometry=line_13,
    SimulationReset=Toggle(False))  # -> Out, Iterations, ParticlesOut, GeometryOut, KE; disabled

offset_3 = Offset(Curve=curve_7, Distance=-1.6, Plane=PlaneXY(0, 0, 0), Corners=1)
divide_curve_9 = DivideCurve(Curve=curve_7, Count=2, Kinks=False)  # -> Points, Tangents, Parameters
divide_curve_10 = DivideCurve(Curve=offset_3, Count=2, Kinks=False)  # -> Points, Tangents, Parameters
list_item_10 = ListItem(List=divide_curve_10.Points, Index=1, Wrap=True)
list_item_11 = ListItem(List=divide_curve_9.Points, Index=1, Wrap=True)
vector_2pt_3 = Vector2Pt(PointA=list_item_11, PointB=list_item_10, Unitize=False)  # -> Vector, Length
move = Move(Geometry=join_curves, Motion=vector_2pt_3.Vector)  # -> Geometry, Transform

offset_4 = Offset(Curve=curve_7, Distance=1.6, Plane=PlaneXY(0, 0, 0), Corners=1)
divide_curve_11 = DivideCurve(Curve=curve_7, Count=2, Kinks=False)  # -> Points, Tangents, Parameters
divide_curve_12 = DivideCurve(Curve=offset_4, Count=2, Kinks=False)  # -> Points, Tangents, Parameters
list_item_12 = ListItem(List=divide_curve_12.Points, Index=1, Wrap=True)
list_item_13 = ListItem(List=divide_curve_11.Points, Index=1, Wrap=True)
vector_2pt_4 = Vector2Pt(PointA=list_item_13, PointB=list_item_12, Unitize=False)  # -> Vector, Length
move_2 = Move(Geometry=join_curves, Motion=vector_2pt_4.Vector)  # -> Geometry, Transform

line_14 = Line(Tree({0;0;0}: [Line((2391.826112, 1566.397015, 0), (2391.805227, 1566.20819, 0.7459359413)), Line((2391.805227, 1566.20819, 0.7459359413), (2391.783704, 1566.009643, 1.384526506)), Line((2391.783704, 1566.009643, 1.384526506), (2391.759965, 1565.793296, 1.903719323)), Line((2391.759965, 1565.793296, 1.903719323), (2391.733867, 1565.537463, 2.283732457)), Line((2391.733867, 1565.537463, 2.283732457), (2391.696328, 1565.204054, 2.453074376)), Line((2391.696328, 1565.204054, 2.453074376), (2391.65879, 1564.870644, 2.283732457))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], {0;1;0}: [Line((2397.557893, 1567.105849, 0), (2397.625684, 1566.926782, 0.746198861)), Line((2397.625684, 1566.926782, 0.746198861), (2397.695395, 1566.738949, 1.38471411)), Line((2397.695395, 1566.738949, 1.38471411), (2397.771291, 1566.535341, 1.903688742)), Line((2397.771291, 1566.535341, 1.903688742), (2397.858831, 1566.294373, 2.2838442)), Line((2397.858831, 1566.294373, 2.2838442), (2397.974452, 1565.98047, 2.453539309)), Line((2397.974452, 1565.98047, 2.453539309), (2398.090072, 1565.666567, 2.2838442))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], {0;2;0}: [Line((2404.368977, 1568.000445, 0), (2404.351014, 1567.811387, 0.7459256791)), Line((2404.351014, 1567.811387, 0.7459256791), (2404.332462, 1567.612557, 1.384519654)), Line((2404.332462, 1567.612557, 1.384519654), (2404.312011, 1567.395856, 1.903717802)), Line((2404.312011, 1567.395856, 1.903717802), (2404.289594, 1567.139635, 2.283716323)), Line((2404.289594, 1567.139635, 2.283716323), (2404.257192, 1566.805663, 2.453079425)), Line((2404.257192, 1566.805663, 2.453079425), (2404.22479, 1566.471691, 2.283716323))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], {0;3;0}: [Line((2406.100036, 1569.546423, 0), (2406.217017, 1569.570087, 0.6417609188)), Line((2406.217017, 1569.570087, 0.6417609188), (2406.343198, 1569.596955, 1.183096551)), Line((2406.343198, 1569.596955, 1.183096551), (2406.484342, 1569.626406, 1.615962261)), Line((2406.484342, 1569.626406, 1.615962261), (2406.654719, 1569.652562, 1.927306707)), Line((2406.654719, 1569.652562, 1.927306707), (2406.883247, 1569.695266, 2.067083929)), Line((2406.883247, 1569.695266, 2.067083929), (2407.111775, 1569.73797, 1.927306707))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], {0;4;0}: [Line((2404.650015, 1573.456867, 0), (2404.750437, 1573.518189, 0.642742097)), Line((2404.750437, 1573.518189, 0.642742097), (2404.860299, 1573.583439, 1.185183111)), Line((2404.860299, 1573.583439, 1.185183111), (2404.984962, 1573.655471, 1.619023936)), Line((2404.984962, 1573.655471, 1.619023936), (2405.1383, 1573.739279, 1.930674906)), Line((2405.1383, 1573.739279, 1.930674906), (2405.34332, 1573.856026, 2.06907786)), Line((2405.34332, 1573.856026, 2.06907786), (2405.548341, 1573.972773, 1.930674906))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], {0;5;0}: [Line((2402.070466, 1576.8445, 0), (2402.056838, 1576.725205, 0.6424960545)), Line((2402.056838, 1576.725205, 0.6424960545), (2402.040866, 1576.596688, 1.184509452)), Line((2402.040866, 1576.596688, 1.184509452), (2402.023274, 1576.45315, 1.617992624)), Line((2402.023274, 1576.45315, 1.617992624), (2402.008758, 1576.280713, 1.929765416)), Line((2402.008758, 1576.280713, 1.929765416), (2401.983943, 1576.049193, 2.070071363)), Line((2401.983943, 1576.049193, 2.070071363), (2401.959128, 1575.817673, 1.929765416))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], {0;6;0}: [Line((2397.491474, 1575.512893, 0), (2397.565311, 1575.42291, 0.6428962278)), Line((2397.565311, 1575.42291, 0.6428962278), (2397.64516, 1575.324248, 1.185489851)), Line((2397.64516, 1575.324248, 1.185489851), (2397.734849, 1575.211874, 1.619428226)), Line((2397.734849, 1575.211874, 1.619428226), (2397.843598, 1575.073472, 1.930749992)), Line((2397.843598, 1575.073472, 1.930749992), (2397.991146, 1574.888131, 2.068717028)), Line((2397.991146, 1574.888131, 2.068717028), (2398.138694, 1574.702789, 1.930749992))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]))
number_slider_11 = Slider(1, range=0..10)
list_item_14 = ListItem(List=divide_curve_2.Points, Index=1, Wrap=True)
move_3 = Move(Geometry=line_14, Motion=vector_2pt_2.Vector)  # -> Geometry, Transform
move_4 = Move(Geometry=line_14, Motion=vector_2pt.Vector)  # -> Geometry, Transform
scale = Scale(Geometry=move_3.Geometry, Center=list_item_14, Factor=number_slider_11)  # -> Geometry, Transform
scale_2 = Scale(Geometry=move_4.Geometry, Center=list_item_14, Factor=number_slider_11)  # -> Geometry, Transform
ruled_surface = RuledSurface(CurveA=line_14, CurveB=scale.Geometry)  # -> flatten(Surface)
ruled_surface_2 = RuledSurface(CurveA=line_14, CurveB=scale_2.Geometry)  # -> flatten(Surface)
number_slider_12 = Slider(0, range=0..100)
brep_join = BrepJoin(Breps=ruled_surface)  # -> Breps, Closed
brep_join_2 = BrepJoin(Breps=ruled_surface_2)  # -> Breps, Closed

ruled_surface_3 = RuledSurface(CurveA=join_curves, CurveB=move.Geometry)  # -> flatten(Surface)
ruled_surface_4 = RuledSurface(CurveA=join_curves, CurveB=move_2.Geometry)  # -> flatten(Surface)
brep_join_3 = BrepJoin(Breps=[ruled_surface_3, ruled_surface_4])  # -> Breps, Closed
settings_custom_4 = SettingsCustom(
    StitchSeams=True,
    SimplePlanes=False,
    Refine=True,
    MinCount=16,
    MaxCount=400,
    AspectRatio=20,
    MaxDistance=0,
    MaxAngle=20,
    MinEdge=0,
    MaxEdge=0)
mesh_brep_4 = MeshBrep(Brep=brep_join_3.Breps, Settings=settings_custom_4)  # -> flatten(Mesh)

brep_join_4 = BrepJoin(Breps=[brep_join_2.Breps, brep_join.Breps])  # -> Breps, Closed
settings_custom_5 = SettingsCustom(
    StitchSeams=True,
    SimplePlanes=False,
    Refine=True,
    MinCount=number_slider_12,
    MaxCount=number_slider_12,
    AspectRatio=20,
    MaxDistance=0,
    MaxAngle=20,
    MinEdge=0,
    MaxEdge=0)
mesh_brep_5 = MeshBrep(Brep=brep_join_4.Breps, Settings=settings_custom_5)
mesh_split = MeshSplit(Mesh=flatten(mesh), Splitters=[brep_join_2.Breps, brep_join.Breps])
area_4 = Area(Geometry=mesh_split)  # -> Area, Centroid
sort_list = SortList(Keys=area_4.Area, ValuesValuesA=mesh_split)  # -> Keys, reverse(ValuesValuesA)
mesh_split_2 = MeshSplit(Mesh=mesh_brep_5, Splitters=mesh)  # -> flatten(Result)
list_item_15 = ListItem(List=sort_list.ValuesValuesA, Index=0, Wrap=True)
list_item_16 = ListItem(
    List=mesh_split_2,
    Index=[Slider(1, range=0..36), Slider(7, range=0..36), Slider(10, range=0..36), Slider(13, range=0..36), Slider(4, range=0..36), Slider(16, range=0..36), Slider(19, range=0..36)],
    Wrap=True)
weaverbird_s_laplacian_smoothing = WeaverbirdsLaplacianSmoothing(MeshCurves=list_item_16, Level=Slider(1, range=0..20), SmoothNakedEdges=0, Thin=Slider(1, range=0..1))
mesh_2 = Mesh(flatten(list_item_15))
mesh_split_3 = MeshSplit(Mesh=mesh_2, Splitters=mesh_brep_4)  # -> flatten(Result)
number_slider_13 = Slider(0.7, range=0..1)
area_5 = Area(Geometry=mesh_split_3)  # -> Area, Centroid
list_item_17 = ListItem(
    List=mesh_split_3,
    Index=[Slider(1, range=0..26), Slider(8, range=0..26), Slider(12, range=0..26), Slider(13, range=0..26), Slider(16, range=0..26), Slider(18, range=0..26), Slider(22, range=0..26), Slider(24, range=0..26)],
    Wrap=True)
plane_surface = PlaneSurface(Plane=PlaneXY(0, 0, 0), XSize=Domain(-10, 10), YSize=Domain(-10, 10))
unit_z_6 = UnitZ(Factor=Slider(0, range=0..2))
sort_list_2 = SortList(Keys=area_5.Area, ValuesValuesA=mesh_split_3)  # -> Keys, ValuesValuesA
mesh_3 = Mesh(list_item_17)
move_5 = Move(Geometry=plane_surface, Motion=unit_z_6)  # -> Geometry, Transform
series = Series(Start=0, Step=1, Count=Slider(8, range=0..15))
list_length = ListLength(List=sort_list_2.Keys)
mesh_split_plane = MeshSplitPlane(Mesh=mesh_3, Plane=move_5.Geometry)  # -> Above, Below
expression_5 = Expression(X=list_length, N=series, Expression="(X-1)-N")
list_item_18 = ListItem(List=flatten(sort_list_2.ValuesValuesA), Index=expression_5, Wrap=True)
weaverbird_s_join_meshes_and_weld = WeaverbirdsJoinMeshesAndWeld(Mesh=flatten([weaverbird_s_laplacian_smoothing, list_item_18, mesh_split_plane.Below]), Weld=True)
# change opening size
weaverbird_s_catmull_clark_subdivision = WeaverbirdsCatmullClarkSubdivision(MeshCurves=weaverbird_s_join_meshes_and_weld, Level=Slider(2, range=0..5), SmoothNakedEdges=0)  # disabled
mesh_4 = Mesh(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)
mesh_5 = Mesh(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)
mesh_6 = Mesh(flatten(mesh_4))
demesh = DeconstructMesh(Mesh=mesh_6)  # -> Vertices, Faces, Colours, Normals
pdecon = Deconstruct(Point=demesh.Vertices)  # -> XComponent, YComponent, ZComponent
smaller = SmallerThan(FirstNumber=pdecon.ZComponent, SecondNumber="0.3")  # -> SmallerThan, OrEqualTo
dispatch = Dispatch(List=demesh.Vertices, DispatchPattern=smaller.OrEqualTo)  # -> ListA, ListB
pt = Point(dispatch.ListA)
cullpt = CullDuplicates(Points=dispatch.ListA, Tolerance="0.05", CullMode=3)  # -> flatten(Points), Indices, Valence
cps = ClosestPointsKaramba(Point=cullpt.Points, Cloud=demesh.Vertices, NumberOfNeighbors=1, LimitDistance=-1)  # -> flatten(Points), Index, Distance
bbox = BoundingBox(Content=mesh_6, Plane=PlaneXY(0, 0, 0))  # -> Box, Box_2
debox = DeconstructBox(Box=bbox.Box)  # -> Plane, X, Y, Z
panel_7 = Panel(debox.Z)
# already safety factor？
panel_8 = Panel("0.0024")

# ----
# live load
number_slider_14 = Slider(1.4, range=0..10)
multiplication_4 = Multiplication(A=Slider(-0.6, range=-1..1), B=number_slider_14)
Z = UnitZ(Factor="-1.2")
Z_2 = UnitZ(Factor=multiplication_4)
loads = LoadsKaramba(Vector=Z, LCase="0", mode="Gravity")
loads_2 = LoadsKaramba(Vector=Z_2, Mesh=mesh_6, LCase="1", mode="MeshLoad -Const.", menu=[buttons(off, off, on), buttons(on, off)])

division_8 = Division(A="0.24", B="2")
matprops = MaterialPropertiesKaramba(
    FamilyOfMaterial="earth bag",
    Name="earth bag",
    YoungsModulus_kN_cm2="2",
    InPlaneShearModulus_kN_cm2="0.77",
    TransverseShearModulus_kN_cm2="0.77",
    SpecificWeight_kN_m3="17",
    CoefficientOfThermalExpansion_1_C=1e-05,
    YieldStrength_kN_cm2=division_8,
    mode="Isotrop")
meshtoshell = MeshToShellKaramba(Mesh=mesh_6, Identifier="whole", LimitDistance_m=0.005)  # -> Element, Points, Info
cross_sections = CrossSectionsKaramba(FamilyNameOfCrossSection="DefaultCroSec", Material=matprops, Height_cm="50", mode="Shell - Const")
load = LoadKaramba([loads_2, loads])
cull_i = CullIndex(List=meshtoshell.Points, Indices="52325", Wrap=True)
galapagos = Galapagos(fitness=num_4, gene=[number_slider_6, number_slider_7, number_slider_9])

# ---- group: reduce mesh point density with cull pattern
panel_9 = Panel("""0
0
0
0
0
1""")  # disabled
cull = CullPattern(List=cull_i, CullPattern=panel_9)  # disabled

# ---- group: map principal stress lines at each point
shelllineresults = LineResultsOnShellsKaramba(Layer=0, ListOfSourcesOfPrincipalStressLinesLinesPoints=cull, SegmentLength_m=0.5, DA_deg=5, mode="PrincStress")  # -> AnalyzedModel, Lines1, Lines2; disabled

# ----
panel_10 = Panel("250")  # disabled

panel_11 = Panel("0.0024")  # disabled

# ---- group: blue
rgb = ColourRGB(Alpha=255, Red=0, Green=0, Blue=panel_10)  # disabled
preview = CustomPreview(Geometry=shelllineresults.Lines1, Shader=rgb)  # disabled

# ---- group: red
rgb_2 = ColourRGB(Alpha=255, Red=panel_10, Green=0, Blue=0)  # disabled
preview_2 = CustomPreview(Geometry=shelllineresults.Lines2, Shader=rgb_2)  # disabled

# ----
demesh_2 = DeconstructMesh(Mesh=mesh_6)  # -> Vertices, Faces, Colours, Normals
pdecon_2 = Deconstruct(Point=demesh_2.Vertices)  # -> XComponent, YComponent, ZComponent
bnd = Bounds(Numbers=flatten(pdecon_2.ZComponent))
dedomain = DeconstructDomain(Domain=bnd)  # -> Start, End
equals = Equality(FirstNumber=pdecon_2.ZComponent, SecondNumber=dedomain.Start)  # -> Equality, Inequality
dispatch_2 = Dispatch(List=demesh_2.Vertices, DispatchPattern=equals.Equality)  # -> ListA, ListB
cullpt_2 = CullDuplicates(Points=dispatch_2.ListA, Tolerance=0.1, CullMode=3)  # -> flatten(Points), Indices, Valence

cps_2 = ClosestPointsKaramba(Point=cullpt_2.Points, Cloud=demesh_2.Vertices, NumberOfNeighbors=1, LimitDistance=-1)  # -> flatten(Points), Index, Distance
pt_2 = Point(dispatch_2.ListA)

supp = SupportKaramba(PosInd=flatten(cps_2.Points), menu=[buttons(on, on, on, on, on, on)])

assemble = AssembleModelKaramba(Points=cull_i, Elem=meshtoshell.Element, Support=supp, Load=load, CrossSection=cross_sections, LimitDistance_m=0.005)  # -> Model, Info, Mass_kg, CenterOfGravity
analyzethi = AnalyzeThIKaramba(Model=assemble.Model)  # -> CalculatedModel, MaximumDisplacement_m, ResultingForceOfGravity_kN, ElasticEnergy_kNm
num = Number(analyzethi.MaximumDisplacement_m)
modelview = ModelViewKaramba(Model=analyzethi.CalculatedModel, LoadCaseFactorsForLinearSuperposition=1, IndexOfVisibleLoadcase=-1)  # -> Model, DeformedMesh, DeformedAxes, DeformedModel
react = ReactionForcesKaramba(AnalyzedModel=modelview.Model, LoadCase=0)  # -> AnalyzedModel, ReactionForces_kN, ReactionMoments_kNm, SupportPosition, SumOfReactionForces_kN, SumOfReactionMoments_kNm
shellview = ShellViewKaramba(Model=modelview.Model, IndexOfLayer=0)  # -> Model, MeshesOfRenderedShells, LegendColors, LegendTags
s_forces = ShellForcesKaramba(AnalyzedModel=shellview.Model, LCase=0, mode="Principal")  # -> AnalyzedModel, FirstPrincipalNormalForce_kN_m, SecondPrincipalNormalForce_kN_m, FirstPrincipalMoment_kN, SecondPrincipalMoment_kN, ShearForceInLocalXDirection_kN_m, ShearForceInLocalYDirection_kN_m
legend = Legend(Colour=shellview.LegendColors, Tags=shellview.LegendTags, LegendType=1)

shellvecresults = ResultVectorsOnShellsKaramba(AnalyzedModel=shellview.Model, LayerOfResults=0, mode="PrincStress")  # -> AnalyzedModel, Points, FirstPrincipalStressVector_kN_cm2, SecondPrincipalStressVector_kN_cm2, FirstPrincipalStressValue_kN_cm2, SecondPrincipalStressValue_kN_cm2
bnd_2 = Bounds(Numbers=[shellvecresults.FirstPrincipalStressValue_kN_cm2, shellvecresults.SecondPrincipalStressValue_kN_cm2])
num_2 = Number(shellvecresults.FirstPrincipalStressValue_kN_cm2)
larger = LargerThan(FirstNumber=num_2, SecondNumber="0")  # -> LargerThan, OrEqualTo
dedomain_2 = DeconstructDomain(Domain=bnd_2)  # -> Start, End
dispatch_3 = Dispatch(List=num_2, DispatchPattern=larger.LargerThan)  # -> ListA, ListB
panel_12 = Panel(dedomain_2.Start)
num_3 = Number(dispatch_3.ListA)
panel_13 = Panel(num_3)

num_4 = Number(dedomain_2.Start)

series_2 = Series(Start=Slider(0, range=0..100), Step="1", Count=Slider(2, range=0..10))
nodedisp = NodalDisplacementsKaramba(AnalyzedModel=shellview.Model, LoadCase=series_2)  # -> AnalyzedModel, NodalTranslations_m, NodalRotations_rad
devec = DeconstructVector(Vector=nodedisp.NodalTranslations_m)  # -> XComponent, YComponent, ZComponent
project = Project(Geometry=nodedisp.NodalTranslations_m, Plane=PlaneXY(0, 0, 0))  # -> Geometry, Transform
vlen = VectorLength(Vector=project.Geometry)
abs = Absolute(Value=devec.ZComponent)
bnd_3 = Bounds(Numbers=abs)
bnd_4 = Bounds(Numbers=vlen)
dedomain_3 = DeconstructDomain(Domain=bnd_3)  # -> Start, End
dedomain_4 = DeconstructDomain(Domain=bnd_4)  # -> Start, End
panel_14 = Panel(dedomain_3.End)
panel_15 = Panel(dedomain_4.End)

panel_16 = Panel(dedomain_2.End)
