# Grasshopper definition 20.10_group 2 gh-bottle-level 0.gh (Grasshopper 1.0.7)
# plug-ins: Karamba, Pufferfish, Kangaroo Components, Weaverbird, Kangaroo2 Components

# Doubleclick Me!
curve = Curve([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])

boundary_surfaces = BoundarySurfaces(Edges=curve)
number_slider = Slider(247, range=0..500)
settings_custom = SettingsCustom(
    StitchSeams=True,
    SimplePlanes=False,
    Refine=True,
    MinCount=number_slider,
    MaxCount=number_slider,
    AspectRatio=Slider(17, range=0..100),
    MaxDistance=0,
    MaxAngle=20,
    MinEdge=0,
    MaxEdge=0)
mesh_brep = MeshBrep(Brep=boundary_surfaces, Settings=settings_custom)
area = Area(Geometry=mesh_brep)  # -> Area, Centroid
panel = Panel(area.Area)
multiplication = Multiplication(A=panel, B=Slider(28, range=0..720))
division = Division(A=multiplication, B=Slider(101, range=0..1000))
weaverbird_s_mesh_edges = WeaverbirdsMeshEdges(MeshOrPolylines=mesh_brep)
nakedvertices = NakedVertices(Mesh=mesh_brep)  # -> ClothedIndex, NakedIndex, ClothedPts, NakedPts
deconstruct_mesh = DeconstructMesh(Mesh=mesh_brep)  # -> Vertices, Faces, Colours, Normals
panel_2 = Panel(deconstruct_mesh.Vertices)
unit_z = UnitZ(Factor=division)
list_item = ListItem(List=deconstruct_mesh.Vertices, Index=nakedvertices.NakedIndex, Wrap=True)
springsfromline = SpringsFromLine(
    Connection=weaverbird_s_mesh_edges,
    Stiffness=Slider(28, range=0..1000),
    Damping=10,
    RestLength=weaverbird_s_mesh_edges,
    UpperCutoff=0,
    LowerCutoff=0,
    Plasticity=0)
unaryforce = UnaryForce(Point=deconstruct_mesh.Vertices, Force=unit_z)
timer = Timer(TimerInterval=20, Target=kangaroophysics)
kangaroophysics = KangarooPhysics(
    ForceObjects=flatten([unaryforce, springsfromline]),
    AnchorPoints=flatten(list_item),
    Settings=null,
    Geometry=mesh_brep,
    SimulationReset=Toggle(False))  # -> Out, Iterations, ParticlesOut, GeometryOut, KE; disabled

curve_2 = Curve(flatten(curve))

openings = Curve([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])
end_points = EndPoints(Curve=openings)  # -> Start, End

point_in_curve = PointInCurve(Point=end_points.Start, Curve=curve_2)  # -> Relationship, Point
point_in_curve_2 = PointInCurve(Point=end_points.End, Curve=curve_2)  # -> Relationship, Point
point = Point(point_in_curve_2.Point)
reference_anchor = Point(point_in_curve.Point)
line = Line(StartPoint=reference_anchor, EndPoint=point)
divide_curve = DivideCurve(Curve=line, Count=2, Kinks=False)  # -> Points, Tangents, Parameters
point_2 = Point(flatten(divide_curve.Points))
find_similar_member = FindSimilarMember(Data=[end_points.Start, end_points.End], Set=point_2)  # -> Hit, Index
midpoints = CullIndex(List=divide_curve.Points, Indices=find_similar_member.Index, Wrap=True)  # -> flatten(List)

value_list = ValueList({"One": 1.2, "Two": 2.4, "Three": 3.6, "Four": 4.8}, selected="One")
value_list_2 = ValueList({"One": 1.2, "Two": 2.4, "Three": 3.6, "Four": 4.8}, selected="Two")
value_list_3 = ValueList({"One": 1.2, "Two": 2.4, "Three": 3.6, "Four": 4.8}, selected="Three")
value_list_4 = ValueList({"One": 1.2, "Two": 2.4, "Three": 3.6, "Four": 4.8}, selected="Four")
length = Length(Curve=line)
round_to_nearest = RoundToNearest(NumbersX=length, NumbersY=[value_list_2, value_list_3, value_list_4, value_list], RemapNumberX=False)  # -> Nearest, RemappedNumberX
expression = Expression(x=round_to_nearest.Nearest, y=value_list, Expression="If(x=y,True,False)")
expression_2 = Expression(x=round_to_nearest.Nearest, y=value_list_3, Expression="If(x=y,True,False)")
expression_3 = Expression(x=round_to_nearest.Nearest, y=value_list_2, Expression="If(x=y,True,False)")
expression_4 = Expression(x=round_to_nearest.Nearest, y=value_list_4, Expression="If(x=y,True,False)")

mesh = Mesh(simplify([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]))

cull_pattern = CullPattern(List=midpoints, CullPattern=expression)
cull_pattern_2 = CullPattern(List=midpoints, CullPattern=expression_3)
cull_pattern_3 = CullPattern(List=midpoints, CullPattern=expression_2)
cull_pattern_4 = CullPattern(List=midpoints, CullPattern=expression_4)
cull_pattern_5 = CullPattern(List=line, CullPattern=expression)
cull_pattern_6 = CullPattern(List=line, CullPattern=expression_4)
cull_pattern_7 = CullPattern(List=line, CullPattern=expression_2)
cull_pattern_8 = CullPattern(List=line, CullPattern=expression_3)

division_2 = Division(A=Slider(3.6, range=2.4..3.6), B=2)
circle_cnr = CircleCNR(Center=cull_pattern_3, Normal=Vector(0, 0, 1), Radius=division_2)
line_2 = Line(cull_pattern_7)
surface = Surface(circle_cnr)
surface_curve = SurfaceCurve(Surface=surface, Curve=line_2)  # -> Curves, Points, UVPoints, Normals, Parameters, Tangents
line_3 = Line(surface_curve.Curves)

division_3 = Division(A=Slider(2.4, range=1.2..2.4), B=2)
circle_cnr_2 = CircleCNR(Center=cull_pattern_2, Normal=Vector(0, 0, 1), Radius=division_3)
line_4 = Line(cull_pattern_8)
surface_2 = Surface(circle_cnr_2)
surface_curve_2 = SurfaceCurve(Surface=surface_2, Curve=line_4)  # -> Curves, Points, UVPoints, Normals, Parameters, Tangents
line_5 = Line(surface_curve_2.Curves)

division_4 = Division(A=Slider(0.9, range=0.8..1.2), B=2)
circle_cnr_3 = CircleCNR(Center=cull_pattern, Normal=Vector(0, 0, 1), Radius=division_4)
line_6 = Line(cull_pattern_5)
surface_3 = Surface(circle_cnr_3)
surface_curve_3 = SurfaceCurve(Surface=surface_3, Curve=line_6)  # -> Curves, Points, UVPoints, Normals, Parameters, Tangents
line_7 = Line(surface_curve_3.Curves)

division_5 = Division(A=Slider(4.8, range=3.6..4.8), B=2)
circle_cnr_4 = CircleCNR(Center=cull_pattern_4, Normal=Vector(0, 0, 1), Radius=division_5)
line_8 = Line(cull_pattern_6)
surface_4 = Surface(circle_cnr_4)
surface_curve_4 = SurfaceCurve(Surface=surface_4, Curve=line_8)  # -> Curves, Points, UVPoints, Normals, Parameters, Tangents
line_9 = Line(surface_curve_4.Curves)

curve_3 = Curve(graft([line_9, line_3, line_5, line_7]))
divide_curve_2 = DivideCurve(Curve=curve_3, Count=10, Kinks=False)  # -> Points, Tangents, Parameters
unit_z_2 = UnitZ(Factor=Slider(78, range=0..100))
shatter = Shatter(Curve=curve_3, Parameters=divide_curve_2.Parameters)
point_3 = Point(divide_curve_2.Points)
unaryforce_2 = UnaryForce(Point=point_3, Force=unit_z_2)
list_item_2 = ListItem(List=divide_curve_2.Points, Index=[0, 10], Wrap=True)
line_10 = Line(shatter)
timer_2 = Timer(TimerInterval=20, Target=kangaroophysics_2)
springsfromline_2 = SpringsFromLine(
    Connection=line_10,
    Stiffness=Slider(603, range=0..1000),
    Damping=10,
    RestLength=line_10,
    UpperCutoff=0,
    LowerCutoff=0,
    Plasticity=0)
kangaroophysics_2 = KangarooPhysics(
    ForceObjects=flatten([springsfromline_2, unaryforce_2]),
    AnchorPoints=flatten(list_item_2),
    Settings=null,
    Geometry=line_10,
    SimulationReset=Toggle(False))  # -> Out, Iterations, ParticlesOut, GeometryOut, KE; disabled
line_11 = Line(Tree({0;0;0;0;0}: [Line((2377.188458, 1588.915181, 0), (2377.18844, 1588.988769, 0.6715540361)), Line((2377.18844, 1588.988769, 0.6715540361), (2377.188421, 1589.065109, 1.21341023)), Line((2377.188421, 1589.065109, 1.21341023), (2377.188402, 1589.14631, 1.625092112)), Line((2377.188402, 1589.14631, 1.625092112), (2377.188379, 1589.238201, 1.904620668)), Line((2377.188379, 1589.238201, 1.904620668), (2377.188348, 1589.365181, 2.033377339)), Line((2377.188348, 1589.365181, 2.033377339), (2377.188318, 1589.492162, 1.904620668))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], {0;0;1;0;0}: [Line((2370.14655, 1591.589226, 0), (2370.07747, 1591.563867, 0.6715540361)), Line((2370.07747, 1591.563867, 0.6715540361), (2370.005805, 1591.53756, 1.21341023)), Line((2370.005805, 1591.53756, 1.21341023), (2369.929579, 1591.509578, 1.625092112)), Line((2369.929579, 1591.509578, 1.625092112), (2369.843316, 1591.477912, 1.904620668)), Line((2369.843316, 1591.477912, 1.904620668), (2369.724113, 1591.434154, 2.033377339)), Line((2369.724113, 1591.434154, 2.033377339), (2369.604911, 1591.390396, 1.904620668))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], {0;0;2;0;0}: [Line((2368.492378, 1590.411883, 0), (2368.471845, 1590.341218, 0.6715540361)), Line((2368.471845, 1590.341218, 0.6715540361), (2368.450545, 1590.267909, 1.21341023)), Line((2368.450545, 1590.267909, 1.21341023), (2368.427889, 1590.189933, 1.625092112)), Line((2368.427889, 1590.189933, 1.625092112), (2368.402249, 1590.101692, 1.904620668)), Line((2368.402249, 1590.101692, 1.904620668), (2368.366819, 1589.979754, 2.033377339)), Line((2368.366819, 1589.979754, 2.033377339), (2368.331389, 1589.857817, 1.904620668))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], {0;0;3;0;0}: [Line((2370.03502, 1582.65986, 0), (2370.108608, 1582.6599, 0.6715540361)), Line((2370.108608, 1582.6599, 0.6715540361), (2370.184948, 1582.659942, 1.21341023)), Line((2370.184948, 1582.659942, 1.21341023), (2370.266149, 1582.659987, 1.625092112)), Line((2370.266149, 1582.659987, 1.625092112), (2370.358039, 1582.660038, 1.904620668)), Line((2370.358039, 1582.660038, 1.904620668), (2370.48502, 1582.660107, 2.033377339)), Line((2370.48502, 1582.660107, 2.033377339), (2370.612, 1582.660177, 1.904620668))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]))
join_curves = JoinCurves(Curves=[line_11, curve_3], Preserve=False)

line_12 = Line([Line((2372.732304, 1590.149148, 0), (2372.735411, 1588.549148, 0)), Line((2369.699306, 1587.111279, 0), (2371.299306, 1587.111279, 0))])
curve_4 = Curve(graft(line_12))
divide_curve_3 = DivideCurve(Curve=curve_4, Count=2, Kinks=False)  # -> Points, Tangents, Parameters
divide_curve_4 = DivideCurve(Curve=curve_4, Count=10, Kinks=False)  # -> Points, Tangents, Parameters

offset = Offset(Curve=curve_3, Distance=-1, Plane=PlaneXY(0, 0, 0), Corners=1)
divide_curve_5 = DivideCurve(Curve=curve_3, Count=2, Kinks=False)  # -> Points, Tangents, Parameters
divide_curve_6 = DivideCurve(Curve=offset, Count=2, Kinks=False)  # -> Points, Tangents, Parameters
list_item_3 = ListItem(List=divide_curve_6.Points, Index=1, Wrap=True)
list_item_4 = ListItem(List=divide_curve_5.Points, Index=1, Wrap=True)
vector_2pt = Vector2Pt(PointA=list_item_4, PointB=list_item_3, Unitize=False)  # -> Vector, Length
move = Move(Geometry=join_curves, Motion=vector_2pt.Vector)  # -> Geometry, Transform

offset_2 = Offset(Curve=curve_3, Distance=1, Plane=PlaneXY(0, 0, 0), Corners=1)
divide_curve_7 = DivideCurve(Curve=curve_3, Count=2, Kinks=False)  # -> Points, Tangents, Parameters
divide_curve_8 = DivideCurve(Curve=offset_2, Count=2, Kinks=False)  # -> Points, Tangents, Parameters
list_item_5 = ListItem(List=divide_curve_8.Points, Index=1, Wrap=True)
list_item_6 = ListItem(List=divide_curve_7.Points, Index=1, Wrap=True)
vector_2pt_2 = Vector2Pt(PointA=list_item_6, PointB=list_item_5, Unitize=False)  # -> Vector, Length
move_2 = Move(Geometry=join_curves, Motion=vector_2pt_2.Vector)  # -> Geometry, Transform

shatter_2 = Shatter(Curve=curve_4, Parameters=divide_curve_4.Parameters)
offset_3 = Offset(Curve=curve_4, Distance=-1.2, Plane=PlaneXY(0, 0, 0), Corners=1)
offset_4 = Offset(Curve=curve_4, Distance=1.2, Plane=PlaneXY(0, 0, 0), Corners=1)
unit_z_3 = UnitZ(Factor=Slider(78, range=0..100))
point_4 = Point(divide_curve_4.Points)
divide_curve_9 = DivideCurve(Curve=curve_4, Count=2, Kinks=False)  # -> Points, Tangents, Parameters
divide_curve_10 = DivideCurve(Curve=curve_4, Count=2, Kinks=False)  # -> Points, Tangents, Parameters
list_item_7 = ListItem(List=divide_curve_4.Points, Index=[0, 10], Wrap=True)
divide_curve_11 = DivideCurve(Curve=offset_3, Count=2, Kinks=False)  # -> Points, Tangents, Parameters
divide_curve_12 = DivideCurve(Curve=offset_4, Count=2, Kinks=False)  # -> Points, Tangents, Parameters
line_13 = Line(shatter_2)
unaryforce_3 = UnaryForce(Point=point_4, Force=unit_z_3)
list_item_8 = ListItem(List=divide_curve_9.Points, Index=1, Wrap=True)
list_item_9 = ListItem(List=divide_curve_10.Points, Index=1, Wrap=True)
list_item_10 = ListItem(List=divide_curve_11.Points, Index=1, Wrap=True)
list_item_11 = ListItem(List=divide_curve_12.Points, Index=1, Wrap=True)
timer_3 = Timer(TimerInterval=20, Target=kangaroophysics_3)
springsfromline_3 = SpringsFromLine(
    Connection=line_13,
    Stiffness=Slider(626, range=0..1000),
    Damping=10,
    RestLength=line_13,
    UpperCutoff=0,
    LowerCutoff=0,
    Plasticity=0)
vector_2pt_3 = Vector2Pt(PointA=list_item_8, PointB=list_item_10, Unitize=False)  # -> Vector, Length
vector_2pt_4 = Vector2Pt(PointA=list_item_9, PointB=list_item_11, Unitize=False)  # -> Vector, Length
kangaroophysics_3 = KangarooPhysics(
    ForceObjects=flatten([springsfromline_3, unaryforce_3]),
    AnchorPoints=flatten(list_item_7),
    Settings=null,
    Geometry=line_13,
    SimulationReset=Toggle(False))  # -> Out, Iterations, ParticlesOut, GeometryOut, KE; disabled
line_14 = Line(Tree({0;0;0}: [Line((2372.732304, 1590.149148, 0), (2372.732544, 1590.025398, 0.7183805155)), Line((2372.732544, 1590.025398, 0.7183805155), (2372.732799, 1589.894212, 1.310697231)), Line((2372.732799, 1589.894212, 1.310697231), (2372.733078, 1589.750238, 1.775020944)), Line((2372.733078, 1589.750238, 1.775020944), (2372.733409, 1589.580193, 2.104063139)), Line((2372.733409, 1589.580193, 2.104063139), (2372.733857, 1589.349148, 2.253089452)), Line((2372.733857, 1589.349148, 2.253089452), (2372.734306, 1589.118103, 2.104063139))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], {0;1;0}: [Line((2369.699306, 1587.111279, 0), (2369.823056, 1587.111279, 0.7183802242)), Line((2369.823056, 1587.111279, 0.7183802242), (2369.954242, 1587.111279, 1.310696654)), Line((2369.954242, 1587.111279, 1.310696654), (2370.098216, 1587.111279, 1.775020098)), Line((2370.098216, 1587.111279, 1.775020098), (2370.268261, 1587.111279, 2.104062064)), Line((2370.268261, 1587.111279, 2.104062064), (2370.499306, 1587.111279, 2.253088295)), Line((2370.499306, 1587.111279, 2.253088295), (2370.730351, 1587.111279, 2.104062064))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]))
number_slider_2 = Slider(1.262, range=0..10)
list_item_12 = ListItem(List=divide_curve_3.Points, Index=1, Wrap=True)

ruled_surface = RuledSurface(CurveA=join_curves, CurveB=move.Geometry)  # -> flatten(Surface)
ruled_surface_2 = RuledSurface(CurveA=join_curves, CurveB=move_2.Geometry)  # -> flatten(Surface)
brep_join = BrepJoin(Breps=[ruled_surface, ruled_surface_2])  # -> Breps, Closed
settings_custom_2 = SettingsCustom(
    StitchSeams=True,
    SimplePlanes=False,
    Refine=True,
    MinCount=16,
    MaxCount=400,
    AspectRatio=20,
    MaxDistance=0,
    MaxAngle=20,
    MinEdge=0,
    MaxEdge=0)
mesh_brep_2 = MeshBrep(Brep=brep_join.Breps, Settings=settings_custom_2)  # -> flatten(Mesh)

move_3 = Move(Geometry=line_14, Motion=vector_2pt_4.Vector)  # -> Geometry, Transform
move_4 = Move(Geometry=line_14, Motion=vector_2pt_3.Vector)  # -> Geometry, Transform
scale = Scale(Geometry=move_3.Geometry, Center=list_item_12, Factor=number_slider_2)  # -> Geometry, Transform
scale_2 = Scale(Geometry=move_4.Geometry, Center=list_item_12, Factor=number_slider_2)  # -> Geometry, Transform
ruled_surface_3 = RuledSurface(CurveA=line_14, CurveB=scale.Geometry)  # -> flatten(Surface)
ruled_surface_4 = RuledSurface(CurveA=line_14, CurveB=scale_2.Geometry)  # -> flatten(Surface)
number_slider_3 = Slider(65, range=0..100)
brep_join_2 = BrepJoin(Breps=ruled_surface_3)  # -> Breps, Closed
brep_join_3 = BrepJoin(Breps=ruled_surface_4)  # -> Breps, Closed
brep_join_4 = BrepJoin(Breps=[brep_join_3.Breps, brep_join_2.Breps])  # -> Breps, Closed
settings_custom_3 = SettingsCustom(
    StitchSeams=True,
    SimplePlanes=False,
    Refine=True,
    MinCount=number_slider_3,
    MaxCount=number_slider_3,
    AspectRatio=20,
    MaxDistance=0,
    MaxAngle=20,
    MinEdge=0,
    MaxEdge=0)
mesh_brep_3 = MeshBrep(Brep=brep_join_4.Breps, Settings=settings_custom_3)
mesh_split = MeshSplit(Mesh=flatten(mesh), Splitters=[brep_join_3.Breps, brep_join_2.Breps])
mesh_split_2 = MeshSplit(Mesh=mesh_brep_3, Splitters=mesh)  # -> flatten(Result)
area_2 = Area(Geometry=mesh_split)  # -> Area, Centroid
sort_list = SortList(Keys=area_2.Area, ValuesValuesA=mesh_split)  # -> Keys, reverse(ValuesValuesA)
list_item_13 = ListItem(List=sort_list.ValuesValuesA, Index=0, Wrap=True)
list_item_14 = ListItem(List=mesh_split_2, Index=[Slider(1, range=0..7), Slider(4, range=0..7)], Wrap=True)
weaverbird_s_laplacian_smoothing = WeaverbirdsLaplacianSmoothing(MeshCurves=list_item_14, Level=Slider(5, range=0..20), SmoothNakedEdges=0, Thin=Slider(1, range=0..1))
mesh_2 = Mesh(flatten(list_item_13))
multiplication_2 = Multiplication(B="10")
mesh_split_3 = MeshSplit(Mesh=mesh_2, Splitters=mesh_brep_2)  # -> flatten(Result)
multiplication_3 = Multiplication(B="10")
panel_3 = Panel(mesh_split_3)
area_3 = Area(Geometry=mesh_split_3)  # -> Area, Centroid
sort_list_2 = SortList(Keys=area_3.Area, ValuesValuesA=mesh_split_3)  # -> Keys, ValuesValuesA
series = Series(Start=0, Step=1, Count=Slider(3, range=0..10))
list_length = ListLength(List=sort_list_2.Keys)
expression_5 = Expression(X=list_length, N=series, Expression="(X-1)-N")
list_item_15 = ListItem(List=flatten(sort_list_2.ValuesValuesA), Index=expression_5, Wrap=True)
weaverbird_s_join_meshes_and_weld = WeaverbirdsJoinMeshesAndWeld(Mesh=flatten([weaverbird_s_laplacian_smoothing, list_item_15]), Weld=True)
mesh_3 = Mesh(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)
mesh_4 = Mesh(flatten(mesh_3))
demesh = DeconstructMesh(Mesh=mesh_4)  # -> Vertices, Faces, Colours, Normals
bbox = BoundingBox(Content=mesh_4, Plane=PlaneXY(0, 0, 0))  # -> Box, Box_2
debox = DeconstructBox(Box=bbox.Box)  # -> Plane, X, Y, Z
pdecon = Deconstruct(Point=demesh.Vertices)  # -> XComponent, YComponent, ZComponent
panel_4 = Panel(debox.Z)
smaller = SmallerThan(FirstNumber=pdecon.ZComponent, SecondNumber="0")  # -> SmallerThan, OrEqualTo
dispatch = Dispatch(List=demesh.Vertices, DispatchPattern=smaller.OrEqualTo)  # -> ListA, ListB

# ----
# from the fabric
# live load
number_slider_4 = Slider(1.4, range=0..10)
# bottle wall
panel_5 = Panel("-1.2")
pt = Point()  # disabled
vec = Vector()  # disabled
multiplication_4 = Multiplication(A=Slider(-0.6, range=-1..1), B=number_slider_4)
Z = UnitZ(Factor=panel_5)
panel_6 = Panel("1")  # disabled
vlen = VectorLength(Vector=vec)  # disabled
Z_2 = UnitZ(Factor=multiplication_4)
rev = Reverse(Vector=vec)  # disabled
bnd = Bounds(Numbers=vlen)  # disabled
loads = LoadsKaramba(ForceVector=rev, Local=False, PosInd=pt, LCase=panel_6, mode="Point")  # -> flatten(Load); disabled
loads_2 = LoadsKaramba(Vector=Z, LCase="0", mode="Gravity")
loads_3 = LoadsKaramba(Vector=Z_2, Mesh=mesh_4, LCase="1", mode="MeshLoad -Const.", menu=[buttons(off, off, on), buttons(on, off)])
dedomain = DeconstructDomain(Domain=bnd)  # -> Start, End; disabled

# ----
# safety factor
panel_7 = Panel("2")
division_6 = Division(A="0.485", B=panel_7)
cullpt = CullDuplicates(Points=dispatch.ListA, Tolerance="0.01", CullMode=3)  # -> flatten(Points), Indices, Valence
panel_8 = Panel("0.00485")
cps = ClosestPointsKaramba(Point=cullpt.Points, Cloud=demesh.Vertices, NumberOfNeighbors=1, LimitDistance=-1)  # -> flatten(Points), Index, Distance
matprops = MaterialPropertiesKaramba(
    FamilyOfMaterial="bottle wall",
    Name="bottle wall",
    YoungsModulus_kN_cm2="2.63",
    InPlaneShearModulus_kN_cm2="1.01",
    TransverseShearModulus_kN_cm2="1.01",
    SpecificWeight_kN_m3="14.18",
    CoefficientOfThermalExpansion_1_C=1e-05,
    YieldStrength_kN_cm2=division_6,
    mode="Isotrop")
supp = SupportKaramba(PosInd=cps.Points, menu=[buttons(on, on, on, on, on, on)])
meshtoshell = MeshToShellKaramba(Mesh=mesh_4, Identifier="whole", LimitDistance_m=0.005)  # -> Element, Points, Info
cross_sections = CrossSectionsKaramba(FamilyNameOfCrossSection="DefaultCroSec", Material=matprops, Height_cm="40", mode="Shell - Const")
load = LoadKaramba([loads_3, loads_2])
assemble = AssembleModelKaramba(
    Points=meshtoshell.Points,
    Elem=meshtoshell.Element,
    Support=supp,
    Load=load,
    CrossSection=cross_sections,
    LimitDistance_m=0.005)  # -> Model, Info, Mass_kg, CenterOfGravity
analyzethi = AnalyzeThIKaramba(Model=assemble.Model)  # -> CalculatedModel, MaximumDisplacement_m, ResultingForceOfGravity_kN, ElasticEnergy_kNm
num = Number(analyzethi.MaximumDisplacement_m)
panel_9 = Panel(num)
modelview = ModelViewKaramba(Model=analyzethi.CalculatedModel, LoadCaseFactorsForLinearSuperposition=1, IndexOfVisibleLoadcase=-1)  # -> Model, DeformedMesh, DeformedAxes, DeformedModel
react = ReactionForcesKaramba(AnalyzedModel=modelview.Model, LoadCase=0)  # -> AnalyzedModel, ReactionForces_kN, ReactionMoments_kNm, SupportPosition, SumOfReactionForces_kN, SumOfReactionMoments_kNm
shellview = ShellViewKaramba(Model=modelview.Model, IndexOfLayer=0)  # -> Model, MeshesOfRenderedShells, LegendColors, LegendTags
s_forces = ShellForcesKaramba(AnalyzedModel=shellview.Model, LCase=0, mode="Principal")  # -> AnalyzedModel, FirstPrincipalNormalForce_kN_m, SecondPrincipalNormalForce_kN_m, FirstPrincipalMoment_kN, SecondPrincipalMoment_kN, ShearForceInLocalXDirection_kN_m, ShearForceInLocalYDirection_kN_m
multiplication_5 = Multiplication(A=shellview.LegendTags, B="10")
legend = Legend(Colour=shellview.LegendColors, Tags=multiplication_5, LegendType=1)

series_2 = Series(Start=Slider(0, range=0..100), Step="1", Count=Slider(2, range=0..10))
nodedisp = NodalDisplacementsKaramba(AnalyzedModel=shellview.Model, LoadCase=series_2)  # -> AnalyzedModel, NodalTranslations_m, NodalRotations_rad
devec = DeconstructVector(Vector=nodedisp.NodalTranslations_m)  # -> XComponent, YComponent, ZComponent
project = Project(Geometry=nodedisp.NodalTranslations_m, Plane=PlaneXY(0, 0, 0))  # -> Geometry, Transform
vlen_2 = VectorLength(Vector=project.Geometry)
abs = Absolute(Value=devec.ZComponent)
bnd_2 = Bounds(Numbers=abs)
bnd_3 = Bounds(Numbers=vlen_2)
dedomain_2 = DeconstructDomain(Domain=bnd_2)  # -> Start, End
dedomain_3 = DeconstructDomain(Domain=bnd_3)  # -> Start, End
panel_10 = Panel(dedomain_2.End)
panel_11 = Panel(dedomain_3.End)

shellvecresults = ResultVectorsOnShellsKaramba(AnalyzedModel=shellview.Model, LayerOfResults=0, mode="PrincStress")  # -> AnalyzedModel, Points, FirstPrincipalStressVector_kN_cm2, SecondPrincipalStressVector_kN_cm2, FirstPrincipalStressValue_kN_cm2, SecondPrincipalStressValue_kN_cm2
bnd_4 = Bounds(Numbers=[shellvecresults.FirstPrincipalStressValue_kN_cm2, shellvecresults.SecondPrincipalStressValue_kN_cm2])
num_2 = Number(shellvecresults.FirstPrincipalStressValue_kN_cm2)
larger = LargerThan(FirstNumber=num_2, SecondNumber="0")  # -> LargerThan, OrEqualTo
dedomain_4 = DeconstructDomain(Domain=bnd_4)  # -> Start, End
panel_12 = Panel(dedomain_4.Start)
dispatch_2 = Dispatch(List=num_2, DispatchPattern=larger.LargerThan)  # -> ListA, ListB
num_3 = Number(dispatch_2.ListA)
panel_13 = Panel(num_3)

# ---- group: reduce mesh point density with cull pattern
panel_14 = Panel("""0
0
0
0
0
1""")
cull = CullPattern(List=meshtoshell.Points, CullPattern=panel_14)

# ---- group: map principal stress lines at each point
shelllineresults = LineResultsOnShellsKaramba(
    AnalyzedModel=analyzethi.CalculatedModel,
    Layer=0,
    ListOfSourcesOfPrincipalStressLinesLinesPoints=cull,
    SegmentLength_m=0.5,
    DA_deg=5,
    mode="PrincStress")  # -> AnalyzedModel, Lines1, Lines2

# ----
panel_15 = Panel(dedomain_4.End)

# ---- group: blue
rgb = ColourRGB(Alpha=255, Red=0, Green=0, Blue="250")
preview = CustomPreview(Geometry=shelllineresults.Lines1, Shader=rgb)

# ---- group: red
rgb_2 = ColourRGB(Alpha=255, Red="250", Green=0, Blue=0)
preview_2 = CustomPreview(Geometry=shelllineresults.Lines2, Shader=rgb_2)
