# Grasshopper definition 20.10_group 6 gh-bottle-level 0.gh (Grasshopper 1.0.7)
# plug-ins: Karamba, Pufferfish, Kangaroo Components, Weaverbird, Kangaroo2 Components

# Doubleclick Me!
curve = Curve([<curve referenced from the Rhino model> x2])
curve_2 = Curve(flatten(curve))

boundary_surfaces = BoundarySurfaces(Edges=curve)
number_slider = Slider(144, range=0..500)
settings_custom = SettingsCustom(
    StitchSeams=True,
    SimplePlanes=False,
    Refine=True,
    MinCount=number_slider,
    MaxCount=number_slider,
    AspectRatio=Slider(17, range=0..100),
    MaxDistance=0,
    MaxAngle=20,
    MinEdge=0,
    MaxEdge=0)
mesh_brep = MeshBrep(Brep=boundary_surfaces, Settings=settings_custom)
area = Area(Geometry=mesh_brep)  # -> Area, Centroid
panel = Panel(area.Area)
multiplication = Multiplication(A=panel, B=Slider(28, range=0..720))
division = Division(A=multiplication, B=Slider(101, range=0..1000))
weaverbird_s_mesh_edges = WeaverbirdsMeshEdges(MeshOrPolylines=mesh_brep)
nakedvertices = NakedVertices(Mesh=mesh_brep)  # -> ClothedIndex, NakedIndex, ClothedPts, NakedPts
deconstruct_mesh = DeconstructMesh(Mesh=mesh_brep)  # -> Vertices, Faces, Colours, Normals
panel_2 = Panel(deconstruct_mesh.Vertices)
unit_z = UnitZ(Factor=division)
list_item = ListItem(List=deconstruct_mesh.Vertices, Index=nakedvertices.NakedIndex, Wrap=True)
springsfromline = SpringsFromLine(
    Connection=weaverbird_s_mesh_edges,
    Stiffness=Slider(24, range=0..1000),
    Damping=10,
    RestLength=weaverbird_s_mesh_edges,
    UpperCutoff=0,
    LowerCutoff=0,
    Plasticity=0)
unaryforce = UnaryForce(Point=deconstruct_mesh.Vertices, Force=unit_z)
timer = Timer(TimerInterval=20, Target=kangaroophysics)
kangaroophysics = KangarooPhysics(
    ForceObjects=flatten([unaryforce, springsfromline]),
    AnchorPoints=flatten(list_item),
    Settings=null,
    Geometry=mesh_brep,
    SimulationReset=Toggle(False))  # -> Out, Iterations, ParticlesOut, GeometryOut, KE; disabled

openings = Curve([<curve referenced from the Rhino model> x2])
end_points = EndPoints(Curve=openings)  # -> Start, End

point_in_curve = PointInCurve(Point=end_points.Start, Curve=curve_2)  # -> Relationship, Point
point_in_curve_2 = PointInCurve(Point=end_points.End, Curve=curve_2)  # -> Relationship, Point
point = Point(point_in_curve_2.Point)
reference_anchor = Point(point_in_curve.Point)
line = Line(StartPoint=reference_anchor, EndPoint=point)
divide_curve = DivideCurve(Curve=line, Count=2, Kinks=False)  # -> Points, Tangents, Parameters
point_2 = Point(flatten(divide_curve.Points))
find_similar_member = FindSimilarMember(Data=[end_points.Start, end_points.End], Set=point_2)  # -> Hit, Index
midpoints = CullIndex(List=divide_curve.Points, Indices=find_similar_member.Index, Wrap=True)  # -> flatten(List)

value_list = ValueList({"One": 1.2, "Two": 2.4, "Three": 3.6, "Four": 4.8}, selected="One")
value_list_2 = ValueList({"One": 1.2, "Two": 2.4, "Three": 3.6, "Four": 4.8}, selected="Two")
value_list_3 = ValueList({"One": 1.2, "Two": 2.4, "Three": 3.6, "Four": 4.8}, selected="Three")
value_list_4 = ValueList({"One": 1.2, "Two": 2.4, "Three": 3.6, "Four": 4.8}, selected="Four")
length = Length(Curve=line)
round_to_nearest = RoundToNearest(NumbersX=length, NumbersY=[value_list_2, value_list_3, value_list_4, value_list], RemapNumberX=False)  # -> Nearest, RemappedNumberX
expression = Expression(x=round_to_nearest.Nearest, y=value_list, Expression="If(x=y,True,False)")
expression_2 = Expression(x=round_to_nearest.Nearest, y=value_list_3, Expression="If(x=y,True,False)")
expression_3 = Expression(x=round_to_nearest.Nearest, y=value_list_2, Expression="If(x=y,True,False)")
expression_4 = Expression(x=round_to_nearest.Nearest, y=value_list_4, Expression="If(x=y,True,False)")

point_on_curve = PointOnCurve(parameter=0)
point_on_curve_2 = PointOnCurve(parameter=1)
point_on_curve_3 = PointOnCurve(parameter=0)
point_on_curve_4 = PointOnCurve(parameter=1)
point_on_curve_5 = PointOnCurve(parameter=0)
point_on_curve_6 = PointOnCurve(parameter=1)
point_on_curve_7 = PointOnCurve(parameter=0)
point_on_curve_8 = PointOnCurve(parameter=1)
cull_pattern = CullPattern(List=midpoints, CullPattern=expression)
cull_pattern_2 = CullPattern(List=midpoints, CullPattern=expression_3)
cull_pattern_3 = CullPattern(List=midpoints, CullPattern=expression_2)
cull_pattern_4 = CullPattern(List=midpoints, CullPattern=expression_4)
cull_pattern_5 = CullPattern(List=line, CullPattern=expression)
cull_pattern_6 = CullPattern(List=line, CullPattern=expression_4)
cull_pattern_7 = CullPattern(List=line, CullPattern=expression_2)
cull_pattern_8 = CullPattern(List=line, CullPattern=expression_3)

mesh = Mesh(simplify([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]))

division_2 = Division(A=Slider(3.6, range=2.4..3.6), B=2)
circle_cnr = CircleCNR(Center=cull_pattern_3, Normal=Vector(0, 0, 1), Radius=division_2)
line_2 = Line(cull_pattern_7)
surface = Surface(circle_cnr)
surface_curve = SurfaceCurve(Surface=surface, Curve=line_2)  # -> Curves, Points, UVPoints, Normals, Parameters, Tangents
line_3 = Line(surface_curve.Curves)

division_3 = Division(A=Slider(1.5, range=1.2..2.4), B=2)
circle_cnr_2 = CircleCNR(Center=cull_pattern_2, Normal=Vector(0, 0, 1), Radius=division_3)
line_4 = Line(cull_pattern_8)
surface_2 = Surface(circle_cnr_2)
surface_curve_2 = SurfaceCurve(Surface=surface_2, Curve=line_4)  # -> Curves, Points, UVPoints, Normals, Parameters, Tangents
line_5 = Line(surface_curve_2.Curves)

division_4 = Division(A=Slider(0.6, range=0.6..1.8), B=2)
circle_cnr_3 = CircleCNR(Center=cull_pattern, Normal=Vector(0, 0, 1), Radius=division_4)
line_6 = Line(cull_pattern_5)
surface_3 = Surface(circle_cnr_3)
surface_curve_3 = SurfaceCurve(Surface=surface_3, Curve=line_6)  # -> Curves, Points, UVPoints, Normals, Parameters, Tangents
line_7 = Line(surface_curve_3.Curves)

division_5 = Division(A=Slider(4.8, range=3.6..4.8), B=2)
circle_cnr_4 = CircleCNR(Center=cull_pattern_4, Normal=Vector(0, 0, 1), Radius=division_5)
line_8 = Line(cull_pattern_6)
surface_4 = Surface(circle_cnr_4)
surface_curve_4 = SurfaceCurve(Surface=surface_4, Curve=line_8)  # -> Curves, Points, UVPoints, Normals, Parameters, Tangents
line_9 = Line(surface_curve_4.Curves)

curve_3 = Curve(graft([line_9, line_3, line_5, line_7]))
divide_curve_2 = DivideCurve(Curve=curve_3, Count=10, Kinks=False)  # -> Points, Tangents, Parameters
unit_z_2 = UnitZ(Factor=Slider(78, range=0..100))
shatter = Shatter(Curve=curve_3, Parameters=divide_curve_2.Parameters)
point_3 = Point(divide_curve_2.Points)
unaryforce_2 = UnaryForce(Point=point_3, Force=unit_z_2)
list_item_2 = ListItem(List=divide_curve_2.Points, Index=[0, 10], Wrap=True)
line_10 = Line(shatter)
timer_2 = Timer(TimerInterval=20, Target=kangaroophysics_2)
springsfromline_2 = SpringsFromLine(
    Connection=line_10,
    Stiffness=Slider(668, range=0..1000),
    Damping=10,
    RestLength=line_10,
    UpperCutoff=0,
    LowerCutoff=0,
    Plasticity=0)
kangaroophysics_2 = KangarooPhysics(
    ForceObjects=flatten([springsfromline_2, unaryforce_2]),
    AnchorPoints=flatten(list_item_2),
    Settings=null,
    Geometry=line_10,
    SimulationReset=Toggle(False))  # -> Out, Iterations, ParticlesOut, GeometryOut, KE; disabled
line_11 = Line(Tree({0;0;0;0;0}: [Line((2385.11706, 1596.152907, 0), (2385.227695, 1596.117998, 0.6732706601)), Line((2385.227695, 1596.117998, 0.6732706601), (2385.344981, 1596.080991, 1.228402392)), Line((2385.344981, 1596.080991, 1.228402392), (2385.473702, 1596.040376, 1.663585675)), Line((2385.473702, 1596.040376, 1.663585675), (2385.625735, 1595.992405, 1.971984769)), Line((2385.625735, 1595.992405, 1.971984769), (2385.8323, 1595.927228, 2.111657409)), Line((2385.8323, 1595.927228, 2.111657409), (2386.038866, 1595.862051, 1.971984769))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], {0;0;1;0;0}: [Line((2384.382993, 1592.977531, 0), (2384.317362, 1593.073194, 0.6732706601)), Line((2384.317362, 1593.073194, 0.6732706601), (2384.247787, 1593.174607, 1.228402392)), Line((2384.247787, 1593.174607, 1.228402392), (2384.171427, 1593.285908, 1.663585675)), Line((2384.171427, 1593.285908, 1.663585675), (2384.081239, 1593.417367, 1.971984769)), Line((2384.081239, 1593.417367, 1.971984769), (2383.958701, 1593.595978, 2.111657409)), Line((2383.958701, 1593.595978, 2.111657409), (2383.836164, 1593.774589, 1.971984769))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]))
join_curves = JoinCurves(Curves=[line_11, curve_3], Preserve=False)

offset = Offset(Curve=curve_3, Distance=-1, Plane=PlaneXY(0, 0, 0), Corners=1)
divide_curve_3 = DivideCurve(Curve=curve_3, Count=2, Kinks=False)  # -> Points, Tangents, Parameters
divide_curve_4 = DivideCurve(Curve=offset, Count=2, Kinks=False)  # -> Points, Tangents, Parameters
list_item_3 = ListItem(List=divide_curve_4.Points, Index=1, Wrap=True)
list_item_4 = ListItem(List=divide_curve_3.Points, Index=1, Wrap=True)
vector_2pt = Vector2Pt(PointA=list_item_4, PointB=list_item_3, Unitize=False)  # -> Vector, Length
move = Move(Geometry=join_curves, Motion=vector_2pt.Vector)  # -> Geometry, Transform

offset_2 = Offset(Curve=curve_3, Distance=1, Plane=PlaneXY(0, 0, 0), Corners=1)
divide_curve_5 = DivideCurve(Curve=curve_3, Count=2, Kinks=False)  # -> Points, Tangents, Parameters
divide_curve_6 = DivideCurve(Curve=offset_2, Count=2, Kinks=False)  # -> Points, Tangents, Parameters
list_item_5 = ListItem(List=divide_curve_6.Points, Index=1, Wrap=True)
list_item_6 = ListItem(List=divide_curve_5.Points, Index=1, Wrap=True)
vector_2pt_2 = Vector2Pt(PointA=list_item_6, PointB=list_item_5, Unitize=False)  # -> Vector, Length
move_2 = Move(Geometry=join_curves, Motion=vector_2pt_2.Vector)  # -> Geometry, Transform

ruled_surface = RuledSurface(CurveA=join_curves, CurveB=move.Geometry)  # -> flatten(Surface)
ruled_surface_2 = RuledSurface(CurveA=join_curves, CurveB=move_2.Geometry)  # -> flatten(Surface)
brep_join = BrepJoin(Breps=[ruled_surface, ruled_surface_2])  # -> Breps, Closed
settings_custom_2 = SettingsCustom(
    StitchSeams=True,
    SimplePlanes=False,
    Refine=True,
    MinCount=16,
    MaxCount=400,
    AspectRatio=20,
    MaxDistance=0,
    MaxAngle=20,
    MinEdge=0,
    MaxEdge=0)
mesh_brep_2 = MeshBrep(Brep=brep_join.Breps, Settings=settings_custom_2)

mesh_2 = Mesh(mesh)
mesh_split = MeshSplit(Mesh=mesh_2, Splitters=mesh_brep_2)  # -> flatten(Result)
area_2 = Area(Geometry=mesh_split)  # -> Area, Centroid
sort_list = SortList(Keys=area_2.Area, ValuesValuesA=mesh_split)  # -> Keys, ValuesValuesA
series = Series(Start=0, Step=1, Count=Slider(2, range=0..10))
list_length = ListLength(List=sort_list.Keys)
expression_5 = Expression(X=list_length, N=series, Expression="(X-1)-N")
list_item_7 = ListItem(List=flatten(sort_list.ValuesValuesA), Index=expression_5, Wrap=True)
mesh_3 = Mesh([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])
# two similar
#  structures
item = ListItem(List=mesh_3, Index=0, Wrap=True)
mesh_4 = Mesh(flatten(item))

bbox = BoundingBox(Content=mesh_4, Plane=PlaneXY(0, 0, 0))  # -> Box, Box_2
debox = DeconstructBox(Box=bbox.Box)  # -> Plane, X, Y, Z
panel_3 = Panel(debox.Z)

# ----
# bottle wall
panel_4 = Panel("-1.2")
pt = Point()  # disabled
vec = Vector()  # disabled
multiplication_2 = Multiplication(A=Slider(-0.6, range=-1..1), B=Slider(1.4, range=0..10))
Z = UnitZ(Factor=panel_4)
panel_5 = Panel("1")  # disabled
vlen = VectorLength(Vector=vec)  # disabled
Z_2 = UnitZ(Factor=multiplication_2)
rev = Reverse(Vector=vec)  # disabled
bnd = Bounds(Numbers=vlen)  # disabled
loads = LoadsKaramba(ForceVector=rev, Local=False, PosInd=pt, LCase=panel_5, mode="Point")  # -> flatten(Load); disabled
loads_2 = LoadsKaramba(Vector=Z, LCase="0", mode="Gravity")
loads_3 = LoadsKaramba(Vector=Z_2, Mesh=mesh_4, LCase="1", mode="MeshLoad -Const.", menu=[buttons(off, off, on), buttons(on, off)])
dedomain = DeconstructDomain(Domain=bnd)  # -> Start, End; disabled

# ----
# safety factor
panel_6 = Panel("2")
division_6 = Division(A="0.485", B=panel_6)
panel_7 = Panel("0.00485")
matprops = MaterialPropertiesKaramba(
    FamilyOfMaterial="bottle wall",
    Name="bottle wall",
    YoungsModulus_kN_cm2="2.63",
    InPlaneShearModulus_kN_cm2="1.01",
    TransverseShearModulus_kN_cm2="1.01",
    SpecificWeight_kN_m3="14.18",
    CoefficientOfThermalExpansion_1_C=1e-05,
    YieldStrength_kN_cm2=division_6,
    mode="Isotrop")
meshtoshell = MeshToShellKaramba(Mesh=mesh_4, Identifier="whole", LimitDistance_m=0.005)  # -> Element, Points, Info
cross_sections = CrossSectionsKaramba(FamilyNameOfCrossSection="DefaultCroSec", Material=matprops, Height_cm="40", mode="Shell - Const")
load = LoadKaramba([loads_3, loads_2])
galapagos = Galapagos()

# ---- group: reduce mesh point density with cull pattern
panel_8 = Panel("""0
0
0
0
0
1""")
cull = CullPattern(List=meshtoshell.Points, CullPattern=panel_8)

# ----
demesh = DeconstructMesh(Mesh=mesh_4)  # -> Vertices, Faces, Colours, Normals
pdecon = Deconstruct(Point=demesh.Vertices)  # -> XComponent, YComponent, ZComponent
bnd_2 = Bounds(Numbers=flatten(pdecon.ZComponent))
dedomain_2 = DeconstructDomain(Domain=bnd_2)  # -> Start, End
equals = Equality(FirstNumber=pdecon.ZComponent, SecondNumber=dedomain_2.Start)  # -> Equality, Inequality
dispatch = Dispatch(List=demesh.Vertices, DispatchPattern=equals.Equality)  # -> ListA, ListB
cullpt = CullDuplicates(Points=dispatch.ListA, Tolerance=0.1, CullMode=3)  # -> flatten(Points), Indices, Valence; disabled

cps = ClosestPointsKaramba(Point=cullpt.Points, Cloud=demesh.Vertices, NumberOfNeighbors=1, LimitDistance=-1)  # -> flatten(Points), Index, Distance; disabled
pt_2 = Point(dispatch.ListA)

supp = SupportKaramba(PosInd=pt_2, menu=[buttons(on, on, on, on, on, on)])

assemble = AssembleModelKaramba(
    Points=meshtoshell.Points,
    Elem=meshtoshell.Element,
    Support=supp,
    Load=load,
    CrossSection=cross_sections,
    LimitDistance_m=0.005)  # -> Model, Info, Mass_kg, CenterOfGravity
analyzethi = AnalyzeThIKaramba(Model=assemble.Model)  # -> CalculatedModel, MaximumDisplacement_m, ResultingForceOfGravity_kN, ElasticEnergy_kNm
num = Number(analyzethi.MaximumDisplacement_m)
panel_9 = Panel(num)
modelview = ModelViewKaramba(Model=analyzethi.CalculatedModel, LoadCaseFactorsForLinearSuperposition=1, IndexOfVisibleLoadcase=-1)  # -> Model, DeformedMesh, DeformedAxes, DeformedModel
shellview = ShellViewKaramba(Model=modelview.Model, IndexOfLayer=0)  # -> Model, MeshesOfRenderedShells, LegendColors, LegendTags
react = ReactionForcesKaramba(AnalyzedModel=modelview.Model, LoadCase=0)  # -> AnalyzedModel, ReactionForces_kN, ReactionMoments_kNm, SupportPosition, SumOfReactionForces_kN, SumOfReactionMoments_kNm
multiplication_3 = Multiplication(A=shellview.LegendTags, B="10")
legend = Legend(Colour=shellview.LegendColors, Tags=multiplication_3, LegendType=1)
s_forces = ShellForcesKaramba(AnalyzedModel=shellview.Model, LCase=0, mode="Principal")  # -> AnalyzedModel, FirstPrincipalNormalForce_kN_m, SecondPrincipalNormalForce_kN_m, FirstPrincipalMoment_kN, SecondPrincipalMoment_kN, ShearForceInLocalXDirection_kN_m, ShearForceInLocalYDirection_kN_m

shellvecresults = ResultVectorsOnShellsKaramba(AnalyzedModel=shellview.Model, LayerOfResults=0, mode="PrincStress")  # -> AnalyzedModel, Points, FirstPrincipalStressVector_kN_cm2, SecondPrincipalStressVector_kN_cm2, FirstPrincipalStressValue_kN_cm2, SecondPrincipalStressValue_kN_cm2
bnd_3 = Bounds(Numbers=[shellvecresults.SecondPrincipalStressValue_kN_cm2, shellvecresults.FirstPrincipalStressValue_kN_cm2])
num_2 = Number(shellvecresults.FirstPrincipalStressValue_kN_cm2)
larger = LargerThan(FirstNumber=num_2, SecondNumber="0")  # -> LargerThan, OrEqualTo
dedomain_3 = DeconstructDomain(Domain=bnd_3)  # -> Start, End
panel_10 = Panel(dedomain_3.Start)
dispatch_2 = Dispatch(List=num_2, DispatchPattern=larger.LargerThan)  # -> ListA, ListB
num_3 = Number(dispatch_2.ListA)
panel_11 = Panel(num_3)

series_2 = Series(Start=Slider(0, range=0..100), Step="1", Count=Slider(2, range=0..10))
nodedisp = NodalDisplacementsKaramba(AnalyzedModel=shellview.Model, LoadCase=series_2)  # -> AnalyzedModel, NodalTranslations_m, NodalRotations_rad
devec = DeconstructVector(Vector=nodedisp.NodalTranslations_m)  # -> XComponent, YComponent, ZComponent
project = Project(Geometry=nodedisp.NodalTranslations_m, Plane=PlaneXY(0, 0, 0))  # -> Geometry, Transform
vlen_2 = VectorLength(Vector=project.Geometry)
abs = Absolute(Value=devec.ZComponent)
bnd_4 = Bounds(Numbers=abs)
bnd_5 = Bounds(Numbers=vlen_2)
dedomain_4 = DeconstructDomain(Domain=bnd_4)  # -> Start, End
dedomain_5 = DeconstructDomain(Domain=bnd_5)  # -> Start, End
panel_12 = Panel(dedomain_4.End)
panel_13 = Panel(dedomain_5.End)

# ---- group: map principal stress lines at each point
shelllineresults = LineResultsOnShellsKaramba(
    AnalyzedModel=analyzethi.CalculatedModel,
    Layer=0,
    ListOfSourcesOfPrincipalStressLinesLinesPoints=cull,
    SegmentLength_m=0.5,
    DA_deg=5,
    mode="PrincStress")  # -> AnalyzedModel, Lines1, Lines2

# ----
panel_14 = Panel(dedomain_3.End)

# ---- group: blue
rgb = ColourRGB(Alpha=255, Red=0, Green=0, Blue="250")
preview = CustomPreview(Geometry=shelllineresults.Lines1, Shader=rgb)

# ---- group: red
rgb_2 = ColourRGB(Alpha=255, Red="250", Green=0, Blue=0)
preview_2 = CustomPreview(Geometry=shelllineresults.Lines2, Shader=rgb_2)
