# Grasshopper definition 20.10_group 7 gh-earthbag-level 0.gh (Grasshopper 1.0.7)
# plug-ins: Karamba, Pufferfish, Kangaroo Components, Weaverbird, Kangaroo2 Components

# Doubleclick Me!
curve = Curve([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])
curve_2 = Curve(flatten(curve))

openings = Curve([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])
end_points = EndPoints(Curve=openings)  # -> Start, End

point_in_curve = PointInCurve(Point=end_points.Start, Curve=curve_2)  # -> Relationship, Point
point_in_curve_2 = PointInCurve(Point=end_points.End, Curve=curve_2)  # -> Relationship, Point
point = Point(point_in_curve_2.Point)
reference_anchor = Point(point_in_curve.Point)
line = Line(StartPoint=reference_anchor, EndPoint=point)
divide_curve = DivideCurve(Curve=line, Count=2, Kinks=False)  # -> Points, Tangents, Parameters
point_2 = Point(flatten(divide_curve.Points))
find_similar_member = FindSimilarMember(Data=[end_points.Start, end_points.End], Set=point_2)  # -> Hit, Index
midpoints = CullIndex(List=divide_curve.Points, Indices=find_similar_member.Index, Wrap=True)  # -> flatten(List)

value_list = ValueList({"One": 1.2, "Two": 2.4, "Three": 3.6, "Four": 4.8}, selected="One")
value_list_2 = ValueList({"One": 1.2, "Two": 2.4, "Three": 3.6, "Four": 4.8}, selected="Two")
value_list_3 = ValueList({"One": 1.2, "Two": 2.4, "Three": 3.6, "Four": 4.8}, selected="Three")
value_list_4 = ValueList({"One": 1.2, "Two": 2.4, "Three": 3.6, "Four": 4.8}, selected="Four")
length = Length(Curve=line)
round_to_nearest = RoundToNearest(NumbersX=length, NumbersY=[value_list_2, value_list_3, value_list_4, value_list], RemapNumberX=False)  # -> Nearest, RemappedNumberX
expression = Expression(x=round_to_nearest.Nearest, y=value_list, Expression="If(x=y,True,False)")
expression_2 = Expression(x=round_to_nearest.Nearest, y=value_list_3, Expression="If(x=y,True,False)")
expression_3 = Expression(x=round_to_nearest.Nearest, y=value_list_2, Expression="If(x=y,True,False)")
expression_4 = Expression(x=round_to_nearest.Nearest, y=value_list_4, Expression="If(x=y,True,False)")

boundary_surfaces = BoundarySurfaces(Edges=curve)
number_slider = Slider(247, range=0..500)
settings_custom = SettingsCustom(
    StitchSeams=True,
    SimplePlanes=False,
    Refine=True,
    MinCount=number_slider,
    MaxCount=number_slider,
    AspectRatio=Slider(17, range=0..100),
    MaxDistance=0,
    MaxAngle=20,
    MinEdge=0,
    MaxEdge=0)
mesh_brep = MeshBrep(Brep=boundary_surfaces, Settings=settings_custom)
area = Area(Geometry=mesh_brep)  # -> Area, Centroid
panel = Panel(area.Area)
multiplication = Multiplication(A=panel, B=Slider(28, range=0..720))
division = Division(A=multiplication, B=Slider(101, range=0..1000))
weaverbird_s_mesh_edges = WeaverbirdsMeshEdges(MeshOrPolylines=mesh_brep)
nakedvertices = NakedVertices(Mesh=mesh_brep)  # -> ClothedIndex, NakedIndex, ClothedPts, NakedPts
deconstruct_mesh = DeconstructMesh(Mesh=mesh_brep)  # -> Vertices, Faces, Colours, Normals
panel_2 = Panel(deconstruct_mesh.Vertices)
unit_z = UnitZ(Factor=division)
list_item = ListItem(List=deconstruct_mesh.Vertices, Index=nakedvertices.NakedIndex, Wrap=True)
springsfromline = SpringsFromLine(
    Connection=weaverbird_s_mesh_edges,
    Stiffness=Slider(50, range=30..50),
    Damping=10,
    RestLength=weaverbird_s_mesh_edges,
    UpperCutoff=0,
    LowerCutoff=0,
    Plasticity=0)
unaryforce = UnaryForce(Point=deconstruct_mesh.Vertices, Force=unit_z)
timer = Timer(TimerInterval=20, Target=kangaroophysics)
kangaroophysics = KangarooPhysics(
    ForceObjects=flatten([unaryforce, springsfromline]),
    AnchorPoints=flatten(list_item),
    Settings=null,
    Geometry=mesh_brep,
    SimulationReset=Toggle(False))  # -> Out, Iterations, ParticlesOut, GeometryOut, KE; disabled

number_slider_2 = Slider(40, range=0..1000)

cull_pattern = CullPattern(List=midpoints, CullPattern=expression)
cull_pattern_2 = CullPattern(List=midpoints, CullPattern=expression_3)
cull_pattern_3 = CullPattern(List=midpoints, CullPattern=expression_2)
cull_pattern_4 = CullPattern(List=midpoints, CullPattern=expression_4)
cull_pattern_5 = CullPattern(List=line, CullPattern=expression)
cull_pattern_6 = CullPattern(List=line, CullPattern=expression_4)
cull_pattern_7 = CullPattern(List=line, CullPattern=expression_2)
cull_pattern_8 = CullPattern(List=line, CullPattern=expression_3)

mesh = Mesh(simplify([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]))

# ----
# 3.6
number_slider_3 = Slider(2.4, range=2.4..3.6)
division_2 = Division(A=number_slider_3, B=2)
circle_cnr = CircleCNR(Center=cull_pattern_3, Normal=Vector(0, 0, 1), Radius=division_2)
line_2 = Line(cull_pattern_7)
surface = Surface(circle_cnr)
surface_curve = SurfaceCurve(Surface=surface, Curve=line_2)  # -> Curves, Points, UVPoints, Normals, Parameters, Tangents
line_3 = Line(surface_curve.Curves)

# ----
# 1
number_slider_4 = Slider(0.8, range=0.8..1.2)
division_3 = Division(A=number_slider_4, B=2)
circle_cnr_2 = CircleCNR(Center=cull_pattern, Normal=Vector(0, 0, 1), Radius=division_3)
line_4 = Line(cull_pattern_5)
surface_2 = Surface(circle_cnr_2)
surface_curve_2 = SurfaceCurve(Surface=surface_2, Curve=line_4)  # -> Curves, Points, UVPoints, Normals, Parameters, Tangents
line_5 = Line(surface_curve_2.Curves)

# ----
# 2.4
number_slider_5 = Slider(1.2, range=1.2..2.4)
division_4 = Division(A=number_slider_5, B=2)
circle_cnr_3 = CircleCNR(Center=cull_pattern_2, Normal=Vector(0, 0, 1), Radius=division_4)
line_6 = Line(cull_pattern_8)
surface_3 = Surface(circle_cnr_3)
surface_curve_3 = SurfaceCurve(Surface=surface_3, Curve=line_6)  # -> Curves, Points, UVPoints, Normals, Parameters, Tangents
line_7 = Line(surface_curve_3.Curves)

division_5 = Division(A=Slider(4.8, range=3.6..4.8), B=2)
circle_cnr_4 = CircleCNR(Center=cull_pattern_4, Normal=Vector(0, 0, 1), Radius=division_5)
line_8 = Line(cull_pattern_6)
surface_4 = Surface(circle_cnr_4)
surface_curve_4 = SurfaceCurve(Surface=surface_4, Curve=line_8)  # -> Curves, Points, UVPoints, Normals, Parameters, Tangents
line_9 = Line(surface_curve_4.Curves)

curve_3 = Curve(graft([line_9, line_3, line_7, line_5]))
divide_curve_2 = DivideCurve(Curve=curve_3, Count=10, Kinks=False)  # -> Points, Tangents, Parameters
unit_z_2 = UnitZ(Factor=Slider(78, range=0..100))
shatter = Shatter(Curve=curve_3, Parameters=divide_curve_2.Parameters)
point_3 = Point(divide_curve_2.Points)
unaryforce_2 = UnaryForce(Point=point_3, Force=unit_z_2)
list_item_2 = ListItem(List=divide_curve_2.Points, Index=[0, 10], Wrap=True)
line_10 = Line(shatter)
timer_2 = Timer(TimerInterval=20, Target=kangaroophysics_2)
springsfromline_2 = SpringsFromLine(
    Connection=line_10,
    Stiffness=Slider(723, range=0..1000),
    Damping=10,
    RestLength=line_10,
    UpperCutoff=0,
    LowerCutoff=0,
    Plasticity=0)
kangaroophysics_2 = KangarooPhysics(
    ForceObjects=flatten([springsfromline_2, unaryforce_2]),
    AnchorPoints=flatten(list_item_2),
    Settings=null,
    Geometry=line_10,
    SimulationReset=Toggle(False))  # -> Out, Iterations, ParticlesOut, GeometryOut, KE; disabled
line_11 = Line(Tree({0;0;0;0;0}: [Line((2335.838001, 1596.062031, 0), (2335.941061, 1595.914801, 0.7177204381)), Line((2335.941061, 1595.914801, 0.7177204381), (2336.052831, 1595.755143, 1.323260419)), Line((2336.052831, 1595.755143, 1.323260419), (2336.178902, 1595.575084, 1.811405496)), Line((2336.178902, 1595.575084, 1.811405496), (2336.331003, 1595.357889, 2.164983113)), Line((2336.331003, 1595.357889, 2.164983113), (2336.526295, 1595.07905, 2.316317372)), Line((2336.526295, 1595.07905, 2.316317372), (2336.721588, 1594.800211, 2.164983113))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], {0;0;0;1;0}: [Line((2351.056091, 1587.09168, 0), (2351.149902, 1587.09168, 0.6025650625)), Line((2351.149902, 1587.09168, 0.6025650625), (2351.248832, 1587.09168, 1.096478992)), Line((2351.248832, 1587.09168, 1.096478992), (2351.356636, 1587.09168, 1.480653317)), Line((2351.356636, 1587.09168, 1.480653317), (2351.482906, 1587.09168, 1.750467406)), Line((2351.482906, 1587.09168, 1.750467406), (2351.656091, 1587.09168, 1.873753292)), Line((2351.656091, 1587.09168, 1.873753292), (2351.829275, 1587.09168, 1.750467406))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], {0;0;0;2;0}: [Line((2358.556087, 1593.202673, 0), (2358.49105, 1593.202673, 0.5637482436)), Line((2358.49105, 1593.202673, 0.5637482436), (2358.423463, 1593.202673, 1.019392188)), Line((2358.423463, 1593.202673, 1.019392188), (2358.351384, 1593.202673, 1.366572481)), Line((2358.351384, 1593.202673, 1.366572481), (2358.269449, 1593.202674, 1.603453293)), Line((2358.269449, 1593.202674, 1.603453293), (2358.156087, 1593.202674, 1.71272804)), Line((2358.156087, 1593.202674, 1.71272804), (2358.042724, 1593.202674, 1.603453293))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], {0;0;1;0;0}: [Line((2342.55607, 1591.270347, 0), (2342.55607, 1591.090835, 0.7177500989)), Line((2342.55607, 1591.090835, 0.7177500989), (2342.556071, 1590.896079, 1.323310987)), Line((2342.556071, 1590.896079, 1.323310987), (2342.556071, 1590.676272, 1.811446376)), Line((2342.556071, 1590.676272, 1.811446376), (2342.556072, 1590.410959, 2.164947121)), Line((2342.556072, 1590.410959, 2.164947121), (2342.556073, 1590.070347, 2.316146216)), Line((2342.556073, 1590.070347, 2.316146216), (2342.556074, 1589.729736, 2.164947121))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], {0;0;1;1;0}: [Line((2356.147131, 1587.79075, 0), (2356.228299, 1587.743877, 0.6025770179)), Line((2356.228299, 1587.743877, 0.6025770179), (2356.313936, 1587.694485, 1.096500027)), Line((2356.313936, 1587.694485, 1.096500027), (2356.407278, 1587.64056, 1.480672177)), Line((2356.407278, 1587.64056, 1.480672177), (2356.516684, 1587.577418, 1.750467697)), Line((2356.516684, 1587.577418, 1.750467697), (2356.666747, 1587.490751, 1.873685565)), Line((2356.666747, 1587.490751, 1.873685565), (2356.81681, 1587.404084, 1.750467697))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], {0;0;1;2;0}: [Line((2356.56427, 1592.898329, 0), (2356.511765, 1592.859577, 0.5637285041)), Line((2356.511765, 1592.859577, 0.5637285041), (2356.457247, 1592.819375, 1.019357787)), Line((2356.457247, 1592.819375, 1.019357787), (2356.399258, 1592.776529, 1.366533445)), Line((2356.399258, 1592.776529, 1.366533445), (2356.333469, 1592.727923, 1.603435832)), Line((2356.333469, 1592.727923, 1.603435832), (2356.242539, 1592.660655, 1.712805603)), Line((2356.242539, 1592.660655, 1.712805603), (2356.151609, 1592.593387, 1.603435832))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], {0;0;2;0;0}: [Line((2360.797479, 1584.660052, 0), (2360.884923, 1584.626116, 0.6025679401)), Line((2360.884923, 1584.626116, 0.6025679401), (2360.977166, 1584.590485, 1.096485308)), Line((2360.977166, 1584.590485, 1.096485308), (2361.07765, 1584.551383, 1.480655283)), Line((2361.07765, 1584.551383, 1.480655283), (2361.195387, 1584.505761, 1.750466745)), Line((2361.195387, 1584.505761, 1.750466745), (2361.356872, 1584.443076, 1.873731346)), Line((2361.356872, 1584.443076, 1.873731346), (2361.518358, 1584.380391, 1.750466745))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], {0;0;2;1;0}: [Line((2353.891364, 1592.422973, 0), (2353.838858, 1592.461725, 0.563728504)), Line((2353.838858, 1592.461725, 0.563728504), (2353.78434, 1592.501927, 1.019357787)), Line((2353.78434, 1592.501927, 1.019357787), (2353.726352, 1592.544773, 1.366533445)), Line((2353.726352, 1592.544773, 1.366533445), (2353.660563, 1592.593379, 1.603435832)), Line((2353.660563, 1592.593379, 1.603435832), (2353.569633, 1592.660647, 1.712805603)), Line((2353.569633, 1592.660647, 1.712805603), (2353.478703, 1592.727915, 1.603435832))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], {0;0;3;0;0}: [Line((2363.722619, 1587.015578, 0), (2363.656383, 1587.081814, 0.602586337)), Line((2363.656383, 1587.081814, 0.602586337), (2363.586499, 1587.151698, 1.096514952)), Line((2363.586499, 1587.151698, 1.096514952), (2363.510285, 1587.227913, 1.480687596)), Line((2363.510285, 1587.227913, 1.480687596), (2363.420935, 1587.317263, 1.750465963)), Line((2363.420935, 1587.317263, 1.750465963), (2363.298355, 1587.439842, 1.873644208)), Line((2363.298355, 1587.439842, 1.873644208), (2363.175776, 1587.562422, 1.750465963))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], {0;0;3;1;0}: [Line((2352.056091, 1593.202668, 0), (2351.991054, 1593.202668, 0.5637482436)), Line((2351.991054, 1593.202668, 0.5637482436), (2351.923468, 1593.202668, 1.019392188)), Line((2351.923468, 1593.202668, 1.019392188), (2351.851388, 1593.202668, 1.366572481)), Line((2351.851388, 1593.202668, 1.366572481), (2351.769453, 1593.202668, 1.603453293)), Line((2351.769453, 1593.202668, 1.603453293), (2351.656091, 1593.202668, 1.71272804)), Line((2351.656091, 1593.202668, 1.71272804), (2351.542728, 1593.202668, 1.603453293))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]))
join_curves = JoinCurves(Curves=[line_11, curve_3], Preserve=False)

offset = Offset(Curve=curve_3, Distance=-1, Plane=PlaneXY(0, 0, 0), Corners=1)
divide_curve_3 = DivideCurve(Curve=curve_3, Count=2, Kinks=False)  # -> Points, Tangents, Parameters
divide_curve_4 = DivideCurve(Curve=offset, Count=2, Kinks=False)  # -> Points, Tangents, Parameters
list_item_3 = ListItem(List=divide_curve_4.Points, Index=1, Wrap=True)
list_item_4 = ListItem(List=divide_curve_3.Points, Index=1, Wrap=True)
vector_2pt = Vector2Pt(PointA=list_item_4, PointB=list_item_3, Unitize=False)  # -> Vector, Length
move = Move(Geometry=join_curves, Motion=vector_2pt.Vector)  # -> Geometry, Transform

offset_2 = Offset(Curve=curve_3, Distance=1, Plane=PlaneXY(0, 0, 0), Corners=1)
divide_curve_5 = DivideCurve(Curve=curve_3, Count=2, Kinks=False)  # -> Points, Tangents, Parameters
divide_curve_6 = DivideCurve(Curve=offset_2, Count=2, Kinks=False)  # -> Points, Tangents, Parameters
list_item_5 = ListItem(List=divide_curve_6.Points, Index=1, Wrap=True)
list_item_6 = ListItem(List=divide_curve_5.Points, Index=1, Wrap=True)
vector_2pt_2 = Vector2Pt(PointA=list_item_6, PointB=list_item_5, Unitize=False)  # -> Vector, Length
move_2 = Move(Geometry=join_curves, Motion=vector_2pt_2.Vector)  # -> Geometry, Transform

line_12 = Line([Line((2341.906076, 1597.770349, 0), (2341.906076, 1595.370349, 0)), Line((2343.956079, 1593.320355, 0), (2346.356079, 1593.320355, 0)), Line((2348.406091, 1591.270355, 0), (2348.406091, 1588.870355, 0)), Line((2354.906083, 1591.270355, 0), (2354.906083, 1588.870355, 0)), Line((2361.15433, 1588.466307, 0), (2359.733976, 1587.058262, 0))])
curve_4 = Curve(graft(line_12))
divide_curve_7 = DivideCurve(Curve=curve_4, Count=2, Kinks=False)  # -> Points, Tangents, Parameters
divide_curve_8 = DivideCurve(Curve=curve_4, Count=10, Kinks=False)  # -> Points, Tangents, Parameters
shatter_2 = Shatter(Curve=curve_4, Parameters=divide_curve_8.Parameters)
offset_3 = Offset(Curve=curve_4, Distance=-1.2, Plane=PlaneXY(0, 0, 0), Corners=1)
offset_4 = Offset(Curve=curve_4, Distance=1.2, Plane=PlaneXY(0, 0, 0), Corners=1)
unit_z_3 = UnitZ(Factor=Slider(78, range=0..100))

ruled_surface = RuledSurface(CurveA=join_curves, CurveB=move.Geometry)  # -> flatten(Surface)
ruled_surface_2 = RuledSurface(CurveA=join_curves, CurveB=move_2.Geometry)  # -> flatten(Surface)
brep_join = BrepJoin(Breps=[ruled_surface, ruled_surface_2])  # -> Breps, Closed
settings_custom_2 = SettingsCustom(
    StitchSeams=True,
    SimplePlanes=False,
    Refine=True,
    MinCount=16,
    MaxCount=400,
    AspectRatio=20,
    MaxDistance=0,
    MaxAngle=20,
    MinEdge=0,
    MaxEdge=0)
mesh_brep_2 = MeshBrep(Brep=brep_join.Breps, Settings=settings_custom_2)  # -> flatten(Mesh)

point_4 = Point(divide_curve_8.Points)
divide_curve_9 = DivideCurve(Curve=curve_4, Count=2, Kinks=False)  # -> Points, Tangents, Parameters
divide_curve_10 = DivideCurve(Curve=curve_4, Count=2, Kinks=False)  # -> Points, Tangents, Parameters
list_item_7 = ListItem(List=divide_curve_8.Points, Index=[0, 10], Wrap=True)
divide_curve_11 = DivideCurve(Curve=offset_3, Count=2, Kinks=False)  # -> Points, Tangents, Parameters
divide_curve_12 = DivideCurve(Curve=offset_4, Count=2, Kinks=False)  # -> Points, Tangents, Parameters
line_13 = Line(shatter_2)
unaryforce_3 = UnaryForce(Point=point_4, Force=unit_z_3)
list_item_8 = ListItem(List=divide_curve_9.Points, Index=1, Wrap=True)
list_item_9 = ListItem(List=divide_curve_10.Points, Index=1, Wrap=True)
list_item_10 = ListItem(List=divide_curve_11.Points, Index=1, Wrap=True)
list_item_11 = ListItem(List=divide_curve_12.Points, Index=1, Wrap=True)
timer_3 = Timer(TimerInterval=20, Target=kangaroophysics_3)
springsfromline_3 = SpringsFromLine(
    Connection=line_13,
    Stiffness=Slider(747, range=0..1000),
    Damping=10,
    RestLength=line_13,
    UpperCutoff=0,
    LowerCutoff=0,
    Plasticity=0)
vector_2pt_3 = Vector2Pt(PointA=list_item_8, PointB=list_item_10, Unitize=False)  # -> Vector, Length
vector_2pt_4 = Vector2Pt(PointA=list_item_9, PointB=list_item_11, Unitize=False)  # -> Vector, Length
kangaroophysics_3 = KangarooPhysics(
    ForceObjects=flatten([springsfromline_3, unaryforce_3]),
    AnchorPoints=flatten(list_item_7),
    Settings=null,
    Geometry=line_13,
    SimulationReset=Toggle(False))  # -> Out, Iterations, ParticlesOut, GeometryOut, KE; disabled
line_14 = Line(Tree({0;0;0}: [Line((2341.906076, 1597.770349, 0), (2341.906076, 1597.591064, 0.7024242833)), Line((2341.906076, 1597.591064, 0.7024242833), (2341.906076, 1597.3963, 1.295921333)), Line((2341.906076, 1597.3963, 1.295921333), (2341.906076, 1597.176174, 1.775050501)), Line((2341.906076, 1597.176174, 1.775050501), (2341.906076, 1596.910334, 2.122230115)), Line((2341.906076, 1596.910334, 2.122230115), (2341.906076, 1596.570349, 2.270233273)), Line((2341.906076, 1596.570349, 2.270233273), (2341.906076, 1596.230365, 2.122230115))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], {0;1;0}: [Line((2343.956079, 1593.320355, 0), (2344.135364, 1593.320355, 0.7024242833)), Line((2344.135364, 1593.320355, 0.7024242833), (2344.330128, 1593.320355, 1.295921333)), Line((2344.330128, 1593.320355, 1.295921333), (2344.550254, 1593.320355, 1.775050501)), Line((2344.550254, 1593.320355, 1.775050501), (2344.816094, 1593.320355, 2.122230115)), Line((2344.816094, 1593.320355, 2.122230115), (2345.156079, 1593.320355, 2.270233273)), Line((2345.156079, 1593.320355, 2.270233273), (2345.496063, 1593.320355, 2.122230115))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], {0;2;0}: [Line((2348.406091, 1591.270355, 0), (2348.406091, 1591.091069, 0.7024242833)), Line((2348.406091, 1591.091069, 0.7024242833), (2348.406091, 1590.896305, 1.295921333)), Line((2348.406091, 1590.896305, 1.295921333), (2348.406091, 1590.67618, 1.775050501)), Line((2348.406091, 1590.67618, 1.775050501), (2348.406091, 1590.410339, 2.122230115)), Line((2348.406091, 1590.410339, 2.122230115), (2348.406091, 1590.070355, 2.270233273)), Line((2348.406091, 1590.070355, 2.270233273), (2348.406091, 1589.73037, 2.122230115))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], {0;3;0}: [Line((2354.906083, 1591.270355, 0), (2354.906083, 1591.091069, 0.7024242833)), Line((2354.906083, 1591.091069, 0.7024242833), (2354.906083, 1590.896305, 1.295921333)), Line((2354.906083, 1590.896305, 1.295921333), (2354.906083, 1590.67618, 1.775050501)), Line((2354.906083, 1590.67618, 1.775050501), (2354.906083, 1590.410339, 2.122230115)), Line((2354.906083, 1590.410339, 2.122230115), (2354.906083, 1590.070355, 2.270233273)), Line((2354.906083, 1590.070355, 2.270233273), (2354.906083, 1589.73037, 2.122230115))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], {0;4;0}: [Line((2361.15433, 1588.466307, 0), (2361.047333, 1588.360238, 0.664935159)), Line((2361.047333, 1588.360238, 0.664935159), (2360.931997, 1588.245901, 1.222414897)), Line((2360.931997, 1588.245901, 1.222414897), (2360.802748, 1588.117772, 1.668649036)), Line((2360.802748, 1588.117772, 1.668649036), (2360.64729, 1587.963661, 1.990680349)), Line((2360.64729, 1587.963661, 1.990680349), (2360.444153, 1587.762285, 2.130947112)), Line((2360.444153, 1587.762285, 2.130947112), (2360.241016, 1587.560908, 1.990680349))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]))
number_slider_6 = Slider(1.262, range=0..10)
list_item_12 = ListItem(List=divide_curve_7.Points, Index=1, Wrap=True)
move_3 = Move(Geometry=line_14, Motion=vector_2pt_4.Vector)  # -> Geometry, Transform
move_4 = Move(Geometry=line_14, Motion=vector_2pt_3.Vector)  # -> Geometry, Transform
scale = Scale(Geometry=move_3.Geometry, Center=list_item_12, Factor=number_slider_6)  # -> Geometry, Transform
scale_2 = Scale(Geometry=move_4.Geometry, Center=list_item_12, Factor=number_slider_6)  # -> Geometry, Transform
ruled_surface_3 = RuledSurface(CurveA=line_14, CurveB=scale.Geometry)  # -> flatten(Surface)
ruled_surface_4 = RuledSurface(CurveA=line_14, CurveB=scale_2.Geometry)  # -> flatten(Surface)
number_slider_7 = Slider(46, range=0..100)
brep_join_2 = BrepJoin(Breps=ruled_surface_3)  # -> Breps, Closed
brep_join_3 = BrepJoin(Breps=ruled_surface_4)  # -> Breps, Closed
brep_join_4 = BrepJoin(Breps=[brep_join_3.Breps, brep_join_2.Breps])  # -> Breps, Closed
settings_custom_3 = SettingsCustom(
    StitchSeams=True,
    SimplePlanes=False,
    Refine=True,
    MinCount=number_slider_7,
    MaxCount=number_slider_7,
    AspectRatio=20,
    MaxDistance=0,
    MaxAngle=20,
    MinEdge=0,
    MaxEdge=0)
mesh_brep_3 = MeshBrep(Brep=brep_join_4.Breps, Settings=settings_custom_3)
mesh_split = MeshSplit(Mesh=flatten(mesh), Splitters=[brep_join_3.Breps, brep_join_2.Breps])
area_2 = Area(Geometry=mesh_split)  # -> Area, Centroid
sort_list = SortList(Keys=area_2.Area, ValuesValuesA=mesh_split)  # -> Keys, reverse(ValuesValuesA)
mesh_split_2 = MeshSplit(Mesh=mesh_brep_3, Splitters=mesh)  # -> flatten(Result)
list_item_13 = ListItem(List=sort_list.ValuesValuesA, Index=0, Wrap=True)
list_item_14 = ListItem(
    List=mesh_split_2,
    Index=[Slider(10, range=0..15), Slider(1, range=0..15), Slider(4, range=0..15), Slider(13, range=0..15), Slider(7, range=0..15)],
    Wrap=True)
weaverbird_s_laplacian_smoothing = WeaverbirdsLaplacianSmoothing(MeshCurves=list_item_14, Level=Slider(5, range=0..20), SmoothNakedEdges=0, Thin=Slider(1, range=0..1))
mesh_2 = Mesh(flatten(list_item_13))
list_item_15 = ListItem(
    List=mesh_2,
    Index=[Slider(0, range=0..5), Slider(2, range=0..5), Slider(3, range=0..5), Slider(4, range=0..5), Slider(5, range=0..5)],
    Wrap=True)
list_item_16 = ListItem(List=mesh_2, Index=Slider(1, range=0..5), Wrap=True)
mesh_split_3 = MeshSplit(Mesh=list_item_15, Splitters=mesh_brep_2)  # -> flatten(Result)
area_3 = Area(Geometry=mesh_split_3)  # -> Area, Centroid
sort_list_2 = SortList(Keys=area_3.Area, ValuesValuesA=mesh_split_3)  # -> Keys, ValuesValuesA
series = Series(Start=0, Step=1, Count=Slider(5, range=0..10))
list_length = ListLength(List=sort_list_2.Keys)
expression_5 = Expression(X=list_length, N=series, Expression="(X-1)-N")
list_item_17 = ListItem(List=flatten(sort_list_2.ValuesValuesA), Index=expression_5, Wrap=True)
weaverbird_s_join_meshes_and_weld = WeaverbirdsJoinMeshesAndWeld(Mesh=flatten([weaverbird_s_laplacian_smoothing, list_item_17, list_item_16]), Weld=True)  # disabled
mesh_3 = Mesh(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)
# new one(problem mesh)
mesh_4 = Mesh(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)
mesh_5 = Mesh(flatten(mesh_3))
bbox = BoundingBox(Content=mesh_5, Plane=PlaneXY(0, 0, 0))  # -> Box, Box_2
debox = DeconstructBox(Box=bbox.Box)  # -> Plane, X, Y, Z
# already safety factor？
panel_3 = Panel("2")
panel_4 = Panel(debox.Z)
panel_5 = Panel("0.0024")

# ----
# live load
number_slider_8 = Slider(1.4, range=0..10)
# earthbag
panel_6 = Panel("-1.2")
multiplication_2 = Multiplication(A=Slider(-0.6, range=-1..1), B=number_slider_8)
Z = UnitZ(Factor=panel_6)
Z_2 = UnitZ(Factor=multiplication_2)
# from the fabric
# live load
loads = LoadsKaramba(Vector=Z, LCase="0", mode="Gravity")
loads_2 = LoadsKaramba(Vector=Z_2, Mesh=mesh_5, LCase="1", mode="MeshLoad -Const.", menu=[buttons(off, off, on), buttons(on, off)])

division_6 = Division(A="0.24", B=panel_3)
matprops = MaterialPropertiesKaramba(
    FamilyOfMaterial="earth bag",
    Name="earth bag",
    YoungsModulus_kN_cm2="2",
    InPlaneShearModulus_kN_cm2="0.77",
    TransverseShearModulus_kN_cm2="0.77",
    SpecificWeight_kN_m3="17",
    CoefficientOfThermalExpansion_1_C=1e-05,
    YieldStrength_kN_cm2=division_6,
    mode="Isotrop")
meshtoshell = MeshToShellKaramba(Mesh=mesh_5, Identifier="whole", LimitDistance_m=0.005)  # -> Element, Points, Info
cross_sections = CrossSectionsKaramba(FamilyNameOfCrossSection="DefaultCroSec", Material=matprops, Height_cm="50", mode="Shell - Const")
load = LoadKaramba([loads_2, loads])
cull_i = CullIndex(List=meshtoshell.Points, Indices=["4020", "3730"], Wrap=True)

# ---- group: reduce mesh point density with cull pattern
panel_7 = Panel("""0
0
0
0
0
1""")
cull = CullPattern(List=cull_i, CullPattern=panel_7)

# ----
demesh = DeconstructMesh(Mesh=mesh_5)  # -> Vertices, Faces, Colours, Normals
pdecon = Deconstruct(Point=demesh.Vertices)  # -> XComponent, YComponent, ZComponent
bnd = Bounds(Numbers=flatten(pdecon.ZComponent))
dedomain = DeconstructDomain(Domain=bnd)  # -> Start, End
equals = Equality(FirstNumber=pdecon.ZComponent, SecondNumber=dedomain.Start)  # -> Equality, Inequality
dispatch = Dispatch(List=demesh.Vertices, DispatchPattern=equals.Equality)  # -> ListA, ListB
cullpt = CullDuplicates(Points=dispatch.ListA, Tolerance=0.1, CullMode=3)  # -> flatten(Points), Indices, Valence

cps = ClosestPointsKaramba(Point=cullpt.Points, Cloud=demesh.Vertices, NumberOfNeighbors=1, LimitDistance="0.007")  # -> flatten(Points), Index, Distance
pt = Point(dispatch.ListA)
panel_8 = Panel(cps.Points)

supp = SupportKaramba(PosInd=flatten(cps.Points), menu=[buttons(on, on, on, on, on, on)])

assemble = AssembleModelKaramba(Points=cull_i, Elem=meshtoshell.Element, Support=supp, Load=load, CrossSection=cross_sections, LimitDistance_m=0.005)  # -> Model, Info, Mass_kg, CenterOfGravity
analyzethi = AnalyzeThIKaramba(Model=assemble.Model)  # -> CalculatedModel, MaximumDisplacement_m, ResultingForceOfGravity_kN, ElasticEnergy_kNm
num = Number(analyzethi.MaximumDisplacement_m)
panel_9 = Panel(num)
modelview = ModelViewKaramba(Model=analyzethi.CalculatedModel, LoadCaseFactorsForLinearSuperposition=1, IndexOfVisibleLoadcase=-1)  # -> Model, DeformedMesh, DeformedAxes, DeformedModel
shellview = ShellViewKaramba(Model=modelview.Model, IndexOfLayer=0)  # -> Model, MeshesOfRenderedShells, LegendColors, LegendTags
react = ReactionForcesKaramba(AnalyzedModel=modelview.Model, LoadCase=0)  # -> AnalyzedModel, ReactionForces_kN, ReactionMoments_kNm, SupportPosition, SumOfReactionForces_kN, SumOfReactionMoments_kNm
multiplication_3 = Multiplication(A=shellview.LegendTags, B="10")
s_forces = ShellForcesKaramba(AnalyzedModel=shellview.Model, LCase=0, mode="Principal")  # -> AnalyzedModel, FirstPrincipalNormalForce_kN_m, SecondPrincipalNormalForce_kN_m, FirstPrincipalMoment_kN, SecondPrincipalMoment_kN, ShearForceInLocalXDirection_kN_m, ShearForceInLocalYDirection_kN_m
legend = Legend(Colour=shellview.LegendColors, Tags=multiplication_3, LegendType=1)

series_2 = Series(Start=Slider(0, range=0..100), Step="1", Count=Slider(2, range=0..10))
nodedisp = NodalDisplacementsKaramba(AnalyzedModel=shellview.Model, LoadCase=series_2)  # -> AnalyzedModel, NodalTranslations_m, NodalRotations_rad
devec = DeconstructVector(Vector=nodedisp.NodalTranslations_m)  # -> XComponent, YComponent, ZComponent
project = Project(Geometry=nodedisp.NodalTranslations_m, Plane=PlaneXY(0, 0, 0))  # -> Geometry, Transform
vlen = VectorLength(Vector=project.Geometry)
abs = Absolute(Value=devec.ZComponent)
bnd_2 = Bounds(Numbers=abs)
bnd_3 = Bounds(Numbers=vlen)
dedomain_2 = DeconstructDomain(Domain=bnd_2)  # -> Start, End
dedomain_3 = DeconstructDomain(Domain=bnd_3)  # -> Start, End
panel_10 = Panel(dedomain_2.End)
panel_11 = Panel(dedomain_3.End)

shellvecresults = ResultVectorsOnShellsKaramba(AnalyzedModel=shellview.Model, LayerOfResults=0, mode="PrincStress")  # -> AnalyzedModel, Points, FirstPrincipalStressVector_kN_cm2, SecondPrincipalStressVector_kN_cm2, FirstPrincipalStressValue_kN_cm2, SecondPrincipalStressValue_kN_cm2
bnd_4 = Bounds(Numbers=[shellvecresults.FirstPrincipalStressValue_kN_cm2, shellvecresults.SecondPrincipalStressValue_kN_cm2])
num_2 = Number(shellvecresults.FirstPrincipalStressValue_kN_cm2)
larger = LargerThan(FirstNumber=num_2, SecondNumber="0")  # -> LargerThan, OrEqualTo
dedomain_4 = DeconstructDomain(Domain=bnd_4)  # -> Start, End
dispatch_2 = Dispatch(List=num_2, DispatchPattern=larger.LargerThan)  # -> ListA, ListB
panel_12 = Panel(dedomain_4.Start)
num_3 = Number(dispatch_2.ListA)
panel_13 = Panel(num_3)

# ---- group: map principal stress lines at each point
shelllineresults = LineResultsOnShellsKaramba(
    AnalyzedModel=analyzethi.CalculatedModel,
    Layer=0,
    ListOfSourcesOfPrincipalStressLinesLinesPoints=cull,
    SegmentLength_m=0.5,
    DA_deg=5,
    mode="PrincStress")  # -> AnalyzedModel, Lines1, Lines2

# ----
panel_14 = Panel(dedomain_4.End)

# ---- group: blue
rgb = ColourRGB(Alpha=255, Red=0, Green=0, Blue="250")
preview = CustomPreview(Geometry=shelllineresults.Lines1, Shader=rgb)

# ---- group: red
rgb_2 = ColourRGB(Alpha=255, Red="250", Green=0, Blue=0)
preview_2 = CustomPreview(Geometry=shelllineresults.Lines2, Shader=rgb_2)
