# Grasshopper definition 20.10_group 9 gh-earthbag-level 0.gh (Grasshopper 1.0.7)
# plug-ins: Karamba, Pufferfish, Kangaroo Components, Weaverbird, Kangaroo2 Components

# Doubleclick Me!
curve = Curve([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])
curve_2 = Curve(flatten(curve))

openings = Curve([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])
end_points = EndPoints(Curve=openings)  # -> Start, End

point_in_curve = PointInCurve(Point=end_points.Start, Curve=curve_2)  # -> Relationship, Point
point_in_curve_2 = PointInCurve(Point=end_points.End, Curve=curve_2)  # -> Relationship, Point
point = Point(point_in_curve_2.Point)
reference_anchor = Point(point_in_curve.Point)
line = Line(StartPoint=reference_anchor, EndPoint=point)
divide_curve = DivideCurve(Curve=line, Count=2, Kinks=False)  # -> Points, Tangents, Parameters
point_2 = Point(flatten(divide_curve.Points))
find_similar_member = FindSimilarMember(Data=[end_points.Start, end_points.End], Set=point_2)  # -> Hit, Index
midpoints = CullIndex(List=divide_curve.Points, Indices=find_similar_member.Index, Wrap=True)  # -> flatten(List)

boundary_surfaces = BoundarySurfaces(Edges=curve)
number_slider = Slider(247, range=0..500)
settings_custom = SettingsCustom(
    StitchSeams=True,
    SimplePlanes=False,
    Refine=True,
    MinCount=number_slider,
    MaxCount=number_slider,
    AspectRatio=Slider(17, range=0..100),
    MaxDistance=0,
    MaxAngle=20,
    MinEdge=0,
    MaxEdge=0)
mesh_brep = MeshBrep(Brep=boundary_surfaces, Settings=settings_custom)
area = Area(Geometry=mesh_brep)  # -> Area, Centroid
panel = Panel(area.Area)
multiplication = Multiplication(A=panel, B=Slider(28, range=0..720))
division = Division(A=multiplication, B=Slider(101, range=0..1000))
number_slider_2 = Slider(100, range=0..1000)
weaverbird_s_mesh_edges = WeaverbirdsMeshEdges(MeshOrPolylines=mesh_brep)
nakedvertices = NakedVertices(Mesh=mesh_brep)  # -> ClothedIndex, NakedIndex, ClothedPts, NakedPts
deconstruct_mesh = DeconstructMesh(Mesh=mesh_brep)  # -> Vertices, Faces, Colours, Normals
panel_2 = Panel(deconstruct_mesh.Vertices)
unit_z = UnitZ(Factor=division)
list_item = ListItem(List=deconstruct_mesh.Vertices, Index=nakedvertices.NakedIndex, Wrap=True)
springsfromline = SpringsFromLine(
    Connection=weaverbird_s_mesh_edges,
    Stiffness=Slider(78, range=0..1000),
    Damping=10,
    RestLength=weaverbird_s_mesh_edges,
    UpperCutoff=0,
    LowerCutoff=0,
    Plasticity=0)
unaryforce = UnaryForce(Point=deconstruct_mesh.Vertices, Force=unit_z)
timer = Timer(TimerInterval=20, Target=kangaroophysics)
kangaroophysics = KangarooPhysics(
    ForceObjects=flatten([unaryforce, springsfromline]),
    AnchorPoints=flatten(list_item),
    Settings=null,
    Geometry=mesh_brep,
    SimulationReset=Toggle(False))  # -> Out, Iterations, ParticlesOut, GeometryOut, KE; disabled

value_list = ValueList({"One": 1.2, "Two": 2.4, "Three": 3.6, "Four": 4.8}, selected="One")
value_list_2 = ValueList({"One": 1.2, "Two": 2.4, "Three": 3.6, "Four": 4.8}, selected="Two")
value_list_3 = ValueList({"One": 1.2, "Two": 2.4, "Three": 3.6, "Four": 4.8}, selected="Three")
value_list_4 = ValueList({"One": 1.2, "Two": 2.4, "Three": 3.6, "Four": 4.8}, selected="Four")
length = Length(Curve=line)
round_to_nearest = RoundToNearest(NumbersX=length, NumbersY=[value_list_2, value_list_3, value_list_4, value_list], RemapNumberX=False)  # -> Nearest, RemappedNumberX
expression = Expression(x=round_to_nearest.Nearest, y=value_list, Expression="If(x=y,True,False)")
expression_2 = Expression(x=round_to_nearest.Nearest, y=value_list_3, Expression="If(x=y,True,False)")
expression_3 = Expression(x=round_to_nearest.Nearest, y=value_list_2, Expression="If(x=y,True,False)")
expression_4 = Expression(x=round_to_nearest.Nearest, y=value_list_4, Expression="If(x=y,True,False)")

mesh = Mesh(simplify([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]))

cull_pattern = CullPattern(List=midpoints, CullPattern=expression)
cull_pattern_2 = CullPattern(List=midpoints, CullPattern=expression_3)
cull_pattern_3 = CullPattern(List=midpoints, CullPattern=expression_2)
cull_pattern_4 = CullPattern(List=midpoints, CullPattern=expression_4)
cull_pattern_5 = CullPattern(List=line, CullPattern=expression)
cull_pattern_6 = CullPattern(List=line, CullPattern=expression_4)
cull_pattern_7 = CullPattern(List=line, CullPattern=expression_2)
cull_pattern_8 = CullPattern(List=line, CullPattern=expression_3)

division_2 = Division(A=Slider(2.4, range=2.4..3.6), B=2)
circle_cnr = CircleCNR(Center=cull_pattern_3, Normal=Vector(0, 0, 1), Radius=division_2)
line_2 = Line(cull_pattern_7)
surface = Surface(circle_cnr)
surface_curve = SurfaceCurve(Surface=surface, Curve=line_2)  # -> Curves, Points, UVPoints, Normals, Parameters, Tangents
line_3 = Line(surface_curve.Curves)

number_slider_3 = Slider(3.6, range=2.4..3.6)

division_3 = Division(A=Slider(1.2, range=1.2..2.4), B=2)
circle_cnr_2 = CircleCNR(Center=cull_pattern_2, Normal=Vector(0, 0, 1), Radius=division_3)
line_4 = Line(cull_pattern_8)
surface_2 = Surface(circle_cnr_2)
surface_curve_2 = SurfaceCurve(Surface=surface_2, Curve=line_4)  # -> Curves, Points, UVPoints, Normals, Parameters, Tangents
line_5 = Line(surface_curve_2.Curves)

division_4 = Division(A=Slider(1, range=0.8..1.2), B=2)
circle_cnr_3 = CircleCNR(Center=cull_pattern, Normal=Vector(0, 0, 1), Radius=division_4)
line_6 = Line(cull_pattern_5)
surface_3 = Surface(circle_cnr_3)
surface_curve_3 = SurfaceCurve(Surface=surface_3, Curve=line_6)  # -> Curves, Points, UVPoints, Normals, Parameters, Tangents
line_7 = Line(surface_curve_3.Curves)

division_5 = Division(A=Slider(4.5, range=3.6..4.8), B=2)
circle_cnr_4 = CircleCNR(Center=cull_pattern_4, Normal=Vector(0, 0, 1), Radius=division_5)
line_8 = Line(cull_pattern_6)
surface_4 = Surface(circle_cnr_4)
surface_curve_4 = SurfaceCurve(Surface=surface_4, Curve=line_8)  # -> Curves, Points, UVPoints, Normals, Parameters, Tangents
line_9 = Line(surface_curve_4.Curves)

number_slider_4 = Slider(2.4, range=1.2..2.4)
number_slider_5 = Slider(4.8, range=3.6..4.8)

curve_3 = Curve(graft([line_9, line_3, line_5, line_7]))
divide_curve_2 = DivideCurve(Curve=curve_3, Count=10, Kinks=False)  # -> Points, Tangents, Parameters
unit_z_2 = UnitZ(Factor=Slider(78, range=0..100))
shatter = Shatter(Curve=curve_3, Parameters=divide_curve_2.Parameters)
point_3 = Point(divide_curve_2.Points)
unaryforce_2 = UnaryForce(Point=point_3, Force=unit_z_2)
list_item_2 = ListItem(List=divide_curve_2.Points, Index=[0, 10], Wrap=True)
line_10 = Line(shatter)
timer_2 = Timer(TimerInterval=20, Target=kangaroophysics_2)
springsfromline_2 = SpringsFromLine(
    Connection=line_10,
    Stiffness=Slider(922, range=0..1000),
    Damping=10,
    RestLength=line_10,
    UpperCutoff=0,
    LowerCutoff=0,
    Plasticity=0)
kangaroophysics_2 = KangarooPhysics(
    ForceObjects=flatten([springsfromline_2, unaryforce_2]),
    AnchorPoints=flatten(list_item_2),
    Settings=null,
    Geometry=line_10,
    SimulationReset=Toggle(False))  # -> Out, Iterations, ParticlesOut, GeometryOut, KE; disabled
line_11 = Line(Tree({0;0;0;0;0}: [Line((2342.556097, 1569.270363, 0), (2342.556097, 1569.090215, 0.6295745076)), Line((2342.556097, 1569.090215, 0.6295745076), (2342.556098, 1568.894198, 1.167671153)), Line((2342.556098, 1568.894198, 1.167671153), (2342.556099, 1568.672545, 1.606748612)), Line((2342.556099, 1568.672545, 1.606748612), (2342.5561, 1568.4057, 1.926901183)), Line((2342.5561, 1568.4057, 1.926901183), (2342.556101, 1568.070363, 2.062637614)), Line((2342.556101, 1568.070363, 2.062637614), (2342.556102, 1567.735026, 1.926901183))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], {0;0;0;1;0}: [Line((2348.134759, 1573.970332, 0), (2348.134761, 1574.062949, 0.5208495045)), Line((2348.134761, 1574.062949, 0.5208495045), (2348.134762, 1574.161158, 0.9538532674)), Line((2348.134762, 1574.161158, 0.9538532674), (2348.134764, 1574.269069, 1.295592157)), Line((2348.134764, 1574.269069, 1.295592157), (2348.134766, 1574.396792, 1.538911575)), Line((2348.134766, 1574.396792, 1.538911575), (2348.134769, 1574.570332, 1.648968032)), Line((2348.134769, 1574.570332, 1.648968032), (2348.134772, 1574.743872, 1.538911575))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], {0;0;1;0;0}: [Line((2342.556086, 1575.770368, 0), (2342.556087, 1575.59022, 0.6295745076)), Line((2342.556087, 1575.59022, 0.6295745076), (2342.556088, 1575.394202, 1.167671153)), Line((2342.556088, 1575.394202, 1.167671153), (2342.556089, 1575.17255, 1.606748612)), Line((2342.556089, 1575.17255, 1.606748612), (2342.556091, 1574.905705, 1.926901183)), Line((2342.556091, 1574.905705, 1.926901183), (2342.556092, 1574.570368, 2.062637614)), Line((2342.556092, 1574.570368, 2.062637614), (2342.556094, 1574.235031, 1.926901183))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], {0;0;1;1;0}: [Line((2352.256058, 1571.049047, 0), (2352.163442, 1571.049047, 0.5208495045)), Line((2352.163442, 1571.049047, 0.5208495045), (2352.065232, 1571.049046, 0.9538532674)), Line((2352.065232, 1571.049046, 0.9538532674), (2351.957321, 1571.049046, 1.295592157)), Line((2351.957321, 1571.049046, 1.295592157), (2351.829598, 1571.049045, 1.538911575)), Line((2351.829598, 1571.049045, 1.538911575), (2351.656058, 1571.049045, 1.648968032)), Line((2351.656058, 1571.049045, 1.648968032), (2351.482519, 1571.049044, 1.538911575))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], {0;0;2;0;0}: [Line((2357.506115, 1571.034061, 0), (2357.42215, 1570.996386, 0.52095087)), Line((2357.42215, 1570.996386, 0.52095087), (2357.33276, 1570.95676, 0.9540534433)), Line((2357.33276, 1570.95676, 0.9540534433), (2357.234087, 1570.913737, 1.295823504)), Line((2357.234087, 1570.913737, 1.295823504), (2357.116756, 1570.861879, 1.538994768)), Line((2357.116756, 1570.861879, 1.538994768), (2356.957032, 1570.792176, 1.648565855)), Line((2356.957032, 1570.792176, 1.648565855), (2356.797308, 1570.722474, 1.538994768))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], {0;0;3;0;0}: [Line((2360.489335, 1575.106637, 0), (2360.435624, 1575.032638, 0.5210553468)), Line((2360.435624, 1575.032638, 0.5210553468), (2360.3784, 1574.953692, 0.9542133509)), Line((2360.3784, 1574.953692, 0.9542133509), (2360.315314, 1574.866263, 1.295964324)), Line((2360.315314, 1574.866263, 1.295964324), (2360.239771, 1574.762232, 1.538978687)), Line((2360.239771, 1574.762232, 1.538978687), (2360.137251, 1574.620801, 1.648304068)), Line((2360.137251, 1574.620801, 1.648304068), (2360.034731, 1574.479369, 1.538978687))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], {0;0;4;0;0}: [Line((2364.558307, 1575.206526, 0), (2364.478628, 1575.251954, 0.5210049797)), Line((2364.478628, 1575.251954, 0.5210049797), (2364.3937, 1575.300106, 0.9541388025)), Line((2364.3937, 1575.300106, 0.9541388025), (2364.299776, 1575.352797, 1.29590524)), Line((2364.299776, 1575.352797, 1.29590524), (2364.188058, 1575.416159, 1.538993514)), Line((2364.188058, 1575.416159, 1.538993514), (2364.036048, 1575.5019, 1.648415121)), Line((2364.036048, 1575.5019, 1.648415121), (2363.884038, 1575.587642, 1.538993514))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], {0;0;5;0;0}: [Line((2357.556056, 1565.091706, 0), (2357.648672, 1565.091706, 0.5208495045)), Line((2357.648672, 1565.091706, 0.5208495045), (2357.746882, 1565.091706, 0.9538532674)), Line((2357.746882, 1565.091706, 0.9538532674), (2357.854793, 1565.091706, 1.295592157)), Line((2357.854793, 1565.091706, 1.295592157), (2357.982516, 1565.091706, 1.538911575)), Line((2357.982516, 1565.091706, 1.538911575), (2358.156056, 1565.091706, 1.648968032)), Line((2358.156056, 1565.091706, 1.648968032), (2358.329596, 1565.091706, 1.538911575))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], {0;0;6;0;0}: [Line((2351.056058, 1565.091704, 0), (2351.148675, 1565.091703, 0.5208495045)), Line((2351.148675, 1565.091703, 0.5208495045), (2351.246885, 1565.091703, 0.9538532674)), Line((2351.246885, 1565.091703, 0.9538532674), (2351.354795, 1565.091702, 1.295592157)), Line((2351.354795, 1565.091702, 1.295592157), (2351.482519, 1565.091702, 1.538911575)), Line((2351.482519, 1565.091702, 1.538911575), (2351.656058, 1565.091701, 1.648968032)), Line((2351.656058, 1565.091701, 1.648968032), (2351.829598, 1565.0917, 1.538911575))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]))
join_curves = JoinCurves(Curves=[line_11, curve_3], Preserve=False)

line_12 = Line([Line((2343.956102, 1571.320375, 0), (2346.356102, 1571.320369, 0)), Line((2348.406088, 1566.870366, 0), (2348.406087, 1569.270366, 0)), Line((2354.906088, 1566.870366, 0), (2354.906083, 1569.270366, 0)), Line((2361.238038, 1569.661689, 0), (2359.467179, 1571.281583, 0))])
curve_4 = Curve(graft(line_12))
divide_curve_3 = DivideCurve(Curve=curve_4, Count=2, Kinks=False)  # -> Points, Tangents, Parameters
divide_curve_4 = DivideCurve(Curve=curve_4, Count=10, Kinks=False)  # -> Points, Tangents, Parameters

offset = Offset(Curve=curve_3, Distance=-1, Plane=PlaneXY(0, 0, 0), Corners=1)
divide_curve_5 = DivideCurve(Curve=curve_3, Count=2, Kinks=False)  # -> Points, Tangents, Parameters
divide_curve_6 = DivideCurve(Curve=offset, Count=2, Kinks=False)  # -> Points, Tangents, Parameters
list_item_3 = ListItem(List=divide_curve_6.Points, Index=1, Wrap=True)
list_item_4 = ListItem(List=divide_curve_5.Points, Index=1, Wrap=True)
vector_2pt = Vector2Pt(PointA=list_item_4, PointB=list_item_3, Unitize=False)  # -> Vector, Length
move = Move(Geometry=join_curves, Motion=vector_2pt.Vector)  # -> Geometry, Transform

offset_2 = Offset(Curve=curve_3, Distance=1, Plane=PlaneXY(0, 0, 0), Corners=1)
divide_curve_7 = DivideCurve(Curve=curve_3, Count=2, Kinks=False)  # -> Points, Tangents, Parameters
divide_curve_8 = DivideCurve(Curve=offset_2, Count=2, Kinks=False)  # -> Points, Tangents, Parameters
list_item_5 = ListItem(List=divide_curve_8.Points, Index=1, Wrap=True)
list_item_6 = ListItem(List=divide_curve_7.Points, Index=1, Wrap=True)
vector_2pt_2 = Vector2Pt(PointA=list_item_6, PointB=list_item_5, Unitize=False)  # -> Vector, Length
move_2 = Move(Geometry=join_curves, Motion=vector_2pt_2.Vector)  # -> Geometry, Transform

shatter_2 = Shatter(Curve=curve_4, Parameters=divide_curve_4.Parameters)
offset_3 = Offset(Curve=curve_4, Distance=-1.2, Plane=PlaneXY(0, 0, 0), Corners=1)
offset_4 = Offset(Curve=curve_4, Distance=1.2, Plane=PlaneXY(0, 0, 0), Corners=1)
unit_z_3 = UnitZ(Factor=Slider(78, range=0..100))
point_4 = Point(divide_curve_4.Points)
divide_curve_9 = DivideCurve(Curve=curve_4, Count=2, Kinks=False)  # -> Points, Tangents, Parameters
divide_curve_10 = DivideCurve(Curve=curve_4, Count=2, Kinks=False)  # -> Points, Tangents, Parameters
list_item_7 = ListItem(List=divide_curve_4.Points, Index=[0, 10], Wrap=True)
divide_curve_11 = DivideCurve(Curve=offset_3, Count=2, Kinks=False)  # -> Points, Tangents, Parameters
divide_curve_12 = DivideCurve(Curve=offset_4, Count=2, Kinks=False)  # -> Points, Tangents, Parameters
line_13 = Line(shatter_2)
unaryforce_3 = UnaryForce(Point=point_4, Force=unit_z_3)
list_item_8 = ListItem(List=divide_curve_9.Points, Index=1, Wrap=True)
list_item_9 = ListItem(List=divide_curve_10.Points, Index=1, Wrap=True)
list_item_10 = ListItem(List=divide_curve_11.Points, Index=1, Wrap=True)
list_item_11 = ListItem(List=divide_curve_12.Points, Index=1, Wrap=True)
timer_3 = Timer(TimerInterval=20, Target=kangaroophysics_3)
springsfromline_3 = SpringsFromLine(
    Connection=line_13,
    Stiffness=Slider(835, range=0..1000),
    Damping=10,
    RestLength=line_13,
    UpperCutoff=0,
    LowerCutoff=0,
    Plasticity=0)
vector_2pt_3 = Vector2Pt(PointA=list_item_8, PointB=list_item_10, Unitize=False)  # -> Vector, Length
vector_2pt_4 = Vector2Pt(PointA=list_item_9, PointB=list_item_11, Unitize=False)  # -> Vector, Length
kangaroophysics_3 = KangarooPhysics(
    ForceObjects=flatten([springsfromline_3, unaryforce_3]),
    AnchorPoints=flatten(list_item_7),
    Settings=null,
    Geometry=line_13,
    SimulationReset=Toggle(False))  # -> Out, Iterations, ParticlesOut, GeometryOut, KE; disabled
line_14 = Line(Tree({0;0;0}: [Line((2343.956102, 1571.320375, 0), (2344.133732, 1571.320374, 0.5918802409)), Line((2344.133732, 1571.320374, 0.5918802409), (2344.330303, 1571.320374, 1.089528593)), Line((2344.330303, 1571.320374, 1.089528593), (2344.555368, 1571.320373, 1.490941517)), Line((2344.555368, 1571.320373, 1.490941517), (2344.825683, 1571.320373, 1.780296293)), Line((2344.825683, 1571.320373, 1.780296293), (2345.156102, 1571.320372, 1.900704145)), Line((2345.156102, 1571.320372, 1.900704145), (2345.486522, 1571.320371, 1.780296293))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], {0;1;0}: [Line((2348.406088, 1566.870366, 0), (2348.406088, 1567.047995, 0.5918802409)), Line((2348.406088, 1567.047995, 0.5918802409), (2348.406088, 1567.244566, 1.089528593)), Line((2348.406088, 1567.244566, 1.089528593), (2348.406088, 1567.469631, 1.490941517)), Line((2348.406088, 1567.469631, 1.490941517), (2348.406088, 1567.739946, 1.780296293)), Line((2348.406088, 1567.739946, 1.780296293), (2348.406087, 1568.070366, 1.900704145)), Line((2348.406087, 1568.070366, 1.900704145), (2348.406087, 1568.400785, 1.780296293))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], {0;2;0}: [Line((2354.906088, 1566.870366, 0), (2354.906088, 1567.047995, 0.5918802409)), Line((2354.906088, 1567.047995, 0.5918802409), (2354.906087, 1567.244566, 1.089528593)), Line((2354.906087, 1567.244566, 1.089528593), (2354.906087, 1567.469631, 1.490941517)), Line((2354.906087, 1567.469631, 1.490941517), (2354.906086, 1567.739946, 1.780296293)), Line((2354.906086, 1567.739946, 1.780296293), (2354.906085, 1568.070366, 1.900704145)), Line((2354.906085, 1568.070366, 1.900704145), (2354.906085, 1568.400785, 1.780296293))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], {0;3;0}: [Line((2361.238038, 1569.661689, 0), (2361.10401, 1569.784321, 0.5900620317)), Line((2361.10401, 1569.784321, 0.5900620317), (2360.956723, 1569.918962, 1.08645322)), Line((2360.956723, 1569.918962, 1.08645322), (2360.790395, 1570.071051, 1.487924232)), Line((2360.790395, 1570.071051, 1.487924232), (2360.593539, 1570.251014, 1.780380442)), Line((2360.593539, 1570.251014, 1.780380442), (2360.352608, 1570.471636, 1.905591028)), Line((2360.352608, 1570.471636, 1.905591028), (2360.111678, 1570.692259, 1.780380442))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]))
number_slider_6 = Slider(1.251, range=0..10)
list_item_12 = ListItem(List=divide_curve_3.Points, Index=1, Wrap=True)

ruled_surface = RuledSurface(CurveA=join_curves, CurveB=move.Geometry)  # -> flatten(Surface)
ruled_surface_2 = RuledSurface(CurveA=join_curves, CurveB=move_2.Geometry)  # -> flatten(Surface)
brep_join = BrepJoin(Breps=[ruled_surface, ruled_surface_2])  # -> Breps, Closed
settings_custom_2 = SettingsCustom(
    StitchSeams=True,
    SimplePlanes=False,
    Refine=True,
    MinCount=16,
    MaxCount=400,
    AspectRatio=20,
    MaxDistance=0,
    MaxAngle=20,
    MinEdge=0,
    MaxEdge=0)
mesh_brep_2 = MeshBrep(Brep=brep_join.Breps, Settings=settings_custom_2)  # -> flatten(Mesh)

move_3 = Move(Geometry=line_14, Motion=vector_2pt_4.Vector)  # -> Geometry, Transform
move_4 = Move(Geometry=line_14, Motion=vector_2pt_3.Vector)  # -> Geometry, Transform
scale = Scale(Geometry=move_3.Geometry, Center=list_item_12, Factor=number_slider_6)  # -> Geometry, Transform
scale_2 = Scale(Geometry=move_4.Geometry, Center=list_item_12, Factor=number_slider_6)  # -> Geometry, Transform
ruled_surface_3 = RuledSurface(CurveA=line_14, CurveB=scale.Geometry)  # -> flatten(Surface)
ruled_surface_4 = RuledSurface(CurveA=line_14, CurveB=scale_2.Geometry)  # -> flatten(Surface)
number_slider_7 = Slider(46, range=0..100)
brep_join_2 = BrepJoin(Breps=ruled_surface_3)  # -> Breps, Closed
brep_join_3 = BrepJoin(Breps=ruled_surface_4)  # -> Breps, Closed
brep_join_4 = BrepJoin(Breps=[brep_join_3.Breps, brep_join_2.Breps])  # -> Breps, Closed
settings_custom_3 = SettingsCustom(
    StitchSeams=True,
    SimplePlanes=False,
    Refine=True,
    MinCount=number_slider_7,
    MaxCount=number_slider_7,
    AspectRatio=20,
    MaxDistance=0,
    MaxAngle=20,
    MinEdge=0,
    MaxEdge=0)
mesh_brep_3 = MeshBrep(Brep=brep_join_4.Breps, Settings=settings_custom_3)
mesh_split = MeshSplit(Mesh=flatten(mesh), Splitters=[brep_join_3.Breps, brep_join_2.Breps])
area_2 = Area(Geometry=mesh_split)  # -> Area, Centroid
sort_list = SortList(Keys=area_2.Area, ValuesValuesA=mesh_split)  # -> Keys, reverse(ValuesValuesA)
mesh_split_2 = MeshSplit(Mesh=mesh_brep_3, Splitters=mesh)  # -> flatten(Result)
list_item_13 = ListItem(List=sort_list.ValuesValuesA, Index=0, Wrap=True)
list_item_14 = ListItem(
    List=mesh_split_2,
    Index=[Slider(1, range=0..12), Slider(4, range=0..12), Slider(7, range=0..12), Slider(10, range=0..12)],
    Wrap=True)
weaverbird_s_laplacian_smoothing = WeaverbirdsLaplacianSmoothing(MeshCurves=list_item_14, Level=Slider(5, range=0..20), SmoothNakedEdges=0, Thin=Slider(1, range=0..1))
mesh_2 = Mesh(flatten(list_item_13))
mesh_split_3 = MeshSplit(Mesh=mesh_2, Splitters=mesh_brep_2)  # -> flatten(Result)
area_3 = Area(Geometry=mesh_split_3)  # -> Area, Centroid
sort_list_2 = SortList(Keys=area_3.Area, ValuesValuesA=mesh_split_3)  # -> Keys, ValuesValuesA
series = Series(Start=0, Step=1, Count=Slider(5, range=0..10))
list_length = ListLength(List=sort_list_2.Keys)
expression_5 = Expression(X=list_length, N=series, Expression="(X-1)-N")
list_item_15 = ListItem(List=flatten(sort_list_2.ValuesValuesA), Index=expression_5, Wrap=True)
weaverbird_s_join_meshes_and_weld = WeaverbirdsJoinMeshesAndWeld(Mesh=flatten([weaverbird_s_laplacian_smoothing, list_item_15]), Weld=True)
# new one
mesh_3 = Mesh(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)
mesh_4 = Mesh(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)
# Mesh input
mesh_5 = Mesh(flatten(mesh_4))

demesh = DeconstructMesh(Mesh=mesh_5)  # -> Vertices, Faces, Colours, Normals
pdecon = Deconstruct(Point=demesh.Vertices)  # -> XComponent, YComponent, ZComponent
bnd = Bounds(Numbers=flatten(pdecon.ZComponent))
dedomain = DeconstructDomain(Domain=bnd)  # -> Start, End
equals = Equality(FirstNumber=pdecon.ZComponent, SecondNumber=dedomain.Start)  # -> Equality, Inequality
dispatch = Dispatch(List=demesh.Vertices, DispatchPattern=equals.Equality)  # -> ListA, ListB
cullpt = CullDuplicates(Points=dispatch.ListA, Tolerance=0.1, CullMode=3)  # -> flatten(Points), Indices, Valence
cps = ClosestPointsKaramba(Point=cullpt.Points, Cloud=demesh.Vertices, NumberOfNeighbors=1, LimitDistance="0.008")  # -> flatten(Points), Index, Distance
pt = Point(dispatch.ListA)
# Support
supp = SupportKaramba(PosInd=flatten(cps.Points), menu=[buttons(on, on, on, on, on, on)])

bbox = BoundingBox(Content=mesh_5, Plane=PlaneXY(0, 0, 0))  # -> Box, Box_2
debox = DeconstructBox(Box=bbox.Box)  # -> Plane, X, Y, Z
# Height
panel_3 = Panel(debox.Z)

# ----
# Material
division_6 = Division(A="0.24", B="1.5")
matprops = MaterialPropertiesKaramba(
    FamilyOfMaterial="earth bag",
    Name="earth bag",
    YoungsModulus_kN_cm2="2",
    InPlaneShearModulus_kN_cm2="0.77",
    TransverseShearModulus_kN_cm2="0.77",
    SpecificWeight_kN_m3="17",
    CoefficientOfThermalExpansion_1_C=1e-05,
    YieldStrength_kN_cm2=division_6,
    mode="Isotrop")

# ----
# Load
# live load
number_slider_8 = Slider(1.4, range=0..10)
multiplication_2 = Multiplication(A=Slider(-0.6, range=-1..1), B=number_slider_8)
Z = UnitZ(Factor="-1.2")
Z_2 = UnitZ(Factor=multiplication_2)
loads = LoadsKaramba(Vector=Z, LCase="0", mode="Gravity")
loads_2 = LoadsKaramba(Vector=Z_2, Mesh=mesh_5, LCase="1", mode="MeshLoad -Const.", menu=[buttons(off, off, on), buttons(on, off)])

# ----
# Cross section
panel_4 = Panel("50")
cross_sections = CrossSectionsKaramba(FamilyNameOfCrossSection="DefaultCroSec", Material=matprops, Height_cm=panel_4, mode="Shell - Const")

meshtoshell = MeshToShellKaramba(Mesh=mesh_5, Identifier="whole", LimitDistance_m=0.005)  # -> Element, Points, Info
load = LoadKaramba([loads_2, loads])
# Assembly
assemble = AssembleModelKaramba(
    Points=meshtoshell.Points,
    Elem=meshtoshell.Element,
    Support=supp,
    Load=load,
    CrossSection=cross_sections,
    LimitDistance_m=0.005)  # -> Model, Info, Mass_kg, CenterOfGravity
# Analysis
analyzethi = AnalyzeThIKaramba(Model=assemble.Model)  # -> CalculatedModel, MaximumDisplacement_m, ResultingForceOfGravity_kN, ElasticEnergy_kNm
# Display
modelview = ModelViewKaramba(Model=analyzethi.CalculatedModel, LoadCaseFactorsForLinearSuperposition=1, IndexOfVisibleLoadcase=-1)  # -> Model, DeformedMesh, DeformedAxes, DeformedModel
shellview = ShellViewKaramba(Model=modelview.Model, IndexOfLayer=0)  # -> Model, MeshesOfRenderedShells, LegendColors, LegendTags
# Support reaction
react = ReactionForcesKaramba(AnalyzedModel=modelview.Model, LoadCase=0)  # -> AnalyzedModel, ReactionForces_kN, ReactionMoments_kNm, SupportPosition, SumOfReactionForces_kN, SumOfReactionMoments_kNm
multiplication_3 = Multiplication(A=shellview.LegendTags, B="10")
s_forces = ShellForcesKaramba(AnalyzedModel=shellview.Model, LCase=0, mode="Principal")  # -> AnalyzedModel, FirstPrincipalNormalForce_kN_m, SecondPrincipalNormalForce_kN_m, FirstPrincipalMoment_kN, SecondPrincipalMoment_kN, ShearForceInLocalXDirection_kN_m, ShearForceInLocalYDirection_kN_m
legend = Legend(Colour=shellview.LegendColors, Tags=multiplication_3, LegendType=1)

# ----
# Maximum defomation
number_slider_9 = Slider(0, range=0..100)
series_2 = Series(Start=number_slider_9, Step="1", Count=Slider(2, range=0..10))
nodedisp = NodalDisplacementsKaramba(AnalyzedModel=shellview.Model, LoadCase=series_2)  # -> AnalyzedModel, NodalTranslations_m, NodalRotations_rad
devec = DeconstructVector(Vector=nodedisp.NodalTranslations_m)  # -> XComponent, YComponent, ZComponent
project = Project(Geometry=nodedisp.NodalTranslations_m, Plane=PlaneXY(0, 0, 0))  # -> Geometry, Transform
vlen = VectorLength(Vector=project.Geometry)
abs = Absolute(Value=devec.ZComponent)
bnd_2 = Bounds(Numbers=abs)
bnd_3 = Bounds(Numbers=vlen)
dedomain_2 = DeconstructDomain(Domain=bnd_2)  # -> Start, End
dedomain_3 = DeconstructDomain(Domain=bnd_3)  # -> Start, End
panel_5 = Panel(dedomain_2.End)
panel_6 = Panel(dedomain_3.End)

# ----
# Maximum stress
shellvecresults = ResultVectorsOnShellsKaramba(AnalyzedModel=shellview.Model, LayerOfResults=0, mode="PrincStress")  # -> AnalyzedModel, Points, FirstPrincipalStressVector_kN_cm2, SecondPrincipalStressVector_kN_cm2, FirstPrincipalStressValue_kN_cm2, SecondPrincipalStressValue_kN_cm2
bnd_4 = Bounds(Numbers=[shellvecresults.FirstPrincipalStressValue_kN_cm2, shellvecresults.SecondPrincipalStressValue_kN_cm2])
num = Number(shellvecresults.FirstPrincipalStressValue_kN_cm2)
larger = LargerThan(FirstNumber=num, SecondNumber="0")  # -> LargerThan, OrEqualTo
dedomain_4 = DeconstructDomain(Domain=bnd_4)  # -> Start, End
dispatch_2 = Dispatch(List=num, DispatchPattern=larger.LargerThan)  # -> ListA, ListB
panel_7 = Panel(dedomain_4.Start)
num_2 = Number(dispatch_2.ListA)
panel_8 = Panel(num_2)

# ---- group: reduce mesh point density with cull pattern
# Stress line
panel_9 = Panel("""0
0
0
0
0
1""")
cull = CullPattern(List=meshtoshell.Points, CullPattern=panel_9)

# ---- group: map principal stress lines at each point
shelllineresults = LineResultsOnShellsKaramba(
    AnalyzedModel=analyzethi.CalculatedModel,
    Layer=0,
    ListOfSourcesOfPrincipalStressLinesLinesPoints=cull,
    SegmentLength_m=0.5,
    DA_deg=5,
    mode="PrincStress")  # -> AnalyzedModel, Lines1, Lines2

# ----
panel_10 = Panel(dedomain_4.End)

# ---- group: blue
rgb = ColourRGB(Alpha=255, Red=0, Green=0, Blue="250")
preview = CustomPreview(Geometry=shelllineresults.Lines1, Shader=rgb)

# ---- group: red
rgb_2 = ColourRGB(Alpha=255, Red="250", Green=0, Blue=0)
preview_2 = CustomPreview(Geometry=shelllineresults.Lines2, Shader=rgb_2)
