# Grasshopper definition 21.10_group 13 gh-earthbag-level 0.gh (Grasshopper 1.0.7)
# plug-ins: Karamba

# Doubleclick Me!
mesh = Mesh(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)
mesh_2 = Mesh(flatten(mesh))
bbox = BoundingBox(Content=mesh_2, Plane=PlaneXY(0, 0, 0))  # -> Box, Box_2
debox = DeconstructBox(Box=bbox.Box)  # -> Plane, X, Y, Z
# already safety factor？
panel = Panel("0.24")
panel_2 = Panel("0.0024")
panel_3 = Panel(debox.Z)

# ----
# from the fabric
# live load
number_slider = Slider(1.4, range=0..10)
# earthbag
panel_4 = Panel("-1.2")
pt = Point()  # disabled
vec = Vector()  # disabled
multiplication = Multiplication(A=Slider(-0.6, range=-1..1), B=number_slider)
Z = UnitZ(Factor=panel_4)
panel_5 = Panel("1")  # disabled
vlen = VectorLength(Vector=vec)  # disabled
Z_2 = UnitZ(Factor=multiplication)
rev = Reverse(Vector=vec)  # disabled
bnd = Bounds(Numbers=vlen)  # disabled
loads = LoadsKaramba(ForceVector=rev, Local=False, PosInd=pt, LCase=panel_5, mode="Point")  # -> flatten(Load); disabled
loads_2 = LoadsKaramba(Vector=Z, LCase="0", mode="Gravity")
loads_3 = LoadsKaramba(Vector=Z_2, Mesh=mesh_2, LCase="1", mode="MeshLoad -Const.", menu=[buttons(off, off, on), buttons(on, off)])
dedomain = DeconstructDomain(Domain=bnd)  # -> Start, End; disabled

division = Division(A=panel, B="2")
matprops = MaterialPropertiesKaramba(
    FamilyOfMaterial="earth bag",
    Name="earth bag",
    YoungsModulus_kN_cm2="2",
    InPlaneShearModulus_kN_cm2="0.77",
    TransverseShearModulus_kN_cm2="0.77",
    SpecificWeight_kN_m3="17",
    CoefficientOfThermalExpansion_1_C=1e-05,
    YieldStrength_kN_cm2=division,
    mode="Isotrop")
meshtoshell = MeshToShellKaramba(Mesh=mesh_2, Identifier="whole", LimitDistance_m=0.005)  # -> Element, Points, Info
cross_sections = CrossSectionsKaramba(FamilyNameOfCrossSection="DefaultCroSec", Material=matprops, Height_cm="50", mode="Shell - Const")
load = LoadKaramba([loads_3, loads_2])
cull_i = CullIndex(List=meshtoshell.Points, Indices=["4020", "3730"], Wrap=True)

# ---- group: reduce mesh point density with cull pattern
panel_6 = Panel("""0
0
0
0
0
1""")
cull = CullPattern(List=meshtoshell.Points, CullPattern=panel_6)

# ----
demesh = DeconstructMesh(Mesh=mesh_2)  # -> Vertices, Faces, Colours, Normals
pdecon = Deconstruct(Point=demesh.Vertices)  # -> XComponent, YComponent, ZComponent
bnd_2 = Bounds(Numbers=flatten(pdecon.ZComponent))
dedomain_2 = DeconstructDomain(Domain=bnd_2)  # -> Start, End
equals = Equality(FirstNumber=pdecon.ZComponent, SecondNumber=dedomain_2.Start)  # -> Equality, Inequality
dispatch = Dispatch(List=demesh.Vertices, DispatchPattern=equals.Equality)  # -> ListA, ListB
cullpt = CullDuplicates(Points=dispatch.ListA, Tolerance=0.1, CullMode=3)  # -> flatten(Points), Indices, Valence

cps = ClosestPointsKaramba(Point=cullpt.Points, Cloud=demesh.Vertices, NumberOfNeighbors=1, LimitDistance=-1)  # -> flatten(Points), Index, Distance
pt_2 = Point(dispatch.ListA)
panel_8 = Panel(pt_2)

supp = SupportKaramba(PosInd=flatten(cps.Points), menu=[buttons(on, on, on, on, on, on)])

assemble = AssembleModelKaramba(Elem=meshtoshell.Element, Support=supp, Load=load, CrossSection=cross_sections, LimitDistance_m=0.005)  # -> Model, Info, Mass_kg, CenterOfGravity
analyzethi = AnalyzeThIKaramba(Model=assemble.Model)  # -> CalculatedModel, MaximumDisplacement_m, ResultingForceOfGravity_kN, ElasticEnergy_kNm
num = Number(analyzethi.MaximumDisplacement_m)
panel_9 = Panel(num)
modelview = ModelViewKaramba(Model=analyzethi.CalculatedModel, LoadCaseFactorsForLinearSuperposition=1, IndexOfVisibleLoadcase=-1)  # -> Model, DeformedMesh, DeformedAxes, DeformedModel
react = ReactionForcesKaramba(AnalyzedModel=modelview.Model, LoadCase=0)  # -> AnalyzedModel, ReactionForces_kN, ReactionMoments_kNm, SupportPosition, SumOfReactionForces_kN, SumOfReactionMoments_kNm
shellview = ShellViewKaramba(Model=modelview.Model, IndexOfLayer=0)  # -> Model, MeshesOfRenderedShells, LegendColors, LegendTags
multiplication_2 = Multiplication(A=shellview.LegendTags, B="10")
s_forces = ShellForcesKaramba(AnalyzedModel=shellview.Model, LCase=0, mode="Principal")  # -> AnalyzedModel, FirstPrincipalNormalForce_kN_m, SecondPrincipalNormalForce_kN_m, FirstPrincipalMoment_kN, SecondPrincipalMoment_kN, ShearForceInLocalXDirection_kN_m, ShearForceInLocalYDirection_kN_m
legend = Legend(Colour=shellview.LegendColors, Tags=multiplication_2, LegendType=1)

shellvecresults = ResultVectorsOnShellsKaramba(AnalyzedModel=shellview.Model, LayerOfResults=0, mode="PrincStress")  # -> AnalyzedModel, Points, FirstPrincipalStressVector_kN_cm2, SecondPrincipalStressVector_kN_cm2, FirstPrincipalStressValue_kN_cm2, SecondPrincipalStressValue_kN_cm2
bnd_3 = Bounds(Numbers=[shellvecresults.FirstPrincipalStressValue_kN_cm2, shellvecresults.SecondPrincipalStressValue_kN_cm2])
num_2 = Number(shellvecresults.FirstPrincipalStressValue_kN_cm2)
larger = LargerThan(FirstNumber=num_2, SecondNumber="0")  # -> LargerThan, OrEqualTo
dedomain_3 = DeconstructDomain(Domain=bnd_3)  # -> Start, End
panel_10 = Panel(dedomain_3.Start)
dispatch_2 = Dispatch(List=num_2, DispatchPattern=larger.LargerThan)  # -> ListA, ListB
num_3 = Number(dispatch_2.ListA)
panel_11 = Panel(num_3)

series = Series(Start=Slider(0, range=0..100), Step="1", Count=Slider(2, range=0..10))
nodedisp = NodalDisplacementsKaramba(AnalyzedModel=shellview.Model, LoadCase=series)  # -> AnalyzedModel, NodalTranslations_m, NodalRotations_rad
devec = DeconstructVector(Vector=nodedisp.NodalTranslations_m)  # -> XComponent, YComponent, ZComponent
project = Project(Geometry=nodedisp.NodalTranslations_m, Plane=PlaneXY(0, 0, 0))  # -> Geometry, Transform
vlen_2 = VectorLength(Vector=project.Geometry)
abs = Absolute(Value=devec.ZComponent)
bnd_4 = Bounds(Numbers=abs)
bnd_5 = Bounds(Numbers=vlen_2)
dedomain_4 = DeconstructDomain(Domain=bnd_4)  # -> Start, End
dedomain_5 = DeconstructDomain(Domain=bnd_5)  # -> Start, End
panel_12 = Panel(dedomain_4.End)
panel_13 = Panel(dedomain_5.End)

# ---- group: map principal stress lines at each point
shelllineresults = LineResultsOnShellsKaramba(
    AnalyzedModel=analyzethi.CalculatedModel,
    Layer=0,
    ListOfSourcesOfPrincipalStressLinesLinesPoints=cull,
    SegmentLength_m=0.5,
    DA_deg=5,
    mode="PrincStress")  # -> AnalyzedModel, Lines1, Lines2

# ----
panel_14 = Panel(dedomain_3.End)

# ---- group: blue
rgb = ColourRGB(Alpha=255, Red=0, Green=0, Blue="250")
preview = CustomPreview(Geometry=shelllineresults.Lines1, Shader=rgb)

# ---- group: red
rgb_2 = ColourRGB(Alpha=255, Red="250", Green=0, Blue=0)
preview_2 = CustomPreview(Geometry=shelllineresults.Lines2, Shader=rgb_2)
