# Grasshopper definition level -2.gh (Grasshopper 1.0.7)
# plug-ins: Karamba

# -2
mesh = Mesh(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)
mesh_2 = Mesh(flatten(mesh))
bbox = BoundingBox(Content=mesh_2, Plane=PlaneXY(0, 0, 0))  # -> Box, Box_2
debox = DeconstructBox(Box=bbox.Box)  # -> Plane, X, Y, Z
panel = Panel(debox.Z)
# already safety factor？
panel_2 = Panel("0.24")
panel_3 = Panel("0.0024")
division = Division(A=panel_2, B="1.5")
# earthbag
panel_4 = Panel("-1.2")
multiplication = Multiplication(A=Slider(-0.6, range=-1..1), B=Slider(1.4, range=0..10))
matprops = MaterialPropertiesKaramba(
    FamilyOfMaterial="earth bag",
    Name="earth bag",
    YoungsModulus_kN_cm2="2",
    InPlaneShearModulus_kN_cm2="0.77",
    TransverseShearModulus_kN_cm2="0.77",
    SpecificWeight_kN_m3="17",
    CoefficientOfThermalExpansion_1_C=1e-05,
    YieldStrength_kN_cm2=division,
    mode="Isotrop")
Z = UnitZ(Factor=panel_4)
Z_2 = UnitZ(Factor=multiplication)
loads = LoadsKaramba(Vector=Z_2, Mesh=mesh_2, LCase="1", mode="MeshLoad -Const.", menu=[buttons(off, off, on), buttons(on, off)])
loads_2 = LoadsKaramba(Vector=Z, LCase="0", mode="Gravity")
meshtoshell = MeshToShellKaramba(Mesh=mesh_2, Identifier="whole", LimitDistance_m=0.005)  # -> flatten(Element), Points, Info
cross_sections = CrossSectionsKaramba(FamilyNameOfCrossSection="DefaultCroSec", Material=matprops, Height_cm="50", mode="Shell - Const")
load = LoadKaramba(flatten([loads, loads_2]))

# ---- group: reduce mesh point density with cull pattern
panel_5 = Panel("""0
0
0
0
0
1""")  # disabled
cull = CullPattern(CullPattern=panel_5)  # disabled

# ---- group: map principal stress lines at each point
shelllineresults = LineResultsOnShellsKaramba(Layer=0, ListOfSourcesOfPrincipalStressLinesLinesPoints=cull, SegmentLength_m=0.5, DA_deg=5, mode="PrincStress")  # -> AnalyzedModel, Lines1, Lines2; disabled

# ----
panel_6 = Panel("250")  # disabled

panel_7 = Panel("0.0024")  # disabled

# ---- group: blue
rgb = ColourRGB(Alpha=255, Red=0, Green=0, Blue=panel_6)  # disabled
preview = CustomPreview(Geometry=shelllineresults.Lines1, Shader=rgb)  # disabled

# ---- group: red
rgb_2 = ColourRGB(Alpha=255, Red=panel_6, Green=0, Blue=0)  # disabled
preview_2 = CustomPreview(Geometry=shelllineresults.Lines2, Shader=rgb_2)  # disabled

# ----
demesh = DeconstructMesh(Mesh=mesh_2)  # -> Vertices, Faces, Colours, Normals
pdecon = Deconstruct(Point=demesh.Vertices)  # -> XComponent, YComponent, ZComponent
equals = Equality(FirstNumber=pdecon.ZComponent, SecondNumber="-1")  # -> Equality, Inequality

smaller = SmallerThan(FirstNumber=pdecon.ZComponent, SecondNumber="-1")  # -> SmallerThan, OrEqualTo

dispatch = Dispatch(List=demesh.Vertices, DispatchPattern=smaller.OrEqualTo)  # -> ListA, ListB
pt = Point(dispatch.ListA)

cullpt = CullDuplicates(Points=pt, Tolerance=0.1, CullMode=3)  # -> Points, Indices, Valence
cps = ClosestPointsKaramba(Point=cullpt.Points, Cloud=demesh.Vertices, NumberOfNeighbors=1, LimitDistance=-1)  # -> flatten(Points), Index, Distance
supp = SupportKaramba(PosInd=flatten(cps.Points), menu=[buttons(on, on, on, on, on, on)])  # -> flatten(Support)
assemble = AssembleModelKaramba(
    Points=meshtoshell.Points,
    Elem=meshtoshell.Element,
    Support=supp,
    Load=load,
    CrossSection=cross_sections,
    LimitDistance_m=0.005)  # -> Model, Info, Mass_kg, CenterOfGravity
analyzethi = AnalyzeThIKaramba(Model=assemble.Model)  # -> CalculatedModel, MaximumDisplacement_m, ResultingForceOfGravity_kN, ElasticEnergy_kNm
num = Number(analyzethi.MaximumDisplacement_m)
panel_8 = Panel(num)
modelview = ModelViewKaramba(Model=analyzethi.CalculatedModel, LoadCaseFactorsForLinearSuperposition=1, IndexOfVisibleLoadcase=-1)  # -> Model, DeformedMesh, DeformedAxes, DeformedModel
react = ReactionForcesKaramba(AnalyzedModel=modelview.Model, LoadCase=0)  # -> AnalyzedModel, ReactionForces_kN, ReactionMoments_kNm, SupportPosition, SumOfReactionForces_kN, SumOfReactionMoments_kNm
shellview = ShellViewKaramba(Model=modelview.Model, IndexOfLayer=0)  # -> Model, MeshesOfRenderedShells, LegendColors, LegendTags
multiplication_2 = Multiplication(A=shellview.LegendTags, B="10")
s_forces = ShellForcesKaramba(AnalyzedModel=shellview.Model, LCase=0, mode="Principal")  # -> AnalyzedModel, FirstPrincipalNormalForce_kN_m, SecondPrincipalNormalForce_kN_m, FirstPrincipalMoment_kN, SecondPrincipalMoment_kN, ShearForceInLocalXDirection_kN_m, ShearForceInLocalYDirection_kN_m
legend = Legend(Colour=shellview.LegendColors, Tags=multiplication_2, LegendType=1)

series = Series(Start=Slider(0, range=0..100), Step="1", Count=Slider(2, range=0..10))
nodedisp = NodalDisplacementsKaramba(AnalyzedModel=shellview.Model, LoadCase=series)  # -> AnalyzedModel, NodalTranslations_m, NodalRotations_rad
devec = DeconstructVector(Vector=nodedisp.NodalTranslations_m)  # -> XComponent, YComponent, ZComponent
project = Project(Geometry=nodedisp.NodalTranslations_m, Plane=PlaneXY(0, 0, 0))  # -> Geometry, Transform
vlen = VectorLength(Vector=project.Geometry)
abs = Absolute(Value=devec.ZComponent)
bnd = Bounds(Numbers=abs)
bnd_2 = Bounds(Numbers=vlen)
dedomain = DeconstructDomain(Domain=bnd)  # -> Start, End
dedomain_2 = DeconstructDomain(Domain=bnd_2)  # -> Start, End
panel_9 = Panel(dedomain.End)
panel_10 = Panel(dedomain_2.End)

shellvecresults = ResultVectorsOnShellsKaramba(AnalyzedModel=shellview.Model, LayerOfResults=0, mode="PrincStress")  # -> AnalyzedModel, Points, FirstPrincipalStressVector_kN_cm2, SecondPrincipalStressVector_kN_cm2, FirstPrincipalStressValue_kN_cm2, SecondPrincipalStressValue_kN_cm2
bnd_3 = Bounds(Numbers=[shellvecresults.SecondPrincipalStressValue_kN_cm2, shellvecresults.FirstPrincipalStressValue_kN_cm2])
num_2 = Number(shellvecresults.FirstPrincipalStressValue_kN_cm2)
larger = LargerThan(FirstNumber=num_2, SecondNumber="0")  # -> LargerThan, OrEqualTo
dedomain_3 = DeconstructDomain(Domain=bnd_3)  # -> Start, End
dispatch_2 = Dispatch(List=num_2, DispatchPattern=larger.LargerThan)  # -> ListA, ListB
panel_11 = Panel(dedomain_3.Start)
num_3 = Number(dispatch_2.ListA)
panel_12 = Panel(num_3)

panel_13 = Panel(dedomain_3.End)
