# Grasshopper definition Amey Thakur_4739434.gh (Grasshopper 1.0.7)

srf = Surface(reparameterize(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))
Z = UnitZ(Factor=1)
python = PythonScript(
    srf=srf,
    numU=Slider(150, range=0..1000),
    numV=Slider(25, range=0..100),
    brickl=Slider(15, range=0..100),
    brickh=Slider(50, range=0..100),
    brickw=Slider(15, range=0..100),
    zplane=Z)  # -> out, a, b; inputs srf: Surface, numU: Int32, numV: Int32, brickl: Int32, brickh: Int32, brickw: Int32, zplane: Vector3d
# ---------- python: Python ----------
#import required libraries
import rhinoscriptsyntax as rs
import Rhino.Geometry as rg
import Grasshopper as gh
import ghpythonlib.components as GHP
#reference rhino surface to python
#project points on the surface
a=[]
for i in range(0,numU):
    for j in range(0,numV):
        mypoint = rs.EvaluateSurface(srf,i/numU,j/numV)
        a.append(mypoint)
#loop evaluated points
#make brick
#reference brick to evaulated points
b=[]
for k in a:
    plane = rg.Plane(k,zplane)
    x = rg.Interval(0,brickl)
    y = rg.Interval(0,brickh)
    z = rg.Interval(0,brickw)
    brick = rg.Box(plane,x,y,z)
    b.append(brick)
    print(b)
# ---------- end python ----------
box = CenterBox(Base=PlaneXY(0, 0, 0), X=1, Y=1, Z=1)
brep = Brep(python.b)
