# Grasshopper definition Jiahui Cai-4716124.gh (Grasshopper 0.9.76)
# plug-ins: Python Interpreter, Wombat

# ----
# Input
brep = Brep(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)

# ----
# Process
python = GhPythonScript(cone=brep)  # -> out, bricks, curves, point_a, m; inputs cone: Brep
#   port cone: the piglet's house brep
# ---------- python: Python ----------
import rhinoscriptsyntax as rs
import Rhino.Geometry as rg
import Rhino
from copy import copy

normals=[]
planes=[]
bricks=[]
curves=[]
points_2=[]
boxes=[]


plane= rs.WorldXYPlane()
x,y,z = 203.0, 92.0, 57.0
pt0 = rg.Point3d(x,y,z)
pt1 = rg.Point3d(x,y,-z)
pt2 = rg.Point3d(x,-y,z)
pt3 = rg.Point3d(x,-y,-z)
pt4 = rg.Point3d(-x,y,z)
pt5 = rg.Point3d(-x,-y,-z)
pt6 = rg.Point3d(-x,y,z)
pt7 = rg.Point3d(-x,-y,-z)
pts = [pt0, pt1, pt2, pt3, pt4, pt5, pt6, pt7]
box=rg.Box(plane,pts)
box=box.ToBrep()


#curves = Brep.CreateContourCurves(geometry, base_point, end_point, interval)
a = rg.Point3d(0,0,0)
b = rg.Point3d(0,0,2850)
curves = cone.CreateContourCurves(cone,a,b,114)
if isinstance(curves, list):
    m=1
#divide curve, distances between points are equal

for curve in curves:
    points = rs.DivideCurveLength(curve, 225, True)
    points_2.append(points) #
    #flatten = lambda *n: (e for a in n for e in (flatten(*a) if isinstance(a, (tuple, list)) else (a,)))#
    #points_final = list(flatten(points_2))
    point_a= points[::2]#filter some points
    for point in point_a:
        (t, param) = rg.Curve.ClosestPoint(curve,point)
        (k, frame) = rg.Curve.FrameAt(curve,param)
        x=rg.Transform.PlaneToPlane(rs.WorldXYPlane(), frame)

        duplicate=box.Duplicate()
        rg.Brep.Transform(duplicate,x)
        boxes.append(duplicate)
        bricks=boxes

#mistake: the quantity of bricks not equals to the number of points/2

    #history
    #normal = rs.CurveNormal(curve,point)#get the normal direction----
    #plane=rs.PlaneFromNormal(point, normal, xaxis=None)
    #brick=rg.Box(plane,pts)
    #bricks.append(brick)
    #define a function for creating a box
def FormBox():
    #plane = rs.WorldXYPlane()   needed???
    if plane is None: plane=rs.WorldXYPlane()
    x,y,z = 203.0*0.5, 92.0*0.5, 57.0*0.5
    pt0 = rg.Point3d(x,y,z)
    pt1 = rg.Point3d(x,y,-z)
    pt2 = rg.Point3d(x,-y,z)
    pt3 = rg.Point3d(x,-y,-z)
    pt4 = rg.Point3d(-x,y,z)
    pt5 = rg.Point3d(-x,-y,-z)
    pt6 = rg.Point3d(-x,y,z)
    pt7 = rg.Point3d(-x,-y,-Z)
    box=rs.AddBox([pt0, pt1, pt2, pt3, pt4, pt5, pt6, pt7])
    return box

a= box
# ---------- end python ----------

panel = Panel(python.m)
pt = Point(python.point_a)
crv = Curve(python.curves)
brep_2 = Brep(python.bricks)

# ----
# Output
geo = Geometry([python.bricks, python.curves])

# ----
# Visuals
number_slider = Slider(10, range=0..10)
randcol = RandomColor(Data=python.bricks, Seed=number_slider, FastMode=False)
preview = CustomPreview(Geometry=geo, Material=randcol)

panel_2 = Panel(brep_2)
panel_3 = Panel(python.point_a)
panel_4 = Panel(crv)
