# Grasshopper definition Initial _Python _Attempt.gh (Grasshopper 0.9.76)
# plug-ins: Python Interpreter, Anemone

radians = Radians(Degrees=Slider(317, range=0..360))
arc = Arc(Plane=PlaneXY(0, 0, 0), Radius=Slider(10, range=0..12), Angle=radians)  # -> Arc, Length

# ----
# Sample
number_slider = Slider(3, range=0..10)
number_slider_2 = Slider(0.9, range=0..10)
fast_loop_start = FastLoopStart(Iterations=number_slider, Data=arc.Arc)  # -> port, Counter, Data
scale = Scale(Geometry=reverse(fast_loop_start.Data), Center=Point(0, 0, 0), Factor=number_slider_2)  # -> Geometry, Transform
unit_z = UnitZ(Factor=Slider(2, range=0..10))
move = Move(Geometry=scale.Geometry, Motion=unit_z)  # -> Geometry, Transform
fast_loop_end = FastLoopEnd(port=fast_loop_start.port, Exit=False, Data=move.Geometry, RecordData=True, TimeOutVal=0)
number_slider_3 = Slider(1, range=0..10)
divide_distance = DivideDistance(Curve=fast_loop_end, Distance=Slider(4.5, range=0..50))  # -> Points, Tangents, Parameters
center_box = CenterBox(Base=PlaneXY(0, 0, 0), X=number_slider_3, Y=number_slider_3, Z=Slider(2, range=0..2))
line_sdl = LineSDL(Start=divide_distance.Points, Direction=divide_distance.Tangents, Length=1)
orient = Orient(Geometry=center_box, Source=PlaneXY(0, 0, 0), Target=line_sdl)  # -> Geometry, Transform

deconstruct_plane = DeconstructPlane(Plane=arc.Arc)  # -> Origin, XAxis, YAxis, ZAxis
python_script = PythonScript(x=arc.Arc, y=deconstruct_plane.Origin, z=number_slider_2, u=radians)  # -> out, a, b
# ---------- python_script: Python ----------
import rhinoscriptsyntax as rs
import Rhino.Geometry as rg
from copy import copy 
import math

#scale arc 
arc = rs.ArcRadius(x) 
arc_origin = rg.Point3d(0,0,0) 
factor = 0.9

scale = rg.Transform.Scale(arc_origin,factor)
#scaled_arc = arc * factor 
b=scale

#scaled_arc = rs.ScaleObject("arc", [0,0,0], [1,1,1])

#move object

#strObject = rg.GetObject(arc)
#arr_end = rg.Point3d(0,0,2)
#move_object= rs.MoveObject(scaled_arc, arc_origin, arr_end)

#loop

#divide by length

#create boxes/bricks tangent to these points
# ---------- end python_script ----------
curve = Curve(python_script.b)
