# Grasshopper definition Pierre Kauter_4742222.gh (Grasshopper 0.9.76)
# plug-ins: Python Interpreter

# ---- group: Experiments
python_script = PythonScript(x=Slider(11, range=0..20))  # -> out, a, b; inputs x: Int32, y: Vector3d
# ---------- python_script: Python ----------
import rhinoscriptsyntax as rs
import ghpythonlib.components as ghcomp
import Rhino.Geometry as rg
import random
import Rhino

#INPUT
listpts = []

#for i in range(0,x):
#    pt2 = rs.AddPoint((i,0,0))
#    a.append(pt2)

#Create Brick
#pts = []
#pts.append(pt2)
#vect = ghcomp.VectorXYZ(0.92,2.03,0.57)
#newPt = ghcomp.Move(pt2,vect)
#pts.append(newPt)
#box = ghcomp.Box2Pt(pt2,newPt)

#Create Curvature
Pt0 = (0,0,0)
Pt1 = (30,0,0)
Pitch = 0
Turns = 1
Radius0 = 0
Radius1 = 10
Spiral = rs.AddSpiral(Pt0, Pt1, Pitch, Turns, Radius0, Radius1)

Pt2 = (0,0,0)
Pt3 = (10,0,0)
Pitch1 = 0
Turns1 = 1
Radius2 = 0
Radius3 = 10
Spiral1 = rs.AddSpiral(Pt2, Pt3, Pitch, Turns, Radius2, Radius3)


#OUTPUT
a = Spiral
b = Spiral1
# ---------- end python_script ----------
python_script_2 = PythonScript(z=Slider(0, range=-5..5))  # -> out, a, b
# ---------- python_script_2: Python ----------
import rhinoscriptsyntax as rs
import ghpythonlib.components as ghcomp
import Rhino.Geometry as rg
import random
import Rhino

#INPUT

#Fibonnaci Try-Out
def fib(n):
    if n == 0:
        return 0
    if n == 1:
        return 1
    return fib(n-1) + fib(n-2)

list=[]
for i in range(0,10):
    print fib(i)
    list.append(fib(i))
print list

#Manual Curve

vect1 = rs.AddPoint(0,0,z)
vect2 = rs.AddPoint(10,10,z)
vect3 = rs.AddPoint(30,0,z)
vect4 = rs.AddPoint(0,-30,z)
vect5 = rs.AddPoint(-50,20,z)
list=[vect1,vect2,vect3,vect4,vect5]
curve = rs.AddInterpCurve(list)

curve = rs.AddSpiral(

#Extrusion
topvector=rs.VectorUnitize((0,0,50))
top = rs.AddPoint(0,0,50)
srf = rs.ExtrudeCurvePoint(curve, top)

#Layering

#Point Division

#Brick on Point

#OUTPUT
a=srf
# ---------- end python_script_2 ----------
panel = Panel(python_script.a)

# ---- group: Unfinished
python_script_3 = PythonScript()  # -> out, a
# ---------- python_script_3: Python ----------
import rhinoscriptsyntax as rs
import Rhino.Geometry as rg
import Rhino

#Create Curvature Bottom
Pt0 = (0,0,0)
Pt1 = (10,0,0)
Pitch = 0
Turns = 1
Radius0 = 0
Radius1 = 10

#Create Curvature Top
LoftHeight=20
Spiral = rs.AddSpiral(Pt0, Pt1, Pitch, Turns, Radius0, Radius1)
Spiral1 = rs.CopyObject(Spiral)
Translation = rs.PointAdd((0,0,0),(LoftHeight,0,0))
rs.MoveObject(Spiral1,Translation)
rs.ScaleObject(Spiral1,(20,0,0), (0.5, 0.5, 0.5), True)
#List Curvature
Curves = [Spiral, Spiral1]
#Create Surface
Loft = rs.AddLoftSrf(Curves)

#Create Brick
width = 0.092
lenght = 0.203
height = 0.057
Pt5 = rg.Point3d(0,0,0)
Pt6 = rg.Point3d(width, lenght, height)
Brick = rg.BoundingBox(Pt5, Pt6)

#Create cutting planes
xyPlane = rs.WorldXYPlane()
sectionPlane = rs.AddPlaneSurface(xyPlane,10,10)
rs.MoveObject(sectionPlane, [-10,-10,0])
#Extract points 4 bricks
Points4Bricks = []
height=0
i=0
while height<LoftHeight:
    sectionPlaneMoved = rs.CopyObject(sectionPlane,[0,0,height])
    sectionCurve = rs.IntersectBreps(Loft, sectionPlaneMoved)
#Make Brick Pattern
    if i%2 == 0:
        rs.ExtendCurveLength(sectionCurve,2,0,(0.5*lenght)) 
        #error of geometry or GUID
# ---------- end python_script_3 ----------
panel_2 = Panel(python_script_3.out)
