# Grasshopper definition Soujanya-4735641.gh (Grasshopper 0.9.76)
# plug-ins: Python Interpreter

constant = Slider(9, range=0..10)
# Creating points that form a spiral
number_of_points = Slider(10, range=0..10)
range = Range(Domain=Slider(360, range=0..360), Steps=number_of_points)
spiral_eq = Multiplication(A=constant, B=range)
pt = ConstructPoint(XCoordinate=0, YCoordinate=0, ZCoordinate=0)
pt_2 = ConstructPoint(XCoordinate=0, YCoordinate=spiral_eq, ZCoordinate=0)
range_2 = Range(Domain=Slider(360, range=0..360), Steps=number_of_points)
ln = Line(StartPoint=pt, EndPoint=pt_2)
panel = Panel(range_2)
rotate = Rotate(Geometry=ln, Angle=degrees(range_2), Plane=PlaneXY(0, 0, 0))  # -> Geometry, Transform
end = EndPoints(Curve=rotate.Geometry)  # -> Start, End

# ----
# Trying to use the same logic in python
python = PythonScript()  # -> out, a, b, c
# ---------- python: Python ----------
import ghpythonlib.components as ghcomp
import rhinoscriptsyntax as rs
import Rhino.Geometry as rg
import Rhino
import math as math

#making spiral using same logic as gh definition (does not work in python)

centre = Rhino.Geometry.Point3d(0,0,0)
for i in range(360):
    r = 10*i
    radius = (0,r,0)

    #lines from origin to radius
    lines = rs.AddLine(centre,radius)

    #rotate lines

    #end points of lines

#making spiral using points obtained by Fibonacci sequence
#interpolate curve through points 
p1 = rs.AddPoint(0,0,0)
p2 = rs.AddPoint(1,1,0)
p3 = rs.AddPoint(3,0,0)
p4 = rs.AddPoint(0,-3,0)
p5 = rs.AddPoint(-5,2,0)

list=[p1,p2,p3,p4,p5]

curve = rs.AddInterpCurve(list)
a=curve

#extrude spiral to point to make surface
height = 10
point = (0,0,height)
surface=rs.ExtrudeCurvePoint(curve, point)
a=surface

#making a brick
brickL = 0.092
brickW = 0.203
brickH = 0.057
point2 = Rhino.Geometry.Point3d(5,5,0)
points = []
points.append(point2)
path = ghcomp.VectorXYZ(brickL,brickW,brickH)
point3 = ghcomp.Move(point2,path)
points.append(point3)
box = ghcomp.Box2Pt(point2,point3)

b=box

#layers
hPlane = rs.WorldXYPlane()
sPlane = rs.AddPlaneSurface(hPlane,20,20)
rs.MoveObject(sPlane, [-10,-10,0])
brickPoints = []
h=0
i=0
while h<height:
    sPlaneMove = rs.CopyObject(sPlane,[0,0,h])
    sCurve = rs.IntersectBreps(surface, sPlaneMove)
    if i%2 ==0:
        rs.ExtendCurveLength(sCurve,2,0,(0.5*brickL))
    brickPoint = rs.DivideCurveEquidistant(sCurve,brickL,True,True)
    brickPoints.extend(brickPoint)
    h += brickH
    i+= 1

c = brickPoints
# ---------- end python ----------

# ----
# Creating surface using spiral base and a point
panel_2 = Panel(end.End)
item = ListItem(List=end.End, Index=0, Wrap=True)
Z = UnitZ(Factor=5000)
move = Move(Geometry=item, Motion=Z)  # -> Geometry, Transform
intcrv = Interpolate(Vertices=panel_2, Degree=3, Periodic=False, KnotStyle=1)  # -> Curve, Length, Domain
extr = ExtrudePoint(Base=intcrv.Curve, Point=move.Geometry)

# ----
# Brick Dimensions
number_slider = Slider(57, range=0..460)
number_slider_2 = Slider(203, range=0..460)

xy = XYPlane(Origin=Point(0, 0, 0))
X = UnitX(Factor=2000)
move_2 = Move(Geometry=xy, Motion=X)  # -> Geometry, Transform
# Creating one brick
rectangle = Rectangle(Plane=move_2.Geometry, XSize=number_slider_2, YSize=Slider(92, range=0..460), Radius=0)  # -> Rectangle, Length
boxrec = BoxRectangle(Rectangle=rectangle.Rectangle, Height=number_slider)

# ----
# Overlap between adjacent bricks
subtraction = Subtraction(A=number_slider_2, B=20)

contour = Contour(Shape=extr, Point=Point(0, 0, 0), Direction=Vector(0, 0, 1), Distance=expr("X+10", number_slider))  # -> flatten(Contours)
# Dividing the surface into brick courses and pattern
len = Length(Curve=contour)
division = Division(A=len, B=subtraction)
hframes = HorizontalFrames(Curve=contour, Count=division)  # -> Frames, Parameters

# ----
# Centroid of bottom face of each brick
debrep = DeconstructBrep(Brep=boxrec)  # -> Faces, Edges, Vertices
item_2 = ListItem(List=debrep.Faces, Index=4, Wrap=True)
area = Area(Geometry=item_2)  # -> Area, Centroid

# ----
# Arranging bricks on surface
# (Problem with the pattern)
orient = Orient(Geometry=boxrec, Source=area.Centroid, Target=hframes.Frames)  # -> Geometry, Transform
culln = CullNth(List=orient.Geometry, CullFrequency=2)
