# Grasshopper definition BoxConfiguration.gh (Grasshopper 1.0.7)

names = Text(["Entrance", "Administration", "Waiting Room", "Toilets", "Courtyard", "Canteen + storage", "Operating theatres (3)", "Education_Classroom", "OBGyN_Nursery", "OBGyN_Lab + storage", "OBGyN_Wards", "OBGyN_Diagnostics", "OBGyN_Bathrooms", "Doctor/nurse rooms", "Emergency_Diagnostics[A+E]", "Pediatric_Kids wards", "Pediatric_Diagnostics", "Pediatric_Playground", "Pediatric_Bathrooms"])
areas = Text(["30", "15", "20", "15", "50", "30", "150", "40", "600", "30", "900", "25", "15", "40", "25", "900", "25", "30", "15"])
# READ ME
# All GhPython components should have the same code.
# If any changes are to be made to the code do the changes
# in the first component "Entrance" then extract parameter
# from the code input, disconnect it, then connect it to the
# data container named "code", then click
# "internalise data" to apply the change.
# This will update all other components.
# If you create another GhPython instance then
# be sure to connect the code container to it as well
room_names = Panel(names)

# ----
# Module Size [m]
panel = Panel("3")

areas_2 = Panel(areas)
int = Integer(panel)
int_2 = Integer("6")

pt = Point(Point(32.40886727, 17.89409022, 0))
python = GhPythonScript(name="Entrance", ins_pt=pt, module_x=int, module_y=int_2, mods_x=Slider(4, range=1..10), mods_y=Slider(1, range=1..10))  # -> out, box, area, pts, grid, centroid, tag; inputs attach_pts: list of Point3d, ins_pt: Point3d, mods_x: Int32, mods_y: Int32
# ---------- python: Python ----------
"""Creates a building module.
    Inputs:
        Name: Name of Room
        module_x: Size of 1 module in x
        module_y: Size of 1 module in y
        mods_x: number of modules in x direction
        mods_y: number of modules in y direction
    Output:
        box: Room box
        area: Area of room
        pts: attachment points"""

__author__ = "erron estrado"
__version__ = "2018.09.21"

import rhinoscriptsyntax as rs
import Rhino.Geometry as rg
import math
from copy import copy

# create box points
def ConstructBoxPts(module_x, module_y, mods_x, mods_y, ins_pt):
    anchorPts = []
    anchorPts.append(ins_pt)
    prev_pt = ins_pt
    
    # make points of first edge
    for i in range(mods_x):
        pt = copy(prev_pt)
        vector = rg.Vector3d.XAxis * module_x * (i+1)
        pt += vector
        anchorPts.append(pt)
        pt = prev_pt
    prev_pt = anchorPts[anchorPts.Count - 1]
    
    # make points of second edge
    for i in range(mods_y):
        pt = copy(prev_pt)
        vector = rg.Vector3d.YAxis * module_y * (i+1)
        pt += vector
        anchorPts.append(pt)
        pt = prev_pt
    prev_pt = anchorPts[anchorPts.Count - 1]
    
    # make points of third edge
    for i in range(mods_x):
        pt = copy(prev_pt)
        vector = rg.Vector3d.XAxis * module_x * (i+1) * -1
        pt += vector
        anchorPts.append(pt)
        pt = prev_pt
    prev_pt = anchorPts[anchorPts.Count - 1]
    
    # make points of fourth edge
    for i in range(mods_y):
        pt = copy(prev_pt)
        vector = rg.Vector3d.YAxis * module_y * (i+1) *-1
        pt += vector
        anchorPts.append(pt)
        pt = prev_pt
    
    # make box curve
    
    return anchorPts

# snapping to other boxes
def Snap(snapPts, boxPts):
    if snapPts.Count != 0:
        closestPts = []
        dist = boxPts[0].DistanceTo(snapPts[0])
        for pt in boxPts:
            for pt2 in snapPts:
                distToPt = pt.DistanceTo(pt2)
                if distToPt < dist:
                    dist = distToPt
                    closestPts.Clear()
                    closestPts.append(pt)
                    closestPts.append(pt2)
        vec = closestPts[1] - closestPts[0]
        
        # new moved anchor points
        newAnchors = []
        for pt in boxPts:
            pt += vec
            newAnchors.append(pt)
    else:
        newAnchors = boxPts
    return newAnchors

def DrawBox(points):
    polycurve = rg.PolylineCurve(points)
    return polycurve

# get interior lines of individual modules
def GetGridLines(module_x, module_y, mods_x, mods_y, ins_pt):
    modules = []
    start_pt = ins_pt
    for i in range(mods_y+1):
        for j in range(mods_x):
            plane = rg.Plane(start_pt, rg.Vector3d.ZAxis)
            mod = rg.Rectangle3d(plane, module_x, module_y)
            modules.append(mod)
            vec_x = rg.Vector3d.XAxis * module_x
            start_pt += vec_x
        start_pt = ins_pt
        start_pt += rg.Vector3d.YAxis * module_y * i
    return modules

# run functions
roomPts = ConstructBoxPts(module_x, module_y, mods_x, mods_y, ins_pt)
newPts = Snap(attach_pts, roomPts)
room = DrawBox(newPts)

# get area properties
roomProperties = rg.AreaMassProperties.Compute(room)

# outputs
grid = GetGridLines(module_x, module_y, mods_x, mods_y, newPts[0])
centroid = roomProperties.Centroid
area = roomProperties.Area
tag = '{}\n{}m2'.format(name, area)
box = room
pts = newPts
# ---------- end python ----------
crv = Curve(python.box)
tag = TextTag(Location=python.centroid, Text=python.tag)

# ----
# Code changes here
code = Code("""\"\"\"Creates a building module.
    Inputs:
        Name: Name of Room
        module_x: Size of 1 module in x
        module_y: Size of 1 module in y
        mods_x: number of modules in x direction
        mods_y: number of modules in y direction
    Output:
        box: Room box
        area: Area of room
        pts: attachment points\"\"\"

__author__ = "erron estrado"
__version__ = "2018.09.21"

import rhinoscriptsyntax as rs
import Rhino.Geometry as rg
import math
from copy import copy

# create box points
def ConstructBoxPts(module_x, module_y, mods_x, mods_y, ins_pt):
    anchorPts = []
    anchorPts.append(ins_pt)
    prev_pt = ins_pt
    
    # make points of first edge
    for i in range(mods_x):
        pt = copy(prev_pt)
        vector = rg.Vector3d.XAxis * module_x * (i+1)
        pt += vector
        anchorPts.append(pt)
        pt = prev_pt
    prev_pt = anchorPts[anchorPts.Count - 1]
    
    # make points of second edge
    for i in range(mods_y):
        pt = copy(prev_pt)
        vector = rg.Vector3d.YAxis * module_y * (i+1)
        pt += vector
        anchorPts.append(pt)
        pt = prev_pt
    prev_pt = anchorPts[anchorPts.Count - 1]
    
    # make points of third edge
    for i in range(mods_x):
        pt = copy(prev_pt)
        vector = rg.Vector3d.XAxis * module_x * (i+1) * -1
        pt += vector
        anchorPts.append(pt)
        pt = prev_pt
    prev_pt = anchorPts[anchorPts.Count - 1]
    
    # make points of fourth edge
    for i in range(mods_y):
        pt = copy(prev_pt)
        vector = rg.Vector3d.YAxis * module_y * (i+1) *-1
        pt += vector
        anchorPts.append(pt)
        pt = prev_pt
    
    # make box curve
    
    return anchorPts

# snapping to other boxes
def Snap(snapPts, boxPts):
    if snapPts.Count != 0:
        closestPts = []
        dist = boxPts[0].DistanceTo(snapPts[0])
        for pt in boxPts:
            for pt2 in snapPts:
                distToPt = pt.DistanceTo(pt2)
                if distToPt < dist:
                    dist = distToPt
                    closestPts.Clear()
                    closestPts.append(pt)
                    closestPts.append(pt2)
        vec = closestPts[1] - closestPts[0]
        
        # new moved anchor points
        newAnchors = []
        for pt in boxPts:
            pt += vec
            newAnchors.append(pt)
    else:
        newAnchors = boxPts
    return newAnchors

def DrawBox(points):
    polycurve = rg.PolylineCurve(points)
    return polycurve

# get interior lines of individual modules
def GetGridLines(module_x, module_y, mods_x, mods_y, ins_pt):
    modules = []
    start_pt = ins_pt
    for i in range(mods_y+1):
        for j in range(mods_x):
            plane = rg.Plane(start_pt, rg.Vector3d.ZAxis)
            mod = rg.Rectangle3d(plane, module_x, module_y)
            modules.append(mod)
            vec_x = rg.Vector3d.XAxis * module_x
            start_pt += vec_x
        start_pt = ins_pt
        start_pt += rg.Vector3d.YAxis * module_y * i
    return modules

# run functions
roomPts = ConstructBoxPts(module_x, module_y, mods_x, mods_y, ins_pt)
newPts = Snap(attach_pts, roomPts)
room = DrawBox(newPts)

# get area properties
roomProperties = rg.AreaMassProperties.Compute(room)

# outputs
grid = GetGridLines(module_x, module_y, mods_x, mods_y, newPts[0])
centroid = roomProperties.Centroid
area = roomProperties.Area
tag = '{}\n{}m2'.format(name, area)
box = room
pts = newPts""")

int_3 = Integer("6")
int_4 = Integer(panel)
pt_2 = Point(Point(32.51436879, 23.80514769, 0))
python_2 = GhPythonScript(
    Code=code,
    Attach_pts=python.pts,
    Name="Waiting",
    Ins_pt=pt_2,
    Module_x=int_4,
    Module_y=int_3,
    Mods_x=Slider(4, range=1..10),
    Mods_y=Slider(1, range=1..10))  # -> Out, Box, Area, Pts, Grid, Centroid, Tag
crv_2 = Curve(python_2.Box)
tag_2 = TextTag(Location=python_2.Centroid, Text=python_2.Tag)

int_5 = Integer(panel)
int_6 = Integer("6")
pt_3 = Point(Point(47.91009679, 23.91991905, 0))
python_3 = GhPythonScript(
    Code=code,
    Attach_pts=python_2.Pts,
    Name="A+E",
    Ins_pt=pt_3,
    Module_x=int_5,
    Module_y=int_6,
    Mods_x=Slider(2, range=1..10),
    Mods_y=Slider(1, range=1..10))  # -> Out, Box, Area, Pts, Grid, Centroid, Tag
crv_3 = Curve(python_3.Box)
tag_3 = TextTag(Location=python_3.Centroid, Text=python_3.Tag)

pt_4 = Point(Point(44.76306861, 30.46809983, 0))
python_4 = GhPythonScript(
    Code=code,
    Attach_pts=flatten([python_2.Pts, python_3.Pts]),
    Name="Lab + Storage",
    Ins_pt=pt_4,
    Module_x="6",
    Module_y=panel,
    Mods_x=Slider(1, range=1..10),
    Mods_y=Slider(3, range=1..10))  # -> Out, Box, Area, Pts, Grid, Centroid, Tag
tag_4 = TextTag(Location=python_4.Centroid, Text=python_4.Tag)
crv_4 = Curve(python_4.Box)

int_7 = Integer(panel)
int_8 = Integer("6")
pt_5 = Point(Point(24.34054444, 24.12870332, 0))
python_5 = GhPythonScript(
    Code=code,
    Attach_pts=python_2.Pts,
    Name="OBGyn_Diag",
    Ins_pt=pt_5,
    Module_x=int_7,
    Module_y=int_8,
    Mods_x=Slider(3, range=1..10),
    Mods_y=Slider(1, range=1..10))  # -> Out, Box, Area, Pts, Grid, Centroid, Tag
tag_5 = TextTag(Location=python_5.Centroid, Text=python_5.Tag)
crv_5 = Curve(python_5.Box)

pt_6 = Point(Point(38.26206874, 30.46809983, 0))
python_6 = GhPythonScript(
    Code=code,
    Attach_pts=python_2.Pts,
    Name="Ped_Diag",
    Ins_pt=pt_6,
    Module_x="6",
    Module_y=panel,
    Mods_x=Slider(1, range=1..10),
    Mods_y=Slider(3, range=1..10))  # -> Out, Box, Area, Pts, Grid, Centroid, Tag
crv_6 = Curve(python_6.Box)
tag_6 = TextTag(Location=python_6.Centroid, Text=python_6.Tag)

pt_7 = Point(Point(10.93669379, 24.12870332, 0))
int_9 = Integer(panel)
int_10 = Integer("6")
python_7 = GhPythonScript(
    Code=code,
    Attach_pts=python_5.Pts,
    Name="Operating Theatre",
    Ins_pt=pt_7,
    Module_x=int_10,
    Module_y=int_9,
    Mods_x=Slider(2, range=1..10),
    Mods_y=Slider(5, range=1..10))  # -> Out, Box, Area, Pts, Grid, Centroid, Tag
tag_7 = TextTag(Location=python_7.Centroid, Text=python_7.Tag)
crv_7 = Curve(python_7.Box)

pt_8 = Point(Point(-11.45775068, 24.12870332, 0))
int_11 = Integer(panel)
int_12 = Integer("6")
python_8 = GhPythonScript(
    Code=code,
    Attach_pts=flatten(python_7.Pts),
    Name="Classroom",
    Ins_pt=pt_8,
    Module_x=int_11,
    Module_y=int_12,
    Mods_x=Slider(5, range=1..10),
    Mods_y=Slider(1, range=1..10))  # -> Out, Box, Area, Pts, Grid, Centroid, Tag
tag_8 = TextTag(Location=python_8.Centroid, Text=python_8.Tag)
crv_8 = Curve(python_8.Box)

int_13 = Integer(panel)
int_14 = Integer("6")
pt_9 = Point(Point(12.205889, 39.89352318, 0))
python_9 = GhPythonScript(
    Code=code,
    Attach_pts=flatten(python_7.Pts),
    Name="OBGyn_Ward",
    Ins_pt=pt_9,
    Module_x=int_14,
    Module_y=int_13,
    Mods_x=Slider(2, range=1..10),
    Mods_y=Slider(11, range=1..20))  # -> Out, Box, Area, Pts, Grid, Centroid, Tag
crv_9 = Curve(python_9.Box)
crv_10 = Curve(python_9.Grid)
tag_9 = TextTag(Location=python_9.Centroid, Text=python_9.Tag)

pt_10 = Point(Point(-9.036959912, 24.12870332, 0))
int_15 = Integer(panel)
int_16 = Integer("6")
python_10 = GhPythonScript(
    Code=code,
    Attach_pts=flatten(python_8.Pts),
    Name="Entrance",
    Ins_pt=pt_10,
    Module_x=int_15,
    Module_y=int_16,
    Mods_x=Slider(2, range=1..10),
    Mods_y=Slider(1, range=1..10))  # -> Out, Box, Area, Pts, Grid, Centroid, Tag
tag_10 = TextTag(Location=python_10.Centroid, Text=python_10.Tag)
crv_11 = Curve(python_10.Box)

pt_11 = Point(Point(38.28392633, 39.14006169, 0))
int_17 = Integer("6")
int_18 = Integer(panel)
python_11 = GhPythonScript(
    Code=code,
    Attach_pts=flatten([python_6.Pts, python_4.Grid]),
    Name="OBGyn_Ward",
    Ins_pt=pt_11,
    Module_x=int_17,
    Module_y=int_18,
    Mods_x=Slider(2, range=1..10),
    Mods_y=Slider(11, range=1..20))  # -> Out, Box, Area, Pts, Grid, Centroid, Tag
crv_12 = Curve(python_11.Box)
crv_13 = Curve(python_11.Grid)
tag_11 = TextTag(Location=python_11.Centroid, Text=python_11.Tag)

pt_12 = Point(Point(50.69569976, 71.12912475, 0))
int_19 = Integer(panel)
int_20 = Integer("6")
python_12 = GhPythonScript(
    Code=code,
    Attach_pts=flatten(python_11.Pts),
    Name="Nursery",
    Ins_pt=pt_12,
    Module_x=int_19,
    Module_y=int_20,
    Mods_x=Slider(5, range=1..10),
    Mods_y=Slider(1, range=1..20))  # -> Out, Box, Area, Pts, Grid, Centroid, Tag
tag_12 = TextTag(Location=python_12.Centroid, Text=python_12.Tag)
crv_14 = Curve(python_12.Grid)
crv_15 = Curve(python_12.Box)

pt_13 = Point(Point(-23.35482143, 47.56694888, 0))
int_21 = Integer(panel)
int_22 = Integer("6")
python_13 = GhPythonScript(
    Code=code,
    Attach_pts=flatten([python_7.Pts, python_9.Pts]),
    Name="Ped_Ward",
    Ins_pt=pt_13,
    Module_x=int_21,
    Module_y=int_22,
    Mods_x=Slider(11, range=1..20),
    Mods_y=Slider(2, range=1..10))  # -> Out, Box, Area, Pts, Grid, Centroid, Tag
tag_13 = TextTag(Location=python_13.Centroid, Text=python_13.Tag)
crv_16 = Curve(python_13.Box)
crv_17 = Curve(python_13.Grid)

pt_14 = Point(Point(-23.74067673, 24.12870332, 0))
int_23 = Integer(panel)
int_24 = Integer("6")
python_14 = GhPythonScript(
    Code=code,
    Attach_pts=flatten(python_10.Pts),
    Name="Admin",
    Ins_pt=pt_14,
    Module_x=int_23,
    Module_y=int_24,
    Mods_x=Slider(4, range=1..10),
    Mods_y=Slider(1, range=1..10))  # -> Out, Box, Area, Pts, Grid, Centroid, Tag
tag_14 = TextTag(Location=python_14.Centroid, Text=python_14.Tag)
crv_18 = Curve(python_14.Box)

pt_15 = Point(Point(-33.12279308, 38.56388826, 0))
int_25 = Integer(panel)
int_26 = Integer("6")
python_15 = GhPythonScript(
    Code=code,
    Attach_pts=flatten(python_13.Pts),
    Name="Canteen + Storage",
    Ins_pt=pt_15,
    Module_x=int_26,
    Module_y=int_25,
    Mods_x=Slider(2, range=1..10),
    Mods_y=Slider(3, range=1..10))  # -> Out, Box, Area, Pts, Grid, Centroid, Tag
tag_15 = TextTag(Location=python_15.Centroid, Text=python_15.Tag)
crv_19 = Curve(python_15.Box)

pt_16 = Point(Point(-36.51877841, 59.45990648, 0))
int_27 = Integer(panel)
int_28 = Integer("6")
python_16 = GhPythonScript(
    Code=code,
    Attach_pts=flatten([python_9.Pts, python_13.Pts]),
    Name="Ped_Ward",
    Ins_pt=pt_16,
    Module_x=int_28,
    Module_y=int_27,
    Mods_x=Slider(2, range=1..20),
    Mods_y=Slider(4, range=1..20))  # -> Out, Box, Area, Pts, Grid, Centroid, Tag
crv_20 = Curve(python_16.Box)
crv_21 = Curve(python_16.Grid)
tag_16 = TextTag(Location=python_16.Centroid, Text=python_16.Tag)

int_29 = Integer("6")
int_30 = Integer(panel)
pt_17 = Point(Point(24.67729863, 75.65491464, 0))
python_17 = GhPythonScript(
    Code=code,
    Attach_pts=flatten([python_11.Pts, python_9.Pts]),
    Name="OBGyn_Ward",
    Ins_pt=pt_17,
    Module_x=int_30,
    Module_y=int_29,
    Mods_x=Slider(5, range=1..20),
    Mods_y=Slider(1, range=1..10))  # -> Out, Box, Area, Pts, Grid, Centroid, Tag
crv_22 = Curve(python_17.Grid)
tag_17 = TextTag(Location=python_17.Centroid, Text=python_17.Tag)
crv_23 = Curve(python_17.Box)

pt_18 = Point(Point(-33.12279308, 27.00153922, 0))
int_31 = Integer(panel)
int_32 = Integer("6")
python_18 = GhPythonScript(
    Code=code,
    Attach_pts=flatten(python_15.Pts),
    Name="D+N Rooms",
    Ins_pt=pt_18,
    Module_x=int_32,
    Module_y=int_31,
    Mods_x=Slider(2, range=1..10),
    Mods_y=Slider(3, range=1..10))  # -> Out, Box, Area, Pts, Grid, Centroid, Tag
tag_18 = TextTag(Location=python_18.Centroid, Text=python_18.Tag)
crv_24 = Curve(python_18.Box)

pt_19 = Point(Point(-22.55911545, 73.43389558, 0))
int_33 = Integer(panel)
int_34 = Integer("6")
python_19 = GhPythonScript(
    Code=code,
    Attach_pts=flatten(python_16.Pts),
    Name="Ped_Ward",
    Ins_pt=pt_19,
    Module_x=int_33,
    Module_y=int_34,
    Mods_x=Slider(11, range=1..20),
    Mods_y=Slider(1, range=1..20))  # -> Out, Box, Area, Pts, Grid, Centroid, Tag
tag_19 = TextTag(Location=python_19.Centroid, Text=python_19.Tag)
crv_25 = Curve(python_19.Grid)
crv_26 = Curve(python_19.Box)

int_35 = Integer("6")
int_36 = Integer(panel)
pt_20 = Point([Point(-27.17748458, 53.28561626, 0), Point(-26.5914288, 73.93143547, 0), Point(10.46843328, 74.0531444, 0), Point(18.27779032, 73.71638405, 0), Point(39.94463509, 72.24941626, 0), Point(44.39628726, 72.48744278, 0), Point(-28.05587015, 24.05933269, 0)])
python_20 = GhPythonScript(
    Code=code,
    Attach_pts=flatten([python_17.Pts, python_16.Pts, python_9.Pts, python_12.Pts, python_18.Pts]),
    Name="Bathroom",
    Ins_pt=pt_20,
    Module_x=int_36,
    Module_y=int_35,
    Mods_x=Slider(2, range=1..20),
    Mods_y=Slider(1, range=1..10))  # -> Out, Box, Area, Pts, Grid, Centroid, Tag
tag_20 = TextTag(Location=python_20.Centroid, Text=python_20.Tag)
crv_27 = Curve(python_20.Box)

# ----
# Connect all boxes here for overall dimensions
crv_28 = Curve(flatten([python.box, python_2.Box, python_3.Box, python_5.Box, python_4.Box, python_6.Box, python_7.Box, python_9.Box, python_11.Box, python_17.Box, python_20.Box, python_13.Box, python_16.Box, python_19.Box, python_18.Box, python_10.Box, python_14.Box, python_15.Box, python_12.Box]))
bbox = BoundingBox(Content=crv_28, Plane=PlaneXY(0, 0, 0), UnionBox=True)  # -> Box, Box_2
debrep = DeconstructBrep(Brep=bbox.Box)  # -> Faces, Edges, Vertices
area = Area(Geometry=bbox.Box)  # -> Area, Centroid
panel_2 = Panel(area.Area)
item = ListItem(List=debrep.Vertices, Index=0, Wrap=True)  # -> Item, Item1, Item2, Item3
aligndim = AlignedDimension(Plane=PlaneXY(0, 0, 0), PointA=item.Item, PointB=item.Item1, Offset="-3", Text="{0:0.00}", Size=1)
aligndim_2 = AlignedDimension(Plane=PlaneXY(0, 0, 0), PointA=item.Item1, PointB=item.Item2, Offset="-3", Text="{0:0.00}", Size=1)
