# Grasshopper definition DynamicRelaxationForConfiguration_StartingFromGrid.gh (Grasshopper 1.0.7)
# plug-ins: Kangaroo Components, LunchBox, TT Toolbox

# ----
# Excel Read
# set excel sheet
# file here
toggle = BooleanToggle(True)
path = FilePath("C:\Users\benj_\Desktop\delft\3\earthy\areas and conncetions.xlsx")
excelread = ExcelReader(ReadExcelData=toggle, WorkbookPath=path, WorksheetName="Sheet1")  # -> Exceptions, ExcelData
cull_i = CullIndex(List=excelread.ExcelData, Indices=Slider(0, range=0..100), Wrap=True)  # -> simplify(List)
cull_i_2 = CullIndex(List=cull_i, Indices=Slider(11, range=0..100), Wrap=True)  # -> simplify(List)
tbi = TreeBranchIndex(DataTree=cull_i_2, BranchIndex=Slider(1, range=0..1))
tbi_2 = TreeBranchIndex(DataTree=cull_i_2, BranchIndex=0)

# ----
# Python placing starting locations and connections for kangaroo
# x and y denote number of grid points in respective directions.
# 
# x1 and y1 denote distance between points in respective directions.
# 
# Galapagos can be used to minimise starting distances of important connections between programes.
number_slider = Slider(30, range=0..100)
number_slider_2 = Slider(3.5, range=0..5)
number_slider_3 = Slider(30, range=0..100)
number_slider_4 = Slider(3.5, range=0..5)
number_slider_5 = Slider(70459, range=0..100000)
python = GhPythonScript(
    x=number_slider,
    x1=number_slider_2,
    y=number_slider_3,
    y1=number_slider_4,
    seed=number_slider_5,
    Names=tbi_2,
    Areas=tbi,
    excel=cull_i_2)  # -> out, locations, circles, connections, remaining_grid, radii, strength, restlength, relevant_connections; inputs x: Int32, y: Int32, seed: Int32, Names: list, Areas: list, excel: tree
# ---------- python: Python ----------
import rhinoscriptsyntax as rs
import Rhino.Geometry as rg
import random as rn
import math

rn.seed(seed)

#reading from excel
name_list = Names
area_list = Areas

class space:
    def __init__(self, name, area):
        self.name = name
        self.area = area
        
    def SetLocation(self,location):
        self.location = location
        self.radius = math.sqrt(self.area/math.pi)
        self.circle = rg.Circle(self.location, self.radius)

def CreateGrid(xspan,yspan,xsize,ysize):
    pt_list = []
    for i in range(xspan):
        for j in range(yspan):
            pt_list.append(rg.Point3d(i*xsize,j*ysize,0.0))
    return pt_list

#setting up grid
pt_list_unused = CreateGrid(x,y,x1,y1)
pt_list_used = []

#setting up data storage and output lists
space_list=[]
circle_list = []
test_list = []
strength_list = []
ln_list = []
radius_list = []
restlength_list = []
relevance_list = []

#positioning spaces
for i in range(len(name_list)):
    newspace = space(name_list[i],area_list[i])
    pt = pt_list_unused[rn.randint(0,len(pt_list_unused)-1)]
    newspace.SetLocation(pt)
    if i!=0:
        j = 0
        while j < len(space_list):
            for spaces in space_list:
                _distance = rg.Point3d.DistanceTo(spaces.circle.Center,newspace.circle.Center)
                if _distance < (newspace.radius + spaces.radius):
                    newspace = space(name_list[i],area_list[i])
                    pt = pt_list_unused[rn.randint(0,len(pt_list_unused)-1)]
                    newspace.SetLocation(pt)
                    j = 0
                else:
                    j += 1
    pt_list_unused.remove(pt)
    pt_list_used.append(pt)
    space_list.append(newspace)
    circle_list.append(newspace.circle)
    radius_list.append(newspace.radius)

#connections between spaces
for i in range((_excel.BranchCount)-2):
    for j in range(len(_excel.Branch(i+2))):
        if space_list[i].location!=space_list[j].location:
            strength_list.append(int(_excel.Branch(i+2)[j]))
            ln_list.append(rg.Line(space_list[i].location,space_list[j].location))
            d = space_list[i].radius + space_list[j].radius
            restlength_list.append(d)
        if int(_excel.Branch(i+2)[j]) == 1:
            relevance_list.append(rg.Line(space_list[i].location,space_list[j].location))

locations = pt_list_used
circles = circle_list
connections = ln_list
remaining_grid = pt_list_unused
radii = radius_list
strength = strength_list
restlength = restlength_list
relevant_connections = relevance_list
# ---------- end python ----------
len = Length(Curve=python.relevant_connections)
line = Line(python.relevant_connections)
ma = MassAddition(Input=len)  # -> Result, PartialResults
galapagos = Galapagos(fitness=ma, gene=number_slider_5)
total_starting_distance_of_important_con = Panel(ma.Result)  # "Total Starting Distance of important connections"

# ----
# Kangaroo
# Set strength of pulling.
# 
# Reset simulation and enable timer.
number_slider_6 = Slider(6, range=0..20)
strength = Number(python.strength)
connections = Line(python.connections)
multiplication = Multiplication(A=strength, B=number_slider_6)
neg = Negative(Value=multiplication)
rest_length = Number(python.restlength)
springs = SpringsFromLine(
    Connection=connections,
    Stiffness=1000,
    Damping=10,
    RestLength=rest_length,
    UpperCutoff=rest_length,
    LowerCutoff=0,
    Plasticity=0)
plaw = PowerLaw(Connection=connections, Exponents=0, Strength=neg, Cutoff=0)
timer = Timer(TimerInterval=20, Target=kangaroo)  # disabled
kangaroo = KangarooPhysics(ForceObjects=[springs, plaw], Settings=null, SimulationReset=Toggle(False))  # -> Out, Iterations, ParticlesOut, GeometryOut, KE
radii = Number(python.radii)
cir = Circle(Plane=kangaroo.ParticlesOut, Radius=radii)
swatch = ColourSwatch(SwatchColor=RGB(0, 0, 0))
xy = XYPlane(Origin=cir)
tag = TextTag(Location=xy, Text=tbi_2, Colour=swatch)
preview = CustomPreview(Geometry=cir, Material=swatch)

# ----
# Boundary
multiplication_2 = Multiplication(A=number_slider, B=number_slider_2)
multiplication_3 = Multiplication(A=number_slider_3, B=number_slider_4)
rectangle = Rectangle(Plane=PlaneXY(0, 0, 0), XSize=multiplication_2, YSize=multiplication_3, Radius=0)  # -> Rectangle, Length
