# Grasshopper definition BubbleToLayout.gh (Grasshopper 1.0.7)
# plug-ins: Kangaroo Components, LunchBox

# ---- group: Read excel file
# Excel file "schedule-1_201810"
toggle = BooleanToggle(True)
path = FilePath("E:\TU DELFT\EARTHY\PYTHON TRIALS\schedule-1_201810.xlsx")
excelread = ExcelReader(ReadExcelData=toggle, WorkbookPath=path, WorksheetName="Sheet1")  # -> Exceptions, ExcelData

# ----
lng = ListLength(List=excelread.ExcelData)
lng_2 = ListLength(List=flatten(lng))  # -> expr("x-1", Length)
series = Series(Start=1, Step=1, Count=expr("x-1", lng_2))
branch = TreeBranch(Tree=excelread.ExcelData, Path="{0}", MaintainPaths=True)
branch_2 = TreeBranch(Tree=excelread.ExcelData, Path=series, MaintainPaths=True)
branch_3 = TreeBranch(Tree=excelread.ExcelData, Path=lng_2, MaintainPaths=True)
cull_i = CullIndex(List=branch_2, Indices=0, Wrap=True)  # -> simplify(List)
cull_i_2 = CullIndex(List=branch, Indices=0, Wrap=True)
cull_i_3 = CullIndex(List=branch_3, Indices=0, Wrap=True)

# ---- group: Origin points location selection
# CHANGE SEED
number_slider = Slider(10, range=0..10)

# ----
panel = Panel(cull_i_2)

# ----
# RESET SIMULATION
button = Button()

# ----
# ACTIVATE TIMER FOR SIMULATION
timer = Timer(TimerInterval=20, Target=kangaroo)  # disabled

# ---- group: Origin points location selection
lng_3 = ListLength(List=cull_i_2)

# 0 for points on circle
# 1 for random points on XY plane
number_slider_2 = Slider(100, range=-1..100)
cir = Circle(Plane=PlaneXY(0, 0, 0), Radius=number_slider_2)
divide = DivideCurve(Curve=cir, Count=lng_3, Kinks=False)  # -> Points, Tangents, Parameters

pop2d = Populate2D(Region={Plane=PlaneXY(1, -5, 0), Size=Domain2(u=-123..123, v=-115..115)}, Count=lng_3, Seed=number_slider)

filter = StreamFilter(Gate=Slider(0, range=0..1), Stream0=divide.Points, Stream1=pop2d)
pt = Point(filter)

# ---- group: Attractive and repulsive forces based on REL matrix
python = GhPythonScript(matrix=cull_i, multiplier=Slider(20, range=0..100))  # -> out, weights; inputs matrix: tree, multiplier: Int32
# ---------- python: Python ----------
"""Provides list of attraction and repulsion factors based on REL chart.
    Inputs:
        matrix: The REL chart as a tree
    Output:
        weights: The attraction and repulsion factors to be used in Kangaroo"""

__author__ = "nchristidi"
__version__ = "2018.09.21"

import rhinoscriptsyntax as rs

rels = []
colNumber = matrix.BranchCount
for i in range(colNumber):
    col = matrix.Branch(i)
    for j in range (len(col)):
        if i>j:
            rel = -float(col[j])*multiplier
            rels.append(rel)
            
weights = rels
# ---------- end python ----------
inter = InterconnectPoints(Pts=pt)

# ---- group: Circle radii definition
end = EndPoints(Curve=graft(inter))  # -> Start, End
mindex = MemberIndex(Set=pt, Member=[end.Start, end.End])  # -> Index, Count
division = Division(A=cull_i_3, B=20)
pshift = ShiftPaths(Data=mindex.Index, Offset=-1)
num = Number(division)
item = ListItem(List=num, Index=pshift, Wrap=True)
ma = MassAddition(Input=item)  # -> flatten(Result), PartialResults

# ----
avr = Average(Input=pt)

# ---- group: Attractive forces to centroid
ln = Line(StartPoint=pt, EndPoint=avr)
# Force objects
plaw = PowerLaw(Connection=ln, Exponents=0, Strength=Slider(-68.502, range=-100..0), Cutoff=0)

# ---- group: Att and Rep forces in pairs
plaw_2 = PowerLaw(Connection=inter, Exponents=0, Strength=python.weights, Cutoff=0)  # -> flatten(PowerLaw)

# ----
springs = SpringsFromLine(Connection=inter, Stiffness=1000, Damping=10, RestLength=ma.Result, UpperCutoff=ma.Result, LowerCutoff=0, Plasticity=0)

# ---- group: Kangaroo solver
kangaroo = KangarooPhysics(ForceObjects=flatten([springs, plaw_2, plaw]), AnchorPoints=avr, Settings=null, Geometry=pt, SimulationReset=button)  # -> Out, Iterations, ParticlesOut, GeometryOut, KE

# ----
kinetic_energy = Panel(kangaroo.KE)
iterations = Panel(kangaroo.Iterations)

# ---- group: Connections weight "1"
python_2 = GhPythonScript(pts=kangaroo.GeometryOut, matrix=cull_i)  # -> out, lines_1; inputs pts: list of Point3d, matrix: tree
# ---------- python_2: Python ----------
"""Draws the most important connections as lines, based on REL chart.
    Inputs:
        pts: Bubbles centre points, representing spaces
        matrix: REL chart as a tree
    Output:
        lines_1: List of the most important connections"""

__author__ = "nchristidi"
__version__ = "2018.09.21"

import rhinoscriptsyntax as rs
import Rhino.Geometry as rg

lines = []
colNumber = matrix.BranchCount
for i in range(colNumber):
    col = matrix.Branch(i)
    for j in range (len(col)):
        if i>j:
            if col[j]=="1":
                line = rg.Line(pts[i],pts[j])
                lines.append(line)

lines_1 = lines
# ---------- end python_2 ----------
crv = Curve(python_2.lines_1)

# ---- group: Circles
cir_2 = Circle(Plane=kangaroo.GeometryOut, Radius=num)
area = Area(Geometry=cir_2)  # -> Area, Centroid
srf = Surface(cir_2)

# ---- group: Outputs
inter_2 = InterconnectPoints(Pts=area.Centroid)
item_2 = ListItem(List=srf, Index=[0, 1, 2, 3, 4, 5, 6, 7, 8], Wrap=True)
item_3 = ListItem(List=srf, Index=9, Wrap=True)
item_4 = ListItem(List=srf, Index=10, Wrap=True)
item_5 = ListItem(List=srf, Index=11, Wrap=True)
# Most important connections
preview = CustomPreview(Geometry=crv, Material=ColourSwatch(SwatchColor=RGBA(255, 255, 255, 48)))
# Space names
tag = TextTag(Location=area.Centroid, Text=cull_i_2, Colour=ColourSwatch(SwatchColor=RGB(0, 0, 0)))
preview_2 = CustomPreview(Geometry=item_2, Material=ColourSwatch(SwatchColor=RGB(4, 105, 122)))
preview_3 = CustomPreview(Geometry=item_3, Material=ColourSwatch(SwatchColor=RGB(255, 132, 0)))
# Space bubbles
preview_4 = CustomPreview(Geometry=item_4, Material=ColourSwatch(SwatchColor=RGB(99, 73, 39)))
preview_5 = CustomPreview(Geometry=item_5, Material=ColourSwatch(SwatchColor=RGB(0, 187, 255)))
