# Grasshopper definition roofTypologies.gh (Grasshopper 1.0.7)
# plug-ins: LunchBox, Kangaroo2 Components

# ---- group: General settings
span_m = Slider(3, range=0..10)

# ---- group: Vault settings
extrusion_lenght_m = Slider(3, range=0..100)

# ----
nr_of_divisions_in_span_direction = Slider(10, range=0..50)
nr_of_divisions_in_perpendicular_directi = Slider(10, range=0..50)  # "Nr of divisions in perpendicular direction"
rectangle = Rectangle(Plane=PlaneXY(0, 0, 0), XSize=span_m, YSize=extrusion_lenght_m, Radius=0)  # -> Rectangle, Length

# ----
# RESET TOOL
reset = Button()
data = Data([span_m, nr_of_divisions_in_span_direction, nr_of_divisions_in_perpendicular_directi, extrusion_lenght_m])
dam = DataDam(DataA=data, BufferDelay=2500000, BufferMode=2)
equals = Equality(FirstNumber=data, SecondNumber=dam)  # -> Equality, Inequality
ma = MassAddition(Input=equals.Inequality)  # -> Result, PartialResults
bool = Boolean(ma.Result)

# ----
# Creating grid
gridbraced2d = BracedGrid2DStructure(
    Surface=rectangle.Rectangle,
    UDivisions=nr_of_divisions_in_span_direction,
    VDivisions=nr_of_divisions_in_perpendicular_directi)  # -> PrimaryLines, BraceLines, StructureNodes
addition = Addition(A=nr_of_divisions_in_perpendicular_directi, B=1)
addition_2 = Addition(A=nr_of_divisions_in_perpendicular_directi, B=1)
explode = Explode(Curve=rectangle.Rectangle, Recursive=True)  # -> Segments, Vertices
cull = CullPattern(List=explode.Segments, CullPattern=invert([True, False]))
diagonals = Line(gridbraced2d.BraceLines)
edges = Line(gridbraced2d.PrimaryLines)
mcx = MultipleCurves(Curves=edges)  # -> Points, IndexA, IndexB, ParamA, ParamB
cullpt = CullDuplicates(Points=mcx.Points, Tolerance=0.1, CullMode=3)  # -> Points, Indices, Valence
pdecon = Deconstruct(Point=cullpt.Points)  # -> XComponent, YComponent, ZComponent
lng = ListLength(List=cullpt.Points)
sort = SortList(Keys=pdecon.XComponent, ValuesA=cullpt.Points)  # -> Keys, ValuesA
subtraction = Subtraction(A=lng, B=addition)
split = SplitList(List=sort.ValuesA, Index=subtraction)  # -> ListA, ListB
split_2 = SplitList(List=sort.ValuesA, Index=addition_2)  # -> ListA, ListB
supports = Point(flatten([split_2.ListA, split.ListB]))
points = Point(sort.ValuesA)

# ----
# Form-finding vault
crv = Curve(cull)

stiffness_edges = Slider(500, range=1..1500)
stiffness_diagonals = Slider(1, range=1..1500)
force = Slider(43, range=0..1000)

# ----
# Kangaroo!
# Edges
# Diagonals
# Force points
# Supports
# Curve for patch
# (supports)
pt = Point(flatten(points))
crv_2 = Curve(crv)
line = Line(diagonals)
pt_2 = Point(supports)
line_2 = Line(edges)
Z = UnitZ(Factor=force)
anchor = Anchor(Point=pt_2, Strength=1000000000)
length_line = LengthLine(Line=line_2, Strength=stiffness_edges)
length_line_2 = LengthLine(Line=line, Strength=stiffness_diagonals)
load = Load(Point=pt, ForceVector=Z)
solver = Solver(
    GoalObjects=[length_line, length_line_2, anchor, load],
    Reset=[bool, reset],
    Threshold=1e-15,
    Tolerance=0.01,
    On=Toggle(True))  # -> I, V, flatten(O)

# ----
# Rectangle
dom = ConstructDomain(DomainStart=expr("-x", span_m), DomainEnd=span_m)
dom_2 = ConstructDomain(DomainStart=expr("-x", span_m), DomainEnd=span_m)
rectangle_2 = Rectangle(Plane=PlaneXY(0, 0, 0), XSize=dom, YSize=dom_2, Radius=0)  # -> Rectangle, Length
rec = Rectangle(rectangle_2.Rectangle)
explode_2 = Explode(Curve=rec, Recursive=True)  # -> Segments, Vertices
area = Area(Geometry=rec)  # -> Area, Centroid
item = ListItem(List=explode_2.Vertices, Index=0, Wrap=True)
item_2 = ListItem(List=explode_2.Segments, Index=0, Wrap=True)
eval = EvaluateCurve(Curve=reparameterize(item_2), Parameter=0.5)  # -> Point, Tangent, Angle
dist = Distance(PointA=area.Centroid, PointB=item)

# ----
# Approximate surface
null = NullItem(Item=solver.O)  # -> NullFlags, InvalidFlags, Description
addition_3 = Addition(A=nr_of_divisions_in_span_direction, B=1)
cull_2 = CullPattern(List=solver.O, CullPattern=invert(null.NullFlags))
end = EndPoints(Curve=cull_2)  # -> Start, End
merge = Merge(Data1=end.Start, Data2=end.End)
cullpt_2 = CullDuplicates(Points=merge, Tolerance=0.1, CullMode=3)  # -> Points, Indices, Valence
pdecon_2 = Deconstruct(Point=cullpt_2.Points)  # -> XComponent, YComponent, ZComponent
sort_2 = SortList(Keys=pdecon_2.YComponent, ValuesA=cullpt_2.Points)  # -> Keys, ValuesA
lng_2 = ListLength(List=sort_2.ValuesA)
subtraction_2 = Subtraction(A=lng_2, B=addition_3)
split_3 = SplitList(List=sort_2.ValuesA, Index=addition_3)  # -> ListA, ListB
split_4 = SplitList(List=sort_2.ValuesA, Index=subtraction_2)  # -> ListA, ListB
pt_3 = Point(split_3.ListA)
pt_4 = Point(split_4.ListB)
pdecon_3 = Deconstruct(Point=pt_3)  # -> XComponent, YComponent, ZComponent
pdecon_4 = Deconstruct(Point=pt_4)  # -> XComponent, YComponent, ZComponent
sort_3 = SortList(Keys=pdecon_3.XComponent, ValuesA=pt_3)  # -> Keys, ValuesA
sort_4 = SortList(Keys=pdecon_4.XComponent, ValuesA=pt_4)  # -> Keys, ValuesA
intcrv = Interpolate(Vertices=sort_3.ValuesA, Degree=3, Periodic=False, KnotStyle=1)  # -> Curve, Length, Domain
intcrv_2 = Interpolate(Vertices=sort_4.ValuesA, Degree=3, Periodic=False, KnotStyle=1)  # -> Curve, Length, Domain
loft_opt = LoftOptions(Closed=False, Adjust=False, Rebuild=Slider(100, range=0..100), Refit=0, Type=2)
loft = Loft(Curves=[intcrv.Curve, intcrv_2.Curve], Options=loft_opt)
mesh_uv = MeshSurface(
    Surface=loft,
    UCount=expr("x*5", nr_of_divisions_in_span_direction),
    VCount=expr("x*5", nr_of_divisions_in_perpendicular_directi),
    Overhang=True,
    Equalize=False)

# ----
# Semisphere
xy = XYPlane(Origin=Point(0, 0, 0))
sph = Sphere(Base=PlaneXY(0, 0, 0), Radius=dist)
sec = BrepPlane(Brep=sph, Plane=xy)  # -> Curves, Points
srfsplit = SurfaceSplit(Surface=sph, Curves=sec.Curves)
area_2 = Area(Geometry=srfsplit)  # -> Area, Centroid
pdecon_5 = Deconstruct(Point=area_2.Centroid)  # -> XComponent, YComponent, ZComponent
sort_5 = SortList(Keys=pdecon_5.ZComponent, ValuesA=srfsplit)  # -> Keys, ValuesA
rev = ReverseList(List=sort_5.ValuesA)
item_3 = ListItem(List=rev, Index=0, Wrap=True)

xz = XZPlane(Origin=eval.Point)
cyl = Cylinder(Base=xz, Radius=span_m, Length=expr("-2*x", span_m))
rotate = Rotate(Geometry=cyl, Angle=1.570796327, Plane=area.Centroid)  # -> Geometry, Transform
srf = Surface(cyl)
srf_2 = Surface(rotate.Geometry)

bbx = BrepBrep(BrepA=[srf, srf_2], BrepB=item_3)  # -> flatten(Curves), Points
srfsplit_2 = SurfaceSplit(Surface=item_3, Curves=bbx.Curves)
num = Number(expr("2*x", span_m))
dom_3 = ConstructDomain(DomainStart=0, DomainEnd=span_m)
dom_4 = ConstructDomain(DomainStart=0, DomainEnd=span_m)
X = UnitX(Factor=span_m)
item_4 = ListItem(List=srfsplit_2, Index=0, Wrap=True)
move = Move(Geometry=item_4, Motion=X)  # -> Geometry, Transform
box = DomainBox(Base=PlaneXY(0, 0, 0), X=dom_3, Y=dom_4, Z=num)
Y = UnitY(Factor=span_m)
X_2 = UnitX(Factor=expr("-x", span_m))
move_2 = Move(Geometry=move.Geometry, Motion=Y)  # -> Geometry, Transform
bbx_2 = BrepBrep(BrepA=box, BrepB=item_4)  # -> Curves, Points
bbx_3 = BrepBrep(BrepA=box, BrepB=move.Geometry)  # -> Curves, Points
bbx_4 = BrepBrep(BrepA=box, BrepB=move_2.Geometry)  # -> Curves, Points
move_3 = Move(Geometry=move_2.Geometry, Motion=X_2)  # -> Geometry, Transform
bbx_5 = BrepBrep(BrepA=box, BrepB=move_3.Geometry)  # -> Curves, Points
srfsplit_3 = SurfaceSplit(Surface=item_4, Curves=bbx_2.Curves)
srfsplit_4 = SurfaceSplit(Surface=move.Geometry, Curves=bbx_3.Curves)
srfsplit_5 = SurfaceSplit(Surface=move_2.Geometry, Curves=bbx_4.Curves)
srfsplit_6 = SurfaceSplit(Surface=move_3.Geometry, Curves=bbx_5.Curves)
item_5 = ListItem(List=srfsplit_3, Index=Slider(2, range=0..5), Wrap=True)
item_6 = ListItem(List=srfsplit_4, Index=Slider(4, range=0..5), Wrap=True)
item_7 = ListItem(List=srfsplit_5, Index=Slider(6, range=0..6), Wrap=True)
item_8 = ListItem(List=srfsplit_6, Index=Slider(2, range=0..6), Wrap=True)

# ----
# Rotate vault
area_3 = Area(Geometry=loft)  # -> Area, Centroid
pdecon_6 = Deconstruct(Point=area_3.Centroid)  # -> XComponent, YComponent, ZComponent
pt_5 = ConstructPoint(XCoordinate=pdecon_6.XComponent, YCoordinate=pdecon_6.YComponent, ZCoordinate=0)
rotate_2 = Rotate(Geometry=loft, Angle=1.570796327, Plane=pt_5)  # -> Geometry, Transform

srf_3 = Surface(loft)
srf_4 = Surface(rotate_2.Geometry)

bbx_6 = BrepBrep(BrepA=srf_3, BrepB=srf_4)  # -> Curves, Points
srfsplit_7 = SurfaceSplit(Surface=srf_3, Curves=bbx_6.Curves)
srfsplit_8 = SurfaceSplit(Surface=srf_4, Curves=bbx_6.Curves)

item_9 = ListItem(List=srfsplit_7, Index=[1, 3], Wrap=True)
item_10 = ListItem(List=srfsplit_8, Index=[0, 2], Wrap=True)
item_11 = ListItem(List=srfsplit_7, Index=[0, 1], Wrap=True)
item_12 = ListItem(List=srfsplit_8, Index=[2, 3], Wrap=True)
item_13 = ListItem(List=srfsplit_7, Index=[1, 2], Wrap=True)
item_14 = ListItem(List=srfsplit_8, Index=[3, 0], Wrap=True)
item_15 = ListItem(List=srfsplit_7, Index=[2, 3], Wrap=True)
item_16 = ListItem(List=srfsplit_8, Index=[0, 1], Wrap=True)
item_17 = ListItem(List=srfsplit_7, Index=[3, 0], Wrap=True)
item_18 = ListItem(List=srfsplit_8, Index=[1, 2], Wrap=True)
item_19 = ListItem(List=srfsplit_7, Index=3, Wrap=True)
item_20 = ListItem(List=srfsplit_8, Index=[1, 2, 0], Wrap=True)
item_21 = ListItem(List=srfsplit_7, Index=[1, 2, 3], Wrap=True)
item_22 = ListItem(List=srfsplit_8, Index=0, Wrap=True)
item_23 = ListItem(List=srfsplit_7, Index=1, Wrap=True)
item_24 = ListItem(List=srfsplit_8, Index=[0, 2, 3], Wrap=True)
item_25 = ListItem(List=srfsplit_7, Index=[0, 1, 3], Wrap=True)
item_26 = ListItem(List=srfsplit_8, Index=2, Wrap=True)

sunion = SolidUnion(Breps=[item_9, item_10])
sunion_2 = SolidUnion(Breps=[item_11, item_12])
sunion_3 = SolidUnion(Breps=[item_13, item_14])
sunion_4 = SolidUnion(Breps=[item_15, item_16])
sunion_5 = SolidUnion(Breps=[item_17, item_18])
sunion_6 = SolidUnion(Breps=[item_19, item_20])
sunion_7 = SolidUnion(Breps=[item_21, item_22])
sunion_8 = SolidUnion(Breps=[item_23, item_24])
sunion_9 = SolidUnion(Breps=[item_25, item_26])

brep = Brep(sunion_7)
brep_2 = Brep(sunion_8)
brep_3 = Brep(sunion_9)
brep_4 = Brep(sunion_6)

# ---- group: Lookup table
# Check lookup table indices here
number_slider = Slider(3, range=0..10)
srf_5 = Surface(srf_3)
srf_6 = Surface(srf_4)
brep_5 = Brep(sunion_5)
srf_7 = Surface(item_6)
srf_8 = Surface(item_7)
srf_9 = Surface(item_8)
brep_6 = Brep(sunion)
brep_7 = Brep(sunion_2)
brep_8 = Brep(sunion_3)
brep_9 = Brep(sunion_4)
srf_10 = Surface(item_5)
filter = StreamFilter(
    Gate=number_slider,
    Stream0=flatten(srf_5),
    Stream1=flatten(srf_6),
    Stream2=flatten(brep_6),
    Stream3=flatten(brep_7),
    Stream4=flatten(brep_8),
    Stream5=flatten(brep_9),
    Stream6=flatten(brep_5),
    Stream7=flatten(brep_4),
    Stream8=flatten(brep),
    Stream9=flatten(brep_2),
    Stream10=flatten(brep_3),
    Stream11=flatten(srf_10),
    Stream12=flatten(srf_7),
    Stream13=flatten(srf_8),
    Stream14=flatten(srf_9))
gate = StreamGate(Stream=filter, Gate=Toggle(True))  # -> Target0, Target1
preview = CustomPreview(Geometry=gate.Target1, Material=ColourSwatch(SwatchColor=RGB(115, 115, 115)))

# ----
merge_2 = Merge(
    Data1=flatten(srf_5),
    Data2=flatten(srf_6),
    Data3=flatten(brep_6),
    Data4=flatten(brep_7),
    Data5=flatten(brep_8),
    Data6=flatten(brep_9),
    Data7=flatten(brep_5),
    Data8=flatten(sunion_6),
    Data9=flatten(sunion_7),
    Data10=flatten(sunion_8),
    Data11=flatten(sunion_9),
    Data12=flatten(srf_10),
    Data13=flatten(srf_7),
    Data14=flatten(srf_8),
    Data15=flatten(srf_9))
item_27 = ListItem(List=merge_2, Index=Slider(6, range=0..14), Wrap=True)

# ---- group: Configuration based on lookup table
# Read excel file with configuration
# based on lookup table
# |
# |
# 
# Insert excel sheet here
toggle = BooleanToggle(True)
path = FilePath("E:\TU DELFT\EARTHY\PYTHON TRIALS\roofMatrix002.xlsx")
excelread = ExcelReader(ReadExcelData=toggle, WorkbookPath=path, WorksheetName="Sheet1")  # -> Exceptions, ExcelData
lng_3 = ListLength(List=excelread.ExcelData)  # -> flatten(Length)
lng_4 = ListLength(List=lng_3)
item_28 = ListItem(List=lng_3, Index=0, Wrap=True)
num_2 = Number(span_m)
recgrid = Rectangular(Plane=PlaneXY(0, 0, 0), SizeX=num_2, SizeY=expr("-x", num_2), ExtentX=lng_4, ExtentY=item_28)  # -> Cells, Points
pt_6 = Point(simplify(recgrid.Points))
python = GhPythonScript(roofMatrix=excelread.ExcelData, pts=pt_6, roofTypes=merge_2)  # -> out, roofs; inputs roofMatrix: tree of Int32, pts: tree of Point3d, roofTypes: list
# ---------- python: Python ----------
"""Creates roof configuration based on lookup table.
    Inputs:
        roofMatrix: The 2D matrix (as a tree) containing the configuration (int).
        pts: The grid points (as a tree) where the roof units are placed (Point3d).
        roofTypes: The list of roof types.
    Output:
        roofs: The roof configuration."""

__author__ = "nchristidi"
__version__ = "2018.09.28"

#Libraries
import rhinoscriptsyntax as rs
import Rhino.Geometry as rg
from copy import copy

#Definitions
orPoint = rg.Point3d(0,0,0)
stPoints = []
roofs = []

#Create starting points list
for i in range(pts.BranchCount-1):
    branchList = pts.Branch(i)
    
    for j in range(branchList.Count-1):
        stPoints.append(branchList[j])

#Main loop
for i in range(len(roofTypes)):
    roofTypes[i] = rs.coercebrep(roofTypes[i])
for i in range(roofMatrix.BranchCount):
    branchList = roofMatrix.Branch(i)
    pointsColumn = pts.Branch(i)
    for j in range(branchList.Count):
        currentPt = pointsColumn[j]
        vector = currentPt - orPoint
        pointer = branchList[j]
        roofCopy = copy(roofTypes[pointer])
        roofCopy.Translate(vector)
        roofs.append(roofCopy)
# ---------- end python ----------
panel = Panel(excelread.ExcelData)
preview_2 = CustomPreview(Geometry=python.roofs, Material=ColourSwatch(SwatchColor=RGB(115, 115, 115)))
