# Grasshopper definition Bricklayingwithgaps.gh (Grasshopper 1.0.7)

# ----
# _top_pt is the highest point of the surface.
# 
# _btm_pt is the lowest point of the surface.
# 
# _brick_brep is the brep of the desired brick geometry. Currently it is set as an internalised data.
# 
# _brick spacing is the gap between the bricks.
# 
# _brick_d is the length of the brick. It should correspond to _brick_brep for the best results, but it can be manually set.
brick_d = Slider(105, range=50..150)
brick_spacing = Slider(50, range=0..100)
addition = Addition(A=brick_spacing, B=brick_d)
pt = Point(<point referenced from the Rhino model>)
pt_2 = Point(<point referenced from the Rhino model>)
srf = Surface(<surface referenced from the Rhino model>)
python = PythonScript(
    top_pt=pt,
    btm_pt=pt_2,
    srf=srf,
    brick_brep={Plane=PlaneXY(0, 0, 28.5), X=Domain(-46, 46), Y=Domain(-101.5, 101.5), Z=Domain(-28.5, 28.5)},
    brick_z=57,
    brick_spacing=addition,
    brick_d=brick_d)  # -> out, a
# ---------- python: Python ----------
import rhinoscriptsyntax as rs
import Rhino.Geometry as rg
import math

#function for calculating distance between bricks
def BrickDistance(t,pt_list,crv):
    pt_list = []
    for _k1 in t:
        pt_list.append(crv.PointAt(_k1))
    _p1 = pt_list[0]
    _p2 = pt_list[1]
    _d = _p1.DistanceTo(_p2)
    return _d

#function for placing the bricks.
def BrickPlacing(Frame,Brep,List):
    _t = rg.Transform.PlaneToPlane(rs.WorldXYPlane(),Frame)
    x = Brep.Duplicate()
    rg.Brep.Transform(x,_t)
    List.append(x)

#converting object IDs into geometries
_srf = rs.coercesurface(_srf)
_top_pt = rs.coerce3dpoint(_top_pt)
_btm_pt = rs.coerce3dpoint(_btm_pt)
_brick_brep = rs.coercebrep(_brick_brep)

_brep = rg.Surface.ToBrep(_srf)
_l1 = []

#create the contour lines vertically through the geometry
"""
it is understood that _btm_pt and _top_pt should be acquired by creating a
bounding box from the brep and then extracting one of the vertical sides and
choosing its start and end points. but it's omitted in this code.
"""
_crvlist=rg.Brep.CreateContourCurves(_brep,_btm_pt,_top_pt,_brick_z)

for i in range(len(_crvlist)):
    #determining number of bricks per contour line.
    """
    This part of the script enables the user to have controlled gaps
    in between the bricks, resulting in the gaps seen at the bottom of the 
    geometry, and it reduces as the bricks get closer as we approach the
    higher portions, until the bricks get too close and the number of bricks
    is recalibrated.
    """
    if i >0:
        _t1 = _crvlist[i].DivideByCount(len(_ptlist)-1,True)
        _d = BrickDistance(_t1,_ptlist,_crvlist[i])
        #checking distance between bricks to ensure its far enough.
        #Otherwise, re-divide the contour line with less bricks.
        if len(_ptlist)>2:
            while _d < _brick_d and len(_t1)>2:
                _t1 = _crvlist[i].DivideByCount(len(_ptlist)-2,True)
                _ptlist = []
                for _k1 in _t1:
                    _ptlist.append(_crvlist[i].PointAt(_k1))
                _p1 = _ptlist[0]
                _p2 = _ptlist[1]
                _d = _p1.DistanceTo(_p2)
    else:
        _ptlist = _crvlist[i].DivideEquidistant(_brick_spacing)
    
    #placing the bricks. Uses frames along the contour line.
    #odd/even placement.
    for j in range(len(_ptlist)):
        (_result,_t) = _crvlist[i].ClosestPoint(_ptlist[j])
        if _result:                        
            (_temp,_frame) = _crvlist[i].FrameAt(_t)
            rg.Plane.Rotate(_frame,math.pi/2,rg.Vector3d(0.0,0.0,1.0))
            if i%2==0:
                if j%2==0:
                    BrickPlacing(_frame,_brick_brep,_l1)
            else:
                if j%2!=0:
                    BrickPlacing(_frame,_brick_brep,_l1)

a = _l1
# ---------- end python ----------
panel = Panel(python.a)
