# Grasshopper definition brickPatternsGeneral.gh (Grasshopper 1.0.7)

# ---- group: Input
number_slider = Slider(3.71, range=0..10)
number_slider_2 = Slider(0.1, range=0..1)
number_slider_3 = Slider(0.225, range=0..1)
number_slider_4 = Slider(0.1125, range=0..1)
number_slider_5 = Slider(0.075, range=0..0.1)
number_slider_6 = Slider(2.42, range=0..10)

# ---- group: Patterns
python = GhPythonScript(
    length=number_slider,
    width=number_slider_2,
    height=number_slider_6,
    brLength=number_slider_3,
    brWidth=number_slider_4,
    brHeight=number_slider_5)  # -> out, a
# ---------- python: Python ----------
"""Stretcher bond."""

__author__ = "nchristidi"
__version__ = "2018.10.07"

import Rhino.Geometry as rg

class brickWall:
    def __init__ (self, length, width, height):
        self.length = length
        self.width = width
        self.height = height
        self.orPt = rg.Point3d(0, width,0)
        self.peakPt = rg.Point3d(0, width, height)
    def createWall (self):
        basePlane = rg.Plane.WorldXY
        xSize = rg.Interval(0, self.length)
        ySize = rg.Interval(0, self.width)
        zSize = rg.Interval(0, self.height)
        wall = rg.Box(basePlane, xSize, ySize, zSize)
        wall = wall.ToBrep()
        return wall

class brick:
    def __init__ (self, length, width, height):
        self.length = length
        self.width = width
        self.height = height
    def stretcher (self, orPt):
        basePlane = rg.Plane.WorldXY
        xSize = rg.Interval(orPt[0], orPt[0]+self.length)
        ySize = rg.Interval(orPt[1], orPt[1]-self.width)
        zSize = rg.Interval(orPt[2], orPt[2]+self.height)
        brick = rg.Box(basePlane, xSize, ySize, zSize)
        return brick
    def halfBrick (self, orPt):
        basePlane = rg.Plane.WorldXY
        xSize = rg.Interval(orPt[0], orPt[0]+self.length/2)
        ySize = rg.Interval(orPt[1], orPt[1]-self.width)
        zSize = rg.Interval(orPt[2], orPt[2]+self.height)
        brick = rg.Box(basePlane, xSize, ySize, zSize)
        return brick

bw = brickWall(length, width, height)
b = brick(brLength, brWidth, brHeight)
wall = bw.createWall()
faces = wall.Faces
face = faces.ExtractFace(2)
contours = rg.Brep.CreateContourCurves(face, bw.orPt, bw.peakPt, brHeight)
bricks = []
counter = 0
for contour in contours:
    contour.Reverse()
    contour.Domain = rg.Interval(0,1)
    t = contour.DivideByLength(brLength/2, True)
    listL= len(t)
    for i in range(len(t)-1):
        pt = contour.PointAt(t[i])
        if counter%2==0:
            if i==0:
                bricks.append(b.halfBrick(pt))
            elif i%2==1:
                bricks.append(b.stretcher(pt))
        else:
            if i%2==0:
                bricks.append(b.stretcher(pt))
    pt = contour.PointAt(t[len(t)-1])
    if listL%2==0:
        if counter%2==0:
            bricks.append(b.halfBrick(pt))
    else:
        if counter%2==1:
            bricks.append(b.halfBrick(pt))
    counter +=1

a = bricks
# ---------- end python ----------
python_2 = GhPythonScript(
    length=number_slider,
    width=number_slider_2,
    height=number_slider_6,
    brLength=number_slider_3,
    brWidth=number_slider_4,
    brHeight=number_slider_5)  # -> out, a
# ---------- python_2: Python ----------
"""Flemish bond."""

__author__ = "nchristidi"
__version__ = "2018.10.07"

import Rhino.Geometry as rg

class brickWall:
    def __init__ (self, length, width, height):
        self.length = length
        self.width = width
        self.height = height
        self.orPt = rg.Point3d(0, width,0)
        self.peakPt = rg.Point3d(0, width, height)
    def createWall (self):
        basePlane = rg.Plane.WorldXY
        xSize = rg.Interval(0, self.length)
        ySize = rg.Interval(0, self.width)
        zSize = rg.Interval(0, self.height)
        wall = rg.Box(basePlane, xSize, ySize, zSize)
        wall = wall.ToBrep()
        return wall

class brick:
    def __init__ (self, length, width, height):
        self.length = length
        self.width = width
        self.height = height
    def stretcher (self, orPt):
        basePlane = rg.Plane.WorldXY
        xSize = rg.Interval(orPt[0], orPt[0]+self.length)
        ySize = rg.Interval(orPt[1], orPt[1]-self.width)
        zSize = rg.Interval(orPt[2], orPt[2]+self.height)
        brick = rg.Box(basePlane, xSize, ySize, zSize)
        return brick
    def halfBrick (self, orPt):
        basePlane = rg.Plane.WorldXY
        xSize = rg.Interval(orPt[0], orPt[0]+self.length/2)
        ySize = rg.Interval(orPt[1], orPt[1]-self.width)
        zSize = rg.Interval(orPt[2], orPt[2]+self.height)
        brick = rg.Box(basePlane, xSize, ySize, zSize)
        return brick
    def corner (self, orPt):
        basePlane = rg.Plane.WorldXY
        xSize = rg.Interval(orPt[0], orPt[0]+3*self.length/4)
        ySize = rg.Interval(orPt[1], orPt[1]-self.width)
        zSize = rg.Interval(orPt[2], orPt[2]+self.height)
        brick = rg.Box(basePlane, xSize, ySize, zSize)
        return brick
    def cornerS (self, orPt):
        basePlane = rg.Plane.WorldXY
        xSize = rg.Interval(orPt[0], orPt[0]+self.length/4)
        ySize = rg.Interval(orPt[1], orPt[1]-self.width)
        zSize = rg.Interval(orPt[2], orPt[2]+self.height)
        brick = rg.Box(basePlane, xSize, ySize, zSize)
        return brick

bw = brickWall(length, width, height)
b = brick(brLength, brWidth, brHeight)
wall = bw.createWall()
faces = wall.Faces
face = faces.ExtractFace(2)
contours = rg.Brep.CreateContourCurves(face, bw.orPt, bw.peakPt, brHeight)
bricks = []
counter = 0
for contour in contours:
    contour.Reverse()
    contour.Domain = rg.Interval(0,1)
    t = contour.DivideByLength(brLength/4, True)
    listL= len(t)
    j0 = 0
    j1 = -3
    for i in range(len(t)-1):
        #print "counter:", counter, " j0:",j0, "j1: ", j1
        pt = contour.PointAt(t[i])
        if counter%2==1:
            if j1==-3:
                bricks.append(b.corner(pt))
            elif j1==0:
                bricks.append(b.halfBrick(pt))
            elif j1==2:
                bricks.append(b.stretcher(pt))
        else:
            if j0 ==0:
                bricks.append(b.halfBrick(pt))
            elif j0 == 2:
                bricks.append(b.stretcher(pt))
        if j0==5:
            j0=0
        else:
            j0 +=1
        if j1==5:
            j1=0
        else:
            j1 +=1

    counter +=1


a = bricks
# ---------- end python_2 ----------
python_3 = GhPythonScript(
    length=number_slider,
    width=number_slider_2,
    height=number_slider_6,
    brLength=number_slider_3,
    brWidth=number_slider_4,
    brHeight=number_slider_5)  # -> out, a
# ---------- python_3: Python ----------
"""English bond."""

__author__ = "nchristidi"
__version__ = "2018.10.07"

import Rhino.Geometry as rg

class brickWall:
    def __init__ (self, length, width, height):
        self.length = length
        self.width = width
        self.height = height
        self.orPt = rg.Point3d(0, width,0)
        self.peakPt = rg.Point3d(0, width, height)
    def createWall (self):
        basePlane = rg.Plane.WorldXY
        xSize = rg.Interval(0, self.length)
        ySize = rg.Interval(0, self.width)
        zSize = rg.Interval(0, self.height)
        wall = rg.Box(basePlane, xSize, ySize, zSize)
        wall = wall.ToBrep()
        return wall

class brick:
    def __init__ (self, length, width, height):
        self.length = length
        self.width = width
        self.height = height
    def stretcher (self, orPt):
        basePlane = rg.Plane.WorldXY
        xSize = rg.Interval(orPt[0], orPt[0]+self.length)
        ySize = rg.Interval(orPt[1], orPt[1]-self.width)
        zSize = rg.Interval(orPt[2], orPt[2]+self.height)
        brick = rg.Box(basePlane, xSize, ySize, zSize)
        return brick
    def halfBrick (self, orPt):
        basePlane = rg.Plane.WorldXY
        xSize = rg.Interval(orPt[0], orPt[0]+self.length/2)
        ySize = rg.Interval(orPt[1], orPt[1]-self.width)
        zSize = rg.Interval(orPt[2], orPt[2]+self.height)
        brick = rg.Box(basePlane, xSize, ySize, zSize)
        return brick
    def corner (self, orPt):
        basePlane = rg.Plane.WorldXY
        xSize = rg.Interval(orPt[0], orPt[0]+3*self.length/4)
        ySize = rg.Interval(orPt[1], orPt[1]-self.width)
        zSize = rg.Interval(orPt[2], orPt[2]+self.height)
        brick = rg.Box(basePlane, xSize, ySize, zSize)
        return brick
    def cornerS (self, orPt):
        basePlane = rg.Plane.WorldXY
        xSize = rg.Interval(orPt[0], orPt[0]+self.length/4)
        ySize = rg.Interval(orPt[1], orPt[1]-self.width)
        zSize = rg.Interval(orPt[2], orPt[2]+self.height)
        brick = rg.Box(basePlane, xSize, ySize, zSize)
        return brick

bw = brickWall(length, width, height)
b = brick(brLength, brWidth, brHeight)
wall = bw.createWall()
faces = wall.Faces
face = faces.ExtractFace(2)
contours = rg.Brep.CreateContourCurves(face, bw.orPt, bw.peakPt, brHeight)
bricks = []
counter = 0
for contour in contours:
    contour.Reverse()
    contour.Domain = rg.Interval(0,1)
    t = contour.DivideByLength(brLength/4, True)
    listL= len(t)
    j0 = 0
    j1 = -1
    for i in range(len(t)-1):
        #print "counter:", counter, " j0:",j0, "j1: ", j1
        pt = contour.PointAt(t[i])
        if counter%2==1:
            if j1==-1:
                bricks.append(b.cornerS(pt))
            elif j1==0:
                bricks.append(b.halfBrick(pt))
        else:
            if j0 ==0:
                bricks.append(b.stretcher(pt))
        if j0==3:
            j0=0
        else:
            j0 +=1
        if j1==1:
            j1=0
        else:
            j1 +=1

    counter +=1


a = bricks
# ---------- end python_3 ----------
python_4 = GhPythonScript(
    length=number_slider,
    width=number_slider_2,
    height=number_slider_6,
    brLength=number_slider_3,
    brWidth=number_slider_4,
    brHeight=number_slider_5)  # -> out, a
# ---------- python_4: Python ----------
"""Double stretcher bond."""

__author__ = "nchristidi"
__version__ = "2018.10.07"

import Rhino.Geometry as rg

class brickWall:
    def __init__ (self, length, width, height):
        self.length = length
        self.width = width
        self.height = height
        self.orPt = rg.Point3d(0, width,0)
        self.peakPt = rg.Point3d(0, width, height)
    def createWall (self):
        basePlane = rg.Plane.WorldXY
        xSize = rg.Interval(0, self.length)
        ySize = rg.Interval(0, self.width)
        zSize = rg.Interval(0, self.height)
        wall = rg.Box(basePlane, xSize, ySize, zSize)
        wall = wall.ToBrep()
        return wall

class brick:
    def __init__ (self, length, width, height):
        self.length = length
        self.width = width
        self.height = height
    def stretcher (self, orPt):
        basePlane = rg.Plane.WorldXY
        xSize = rg.Interval(orPt[0], orPt[0]+self.length)
        ySize = rg.Interval(orPt[1], orPt[1]-self.width)
        zSize = rg.Interval(orPt[2], orPt[2]+self.height)
        brick = rg.Box(basePlane, xSize, ySize, zSize)
        return brick
    def halfBrick (self, orPt):
        basePlane = rg.Plane.WorldXY
        xSize = rg.Interval(orPt[0], orPt[0]+self.length/2)
        ySize = rg.Interval(orPt[1], orPt[1]-self.width)
        zSize = rg.Interval(orPt[2], orPt[2]+self.height)
        brick = rg.Box(basePlane, xSize, ySize, zSize)
        return brick
    def corner (self, orPt):
        basePlane = rg.Plane.WorldXY
        xSize = rg.Interval(orPt[0], orPt[0]+3*self.length/4)
        ySize = rg.Interval(orPt[1], orPt[1]-self.width)
        zSize = rg.Interval(orPt[2], orPt[2]+self.height)
        brick = rg.Box(basePlane, xSize, ySize, zSize)
        return brick
    def cornerS (self, orPt):
        basePlane = rg.Plane.WorldXY
        xSize = rg.Interval(orPt[0], orPt[0]+self.length/4)
        ySize = rg.Interval(orPt[1], orPt[1]-self.width)
        zSize = rg.Interval(orPt[2], orPt[2]+self.height)
        brick = rg.Box(basePlane, xSize, ySize, zSize)
        return brick

bw = brickWall(length, width, height)
b = brick(brLength, brWidth, brHeight)
wall = bw.createWall()
faces = wall.Faces
face = faces.ExtractFace(2)
contours = rg.Brep.CreateContourCurves(face, bw.orPt, bw.peakPt, brHeight)
bricks = []
counter = 0
for contour in contours:
    contour.Reverse()
    contour.Domain = rg.Interval(0,1)
    t = contour.DivideByLength(brLength/4, True)
    listL= len(t)
    j0 = -2
    j1 = -1
    for i in range(len(t)-1):
        #print "counter:", counter, " j0:",j0, "j1: ", j1
        pt = contour.PointAt(t[i])
        ptFr = pt + rg.Vector3d(0,-0.02,0)
        if counter%2==1:
            if j1==-1:
                bricks.append(b.cornerS(pt))
            elif j1==0:
                bricks.append(b.stretcher(pt))
            elif j1==4:
                bricks.append(b.stretcher(pt))
            elif j1==8:
                bricks.append(b.halfBrick(pt))
        else:
            if j0 ==-2:
                bricks.append(b.halfBrick(pt))
            if j0==0:
                bricks.append(b.stretcher(pt))
            if j0==4:
                bricks.append(b.halfBrick(pt))
            if j0==6:
                bricks.append(b.stretcher(pt))
        if j0==9:
            j0=0
        else:
            j0 +=1
        if j1==9:
            j1=0
        else:
            j1 +=1

    counter +=1


a = bricks
# ---------- end python_4 ----------
python_5 = GhPythonScript(
    length=number_slider,
    width=number_slider_2,
    height=number_slider_6,
    brLength=number_slider_3,
    brWidth=number_slider_4,
    brHeight=number_slider_5)  # -> out, a
# ---------- python_5: Python ----------
"""Monk bond."""

__author__ = "nchristidi"
__version__ = "2018.10.07"

import Rhino.Geometry as rg

class brickWall:
    def __init__ (self, length, width, height):
        self.length = length
        self.width = width
        self.height = height
        self.orPt = rg.Point3d(0, width,0)
        self.peakPt = rg.Point3d(0, width, height)
    def createWall (self):
        basePlane = rg.Plane.WorldXY
        xSize = rg.Interval(0, self.length)
        ySize = rg.Interval(0, self.width)
        zSize = rg.Interval(0, self.height)
        wall = rg.Box(basePlane, xSize, ySize, zSize)
        wall = wall.ToBrep()
        return wall

class brick:
    def __init__ (self, length, width, height):
        self.length = length
        self.width = width
        self.height = height
    def stretcher (self, orPt):
        basePlane = rg.Plane.WorldXY
        xSize = rg.Interval(orPt[0], orPt[0]+self.length)
        ySize = rg.Interval(orPt[1], orPt[1]-self.width)
        zSize = rg.Interval(orPt[2], orPt[2]+self.height)
        brick = rg.Box(basePlane, xSize, ySize, zSize)
        return brick
    def halfBrick (self, orPt):
        basePlane = rg.Plane.WorldXY
        xSize = rg.Interval(orPt[0], orPt[0]+self.length/2)
        ySize = rg.Interval(orPt[1], orPt[1]-self.width)
        zSize = rg.Interval(orPt[2], orPt[2]+self.height)
        brick = rg.Box(basePlane, xSize, ySize, zSize)
        return brick
    def corner (self, orPt):
        basePlane = rg.Plane.WorldXY
        xSize = rg.Interval(orPt[0], orPt[0]+3*self.length/4)
        ySize = rg.Interval(orPt[1], orPt[1]-self.width)
        zSize = rg.Interval(orPt[2], orPt[2]+self.height)
        brick = rg.Box(basePlane, xSize, ySize, zSize)
        return brick
    def cornerS (self, orPt):
        basePlane = rg.Plane.WorldXY
        xSize = rg.Interval(orPt[0], orPt[0]+self.length/4)
        ySize = rg.Interval(orPt[1], orPt[1]-self.width)
        zSize = rg.Interval(orPt[2], orPt[2]+self.height)
        brick = rg.Box(basePlane, xSize, ySize, zSize)
        return brick

bw = brickWall(length, width, height)
b = brick(brLength, brWidth, brHeight)
wall = bw.createWall()
faces = wall.Faces
face = faces.ExtractFace(2)
contours = rg.Brep.CreateContourCurves(face, bw.orPt, bw.peakPt, brHeight)
bricks = []
counter = 0
for contour in contours:
    contour.Reverse()
    contour.Domain = rg.Interval(0,1)
    t = contour.DivideByLength(brLength/4, True)
    listL= len(t)
    j0 = -7
    j1 = -2
    for i in range(len(t)-1):
        #print "counter:", counter, " j0:",j0, "j1: ", j1
        pt = contour.PointAt(t[i])
        ptFr = pt + rg.Vector3d(0,-0.02,0)
        if counter%2==1:
            if j1==-2:
                bricks.append(b.halfBrick(pt))
            elif j1==0:
                bricks.append(b.halfBrick(pt))
            elif j1==2:
                bricks.append(b.stretcher(pt))
            elif j1==6:
                bricks.append(b.stretcher(pt))
        else:
            if j0 ==-7:
                bricks.append(b.corner(pt))
            elif j0==-4:
                bricks.append(b.stretcher(pt))
            elif j0==0:
                bricks.append(b.halfBrick(pt))
            elif j0==2:
                bricks.append(b.stretcher(pt))
            elif j0==6:
                bricks.append(b.stretcher(pt))
        if j0==9:
            j0=0
        else:
            j0 +=1
        if j1==9:
            j1=0
        else:
            j1 +=1

    counter +=1


a = bricks
# ---------- end python_5 ----------
python_6 = GhPythonScript(
    length=number_slider,
    width=number_slider_2,
    height=number_slider_6,
    brLength=number_slider_3,
    brWidth=number_slider_4,
    brHeight=number_slider_5)  # -> out, a
# ---------- python_6: Python ----------
"""Sussex bond."""

__author__ = "nchristidi"
__version__ = "2018.10.07"

import Rhino.Geometry as rg

class brickWall:
    def __init__ (self, length, width, height):
        self.length = length
        self.width = width
        self.height = height
        self.orPt = rg.Point3d(0, width,0)
        self.peakPt = rg.Point3d(0, width, height)
    def createWall (self):
        basePlane = rg.Plane.WorldXY
        xSize = rg.Interval(0, self.length)
        ySize = rg.Interval(0, self.width)
        zSize = rg.Interval(0, self.height)
        wall = rg.Box(basePlane, xSize, ySize, zSize)
        wall = wall.ToBrep()
        return wall

class brick:
    def __init__ (self, length, width, height):
        self.length = length
        self.width = width
        self.height = height
    def stretcher (self, orPt):
        basePlane = rg.Plane.WorldXY
        xSize = rg.Interval(orPt[0], orPt[0]+self.length)
        ySize = rg.Interval(orPt[1], orPt[1]-self.width)
        zSize = rg.Interval(orPt[2], orPt[2]+self.height)
        brick = rg.Box(basePlane, xSize, ySize, zSize)
        return brick
    def halfBrick (self, orPt):
        basePlane = rg.Plane.WorldXY
        xSize = rg.Interval(orPt[0], orPt[0]+self.length/2)
        ySize = rg.Interval(orPt[1], orPt[1]-self.width)
        zSize = rg.Interval(orPt[2], orPt[2]+self.height)
        brick = rg.Box(basePlane, xSize, ySize, zSize)
        return brick
    def corner (self, orPt):
        basePlane = rg.Plane.WorldXY
        xSize = rg.Interval(orPt[0], orPt[0]+3*self.length/4)
        ySize = rg.Interval(orPt[1], orPt[1]-self.width)
        zSize = rg.Interval(orPt[2], orPt[2]+self.height)
        brick = rg.Box(basePlane, xSize, ySize, zSize)
        return brick
    def cornerS (self, orPt):
        basePlane = rg.Plane.WorldXY
        xSize = rg.Interval(orPt[0], orPt[0]+self.length/4)
        ySize = rg.Interval(orPt[1], orPt[1]-self.width)
        zSize = rg.Interval(orPt[2], orPt[2]+self.height)
        brick = rg.Box(basePlane, xSize, ySize, zSize)
        return brick

bw = brickWall(length, width, height)
b = brick(brLength, brWidth, brHeight)
wall = bw.createWall()
faces = wall.Faces
face = faces.ExtractFace(2)
contours = rg.Brep.CreateContourCurves(face, bw.orPt, bw.peakPt, brHeight)
bricks = []
counter = 0
for contour in contours:
    contour.Reverse()
    contour.Domain = rg.Interval(0,1)
    t = contour.DivideByLength(brLength/4, True)
    listL= len(t)
    j0 = -7
    j1 = 0
    for i in range(len(t)-1):
        #print "counter:", counter, " j0:",j0, "j1: ", j1
        pt = contour.PointAt(t[i])
        ptFr = pt + rg.Vector3d(0,-0.02,0)
        if counter%2==1:
            if j1==0:
                bricks.append(b.halfBrick(pt))
            elif j1==2:
                bricks.append(b.stretcher(pt))
            elif j1==6:
                bricks.append(b.stretcher(pt))
            elif j1==10:
                bricks.append(b.stretcher(pt))
        else:
            if j0 ==-7:
                bricks.append(b.corner(pt))
            elif j0==-4:
                bricks.append(b.stretcher(pt))
            elif j0==0:
                bricks.append(b.halfBrick(pt))
            elif j0==2:
                bricks.append(b.stretcher(pt))
            elif j0==6:
                bricks.append(b.stretcher(pt))
            elif j0==10:
                bricks.append(b.stretcher(pt))
        if j0==13:
            j0=0
        else:
            j0 +=1
        if j1==13:
            j1=0
        else:
            j1 +=1

    counter +=1


a = bricks
# ---------- end python_6 ----------

# ----
# Slide to see more patterns!
number_slider_7 = Slider(4, range=0..5)

division = Division(A=number_slider, B=2)
eval = Evaluate(F="10*x/9", x=number_slider_6)
pt = ConstructPoint(XCoordinate=division, YCoordinate=0, ZCoordinate=eval)

# ---- group: Output
filter = StreamFilter(
    Gate=number_slider_7,
    Stream0=python.a,
    Stream1=python_2.a,
    Stream2=python_3.a,
    Stream3=python_4.a,
    Stream4=python_6.a,
    Stream5=python_5.a)
filter_2 = StreamFilter(
    Gate=number_slider_7,
    Stream0="Stretcher bond",
    Stream1="Flemish bond",
    Stream2="English bond",
    Stream3="Double stretcher bond",
    Stream4="Sussex bond",
    Stream5="Monk bond")
tag = TextTag(Location=pt, Text=filter_2)
