# Grasshopper definition BricksForDome.gh (Grasshopper 1.0.7)

md_slider = MDSlider(SliderMode=0, slider_value=Point(0.5, 0.5, 0.5), x_domain=Domain(0, 1), y_domain=Domain(0, 1), z_domain=Domain(0, 1))
md_slider_2 = MDSlider(SliderMode=0, slider_value=Point(0, 0, 0.5), x_domain=Domain(0, 1), y_domain=Domain(0, 1), z_domain=Domain(0, 1))
srf = Surface(reparameterize(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))
evalsrf = EvaluateSurface(Surface=srf, Point=[md_slider, md_slider_2])  # -> Point, Normal, UDirection, VDirection, Frame
item = ListItem(List=evalsrf.Point, Index=0, Wrap=True)  # -> Item, Item1
ln = Line(StartPoint=item.Item, EndPoint=item.Item1)
project = Project(Curve=ln, Brep=srf, Direction=Vector(0, 0, 1))
divdist = DivideDistance(Curve=project, Distance=Slider(0.067, range=0.067..1))  # -> Points, Tangents, Parameters
pln = Plane(divdist.Points)
sec = BrepPlane(Brep=srf, Plane=pln)  # -> simplify(flatten(Curves)), Points

pt = ConstructPoint(XCoordinate="0.20", YCoordinate="0.10", ZCoordinate="0.06")
xy = XYPlane(Origin=Point(0, 0, 0))
box = Box2Pt(PointA=xy, PointB=pt, Plane=PlaneXY(0, 0, 0))
brep = Brep(box)
deconstruct_brep = DeconstructBrep(Brep=brep)  # -> Faces, Edges, Vertices
list_item = ListItem(List=deconstruct_brep.Faces, Index=Slider(5, range=0..5), Wrap=True)
python = GhPythonScript(
    srf=srf,
    horCrvs=sec.Curves,
    brick=brep,
    brk_ht="0.06",
    brk_len="0.20",
    y_spacing=Slider(0.01, range=0..0.01),
    x_spacing=Slider(0.01, range=0..0.01))  # -> out, a; inputs srf: Surface, horCrvs: list of Curve, brick: Brep
# ---------- python: Python ----------
"""
The script places bricks in a dome-surface. Suggestions for future work include the alternating 
pattern for the bricks. 
    Inputs:
        srf: The reparametrized surface of the dome (surface).
        horCrvs: Horizontal curves on the surface, with the same distance between them (list of curves).
        brick: The Brep of the brick to be used (Brep).
        brk_ht: The height of the brick (float).
        brk_len: The length of the brick (float).
        y_spacing: The space between the bricks in y-axis(float).
        x_spacing: The space between the bricks in x-axis(float).
    Output:
        a: Bricks (list).
"""
__author__ = "Despoina Pouniou, Erron Estrado"
__version__ = "2018.10.17"

import rhinoscriptsyntax as rs
import Rhino.Geometry as rg
import Rhino.Collections as rc
import math
from copy import copy


#Get center point on brick.
b_area = rg.AreaMassProperties.Compute(brick)
brick_center = b_area.Centroid
surface = brick.Faces[5]
closestpt = surface.ClosestPoint(brick_center)
normal = surface.NormalAt(closestpt[1], closestpt[2])
brk = brick

bricks = []
#Start placement loops.
for crv in horCrvs:
    #If curve is shorter than brick length then skip
    if crv.GetLength() <= brk_len:
        continue
    #Divide curve by brick length.
    t = crv.DivideByLength(brk_len, True)
    #Rotate and move brick into position.
    for i, item in enumerate(t):
        dest_pt = crv.PointAt(item)
        dir = dest_pt - brick_center
        tangvec = crv.TangentAt(item)
        pt = srf.ClosestPoint(dest_pt)
        norm = srf.NormalAt(pt[1], pt[2])
        norm.Reverse()
        new_brick = copy(brk)
#------------------------------------------------------------------
        plane0=rg.Plane(brick_center, normal)
        plane05=rg.Plane(brick_center,plane0.YAxis, plane0.XAxis)
        plane1=rg.Plane(dest_pt, norm, tangvec)
#------------------------------------------------------------------
        transform= rg.Transform.PlaneToPlane(plane05, plane1)
        new_brick.Transform(transform)
        bricks.append(new_brick)

a = bricks
# ---------- end python ----------
bricks = Brep(python.a)
