# Grasshopper definition DomeButtress.gh (Grasshopper 1.0.7)
# plug-ins: Pufferfish, EleFront

inblock = InsertBlock(BlockName="waiting area/canteen open", SourcePlane=PlaneXY(0, 0, 0))
deblock = DeconstructBlock(Block=inblock)  # -> Name, Plane, Geometry
geo = Geometry(deblock.Geometry)
brep = Brep(geo)

# ---- group: Arch Curve
bbox = BoundingBox(Content=geo, Plane=PlaneXY(0, 0, 0), UnionBox=True)  # -> Box, Box_2
debrep = DeconstructBrep(Brep=bbox.Box)  # -> Faces, Edges, Vertices
number_slider = Slider(0.1, range=0..2)
item = ListItem(List=debrep.Edges, Index=0, Wrap=True)
ext = ExtendCurve(Curve=item, Type=0, Start=expr("-x", number_slider), End=expr("-x", number_slider))
end = EndPoints(Curve=ext)  # -> Start, End
Z = UnitZ(Factor=1)
cat = Catenary(PointA=end.Start, PointB=end.End, Length=Slider(11.8, range=0..20), Gravity=Z)
explode = Explode(Curve=cat, Recursive=True)  # -> Segments, Vertices
intcrv = Interpolate(Vertices=explode.Vertices, Degree=3, Periodic=False, KnotStyle=1)  # -> Curve, Length, Domain

# ----
clean = CleanTree(RemoveNulls=True, RemoveInvalid=True, RemoveEmpty=True, Tree=brep)

# ---- group: Side Curves
item_2 = ListItem(List=clean, Index=0, Wrap=True)
bbox_2 = BoundingBox(Content=item_2, Plane=PlaneXY(0, 0, 0))  # -> Box, Box_2
debrep_2 = DeconstructBrep(Brep=bbox_2.Box)  # -> Faces, Edges, Vertices
item_3 = ListItem(List=debrep_2.Edges, Index=Slider(8, range=0..11), Wrap=True)  # -> Item, Item1

# ---- group: Top Arch Curve
item_4 = ListItem(List=clean, Index=4, Wrap=True)
debrep_3 = DeconstructBrep(Brep=item_4)  # -> Faces, Edges, Vertices
item_5 = ListItem(List=debrep_3.Edges, Index=Slider(9, range=0..11), Wrap=True)

# ---- group: Blend Valley Curve
xz = XZPlane(Origin=Point(0, 0, 0))
number_slider_2 = Slider(2, range=0..10)
project = Project(Geometry=item_5, Plane=xz)  # -> Geometry, Transform
Y = UnitY(Factor=expr("-x", number_slider_2))
move = Move(Geometry=project.Geometry, Motion=Y)  # -> Geometry, Transform
shatter = Shatter(Curve=reparameterize(move.Geometry), Parameters="0.5")
item_6 = ListItem(List=shatter, Index=1, Wrap=True)
Y_2 = UnitY(Factor=number_slider_2)
extr = Extrude(Base=item_6, Direction=Y_2)
end_2 = EndPoints(Curve=item_6)  # -> Start, End
yz = YZPlane(Origin=end_2.End)
mirror = Mirror(Geometry=item_6, Plane=yz)  # -> Geometry, Transform
number_slider_3 = Slider(0, range=0..100)
number_slider_4 = Slider(2.047, range=0..5)
flip = FlipCurve(Curve=item_6)  # -> Curve, Flag
ext_2 = ExtendCurve(Curve=flip.Curve, Type=0, Start=expr("-x", number_slider_4), End=expr("-x", number_slider_3))
ext_3 = ExtendCurve(Curve=mirror.Geometry, Type=0, Start=expr("-x", number_slider_3), End=expr("-x", number_slider_4))
blendc = BlendCurve(CurveA=ext_3, CurveB=ext_2, BulgeA=1, BulgeB=1, Continuity=2)
# Make Valley
join = JoinCurves(Curves=flatten([ext_3, blendc, ext_2]), Preserve=False)
reb = RebuildCurve(Curve=join, Count=Slider(23, range=0..100), Tangents=False)
extr_2 = Extrude(Base=reb, Direction=Y_2)

# ---- group: Bottom Curves
end_3 = EndPoints(Curve=item_3.Item)  # -> Start, End
end_4 = EndPoints(Curve=item_3.Item1)  # -> Start, End
end_5 = EndPoints(Curve=intcrv.Curve)  # -> Start, End
ln = Line(StartPoint=end_5.Start, EndPoint=end_3.End)
ln_2 = Line(StartPoint=end_5.End, EndPoint=end_4.Start)

# ---- group: Buttress
merge = Merge(Data1=intcrv.Curve, Data2=item_3.Item, Data3=item_3.Item1, Data4=ln, Data5=ln_2, Data6=item_5)
join_2 = JoinCurves(Curves=flatten(merge), Preserve=False)
xz_2 = XZPlane(Origin=Point(0, 0, 0))
project_2 = Project(Geometry=join_2, Plane=xz_2)  # -> Geometry, Transform
clscrv = CloseCurve(Curve=project_2.Geometry, CloseType=3, Bulge=0.5, Tolerance=0)  # -> Closed, R
Y_3 = UnitY(Factor=expr("-x", Slider(2, range=0..10)))
extr_3 = Extrude(Base=clscrv.Closed, Direction=Y_3)
cap = CapHoles(Brep=extr_3)

# ---- group: Make Valley Surfaces
dom²num = ConstructDomain²(UMin=0, UMax=1, VMin=Slider(0.5, range=0..1), VMax=1)
subsrf = Isotrim(Surface=reparameterize(extr_2), Domain=dom²num)
debrep_4 = DeconstructBrep(Brep=subsrf)  # -> Faces, Edges, Vertices
debrep_5 = DeconstructBrep(Brep=extr)  # -> Faces, Edges, Vertices
item_7 = ListItem(List=debrep_4.Edges, Index=0, Wrap=True)
item_8 = ListItem(List=debrep_5.Edges, Index=2, Wrap=True)
loft = Loft(
    Curves=flatten([item_8, item_7]),
    Options={Adjust=True, Closed=False, LoftEnds=0, LoftSimp=0, LoftType=0, Rebuild=10, Refit=0.01})

# ---- group: Make Solid BReps
join_3 = BrepJoin(Breps=flatten([extr, subsrf, loft]))  # -> Breps, Closed
end_6 = EndPoints(Curve=item_6)  # -> Start, End
cap_2 = CapHoles(Brep=join_3.Breps)
yz_2 = YZPlane(Origin=end_6.Start)
mirror_2 = Mirror(Geometry=cap_2, Plane=yz_2)  # -> Geometry, Transform

# ---- group: Cut
X = UnitX(Factor=-1)
crv = Curve(<curve referenced from the Rhino model>)
move_2 = Move(Geometry=crv, Motion=X)  # -> Geometry, Transform
X_2 = UnitX(Factor=Slider(10, range=0..10))
extr_4 = Extrude(Base=move_2.Geometry, Direction=X_2)
sdiff = SolidDifference(BrepsA=flatten([cap_2, cap, mirror_2.Geometry]), BrepsB=extr_4)

# ---- group: Doorway Loft
brep_2 = Brep(item_2)
item_9 = ListItem(List=sdiff, Index=1, Wrap=True)
debrep_6 = DeconstructBrep(Brep=brep_2)  # -> Faces, Edges, Vertices
debrep_7 = DeconstructBrep(Brep=item_9)  # -> Faces, Edges, Vertices
item_10 = ListItem(List=debrep_6.Edges, Index=0, Wrap=True)
item_11 = ListItem(List=debrep_7.Edges, Index=16, Wrap=True)
loft_2 = Loft(
    Curves=flatten([item_11, item_10]),
    Options={Adjust=True, Closed=False, LoftEnds=0, LoftSimp=0, LoftType=0, Rebuild=10, Refit=0.01})

# ---- group: Bake and Update
number_slider_5 = Slider(16, range=0..22)
module = Geometry(deblock.Geometry)
cull_i = CullIndex(List=module, Indices=number_slider_5, Wrap=True)
item_12 = ListItem(List=module, Index=number_slider_5, Wrap=True)
layer = DefineLayer(Name="waiting area/canteen")
layer_2 = DefineLayer(Name="Default")
merge_2 = Merge(Data1=flatten(item_12), Data2=flatten(cull_i), Data3=flatten(sdiff), Data4=flatten(loft_2))
attributes = DefineObjectAttributes(Layer=layer)
attributes_2 = DefineObjectAttributes(Layer=layer_2)
lng = ListLength(List=merge_2)
repeat = RepeatData(Data=attributes_2, Length=lng)
merge_3 = Merge(Data1=attributes, Data2=repeat)  # -> flatten(Result)
block = DefineBlock(Geometry=flatten(merge_2), Attributes=merge_3, BlockName="Dome_2", BasePlane=PlaneXY(0, 0, 0))
bake = BakeObjects(Geometry=flatten(block), BakeName="Dome", Bake=False)
