# Grasshopper definition VaultButtress.gh (Grasshopper 1.0.7)
# plug-ins: EleFront

# ---- group: Get base block geometry
inblock = InsertBlock(BlockName="wards", SourcePlane=PlaneXY(0, 0, 0))
deblock = DeconstructBlock(Block=inblock)  # -> Name, Plane, Geometry

# ----
geo = Geometry(deblock.Geometry)
brep = Brep(geo)
clean = CleanTree(RemoveNulls=True, RemoveInvalid=True, RemoveEmpty=True, Tree=brep)

# ---- group: Arch Curve
bbox = BoundingBox(Content=geo, Plane=PlaneXY(0, 0, 0), UnionBox=True)  # -> Box, Box_2
number_slider = Slider(0.1, range=0..2)
debrep = DeconstructBrep(Brep=bbox.Box)  # -> Faces, Edges, Vertices
item = ListItem(List=debrep.Edges, Index=0, Wrap=True)
ext = ExtendCurve(Curve=item, Type=0, Start=expr("-x", number_slider), End=expr("-x", number_slider))
Z = UnitZ(Factor=1)
end = EndPoints(Curve=ext)  # -> Start, End
cat = Catenary(PointA=end.Start, PointB=end.End, Length=Slider(10.42, range=0..20), Gravity=Z)
explode = Explode(Curve=cat, Recursive=True)  # -> Segments, Vertices
intcrv = Interpolate(Vertices=explode.Vertices, Degree=3, Periodic=False, KnotStyle=1)  # -> Curve, Length, Domain

# ---- group: Side Curves
item_2 = ListItem(List=clean, Index=0, Wrap=True)
bbox_2 = BoundingBox(Content=item_2, Plane=PlaneXY(0, 0, 0))  # -> Box, Box_2
debrep_2 = DeconstructBrep(Brep=bbox_2.Box)  # -> Faces, Edges, Vertices
item_3 = ListItem(List=debrep_2.Edges, Index=Slider(8, range=0..11), Wrap=True)  # -> Item, Item1

# ---- group: Top Arch Curve
item_4 = ListItem(List=clean, Index=4, Wrap=True)
debrep_3 = DeconstructBrep(Brep=item_4)  # -> Faces, Edges, Vertices
item_5 = ListItem(List=debrep_3.Edges, Index=Slider(9, range=0..11), Wrap=True)

# ---- group: Blend Valley Curve
number_slider_2 = Slider(2, range=0..10)
Y = UnitY(Factor=expr("-x", number_slider_2))
move = Move(Geometry=item_5, Motion=Y)  # -> Geometry, Transform
shatter = Shatter(Curve=reparameterize(move.Geometry), Parameters="0.5")
item_6 = ListItem(List=shatter, Index=1, Wrap=True)
end_2 = EndPoints(Curve=item_6)  # -> Start, End
flip = FlipCurve(Curve=item_6)  # -> Curve, Flag
yz = YZPlane(Origin=end_2.End)
mirror = Mirror(Geometry=item_6, Plane=yz)  # -> Geometry, Transform
number_slider_3 = Slider(0.701, range=0..1)
number_slider_4 = Slider(0, range=0..100)
ext_2 = ExtendCurve(Curve=mirror.Geometry, Type=0, Start=expr("-x", number_slider_4), End=expr("-x", number_slider_3))
ext_3 = ExtendCurve(Curve=flip.Curve, Type=0, Start=expr("-x", number_slider_3), End=expr("-x", number_slider_4))
blendc = BlendCurve(CurveA=ext_2, CurveB=ext_3, BulgeA=1, BulgeB=1, Continuity=2)
join = JoinCurves(Curves=flatten([ext_2, blendc, ext_3]), Preserve=False)
# Make Valley
reb = RebuildCurve(Curve=join, Count=Slider(23, range=0..100), Tangents=False)

# ---- group: Bottom Curves
end_3 = EndPoints(Curve=item_3.Item)  # -> Start, End
end_4 = EndPoints(Curve=item_3.Item1)  # -> Start, End
end_5 = EndPoints(Curve=intcrv.Curve)  # -> Start, End
ln = Line(StartPoint=end_5.Start, EndPoint=end_3.End)
ln_2 = Line(StartPoint=end_5.End, EndPoint=end_4.Start)

# ---- group: Make Valley Surfaces
dip_curve = Curve(<curve referenced from the Rhino model>)
loft = Loft(
    Curves=flatten([reb, dip_curve]),
    Options={Adjust=False, Closed=False, LoftEnds=0, LoftSimp=0, LoftType=0, Rebuild=10, Refit=0.01})
dom²num = ConstructDomain²(UMin=0, UMax=1, VMin=Slider(0.5, range=0..1), VMax=1)
addition = Addition(A=Slider(6, range=0..10), B=number_slider_2)
subsrf = Isotrim(Surface=reparameterize(loft), Domain=dom²num)
Y_2 = UnitY(Factor=addition)
extr = Extrude(Base=item_6, Direction=Y_2)
debrep_4 = DeconstructBrep(Brep=extr)  # -> Faces, Edges, Vertices
debrep_5 = DeconstructBrep(Brep=subsrf)  # -> Faces, Edges, Vertices
item_7 = ListItem(List=debrep_4.Edges, Index=2, Wrap=True)
item_8 = ListItem(List=debrep_5.Edges, Index=0, Wrap=True)
loft_2 = Loft(
    Curves=flatten([item_7, item_8]),
    Options={Adjust=True, Closed=False, LoftEnds=0, LoftSimp=0, LoftType=0, Rebuild=10, Refit=0.01})

# ---- group: Buttress
merge = Merge(Data1=intcrv.Curve, Data2=item_3.Item, Data3=item_3.Item1, Data4=ln, Data5=ln_2, Data6=item_5)
join_2 = JoinCurves(Curves=flatten(merge), Preserve=False)
Y_3 = UnitY(Factor=expr("-x", Slider(2, range=0..10)))
extr_2 = Extrude(Base=join_2, Direction=Y_3)
cap = CapHoles(Brep=extr_2)

# ---- group: Make Closed BReps
join_3 = BrepJoin(Breps=flatten([extr, subsrf, loft_2]))  # -> Breps, Closed
cap_2 = CapHoles(Brep=join_3.Breps)
end_6 = EndPoints(Curve=item_6)  # -> Start, End
yz_2 = YZPlane(Origin=end_6.Start)
mirror_2 = Mirror(Geometry=cap_2, Plane=yz_2)  # -> Geometry, Transform

# ---- group: Cut
X = UnitX(Factor=-1)
crv = Curve(<curve referenced from the Rhino model>)
move_2 = Move(Geometry=crv, Motion=X)  # -> Geometry, Transform
X_2 = UnitX(Factor=Slider(5, range=0..10))
extr_3 = Extrude(Base=move_2.Geometry, Direction=X_2)
sdiff = SolidDifference(BrepsA=flatten([cap_2, cap, mirror_2.Geometry]), BrepsB=extr_3)

# ---- group: Doorway Loft
brep_2 = Brep(item_2)
item_9 = ListItem(List=sdiff, Index=1, Wrap=True)
debrep_6 = DeconstructBrep(Brep=brep_2)  # -> Faces, Edges, Vertices
debrep_7 = DeconstructBrep(Brep=item_9)  # -> Faces, Edges, Vertices
item_10 = ListItem(List=debrep_6.Edges, Index=6, Wrap=True)
item_11 = ListItem(List=debrep_7.Edges, Index=16, Wrap=True)
loft_3 = Loft(
    Curves=flatten([item_11, item_10]),
    Options={Adjust=True, Closed=False, LoftEnds=0, LoftSimp=0, LoftType=0, Rebuild=10, Refit=0.01})

# ---- group: Bake & Update
module = Geometry(deblock.Geometry)
merge_2 = Merge(Data1=module, Data2=sdiff, Data3=loft_3)
block = DefineBlock(Geometry=flatten(merge_2), BlockName="Wards_2", BasePlane=PlaneXY(0, 0, 0))
bake = BakeObjects(Geometry=block, BakeName="ward", Bake=False)
