# Grasshopper definition Circlesoncurve.gh (Grasshopper 1.0.7)

# ----
# _min & _max are minimum and maximum radii of circles.
# 
# dist sets the distance along the curve between the circles.
# 
# seed sets the pattern seed.
crv = Curve(<curve referenced from the Rhino model>)
python = GhPythonScript(
    min=Slider(0.5, range=0.5..2),
    max=Slider(9, range=1..9),
    crv=crv,
    dist=Slider(0.3, range=0..2),
    seed=Slider(12, range=0..30))  # -> out, a, b; inputs crv: Curve, seed: Int32
# ---------- python: Python ----------
__author__ = "benjamin yong"
__version__ = "2018.10.13"

import rhinoscriptsyntax as rs
import Rhino.Geometry as rg
import random as rn

rn.seed(seed)

radii_list = []
pt_list = []
crv_length = crv.GetLength()
travelled = 0.00
while travelled < crv_length:
    if travelled == 0.00:
        pt = crv.PointAtLength(travelled)
        pt_list.Add(pt)
        r = rn.uniform(_min,_max)
        radii_list.Add(r)
        travelled += (r+dist)
    elif travelled+dist < crv_length:
        r = rn.uniform(_min,_max)
        radii_list.Add(r)
        travelled += r
        pt = crv.PointAtLength(travelled)
        pt_list.Add(pt)
        travelled +=(r+dist)
    else:
        break

a = pt_list
b = radii_list
# ---------- end python ----------
cir = Circle(Plane=python.a, Radius=python.b)
