# Grasshopper definition Curveheight.gh (Grasshopper 1.0.7)

crv = Curve(<curve referenced from the Rhino model>)
vertical_distance = VerticalDistance(curves=crv)  # -> lines, point_a, point_b

# ==== cluster VerticalDistance
curves = ClusterInput()
x_tremez = Extremes(Curve=flatten(curves), Plane=PlaneXY(0, 0, 0))  # -> Highest, Lowest
pdecon = Deconstruct(Point=x_tremez.Highest)  # -> XComponent, YComponent, ZComponent
sort = SortList(Keys=pdecon.ZComponent, ValuesA=x_tremez.Highest)  # -> Keys, ValuesA
lstdex = LastIndex(List=sort.ValuesA)
item = ListItem(List=sort.ValuesA, Index=0, Wrap=True)
item_2 = ListItem(List=sort.ValuesA, Index=lstdex, Wrap=True)
project = Project(Geometry=item, Plane=PlaneXY(0, 0, 0))  # -> Geometry, Transform
project_2 = Project(Geometry=item_2, Plane=PlaneXY(0, 0, 0))  # -> Geometry, Transform
ln = Line(StartPoint=item, EndPoint=project.Geometry)
ln_2 = Line(StartPoint=item_2, EndPoint=project_2.Geometry)
point_a = ClusterOutput([item, item_2])
lines = ClusterOutput([ln, ln_2])
point_b = ClusterOutput([project.Geometry, project_2.Geometry])
