# Grasshopper definition customdynamicrelaxationincsharp.gh (Grasshopper 1.0.7)
# plug-ins: Pufferfish, LunchBox

# ----
# Point Input
# Points are used as input and anchor points.
# 
# Number of subdivisions can be set.
# 
# Damping sets the amount of damping in the system.
# 
# grav sets the gravity.
# 
# dt sets the speed of the iterations.
# ↑enable this to run the c# components every 5ms.  trun it off when done otherwise it will keep running!
# ↑this is to reset the system. make sure its set to false when you want to run the simulation.
pt = Point([Point(-36.43542258, 0.7652571065, 0), Point(-6.825723709, 45.10359388, 0), Point(42.95198611, 20.56237314, 0), Point(5.751864896, -37.22036915, 0)])
pline = PolyLine(Vertices=pt, Closed=True)
boundary = BoundarySurfaces(Edges=pline)
quads = QuadPanels(Surface=boundary, UDivisions=Slider(10, range=5..20), VDivisions=Slider(10, range=5..20))
join = BrepJoin(Breps=quads)  # -> Breps, Closed
timer = Timer(TimerInterval=5, Target=c_script)  # disabled
edges = BrepEdges(Brep=join.Breps)  # -> Naked, Interior, NonManifold
crv = Curve(flatten([edges.Interior, edges.Naked]))
c_script = CSharpScript(
    reset=Toggle(False),
    lines=crv,
    fixpts=pt,
    damping=Slider(0.95, range=0.8..1),
    grav=Slider(0.17, range=-1..1),
    dt=Slider(0.21424, range=0..0.3))  # -> out, A, B; inputs reset: Boolean, lines: list of Curve, fixpts: list of Point3d, damping: Double, grav: Double, dt: Double
# ---------- c_script: C# usings ----------
using System.IO;
using System.Linq;
using System.Data;
using System.Drawing;
using System.Reflection;
using System.Windows.Forms;
using System.Xml;
using System.Xml.Linq;
using System.Runtime.InteropServices;

using Rhino.DocObjects;
using Rhino.Collections;
using GH_IO;
using GH_IO.Serialization;
# ---------- c_script: C# ----------
    /*
        FileName: particle_spring
        Author:  Sawako Kaijima
        Change mady by : Benjamin Yong
    */


    int i;
    int j;

    double density = 1.0;
    double stiffness = 1.0;


    //reset particle spring system
    if (reset) {
      nodes.Clear();
      edges.Clear();
    }

    //spring system node construction
    if (nodes.Count == 0) {
      for(i = 0; i < lines.Count; i++){
        Point3d spt = lines[i].PointAtStart;
        Point3d ept = lines[i].PointAtEnd;


        bool sdup = false;
        bool edup = false;
        int sid = -1;
        int eid = -1;
        for(j = 0; j < nodes.Count; j++){
          if(nodes[j].p.DistanceTo(spt) < 0.01){
            sdup = true;
            sid = j;
          }
          if(nodes[j].p.DistanceTo(ept) < 0.01){
            edup = true;
            eid = j;
          }

        }
        if(!sdup){
          sid = nodes.Count;
          nodes.Add(new Node(spt, density));
        }

        if(!edup){
          eid = nodes.Count;
          nodes.Add(new Node(ept, density));

        }

        edges.Add(new Edge(nodes[sid], nodes[eid], stiffness));

      }

      for (i = 0; i < nodes.Count; i++){
        for (j = 0; j < fixpts.Count; j++){
          Point3d temp = nodes[i].p;
          if(temp.DistanceTo(fixpts[j]) < 0.01){
            nodes[i].fix = true;
          }
        }
      }
    }


    //............................Apply Forces

    foreach(Node n in nodes){
      n.ApplyForce(dt, damping, grav);
    }

    foreach(Edge e in edges) {
      e.ApplySpringForce();
    }

    //............................Calculate Movement

    foreach(Node n in nodes){
      n.Move(dt, damping);
    }

    //.............................Output
    List<Point3d> pt = new List<Point3d>(nodes.Count);

    foreach(Node n in nodes) {
      pt.Add(n.p);
    }
    A = pt;
    List<Line> ln = new List<Line>(edges.Count);
    foreach(Edge e in edges) {
      ln.Add(new Line(e.n0.p, e.n1.p));
    }
    B = ln;
# ---------- c_script: C# additional code ----------
  List<Node> nodes = new List<Node>();
  List<Edge> edges = new List<Edge>();

  class Node{
    public Node(Point3d p0, double mass) {
      p = p0;
      m0 = mass;
    }

    public Point3d p = Point3d.Origin;  //position
    public Vector3d f = Vector3d.Zero;  //force
    public Vector3d v = Vector3d.Zero;  //velocity
    public double m = 0.0;              //mass
    public double m0 = 0.0;              //unit mass
    public bool fix = false;            //fix condition


    public void ApplyForce(double dt, double damping, double g) {
      //apply gravity
      f = Vector3d.ZAxis * g;
    }

    public void Move(double dt, double damping) {
      if (fix) return;
      v *= damping;
      v += f * (dt / m);
      p += v * dt;
      f = Vector3d.Zero;
    }
  }

  class Edge{

    public Edge(Node nn0, Node nn1, double k0) {
      n0 = nn0; //first node
      n1 = nn1; //second node
      k = k0;  //stiffness
      L0 = n0.p.DistanceTo(n1.p); //relaxed length
      n0.m += L0 * n0.m0 * 0.5 * 0.1 * 0.05;
      n1.m += L0 * n0.m0 * 0.5 * 0.1 * 0.05;

    }

    public Node n0;
    public Node n1;

    public double L0 = 0.0;
    public double k = 0.0;

    public void ApplySpringForce() {
      Vector3d dv = n1.p - n0.p;
      double L = dv.Length;
      dv.Unitize();
      n0.f += dv * (k * (L - L0)) * 0.5;
      n1.f -= dv * (k * (L - L0)) * 0.5;
    }
  }
# ---------- end c_script ----------
preview = CustomPreview(Geometry=[c_script.A, c_script.B], Shader=ColourSwatch(SwatchColor=RGB(255, 0, 0)))

# ----
# Curve Input
# 2 points are taken as input.
# 
# Number of curve divisions can be set.
# 
# Damping sets the amount of damping in the system.
# 
# grav sets the gravity.
# 
# dt sets the speed of the iterations.
# ↑enable this to run the c# components every 5ms.  trun it off when done otherwise it will keep running!
# ↑this is to reset the system. make sure its set to false when you want to run the simulation.
number_slider = Slider(16, range=5..30)
pt_2 = Point(<point referenced from the Rhino model>)
pt_3 = Point(<point referenced from the Rhino model>)
ln = Line(StartPoint=pt_3, EndPoint=pt_2)
divide = DivideCurve(Curve=ln, Count=number_slider, Kinks=False)  # -> Points, Tangents, Parameters
trimcrvpts = TrimCurveWithPoints(Curve=ln, Points=divide.Points, Alternate=False)  # -> Trimmed, SubDomains
trimcrvpts_2 = TrimCurveWithPoints(Curve=ln, Points=divide.Points, Alternate=True)  # -> Trimmed, SubDomains
timer_2 = Timer(TimerInterval=5, Target=c_script_2)  # disabled
crv_2 = Curve(flatten([trimcrvpts.Trimmed, trimcrvpts_2.Trimmed]))
pt_4 = Point(flatten([pt_3, pt_2]))
pt_5 = Point(divide.Points)
addition = Addition(A=10, B=Slider(-0.52, range=-1..1))
c_script_2 = CSharpScript(
    reset=Toggle(False),
    lines=crv_2,
    fixpts=pt_4,
    weightpt=pt_5,
    damping=Slider(0.931, range=0.8..1),
    grav=addition,
    dt=Slider(0.07251, range=0..0.1))  # -> out, A, B; inputs reset: Boolean, lines: list of Curve, fixpts: list of Point3d, weightpt: list of Point3d, damping: Double, grav: Double, dt: Double
# ---------- c_script_2: C# ----------
    /*
        FileName: particle_spring
        Author:  Sawako Kaijima
        Change made by : Benjamin Yong
    */

    int i;
    int j;
    double density = 1.0;
    double stiffness = 1.0;



    //reset particle spring system
    if (reset) {
      nodes.Clear();
      edges.Clear();
    }

    //spring system node construction
    if (nodes.Count == 0) {
      for(i = 0; i < lines.Count; i++){
        Point3d spt = lines[i].PointAtStart;
        Point3d ept = lines[i].PointAtEnd;


        bool sdup = false;
        bool edup = false;
        int sid = -1;
        int eid = -1;
        for(j = 0; j < nodes.Count; j++){
          if(nodes[j].p.DistanceTo(spt) < 0.01){
            sdup = true;
            sid = j;
          }
          if(nodes[j].p.DistanceTo(ept) < 0.01){
            edup = true;
            eid = j;
          }

        }
        if(!sdup){
          sid = nodes.Count;
          nodes.Add(new Node(spt, density));
        }

        if(!edup){
          eid = nodes.Count;
          nodes.Add(new Node(ept, density));

        }

        edges.Add(new Edge(nodes[sid], nodes[eid], stiffness, 0.5));

      }


      if(fixpts.Count != 0){
        for (i = 0; i < nodes.Count; i++){
          for (j = 0; j < fixpts.Count; j++){
            Point3d temp = nodes[i].p;
            if(temp.DistanceTo(fixpts[j]) < 0.01){
              nodes[i].fix = true;
            }
          }
        }
        if(weightpt.Count != 0){
          for (i = 0; i < nodes.Count; i++){
            for(j = 0; j < weightpt.Count; j++){
              Point3d temp = nodes[i].p;
              if(temp.DistanceTo(weightpt[j]) < 0.01){
                nodes[i].weight = 10;
              }
            }
          }
        }


      }
    }


    //............................Apply Forces

    foreach(Node n in nodes){
      n.ApplyForce(dt, damping, grav);
    }

    foreach(Edge e in edges) {
      e.ApplySpringForce();
    }

    //............................Calculate Movement

    foreach(Node n in nodes){
      n.Move(dt, damping);
    }

    //.............................Output
    List<Point3d> pt = new List<Point3d>(nodes.Count);

    foreach(Node n in nodes) {
      pt.Add(n.p);
    }
    A = pt;
    List<Line> ln = new List<Line>(edges.Count);
    foreach(Edge e in edges) {
      ln.Add(new Line(e.n0.p, e.n1.p));
    }
    B = ln;
# ---------- c_script_2: C# additional code ----------
  List<Node> nodes = new List<Node>();
  List<Edge> edges = new List<Edge>();

  class Node{
    public Node(Point3d p0, double mass) {
      p = p0;
      m0 = mass;
    }

    public Point3d p = Point3d.Origin;  //position
    public Vector3d f = Vector3d.Zero;  //force
    public Vector3d v = Vector3d.Zero;  //velocity
    public double m = 0.0;              //mass
    public double m0 = 0.0;              //unit mass
    public bool fix = false;            //fix condition
    public double weight = 0.0;


    public void ApplyForce(double dt, double damping, double g) {
      f = Vector3d.ZAxis * g;
      if(weight > 0.0)  f += Vector3d.ZAxis * -weight;

    }

    public void Move(double dt, double damping) {
      if (fix) return;
      v *= damping;
      v += f * (dt / m);
      p += v * dt;
      f = Vector3d.Zero;
    }
  }

  class Edge{

    public Edge(Node nn0, Node nn1, double k0, double L00) {
      n0 = nn0; //first node
      n1 = nn1; //second node
      k = k0;  //stiffness
      L0 = n0.p.DistanceTo(n1.p); //relaxed length
      n0.m += L0 * n0.m0 * 0.5 * 0.1 * 0.05;
      n1.m += L0 * n0.m0 * 0.5 * 0.1 * 0.05;

    }

    public Node n0;
    public Node n1;

    public double L0 = 0.0;
    public double k = 0.0;

    public void ApplySpringForce() {
      Vector3d dv = n1.p - n0.p;
      double L = dv.Length;
      dv.Unitize();
      n0.f += dv * (k * (L - L0)) * 0.5;
      n1.f -= dv * (k * (L - L0)) * 0.5;
    }
  }
# ---------- end c_script_2 ----------
preview_2 = CustomPreview(Geometry=[c_script_2.B, c_script_2.A], Shader=ColourSwatch(SwatchColor=RGB(255, 0, 0)))
