# Grasshopper definition EdgeBundlingPaths.gh (Grasshopper 1.0.7)
# plug-ins: Kangaroo2 Components

crv = Curve([<curve referenced from the Rhino model> x21])
curves_here = Curve(crv)

# ---- group: Divide curve for attraction pts
len = Length(Curve=curves_here)
divide = DivideCurve(Curve=curves_here, Count=len, Kinks=False)  # -> Points, Tangents, Parameters

# ---- group: Anchors
end = EndPoints(Curve=curves_here)  # -> Start, End
pt = Point([end.Start, end.End])
duppt = RemoveDuplicatePts(Points=pt, Tolerance=0.01)
anchors_here = Point(duppt)
anchor = Anchor(Point=anchors_here, Strength=1000)

# ---- group: Attraction force
c_script = CSharpScript(
    Pts=flatten(divide.Points),
    InteractionRadius=Slider(3.52, range=0..5),
    Strength=Slider(2.531, range=0..5),
    Reference="C:\Program Files\Rhino 6\Plug-ins\Grasshopper\Components\KangarooSolver.dll")  # -> out, A; inputs Pts: list of Point3d, InteractionRadius: Double, Strength: Double
# ---------- c_script: C# usings ----------
using System.IO;
using System.Linq;
using System.Data;
using System.Drawing;
using System.Reflection;
using System.Windows.Forms;
using System.Xml;
using System.Xml.Linq;
using System.Runtime.InteropServices;

using Rhino.DocObjects;
using Rhino.Collections;
using GH_IO;
using GH_IO.Serialization;
using KangarooSolver;
using KangarooSolver.Goals;
# ---------- c_script: C# ----------
    A = new RangedAttraction(Pts, InteractionRadius, Strength);
# ---------- c_script: C# additional code ----------
  public class RangedAttraction : GoalObject
  {
    public double Strength;
    public double SqDiam;
    public double Diam;

    public RangedAttraction(List<Point3d> V, double r, double k)
    {
      int L = V.Count;
      PPos = V.ToArray();
      Move = new Vector3d[L];
      Weighting = new double[L];
      Diam = r + r;
      SqDiam = Diam * Diam;
      Strength = k;
    }

    public override void Calculate(List<KangarooSolver.Particle> p)
    {
      int L = PIndex.Length;
      double[] Xcoord = new double[L];
      for (int i = 0; i < L; i++)
      {
        Xcoord[i] = p[PIndex[i]].Position.X;
      }
      Array.Sort(Xcoord, PIndex); //by sorting in X first we can quickly rule out all pairs more than Diam apart

      for (int i = 0; i < L; i++)
      {
        Move[i] = Vector3d.Zero;
        Weighting[i] = 0;
      }

      for (int i = 0; i < (PIndex.Length - 1); i++)
      {
        for (int j = 1; (i + j) < PIndex.Length; j++)
        {
          int k = i + j;
          Vector3d Separation = p[PIndex[k]].Position - p[PIndex[i]].Position;
          if (Separation.X < Diam)
          {
            if (Separation.SquareLength < SqDiam)
            {
              double LengthNow = Separation.Length;

              double Limited = Math.Max(LengthNow, 0.001);
              double RaisedToPower = Math.Pow(Limited, -3); //other powers will give different results
              double FadeOut = RaisedToPower * (Diam - LengthNow);
              double WeightingFactor = Strength * FadeOut;

              Move[i] += WeightingFactor * 0.5 * Separation; //the target is the midpt between the 2 points
              Move[k] -= WeightingFactor * 0.5 * Separation;

              Weighting[i] += WeightingFactor;
              Weighting[k] += WeightingFactor;
            }
          }
          else
          {
            break;
          }
        }
      }

      for (int i = 0; i < L; i++)
      {
        if(Weighting[i] != 0)
        {
          Move[i] = Move[i] * (1.0 / Weighting[i]);
          Weighting[i] = Math.Min(Strength * Weighting[i], 50);
        }
      }
    }

  }
# ---------- end c_script ----------

# ---- group: Springs
shatter = Shatter(Curve=graft(curves_here), Parameters=divide.Parameters)
len_2 = Length(Curve=shatter)
multiplication = Multiplication(A=len_2, B=Slider(0, range=0..2))
length_line = LengthLine(Line=shatter, Length=multiplication, Strength=10)

# ---- group: Show
show = Show(G=divide.Points)
panel = Panel("2")
flatten = FlattenTree(Tree=show, Path=panel)

# ----
merge = Merge(Data1=flatten, Data2=length_line, Data3=c_script.A, Data4=anchor)
solver = Solver(GoalObjects=merge, Reset=Button(), Threshold=1e-09, Tolerance=0.01, On=Toggle(False))  # -> I, V, O

# ---- group: Make curves
unflatten = UnflattenTree(Tree=solver.O, Guide=merge)
branch = TreeBranch(Tree=unflatten, Path=panel, MaintainPaths=True)
unflatten_2 = UnflattenTree(Tree=branch, Guide=show)
intcrv = Interpolate(Vertices=unflatten_2, Degree=3, Periodic=False, KnotStyle=1)  # -> Curve, Length, Domain
preview = CustomPreview(Geometry=intcrv.Curve, Material=ColourSwatch(SwatchColor=RGBA(255, 255, 255, 149)))

# ----
dam = DataDam(DataA=intcrv.Curve, BufferDelay=10000000, BufferMode=0)

# ---- group: Metaball
crv_2 = Curve(flatten(dam))
len_3 = Length(Curve=crv_2)
multiplication_2 = Multiplication(A=len_3, B=Slider(1.5, range=0..10))
divide_2 = DivideCurve(Curve=crv_2, Count=multiplication_2, Kinks=False)  # -> Points, Tangents, Parameters
metaball_t = MetaBallT(Points=flatten(divide_2.Points), Plane=PlaneXY(0, 0, 0), Threshold=Slider(23.845, range=0..100))

# ---- group: Smoothen Lines
smoothpline = SmoothPolyline(Polyline=metaball_t, Strength=1, Times=Slider(4, range=0..10))
explode = Explode(Curve=smoothpline, Recursive=True)  # -> Segments, Vertices
nurbs = NurbsCurve(Vertices=explode.Vertices, Degree=3, Periodic=False)  # -> flatten(Curve), Length, Domain

# ---- group: Create Path surface
len_4 = Length(Curve=nurbs.Curve)
sort = SortList(Keys=len_4, ValuesA=nurbs.Curve)  # -> Keys, ValuesA
item = ListItem(List=reverse(sort.ValuesA), Index=0, Wrap=True)
len_5 = Length(Curve=item)
int = Integer(len_5)
int_2 = Integer(len_4)
equals = Equality(FirstNumber=int, SecondNumber=int_2)  # -> Equality, Inequality
boundary = BoundarySurfaces(Edges=item)
cull = CullPattern(List=nurbs.Curve, CullPattern=equals.Inequality)
srfsplit = SurfaceSplit(Surface=boundary, Curves=cull)
item_2 = ListItem(List=srfsplit, Index=0, Wrap=True)

# ---- group: Give Thiccness
Z = UnitZ(Factor=expr("-x", Slider(0.05, range=0..0.5)))
extr = Extrude(Base=item_2, Direction=Z)
