# Grasshopper definition Educationsector.gh (Grasshopper 1.0.7)
# plug-ins: Karamba, Pufferfish, Weaverbird, Kangaroo2 Components

# ----
# boundaries
# This GH file leads to the creation of the freeform structure
# that constitutes the education sector of the healthcare centre.
# Boundaries, corridor connections and the classroom wall
# outline can be set.
pt = Point([<point referenced from the Rhino model> x12])

# ----
# section connections
crv = Curve(<curve referenced from the Rhino model>)
crv_2 = Curve(<curve referenced from the Rhino model>)

# ----
# rails
crv_3 = Curve(<curve referenced from the Rhino model>)
crv_4 = Curve(<curve referenced from the Rhino model>)
flip = FlipCurve(Curve=crv_4)  # -> Curve, Flag

# ----
# classroom
crv_5 = Curve(<curve referenced from the Rhino model>)

# ----
# classroom
# A second mesh is created for the classroom, using existing vertices from the first mesh. This leads to the eventual creation of the slanted walls of the classrooms.
number_slider = Slider(0, range=0..1)
crv_6 = Curve(crv_5)
boundary = BoundarySurfaces(Edges=crv_6)

# ----
# main body
number_slider_2 = Slider(0, range=0..1)

# ----
# south
number_slider_3 = Slider(3, range=1..5)
pt_2 = Point([<point referenced from the Rhino model> x2])
cir = Circle(Plane=pt_2, Radius=number_slider_3)

# ----
# forming starting mesh
# this is where the starting mesh for kangaroo is created. tweaking the number sliders will change the outline of the mesh.
pline = PolyLine(Vertices=pt, Closed=False)
explode = Explode(Curve=pline, Recursive=True)  # -> Segments, Vertices
lstdex = LastIndex(List=explode.Segments)
item = ListItem(List=explode.Segments, Index=lstdex, Wrap=True)
item_2 = ListItem(List=explode.Segments, Index=0, Wrap=True)
end = EndPoints(Curve=item_2)  # -> Start, End
end_2 = EndPoints(Curve=flip.Curve)  # -> Start, End
end_3 = EndPoints(Curve=item)  # -> Start, End

tangent = Tangent(curve=item, point=end_3.End)  # -> point_2, tangent
tangent_2 = Tangent(curve=flip.Curve, point=end_2.End)  # -> point_2, tangent
neg = Negative(Value=tangent_2.tangent)
bezier = Bezier(
    point_a=tangent.point_2,
    vector_a=tangent.tangent,
    strength_a=Slider(2.07, range=0..5),
    point_b=tangent_2.point_2,
    vector_b=neg,
    strength_b=Slider(3.17, range=0..5))

tangent_3 = Tangent(curve=flip.Curve, point=end_2.Start)  # -> point_2, tangent
tangent_4 = Tangent(curve=item_2, point=end.Start)  # -> point_2, tangent
neg_2 = Negative(Value=tangent_4.tangent)
bezier_2 = Bezier(
    point_a=tangent_3.point_2,
    vector_a=tangent_3.tangent,
    strength_a=Slider(3.85, range=0..5),
    point_b=tangent_4.point_2,
    vector_b=neg_2,
    strength_b=Slider(2.1, range=0..5))

curvepoint = PointOnCurve(crv_3, parameter=0.71)
curvepoint_2 = PointOnCurve(crv_3, parameter=0.247)
ln = Line(StartPoint=curvepoint_2, EndPoint=end.Start)
ln_2 = Line(StartPoint=curvepoint, EndPoint=end_3.End)
trimcrvpts = TrimCurveWithPoints(Curve=crv_3, Points=[curvepoint_2, curvepoint], Alternate=False)  # -> Trimmed, SubDomains
trimcrvpts_2 = TrimCurveWithPoints(Curve=crv_3, Points=[curvepoint_2, curvepoint], Alternate=True)  # -> Trimmed, SubDomains
item_3 = ListItem(List=trimcrvpts.Trimmed, Index=0, Wrap=True)  # -> Item, Item1

join = JoinCurves(Curves=flatten([ln, trimcrvpts_2.Trimmed, ln_2, explode.Segments]), Preserve=False)
boundary_2 = BoundarySurfaces(Edges=flatten([join, flip.Curve]))

flip_2 = FlipCurve(Curve=ln)  # -> Curve, Flag
swpunsplit = SweepUnsplitSurface(Sections=flatten([crv, flip_2.Curve]), Rail1=bezier_2, Rail2=item_3.Item)

flip_3 = FlipCurve(Curve=ln_2)  # -> Curve, Flag
flip_4 = FlipCurve(Curve=bezier)  # -> Curve, Flag
flip_5 = FlipCurve(Curve=item_3.Item1)  # -> Curve, Flag
swpunsplit_2 = SweepUnsplitSurface(Sections=flatten([crv_2, flip_3.Curve]), Rail1=flip_4.Curve, Rail2=flip_5.Curve)

join_2 = BrepJoin(Breps=flatten([boundary_2, swpunsplit, swpunsplit_2]))  # -> Breps, Closed
mesh_breps = MeshBrepsKaramba3D(
    Brep=join_2.Breps,
    MeshResolution=Slider(0.3, range=0.1..1),
    EdgeRefinementFactor=0.67,
    PointReduction=False,
    SmoothingStepSize=0,
    SmoothingIterations=5)  # -> Mesh, Info

# ----
# This is where the anchor points and mesh springs are established.
# supports
# vertices on mesh perimeter
medges = MeshEdges(Mesh=mesh_breps.Mesh)  # -> NakedEdges, InteriorEdges, NonManifoldEdges
end_4 = EndPoints(Curve=medges.NakedEdges)  # -> Start, End
pt_3 = Point(flatten([end_4.Start, end_4.End]))
wires = BrepWireframe(Brep=boundary_2, Density=-1)
duppt = RemoveDuplicatePts(Points=pt_3, Tolerance=0.01)
join_3 = JoinCurves(Curves=wires, Preserve=False)
crv_cp = CurveClosestPoint(Point=duppt, Curve=join_3)  # -> Point, Parameter, Distance
smaller = SmallerThan(FirstNumber=crv_cp.Distance, SecondNumber=Slider(0.05, range=0..0.1))  # -> SmallerThan, OrEqualTo
cull = CullPattern(List=duppt, CullPattern=smaller.SmallerThan)

# ----
# east
# Lines
# Different parts of the mesh have different spring strengths and weights. Leading to a particular geometric form after the mesh is relaxed.
number_slider_4 = Slider(2, range=0..3)
item_4 = ListItem(List=mesh_breps.Mesh, Index=number_slider_4, Wrap=True)
wbedges = WeaverbirdsMeshEdges(MeshOrPolylines=item_4)

# ----
# corridor connections
# west
number_slider_5 = Slider(1, range=0..3)
item_5 = ListItem(List=mesh_breps.Mesh, Index=number_slider_5, Wrap=True)
wbedges_2 = WeaverbirdsMeshEdges(MeshOrPolylines=item_5)

item_6 = ListItem(List=mesh_breps.Mesh, Index=number_slider, Wrap=True)
wbedges_3 = WeaverbirdsMeshEdges(MeshOrPolylines=item_6)
end_5 = EndPoints(Curve=wbedges_3)  # -> Start, End
incurve = PointInCurve(Point=end_5.Start, Curve=crv_6)  # -> Relationship, Point
incurve_2 = PointInCurve(Point=end_5.End, Curve=crv_6)  # -> Relationship, Point
and = GateAnd(A=incurve.Relationship, B=incurve_2.Relationship)
cull_2 = CullPattern(List=wbedges_3, CullPattern=and)
wbweave = WeaverbirdsMeshFromLinesWeaveBack(Lines=cull_2, MaximumValence=4)
medges_2 = MeshEdges(Mesh=wbweave)  # -> NakedEdges, InteriorEdges, NonManifoldEdges
wbedges_4 = WeaverbirdsMeshEdges(MeshOrPolylines=wbweave)
line = Line(medges_2.NakedEdges)
srfsplit = SurfaceSplit(Surface=boundary, Curves=line)
end_6 = EndPoints(Curve=line)  # -> Start, End
item_7 = ListItem(List=srfsplit, Index=0, Wrap=True)  # -> Item, Item1
pt_4 = Point([end_6.Start, end_6.End])
cullpt = CullDuplicates(Points=pt_4, Tolerance=0.1, CullMode=3)  # -> Points, Indices, Valence
mesh_breps_2 = MeshBrepsKaramba3D(
    Brep=item_7.Item,
    InclusionPoints=cullpt.Points,
    MeshResolution=Slider(1, range=0.1..1),
    EdgeRefinementFactor=0.67,
    PointReduction=False,
    SmoothingStepSize=0,
    SmoothingIterations=5)  # -> Mesh, Info
flipm = FlipMesh(Mesh=wbweave, VertexNormals=True, FaceNormals=True, FaceOrientation=True)
mesh = Mesh(flatten([mesh_breps_2.Mesh, flipm]))
wbjoin = WeaverbirdsJoinMeshesAndWeld(Mesh=mesh, Weld=True)
wbedges_5 = WeaverbirdsMeshEdges(MeshOrPolylines=wbjoin)

item_8 = ListItem(List=mesh_breps.Mesh, Index=number_slider_2, Wrap=True)
wbedges_6 = WeaverbirdsMeshEdges(MeshOrPolylines=item_8)
curvepoint_3 = PointOnCurve(wbedges_6, parameter=0.5)
incurve_3 = PointInCurve(Point=curvepoint_3, Curve=crv_6)  # -> Relationship, Point
equals = Equality(FirstNumber=incurve_3.Relationship, SecondNumber=Slider(0, range=0..100))  # -> Equality, Inequality
cull_3 = CullPattern(List=wbedges_6, CullPattern=equals.Inequality)
cull_4 = CullPattern(List=wbedges_6, CullPattern=equals.Equality)

curvepoint_4 = PointOnCurve(cull_4, parameter=0.5)
incurves = PointInCurves(Point=curvepoint_4, Curves=cir)  # -> Relationship, Index, Point

incurve_4 = PointInCurve(Point=curvepoint_4, Curve=graft(cir))  # -> Relationship, Point
cull_5 = CullPattern(List=cull_4, CullPattern=incurve_4.Relationship)
bang = ExplodeTree(Data=cull_5)  # -> Branch0, Branch1
curvepoint_5 = PointOnCurve([bang.Branch0, bang.Branch1], parameter=0.5)
dist = Distance(PointA=pt_2, PointB=curvepoint_5)
hilo = HighestLowestNumbers(Numbers=dist)  # -> Highest, Lowest

equals_2 = Equality(FirstNumber=incurves.Relationship, SecondNumber=Slider(0, range=0..100))  # -> Equality, Inequality
cull_6 = CullPattern(List=cull_4, CullPattern=equals_2.Equality)

# ----
# kangaroo
number_slider_6 = Slider(0, range=0..100)
lstdex_2 = LastIndex(List=pt)
cull_i = CullIndex(List=pt, Indices=flatten([number_slider_6, lstdex_2]), Wrap=True)
cir_2 = Circle(Plane=cull_i, Radius=Slider(0.4, range=0.01..1.5))  # -> graft(Circle)
incurve_5 = PointInCurve(Point=cull, Curve=cir_2)  # -> Relationship, Point
cull_7 = CullPattern(List=cull, CullPattern=incurve_5.Relationship)
pt_5 = Point(flatten(cull_7))
cullpt_2 = CullDuplicates(Points=pt_5, Tolerance=0.1, CullMode=3)  # -> Points, Indices, Valence

medges_3 = MeshEdges(Mesh=wbjoin)  # -> NakedEdges, InteriorEdges, NonManifoldEdges
end_7 = EndPoints(Curve=medges_3.NakedEdges)  # -> Start, End
pt_6 = Point(flatten([end_7.Start, end_7.End]))
curvepoint_6 = PointOnCurve(crv_5, parameter=0.5)
duppt_2 = RemoveDuplicatePts(Points=pt_6, Tolerance=0.01)
dist_2 = Distance(PointA=duppt_2, PointB=curvepoint_6)
larger = LargerThan(FirstNumber=dist_2, SecondNumber=Slider(0.85, range=0.1..2))  # -> LargerThan, OrEqualTo
cull_8 = CullPattern(List=duppt_2, CullPattern=larger.LargerThan)

crv_cp_2 = CurveClosestPoint(Point=duppt, Curve=graft(crv))  # -> Point, Parameter, Distance
smaller_2 = SmallerThan(FirstNumber=crv_cp_2.Distance, SecondNumber=Slider(0.05, range=0..0.1))  # -> SmallerThan, OrEqualTo
cull_9 = CullPattern(List=duppt, CullPattern=smaller_2.SmallerThan)

crv_cp_3 = CurveClosestPoint(Point=duppt, Curve=graft(crv_3))  # -> Point, Parameter, Distance
smaller_3 = SmallerThan(FirstNumber=crv_cp_3.Distance, SecondNumber=Slider(0.05, range=0..0.1))  # -> SmallerThan, OrEqualTo
cull_10 = CullPattern(List=duppt, CullPattern=smaller_3.SmallerThan)

crv_cp_4 = CurveClosestPoint(Point=duppt, Curve=graft([bezier, bezier_2]))  # -> Point, Parameter, Distance
smaller_4 = SmallerThan(FirstNumber=crv_cp_4.Distance, SecondNumber=Slider(0.05, range=0..0.1))  # -> SmallerThan, OrEqualTo
cull_11 = CullPattern(List=crv_cp_4.Point, CullPattern=smaller_4.SmallerThan)

crv_cp_5 = CurveClosestPoint(Point=duppt, Curve=graft(crv_2))  # -> Point, Parameter, Distance
smaller_5 = SmallerThan(FirstNumber=crv_cp_5.Distance, SecondNumber=Slider(0.05, range=0..0.1))  # -> SmallerThan, OrEqualTo
cull_12 = CullPattern(List=duppt, CullPattern=smaller_5.SmallerThan)

# ----
# normal
number_slider_7 = Slider(0, range=0..100)
length_line = LengthLine(Line=cull_4, Length=number_slider_7, Strength=10)
dw = DynamicWeight1d(Line=cull_6, Weight=Slider(2.25, range=0..6))

# ----
# corridor ends
number_slider_8 = Slider(0, range=0..100)
length_line_2 = LengthLine(Line=[wbedges_2, wbedges], Length=number_slider_8, Strength=10)
dw_2 = DynamicWeight1d(Line=wbedges, Weight=Slider(0.7, range=0..3))
dw_3 = DynamicWeight1d(Line=wbedges_2, Weight=Slider(0.3, range=0..3))

# ----
# real classroom
number_slider_9 = Slider(10, range=0..100)
length_line_3 = LengthLine(Line=wbedges_5, Length=Slider(0, range=0..100), Strength=number_slider_9)

# ----
# following classroom
number_slider_10 = Slider(0, range=0..100)
length_line_4 = LengthLine(Line=cull_3, Length=number_slider_10, Strength=10)
dw_4 = DynamicWeight1d(Line=cull_3, Weight=Slider(1.7, range=0..6))

# ----
# corridor
dom = ConstructDomain(DomainStart=hilo.Lowest, DomainEnd=hilo.Highest)
dom_2 = ConstructDomain(
    DomainStart=graft([Slider(0, range=0..4), Slider(0.5, range=0..4)]),
    DomainEnd=graft([Slider(1, range=0..4), Slider(2, range=0..4)]))
remap = RemapNumbers(Value=dist, Source=dom, Target=dom_2)  # -> Mapped, Clipped
dw_5 = DynamicWeight1d(Line=cull_5, Weight=remap.Mapped)

# ----
# anchor points
anchor = Anchor(Point=[cull_12, cull_9, cull_10, cull_11, cull_8, cullpt_2.Points], Strength=10000)

# ----
# Execution
# The mesh is relaxed. Thicknesses can be set here.
merge = Merge(
    Data1=anchor,
    Data2=length_line_3,
    Data3=length_line_4,
    Data4=dw_4,
    Data5=dw_5,
    Data6=length_line,
    Data7=dw,
    Data8=length_line_2,
    Data9=dw_3,
    Data10=dw_2)
solver = Solver(GoalObjects=merge, Reset=Button(), Threshold=1e-15, Tolerance=0.01, On=Toggle(False))  # -> I, V, O
iterations = Panel(solver.I)
clean = CleanTree(RemoveNulls=True, RemoveInvalid=True, RemoveEmpty=True, Tree=solver.O)
number_slider_11 = Slider(0.25, range=0.1..1.1)
wbweave_2 = WeaverbirdsMeshFromLinesWeaveBack(Lines=clean, MaximumValence=4)
wbloop = WeaverbirdsLoopSubdivision(MeshCurves=wbweave_2, Level=Slider(0, range=0..4), SmoothNakedEdges=0)  # -> graft(OutputMeshCurves)
neg_3 = Negative(Value=number_slider_11)
offmsh = OffsetMesh(Mesh=wbloop, Distance=graft([neg_3, number_slider_11]), BothSides=False, CreateSolid=True)
xy = XYPlane(Origin=Point(0, 0, 0))
trimmshpln = TrimMeshWithPlane(Mesh=offmsh, Plane=xy, Flip=False, TrimType=0)  # -> Trimmed, R
clsmsh = CloseMesh(Mesh=trimmshpln.Trimmed, Quadrangulate=True)  # -> Closed, R

# ==== cluster Bezier
point_b = ClusterInput()
strength_a = ClusterInput()
vector_b = ClusterInput()
vector_a = ClusterInput()
strength_b = ClusterInput()
point_a = ClusterInput()
multiplication = Multiplication(A=vector_b, B=strength_b)
multiplication_2 = Multiplication(A=vector_a, B=strength_a)
bzspan = BezierSpan(StartPoint=point_a, StartTangent=multiplication_2, EndPoint=point_b, EndTangent=multiplication)  # -> Curve, Length, Domain
bezier_curve = ClusterOutput(bzspan.Curve)

# ==== cluster Tangent
point = ClusterInput()
curve = ClusterInput()
crv_cp = CurveClosestPoint(Point=point, Curve=curve)  # -> Point, Parameter, Distance
eval = EvaluateCurve(Curve=curve, Parameter=crv_cp.Parameter)  # -> Point, Tangent, Angle
point_2 = ClusterOutput(eval.Point)
tangent = ClusterOutput(eval.Tangent)
