# Grasshopper definition Entrance.gh (Grasshopper 1.0.7)
# plug-ins: EleFront

arc_height_offset = Slider(0, range=-2..2)
overall_height = Slider(6.5, range=0..10)

# ---- group: Facing Courtyard
crv = Curve(<curve referenced from the Rhino model>)
explode = Explode(Curve=crv, Recursive=True)  # -> Segments, Vertices
number_slider = Slider(0.5, range=0..1)
pframe = PerpFrame(Curve=reparameterize(explode.Segments), Parameter="0.5")
deplane = DeconstructPlane(Plane=graft(pframe))  # -> Origin, XAxis, YAxis, ZAxis
amp = Amplitude(Vector=deplane.YAxis, Amplitude=Slider(0.4, range=-2..2))
move = Move(Geometry=graft(explode.Segments), Motion=amp)  # -> Geometry, Transform
ext = ExtendCurve(Curve=flatten(move.Geometry), Type=0, Start=expr("-x", number_slider), End=expr("-x", number_slider))
rev = Reverse(Vector=deplane.XAxis)
addition = Addition(A=Slider(10, range=0..15), B=arc_height_offset)
Z = UnitZ(Factor=1)
end = EndPoints(Curve=ext)  # -> Start, End
cat = Catenary(PointA=end.Start, PointB=end.End, Length=addition, Gravity=Z)
explode_2 = Explode(Curve=cat, Recursive=True)  # -> Segments, Vertices
intcrv = Interpolate(Vertices=explode_2.Vertices, Degree=3, Periodic=False, KnotStyle=1)  # -> simplify(Curve), Length, Domain

# ---- group: Facing Court - Surrounding lines
height = Slider(6, range=0..10)
end_2 = EndPoints(Curve=graft(explode.Segments))  # -> Start, End
addition_2 = Addition(A=rev, B=amp)
Z_2 = UnitZ(Factor=overall_height)
move_2 = Move(Geometry=[end_2.Start, end_2.End], Motion=Z_2)  # -> Geometry, Transform
item = ListItem(List=move_2.Geometry, Index=0, Wrap=True)  # -> Item, Item1
ln = Line(StartPoint=[end_2.Start, end_2.End], EndPoint=move_2.Geometry)
cat_2 = Catenary(PointA=item.Item, PointB=item.Item1, Length=Slider(4.11, range=0..10), Gravity=addition_2)
item_2 = ListItem(List=flatten(ln), Index=0, Wrap=True)
explode_3 = Explode(Curve=cat_2, Recursive=True)  # -> Segments, Vertices
end_3 = EndPoints(Curve=item_2)  # -> Start, End
xz = XZPlane(Origin=end_3.Start)
intcrv_2 = Interpolate(Vertices=explode_3.Vertices, Degree=3, Periodic=False, KnotStyle=1)  # -> Curve, Length, Domain
aligndim = AlignedDimension(Plane=xz, PointA=end_3.Start, PointB=end_3.End, Offset=1, Text="{0:0.00}", Size=Slider(0.3, range=0..1))
pshift = ShiftPaths(Data=intcrv_2.Curve, Offset=-1)
join = JoinCurves(Curves=[ln, pshift], Preserve=False)  # -> simplify(Curves)

# ----
# REAR
dimension = Dimension(pt=explode_2.Vertices)
loft = Loft(
    Curves=[intcrv.Curve, join],
    Options={Adjust=False, Closed=False, LoftEnds=0, LoftSimp=0, LoftType=0, Rebuild=10, Refit=0.01})

# ---- group: Entrance arch
crv_2 = Curve(<curve referenced from the Rhino model>)
explode_4 = Explode(Curve=crv_2, Recursive=True)  # -> Segments, Vertices
pframe_2 = PerpFrame(Curve=reparameterize(explode_4.Segments), Parameter="0.5")
deplane_2 = DeconstructPlane(Plane=graft(pframe_2))  # -> Origin, XAxis, YAxis, ZAxis
number_slider_2 = Slider(0.5, range=0..1)
amp_2 = Amplitude(Vector=deplane_2.YAxis, Amplitude=Slider(-0.5, range=-2..2))
arc_length = Slider(9.8, range=0..20)
move_3 = Move(Geometry=graft(explode_4.Segments), Motion=amp_2)  # -> Geometry, Transform
# FRONT
rev_2 = Reverse(Vector=deplane_2.XAxis)
ext_2 = ExtendCurve(Curve=flatten(move_3.Geometry), Type=0, Start=expr("-x", number_slider_2), End=expr("-x", number_slider_2))
addition_3 = Addition(A=arc_length, B=arc_height_offset)
end_4 = EndPoints(Curve=ext_2)  # -> Start, End
Z_3 = UnitZ(Factor=1)
cat_3 = Catenary(PointA=end_4.Start, PointB=end_4.End, Length=addition_3, Gravity=Z_3)
explode_5 = Explode(Curve=cat_3, Recursive=True)  # -> Segments, Vertices
intcrv_3 = Interpolate(Vertices=explode_5.Vertices, Degree=3, Periodic=False, KnotStyle=1)  # -> Curve, Length, Domain
simplify = SimplifyTree(Tree=graft(intcrv_3.Curve), Front=False)  # -> simplify(Tree)
dimension_2 = Dimension(pt=explode_5.Vertices)

# ---- group: Surrounding lines
dip_length = Slider(3.7, range=0..10)
height_2 = Slider(6, range=0..10)
end_5 = EndPoints(Curve=graft(explode_4.Segments))  # -> Start, End
Z_4 = UnitZ(Factor=overall_height)
move_4 = Move(Geometry=[end_5.Start, end_5.End], Motion=Z_4)  # -> Geometry, Transform
addition_4 = Addition(A=amp_2, B=rev_2)
item_3 = ListItem(List=move_4.Geometry, Index=0, Wrap=True)  # -> Item, Item1
ln_2 = Line(StartPoint=[end_5.Start, end_5.End], EndPoint=move_4.Geometry)
cat_4 = Catenary(PointA=item_3.Item, PointB=item_3.Item1, Length=dip_length, Gravity=addition_4)
item_4 = ListItem(List=flatten(ln_2), Index=0, Wrap=True)
explode_6 = Explode(Curve=cat_4, Recursive=True)  # -> Segments, Vertices
end_6 = EndPoints(Curve=item_4)  # -> Start, End
xz_2 = XZPlane(Origin=end_6.Start)
intcrv_4 = Interpolate(Vertices=explode_6.Vertices, Degree=3, Periodic=False, KnotStyle=1)  # -> Curve, Length, Domain
aligndim_2 = AlignedDimension(Plane=xz_2, PointA=end_6.Start, PointB=end_6.End, Offset=1, Text="{0:0.00}", Size=Slider(0.3, range=0..1))
pshift_2 = ShiftPaths(Data=intcrv_4.Curve, Offset=-1)
join_2 = JoinCurves(Curves=[ln_2, pshift_2], Preserve=False)  # -> simplify(Curves)

# ---- group: Entrance arch (continued)
loft_2 = Loft(
    Curves=[simplify, join_2],
    Options={Adjust=False, Closed=False, LoftEnds=0, LoftSimp=0, LoftType=1, Rebuild=10, Refit=0.01})

# ---- group: Side vaults
number_slider_3 = Slider(0.5, range=0..1)
crv_3 = Curve([<curve referenced from the Rhino model> x2])
explode_7 = Explode(Curve=crv_3, Recursive=True)  # -> Segments, Vertices
ext_3 = ExtendCurve(Curve=flatten(explode_7.Segments), Type=0, Start=expr("-x", number_slider_3), End=expr("-x", number_slider_3))
addition_5 = Addition(A=Slider(11, range=0..15), B=arc_height_offset)
Z_5 = UnitZ(Factor=1)
end_7 = EndPoints(Curve=ext_3)  # -> Start, End
cat_5 = Catenary(PointA=end_7.Start, PointB=end_7.End, Length=addition_5, Gravity=Z_5)
explode_8 = Explode(Curve=cat_5, Recursive=True)  # -> Segments, Vertices
panel = Panel("""0
3""")
intcrv_5 = Interpolate(Vertices=explode_8.Vertices, Degree=3, Periodic=False, KnotStyle=1)  # -> Curve, Length, Domain
item_5 = ListItem(List=flatten(intcrv_3.Curve), Index=panel, Wrap=True)  # -> graft(Item)
loft_3 = Loft(
    Curves=[item_5, intcrv_5.Curve],
    Options={Adjust=False, Closed=False, LoftEnds=0, LoftSimp=0, LoftType=0, Rebuild=10, Refit=0.01})

# ---- group: Center Vaults
panel_2 = Panel("""1
2""")
item_6 = ListItem(List=flatten(intcrv_3.Curve), Index=panel_2, Wrap=True)
crv_4 = Curve(flatten(intcrv.Curve))
graft = GraftTree(Tree=crv_4, IncludeEmptyLists=True, IncludeNullItems=True)
graft_2 = GraftTree(Tree=item_6, IncludeEmptyLists=True, IncludeNullItems=True)
loft_4 = Loft(
    Curves=[graft, graft_2],
    Options={Adjust=False, Closed=False, LoftEnds=0, LoftSimp=0, LoftType=0, Rebuild=10, Refit=0.01})

# ----
# SIDES
side_base_curves = Curve([<curve referenced from the Rhino model> x2])

# ---- group: Side Arches
crv_5 = Curve(side_base_curves)
number_slider_4 = Slider(1, range=0..10)
explode_9 = Explode(Curve=crv_5, Recursive=True)  # -> Segments, Vertices
offset = Slider(0.4, range=0..1)
item_7 = ListItem(List=explode_9.Segments, Index=1, Wrap=True)
ext_4 = ExtendCurve(Curve=item_7, Type=0, Start=expr("-x", number_slider_4), End=expr("-x", number_slider_4))
X = UnitX(Factor=expr("-x", offset))
Y = UnitY(Factor=offset)
move_5 = Move(Geometry=ext_4, Motion=graft([Y, X]))  # -> Geometry, Transform
addition_6 = Addition(A=Slider(10.09, range=0..100), B=arc_height_offset)
end_8 = EndPoints(Curve=move_5.Geometry)  # -> Start, End
Z_6 = UnitZ(Factor=1)
cat_6 = Catenary(PointA=end_8.Start, PointB=end_8.End, Length=addition_6, Gravity=Z_6)
explode_10 = Explode(Curve=cat_6, Recursive=True)  # -> Segments, Vertices
intcrv_6 = Interpolate(Vertices=explode_10.Vertices, Degree=3, Periodic=False, KnotStyle=1)  # -> Curve, Length, Domain

# ----
dimension_3 = Dimension(pt=explode_10.Vertices)

# ---- group: Long vault
number_slider_5 = Slider(1.5, range=0..10)
crv_6 = Curve([<curve referenced from the Rhino model> x3])
ext_5 = ExtendCurve(Curve=crv_6, Type=0, Start=expr("-x", number_slider_5), End=expr("-x", number_slider_5))
Z_7 = UnitZ(Factor=1)
end_9 = EndPoints(Curve=ext_5)  # -> Start, End
addition_7 = Addition(A=Slider(11.62, range=0..100), B=arc_height_offset)
cat_7 = Catenary(PointA=end_9.Start, PointB=end_9.End, Length=addition_7, Gravity=Z_7)
item_8 = ListItem(List=flatten(intcrv_6.Curve), Index=0, Wrap=True)  # -> Item, Item1
explode_11 = Explode(Curve=cat_7, Recursive=True)  # -> Segments, Vertices
intcrv_7 = Interpolate(Vertices=explode_11.Vertices, Degree=3, Periodic=False, KnotStyle=1)  # -> Curve, Length, Domain
merge = Merge(Data1=flatten(item_8.Item1), Data2=flatten(intcrv_7.Curve), Data3=flatten(item_8.Item))
loft_5 = Loft(Curves=merge, Options={Adjust=False, Closed=False, LoftEnds=0, LoftSimp=0, LoftType=2, Rebuild=10, Refit=0.01})

# ----
# INTERIOR VAULTS
dimension_4 = Dimension(pt=explode_11.Vertices)
dimension_5 = Dimension(pt=explode_8.Vertices)

# ---- group: Corridor arches
number_slider_6 = Slider(3, range=0..10)
Y_2 = UnitY(Factor=expr("-x", number_slider_6))
X_2 = UnitX(Factor=number_slider_6)
crv_7 = Curve(<curve referenced from the Rhino model>)
crv_8 = Curve(<curve referenced from the Rhino model>)
extr = Extrude(Base=crv_7, Direction=Y_2)
extr_2 = Extrude(Base=crv_8, Direction=X_2)
split = SplitBrep(Brep=graft([extr, extr_2]), Cutter=flatten(loft_5))
item_9 = ListItem(List=split, Index=0, Wrap=True)

# ---- group: Side walls
height_3 = Slider(6, range=0..10)
dip = Slider(5.17, range=0..10)
explode_12 = Explode(Curve=side_base_curves, Recursive=True)  # -> Segments, Vertices
item_10 = ListItem(List=explode_12.Segments, Index=3, Wrap=True)
Z_8 = UnitZ(Factor=overall_height)
item_11 = ListItem(List=explode_12.Segments, Index="1", Wrap=True)
Z_9 = UnitZ(Factor=overall_height)
move_6 = Move(Geometry=item_10, Motion=Z_9)  # -> Geometry, Transform
move_7 = Move(Geometry=item_11, Motion=Z_8)  # -> Geometry, Transform
vec = VectorXYZ(XComponent=expr("-X", offset), YComponent=0, ZComponent="-1")  # -> Vector, Length
end_10 = EndPoints(Curve=graft(move_6.Geometry))  # -> Start, End
vec_2 = VectorXYZ(XComponent=0, YComponent=offset, ZComponent="-1")  # -> Vector, Length
dip_2 = Slider(9.6, range=0..15)
end_11 = EndPoints(Curve=graft(move_7.Geometry))  # -> Start, End
cat_8 = Catenary(PointA=end_10.Start, PointB=end_10.End, Length=dip_2, Gravity=Vector(0, 0, -1))
cat_9 = Catenary(PointA=end_11.Start, PointB=end_11.End, Length=dip, Gravity=graft([vec_2.Vector, vec.Vector]))
explode_13 = Explode(Curve=cat_8, Recursive=True)  # -> Segments, Vertices
explode_14 = Explode(Curve=cat_9, Recursive=True)  # -> Segments, Vertices
intcrv_8 = Interpolate(Vertices=explode_13.Vertices, Degree=3, Periodic=False, KnotStyle=1)  # -> Curve, Length, Domain
intcrv_9 = Interpolate(Vertices=explode_14.Vertices, Degree=3, Periodic=False, KnotStyle=1)  # -> Curve, Length, Domain
end_12 = EndPoints(Curve=item_11)  # -> Start, End
pshift_3 = ShiftPaths(Data=intcrv_8.Curve, Offset=-2)
loft_6 = Loft(
    Curves=[item_10, pshift_3],
    Options={Adjust=True, Closed=False, LoftEnds=0, LoftSimp=0, LoftType=0, Rebuild=10, Refit=0.01})
pshift_4 = ShiftPaths(Data=intcrv_9.Curve, Offset=-1)
ln_3 = Line(StartPoint=end_12.Start, EndPoint=end_11.Start)
ln_4 = Line(StartPoint=end_11.End, EndPoint=end_12.End)
brep = Brep(flatten(item_9))
brep_2 = Brep(simplify(loft_3))
panel_3 = Panel("""0
2""")
item_12 = ListItem(List=explode_12.Segments, Index=panel_3, Wrap=True)
Z_10 = UnitZ(Factor=overall_height)
simplify_2 = SimplifyTree(Tree=reverse(graft(brep)), Front=False)
join_3 = JoinCurves(Curves=[pshift_4, ln_3, ln_4], Preserve=False)  # -> simplify(Curves)
crv_9 = Curve(simplify(intcrv_6.Curve))
extr_3 = Extrude(Base=item_12, Direction=Z_10)  # -> simplify(Extrusion)
loft_7 = Loft(Curves=[join_3, crv_9], Options={Adjust=True, Closed=False, LoftEnds=0, LoftSimp=0, LoftType=0, Rebuild=10, Refit=0.01})
splitmul = SplitBrepMultiple(Brep=loft_6, Cutters=[simplify_2, brep_2])
sort = SortList(Keys=splitmul, ValuesA=splitmul)  # -> Keys, ValuesA
item_13 = ListItem(List=reverse(sort.ValuesA), Index=0, Wrap=True)
join_4 = BrepJoin(Breps=[loft_7, item_13, extr_3])  # -> Breps, Closed

# ----
# ROOF
crv_10 = Curve(intcrv_2.Curve)
crv_11 = Curve(intcrv_8.Curve)
crv_12 = Curve(intcrv_4.Curve)
flatten = FlattenTree(Tree=crv_12, Path="{0}")  # -> graft(Tree)
item_14 = ListItem(List=flatten(crv_11), Index=0, Wrap=True)  # -> Item, Item1
merge_2 = Merge(Data1=item_14.Item1, Data2=flatten(crv_10), Data3=item_14.Item)  # -> graft(Result)
tweencrv = TweenCurve(CurveA=merge_2, CurveB=flatten, Factor=0.5, BlendType=0)
end_13 = EndPoints(Curve=tweencrv)  # -> Start, End
ln_5 = Line(StartPoint=end_13.Start, EndPoint=end_13.End)
merge_3 = Merge(Data1=merge_2, Data2=ln_5, Data3=flatten)
loft_8 = Loft(Curves=merge_3, Options={Adjust=True, Closed=False, LoftEnds=0, LoftSimp=0, LoftType=0, Rebuild=10, Refit=0.01})

# ---- group: Make Cross Vaults
srf = Surface(loft_4)
srf_2 = Surface(loft_3)
merge_4 = Merge(Data1=srf, Data2=srf_2)  # -> flatten(Result)
geo = Geometry(merge_4)
geo_2 = Geometry(loft_5)
splitmul_2 = SplitBrepMultiple(Brep=geo_2, Cutters=flatten([geo, extr, extr_2]))
split_2 = SplitBrep(Brep=graft(geo), Cutter=flatten(loft_5))
panel_4 = Panel("""0
1""")
area = Area(Geometry=splitmul_2)  # -> Area, Centroid
item_15 = ListItem(List=split_2, Index=panel_4, Wrap=True)
sort_2 = SortList(Keys=area.Area, ValuesA=splitmul_2)  # -> Keys, ValuesA
item_16 = ListItem(List=reverse(sort_2.ValuesA), Index="0", Wrap=True)
join_5 = BrepJoin(Breps=flatten([item_16, item_15, item_9]))  # -> Breps, Closed

# ---- group: View Geometry
inner_vaults = Brep(join_5.Breps)
outer_walls = Brep([loft_2, loft, join_4.Breps])
roof = Brep(loft_8)
preview = CustomPreview(Geometry=[outer_walls, inner_vaults, roof], Material=ColourSwatch(SwatchColor=RGB(184, 176, 176)))

# ---- group: Bake and Update
layer = DefineLayer(Name="Entrance")
attributes = DefineObjectAttributes(Layer=layer)
bake = BakeObjects(Geometry=flatten([outer_walls, inner_vaults, roof]), Attributes=attributes, BakeName="Entrance 4", Bake=False)

# ==== cluster Dimension
pt = ClusterInput()
pt_2 = Point(flatten(pt))
pdecon = Deconstruct(Point=pt_2)  # -> XComponent, YComponent, ZComponent
sort = SortList(Keys=pdecon.ZComponent, ValuesA=pt_2)  # -> Keys, ValuesA
item = ListItem(List=reverse(sort.ValuesA), Index=0, Wrap=True)
pdecon_2 = Deconstruct(Point=item)  # -> XComponent, YComponent, ZComponent
pt_3 = ConstructPoint(XCoordinate=pdecon_2.XComponent, YCoordinate=pdecon_2.YComponent, ZCoordinate=0)
xz = XZPlane(Origin=pt_3)
aligndim = AlignedDimension(Plane=xz, PointA=item, PointB=pt_3, Offset=1, Text="{0:0.00}", Size=Slider(0.3, range=0..1))
