# Grasshopper definition 20181005_moduleClass.gh (Grasshopper 1.0.7)

python = GhPythonScript(
    openingsWidth=Slider(1.17, range=0.8..1.6),
    openingsHeight=Slider(2.13, range=2..2.5),
    boundaryPosition=Toggle(True),
    backWall=Toggle(True),
    backOpeningsNumber=Slider(4, range=3..6),
    backOpeningsSize=Slider(0.2, range=0.01..0.2),
    backOpenings=Toggle(True),
    innerOpeningsWidth=Slider(1.37, range=0.8..1.6),
    innerOpeningsHeight=Slider(2, range=2..2.5),
    leftNeighbour=Toggle(True),
    rightNeighbour=Toggle(True),
    distanceFromIW=Slider(0.48, range=0.1..1))  # -> out, module; inputs backOpeningsNumber: Int32, backOpenings: Boolean, leftNeighbour: Boolean, rightNeighbour: Boolean
# ---------- python: Python ----------
"""Creates and places the ward module.
    Inputs:
        openingsWidth: The width of the corridor openings (float).
        openingsHeight: The height of the corridor openings (float).
        boundaryPosition: Whether or not the module is on the boundaries of the plot (boolean).
        backWall: Whether or not the module is part of a four-modules system (boolean).
        backOpeningsNumber: The number of the openings on the back wall (int).
        backOpeningsSize: The size of the openings on the back wall (float).
        backOpenings: Whether or  not there are openings on the back wall (boolean).
        innerOpeningsWidth: The width of the interior openings of the module (float).
        innerOpeningsHeight: The height of the interior openings of the module (float).
        leftNeighbour: Whether or not the module is adjacent to another module on the left side (boolean).
        rightNeighbour: Whether or not the module is adjacent to another module on the right side (boolean).
        distanceFromIW: The distance of the interior openings from the interior wall (float).
    Output:
        module: The module (Brep)"""

__author__ = "nikoletta christidi"
__version__ = "2018.10.04"

import rhinoscriptsyntax as rs
import Rhino.Geometry as rg
import Rhino.Collections as rc
from copy import copy
import math

def createSquare(point, size):
    pt1 = point + rg.Vector3d(size/2, size/2, 0)
    pt2 = point + rg.Vector3d(-size/2, size/2, 0)
    pt3 = point + rg.Vector3d(-size/2, -size/2, 0)
    pt4 = point + rg.Vector3d(size/2, -size/2,0)
    sqrPts = [pt1,pt2,pt3,pt4,pt1]
    square = rs.AddPolyline(sqrPts)
    square = rs.coercecurve(square)
    square.Rotate(math.pi/2, rg.Vector3d.XAxis, point)
    return square

class Module:
    def __init__ (self, orPt, outside, opWidth, opHeight, inOpWidth, inOpHeight, dFromIW):
        self.length = 6.00
        self.width = 3.00
        self.thickness = 0.20
        self.height = 3.00
        self.orPt = orPt
        self.opWidth = opWidth
        self.opHeight = opHeight
        self.inOpWidth = inOpWidth
        self.inOpHeight = inOpHeight
        self.dFromIW = dFromIW
        if outside:
            self.thicknessBW = self.thickness*2
        else:
            self.thicknessBW = self.thickness

    def backWall(self, existence, openings, backOpNum, backOpSize):
        vecBW = rg.Vector3d(self.thickness, 0,0)
        orPtBW = self.orPt + vecBW
        xSize = rg.Interval(0, self.width-2*self.thickness)
        ySize = rg.Interval(0, self.thicknessBW)
        zSize = rg.Interval(0, self.height)
        plane = rg.Plane(orPtBW, rg.Vector3d.ZAxis)
        bw = rg.Box(plane, xSize, ySize, zSize)
        bwBrep = bw.ToBrep()
        
        if openings:
            self.backOpNum = backOpNum
            self.backOpSize = backOpSize
            divLength = self.width/(self.backOpNum+1)
            squares = rc.CurveList()
            extrusions = []
            for i in range(self.backOpNum):
                 pt = self.orPt + rg.Vector3d((i+1)*divLength,0,self.opHeight)
                 sq = createSquare(pt, self.backOpSize)
                 sq1 = copy(sq)
                 sq1.Translate(0,self.thicknessBW,0)
                 squares.Add(sq)
                 squares.Add(sq1)
                 extr = rg.Brep.CreateFromLoft(squares, rg.Point3d.Unset, rg.Point3d.Unset, rg.LoftType.Straight, False)
                 squares.Clear()
                 extrusions.append(extr)
            for i in range(len(extrusions)):
                bw = rg.Brep.CreateBooleanDifference(bwBrep, extrusions[i][0], 0.001)
                backWall = rg.Brep.CreateBooleanDifference(bw[0], extrusions[i][0], 0.001)
                bwBrep = backWall[0]
        else:
            backWall = bwBrep
        if existence == False:
            ySize = rg.Interval(0, self.thickness)
            zSize = rg.Interval(0, self.height/2)
            bw = rg.Box(plane, xSize, ySize, zSize)
            backWall = bw.ToBrep()
        backWall = backWall[0]
        return backWall
        
    def frontWall(self):
        vecFW = rg.Vector3d(0, self.length-self.thickness*2,0)
        orPtFW = self.orPt + vecFW
        xSize = rg.Interval(0, self.width)
        ySize = rg.Interval(0, self.thickness*2)
        zSize = rg.Interval(0, self.height)
        plane = rg.Plane(orPtFW, rg.Vector3d.ZAxis)
        frontwallPlain = rg.Box(plane, xSize, ySize, zSize)
        curves = rc.CurveList()
        orPtOpening = orPtFW + rg.Vector3d(self.width/2,0,0) - rg.Vector3d(self.opWidth/2,0,0)
        curve1 = rg.LineCurve(orPtOpening, rg.Point3d(orPtOpening[0],orPtOpening[1],self.opHeight))
        curve2 = copy(curve1)
        curve2.Translate(rg.Vector3d(self.opWidth,0,0))
        curve3 = rg.Arc(rg.Point3d(orPtOpening[0],orPtOpening[1],self.opHeight), rg.Point3d(orPtOpening[0]+self.opWidth/2,orPtOpening[1],self.opHeight+self.opWidth/2),rg.Point3d(orPtOpening[0]+self.opWidth,orPtOpening[1],self.opHeight))
        curves.Add(curve1)
        curves.Add(curve2)
        curves.Add(curve3)
        curvesJ = rg.Curve.JoinCurves(curves)
        curvesJ = curvesJ[0]
        curvesJ1 = copy(curvesJ)
        curvesJ1.Translate(0,self.thickness*2,0)
        loftCrvs = rc.CurveList()
        loftCrvs.Add(curvesJ)
        loftCrvs.Add(curvesJ1)
        extr = rg.Brep.CreateFromLoft(loftCrvs, rg.Point3d.Unset, rg.Point3d.Unset, rg.LoftType.Straight, False)
        fwPlainBrep = frontwallPlain.ToBrep()
        extr = extr[0]
        frontWall = rg.Brep.CreateBooleanDifference(fwPlainBrep, extr, 0.001)
        frontWall = rg.Brep.CreateBooleanDifference(fwPlainBrep, frontWall[0], 0.001)
        frontWall = frontWall[0]
        return frontWall
        
    def leftWall(self, leftNeightbour):
        orPtLW = self.orPt 
        xSize = rg.Interval(0, self.thickness)
        ySize = rg.Interval(0, self.length-2*self.thickness)
        zSize = rg.Interval(0, self.height)
        plane = rg.Plane(orPtLW, rg.Vector3d.ZAxis)
        leftWallPlain = rg.Box(plane, xSize, ySize, zSize)
        
        #corridor opening
        corWidth = (self.length-self.thickness*2)-((2*self.length/3)+self.thickness/2)
        orPtOpening1 = orPt + rg.Vector3d(0, (2*self.length/3)+(self.thickness/2+corWidth/2)-self.opWidth/2,0)
        curves = rc.CurveList()
        curve1 = rg.LineCurve(orPtOpening1, rg.Point3d(orPtOpening1[0],orPtOpening1[1],self.opHeight))
        curve2 = copy(curve1)
        curve2.Translate(rg.Vector3d(0, self.opWidth,0))
        curve3 = rg.Arc(rg.Point3d(orPtOpening1[0],orPtOpening1[1],self.opHeight), rg.Point3d(orPtOpening1[0],orPtOpening1[1]+self.opWidth/2,self.opHeight+self.opWidth/2),rg.Point3d(orPtOpening1[0],orPtOpening1[1]+self.opWidth,self.opHeight))
        curves.Add(curve1)
        curves.Add(curve2)
        curves.Add(curve3)
        curvesJ = rg.Curve.JoinCurves(curves)
        curvesJ = curvesJ[0]
        curvesJ1 = copy(curvesJ)
        curvesJ1.Translate(self.thickness,0,0)
        loftCrvs = rc.CurveList()
        loftCrvs.Add(curvesJ)
        loftCrvs.Add(curvesJ1)
        extr = rg.Brep.CreateFromLoft(loftCrvs, rg.Point3d.Unset, rg.Point3d.Unset, rg.LoftType.Straight, False)
        lwPlainBrep = leftWallPlain.ToBrep()
        extr = extr[0]
        leftWall = rg.Brep.CreateBooleanDifference(lwPlainBrep, extr, 0.001)
        #leftWall = rg.Brep.CreateBooleanDifference(lwPlainBrep, leftWall[0], 0.001)
        
        if leftNeighbour:
            orPtOpening2 = orPt + rg.Vector3d(0, 2*self.length/3 - self.thickness/2 - self.dFromIW - self.inOpWidth,0)
            curves = rc.CurveList()
            curve1 = rg.LineCurve(orPtOpening2, rg.Point3d(orPtOpening2[0],orPtOpening2[1],self.inOpHeight))
            curve2 = copy(curve1)
            curve2.Translate(rg.Vector3d(0, self.inOpWidth,0))
            curve3 = rg.Arc(rg.Point3d(orPtOpening2[0],orPtOpening2[1],self.inOpHeight), rg.Point3d(orPtOpening2[0],orPtOpening2[1]+self.inOpWidth/2,self.inOpHeight+self.inOpWidth/2),rg.Point3d(orPtOpening2[0],orPtOpening2[1]+self.inOpWidth,self.inOpHeight))
            curves.Add(curve1)
            curves.Add(curve2)
            curves.Add(curve3)
            curvesJ = rg.Curve.JoinCurves(curves)
            curvesJ = curvesJ[0]
            curvesJ1 = copy(curvesJ)
            curvesJ1.Translate(self.thickness,0,0)
            loftCrvs = rc.CurveList()
            loftCrvs.Add(curvesJ)
            loftCrvs.Add(curvesJ1)
            extr = rg.Brep.CreateFromLoft(loftCrvs, rg.Point3d.Unset, rg.Point3d.Unset, rg.LoftType.Straight, False)
            lwPlainBrep = leftWall[0]
            extr = extr[0]
            leftWall = rg.Brep.CreateBooleanDifference(lwPlainBrep, extr, 0.001)
        leftWall = leftWall[0]
        return leftWall
        
    def rightWall(self, rightNeighbour):
        vecLW = rg.Vector3d(self.width-self.thickness, 0, 0)
        orPtLW = self.orPt + vecLW
        xSize = rg.Interval(0, self.thickness)
        ySize = rg.Interval(0, self.length-2*self.thickness)
        zSize = rg.Interval(0, self.height)
        plane = rg.Plane(orPtLW, rg.Vector3d.ZAxis)
        rightWallPlain = rg.Box(plane, xSize, ySize, zSize)
        
        #corridor opening
        corWidth = (self.length-self.thickness*2)-((2*self.length/3)+self.thickness/2)
        orPtOpening1 = orPt + rg.Vector3d(self.width-self.thickness, (2*self.length/3)+(self.thickness/2+corWidth/2)-self.opWidth/2,0)
        curves = rc.CurveList()
        curve1 = rg.LineCurve(orPtOpening1, rg.Point3d(orPtOpening1[0],orPtOpening1[1],self.opHeight))
        curve2 = copy(curve1)
        curve2.Translate(rg.Vector3d(0, self.opWidth,0))
        curve3 = rg.Arc(rg.Point3d(orPtOpening1[0],orPtOpening1[1],self.opHeight), rg.Point3d(orPtOpening1[0],orPtOpening1[1]+self.opWidth/2,self.opHeight+self.opWidth/2),rg.Point3d(orPtOpening1[0],orPtOpening1[1]+self.opWidth,self.opHeight))
        curves.Add(curve1)
        curves.Add(curve2)
        curves.Add(curve3)
        curvesJ = rg.Curve.JoinCurves(curves)
        curvesJ = curvesJ[0]
        curvesJ1 = copy(curvesJ)
        curvesJ1.Translate(self.thickness,0,0)
        loftCrvs = rc.CurveList()
        loftCrvs.Add(curvesJ)
        loftCrvs.Add(curvesJ1)
        extr = rg.Brep.CreateFromLoft(loftCrvs, rg.Point3d.Unset, rg.Point3d.Unset, rg.LoftType.Straight, False)
        rwPlainBrep = rightWallPlain.ToBrep()
        extr = extr[0]
        rightWall = rg.Brep.CreateBooleanDifference(rwPlainBrep, extr, 0.001)
        #rightWall = rg.Brep.CreateBooleanDifference(rwPlainBrep, rightwall[0], 0.001)
        
        if rightNeighbour:
            orPtOpening2 = orPt + rg.Vector3d(self.width-self.thickness, 2*self.length/3 - self.thickness/2 - self.dFromIW - self.inOpWidth,0)
            curves = rc.CurveList()
            curve1 = rg.LineCurve(orPtOpening2, rg.Point3d(orPtOpening2[0],orPtOpening2[1],self.inOpHeight))
            curve2 = copy(curve1)
            curve2.Translate(rg.Vector3d(0, self.inOpWidth,0))
            curve3 = rg.Arc(rg.Point3d(orPtOpening2[0],orPtOpening2[1],self.inOpHeight), rg.Point3d(orPtOpening2[0],orPtOpening2[1]+self.inOpWidth/2,self.inOpHeight+self.inOpWidth/2),rg.Point3d(orPtOpening2[0],orPtOpening2[1]+self.inOpWidth,self.inOpHeight))
            curves.Add(curve1)
            curves.Add(curve2)
            curves.Add(curve3)
            curvesJ = rg.Curve.JoinCurves(curves)
            curvesJ = curvesJ[0]
            curvesJ1 = copy(curvesJ)
            curvesJ1.Translate(self.thickness,0,0)
            loftCrvs = rc.CurveList()
            loftCrvs.Add(curvesJ)
            loftCrvs.Add(curvesJ1)
            extr = rg.Brep.CreateFromLoft(loftCrvs, rg.Point3d.Unset, rg.Point3d.Unset, rg.LoftType.Straight, False)
            rwPlainBrep = rightWall[0]
            extr = extr[0]
            rightWall = rg.Brep.CreateBooleanDifference(rwPlainBrep, extr, 0.001)
        rightWall = rightWall[0]
        return rightWall
        
    def interWall(self):
        vecIW = rg.Vector3d(self.thickness, (self.length*2/3)-self.thickness/2,0)
        orPtIW = self.orPt + vecIW
        xSize = rg.Interval(0, self.width-2*self.thickness)
        ySize = rg.Interval(0, self.thickness)
        zSize = rg.Interval(0, self.height)
        plane = rg.Plane(orPtIW, rg.Vector3d.ZAxis)
        interwallPlain = rg.Box(plane, xSize, ySize, zSize)
        curves = rc.CurveList()
        orPtOpening = orPtIW + rg.Vector3d(xSize[1]/2,0,0) - rg.Vector3d(self.inOpWidth/2,0,0)
        curve1 = rg.LineCurve(orPtOpening, rg.Point3d(orPtOpening[0],orPtOpening[1],self.inOpHeight))
        curve2 = copy(curve1)
        curve2.Translate(rg.Vector3d(self.inOpWidth,0,0))
        curve3 = rg.Arc(rg.Point3d(orPtOpening[0],orPtOpening[1],self.inOpHeight), rg.Point3d(orPtOpening[0]+self.inOpWidth/2,orPtOpening[1],self.inOpHeight+self.inOpWidth/2),rg.Point3d(orPtOpening[0]+self.inOpWidth,orPtOpening[1],self.inOpHeight))
        curves.Add(curve1)
        curves.Add(curve2)
        curves.Add(curve3)
        curvesJ = rg.Curve.JoinCurves(curves)
        curvesJ = curvesJ[0]
        curvesJ1 = copy(curvesJ)
        curvesJ1.Translate(0,self.thickness,0)
        loftCrvs = rc.CurveList()
        loftCrvs.Add(curvesJ)
        loftCrvs.Add(curvesJ1)
        extr = rg.Brep.CreateFromLoft(loftCrvs, rg.Point3d.Unset, rg.Point3d.Unset, rg.LoftType.Straight, False)
        iwPlainBrep = interwallPlain.ToBrep()
        extr = extr[0]
        interWall = rg.Brep.CreateBooleanDifference(iwPlainBrep, extr, 0.001)
        interWall = rg.Brep.CreateBooleanDifference(iwPlainBrep, interWall[0], 0.001)
        interWall = interWall[0]
        return interWall
    def makeModule(self, walls):
        module = rg.Brep.CreateBooleanUnion(walls, 0.001)
        #despoina
        return module

orPt = rg.Point3d(0,0,0)
m = Module(orPt, boundaryPosition, openingsWidth, openingsHeight, innerOpeningsWidth, innerOpeningsHeight, distanceFromIW)
walls = []
walls.append(m.backWall(backWall, backOpenings, backOpeningsNumber, backOpeningsSize))
walls.append(m.frontWall())
walls.append(m.leftWall(leftNeighbour))
walls.append(m.rightWall(rightNeighbour))
walls.append(m.interWall())
mod = m.makeModule(walls)

module = mod
# ---------- end python ----------
module = Brep(python.module)
