# Grasshopper definition Entrance_1005.ghx (Grasshopper 1.0.7)

# ---- group: Facing Courtyard
crv = Curve(<curve referenced from the Rhino model>)
explode = Explode(Curve=crv, Recursive=True)  # -> Segments, Vertices
number_slider = Slider(0.5, range=0..1)
pframe = PerpFrame(Curve=reparameterize(explode.Segments), Parameter="0.5")
deplane = DeconstructPlane(Plane=graft(pframe))  # -> Origin, XAxis, YAxis, ZAxis
amp = Amplitude(Vector=deplane.YAxis, Amplitude=Slider(0.4, range=-2..2))
move = Move(Geometry=graft(explode.Segments), Motion=amp)  # -> Geometry, Transform
ext = ExtendCurve(Curve=flatten(move.Geometry), Type=0, Start=expr("-x", number_slider), End=expr("-x", number_slider))
rev = Reverse(Vector=deplane.XAxis)
Z = UnitZ(Factor=1)
end = EndPoints(Curve=ext)  # -> Start, End
cat = Catenary(PointA=end.Start, PointB=end.End, Length=Slider(8.5, range=0..10), Gravity=Z)
explode_2 = Explode(Curve=cat, Recursive=True)  # -> Segments, Vertices
intcrv = Interpolate(Vertices=explode_2.Vertices, Degree=3, Periodic=False, KnotStyle=1)  # -> simplify(Curve), Length, Domain

# ---- group: Surrounding lines
end_2 = EndPoints(Curve=graft(explode.Segments))  # -> Start, End
addition = Addition(A=rev, B=amp)
Z_2 = UnitZ(Factor=Slider(5, range=0..10))
move_2 = Move(Geometry=[end_2.Start, end_2.End], Motion=Z_2)  # -> Geometry, Transform
item = ListItem(List=move_2.Geometry, Index=0, Wrap=True)  # -> Item, Item1
panel = Panel(addition)
ln = Line(StartPoint=[end_2.Start, end_2.End], EndPoint=move_2.Geometry)
cat_2 = Catenary(PointA=item.Item, PointB=item.Item1, Length=Slider(4.52, range=0..10), Gravity=addition)
item_2 = ListItem(List=flatten(ln), Index=0, Wrap=True)
explode_3 = Explode(Curve=cat_2, Recursive=True)  # -> Segments, Vertices
end_3 = EndPoints(Curve=item_2)  # -> Start, End
xz = XZPlane(Origin=end_3.Start)
intcrv_2 = Interpolate(Vertices=explode_3.Vertices, Degree=3, Periodic=False, KnotStyle=1)  # -> Curve, Length, Domain
aligndim = AlignedDimension(Plane=xz, PointA=end_3.Start, PointB=end_3.End, Offset=1, Text="{0:0.00}", Size=Slider(0.3, range=0..1))
pshift = ShiftPaths(Data=intcrv_2.Curve, Offset=-1)
join = JoinCurves(Curves=[ln, pshift], Preserve=False)  # -> simplify(Curves)

# ----
loft = Loft(
    Curves=[intcrv.Curve, join],
    Options={Adjust=False, Closed=False, LoftEnds=0, LoftSimp=0, LoftType=0, Rebuild=10, Refit=0.01})

# ---- group: Dimension
pt = Point(flatten(explode_2.Vertices))
pdecon = Deconstruct(Point=pt)  # -> XComponent, YComponent, ZComponent
sort = SortList(Keys=pdecon.ZComponent, ValuesA=pt)  # -> Keys, ValuesA
item_3 = ListItem(List=reverse(sort.ValuesA), Index=0, Wrap=True)
pdecon_2 = Deconstruct(Point=item_3)  # -> XComponent, YComponent, ZComponent
pt_2 = ConstructPoint(XCoordinate=pdecon_2.XComponent, YCoordinate=pdecon_2.YComponent, ZCoordinate=0)
xz_2 = XZPlane(Origin=pt_2)
aligndim_2 = AlignedDimension(Plane=xz_2, PointA=item_3, PointB=pt_2, Offset=1, Text="{0:0.00}", Size=Slider(0.3, range=0..1))

# ---- group: Side interior arches
crv_2 = Curve([<curve referenced from the Rhino model> x2])
explode_4 = Explode(Curve=crv_2, Recursive=True)  # -> Segments, Vertices
number_slider_2 = Slider(0.5, range=0..1)
pframe_2 = PerpFrame(Curve=reparameterize(explode_4.Segments), Parameter="0.5")
deplane_2 = DeconstructPlane(Plane=graft(pframe_2))  # -> Origin, XAxis, YAxis, ZAxis
amp_2 = Amplitude(Vector=deplane_2.YAxis, Amplitude=Slider(0, range=-2..2))
move_3 = Move(Geometry=graft(explode_4.Segments), Motion=amp_2)  # -> Geometry, Transform
ext_2 = ExtendCurve(Curve=flatten(move_3.Geometry), Type=0, Start=expr("-x", number_slider_2), End=expr("-x", number_slider_2))
Z_3 = UnitZ(Factor=1)
end_4 = EndPoints(Curve=ext_2)  # -> Start, End
cat_3 = Catenary(PointA=end_4.Start, PointB=end_4.End, Length=Slider(9.2, range=0..10), Gravity=Z_3)
explode_5 = Explode(Curve=cat_3, Recursive=True)  # -> Segments, Vertices
intcrv_3 = Interpolate(Vertices=explode_5.Vertices, Degree=3, Periodic=False, KnotStyle=1)  # -> Curve, Length, Domain

# ---- group: Dimension
pt_3 = Point(flatten(explode_5.Vertices))
pdecon_3 = Deconstruct(Point=pt_3)  # -> XComponent, YComponent, ZComponent
sort_2 = SortList(Keys=pdecon_3.ZComponent, ValuesA=pt_3)  # -> Keys, ValuesA
item_4 = ListItem(List=reverse(sort_2.ValuesA), Index=0, Wrap=True)
pdecon_4 = Deconstruct(Point=item_4)  # -> XComponent, YComponent, ZComponent
pt_4 = ConstructPoint(XCoordinate=pdecon_4.XComponent, YCoordinate=pdecon_4.YComponent, ZCoordinate=0)
xz_3 = XZPlane(Origin=pt_4)
aligndim_3 = AlignedDimension(Plane=xz_3, PointA=item_4, PointB=pt_4, Offset=1, Text="{0:0.00}", Size=Slider(0.3, range=0..1))

# ----
panel_2 = Panel("""0
3""")

# ---- group: Interior Vaults
number_slider_3 = Slider(1.12, range=0..10)
crv_3 = Curve([<curve referenced from the Rhino model> x3])
ext_3 = ExtendCurve(Curve=crv_3, Type=0, Start=expr("-x", number_slider_3), End=expr("-x", number_slider_3))
Z_4 = UnitZ(Factor=1)
end_5 = EndPoints(Curve=ext_3)  # -> Start, End
cat_4 = Catenary(PointA=end_5.Start, PointB=end_5.End, Length=Slider(10.45, range=0..100), Gravity=Z_4)
explode_6 = Explode(Curve=cat_4, Recursive=True)  # -> Segments, Vertices
intcrv_4 = Interpolate(Vertices=explode_6.Vertices, Degree=3, Periodic=False, KnotStyle=1)  # -> Curve, Length, Domain

# ---- group: Entrance arch
crv_4 = Curve(<curve referenced from the Rhino model>)
explode_7 = Explode(Curve=crv_4, Recursive=True)  # -> Segments, Vertices
pframe_3 = PerpFrame(Curve=reparameterize(explode_7.Segments), Parameter="0.5")
deplane_3 = DeconstructPlane(Plane=graft(pframe_3))  # -> Origin, XAxis, YAxis, ZAxis
number_slider_4 = Slider(0.5, range=0..1)
amp_3 = Amplitude(Vector=deplane_3.YAxis, Amplitude=Slider(-0.5, range=-2..2))
move_4 = Move(Geometry=graft(explode_7.Segments), Motion=amp_3)  # -> Geometry, Transform
rev_2 = Reverse(Vector=deplane_3.XAxis)
ext_4 = ExtendCurve(Curve=flatten(move_4.Geometry), Type=0, Start=expr("-x", number_slider_4), End=expr("-x", number_slider_4))
end_6 = EndPoints(Curve=ext_4)  # -> Start, End
Z_5 = UnitZ(Factor=1)
cat_5 = Catenary(PointA=end_6.Start, PointB=end_6.End, Length=Slider(8.213, range=0..20), Gravity=Z_5)
explode_8 = Explode(Curve=cat_5, Recursive=True)  # -> Segments, Vertices
intcrv_5 = Interpolate(Vertices=explode_8.Vertices, Degree=3, Periodic=False, KnotStyle=1)  # -> Curve, Length, Domain
simplify = SimplifyTree(Tree=graft(intcrv_5.Curve), Front=False)  # -> simplify(Tree)

# ---- group: Surrounding lines
height = Slider(5, range=0..10)
end_7 = EndPoints(Curve=graft(explode_7.Segments))  # -> Start, End
Z_6 = UnitZ(Factor=height)
move_5 = Move(Geometry=[end_7.Start, end_7.End], Motion=Z_6)  # -> Geometry, Transform
addition_2 = Addition(A=amp_3, B=rev_2)
item_5 = ListItem(List=move_5.Geometry, Index=0, Wrap=True)  # -> Item, Item1
ln_2 = Line(StartPoint=[end_7.Start, end_7.End], EndPoint=move_5.Geometry)
cat_6 = Catenary(PointA=item_5.Item, PointB=item_5.Item1, Length=Slider(3.7, range=0..10), Gravity=addition_2)
item_6 = ListItem(List=flatten(ln_2), Index=0, Wrap=True)
explode_9 = Explode(Curve=cat_6, Recursive=True)  # -> Segments, Vertices
end_8 = EndPoints(Curve=item_6)  # -> Start, End
xz_4 = XZPlane(Origin=end_8.Start)
intcrv_6 = Interpolate(Vertices=explode_9.Vertices, Degree=3, Periodic=False, KnotStyle=1)  # -> Curve, Length, Domain
aligndim_4 = AlignedDimension(Plane=xz_4, PointA=end_8.Start, PointB=end_8.End, Offset=1, Text="{0:0.00}", Size=Slider(0.3, range=0..1))
pshift_2 = ShiftPaths(Data=intcrv_6.Curve, Offset=-1)
join_2 = JoinCurves(Curves=[ln_2, pshift_2], Preserve=False)  # -> simplify(Curves)

# ---- group: Entrance arch (continued)
loft_2 = Loft(
    Curves=[simplify, join_2],
    Options={Adjust=False, Closed=False, LoftEnds=0, LoftSimp=0, LoftType=1, Rebuild=10, Refit=0.01})

# ---- group: Dimension
pt_5 = Point(flatten(explode_8.Vertices))
pdecon_5 = Deconstruct(Point=pt_5)  # -> XComponent, YComponent, ZComponent
sort_3 = SortList(Keys=pdecon_5.ZComponent, ValuesA=pt_5)  # -> Keys, ValuesA
item_7 = ListItem(List=reverse(sort_3.ValuesA), Index=0, Wrap=True)
pdecon_6 = Deconstruct(Point=item_7)  # -> XComponent, YComponent, ZComponent
pt_6 = ConstructPoint(XCoordinate=pdecon_6.XComponent, YCoordinate=pdecon_6.YComponent, ZCoordinate=0)
xz_5 = XZPlane(Origin=pt_6)
aligndim_5 = AlignedDimension(Plane=xz_5, PointA=item_7, PointB=pt_6, Offset=1, Text="{0:0.00}", Size=Slider(0.3, range=0..1))

# ----
panel_3 = Panel("""1
2""")
item_8 = ListItem(List=flatten(intcrv_5.Curve), Index=panel_3, Wrap=True)
crv_5 = Curve(flatten(intcrv.Curve))
graft = GraftTree(Tree=crv_5, IncludeEmptyLists=True, IncludeNullItems=True)
graft_2 = GraftTree(Tree=item_8, IncludeEmptyLists=True, IncludeNullItems=True)
loft_3 = Loft(
    Curves=[graft, graft_2],
    Options={Adjust=False, Closed=False, LoftEnds=0, LoftSimp=0, LoftType=0, Rebuild=10, Refit=0.01})

item_9 = ListItem(List=flatten(intcrv_5.Curve), Index=panel_2, Wrap=True)  # -> graft(Item)
loft_4 = Loft(
    Curves=[item_9, intcrv_3.Curve],
    Options={Adjust=False, Closed=False, LoftEnds=0, LoftSimp=0, LoftType=0, Rebuild=10, Refit=0.01})

# ---- group: Side walls
crv_6 = Curve([<curve referenced from the Rhino model> x2])
explode_10 = Explode(Curve=crv_6, Recursive=True)  # -> Segments, Vertices
Z_7 = UnitZ(Factor=Slider(5, range=0..10))
item_10 = ListItem(List=explode_10.Segments, Index="1", Wrap=True)
move_6 = Move(Geometry=item_10, Motion=Z_7)  # -> Geometry, Transform
end_9 = EndPoints(Curve=graft(move_6.Geometry))  # -> Start, End
end_10 = EndPoints(Curve=item_10)  # -> Start, End
brep = Brep(flatten(loft_4))
ln_3 = Line(StartPoint=end_10.Start, EndPoint=end_9.Start)
ln_4 = Line(StartPoint=end_9.End, EndPoint=end_10.End)
panel_4 = Panel("""0
2""")
simplify_2 = SimplifyTree(Tree=reverse(graft(brep)), Front=False)
item_11 = ListItem(List=explode_10.Segments, Index=panel_4, Wrap=True)
Z_8 = UnitZ(Factor=Slider(5, range=0..10))
extr = Extrude(Base=item_11, Direction=Z_8)  # -> simplify(Extrusion)
item_12 = ListItem(List=extr, Index=1, Wrap=True)
item_13 = ListItem(List=extr, Index=0, Wrap=True)

# ---- group: Side Arches
crv_7 = Curve(crv_6)
number_slider_5 = Slider(1, range=0..10)
explode_11 = Explode(Curve=crv_7, Recursive=True)  # -> Segments, Vertices
number_slider_6 = Slider(0.4, range=0..1)
item_14 = ListItem(List=explode_11.Segments, Index=1, Wrap=True)
ext_5 = ExtendCurve(Curve=item_14, Type=0, Start=expr("-x", number_slider_5), End=expr("-x", number_slider_5))
X = UnitX(Factor=expr("-x", number_slider_6))
Y = UnitY(Factor=number_slider_6)
move_7 = Move(Geometry=ext_5, Motion=graft([X, Y]))  # -> Geometry, Transform
end_11 = EndPoints(Curve=move_7.Geometry)  # -> Start, End
Z_9 = UnitZ(Factor=1)
cat_7 = Catenary(PointA=end_11.Start, PointB=end_11.End, Length=Slider(8.85, range=0..100), Gravity=Z_9)
explode_12 = Explode(Curve=cat_7, Recursive=True)  # -> Segments, Vertices
intcrv_7 = Interpolate(Vertices=explode_12.Vertices, Degree=3, Periodic=False, KnotStyle=1)  # -> Curve, Length, Domain

# ---- group: Dimension
pt_7 = Point(flatten(explode_12.Vertices))
pdecon_7 = Deconstruct(Point=pt_7)  # -> XComponent, YComponent, ZComponent
sort_4 = SortList(Keys=pdecon_7.ZComponent, ValuesA=pt_7)  # -> Keys, ValuesA
item_15 = ListItem(List=reverse(sort_4.ValuesA), Index=0, Wrap=True)
pdecon_8 = Deconstruct(Point=item_15)  # -> XComponent, YComponent, ZComponent
pt_8 = ConstructPoint(XCoordinate=pdecon_8.XComponent, YCoordinate=pdecon_8.YComponent, ZCoordinate=0)
xz_6 = XZPlane(Origin=pt_8)
aligndim_6 = AlignedDimension(Plane=xz_6, PointA=item_15, PointB=pt_8, Offset=1, Text="{0:0.00}", Size=Slider(0.3, range=0..1))

# ---- group: Side walls (continued)
vec = VectorXYZ(XComponent=expr("-X", number_slider_6), YComponent=0, ZComponent="-1")  # -> Vector, Length
vec_2 = VectorXYZ(XComponent=0, YComponent=number_slider_6, ZComponent="-1")  # -> Vector, Length
cat_8 = Catenary(PointA=end_9.Start, PointB=end_9.End, Length=Slider(5.73, range=0..10), Gravity=graft([vec.Vector, vec_2.Vector]))
explode_13 = Explode(Curve=cat_8, Recursive=True)  # -> Segments, Vertices
intcrv_8 = Interpolate(Vertices=explode_13.Vertices, Degree=3, Periodic=False, KnotStyle=1)  # -> Curve, Length, Domain
pshift_3 = ShiftPaths(Data=intcrv_8.Curve, Offset=-1)
join_3 = JoinCurves(Curves=[pshift_3, ln_3, ln_4], Preserve=False)  # -> simplify(Curves)
crv_8 = Curve(simplify(intcrv_7.Curve))
loft_5 = Loft(Curves=[join_3, crv_8], Options={Adjust=True, Closed=False, LoftEnds=0, LoftSimp=0, LoftType=0, Rebuild=10, Refit=0.01})

# ---- group: Waiting area cross vaulting
item_16 = ListItem(List=flatten(intcrv_7.Curve), Index=0, Wrap=True)  # -> Item, Item1
flip = FlipCurve(Curve=item_16.Item)  # -> Curve, Flag
merge = Merge(Data1=flatten(item_16.Item1), Data2=flatten(intcrv_4.Curve), Data3=flatten(flip.Curve))
srf = Surface(loft_3)
srf_2 = Surface(loft_4)
merge_2 = Merge(Data1=srf, Data2=srf_2)  # -> flatten(Result)
loft_6 = Loft(Curves=merge, Options={Adjust=False, Closed=False, LoftEnds=0, LoftSimp=0, LoftType=0, Rebuild=10, Refit=0.01})
split = SplitBrep(Brep=graft(merge_2), Cutter=flatten(loft_6))
panel_5 = Panel("""0
1""")
item_17 = ListItem(List=split, Index=panel_5, Wrap=True)

# ---- group: Corridor arches
number_slider_7 = Slider(3, range=0..10)
Y_2 = UnitY(Factor=expr("-x", number_slider_7))
X_2 = UnitX(Factor=number_slider_7)
crv_9 = Curve(<curve referenced from the Rhino model>)
crv_10 = Curve(<curve referenced from the Rhino model>)
extr_2 = Extrude(Base=crv_9, Direction=Y_2)
extr_3 = Extrude(Base=crv_10, Direction=X_2)
split_2 = SplitBrep(Brep=graft([extr_2, extr_3]), Cutter=flatten(loft_6))
item_18 = ListItem(List=split_2, Index=0, Wrap=True)

# ---- group: Side walls (continued)
brep_2 = Brep(simplify(item_18))
splitmul = SplitBrepMultiple(Brep=item_12, Cutters=[brep_2, simplify_2])
sort_5 = SortList(Keys=splitmul, ValuesA=splitmul)  # -> Keys, ValuesA
item_19 = ListItem(List=reverse(sort_5.ValuesA), Index=0, Wrap=True)
join_4 = BrepJoin(Breps=[loft_5, item_19, item_13])  # -> Breps, Closed

# ---- group: Waiting area cross vaulting (continued)
splitmul_2 = SplitBrepMultiple(Brep=loft_6, Cutters=flatten([merge_2, extr_2, extr_3]))
area = Area(Geometry=splitmul_2)  # -> Area, Centroid
sort_6 = SortList(Keys=area.Area, ValuesA=splitmul_2)  # -> Keys, ValuesA
item_20 = ListItem(List=reverse(sort_6.ValuesA), Index="0", Wrap=True)
join_5 = BrepJoin(Breps=flatten([item_20, item_17, item_18]))  # -> Breps, Closed

# ----
inner_vaults = Brep(join_5.Breps)
outer_walls = Brep([loft_2, loft, join_4.Breps])
preview = CustomPreview(Geometry=[outer_walls, inner_vaults], Material=ColourSwatch(SwatchColor=RGB(255, 255, 255)))
