# Grasshopper definition dynamic_relaxation002.gh (Grasshopper 1.0.7)
# plug-ins: Kangaroo Components, LunchBox

# ----
# Excel file "schedule-1"
toggle = BooleanToggle(True)
path = FilePath("E:\TU DELFT\EARTHY\PYTHON TRIALS\schedule-1.xlsx")
excelread = ExcelReader(ReadExcelData=toggle, WorkbookPath=path, WorksheetName="Sheet1")  # -> Exceptions, ExcelData

lng = ListLength(List=excelread.ExcelData)
lng_2 = ListLength(List=flatten(lng))  # -> expr("x-1", Length)
series = Series(Start=1, Step=1, Count=expr("x-1", lng_2))
branch = TreeBranch(Tree=excelread.ExcelData, Path="{0}", MaintainPaths=True)
branch_2 = TreeBranch(Tree=excelread.ExcelData, Path=series, MaintainPaths=True)
branch_3 = TreeBranch(Tree=excelread.ExcelData, Path=lng_2, MaintainPaths=True)
cull_i = CullIndex(List=branch_2, Indices=0, Wrap=True)  # -> simplify(List)
cull_i_2 = CullIndex(List=branch, Indices=0, Wrap=True)
cull_i_3 = CullIndex(List=branch_3, Indices=0, Wrap=True)

# ----
# CHANGE SEED
number_slider = Slider(6, range=0..10)

lng_3 = ListLength(List=cull_i_2)
pop2d = Populate2D(Region={Plane=PlaneXY(126.5, 162, 0), Size=Domain2(u=-1199.5..1199.5, v=-894..894)}, Count=lng_3, Seed=number_slider)
pt = Point(pop2d)
panel = Panel(cull_i_3)
cir = Circle(Plane=pt, Radius=cull_i_3)
avr = Average(Input=pt)
points = PointList(Points=pt, Size=Slider(6.61, range=0..10))
python = GhPythonScript(pts=pt, matrix=cull_i, multiplier=Slider(50, range=0..50))  # -> out, a; inputs pts: list of Point3d, matrix: tree, multiplier: Int32
# ---------- python: Python ----------
__author__ = "nikol"
__version__ = "2018.09.21"

import rhinoscriptsyntax as rs

rels = []
colNumber = matrix.BranchCount
for i in range(colNumber):
    col = matrix.Branch(i)
    #print col
    for j in range (len(col)):
        if i>j:
            #print "i:",i,"j:",j
            #print col[j]
            rel = -float(col[j])*multiplier
            rels.append(rel)
            
a = rels
# ---------- end python ----------
inter = InterconnectPoints(Pts=pt)

end = EndPoints(Curve=graft(inter))  # -> Start, End
mindex = MemberIndex(Set=pt, Member=[end.Start, end.End])  # -> Index, Count
pshift = ShiftPaths(Data=mindex.Index, Offset=-1)
item = ListItem(List=cull_i_3, Index=pshift, Wrap=True)
ma = MassAddition(Input=item)  # -> flatten(Result), PartialResults

ln = Line(StartPoint=pt, EndPoint=avr)

# ----
# RESET SIMULATION
button = Button()

plaw = PowerLaw(Connection=ln, Exponents=0, Strength=Slider(-288.659, range=-1000..100.001), Cutoff=0)
plaw_2 = PowerLaw(Connection=inter, Exponents=0, Strength=python.a, Cutoff=0)  # -> flatten(PowerLaw)
springs = SpringsFromLine(Connection=inter, Stiffness=1000, Damping=10, RestLength=ma.Result, UpperCutoff=ma.Result, LowerCutoff=0, Plasticity=0)
kangaroo = KangarooPhysics(ForceObjects=flatten([springs, plaw_2, plaw]), AnchorPoints=avr, Settings=null, Geometry=pt, SimulationReset=button)  # -> Out, Iterations, ParticlesOut, GeometryOut, KE

# ----
# ACTIVATE TIMER FOR SIMULATION
timer = Timer(TimerInterval=20, Target=kangaroo)  # disabled

panel_2 = Panel(kangaroo.Iterations)
panel_3 = Panel(kangaroo.KE)
python_2 = GhPythonScript(pts=kangaroo.GeometryOut, matrix=cull_i)  # -> out, a; inputs pts: list of Point3d, matrix: tree
# ---------- python_2: Python ----------
__author__ = "nikol"
__version__ = "2018.09.21"

import rhinoscriptsyntax as rs
import Rhino.Geometry as rg

lines = []
colNumber = matrix.BranchCount
for i in range(colNumber):
    col = matrix.Branch(i)
    for j in range (len(col)):
        if i>j:
            if col[j]=="1":
                line = rg.Line(pts[i],pts[j])
                lines.append(line)

a = lines
# ---------- end python_2 ----------
cir_2 = Circle(Plane=kangaroo.GeometryOut, Radius=cull_i_3)
area = Area(Geometry=cir_2)  # -> Area, Centroid
srf = Surface(cir_2)
crv = Curve(python_2.a)
inter_2 = InterconnectPoints(Pts=area.Centroid)
tag = TextTag(Location=area.Centroid, Text=cull_i_2)
preview = CustomPreview(Geometry=[srf, crv], Material=ColourSwatch(SwatchColor=RGB(99, 80, 80)))
