# Grasshopper definition rel_chartFromMatrix002.gh (Grasshopper 1.0.7)
# plug-ins: EleFront, LunchBox

path = FilePath("E:\TU DELFT\EARTHY\PYTHON TRIALS\schedule.xlsx")

excelread = ExcelReader(ReadExcelData=Toggle(True), WorkbookPath=path, WorksheetName="Sheet1")  # -> Exceptions, ExcelData

series = Series(Start=1, Step=1, Count=19)
branch = TreeBranch(Tree=excelread.ExcelData, Path=series, MaintainPaths=True)
branch_2 = TreeBranch(Tree=excelread.ExcelData, Path="{0}", MaintainPaths=True)
cull_i = CullIndex(List=branch, Indices=0, Wrap=True)  # -> simplify(List)
cull_i_2 = CullIndex(List=branch_2, Indices=0, Wrap=True)  # -> flatten(List)

python = PythonScript(
    displacement=Slider(72, range=-100..100),
    cellsLength=Slider(21, range=0..100),
    cellsWidth=Slider(2, range=0..10),
    tags=cull_i_2,
    matrix=cull_i)  # -> out, cells, locations, diaCells, relationships; inputs tags: list, matrix: tree
# ---------- python: Python ----------
"""Creates a rel chart from a 2D matrix.
    Inputs:
        displacement: Location of the rel chart in relation to the x axis (int).
        cellsLength: The length of the cells (int).
        cellsWidth: The width of the cells (int).
        tags: The cell names (str).
        matrix: The 2D matrix to be interpreted (tree, ghdoc Object).
    Outputs:
        cells: The cells that contain the space tags(list, curve).
        locations: The locations of the space tags (list, Point3d).
        diaCells: The diamond cells that contain the relationship symbols (list, curve).
        relationships: The relationship symbols (list, curve)."""

__author__ = "nikoletta christidi"
__version__ = "2018.10.04"

import Rhino.Geometry as rg
import rhinoscriptsyntax as rs
import Rhino as r
from copy import copy
import math

x = cellsLength
y = cellsWidth
#create original text tag boundary
pts = (0,displacement,0),(x,displacement,0),(x+y,displacement+y,0),(x,displacement+2*y,0),(0,displacement+2*y,0),(0,displacement,0)
pline = rs.AddPolyline(pts)


plines = [] #tags
locs = [] #text points

#iteration for array of text tags and text points
for i in range (len(tags)):
    trans_value = i*(-2*y)
    vec = rg.Vector3d(0,trans_value,0)
    new_pl = rs.coercecurve(pline)
    new_pl.Translate(vec)
    plines.append(new_pl)
    
    pr = rg.AreaMassProperties.Compute(new_pl)
    cen = pr.Centroid
    vec = rg.Vector3d(1-x/2,0,0)
    loc = cen+vec
    locs.append(loc)

#starting point for diamonds
pt0 = rs.AddPoint(x+y,displacement+y,0)

#functions for symbols
def DrawDiamond (orPt, edgeSize):
    orPt = rs.coerce3dpoint(orPt)
    pt1 = orPt + rg.Vector3d(edgeSize,-edgeSize,0)
    pt2 = orPt + rg.Vector3d(0, -2*edgeSize,0)
    pt3 = orPt + rg.Vector3d(-edgeSize, -edgeSize,0)
    pts = (orPt, pt1, pt2, pt3, orPt)
    diamond = rs.AddPolyline(pts)
    return diamond

def DrawDiamondInscribed(orPt, edgeSize):
    orPt = rs.coerce3dpoint(orPt)
    edgeSize = 1.5*edgeSize
    radius = (edgeSize*math.sqrt(3))/6
    vec = rg.Vector3d(0,radius,0)
    pt1 = orPt + vec
    vec = rg.Vector3d(radius, -2*radius,0)
    pt2 = pt1 + vec
    vec = rg.Vector3d(-2*radius, 0,0)
    pt3 = pt2 + vec
    pts = (pt1,pt2, pt3, pt1)
    diamond = rs.AddPolyline(pts)
    return diamond
    
def DrawSquare(orPt, edgeSize):
    orPt = rs.coerce3dpoint(orPt)
    edgeSize = 0.8 *edgeSize
    pts = []
    vec = rg.Vector3d(-edgeSize/2,edgeSize/2,0)
    pt1 = orPt+vec
    vec = rg.Vector3d(edgeSize, 0, 0)
    pt2 = pt1+vec
    vec = rg.Vector3d(0,-edgeSize,0)
    pt3 = pt2+vec
    vec = rg.Vector3d(-edgeSize,0,0)
    pt4 = pt3 + vec
    pts = (pt1,pt2,pt3,pt4,pt1)
    square = rs.AddPolyline(pts)
    return square

def DrawStar(orPt, edgeSize):
    orPt = rs.coerce3dpoint(orPt)
    edgeSize = 0.8*edgeSize
    inner = edgeSize/3
    
    pts = []
    
    vec = rg.Vector3d(-inner/2,inner/2,0)
    pt1 = orPt + vec
    vec = rg.Vector3d(inner/2,inner/2,0)
    pt3 = orPt + vec
    vec = rg.Vector3d(0,edgeSize,0)
    pt2 = orPt + vec
    
    vec = rg.Vector3d(inner/2,inner/2,0)
    pt4 = orPt + vec
    vec = rg.Vector3d(inner/2,-inner/2,0)
    pt6 = orPt + vec
    vec = rg.Vector3d(edgeSize,0,0)
    pt5 = orPt + vec
    
    vec = rg.Vector3d(inner/2,-inner/2,0)
    pt7 = orPt + vec
    vec = rg.Vector3d(-inner/2,-inner/2,0)
    pt9 = orPt + vec
    vec = rg.Vector3d(0,-edgeSize,0)
    pt8 = orPt + vec
    
    vec = rg.Vector3d(-inner/2,-inner/2,0)
    pt10 = orPt + vec
    vec = rg.Vector3d(-inner/2,inner/2,0)
    pt12 = orPt + vec
    vec = rg.Vector3d(-edgeSize,0,0)
    pt11 = orPt + vec
    
    pts = (pt1,pt2,pt3,pt4,pt5,pt6,pt7,pt8,pt9,pt10,pt11,pt12)
    star = rs.AddPolyline(pts)
    return star


diamonds = [] #list of diamonds
diaCnt = [] #list of center points of diamonds
lng = 2*(len(tags)-1) #two times the number of cells in first column, because diamonds are arranged also in half-rows

#iteration
for i in range (len(tags)-1): #zero to columns number minus one (number of columns)
    #print "i:",i
    j = i
    while j<lng:
        #print "j:", j
        orPt = rs.coerce3dpoint(pt0)
        #print rg.Vector3d(y*i, -y*j, 0)
        orPt = orPt + rg.Vector3d(y*i, -y*j, 0)
        pline1 = DrawDiamond (orPt, y)
        pline1 = rs.coercecurve(pline1)
        diamonds.append(pline1) #adds to list of diamonds
        
        prp = rg.AreaMassProperties.Compute(pline1)
        cnt = prp.Centroid
        diaCnt.append(cnt) #adds to list of diamond center points
        j += 2 #skips a half-row
    lng = lng-1 #in every iteration the number of rows decreases by one to create triangle


k = matrix.BranchCount
diaNumber = int((pow(k,2)-k)/2) #number of diamonds based on number of text tags (triangular stacking)

#function that finds index based on the particular arrangement, using as given the indexes of the two spaces and the number of spaces
def IndexFind(a,b,k):
    end = b-a
    l = 0
    for i in range(end):
        l += k-(i+1)
    result = l-(k-b)
    return result

#iteration for drawing symbols
indexes = []
symbols = []
for i in range (k):
    column = matrix.Branch(i)
    for j in range (k):
        if i>j:
            rel = column[j]
            #print rel
            index = IndexFind(j,i,k)
            #print "i:",i,"j:",j,"index:",index
            indexes.append(index)
            if (rel=="1"):
                cir = rs.AddCircle(rg.Plane(diaCnt[index],rg.Vector3d.ZAxis),y/2)
                symbols.append(cir)
            elif (rel == "0.75"):
                diamond = DrawDiamondInscribed(diaCnt[index],y)
                symbols.append(diamond)
            elif (rel == "0.5"):
                square = DrawSquare(diaCnt[index],y)
                symbols.append(square)
            elif (rel == "0.25"):
                star = DrawStar(diaCnt[index],y)
                symbols.append(star)
            else:
                continue
#print indexes

#output
cells = plines
locations = locs
diaCells = diamonds
relationships = symbols
# ---------- end python ----------
crv = Curve([python.cells, python.diaCells])
geo = Geometry(python.relationships)
text = DefineText(Text=cull_i_2, Plane=python.locations, Size=Slider(1.15, range=1..10), Font="Arial", Justification=1)

panel = Panel(cull_i)
