# Grasshopper definition RelaxTheMeshes_FromFlat.gh (Grasshopper 1.0.7)
# plug-ins: Weaverbird, Kangaroo2 Components

# ---- group: Variables
naked_edge_stiffness = Slider(20, range=0..100)
int_edge_stiffness = Slider(10, range=0..10)
smoothing_level = Slider(6, range=0..10)
number_slider = Slider(0.5, range=0..1)
load = Slider(1.5, range=0..10)

# ---- group: Make mesh
mesh_outline = Curve([<curve referenced from the Rhino model> x12])
custom_mesh_settings = SettingsCustom(
    StitchSeams=True,
    SimplePlanes=False,
    Refine=True,
    MinCount=16,
    MaxCount=400,
    AspectRatio=20,
    MaxDistance=0,
    MaxAngle=20,
    MinEdge=0,
    MaxEdge=number_slider)
join = JoinCurves(Curves=mesh_outline, Preserve=False)
mesh = MeshBrep(Brep=join, Settings=custom_mesh_settings)

# ----
demesh = DeconstructMesh(Mesh=mesh)  # -> Vertices, Faces, Colours, Normals

support_lines = Curve([<curve referenced from the Rhino model> x29])
crv_cp = CurveClosestPoint(Point=demesh.Vertices, Curve=graft(support_lines))  # -> Point, Parameter, Distance
smaller = SmallerThan(FirstNumber=crv_cp.Distance, SecondNumber="0.25")  # -> SmallerThan, OrEqualTo
cull = CullPattern(List=demesh.Vertices, CullPattern=smaller.SmallerThan)
anchor = Anchor(Point=flatten(cull), Strength=1e+10)

medges = MeshEdges(Mesh=mesh)  # -> NakedEdges, InteriorEdges, NonManifoldEdges
length_line = LengthLine(Line=flatten(medges.NakedEdges), Strength=naked_edge_stiffness)
length_line_2 = LengthLine(Line=flatten(medges.InteriorEdges), Strength=int_edge_stiffness)

Z = UnitZ(Factor=load)
load_2 = Load(Point=demesh.Vertices, ForceVector=Z)

show = Show(G=mesh)
flatten = FlattenTree(Tree=show, Path="2")

merge = Merge(Data1=flatten([length_line_2, length_line]), Data2=anchor, Data3=load_2, Data5=flatten)
solver = Solver(GoalObjects=merge, Reset=Button(), Threshold=1e-15, Tolerance=0.01, On=Toggle(False))  # -> I, V, O

# ---- group: Refine and Smooth Mesh
branch = TreeBranch(Tree=solver.O, Path="2", MaintainPaths=True)
refine = Refine(Mesh=branch, Level=1)
wblaplace = WeaverbirdsLaplacianSmoothing(MeshCurves=refine, Level=smoothing_level, SmoothNakedEdges=0, Thin=1)
