# Grasshopper definition RelaxTheMeshes_FromTriangle.gh (Grasshopper 1.0.7)
# plug-ins: Karamba, Kangaroo Components, Weaverbird, Kangaroo2 Components

# ---- group: Variables
bending_rest_angle_multiplier = Slider(1, range=0..2)
number_slider = Slider(0.5, range=0..1)
spring_stiffness = Slider(10, range=0..100)
toggle = BooleanToggle(False)
reset = Button()

# ---- group: Make Mesh
roofs_dome = Brep([<brep referenced from the Rhino model> x8])
roofs = Brep([<brep referenced from the Rhino model> x5])
join = BrepJoin(Breps=roofs)  # -> Breps, Closed
mesh_breps = MeshBrepsKaramba3D(
    Brep=join.Breps,
    MeshResolution=number_slider,
    EdgeRefinementFactor=0.67,
    PointReduction=False,
    SmoothingStepSize=0,
    SmoothingIterations=5)  # -> Mesh, Info
mjoin = MeshJoin(Meshes=mesh_breps.Mesh)
weld = WeldMesh(Mesh=mjoin, Angle=3.141592654)

# ---- group: Bending resistance
hingepoints = HingePoints(Mesh=weld)  # -> _1, _2, _3, _4
fa = FoldAngle(Point1=hingepoints._1, Point2=hingepoints._2, Point3=hingepoints._3, Point4=hingepoints._4)
multiplication = Multiplication(A=fa, B=bending_rest_angle_multiplier)
hinge = Hinge(
    FoldStart=hingepoints._1,
    FoldEnd=hingepoints._2,
    Tip1=hingepoints._3,
    Tip2=hingepoints._4,
    RestAngle=multiplication,
    Strength=Slider(1, range=0..100))

# ---- group: Stiffness
wbedges = WeaverbirdsMeshEdges(MeshOrPolylines=weld)
length_line = LengthLine(Line=wbedges, Strength=spring_stiffness)

# ---- group: Show
show = Show(G=weld)
panel = Panel("2")
flatten = FlattenTree(Tree=show, Path=panel)

# ---- group: Resetter
data = Data([reset, number_slider])
dam = DataDam(DataA=data, BufferDelay=2500000, BufferMode=2)
equals = Equality(FirstNumber=data, SecondNumber=dam)  # -> Equality, Inequality
ma = MassAddition(Input=equals.Inequality)  # -> Result, PartialResults
reset_solver = Boolean(ma.Result)

# ---- group: Varying load
bbox = BoundingBox(Content=weld, Plane=PlaneXY(0, 0, 0))  # -> Box, Box_2
debrep = DeconstructBrep(Brep=bbox.Box)  # -> Faces, Edges, Vertices
item = ListItem(List=debrep.Faces, Index=5, Wrap=True)

# ---- group: Load
wbvertices = WeaverbirdsVerticesComponent(MeshClosedPolylinesGroup=weld, Weld=True)  # -> flatten(Points)

# ---- group: Varying load (continued)
pt = Point(wbvertices)
brep_cp = BrepClosestPoint(Point=pt, Brep=item, UseTasks=True)  # -> Point, Normal, Distance
bnd = Bounds(Numbers=brep_cp.Distance)
remap = RemapNumbers(Value=brep_cp.Distance, Source=bnd, Target=Domain(0, 1))  # -> Mapped, Clipped

# ---- group: Anchors
pt_2 = Point(wbvertices)
project = Project(Geometry=pt_2, Plane=PlaneXY(0, 0, 0))  # -> Geometry, Transform
dist = Distance(PointA=pt_2, PointB=project.Geometry)
sort = SortList(Keys=dist)  # -> Keys, ValuesA
item_2 = ListItem(List=sort.Keys, Index=0, Wrap=True)
equals_2 = Equality(FirstNumber=dist, SecondNumber=item_2)  # -> Equality, Inequality
cull = CullPattern(List=wbvertices, CullPattern=equals_2.Equality)
anchor = Anchor(Point=cull, Strength=10000)

# ---- group: Load (continued)
Z = UnitZ(Factor=remap.Mapped)
load = Load(Point=wbvertices, ForceVector=Z)

# ----
merge = Merge(Data1=flatten, Data2=load, Data3=anchor, Data4=length_line, Data5=hinge)
solver = Solver(GoalObjects=flatten(merge), Reset=reset_solver, Threshold=1e-15, Tolerance=0.01, On=toggle)  # -> I, V, O

# ---- group: Smoothing
unflatten = UnflattenTree(Tree=solver.O, Guide=merge)
branch = TreeBranch(Tree=unflatten, Path=panel, MaintainPaths=True)
wbloop = WeaverbirdsLoopSubdivision(MeshCurves=branch, Level=1, SmoothNakedEdges=0)

# ----
mesh = Mesh(wbloop)
preview = CustomPreview(
    Geometry=mesh,
    Material={diffuse=RGB(221, 160, 221), emission=RGB(66, 48, 66), shine=0.5, specular=RGB(255, 255, 255), transparency=0})
