# Grasshopper definition RelaxTheMeshes_LaplacianSmoothing.gh (Grasshopper 1.0.7)
# plug-ins: Karamba, Weaverbird, Kangaroo2 Components

smoothing_strength = Slider(1, range=1..10)
mesh_resolution = Slider(0.3, range=0..1)
spring_stiffness = Slider(20, range=0..100)

# ---- group: Create Mesh
brep = Brep([<brep referenced from the Rhino model> x5])
mesh_breps = MeshBrepsKaramba3D(
    Brep=brep,
    MeshResolution=mesh_resolution,
    EdgeRefinementFactor=0.67,
    PointReduction=False,
    SmoothingStepSize=0,
    SmoothingIterations=5)  # -> Mesh, Info
mjoin = MeshJoin(Meshes=mesh_breps.Mesh)
weld = WeldMesh(Mesh=mjoin, Angle=3.141592654)

# ---- group: Anchors
wbvertices = WeaverbirdsVerticesComponent(MeshClosedPolylinesGroup=weld, Weld=True)
project = Project(Geometry=wbvertices, Plane=PlaneXY(0, 0, 0))  # -> Geometry, Transform
dist = Distance(PointA=wbvertices, PointB=project.Geometry)
sort = SortList(Keys=dist)  # -> Keys, ValuesA
pdecon = Deconstruct(Point=wbvertices)  # -> XComponent, YComponent, ZComponent
item = ListItem(List=sort.Keys, Index=0, Wrap=True)
equals = Equality(FirstNumber=pdecon.ZComponent, SecondNumber=item)  # -> Equality, Inequality
cull = CullPattern(List=wbvertices, CullPattern=equals.Equality)
anchor = Anchor(Point=flatten(cull), Strength=10000)

# ---- group: Stiffness
wbedges = WeaverbirdsMeshEdges(MeshOrPolylines=weld)
length_line = LengthLine(Line=wbedges, Strength=spring_stiffness)

# ---- group: Laplacian Smoothing
smooth = Smooth(M=weld, Strength=smoothing_strength)

# ----
show = Show(G=weld)
entwine = Entwine(Branch00=show, Branch01=[anchor, length_line, smooth], FlattenInputs=True)

# ---- group: Resetter
data = Data([Button(), mesh_resolution])
dam = DataDam(DataA=data, BufferDelay=2500000, BufferMode=2)
equals_2 = Equality(FirstNumber=data, SecondNumber=dam)  # -> Equality, Inequality
ma = MassAddition(Input=equals_2.Inequality)  # -> Result, PartialResults
reset_solver = Boolean(ma.Result)

# ----
solver = Solver(GoalObjects=entwine, Reset=reset_solver, Threshold=1e-15, Tolerance=0.01, On=Toggle(False))  # -> I, V, O
bang = ExplodeTree(Data=solver.O)  # -> Branch0, Branch1
mesh = Mesh(bang.Branch0)
