# Grasshopper definition Perpendicularvectoroncurve.gh (Grasshopper 1.0.7)

crv = Curve(<curve referenced from the Rhino model>)
pt = Point(<point referenced from the Rhino model>)
perpendicular_vector_on_curve = PerpendicularVectorOnCurve(curve=crv, point=pt)  # -> line_indication, unit_perpendicular_vector

# ==== cluster PerpendicularVectorOnCurve
curve = ClusterInput()
point = ClusterInput()
crv_cp = CurveClosestPoint(Point=point, Curve=curve)  # -> Point, Parameter, Distance
eval = EvaluateCurve(Curve=curve, Parameter=crv_cp.Parameter)  # -> Point, Tangent, Angle
Z = UnitZ(Factor=1)
pi = Pi(Factor=Slider(0.5, range=0..1))
vrot = Rotate(Vector=eval.Tangent, Axis=Z, Angle=pi)
unit = UnitVector(Vector=vrot)
move = Move(Geometry=eval.Point, Motion=unit)  # -> Geometry, Transform
unit_perpendicular_vector = ClusterOutput(unit)
ln = Line(StartPoint=eval.Point, EndPoint=move.Geometry)
line_indication = ClusterOutput(ln)
