# Grasshopper definition RoofMeshDrape.gh (Grasshopper 1.0.7)
# plug-ins: Weaverbird, Kangaroo2 Components

# ---- group: Variables
collision_strength = Slider(10, range=0..10)
spring_strength = Slider(0.56, range=0..10)
line_extension = Slider(1, range=0.9..1.2)
number_slider = Slider(0.3, range=0..1)
load = Slider(-0.001, range=-0.1..0)
toggle = BooleanToggle(False)
button = Button()

# ----
test_section_outline = Curve(<curve referenced from the Rhino model>)
full_roof_2_outline = Curve(<curve referenced from the Rhino model>)
full_roof_1_outline = Curve(<curve referenced from the Rhino model>)

custom_mesh_settings = SettingsCustom(
    StitchSeams=True,
    SimplePlanes=False,
    Refine=True,
    MinCount=16,
    MaxCount=Slider(600, range=0..1000),
    AspectRatio=20,
    MaxDistance=0,
    MaxAngle=20,
    MinEdge=0,
    MaxEdge=number_slider)
boundary = BoundarySurfaces(Edges=test_section_outline)
mesh = MeshBrep(Brep=boundary, Settings=custom_mesh_settings)
mesh_2 = Mesh(mesh)

test_section = Brep(<brep referenced from the Rhino model>)
full_roof = Brep([<brep referenced from the Rhino model> x52])

# ---- group: Solid Collision
demesh = DeconstructMesh(Mesh=mesh_2)  # -> Vertices, Faces, Colours, Normals
spc = SolidPointCollide(Points=demesh.Vertices, Solid=flatten(test_section), Interior=False, Unidirectional="True", Strength=collision_strength)

# ---- group: Stiffness
medges = MeshEdges(Mesh=mesh_2)  # -> NakedEdges, InteriorEdges, NonManifoldEdges
crv = Curve([medges.NakedEdges, medges.InteriorEdges])
len = Length(Curve=crv)
multiplication = Multiplication(A=len, B=line_extension)
length_line = LengthLine(Line=crv, Length=multiplication, Strength=spring_strength)

# ---- group: Load
Z = UnitZ(Factor=load)
load_2 = Load(Point=demesh.Vertices, ForceVector=Z)

# ---- group: Show
show = Show(G=mesh_2)
panel = Panel("2")
flatten = FlattenTree(Tree=show, Path=panel)

# ---- group: Solve
merge = Merge(Data1=flatten, Data3=length_line, Data4=spc, Data5=load_2)
solver = Solver(GoalObjects=flatten(merge), Reset=button, Threshold=1e-15, Tolerance=0.01, On=toggle)  # -> I, V, O
unflatten = UnflattenTree(Tree=solver.O, Guide=merge)
branch = TreeBranch(Tree=unflatten, Path=panel, MaintainPaths=True)

# ----
dam = DataDam(DataA=branch, BufferDelay=10000000, BufferMode=0)

# ---- group: Make NURBS surface
mesh_3 = Mesh(dam)
wbvertices = WeaverbirdsVerticesComponent(MeshClosedPolylinesGroup=mesh_3, Weld=True)
patch = Patch(Points=wbvertices, Spans=20, Flexibility=Slider(10, range=0..10), Trim=True)
brep = Brep(patch)
