# Grasshopper definition Surfacethrustlines.gh (Grasshopper 1.0.7)

# ----
# Input points on surface where you want to see the thrust lines.
number_slider = Slider(0.2, range=0..5)
srf = Surface(<surface referenced from the Rhino model>)
pt = Point([<point referenced from the Rhino model> x5])
thrust_lines = ThrustLines(resolution=number_slider, surface=srf, points=pt)  # -> thrust_lines, thrust_line_distances, thrust_vectors
vdis = VectorDisplay(Anchor=pt, Vector=thrust_lines.thrust_vectors)
crv = Curve(thrust_lines.thrust_lines)
panel = Panel(thrust_lines.thrust_line_distances)

# ==== cluster ThrustLines
surface = ClusterInput()
mesh = Mesh(surface)
resolution = ClusterInput()
contour = Contour(Shape=mesh, Point=Point(0, 0, 0), Direction=Vector(0, 0, 1), Distance=resolution)  # -> flatten(Contours)
points = ClusterInput()
cp = ControlPoints(Curve=contour)  # -> Points, Weights, Knots
intcrv = Interpolate(Vertices=cp.Points, Degree=3, Periodic=False, KnotStyle=1)  # -> flatten(Curve), Length, Domain
meshcp = MeshClosestPoint(Point=points, Mesh=mesh)  # -> Point, Index, Parameter
python = GhPythonScript(height=resolution, contours=intcrv.Curve, start_pt=meshcp.Point)  # -> out, a; inputs contours: list of Curve, start_pt: list of Point3d
# ---------- python: Python ----------
__author__ = "benj_"
__version__ = "2018.10.12"

import rhinoscriptsyntax as rs
import Rhino.Geometry as rg

import clr
clr.AddReference("Grasshopper")
from Grasshopper.Kernel.Data import GH_Path
from Grasshopper import DataTree

_big_pt_list = DataTree[rg.Point3d]()

for j in range(len(_start_pt)):
    current_pt = _start_pt[j]
    path = GH_Path(j)
    for i in range(1,len(_contours)):
        (_bool,next_parameter) = _contours[i].ClosestPoint(current_pt)
        next_pt = _contours[i].PointAt(next_parameter)
        if next_pt.Z>current_pt.Z:
            current_pt = next_pt
            _big_pt_list.Add(current_pt,path)
a = _big_pt_list
# ---------- end python ----------
pline = PolyLine(Vertices=python.a, Closed=False)
smoothpline = SmoothPolyline(Polyline=pline, Strength=1, Times=Slider(30, range=1..30))
item = ListItem(List=python.a, Index=0, Wrap=True)
len = Length(Curve=smoothpline)
crv = Curve(smoothpline)
crv_cp = CurveClosestPoint(Point=item, Curve=smoothpline)  # -> Point, Parameter, Distance
thrust_lines = ClusterOutput(crv)
thrust_line_distances = ClusterOutput(len)
eval = EvaluateCurve(Curve=smoothpline, Parameter=crv_cp.Parameter)  # -> Point, Tangent, Angle
neg = Negative(Value=eval.Tangent)  # -> flatten(Result)
vdis = VectorDisplay(Anchor=points, Vector=neg)
thrust_vectors = ClusterOutput(neg)
