# Grasshopper definition StructuralAnalysis_DomeModule.gh (Grasshopper 1.0.7)
# plug-ins: Karamba, Kangaroo2 Components

# ----
# Dome settings
force_variable = Slider(3.5, range=0..100)
stiffness_lines = Slider(1250, range=1..1500)
force_fixed = Slider(1, range=0..5)
variable_slider_nr_2 = Slider(0.5, range=0..1)
toggle = BooleanToggle(False)

# ----
# Wall settings
height_of_wall = Slider(3, range=0..3)

# ----
# Arch settings
length_of_arc = Slider(6.5, range=6..12)

force_variable_2 = Slider(1, range=0..100)
stiffness = Slider(1200, range=0..1500)
number_of_arch_divisions = Slider(25, range=0..50)
force_fixed_2 = Slider(0.5, range=0..5)

force_variable_3 = Slider(1, range=0..100)
force_fixed_3 = Slider(1.5, range=0..5)
stiffness_2 = Slider(400, range=0..1500)
number_of_arch_divisions_2 = Slider(25, range=0..50)

# ----
# Opening big
toggle_2 = BooleanToggle(False)

# ----
# Opening small
toggle_3 = BooleanToggle(True)

# ----
# Relaxed roof settings
deformation_parameter = Slider(1, range=0..5)
height_parameter_top_surface = Slider(0.7, range=0..5)

toggle_opening_1 = BooleanToggle(False)
toggle_opening_2 = BooleanToggle(True)
toggle_opening_3 = BooleanToggle(False)
toggle_opening_4 = BooleanToggle(False)

toggle_opening_1_2 = BooleanToggle(True)
toggle_opening_2_2 = BooleanToggle(True)
toggle_opening_3_2 = BooleanToggle(False)
toggle_opening_4_2 = BooleanToggle(False)

# ----
# DATADAM 2
# - Set toggle true to form find the dome
# - Set toggle false after the shape is converted
toggle_4 = BooleanToggle(False)

# ---- group: Input Data
# KARAMBA!
# Structural analysis of wall
# Inputs
# Thickness wall
# Thickness buttress middle
thickness_mm = Slider(400, range=0..1000)
thickness_mm_2 = Slider(400, range=0..1000)

# KARAMBA!
# Structural analysis of roof
# Inputs
thickness_mm_3 = Slider(200, range=0..1000)

# ----
# Dome span
span_m = Slider(6, range=0..10)
dom = ConstructDomain(DomainStart=expr("x*-0.5", span_m), DomainEnd=expr("x*0.5", span_m))

# ----
# CREATING DOME
pt = ConstructPoint(XCoordinate=0, YCoordinate=0, ZCoordinate=height_of_wall)
xy = XYPlane(Origin=pt)
brep = Brep(<brep referenced from the Rhino model>)

rectangle = Rectangle(Plane=xy, XSize=dom, YSize=dom, Radius=0)  # -> Rectangle, Length
explode = Explode(Curve=rectangle.Rectangle, Recursive=True)  # -> Segments, Vertices

arch_lenght = Slider(5, range=0..5)
height_arch_start = Slider(0, range=0..3)
l0 = Slider(1.75, range=0..6)
l1 = Slider(1.75, range=0..6)

height_arch_start_2 = Slider(0, range=0..3)
arch_lenght_2 = Slider(3, range=0..5)
l0_2 = Slider(2.25, range=0..6)
l1_2 = Slider(2.25, range=0..6)

# ----
# CREATING WALLS
button = Button()

# ----
# Creating arches
line = Line(explode.Segments)
end = EndPoints(Curve=line)  # -> Start, End
Z = UnitZ(Factor=1)
addition = Addition(A=height_parameter_top_surface, B=height_of_wall)
cat = Catenary(PointA=end.Start, PointB=end.End, Length=length_of_arc, Gravity=Z)  # -> simplify(graft(Catenary))
Z_2 = UnitZ(Factor=addition)
move = Move(Geometry=brep, Motion=Z_2)  # -> Geometry, Transform
join = JoinCurves(Curves=cat, Preserve=False)
number_of_arch_divisions_3 = Slider(35, range=0..50)
force_fixed_4 = Slider(2, range=0..5)
stiffness_3 = Slider(1200, range=0..1500)
force_variable_4 = Slider(5, range=0..100)

cluster = Cluster_12(B=deformation_parameter, X=dom, G=move.Geometry, Y=dom)

# ----
# Opening big
subtraction = Subtraction(A=span_m, B=l1)
subtraction_2 = Subtraction(A=subtraction, B=l0)
Z_3 = UnitZ(Factor=height_arch_start)

opening_width_m = Panel(subtraction_2)

# ----
# Opening small
subtraction_3 = Subtraction(A=span_m, B=l1_2)
subtraction_4 = Subtraction(A=subtraction_3, B=l0_2)
Z_4 = UnitZ(Factor=height_arch_start_2)

opening_width_m_2 = Panel(subtraction_4)

# ----
# Creating walls
Z_5 = UnitZ(Factor=expr("x*-1", 1))

panel = Panel("""0 to 77
78 to 155
156 to 234
235 to 312""")

cluster_2 = Cluster_2(crv=join, N=number_of_arch_divisions_3, A=force_fixed_4, A_2=force_variable_4, G=cluster, strength=stiffness_3)

# ----
# DATADAM 1
# - Set toggle true to form find the arch
# - Set toggle false before opening datadam
toggle_5 = BooleanToggle(False)
reset = Button()

solver = Solver(GoalObjects=cluster_2, Reset=reset, Threshold=1e-15, Tolerance=0.01, On=toggle_5)  # -> I, V, O
cluster_3 = Cluster_3(data=solver.O)
item = ListItem(List=flatten(cluster_3), Index=0, Wrap=True)
lng = ListLength(List=flatten(cluster_3))
arrpolar = PolarArray(Geometry=item, Plane=PlaneXY(0, 0, 0), Count=lng, Angle=6.283185307)  # -> Geometry, Transform

dam = DataDam(DataA=arrpolar.Geometry, BufferDelay=100000000, BufferMode=0)

crv = Curve(simplify(graft(dam)))
end_2 = EndPoints(Curve=crv)  # -> Start, End
line_2 = LineSDL(Start=[end_2.Start, end_2.End], Direction=Z_5, Length=height_of_wall)
end_3 = EndPoints(Curve=line_2)  # -> Start, End
item_2 = ListItem(List=end_3.End, Index=0, Wrap=True)  # -> Item, Item1
ln = Line(StartPoint=item_2.Item, EndPoint=item_2.Item1)
join_2 = JoinCurves(Curves=[crv, line_2, ln], Preserve=False)  # -> simplify(Curves)
boundary = BoundarySurfaces(Edges=join_2)

# ----
# Creating surface
number_slider = Slider(0.2, range=0..1)
divide = DivideCurve(Curve=dam, Count=Slider(12, range=0..50), Kinks=False)  # -> flatten(Points), Tangents, Parameters
patch = Patch(Curves=flatten(dam), Points=divide.Points, Spans=20, Flexibility=20, Trim=True)
mesh_breps = MeshBreps(
    Brep=patch,
    MeshResolution=number_slider,
    EdgeRefinementFactor=Slider(0.5, range=0..1),
    PointReduction=False,
    SmoothingStepSize=0,
    SmoothingIterations=5)  # -> Mesh, Info
medges = MeshEdges(Mesh=mesh_breps.Mesh)  # -> NakedEdges, InteriorEdges, NonManifoldEdges
demesh = DeconstructMesh(Mesh=mesh_breps.Mesh)  # -> Vertices, Faces, Colours, Normals
join_3 = JoinCurves(Curves=medges.NakedEdges, Preserve=False)
incurve = PointInCurve(Point=demesh.Vertices, Curve=join_3)  # -> Relationship, Point
python = GhPythonScript(y=Toggle(True), z=Toggle(False))  # -> out, bool_out
# ---------- python: Python ----------
__author__ = "thoma"
__version__ = "2018.09.17"

import rhinoscriptsyntax as rs

#import Rhino geometry
bool = x
dome = y
shell = z

bool = str(bool)
dome = str(dome)
shell = str(shell)

output = []

if bool == 'True':
    output = dome
else:
    output = shell

bool_out = output

print output
# ---------- end python ----------
eval = Evaluate(F="if(x=1, True, False)", x=incurve.Relationship)
cull = CullPattern(List=demesh.Vertices, CullPattern=invert(eval))
cluster_4 = Cluster_5(A=force_fixed, A_2=force_variable, pt=cull, G=move.Geometry, A_3=variable_slider_nr_2)  # -> num_2, R_2, R
cull_2 = CullPattern(List=demesh.Vertices, CullPattern=eval)
Z_6 = UnitZ(Factor=cluster_4.R)
length_line = LengthLine(Line=flatten([medges.InteriorEdges, medges.NakedEdges]), Strength=stiffness_lines)
anchor = Anchor(Point=cull_2, Strength=1e+11)
load = Load(Point=cull, ForceVector=Z_6)
show = Show(G=mesh_breps.Mesh)
solver_2 = Solver(GoalObjects=flatten([length_line, anchor, load, show]), Reset=Button(), Threshold=1e-15, Tolerance=0.01, On=toggle_4)  # -> I, simplify(V), O

# ----
# Form-finding dome
cluster_5 = Cluster_4(data=solver_2.O)
dome = Mesh(cluster_5)

# ----
# DATADAM 3
dam_2 = DataDam(DataA=dome, BufferDelay=10000000, BufferMode=0)

# ---- group: Mesh input
mesh = Mesh(dam_2)

# ----
# Attaching loads
specific_weight_filler_kg_m3 = Panel("1600")
distributed_vertical_load_kn_m2 = Panel("1")
dome_2 = Dome(A_2=specific_weight_filler_kg_m3, M=mesh, A=thickness_mm_3)
Z_7 = UnitZ(Factor=expr("x*-1.2", dome_2))
loads = LoadsKaramba(Vectors=Z_7, Mesh=mesh, LCase="0", mode="MeshLoad -Variable", menu=[buttons(off, on, off), buttons(on, on)])
Z_8 = UnitZ(Factor=expr("x*-1.5", distributed_vertical_load_kn_m2))
loads_2 = LoadsKaramba(Vector=expr("x*1.2", Vector(0, 0, -1)), LCase="0", mode="Gravity")
loads_3 = LoadsKaramba(Vector=Z_8, Mesh=mesh, LCase="0", mode="MeshLoad -Const.", menu=[buttons(off, on, off), buttons(on, on)])

# ---- group: Creating support
# Attaching supports
medges_2 = MeshEdges(Mesh=mesh)  # -> NakedEdges, InteriorEdges, NonManifoldEdges
end_4 = EndPoints(Curve=medges_2.NakedEdges)  # -> Start, End
merge = Merge(Data1=end_4.Start, Data2=end_4.End)
duppt = RemoveDuplicatePts(Points=flatten(merge), Tolerance=0.01)
supp = SupportKaramba(PosInd=duppt, PlaneOfReference=PlaneXY(0, 0, 0), menu=[buttons(on, on, on, off, off, off)])  # -> flatten(Support)

# ---- group: Creating element
# Creating elements
panel_2 = Panel("shell")
meshtoshell = MeshToShellKaramba(Mesh=mesh, Identifier=panel_2, LimitDistance_m=0.005)  # -> Element, Points, Info
Z_9 = UnitZ(Factor=1)
X = UnitX(Factor=1)
orientate = OrientateElemKaramba(Shell=meshtoshell.Element, ShellIdentifier=panel_2, XOrientations=X, ZOrientations=Z_9, mode="Shell")

# ---- group: Setting cross-section
concat = Concatenate(FragmentA="shellCS", FragmentB=thickness_mm_3, JoinSeparator="_")
concat_2 = Concatenate(FragmentA=concat, FragmentB="mm")
division = Division(A=thickness_mm_3, B=10)
cross_sections = CrossSectionsKaramba(
    FamilyNameOfCrossSection="shellCS",
    NameOfCrossSection=concat,
    ElementsIdentifiers=panel_2,
    Material=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,
    Height_cm=division,
    mode="Shell - Const")

# ----
explode_2 = Explode(Curve=crv, Recursive=True)  # -> Segments, Vertices
item_3 = ListItem(List=explode_2.Segments, Index=0, Wrap=True)

explode_3 = Explode(Curve=crv, Recursive=True)  # -> Segments, Vertices
item_4 = ListItem(List=explode_3.Segments, Index=0, Wrap=True)

cluster_6 = Cluster_9(L=ln, L_2=ln)

ext = ExtendCurve(Curve=cluster_6, Type=0, Start=expr("x*-1", l0), End=expr("x*-1", l1))
end_5 = EndPoints(Curve=ext)  # -> Start, End
move_2 = Move(Geometry=end_5.Start, Motion=Z_3)  # -> Geometry, Transform
move_3 = Move(Geometry=end_5.End, Motion=Z_3)  # -> Geometry, Transform
dist = Distance(PointA=move_2.Geometry, PointB=move_3.Geometry)
addition_2 = Addition(A=dist, B=arch_lenght)
cat_2 = Catenary(PointA=move_2.Geometry, PointB=move_3.Geometry, Length=addition_2, Gravity=expr("{0,0,1}", Vector(0, 0, -1)))
divide_2 = DivideCurve(Curve=reparameterize(cat_2), Count=number_of_arch_divisions, Kinks=False)  # -> Points, Tangents, Parameters
cull_i = CullIndex(List=divide_2.Points, Indices=[-1, 0], Wrap=True)
cluster_7 = Cluster(A=force_fixed_2, A_2=force_variable_2, pt=cull_i, G=item_3)  # -> num_2, R
shatter = Shatter(Curve=reparameterize(cat_2), Parameters=divide_2.Parameters)
item_5 = ListItem(List=divide_2.Points, Index=0, Wrap=True)  # -> Item1, Item
path_mapper = PathMapper(cull_i, source="{A;B;C}", target="{A;B}")
Z_10 = UnitZ(Factor=cluster_7.R)
anchor_2 = Anchor(Point=[item_5.Item1, item_5.Item], Strength=1e+12)
length_line_2 = LengthLine(Line=shatter, Strength=stiffness)
load_2 = Load(Point=path_mapper, ForceVector=Z_10)
merge_2 = Merge(Data1=anchor_2, Data2=load_2, Data3=length_line_2)
solver_3 = Solver(GoalObjects=merge_2, Reset=button, Threshold=1e-15, Tolerance=0.01, On=toggle_2)  # -> I, simplify(V), O
cluster_8 = Cluster_8(data=solver_3.V)
cluster_9 = Cluster_6(A=solver_3.V)  # -> flatten(pt_3), B
ln_2 = Line(StartPoint=[end_5.Start, end_5.End], EndPoint=[move_2.Geometry, move_3.Geometry])  # -> flatten(Line)
intcrv = Interpolate(Vertices=cluster_8, Degree=3, Periodic=False, KnotStyle=1)  # -> Curve, Length, Domain
join_4 = JoinCurves(Curves=[ln_2, ext, intcrv.Curve], Preserve=False)
boundary_2 = BoundarySurfaces(Edges=join_4)
gate = StreamGate(Stream=boundary_2, Gate=toggle_2)  # -> Target0, Target1
bang = ExplodeTree(Data=gate.Target1)  # -> Branch0, Branch1, Branch2, Branch3
gate_2 = StreamGate(Stream=bang.Branch2, Gate=toggle_opening_3)  # -> Target0, Target1
gate_3 = StreamGate(Stream=bang.Branch0, Gate=toggle_opening_1)  # -> Target0, Target1
gate_4 = StreamGate(Stream=bang.Branch1, Gate=toggle_opening_2)  # -> Target0, Target1
gate_5 = StreamGate(Stream=bang.Branch3, Gate=toggle_opening_4)  # -> Target0, Target1
item_6 = ListItem(List=flatten([gate_3.Target1, gate_4.Target1, gate_2.Target1, gate_5.Target1]), Index=0, Wrap=True)
cluster_10 = Cluster_7(C=item_6)  # -> P, P_2, i, item_1, item_2, item_3
aligndim = AlignedDimension(
    Plane=[cluster_10.P, cluster_10.P_2],
    PointA=cluster_10.i,
    PointB=[cluster_10.item_2, cluster_10.item_1],
    Offset=expr("x*-1.5", [-4, 6, 6]),
    Text="{0:0.00}",
    Size=1)
cluster_11 = Cluster_10(B=boundary, C=[gate_3.Target1, gate_4.Target1, gate_2.Target1, gate_5.Target1])

ext_2 = ExtendCurve(Curve=cluster_6, Type=0, Start=expr("x*-1", l0_2), End=expr("x*-1", l1_2))
end_6 = EndPoints(Curve=ext_2)  # -> Start, End
move_4 = Move(Geometry=end_6.Start, Motion=Z_4)  # -> Geometry, Transform
move_5 = Move(Geometry=end_6.End, Motion=Z_4)  # -> Geometry, Transform
dist_2 = Distance(PointA=move_4.Geometry, PointB=move_5.Geometry)
addition_3 = Addition(A=dist_2, B=arch_lenght_2)
cat_3 = Catenary(PointA=move_4.Geometry, PointB=move_5.Geometry, Length=addition_3, Gravity=expr("{0,0,1}", Vector(0, 0, -1)))
divide_3 = DivideCurve(Curve=reparameterize(cat_3), Count=number_of_arch_divisions_2, Kinks=False)  # -> Points, Tangents, Parameters
cull_i_2 = CullIndex(List=divide_3.Points, Indices=[-1, 0], Wrap=True)
cluster_12 = Cluster(A=force_fixed_3, A_2=force_variable_3, pt=cull_i_2, G=item_4)  # -> num_2, R
shatter_2 = Shatter(Curve=reparameterize(cat_3), Parameters=divide_3.Parameters)
item_7 = ListItem(List=divide_3.Points, Index=0, Wrap=True)  # -> Item1, Item
path_mapper_2 = PathMapper(cull_i_2, source="{A;B;C}", target="{A;B}")
Z_11 = UnitZ(Factor=cluster_12.R)
anchor_3 = Anchor(Point=[item_7.Item1, item_7.Item], Strength=1e+12)
length_line_3 = LengthLine(Line=shatter_2, Strength=stiffness_2)
load_3 = Load(Point=path_mapper_2, ForceVector=Z_11)
merge_3 = Merge(Data1=anchor_3, Data2=load_3, Data3=length_line_3)
solver_4 = Solver(GoalObjects=merge_3, Reset=Button(), Threshold=1e-15, Tolerance=0.01, On=toggle_3)  # -> I, simplify(V), O
cluster_13 = Cluster_8(data=solver_4.V)
cluster_14 = Cluster_6(A=solver_4.V)  # -> flatten(pt_3), B
ln_3 = Line(StartPoint=[end_6.Start, end_6.End], EndPoint=[move_4.Geometry, move_5.Geometry])  # -> flatten(Line)
intcrv_2 = Interpolate(Vertices=cluster_13, Degree=3, Periodic=False, KnotStyle=1)  # -> Curve, Length, Domain
join_5 = JoinCurves(Curves=[ln_3, ext_2, intcrv_2.Curve], Preserve=False)
boundary_3 = BoundarySurfaces(Edges=join_5)
gate_6 = StreamGate(Stream=boundary_3, Gate=toggle_3)  # -> Target0, Target1
bang_2 = ExplodeTree(Data=gate_6.Target1)  # -> Branch0, Branch1, Branch2, Branch3
gate_7 = StreamGate(Stream=bang_2.Branch2, Gate=toggle_opening_3_2)  # -> Target0, Target1
gate_8 = StreamGate(Stream=bang_2.Branch0, Gate=toggle_opening_1_2)  # -> Target0, Target1
gate_9 = StreamGate(Stream=bang_2.Branch1, Gate=toggle_opening_2_2)  # -> Target0, Target1
gate_10 = StreamGate(Stream=bang_2.Branch3, Gate=toggle_opening_4_2)  # -> Target0, Target1
item_8 = ListItem(List=flatten([gate_8.Target1, gate_9.Target1, gate_7.Target1, gate_10.Target1]), Index=0, Wrap=True)
cluster_15 = Cluster_7(C=item_8)  # -> P, P_2, i, item_1, item_2, item_3
cluster_16 = Cluster_10(B=cluster_11, C=[gate_8.Target1, gate_9.Target1, gate_7.Target1, gate_10.Target1])

# ----
# Meshing
brep_2 = Brep(cluster_16)
join_6 = BrepJoin(Breps=flatten(brep_2))  # -> simplify(Breps), Closed

# ----
# Preview dimensions
number_slider_2 = Slider(0.4, range=0..1)
bbox = BoundingBox(Content=flatten(dam_2), Plane=PlaneXY(0, 0, 0), UnionBox=True)  # -> Box, Box_2
debrep = DeconstructBrep(Brep=bbox.Box)  # -> Faces, Edges, Vertices
item_9 = ListItem(List=debrep.Vertices, Index=0, Wrap=True)
xy_2 = XYPlane(Origin=Point(0, 0, 0))
yz = YZPlane(Origin=Point(0, 0, 0))

aligndim_2 = AlignedDimension(
    Plane=[cluster_15.P, cluster_15.P_2],
    PointA=cluster_15.i,
    PointB=[cluster_15.item_2, cluster_15.item_1],
    Offset=expr("x*-1.5", [-4, 6, 6]),
    Text="{0:0.00}",
    Size=number_slider_2)

# ---- group: Range of values
# Young's Modulus [N/mm2]: 147 - 225 (D. Silveira et al., 2012)
# Yield Strenght [N/mm2]: maximum compressive strength = 2
specific_weight_kg_m3 = Panel("1200 - 1700 (D.R. Visser)")
compressive_strenght_n_mm2 = Panel("0.514")
poisson_s_ratio = Panel("0.35")

# ---- group: Material properties
# Setting material properties
young_s_modulus_n_mm2 = Panel("150")
specific_weight_kg_m3_2 = Panel("1450")
yield_strenght_n_mm2 = Panel(compressive_strenght_n_mm2)
expression = Expression(x=young_s_modulus_n_mm2, y=poisson_s_ratio, Expression="x/(2*(1+y))")
expression_2 = Expression(x=expression, Expression="Format(\"{0:0.00} N/mm2\", x)")
rgb = ColourRGB(Alpha=255, Red=139, Green=69, Blue=19)
multiplication = Multiplication(A=young_s_modulus_n_mm2, B=0.1)
multiplication_2 = Multiplication(A=expression, B=0.1)
multiplication_3 = Multiplication(A=specific_weight_kg_m3_2, B=0.01)
multiplication_4 = Multiplication(A=yield_strenght_n_mm2, B=0.1)
concat_3 = Concatenate(FragmentA="adobe", FragmentB="natural", JoinSeparator="_")
multiplication_5 = Multiplication(A=compressive_strenght_n_mm2, B=0.1)
matprops = MaterialPropertiesKaramba(
    FamilyOfMaterial="adobe",
    Name=concat_3,
    ElementsIdentifiers=panel_2,
    Color=rgb,
    YoungsModulus_kN_cm2=multiplication,
    InPlaneShearModulus_kN_cm2=multiplication_2,
    TransverseShearModulus_kN_cm2=multiplication_2,
    SpecificWeight_kN_m3=multiplication_3,
    CoefficientOfThermalExpansion_1_C=1e-05,
    YieldStrength_kN_cm2=multiplication_4,
    mode="Isotrop")

# ---- group: Range of values (continued)
shear_modulus_n_mm2 = Panel(expression_2)
tensile_strenght_n_mm2 = Panel(multiplication_5)

# ---- group: Assembling
assemble = AssembleModelKaramba(
    Elem=flatten(orientate),
    Support=flatten(supp),
    Load=flatten([loads_2, loads, loads_3]),
    CrossSection=flatten(cross_sections),
    Material=flatten(matprops),
    LimitDistance_m=0.005)  # -> Model, Info, Mass_kg, CenterOfGravity

# ---- group: ANALYSE!
# ROOF ANALYSIS
# Enable the AnalyzeThI component to calculate the structure. To use the support
# reactions as input for the structural calculations update Datadam 4
analyzethi = AnalyzeThIKaramba(Model=assemble.Model)  # -> CalculatedModel, MaximumDisplacement_m, ResultingForceOfGravity_kN, ElasticEnergy_kNm; disabled

# ---- group: Setting cross-section
concat_4 = Concatenate(FragmentA="wallCS", FragmentB=thickness_mm, JoinSeparator="_")
concat_5 = Concatenate(FragmentA=concat_4, FragmentB="mm")
division_2 = Division(A=thickness_mm, B=10)
concat_6 = Concatenate(FragmentA="wallCS", FragmentB=thickness_mm_2, JoinSeparator="_")
concat_7 = Concatenate(FragmentA=concat_6, FragmentB="mm")
division_3 = Division(A=thickness_mm_2, B=10)
cross_sections_2 = CrossSectionsKaramba(
    FamilyNameOfCrossSection="wallCS",
    NameOfCrossSection=concat_7,
    Material=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,
    Height_cm=division_3,
    mode="Shell - Const")

# ---- group: Material properties
# Setting material properties
young_s_modulus_n_mm2_2 = Panel("150")
specific_weight_kg_m3_3 = Panel("1450")
yield_strenght_n_mm2_2 = Panel(compressive_strenght_n_mm2)
expression_3 = Expression(x=young_s_modulus_n_mm2_2, y=poisson_s_ratio, Expression="x/(2*(1+y))")
rgb_2 = ColourRGB(Alpha=255, Red=139, Green=69, Blue=19)
multiplication_6 = Multiplication(A=young_s_modulus_n_mm2_2, B=0.1)
multiplication_7 = Multiplication(A=expression_3, B=0.1)
multiplication_8 = Multiplication(A=specific_weight_kg_m3_3, B=0.01)
multiplication_9 = Multiplication(A=yield_strenght_n_mm2_2, B=0.1)
concat_8 = Concatenate(FragmentA="adobe", FragmentB="natural", JoinSeparator="_")

# ---- group: Creating element
# Creating elements
Y = UnitY(Factor=1)
Z_12 = UnitZ(Factor=1)
panel_3 = Panel("wall")

# ---- group: Setting cross-section (continued)
cross_sections_3 = CrossSectionsKaramba(
    FamilyNameOfCrossSection="wallCS",
    NameOfCrossSection=concat_5,
    ElementsIdentifiers=panel_3,
    Material=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,
    Height_cm=division_2,
    mode="Shell - Const")

# ---- group: Material properties (continued)
matprops_2 = MaterialPropertiesKaramba(
    FamilyOfMaterial="adobe",
    Name=concat_8,
    ElementsIdentifiers=panel_3,
    Color=rgb_2,
    YoungsModulus_kN_cm2=multiplication_6,
    InPlaneShearModulus_kN_cm2=multiplication_7,
    TransverseShearModulus_kN_cm2=multiplication_7,
    SpecificWeight_kN_m3=multiplication_8,
    CoefficientOfThermalExpansion_1_C=1e-05,
    YieldStrength_kN_cm2=multiplication_9,
    mode="Isotrop")

# ---- group: Setting gravity
loads_4 = LoadsKaramba(Vector=expr("x*1.2", Vector(0, 0, -1)), LCase="0", mode="Gravity")

# ----
# RESULTS
modelview = ModelViewKaramba(Model=analyzethi.CalculatedModel, LoadCaseFactorsForLinearSuperposition=1, IndexOfVisibleLoadcase=-1)  # -> Model, DeformedMesh, DeformedAxes, DeformedModel
shellview = ShellViewKaramba(Model=modelview.Model, IndexOfLayer=0)  # -> Model, MeshesOfRenderedShells, LegendColors, LegendTags
max_compressive_strength_n_mm2 = Panel(yield_strenght_n_mm2)
max_tensile_strength_n_mm2 = Panel(tensile_strenght_n_mm2)

# ----
# DATADAM 4
# Update datadam to retrieve support reactions as input loads on wall
dam_3 = DataDam(DataA=shellview.Model, BufferDelay=10000000, BufferMode=0)

# ---- group: Unit converter
cull_i_3 = CullIndex(List=shellview.LegendTags, Indices=0, Wrap=True)
multiplication_10 = Multiplication(A=cull_i_3, B=10)
merge_4 = Merge(Data1="Stress [N/mm2]", Data2=multiplication_10)  # -> flatten(Result)

# ----
legend = Legend(Colour=shellview.LegendColors, Tags=merge_4, LegendType=1)

# ----
# Maximum stresses
# Maximum stresses
# Tension
# Compression
# Tension
# Compression
number_slider_3 = Slider(0, range=-1..1)
shellvecresults = ResultVectorsOnShellsKaramba(AnalyzedModel=shellview.Model, LayerOfResults=number_slider_3, mode="PrincStress")  # -> AnalyzedModel, Points, FirstPrincipalStressVector_kN_cm2, SecondPrincipalStressVector_kN_cm2, FirstPrincipalStressValue_kN_cm2, SecondPrincipalStressValue_kN_cm2
sort = SortList(Keys=shellvecresults.FirstPrincipalStressValue_kN_cm2)  # -> Keys, ValuesA
sort_2 = SortList(Keys=shellvecresults.SecondPrincipalStressValue_kN_cm2)  # -> Keys, ValuesA
eval_2 = Evaluate(F="if(x≥0, True, False)", x=sort.Keys)
eval_3 = Evaluate(F="if(x≥0, True, False)", x=sort_2.Keys)
cull_3 = CullPattern(List=sort.Keys, CullPattern=invert(eval_2))
cull_4 = CullPattern(List=sort_2.Keys, CullPattern=invert(eval_3))
cull_5 = CullPattern(List=sort.Keys, CullPattern=eval_2)
cull_6 = CullPattern(List=sort_2.Keys, CullPattern=eval_3)
rev = ReverseList(List=cull_6)
rev_2 = ReverseList(List=cull_5)
multiplication_11 = Multiplication(A=rev_2, B=10)
multiplication_12 = Multiplication(A=cull_3, B=10)
multiplication_13 = Multiplication(A=rev, B=10)
multiplication_14 = Multiplication(A=cull_4, B=10)
eval_4 = Evaluate(F="Format(\"{0:0.####} N/mm2\", x)", x=multiplication_11)
eval_5 = Evaluate(F="Format(\"{0:0.####} N/mm2\", x)", x=multiplication_12)
eval_6 = Evaluate(F="Format(\"{0:0.####} N/mm2\", x)", x=multiplication_13)
eval_7 = Evaluate(F="Format(\"{0:0.####} N/mm2\", x)", x=multiplication_14)
min_stress_n_mm2 = Panel(eval_5)
max_stress_n_mm2 = Panel(eval_4)
max_stress_n_mm2_2 = Panel(eval_6)
min_stress_n_mm2_2 = Panel(eval_7)

# ---- group: Displacements
# Outputs of structural analysis sorted from maximum to minimum values
# Maximum displacements
nodedisp = NodalDisplacementsKaramba(AnalyzedModel=shellview.Model, LoadCase=0)  # -> AnalyzedModel, NodalTranslations_m, NodalRotations_rad
pdecon = Deconstruct(Point=nodedisp.NodalTranslations_m)  # -> XComponent, YComponent, ZComponent
sort_3 = SortList(Keys=pdecon.ZComponent)  # -> Keys, ValuesA
lng_2 = ListLength(List=sort_3.Keys)
item_10 = ListItem(List=sort_3.Keys, Index=expr("x-1", lng_2), Wrap=True)
item_11 = ListItem(List=sort_3.Keys, Index=0, Wrap=True)
multiplication_15 = Multiplication(A=item_11, B=1000)
multiplication_16 = Multiplication(A=item_10, B=1000)
eval_8 = Evaluate(F="Format(\"{0:0.##} mm\", x)", x=multiplication_15)
eval_9 = Evaluate(F="Format(\"{0:0.##} mm\", x)", x=multiplication_16)
min_displacement_mm = Panel(eval_8)
max_displacement_mm = Panel(eval_9)

# ----
react = ReactionForcesKaramba(AnalyzedModel=dam_3, LoadCase=0)  # -> AnalyzedModel, ReactionForces_kN, ReactionMoments_kNm, SupportPosition, SumOfReactionForces_kN, SumOfReactionMoments_kNm
cluster_17 = Cluster_11(pt=react.SupportPosition, data=panel, L=react.ReactionForces_kN)  # -> pt_3, R, R_2, B
points = PointList(Points=cluster_17.pt_3)

vdis = VectorDisplay(Anchor=cluster_17.R, Vector=cluster_17.R_2)

mesh_breps_2 = MeshBreps(
    Brep=join_6.Breps,
    InclusionPoints=flatten(react.SupportPosition),
    MeshResolution=Slider(0.4, range=0..1),
    EdgeRefinementFactor=Slider(0.5, range=0..1),
    PointReduction=False,
    SmoothingStepSize=0,
    SmoothingIterations=5)  # -> simplify(Mesh), Info
walls = Mesh(mesh_breps_2.Mesh)

bbox_2 = BoundingBox(Content=flatten([dam_2, walls]), Plane=PlaneXY(0, 0, 0), UnionBox=True)  # -> Box, Box_2
debrep_2 = DeconstructBrep(Brep=bbox_2.Box)  # -> Faces, Edges, Vertices
item_12 = ListItem(List=debrep_2.Vertices, Index=4, Wrap=True)
item_13 = ListItem(List=debrep_2.Vertices, Index=4, Wrap=True)
item_14 = ListItem(List=debrep_2.Vertices, Index=0, Wrap=True)  # -> Item, Item1, Item2
aligndim_3 = AlignedDimension(Plane=yz, PointA=item_9, PointB=item_12, Offset=5, Text="{0:0.00}", Size=number_slider_2)
aligndim_4 = AlignedDimension(
    Plane=[yz, xy_2],
    PointA=[item_14.Item, item_14.Item1],
    PointB=[item_13, item_14.Item2],
    Offset=[3, -3],
    Text="{0:0.00}",
    Size=number_slider_2)

# ---- group: Mesh input
mesh_2 = Mesh(walls)

# ---- group: Creating element (continued)
meshtoshell_2 = MeshToShellKaramba(Mesh=mesh_2, Identifier=panel_3, LimitDistance_m=0.005)  # -> Element, Points, Info
orientate_2 = OrientateElemKaramba(Shell=meshtoshell_2.Element, ShellIdentifier=panel_3, XOrientations=Y, ZOrientations=Z_12, mode="Shell")

# ----
cp = ClosestPoint(Point=cluster_17.R, Cloud=meshtoshell_2.Points)  # -> ClosestPoint, CPIndex, Distance

# ---- group: Creating support
# Attaching supports
dome_3 = Dome_2(P=meshtoshell_2.Points)
rdpoints = RemoveDuplicatePointsKaramba(Point=dome_3, LimitDistance=0.005)  # -> OutPoint, Info, Indexes
supp_2 = SupportKaramba(PosInd=rdpoints.OutPoint, PlaneOfReference=PlaneXY(0, 0, 0), menu=[buttons(on, on, on, on, on, on)])  # -> flatten(Support)

# ---- group: Setting gravity (continued)
rev_3 = Reverse(Vector=cluster_17.R_2)
loads_5 = LoadsKaramba(ForceVector=rev_3, Local=False, PosInd=cp.ClosestPoint, LCase="0", mode="Point")

# ---- group: Assembling
assemble_2 = AssembleModelKaramba(
    Elem=flatten(orientate_2),
    Support=flatten(supp_2),
    Load=flatten([loads_4, loads_5]),
    CrossSection=flatten(cross_sections_3),
    Material=flatten(matprops_2),
    LimitDistance_m=0.005)  # -> Model, Info, Mass_kg, CenterOfGravity

# ---- group: ANALYSE!
# ROOF ANALYSIS
# Enable the AnalyzeThI component to calculate the structure. To use the support
# reactions as input for the structural calculations update Datadam 3
analyzethi_2 = AnalyzeThIKaramba(Model=assemble_2.Model)  # -> CalculatedModel, MaximumDisplacement_m, ResultingForceOfGravity_kN, ElasticEnergy_kNm; disabled

# ----
# Compression < 0
# Tension          > 0
# RESULTS
modelview_2 = ModelViewKaramba(Model=analyzethi_2.CalculatedModel, LoadCaseFactorsForLinearSuperposition=1, IndexOfVisibleLoadcase=-1)  # -> Model, DeformedMesh, DeformedAxes, DeformedModel
shellview_2 = ShellViewKaramba(Model=modelview_2.Model, IndexOfLayer=0)  # -> Model, MeshesOfRenderedShells, LegendColors, LegendTags

# ---- group: Unit converter
cull_i_4 = CullIndex(List=shellview_2.LegendTags, Indices=0, Wrap=True)
new_unit = Panel("Stress [N/mm2]")
multiplication_17 = Multiplication(A=cull_i_4, B=10)
merge_5 = Merge(Data1=new_unit, Data2=multiplication_17)  # -> flatten(Result)

# ----
legend_2 = Legend(Colour=shellview_2.LegendColors, Tags=merge_5, LegendType=1)

# ---- group: Displacements
# Outputs of structural analysis sorted from maximum to minimum values
# Maximum displacements
nodedisp_2 = NodalDisplacementsKaramba(AnalyzedModel=shellview_2.Model, LoadCase=0)  # -> AnalyzedModel, NodalTranslations_m, NodalRotations_rad
pdecon_2 = Deconstruct(Point=nodedisp_2.NodalTranslations_m)  # -> XComponent, YComponent, ZComponent
sort_4 = SortList(Keys=pdecon_2.ZComponent)  # -> Keys, ValuesA
lng_3 = ListLength(List=sort_4.Keys)
item_15 = ListItem(List=sort_4.Keys, Index=expr("x-1", lng_3), Wrap=True)
item_16 = ListItem(List=sort_4.Keys, Index=0, Wrap=True)
multiplication_18 = Multiplication(A=item_16, B=1000)
multiplication_19 = Multiplication(A=item_15, B=1000)
eval_10 = Evaluate(F="Format(\"{0:0.##} mm\", x)", x=multiplication_18)
eval_11 = Evaluate(F="Format(\"{0:0.##} mm\", x)", x=multiplication_19)
min_displacement_mm_2 = Panel(eval_10)
max_displacement_mm_2 = Panel(eval_11)

# ----
# Maximum stresses
# Maximum stresses
# Tension
# Compression
# Tension
# Compression
number_slider_4 = Slider(0, range=-1..1)
shellvecresults_2 = ResultVectorsOnShellsKaramba(AnalyzedModel=shellview_2.Model, LayerOfResults=number_slider_4, mode="PrincStress")  # -> AnalyzedModel, Points, FirstPrincipalStressVector_kN_cm2, SecondPrincipalStressVector_kN_cm2, FirstPrincipalStressValue_kN_cm2, SecondPrincipalStressValue_kN_cm2
sort_5 = SortList(Keys=shellvecresults_2.FirstPrincipalStressValue_kN_cm2)  # -> Keys, ValuesA
sort_6 = SortList(Keys=shellvecresults_2.SecondPrincipalStressValue_kN_cm2)  # -> Keys, ValuesA
eval_12 = Evaluate(F="if(x≥0, True, False)", x=sort_5.Keys)
eval_13 = Evaluate(F="if(x≥0, True, False)", x=sort_6.Keys)
cull_7 = CullPattern(List=sort_5.Keys, CullPattern=invert(eval_12))
cull_8 = CullPattern(List=sort_6.Keys, CullPattern=invert(eval_13))
cull_9 = CullPattern(List=sort_5.Keys, CullPattern=eval_12)
cull_10 = CullPattern(List=sort_6.Keys, CullPattern=eval_13)
rev_4 = ReverseList(List=cull_10)
rev_5 = ReverseList(List=cull_9)
multiplication_20 = Multiplication(A=rev_5, B=10)
multiplication_21 = Multiplication(A=cull_7, B=10)
multiplication_22 = Multiplication(A=rev_4, B=10)
multiplication_23 = Multiplication(A=cull_8, B=10)
eval_14 = Evaluate(F="Format(\"{0:0.####} N/mm2\", x)", x=multiplication_20)
eval_15 = Evaluate(F="Format(\"{0:0.####} N/mm2\", x)", x=multiplication_21)
eval_16 = Evaluate(F="Format(\"{0:0.####} N/mm2\", x)", x=multiplication_22)
eval_17 = Evaluate(F="Format(\"{0:0.####} N/mm2\", x)", x=multiplication_23)
min_stress_n_mm2_3 = Panel(eval_15)
max_stress_n_mm2_3 = Panel(eval_14)
max_stress_n_mm2_4 = Panel(eval_16)
min_stress_n_mm2_4 = Panel(eval_17)

# ==== cluster Dome
M = ClusterInput()
A = ClusterInput()
facen = FaceNormals(Mesh=M)  # -> Centers, Normals
G = ClusterInput()
project = ProjectPoint(Point=facen.Centers, Direction=expr("{0,0,1}", Vector(0, 0, -1)), Geometry=G)  # -> Point, Index
division = Division(A=A, B=2000)
pt = Point(facen.Centers)
A_2 = ClusterInput()
dist = Distance(PointA=pt, PointB=project.Point)
subtraction = Subtraction(A=dist, B=division)
multiplication = Multiplication(A=A_2, B=subtraction)
ln = Line(StartPoint=pt, EndPoint=project.Point)
multiplication_2 = Multiplication(A=multiplication, B=0.01)
R = ClusterOutput(multiplication_2)

# ==== cluster Dome_2
P = ClusterInput()
pdecon = Deconstruct(Point=P)  # -> XComponent, YComponent, ZComponent
sort = SortList(Keys=pdecon.ZComponent, ValuesA=P)  # -> Keys, ValuesA
expression = Expression(x=sort.Keys, Expression="Format(\"{0:0.00}\", x)")
item = ListItem(List=expression, Index=0, Wrap=True)
equals = Equality(FirstNumber=expression, SecondNumber=item)  # -> Equality, Inequality
cull = CullPattern(List=sort.ValuesA, CullPattern=equals.Equality)
L = ClusterOutput(cull)

# ==== cluster Cluster_2
crv = ClusterInput()
crv_2 = Curve(reparameterize(simplify(crv)))
N = ClusterInput()
divide = DivideCurve(Curve=crv_2, Count=N, Kinks=False)  # -> simplify(Points), Tangents, simplify(Parameters)
A = ClusterInput()
A_2 = ClusterInput()
G = ClusterInput()
cull_i = CullIndex(List=divide.Points, Indices=[-1, 0], Wrap=True)
cluster = Cluster(A=A, A_2=A_2, pt=cull_i, G=G)  # -> num_2, R
shatter = Shatter(Curve=crv_2, Parameters=divide.Parameters)  # -> simplify(Segments)
item = ListItem(List=divide.Points, Index=0, Wrap=True)  # -> Item1, Item
strength = ClusterInput()
Z = UnitZ(Factor=cluster.R)
anchor = Anchor(Point=[item.Item1, item.Item], Strength=1e+12)  # -> simplify(A)
length_line = LengthLine(Line=shatter, Strength=strength)
load = Load(Point=simplify(cull_i), ForceVector=Z)
merge = Merge(Data1=anchor, Data2=load, Data3=length_line)
R = ClusterOutput(merge)

# ==== cluster Cluster_3
data = ClusterInput()
data_2 = Data(data)
null = NullItem(Item=data_2)  # -> NullFlags, InvalidFlags, Description
cull = CullPattern(List=data_2, CullPattern=invert(null.NullFlags))
end = EndPoints(Curve=cull)  # -> Start, End
weave = Weave(Pattern=[0, 1], Stream0=end.Start, Stream1=end.End, NullGaps=False)
cullpt = CullDuplicates(Points=weave, Tolerance=0.1, CullMode=3)  # -> Points, Indices, Valence
intcrv = Interpolate(Vertices=cullpt.Points, Degree=3, Periodic=False, KnotStyle=1)  # -> simplify(Curve), Length, Domain
C = ClusterOutput(intcrv.Curve)

# ==== cluster Cluster_4
data = ClusterInput()
data_2 = Data(data)
null = NullItem(Item=data_2)  # -> NullFlags, InvalidFlags, Description
cull = CullPattern(List=data_2, CullPattern=invert(null.NullFlags))
item = ListItem(List=cull, Index=-1, Wrap=True)
i = ClusterOutput(item)

# ==== cluster Cluster_5
A = ClusterInput()
A_2 = ClusterInput()
pt = ClusterInput()
G = ClusterInput()
A_3 = ClusterInput()
pt_2 = Point(pt)
project = ProjectPoint(Point=pt_2, Direction=expr("{0,0,1}", Vector(0, 0, -1)), Geometry=G)  # -> Point, Index
project_2 = Project(Geometry=pt_2, Plane=PlaneXY(0, 0, 0))  # -> Geometry, Transform
pt_3 = ConstructPoint(XCoordinate=0, YCoordinate=0, ZCoordinate=0)
dist = Distance(PointA=pt_2, PointB=project.Point)
expression = Expression(x=dist, Expression="Format(\"{0:0.00}\", x)")
dist_2 = Distance(PointA=pt_3, PointB=project_2.Geometry)
expression_2 = Expression(x=dist_2, Expression="Format(\"{0:0.00}\", x)")
reparamnums = ReparameterizeNumbers(Numbers=expression)  # -> simplify(Reparameterized), Original
reparamnums_2 = ReparameterizeNumbers(Numbers=expression_2)  # -> simplify(Reparameterized), Original
num = Number(reparamnums.Reparameterized)
multiplication = Multiplication(A=A_3, B=reparamnums_2.Reparameterized)
multiplication_2 = Multiplication(A=A_2, B=num)
addition = Addition(A=multiplication, B=1)
addition_2 = Addition(A=A, B=multiplication_2)
multiplication_3 = Multiplication(A=addition_2, B=addition)
R = ClusterOutput(multiplication_3)
R_2 = ClusterOutput(addition_2)
num_2 = ClusterOutput(num)

# ==== cluster Cluster_6
A = ClusterInput()
pdecon = Deconstruct(Point=A)  # -> XComponent, YComponent, ZComponent
sort = SortList(Keys=pdecon.XComponent, ValuesA=A)  # -> Keys, ValuesA
expression = Expression(x=sort.Keys, Expression="Format(\"{0:0.00}\", x)")
cset = CreateSet(List=expression)  # -> simplify(graft(Set)), Map
equals = Equality(FirstNumber=expression, SecondNumber=cset.Set)  # -> Equality, Inequality
cull = CullPattern(List=sort.ValuesA, CullPattern=equals.Equality)
pdecon_2 = Deconstruct(Point=cull)  # -> XComponent, YComponent, ZComponent
sort_2 = SortList(Keys=pdecon_2.YComponent, ValuesA=cull)  # -> Keys, ValuesA
pt = Point(simplify(sort_2.ValuesA))
pt_2 = Point(pt)
lng = ListLength(List=pt_2)  # -> flatten(Length)
lng_2 = ListLength(List=lng)  # -> flatten(Length)
subtraction = Subtraction(A=lng_2, B=1)
concat = Concatenate(FragmentA="{", FragmentB=subtraction, FragmentC="}")
branch = TreeBranch(Tree=pt, Path=["{0}", concat], MaintainPaths=True)
B = ClusterOutput(branch)
pt_3 = ClusterOutput(pt)

# ==== cluster Cluster_7
C = ClusterInput()
bbox = BoundingBox(Content=C, Plane=PlaneXY(0, 0, 0))  # -> Box, Box_2
debrep = DeconstructBrep(Brep=bbox.Box)  # -> Faces, Edges, Vertices
cullpt = CullDuplicates(Points=debrep.Vertices, Tolerance=0.1, CullMode=3)  # -> Points, Indices, Valence
item = ListItem(List=cullpt.Points, Index=0, Wrap=True)  # -> Item, Item1, Item2, Item3
xy = XYPlane(Origin=item.Item)
yz = YZPlane(Origin=item.Item)
P = ClusterOutput(yz)
P_2 = ClusterOutput(xy)
i = ClusterOutput(item.Item)
item_1 = ClusterOutput(item.Item1)
item_2 = ClusterOutput(item.Item2)
item_3 = ClusterOutput(item.Item3)

# ==== cluster Cluster_8
data = ClusterInput()
data_2 = Data(data)
pdecon = Deconstruct(Point=data_2)  # -> XComponent, YComponent, ZComponent
sort = SortList(Keys=pdecon.YComponent, ValuesA=data_2)  # -> Keys, ValuesA
sort_2 = SortList(Keys=pdecon.XComponent, ValuesA=data_2)  # -> Keys, ValuesA
expression = Expression(x=sort_2.Keys, Expression="Format(\"{0:0.00}\", x)")
cset = CreateSet(List=expression)  # -> simplify(graft(Set)), Map
expression_2 = Expression(x=sort.Keys, Expression="Format(\"{0:0.00}\", x)")
cset_2 = CreateSet(List=expression_2)  # -> simplify(graft(Set)), Map
equals = Equality(FirstNumber=cset.Set, SecondNumber=expression)  # -> Equality, Inequality
equals_2 = Equality(FirstNumber=cset_2.Set, SecondNumber=expression_2)  # -> Equality, Inequality
cull = CullPattern(List=sort_2.ValuesA, CullPattern=equals.Equality)  # -> simplify(List)
cull_2 = CullPattern(List=sort.ValuesA, CullPattern=equals_2.Equality)  # -> simplify(List)
lng = ListLength(List=cull)  # -> flatten(Length)
lng_2 = ListLength(List=cull_2)  # -> flatten(Length)
lng_3 = ListLength(List=lng)  # -> flatten(Length)
lng_4 = ListLength(List=lng_2)  # -> flatten(Length)
subtraction = Subtraction(A=lng_3, B=1)
subtraction_2 = Subtraction(A=lng_4, B=1)
concat = Concatenate(FragmentA="{", FragmentB=subtraction, FragmentC="}")
concat_2 = Concatenate(FragmentA="{", FragmentB=subtraction_2, FragmentC="}")
branch = TreeBranch(Tree=cull, Path="{0}", MaintainPaths=True)  # -> flatten(Branch)
branch_2 = TreeBranch(Tree=cull, Path=concat, MaintainPaths=True)  # -> flatten(Branch)
branch_3 = TreeBranch(Tree=cull_2, Path="{0}", MaintainPaths=True)  # -> flatten(Branch)
branch_4 = TreeBranch(Tree=cull_2, Path=concat_2, MaintainPaths=True)  # -> flatten(Branch)
pdecon_2 = Deconstruct(Point=branch_4)  # -> XComponent, YComponent, ZComponent
pdecon_3 = Deconstruct(Point=branch_2)  # -> XComponent, YComponent, ZComponent
pdecon_4 = Deconstruct(Point=branch_3)  # -> XComponent, YComponent, ZComponent
pdecon_5 = Deconstruct(Point=branch)  # -> XComponent, YComponent, ZComponent
sort_3 = SortList(Keys=pdecon_2.XComponent, ValuesA=branch_4)  # -> Keys, ValuesA
sort_4 = SortList(Keys=pdecon_3.YComponent, ValuesA=branch_2)  # -> Keys, ValuesA
sort_5 = SortList(Keys=pdecon_4.XComponent, ValuesA=branch_3)  # -> Keys, ValuesA
sort_6 = SortList(Keys=pdecon_5.YComponent, ValuesA=branch)  # -> Keys, ValuesA
rev = ReverseList(List=sort_3.ValuesA)
rev_2 = ReverseList(List=sort_6.ValuesA)
pt = Point(rev_2)
pt_2 = Point(sort_4.ValuesA)
pt_3 = Point(sort_5.ValuesA)
pt_4 = Point(rev)
entwine = Entwine(Branch00=pt_3, Branch01=pt_2, Branch02=pt_4, Branch03=pt, FlattenInputs=True)  # -> simplify(Result)
R = ClusterOutput(entwine)

# ==== cluster Cluster_9
L = ClusterInput()
item = ListItem(List=flatten(L), Index="2", Wrap=True)
L_2 = ClusterInput()
flip = FlipCurve(Curve=item)  # -> Curve, Flag
replace = ReplaceItems(List=flatten(L_2), Item=flip.Curve, Indices="2", Wrap=False)  # -> simplify(graft(List))
L_3 = ClusterOutput(replace)

# ==== cluster Cluster_10
B = ClusterInput()
C = ClusterInput()
split = SplitBrep(Brep=B, Cutter=C)
area = Area(Geometry=split)  # -> Area, Centroid
sort = SortList(Keys=area.Area, ValuesA=split)  # -> Keys, ValuesA
item = ListItem(List=sort.ValuesA, Index=-1, Wrap=True)
i = ClusterOutput(item)

# ==== cluster Cluster_11
input = ClusterInput()
pt = ClusterInput()
data = ClusterInput()
L = ClusterInput()
pt_2 = Point(pt)
data_2 = Data(data)
subset = SubList(List=L, Domain=data_2, Wrap=True)  # -> simplify(List), Index
subset_2 = SubList(List=pt_2, Domain=data_2, Wrap=True)  # -> simplify(List), Index
pt_3 = ClusterOutput(pt_2)
branch = TreeBranch(Tree=subset_2.List, Path="{0}", MaintainPaths=True)
branch_2 = TreeBranch(Tree=subset.List, Path="{0}", MaintainPaths=True)
branch_3 = TreeBranch(Tree=subset.List, Path="{1}", MaintainPaths=True)
branch_4 = TreeBranch(Tree=subset.List, Path="{2}", MaintainPaths=True)
branch_5 = TreeBranch(Tree=subset.List, Path="{3}", MaintainPaths=True)
branch_6 = TreeBranch(Tree=subset_2.List, Path="{1}", MaintainPaths=True)
branch_7 = TreeBranch(Tree=subset_2.List, Path="{2}", MaintainPaths=True)
branch_8 = TreeBranch(Tree=subset_2.List, Path="{3}", MaintainPaths=True)
devec = DeconstructVector(Vector=branch_5)  # -> XComponent, YComponent, ZComponent
devec_2 = DeconstructVector(Vector=branch_4)  # -> XComponent, YComponent, ZComponent
devec_3 = DeconstructVector(Vector=branch_2)  # -> XComponent, YComponent, ZComponent
devec_4 = DeconstructVector(Vector=branch_3)  # -> XComponent, YComponent, ZComponent
neg = Negative(Value=devec.XComponent)
neg_2 = Negative(Value=devec_2.YComponent)
neg_3 = Negative(Value=devec_4.XComponent)
neg_4 = Negative(Value=devec_3.YComponent)
vec = VectorXYZ(XComponent=neg, YComponent=devec.YComponent, ZComponent=devec.ZComponent)  # -> Vector, Length
vec_2 = VectorXYZ(XComponent=devec_2.XComponent, YComponent=neg_2, ZComponent=devec_2.ZComponent)  # -> Vector, Length
vec_3 = VectorXYZ(XComponent=neg_3, YComponent=devec_4.YComponent, ZComponent=devec_4.ZComponent)  # -> Vector, Length
vec_4 = VectorXYZ(XComponent=devec_3.XComponent, YComponent=neg_4, ZComponent=devec_3.ZComponent)  # -> Vector, Length
flatten = FlattenTree(Tree=branch_3, Path="{0}")
flatten_2 = FlattenTree(Tree=branch_5, Path="{0}")
flatten_3 = FlattenTree(Tree=vec_3.Vector, Path="{1}")
flatten_4 = FlattenTree(Tree=vec.Vector, Path="{1}")
flatten_5 = FlattenTree(Tree=branch_4, Path="{0}")
flatten_6 = FlattenTree(Tree=branch_2, Path="{0}")
flatten_7 = FlattenTree(Tree=vec_4.Vector, Path="{1}")
flatten_8 = FlattenTree(Tree=vec_2.Vector, Path="{1}")
merge = Merge(Data1=flatten_6, Data2=flatten_7)
merge_2 = Merge(Data1=flatten_5, Data2=flatten_8)
merge_3 = Merge(Data1=flatten, Data2=flatten_3)
merge_4 = Merge(Data1=flatten_2, Data2=flatten_4)
vdis = VectorDisplay(Anchor=branch_8, Vector=merge_4)
vdis_2 = VectorDisplay(Anchor=branch_7, Vector=merge_2)
vdis_3 = VectorDisplay(Anchor=branch_6, Vector=merge_3)
vdis_4 = VectorDisplay(Anchor=branch, Vector=merge)
merge_5 = Merge(Data1=branch, Data2=branch_6, Data3=branch_7, Data4=branch_8)  # -> flatten(Result)
merge_6 = Merge(Data1=merge, Data2=merge_3, Data3=merge_2, Data4=merge_4)
branch_9 = TreeBranch(Tree=merge_6, Path="{0}", MaintainPaths=True)
vdis_5 = VectorDisplay(Anchor=merge_5, Vector=merge_6)
B = ClusterOutput(branch_9)
R = ClusterOutput(merge_5)
R_2 = ClusterOutput(merge_6)

# ==== cluster Cluster_12
X = ClusterInput()
Y = ClusterInput()
xy = XYPlane(Origin=Point(0, 0, 0))
number_slider = Slider(30, range=0..200)
rectangle = Rectangle(Plane=xy, XSize=X, YSize=Y, Radius=0)  # -> Rectangle, Length
scale = Scale(Geometry=rectangle.Rectangle, Center=xy, Factor=2)  # -> Geometry, Transform
sdivide = DivideSurface(Surface=scale.Geometry, UCount=number_slider, VCount=number_slider)  # -> flatten(Points), Normals, Parameters
Z = UnitZ(Factor=1)
G = ClusterInput()
project = ProjectPoint(Point=sdivide.Points, Direction=Z, Geometry=G)  # -> Point, Index
pdecon = Deconstruct(Point=project.Point)  # -> XComponent, YComponent, ZComponent
reparamnums = ReparameterizeNumbers(Numbers=pdecon.ZComponent)  # -> Reparameterized, Original
subtraction = Subtraction(A=reparamnums.Reparameterized, B=1)
B = ClusterInput()
abs = Absolute(Value=subtraction)
multiplication = Multiplication(A=abs, B=B)
Z_2 = UnitZ(Factor=expr("x*-1", multiplication))
move = Move(Geometry=project.Point, Motion=Z_2)  # -> Geometry, Transform
patch = Patch(Points=move.Geometry, Spans=20, Flexibility=20, Trim=True)
P = ClusterOutput(patch)

# ==== cluster Cluster
A = ClusterInput()
A_2 = ClusterInput()
pt = ClusterInput()
G = ClusterInput()
pt_2 = Point(pt)
project = ProjectPoint(Point=pt_2, Direction=expr("{0,0,1}", Vector(0, 0, -1)), Geometry=G)  # -> Point, Index
dist = Distance(PointA=pt_2, PointB=project.Point)
expression = Expression(x=dist, Expression="Format(\"{0:0.00}\", x)")
reparamnums = ReparameterizeNumbers(Numbers=expression)  # -> simplify(Reparameterized), Original
num = Number(reparamnums.Reparameterized)
multiplication = Multiplication(A=A_2, B=num)
addition = Addition(A=A, B=multiplication)
R = ClusterOutput(addition)
num_2 = ClusterOutput(num)
