# Grasshopper definition StructuralAnalysis_WardModule.gh (Grasshopper 1.0.7)
# plug-ins: Karamba, Kangaroo2 Components

# ----
# Buttress settings
# Courtyard side (front)
# Backside
# Middle buttresses (position and width)
top_part = Slider(0.1, range=0..1.5)
bothsides = BooleanToggle(True)
bottom_part = Slider(0.5, range=0..1.5)
bottom_part_2 = Slider(1.5, range=0..1.5)
top_part_2 = Slider(1.5, range=0..1.5)
mesh_edge_number = Slider(13, range=0..31)
mesh_edge_number_2 = Slider(20, range=0..31)  # disabled
wall_width = Slider(0.4, range=0..1)

# ---- group: Settings Vault
force_variable = Slider(3, range=0..100)
force_variable_2 = Slider(1, range=0..100)
force_fixed = Slider(0.1, range=0..5)
arc_settings = Slider(1.88, range=0..5)
stiffness_edges = Slider(2500, range=1..2500)
stiffness_edges_2 = Slider(2500, range=1..2500)

# ----
# CREATING VAULT
# 1st iteration
force_fixed_2 = Slider(0.5, range=0..5)
height_parameter_top_surface = Slider(0.2, range=-1..1)
srf = Surface(<surface referenced from the Rhino model>)

force_variable_3 = Slider(1, range=0..100)
stiffness = Slider(400, range=0..1500)
number_of_arch_divisions = Slider(25, range=0..50)
force_fixed_3 = Slider(1.5, range=0..5)

# ----
# Wall dimensions
wall_height = Slider(3, range=0..5)

# ----
# Vault dimensions
pt = ConstructPoint(XCoordinate=0, YCoordinate=0, ZCoordinate=wall_height)
span_m = Slider(3, range=0..10)
extrusion_lenght_m = Slider(6, range=0..100)
nr_of_divisions_in_span_direction = Slider(30, range=0..50)
nr_of_divisions_in_perpendicular_directi = Slider(60, range=0..100)  # "Nr of divisions in perpendicular direction"
xy = XYPlane(Origin=pt)
rectangle = Rectangle(Plane=xy, XSize=span_m, YSize=extrusion_lenght_m, Radius=0)  # -> Rectangle, Length

# ----
# CREATING WALL
# RESET TOOL
translation_wall = Number(span_m)

# ----
# Preview Dimension
number_slider = Slider(0.225, range=0..1)
merge = Merge(Data1=extrusion_lenght_m, Data2=1)

# ----
# RESET TOOL
data = Data([nr_of_divisions_in_span_direction, nr_of_divisions_in_perpendicular_directi, extrusion_lenght_m, span_m, stiffness_edges, force_variable, arc_settings])
dam = DataDam(DataA=data, BufferDelay=2500000, BufferMode=2)
equals = Equality(FirstNumber=data, SecondNumber=dam)  # -> Equality, Inequality
ma = MassAddition(Input=equals.Inequality)  # -> Result, PartialResults
bool = Boolean(ma.Result)

force_variable_4 = Slider(1, range=0..100)
stiffness_2 = Slider(500, range=0..1500)
number_of_arch_divisions_2 = Slider(25, range=0..50)
force_fixed_4 = Slider(1.5, range=0..5)

# ----
# Opening 1
toggle = BooleanToggle(True)

# ----
# Opening 2
toggle_2 = BooleanToggle(True)

explode = Explode(Curve=rectangle.Rectangle, Recursive=True)  # -> Segments, Vertices
item = ListItem(List=explode.Vertices, Index=0, Wrap=True)  # -> Item, Item1, Item2, Item3
addition = Addition(A=arc_settings, B=span_m)
cat = Catenary(
    PointA=[item.Item, item.Item2],
    PointB=[item.Item1, item.Item3],
    Length=addition,
    Gravity=expr("{0,0,1}", Vector(0, 0, -1)))
loft_opt = LoftOptions(Closed=False, Adjust=False, Rebuild=Slider(100, range=0..100), Refit=0, Type=2)
loft = Loft(Curves=cat, Options=loft_opt)
mesh_uv = MeshSurface(
    Surface=loft,
    UCount=nr_of_divisions_in_span_direction,
    VCount=nr_of_divisions_in_perpendicular_directi,
    Overhang=True,
    Equalize=False)
mesh = Mesh(mesh_uv)
medges = MeshEdges(Mesh=mesh)  # -> NakedEdges, InteriorEdges, NonManifoldEdges
demesh = DeconstructMesh(Mesh=mesh)  # -> Vertices, Faces, Colours, Normals
merge_2 = Merge(Data1=medges.NakedEdges, Data2=medges.InteriorEdges, Data3=medges.NonManifoldEdges)  # -> flatten(Result)
cluster = Cluster_3(A=demesh.Vertices)  # -> flatten(pt_3), B
intcrv = Interpolate(Vertices=cluster.B, Degree=3, Periodic=False, KnotStyle=1)  # -> Curve, Length, Domain

addition_2 = Addition(A=wall_height, B=height_parameter_top_surface)
Z = UnitZ(Factor=addition_2)
move = Move(Geometry=srf, Motion=Z)  # -> Geometry, Transform
explode_2 = Explode(Curve=move.Geometry, Recursive=True)  # -> Segments, Vertices
item_2 = ListItem(List=explode_2.Segments, Index=2, Wrap=True)
Y = UnitY(Factor=extrusion_lenght_m)
item_3 = ListItem(List=explode_2.Vertices, Index=3, Wrap=True)
yz = YZPlane(Origin=item_3)
extr = Extrude(Base=item_2, Direction=Y)
mirror = Mirror(Geometry=extr, Plane=yz)  # -> Geometry, Transform
join = BrepJoin(Breps=flatten([extr, mirror.Geometry]))  # -> Breps, Closed

# ----
# Creating basis wall
pt_2 = ConstructPoint(XCoordinate=translation_wall, YCoordinate=extrusion_lenght_m, ZCoordinate=0)
pt_3 = ConstructPoint(XCoordinate=translation_wall, YCoordinate=0, ZCoordinate=0)
ln = Line(StartPoint=pt_3, EndPoint=pt_2)
Z_2 = UnitZ(Factor=wall_height)
extr_2 = Extrude(Base=ln, Direction=Z_2)

# ----
# Adding buttresses
explode_3 = Explode(Curve=extr_2, Recursive=True)  # -> Segments, Vertices
explode_4 = Explode(Curve=extr_2, Recursive=True)  # -> Segments, Vertices
item_4 = ListItem(List=explode_3.Segments, Index=-1, Wrap=True)
item_5 = ListItem(List=explode_4.Segments, Index=1, Wrap=True)
Y_2 = UnitY(Factor=expr("x*-1", bottom_part))
Y_3 = UnitY(Factor=expr("x*-1", top_part))
end = EndPoints(Curve=item_4)  # -> Start, End
end_2 = EndPoints(Curve=item_5)  # -> Start, End
Y_4 = UnitY(Factor=top_part_2)
Y_5 = UnitY(Factor=bottom_part_2)
move_2 = Move(Geometry=end.Start, Motion=Y_2)  # -> Geometry, Transform
move_3 = Move(Geometry=end.End, Motion=Y_3)  # -> Geometry, Transform
move_4 = Move(Geometry=end_2.Start, Motion=Y_4)  # -> Geometry, Transform
move_5 = Move(Geometry=end_2.End, Motion=Y_5)  # -> Geometry, Transform
ln_2 = Line(StartPoint=move_2.Geometry, EndPoint=move_3.Geometry)
ln_3 = Line(StartPoint=[end.Start, end.End], EndPoint=[move_2.Geometry, move_3.Geometry])
ln_4 = Line(StartPoint=move_4.Geometry, EndPoint=move_5.Geometry)
ln_5 = Line(StartPoint=[end_2.Start, end_2.End], EndPoint=[move_4.Geometry, move_5.Geometry])
boundary = BoundarySurfaces(Edges=[item_4, ln_2, ln_3])
boundary_2 = BoundarySurfaces(Edges=[item_5, ln_4, ln_5])

supports = Point(flatten(cluster.B))
edges = Line(merge_2)
points = Point(cluster.pt_3)
mesh_2 = Mesh(mesh)
crv = Curve(intcrv.Curve)

# ---- group: Input Data
# KARAMBA!
# Structural analysis of wall
# Inputs
# Thickness wall
# Thickness buttress middle
thickness_mm = Slider(400, range=0..1000)
thickness_mm_2 = Slider(400, range=0..1000)

# KARAMBA!
# Structural analysis of roof
# Inputs
thickness_mm_3 = Slider(200, range=0..1000)

# ----
# RESET TOOL
reset = Button()

base_settings_arch = Slider(3, range=0..5)
height_arch_start = Slider(0, range=0..3)
l0 = Slider(0.5, range=0..6)
l1 = Slider(4, range=0..6)

base_settings_arch_2 = Slider(3, range=0..5)
height_arch_start_2 = Slider(0, range=0..3)
l0_2 = Slider(3.3, range=0..6)
l1_2 = Slider(1.5, range=0..6)

data_2 = Data([toggle, wall_height, extrusion_lenght_m, l0, l1, base_settings_arch, height_arch_start, force_fixed_3, force_variable_3, stiffness, number_of_arch_divisions, toggle_2, l0_2, l1_2, base_settings_arch_2, height_arch_start_2, force_fixed_4, force_variable_4, stiffness_2, number_of_arch_divisions_2])
dam_2 = DataDam(DataA=data_2, BufferDelay=2500000, BufferMode=2)
equals_2 = Equality(FirstNumber=data_2, SecondNumber=dam_2)  # -> Equality, Inequality
ma_2 = MassAddition(Input=equals_2.Inequality)  # -> Result, PartialResults
bool_2 = Boolean(ma_2.Result)

explode_5 = Explode(Curve=extr_2, Recursive=True)  # -> Segments, Vertices
subtraction = Subtraction(A=extrusion_lenght_m, B=l1)
item_6 = ListItem(List=explode_5.Segments, Index=0, Wrap=True)
subtraction_2 = Subtraction(A=subtraction, B=l0)
ext = ExtendCurve(Curve=ln, Type=0, Start=expr("x*-1", l0), End=expr("x*-1", l1))
end_3 = EndPoints(Curve=ext)  # -> Start, End
Z_3 = UnitZ(Factor=height_arch_start)
move_6 = Move(Geometry=end_3.Start, Motion=Z_3)  # -> Geometry, Transform
move_7 = Move(Geometry=end_3.End, Motion=Z_3)  # -> Geometry, Transform
dist = Distance(PointA=move_6.Geometry, PointB=move_7.Geometry)
addition_3 = Addition(A=dist, B=base_settings_arch)
cat_2 = Catenary(PointA=move_6.Geometry, PointB=move_7.Geometry, Length=addition_3, Gravity=expr("{0,0,1}", Vector(0, 0, -1)))
divide = DivideCurve(Curve=reparameterize(cat_2), Count=number_of_arch_divisions, Kinks=False)  # -> Points, Tangents, Parameters
cull_i = CullIndex(List=divide.Points, Indices=[-1, 0], Wrap=True)
cluster_2 = Cluster_2(A=force_fixed_3, A_2=force_variable_3, pt=cull_i, G=item_6)  # -> num_2, R
shatter = Shatter(Curve=reparameterize(cat_2), Parameters=divide.Parameters)
item_7 = ListItem(List=divide.Points, Index=0, Wrap=True)  # -> Item1, Item
Z_4 = UnitZ(Factor=cluster_2.R)
anchor = Anchor(Point=flatten([item_7.Item1, item_7.Item]), Strength=1e+12)
length_line = LengthLine(Line=flatten(shatter), Strength=stiffness)
load = Load(Point=flatten(cull_i), ForceVector=Z_4)
merge_3 = Merge(Data1=anchor, Data2=load, Data3=length_line)  # -> flatten(Result)
solver = Solver(GoalObjects=merge_3, Reset=bool_2, Threshold=1e-15, Tolerance=0.01, On=toggle)  # -> I, simplify(V), O
cluster_3 = Cluster_3(A=solver.V)  # -> flatten(pt_3), B
ln_6 = Line(StartPoint=[end_3.Start, end_3.End], EndPoint=[move_6.Geometry, move_7.Geometry])  # -> flatten(Line)
intcrv_2 = Interpolate(Vertices=cluster_3.pt_3, Degree=3, Periodic=False, KnotStyle=1)  # -> Curve, Length, Domain
join_2 = JoinCurves(Curves=[ln_6, ext, intcrv_2.Curve], Preserve=False)
boundary_3 = BoundarySurfaces(Edges=join_2)
gate = StreamGate(Stream=boundary_3, Gate=toggle)  # -> Target0, Target1
cluster_4 = Cluster_4(C=gate.Target1)  # -> P, P_2, i, item_1, item_2, item_3
aligndim = AlignedDimension(
    Plane=cluster_4.P,
    PointA=cluster_4.i,
    PointB=[cluster_4.item_2, cluster_4.item_1],
    Offset=expr("x*-1.5", merge),
    Text="{0:0.00}",
    Size=number_slider)

opening_width_m = Panel(subtraction_2)

explode_6 = Explode(Curve=extr_2, Recursive=True)  # -> Segments, Vertices
subtraction_3 = Subtraction(A=extrusion_lenght_m, B=l1_2)
item_8 = ListItem(List=explode_6.Segments, Index=0, Wrap=True)
subtraction_4 = Subtraction(A=subtraction_3, B=l0_2)
ext_2 = ExtendCurve(Curve=ln, Type=0, Start=expr("x*-1", l0_2), End=expr("x*-1", l1_2))
end_4 = EndPoints(Curve=ext_2)  # -> Start, End
Z_5 = UnitZ(Factor=height_arch_start_2)
move_8 = Move(Geometry=end_4.Start, Motion=Z_5)  # -> Geometry, Transform
move_9 = Move(Geometry=end_4.End, Motion=Z_5)  # -> Geometry, Transform
dist_2 = Distance(PointA=move_8.Geometry, PointB=move_9.Geometry)
addition_4 = Addition(A=dist_2, B=base_settings_arch_2)
cat_3 = Catenary(PointA=move_8.Geometry, PointB=move_9.Geometry, Length=addition_4, Gravity=expr("{0,0,1}", Vector(0, 0, -1)))
divide_2 = DivideCurve(Curve=reparameterize(cat_3), Count=number_of_arch_divisions_2, Kinks=False)  # -> Points, Tangents, Parameters
cull_i_2 = CullIndex(List=divide_2.Points, Indices=[-1, 0], Wrap=True)
cluster_5 = Cluster_2(A=force_fixed_4, A_2=force_variable_4, pt=cull_i_2, G=item_8)  # -> num_2, R
shatter_2 = Shatter(Curve=reparameterize(cat_3), Parameters=divide_2.Parameters)
item_9 = ListItem(List=divide_2.Points, Index=0, Wrap=True)  # -> Item1, Item
Z_6 = UnitZ(Factor=cluster_5.R)
anchor_2 = Anchor(Point=flatten([item_9.Item1, item_9.Item]), Strength=1e+12)
length_line_2 = LengthLine(Line=flatten(shatter_2), Strength=stiffness_2)
load_2 = Load(Point=flatten(cull_i_2), ForceVector=Z_6)
merge_4 = Merge(Data1=anchor_2, Data2=load_2, Data3=length_line_2)  # -> flatten(Result)
solver_2 = Solver(GoalObjects=merge_4, Reset=bool_2, Threshold=1e-15, Tolerance=0.01, On=toggle_2)  # -> I, simplify(V), O
cluster_6 = Cluster_3(A=solver_2.V)  # -> flatten(pt_3), B
ln_7 = Line(StartPoint=[end_4.Start, end_4.End], EndPoint=[move_8.Geometry, move_9.Geometry])  # -> flatten(Line)
intcrv_3 = Interpolate(Vertices=cluster_6.pt_3, Degree=3, Periodic=False, KnotStyle=1)  # -> Curve, Length, Domain
join_3 = JoinCurves(Curves=[ln_7, ext_2, intcrv_3.Curve], Preserve=False)
boundary_4 = BoundarySurfaces(Edges=join_3)
gate_2 = StreamGate(Stream=boundary_4, Gate=toggle_2)  # -> Target0, Target1
cluster_7 = Cluster_4(C=gate_2.Target1)  # -> P, P_2, i, item_1, item_2, item_3
aligndim_2 = AlignedDimension(
    Plane=cluster_7.P,
    PointA=cluster_7.i,
    PointB=[cluster_7.item_2, cluster_7.item_1],
    Offset=[-5, -1],
    Text="{0:0.00}",
    Size=number_slider)

opening_width_m_2 = Panel(subtraction_4)

# ---- group: Trimming surface with openings
# Trimming wall with openings
splitmul = SplitBrepMultiple(Brep=extr_2, Cutters=[gate.Target1, gate_2.Target1])
area = Area(Geometry=splitmul)  # -> Area, Centroid
sort = SortList(Keys=area.Area, ValuesA=splitmul)  # -> Keys, ValuesA
lng = ListLength(List=splitmul)
item_10 = ListItem(List=sort.ValuesA, Index=expr("x-1", lng), Wrap=True)
join_4 = BrepJoin(Breps=flatten(item_10))  # -> Breps, Closed

# ----
# Kangaroo!
# Edges
# Force points
# Supports
# Curve for patch
# (supports)
pt_4 = Point(flatten(points))
crv_2 = Curve(crv)
pt_5 = Point(supports)
line = Line(edges)
anchor_3 = Anchor(Point=pt_5, Strength=1e+12)
length_line_3 = LengthLine(Line=line, Strength=stiffness_edges)
show = Show(G=mesh_2)

# ----
# Form-finding vault
cluster_8 = Cluster_2(A=force_fixed_2, A_2=force_variable, pt=pt_4, G=join.Breps)  # -> num_2, R

Z_7 = UnitZ(Factor=cluster_8.R)
load_3 = Load(Point=pt_4, ForceVector=Z_7)
solver_3 = Solver(GoalObjects=flatten([show, length_line_3, anchor_3, load_3]), Reset=bool, Threshold=1e-15, Tolerance=0.01, On=True)  # -> I, V, O
item_11 = ListItem(List=solver_3.O, Index=-1, Wrap=True)

# ----
# DATADAM 1
# After updating the datadam, enable the Kangaroo solver by changing the boolean
#  toggle to True. If need be, the process can be reset using the reset button.
toggle_3 = BooleanToggle(False)
dam_3 = DataDam(DataA=item_11, BufferDelay=10000000, BufferMode=0)
reset_2 = Button()

# ----
# 2nd iteration
scale = Slider(1.084, range=1..1.5)
extend_curve = Slider(1.237, range=0..5)
bulge = Slider(1, range=0..1)
mesh_3 = Mesh(dam_3)
cluster_9 = Cluster_9(num=scale, num_3=extend_curve, num_2=bulge, M=mesh_3, F=extrusion_lenght_m)
Z_8 = UnitZ(Factor=Slider(0, range=0..1))
move_10 = Move(Geometry=cluster_9, Motion=Z_8)  # -> Geometry, Transform
cluster_10 = Cluster_10(mesh=mesh_3, strength=stiffness_edges, A=force_fixed, A_2=force_variable_2, G=move_10.Geometry)
solver_4 = Solver(GoalObjects=flatten(cluster_10), Reset=reset_2, Threshold=1e-15, Tolerance=0.01, On=toggle_3)  # -> I, V, O
cluster_11 = Cluster_11(data=solver_4.O)

# ----
# DATADAM 2
# Update datadam after the shape is fully converged to give the mesh to the
# Karamba structural analysis.
dam_4 = DataDam(DataA=cluster_11, BufferDelay=10000000, BufferMode=0)

# ---- group: Toggle Preview Dome/Vault
# Preview dimensions
number_slider_2 = Slider(0.4, range=0..1)
gate_3 = StreamGate(Stream=dam_4, Gate=0)  # -> Target0, Target1
Z_9 = UnitZ(Factor=wall_height)
bbox = BoundingBox(Content=flatten(gate_3.Target0), Plane=PlaneXY(0, 0, 0), UnionBox=True)  # -> Box, Box_2
xy_2 = XYPlane(Origin=Point(0, 0, 0))
debrep = DeconstructBrep(Brep=bbox.Box)  # -> Faces, Edges, Vertices
xz = XZPlane(Origin=Point(0, 0, 0))
move_11 = Move(Geometry=xy_2, Motion=Z_9)  # -> Geometry, Transform
item_12 = ListItem(List=debrep.Vertices, Index=4, Wrap=True)  # -> Item, Item1, Item2
item_13 = ListItem(List=debrep.Vertices, Index=0, Wrap=True)  # -> Item, Item1, Item2
aligndim_3 = AlignedDimension(
    Plane=[xz, move_11.Geometry],
    PointA=[item_13.Item, item_13.Item1],
    PointB=[item_12.Item, item_13.Item2],
    Offset=[-4, 4],
    Text="{0:0.00}",
    Size=number_slider_2)
aligndim_4 = AlignedDimension(Plane=xz, PointA=item_13.Item, PointB=item_13.Item1, Offset=-1, Text="{0:0.00}", Size=number_slider_2)

# ---- group: Mesh input
mesh_4 = Mesh(dam_4)

# ----
# Attaching loads
distributed_vertical_load_kn_m2 = Panel("1")
specific_weight_filler_kg_m3 = Panel("1600")
vault = Vault_2(A=specific_weight_filler_kg_m3, M=mesh_4, G=move_10.Geometry)
Z_10 = UnitZ(Factor=expr("x*-1.2", vault))
loads = LoadsKaramba(Vectors=Z_10, Mesh=mesh_4, LCase="0", mode="MeshLoad -Variable", menu=[buttons(off, on, off), buttons(on, on)])
Z_11 = UnitZ(Factor=expr("x*-1.5", distributed_vertical_load_kn_m2))
loads_2 = LoadsKaramba(Vector=expr("x*1.2", Vector(0, 0, -1)), LCase="0", mode="Gravity")
loads_3 = LoadsKaramba(Vector=Z_11, Mesh=mesh_4, LCase="0", mode="MeshLoad -Const.", menu=[buttons(off, on, off), buttons(on, on)])

# ---- group: Creating support
# Attaching supports
tolerance = Slider(0.005, range=0..0.1)
cluster_12 = Cluster(A=tolerance, M=mesh_4)
end_5 = EndPoints(Curve=cluster_12)  # -> Start, End
weave = Weave(Pattern=[0, 1], Stream0=end_5.Start, Stream1=end_5.End, NullGaps=False)
duppt = RemoveDuplicatePts(Points=flatten(weave), Tolerance=0.01)
supp = SupportKaramba(PosInd=duppt, PlaneOfReference=PlaneXY(0, 0, 0), menu=[buttons(on, on, on, off, off, off)])  # -> flatten(Support)

# ---- group: Creating element
# Creating elements
panel = Panel("shell")
meshtoshell = MeshToShellKaramba(Mesh=mesh_4, Identifier=panel, LimitDistance_m=0.005)  # -> Element, Points, Info
Z_12 = UnitZ(Factor=1)
X = UnitX(Factor=1)
orientate = OrientateElemKaramba(Shell=meshtoshell.Element, ShellIdentifier=panel, XOrientations=X, ZOrientations=Z_12, mode="Shell")

# ---- group: Setting cross-section
concat = Concatenate(FragmentA="shellCS", FragmentB=thickness_mm_3, JoinSeparator="_")
concat_2 = Concatenate(FragmentA=concat, FragmentB="mm")
division = Division(A=thickness_mm_3, B=10)
cross_sections = CrossSectionsKaramba(
    FamilyNameOfCrossSection="shellCS",
    NameOfCrossSection=concat,
    ElementsIdentifiers=panel,
    Material=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,
    Height_cm=division,
    mode="Shell - Const")

# ----
# Reaction forces from vault
number_slider_3 = Slider(0.2, range=0..3)

yz_2 = YZPlane(Origin=Point(0, 0, 0))

# ----
# Meshing
# Main wall
# Buttress 1
# Buttress 2
# Buttress middle
number_slider_4 = Slider(0.14, range=0.1..1)

# ---- group: Range of values
# Young's Modulus [N/mm2]: 147 - 225 (D. Silveira et al., 2012)
# Yield Strenght [N/mm2]: maximum compressive strength = 2
specific_weight_kg_m3 = Panel("1200 - 1700 (D.R. Visser)")
compressive_strenght_n_mm2 = Panel("0.514")
poisson_s_ratio = Panel("0.35")

# ---- group: Material properties
# Setting material properties
young_s_modulus_n_mm2 = Panel("150")
specific_weight_kg_m3_2 = Panel("1450")
yield_strenght_n_mm2 = Panel(compressive_strenght_n_mm2)
expression = Expression(x=young_s_modulus_n_mm2, y=poisson_s_ratio, Expression="x/(2*(1+y))")
expression_2 = Expression(x=expression, Expression="Format(\"{0:0.00} N/mm2\", x)")
rgb = ColourRGB(Alpha=255, Red=139, Green=69, Blue=19)
multiplication = Multiplication(A=young_s_modulus_n_mm2, B=0.1)
multiplication_2 = Multiplication(A=expression, B=0.1)
multiplication_3 = Multiplication(A=specific_weight_kg_m3_2, B=0.01)
multiplication_4 = Multiplication(A=yield_strenght_n_mm2, B=0.1)
concat_3 = Concatenate(FragmentA="adobe", FragmentB="natural", JoinSeparator="_")
multiplication_5 = Multiplication(A=compressive_strenght_n_mm2, B=0.1)
matprops = MaterialPropertiesKaramba(
    FamilyOfMaterial="adobe",
    Name=concat_3,
    ElementsIdentifiers=panel,
    Color=rgb,
    YoungsModulus_kN_cm2=multiplication,
    InPlaneShearModulus_kN_cm2=multiplication_2,
    TransverseShearModulus_kN_cm2=multiplication_2,
    SpecificWeight_kN_m3=multiplication_3,
    CoefficientOfThermalExpansion_1_C=1e-05,
    YieldStrength_kN_cm2=multiplication_4,
    mode="Isotrop")

# ---- group: Range of values (continued)
shear_modulus_n_mm2 = Panel(expression_2)
tensile_strenght_n_mm2 = Panel(multiplication_5)

# ---- group: Assembling
assemble = AssembleModelKaramba(
    Elem=flatten(orientate),
    Support=flatten(supp),
    Load=flatten([loads_2, loads, loads_3]),
    CrossSection=flatten(cross_sections),
    Material=flatten(matprops),
    LimitDistance_m=0.005)  # -> Model, Info, Mass_kg, CenterOfGravity

# ---- group: ANALYSE!
# ROOF ANALYSIS
# Enable the AnalyzeThI component to calculate the structure. To use the support
# reactions as input for the structural calculations update Datadam 3
analyzethi = AnalyzeThIKaramba(Model=assemble.Model)  # -> CalculatedModel, MaximumDisplacement_m, ResultingForceOfGravity_kN, ElasticEnergy_kNm; disabled

# ---- group: Setting cross-section
concat_4 = Concatenate(FragmentA="wallCS", FragmentB=thickness_mm, JoinSeparator="_")
concat_5 = Concatenate(FragmentA=concat_4, FragmentB="mm")
division_2 = Division(A=thickness_mm, B=10)
concat_6 = Concatenate(FragmentA="wallCS", FragmentB=thickness_mm_2, JoinSeparator="_")
concat_7 = Concatenate(FragmentA=concat_6, FragmentB="mm")
division_3 = Division(A=thickness_mm_2, B=10)

# ---- group: Creating element
# Creating elements
panel_2 = Panel("buttress2")
panel_3 = Panel("buttress1")
Y_6 = UnitY(Factor=1)
Z_13 = UnitZ(Factor=1)
panel_4 = Panel("buttress_middle")
panel_5 = Panel("wall")

# ---- group: Material properties
# Setting material properties
young_s_modulus_n_mm2_2 = Panel("150")
specific_weight_kg_m3_3 = Panel("1450")
yield_strenght_n_mm2_2 = Panel(compressive_strenght_n_mm2)
expression_3 = Expression(x=young_s_modulus_n_mm2_2, y=poisson_s_ratio, Expression="x/(2*(1+y))")
rgb_2 = ColourRGB(Alpha=255, Red=139, Green=69, Blue=19)
multiplication_6 = Multiplication(A=young_s_modulus_n_mm2_2, B=0.1)
multiplication_7 = Multiplication(A=expression_3, B=0.1)
multiplication_8 = Multiplication(A=specific_weight_kg_m3_3, B=0.01)
multiplication_9 = Multiplication(A=yield_strenght_n_mm2_2, B=0.1)
concat_8 = Concatenate(FragmentA="adobe", FragmentB="natural", JoinSeparator="_")
matprops_2 = MaterialPropertiesKaramba(
    FamilyOfMaterial="adobe",
    Name=concat_8,
    ElementsIdentifiers=[panel_5, panel_3, panel_2, panel_4],
    Color=rgb_2,
    YoungsModulus_kN_cm2=multiplication_6,
    InPlaneShearModulus_kN_cm2=multiplication_7,
    TransverseShearModulus_kN_cm2=multiplication_7,
    SpecificWeight_kN_m3=multiplication_8,
    CoefficientOfThermalExpansion_1_C=1e-05,
    YieldStrength_kN_cm2=multiplication_9,
    mode="Isotrop")

# ---- group: Setting cross-section (continued)
cross_sections_2 = CrossSectionsKaramba(
    FamilyNameOfCrossSection="wallCS",
    NameOfCrossSection=concat_5,
    ElementsIdentifiers=[panel_5, panel_3, panel_2],
    Material=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,
    Height_cm=division_2,
    mode="Shell - Const")
cross_sections_3 = CrossSectionsKaramba(
    FamilyNameOfCrossSection="wallCS",
    NameOfCrossSection=concat_7,
    ElementsIdentifiers=panel_4,
    Material=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,
    Height_cm=division_3,
    mode="Shell - Const")

# ---- group: Setting gravity
loads_4 = LoadsKaramba(Vector=expr("x*1.2", Vector(0, 0, -1)), LCase="0", mode="Gravity")

# ----
# Compression < 0
# Tension          > 0
# RESULTS
modelview = ModelViewKaramba(Model=analyzethi.CalculatedModel, LoadCaseFactorsForLinearSuperposition=1, IndexOfVisibleLoadcase=-1)  # -> Model, DeformedMesh, DeformedAxes, DeformedModel
shellview = ShellViewKaramba(Model=modelview.Model, IndexOfLayer=0)  # -> Model, MeshesOfRenderedShells, LegendColors, LegendTags
max_compressive_strength_n_mm2 = Panel(yield_strenght_n_mm2)
max_tensile_strength_n_mm2 = Panel(tensile_strenght_n_mm2)

# ----
# DATADAM 3
# Update datadam to retrieve support reactions as input loads on wall
dam_5 = DataDam(DataA=shellview.Model, BufferDelay=10000000, BufferMode=0)

# ---- group: Unit converter
cull_i_3 = CullIndex(List=shellview.LegendTags, Indices=0, Wrap=True)
multiplication_10 = Multiplication(A=cull_i_3, B=10)
merge_5 = Merge(Data1="Stress [N/mm2]", Data2=multiplication_10)  # -> flatten(Result)

# ----
legend = Legend(Colour=shellview.LegendColors, Tags=merge_5, LegendType=1)

# ----
# Maximum stresses
# Maximum stresses
# Tension
# Compression
# Tension
# Compression
number_slider_5 = Slider(0, range=-1..1)
shellvecresults = ResultVectorsOnShellsKaramba(AnalyzedModel=shellview.Model, LayerOfResults=number_slider_5, mode="PrincStress")  # -> AnalyzedModel, Points, FirstPrincipalStressVector_kN_cm2, SecondPrincipalStressVector_kN_cm2, FirstPrincipalStressValue_kN_cm2, SecondPrincipalStressValue_kN_cm2
sort_2 = SortList(Keys=shellvecresults.FirstPrincipalStressValue_kN_cm2)  # -> Keys, ValuesA
sort_3 = SortList(Keys=shellvecresults.SecondPrincipalStressValue_kN_cm2)  # -> Keys, ValuesA
eval = Evaluate(F="if(x≥0, True, False)", x=sort_2.Keys)
eval_2 = Evaluate(F="if(x≥0, True, False)", x=sort_3.Keys)
cull = CullPattern(List=sort_2.Keys, CullPattern=invert(eval))
cull_2 = CullPattern(List=sort_3.Keys, CullPattern=invert(eval_2))
cull_3 = CullPattern(List=sort_2.Keys, CullPattern=eval)
cull_4 = CullPattern(List=sort_3.Keys, CullPattern=eval_2)
rev = ReverseList(List=cull_4)
rev_2 = ReverseList(List=cull_3)
multiplication_11 = Multiplication(A=rev_2, B=10)
multiplication_12 = Multiplication(A=cull, B=10)
multiplication_13 = Multiplication(A=rev, B=10)
multiplication_14 = Multiplication(A=cull_2, B=10)
eval_3 = Evaluate(F="Format(\"{0:0.####} N/mm2\", x)", x=multiplication_11)
eval_4 = Evaluate(F="Format(\"{0:0.####} N/mm2\", x)", x=multiplication_12)
eval_5 = Evaluate(F="Format(\"{0:0.####} N/mm2\", x)", x=multiplication_13)
eval_6 = Evaluate(F="Format(\"{0:0.####} N/mm2\", x)", x=multiplication_14)
max_stress_n_mm2 = Panel(eval_3)
min_stress_n_mm2 = Panel(eval_4)
max_stress_n_mm2_2 = Panel(eval_5)
min_stress_n_mm2_2 = Panel(eval_6)

# ---- group: Displacements
# Outputs of structural analysis sorted from maximum to minimum values
# Maximum displacements
nodedisp = NodalDisplacementsKaramba(AnalyzedModel=shellview.Model, LoadCase=0)  # -> AnalyzedModel, NodalTranslations_m, NodalRotations_rad
pdecon = Deconstruct(Point=nodedisp.NodalTranslations_m)  # -> XComponent, YComponent, ZComponent
sort_4 = SortList(Keys=pdecon.ZComponent)  # -> Keys, ValuesA
lng_2 = ListLength(List=sort_4.Keys)
item_14 = ListItem(List=sort_4.Keys, Index=expr("x-1", lng_2), Wrap=True)
item_15 = ListItem(List=sort_4.Keys, Index=0, Wrap=True)
multiplication_15 = Multiplication(A=item_15, B=1000)
multiplication_16 = Multiplication(A=item_14, B=1000)
eval_7 = Evaluate(F="Format(\"{0:0.##} mm\", x)", x=multiplication_15)
eval_8 = Evaluate(F="Format(\"{0:0.##} mm\", x)", x=multiplication_16)
min_displacement_mm = Panel(eval_7)
max_displacement_mm = Panel(eval_8)

# ----
react = ReactionForcesKaramba(AnalyzedModel=dam_5, LoadCase=0)  # -> AnalyzedModel, ReactionForces_kN, ReactionMoments_kNm, SupportPosition, SumOfReactionForces_kN, SumOfReactionMoments_kNm
pdecon_2 = Deconstruct(Point=react.SupportPosition)  # -> XComponent, YComponent, ZComponent

sort_5 = SortList(Keys=pdecon_2.XComponent, ValuesA=react.SupportPosition)  # -> Keys, ValuesA
expression_4 = Expression(x=sort_5.Keys, Expression="Format(\"{0:0.00}\", x)")
cset = CreateSet(List=expression_4)  # -> simplify(graft(Set)), Map
equals_3 = Equality(FirstNumber=expression_4, SecondNumber=cset.Set)  # -> Equality, Inequality
cull_5 = CullPattern(List=sort_5.ValuesA, CullPattern=equals_3.Equality)
pdecon_3 = Deconstruct(Point=cull_5)  # -> XComponent, YComponent, ZComponent
sort_6 = SortList(Keys=pdecon_3.YComponent, ValuesA=cull_5)  # -> Keys, ValuesA
support_points = Point(simplify(sort_6.ValuesA))
branch = TreeBranch(Tree=support_points, Path="{1}", MaintainPaths=True)

sort_7 = SortList(Keys=pdecon_2.XComponent, ValuesA=react.ReactionForces_kN)  # -> Keys, ValuesA
expression_5 = Expression(x=sort_7.Keys, Expression="Format(\"{0:0.00}\", x)")
cset_2 = CreateSet(List=expression_5)  # -> simplify(graft(Set)), Map
equals_4 = Equality(FirstNumber=expression_5, SecondNumber=cset_2.Set)  # -> Equality, Inequality
cull_6 = CullPattern(List=sort_7.ValuesA, CullPattern=equals_4.Equality)
pdecon_4 = Deconstruct(Point=cull_5)  # -> XComponent, YComponent, ZComponent
sort_8 = SortList(Keys=pdecon_4.YComponent, ValuesA=cull_6)  # -> Keys, ValuesA
item_16 = ListItem(List=branch, Index=0, Wrap=True)
reaction_forces = Point(simplify(sort_8.ValuesA))
branch_2 = TreeBranch(Tree=reaction_forces, Path="{1}", MaintainPaths=True)  # -> simplify(graft(Branch))
mirror_2 = Mirror(Geometry=branch_2, Plane=yz_2)  # -> simplify(graft(Geometry)), Transform

points_2 = PointList(Points=branch, Size=number_slider_3)

cluster_13 = Cluster_13(L=branch, i=[mesh_edge_number, mesh_edge_number_2], F=wall_width, A=wall_width, G=bothsides)
mesh_breps = MeshBreps(
    Brep=cluster_13,
    MeshResolution=number_slider_4,
    EdgeRefinementFactor=Slider(1, range=0.1..1),
    PointReduction=False,
    SmoothingStepSize=0,
    SmoothingIterations=5)  # -> Mesh, Info
cluster_14 = Cluster_12(M=mesh_breps.Mesh, B=span_m)
mesh_breps_2 = MeshBreps(
    Brep=join_4.Breps,
    InclusionPoints=flatten([branch, cluster_14]),
    MeshResolution=Slider(0.14, range=0.1..1),
    EdgeRefinementFactor=Slider(1, range=0.1..1),
    PointReduction=False,
    SmoothingStepSize=0,
    SmoothingIterations=5)  # -> Mesh, Info
demesh_2 = DeconstructMesh(Mesh=mesh_breps_2.Mesh)  # -> Vertices, Faces, Colours, Normals
demesh_3 = DeconstructMesh(Mesh=mesh_breps_2.Mesh)  # -> Vertices, Faces, Colours, Normals
cluster_15 = Cluster_6(A=demesh_2.Vertices)  # -> pt_3, B
cluster_16 = Cluster_7(A=demesh_3.Vertices)  # -> pt_3, B
branch_3 = TreeBranch(Tree=cluster_15.B, Path="{0}", MaintainPaths=True)
mesh_breps_3 = MeshBreps(
    Brep=boundary,
    InclusionPoints=branch_3,
    MeshResolution=Slider(0.14, range=0.1..1),
    EdgeRefinementFactor=Slider(1, range=0.1..1),
    PointReduction=False,
    SmoothingStepSize=0,
    SmoothingIterations=5)  # -> Mesh, Info
mesh_breps_4 = MeshBreps(
    Brep=boundary_2,
    InclusionPoints=cluster_16.B,
    MeshResolution=Slider(0.14, range=0.1..1),
    EdgeRefinementFactor=Slider(1, range=0.1..1),
    PointReduction=False,
    SmoothingStepSize=0,
    SmoothingIterations=5)  # -> Mesh, Info

# ---- group: Mesh input
mesh_5 = Mesh(mesh_breps_2.Mesh)

# ---- group: Creating element (continued)
meshtoshell_2 = MeshToShellKaramba(Mesh=mesh_breps_4.Mesh, Identifier=panel_2, LimitDistance_m=0.005)  # -> Element, Points, Info
meshtoshell_3 = MeshToShellKaramba(Mesh=mesh_breps_3.Mesh, Identifier=panel_3, LimitDistance_m=0.005)  # -> Element, Points, Info
orientate_2 = OrientateElemKaramba(Shell=meshtoshell_2.Element, ShellIdentifier=panel_2, XOrientations=Y_6, ZOrientations=Z_13, mode="Shell")
orientate_3 = OrientateElemKaramba(Shell=meshtoshell_3.Element, ShellIdentifier=panel_3, XOrientations=Y_6, ZOrientations=Z_13, mode="Shell")
meshtoshell_4 = MeshToShellKaramba(Mesh=mesh_breps.Mesh, Identifier=panel_4, LimitDistance_m=0.005)  # -> Element, Points, Info
meshtoshell_5 = MeshToShellKaramba(Mesh=mesh_5, Identifier=panel_5, LimitDistance_m=0.005)  # -> Element, Points, Info
orientate_4 = OrientateElemKaramba(Shell=meshtoshell_4.Element, ShellIdentifier=panel_4, XOrientations=Y_6, ZOrientations=Z_13, mode="Shell")
orientate_5 = OrientateElemKaramba(Shell=meshtoshell_5.Element, ShellIdentifier=panel_5, XOrientations=Y_6, ZOrientations=Z_13, mode="Shell")

# ---- group: Creating support
# Attaching supports
medges_2 = MeshEdges(Mesh=mesh_5)  # -> NakedEdges, InteriorEdges, NonManifoldEdges
vault_2 = Vault(C=medges_2.NakedEdges)
vault_buttress = VaultButtress(P_2=meshtoshell_3.Points, P_3=meshtoshell_2.Points, P=meshtoshell_4.Points)  # -> B_3, B_2, B
pt_6 = Point(flatten([vault_2, vault_buttress.B_3, vault_buttress.B_2, vault_buttress.B]))
rdpoints = RemoveDuplicatePointsKaramba(Point=pt_6, LimitDistance=0.005)  # -> OutPoint, Info, Indexes
supp_2 = SupportKaramba(PosInd=rdpoints.OutPoint, PlaneOfReference=PlaneXY(0, 0, 0), menu=[buttons(on, on, on, on, on, on)])  # -> flatten(Support)

# ---- group: Setting gravity (continued)
cluster_17 = Cluster_5(A=meshtoshell_5.Points)  # -> pt_3, simplify(graft(B))
rev_3 = Reverse(Vector=[mirror_2.Geometry, branch_2])
loads_5 = LoadsKaramba(ForceVector=rev_3, Local=False, PosInd=cluster_17.B, LCase="0", mode="Point")

# ---- group: Assembling
assemble_2 = AssembleModelKaramba(
    Elem=flatten([orientate_5, orientate_3, orientate_2, orientate_4]),
    Support=flatten(supp_2),
    Load=flatten([loads_4, loads_5]),
    CrossSection=flatten(cross_sections_2),
    Material=flatten(matprops_2),
    LimitDistance_m=0.005)  # -> Model, Info, Mass_kg, CenterOfGravity

# ---- group: ANALYSE!
# ROOF ANALYSIS
# Enable the AnalyzeThI component to calculate the structure. To use the support
# reactions as input for the structural calculations update Datadam 3
analyzethi_2 = AnalyzeThIKaramba(Model=assemble_2.Model)  # -> CalculatedModel, MaximumDisplacement_m, ResultingForceOfGravity_kN, ElasticEnergy_kNm; disabled

# ----
# Compression < 0
# Tension          > 0
# RESULTS
modelview_2 = ModelViewKaramba(Model=analyzethi_2.CalculatedModel, LoadCaseFactorsForLinearSuperposition=1, IndexOfVisibleLoadcase=-1)  # -> Model, DeformedMesh, DeformedAxes, DeformedModel
shellview_2 = ShellViewKaramba(Model=modelview_2.Model, IndexOfLayer=0)  # -> Model, MeshesOfRenderedShells, LegendColors, LegendTags

# ---- group: Unit converter
cull_i_4 = CullIndex(List=shellview_2.LegendTags, Indices=0, Wrap=True)
new_unit = Panel("Stress [N/mm2]")
multiplication_17 = Multiplication(A=cull_i_4, B=10)
merge_6 = Merge(Data1=new_unit, Data2=multiplication_17)  # -> flatten(Result)

# ----
legend_2 = Legend(Colour=shellview_2.LegendColors, Tags=merge_6, LegendType=1)

# ---- group: Displacements
# Outputs of structural analysis sorted from maximum to minimum values
# Maximum displacements
nodedisp_2 = NodalDisplacementsKaramba(AnalyzedModel=shellview_2.Model, LoadCase=0)  # -> AnalyzedModel, NodalTranslations_m, NodalRotations_rad
pdecon_5 = Deconstruct(Point=nodedisp_2.NodalTranslations_m)  # -> XComponent, YComponent, ZComponent
sort_9 = SortList(Keys=pdecon_5.ZComponent)  # -> Keys, ValuesA
lng_3 = ListLength(List=sort_9.Keys)
item_17 = ListItem(List=sort_9.Keys, Index=expr("x-1", lng_3), Wrap=True)
item_18 = ListItem(List=sort_9.Keys, Index=0, Wrap=True)
multiplication_18 = Multiplication(A=item_18, B=1000)
multiplication_19 = Multiplication(A=item_17, B=1000)
eval_9 = Evaluate(F="Format(\"{0:0.##} mm\", x)", x=multiplication_18)
eval_10 = Evaluate(F="Format(\"{0:0.##} mm\", x)", x=multiplication_19)
min_displacement_mm_2 = Panel(eval_9)
max_displacement_mm_2 = Panel(eval_10)

# ----
# Maximum stresses
# Maximum stresses
# Tension
# Compression
# Tension
# Compression
number_slider_6 = Slider(0, range=-1..1)
shellvecresults_2 = ResultVectorsOnShellsKaramba(AnalyzedModel=shellview_2.Model, LayerOfResults=number_slider_6, mode="PrincStress")  # -> AnalyzedModel, Points, FirstPrincipalStressVector_kN_cm2, SecondPrincipalStressVector_kN_cm2, FirstPrincipalStressValue_kN_cm2, SecondPrincipalStressValue_kN_cm2
sort_10 = SortList(Keys=shellvecresults_2.FirstPrincipalStressValue_kN_cm2)  # -> Keys, ValuesA
sort_11 = SortList(Keys=shellvecresults_2.SecondPrincipalStressValue_kN_cm2)  # -> Keys, ValuesA
eval_11 = Evaluate(F="if(x≥0, True, False)", x=sort_10.Keys)
eval_12 = Evaluate(F="if(x≥0, True, False)", x=sort_11.Keys)
cull_7 = CullPattern(List=sort_10.Keys, CullPattern=invert(eval_11))
cull_8 = CullPattern(List=sort_11.Keys, CullPattern=invert(eval_12))
cull_9 = CullPattern(List=sort_10.Keys, CullPattern=eval_11)
cull_10 = CullPattern(List=sort_11.Keys, CullPattern=eval_12)
rev_4 = ReverseList(List=cull_10)
rev_5 = ReverseList(List=cull_9)
multiplication_20 = Multiplication(A=rev_5, B=10)
multiplication_21 = Multiplication(A=cull_7, B=10)
multiplication_22 = Multiplication(A=rev_4, B=10)
multiplication_23 = Multiplication(A=cull_8, B=10)
eval_13 = Evaluate(F="Format(\"{0:0.####} N/mm2\", x)", x=multiplication_20)
eval_14 = Evaluate(F="Format(\"{0:0.####} N/mm2\", x)", x=multiplication_21)
eval_15 = Evaluate(F="Format(\"{0:0.####} N/mm2\", x)", x=multiplication_22)
eval_16 = Evaluate(F="Format(\"{0:0.####} N/mm2\", x)", x=multiplication_23)
min_stress_n_mm2_3 = Panel(eval_14)
max_stress_n_mm2_3 = Panel(eval_13)
max_stress_n_mm2_4 = Panel(eval_15)
min_stress_n_mm2_4 = Panel(eval_16)

# ==== cluster Cluster
A = ClusterInput()
M = ClusterInput()
medges = MeshEdges(Mesh=M)  # -> NakedEdges, InteriorEdges, NonManifoldEdges
merge = Merge(Data1=medges.NakedEdges)  # -> flatten(Result)
eval = EvaluateCurve(Curve=reparameterize(merge), Parameter=0.5)  # -> Point, Tangent, Angle
pdecon = Deconstruct(Point=eval.Point)  # -> XComponent, YComponent, ZComponent
line = Line(merge)
sort = SortList(Keys=pdecon.ZComponent, ValuesA=line)  # -> Keys, ValuesA
item = ListItem(List=sort.Keys, Index=0, Wrap=True)
line_2 = Line(sort.ValuesA)
addition = Addition(A=A, B=item)
smaller = SmallerThan(FirstNumber=sort.Keys, SecondNumber=addition)  # -> SmallerThan, OrEqualTo
cull = CullPattern(List=line_2, CullPattern=smaller.OrEqualTo)
L = ClusterOutput(cull)

# ==== cluster Vault
C = ClusterInput()
end = EndPoints(Curve=C)  # -> Start, End
merge = Merge(Data1=end.Start, Data2=end.End)
rdpoints = RemoveDuplicatePointsKaramba(Point=merge, LimitDistance=0.005)  # -> OutPoint, Info, Indexes
pdecon = Deconstruct(Point=rdpoints.OutPoint)  # -> XComponent, YComponent, ZComponent
sort = SortList(Keys=pdecon.ZComponent, ValuesA=rdpoints.OutPoint)  # -> Keys, ValuesA
expression = Expression(x=sort.Keys, Expression="Format(\"{0:0.00}\", x)")
item = ListItem(List=expression, Index=0, Wrap=True)
equals = Equality(FirstNumber=expression, SecondNumber=item)  # -> Equality, Inequality
cull = CullPattern(List=sort.ValuesA, CullPattern=equals.Equality)
L = ClusterOutput(cull)

# ==== cluster Cluster_2
A = ClusterInput()
A_2 = ClusterInput()
pt = ClusterInput()
G = ClusterInput()
pt_2 = Point(pt)
project = ProjectPoint(Point=pt_2, Direction=expr("{0,0,1}", Vector(0, 0, -1)), Geometry=G)  # -> Point, Index
dist = Distance(PointA=pt_2, PointB=project.Point)
expression = Expression(x=dist, Expression="Format(\"{0:0.00}\", x)")
reparamnums = ReparameterizeNumbers(Numbers=expression)  # -> simplify(Reparameterized), Original
num = Number(reparamnums.Reparameterized)
multiplication = Multiplication(A=A_2, B=num)
addition = Addition(A=A, B=multiplication)
R = ClusterOutput(addition)
num_2 = ClusterOutput(num)

# ==== cluster Cluster_3
A = ClusterInput()
pdecon = Deconstruct(Point=A)  # -> XComponent, YComponent, ZComponent
sort = SortList(Keys=pdecon.XComponent, ValuesA=A)  # -> Keys, ValuesA
expression = Expression(x=sort.Keys, Expression="Format(\"{0:0.00}\", x)")
cset = CreateSet(List=expression)  # -> simplify(graft(Set)), Map
equals = Equality(FirstNumber=expression, SecondNumber=cset.Set)  # -> Equality, Inequality
cull = CullPattern(List=sort.ValuesA, CullPattern=equals.Equality)
pdecon_2 = Deconstruct(Point=cull)  # -> XComponent, YComponent, ZComponent
sort_2 = SortList(Keys=pdecon_2.YComponent, ValuesA=cull)  # -> Keys, ValuesA
pt = Point(simplify(sort_2.ValuesA))
pt_2 = Point(pt)
lng = ListLength(List=pt_2)  # -> flatten(Length)
lng_2 = ListLength(List=lng)  # -> flatten(Length)
subtraction = Subtraction(A=lng_2, B=1)
concat = Concatenate(FragmentA="{", FragmentB=subtraction, FragmentC="}")
branch = TreeBranch(Tree=pt, Path=["{0}", concat], MaintainPaths=True)
B = ClusterOutput(branch)
pt_3 = ClusterOutput(pt)

# ==== cluster Vault_2
M = ClusterInput()
G = ClusterInput()
facen = FaceNormals(Mesh=M)  # -> Centers, Normals
project = ProjectPoint(Point=facen.Centers, Direction=expr("{0,0,1}", Vector(0, 0, -1)), Geometry=G)  # -> Point, Index
pt = Point(facen.Centers)
A = ClusterInput()
dist = Distance(PointA=pt, PointB=project.Point)
ln = Line(StartPoint=pt, EndPoint=project.Point)
multiplication = Multiplication(A=A, B=dist)
multiplication_2 = Multiplication(A=multiplication, B=0.01)
R = ClusterOutput(multiplication_2)

# ==== cluster Cluster_4
C = ClusterInput()
bbox = BoundingBox(Content=C, Plane=PlaneXY(0, 0, 0))  # -> Box, Box_2
debrep = DeconstructBrep(Brep=bbox.Box)  # -> Faces, Edges, Vertices
cullpt = CullDuplicates(Points=debrep.Vertices, Tolerance=0.1, CullMode=3)  # -> Points, Indices, Valence
item = ListItem(List=cullpt.Points, Index=0, Wrap=True)  # -> Item, Item1, Item2, Item3
xy = XYPlane(Origin=item.Item)
yz = YZPlane(Origin=item.Item)
P = ClusterOutput(yz)
P_2 = ClusterOutput(xy)
i = ClusterOutput(item.Item)
item_1 = ClusterOutput(item.Item1)
item_2 = ClusterOutput(item.Item2)
item_3 = ClusterOutput(item.Item3)

# ==== cluster Cluster_5
A = ClusterInput()
pdecon = Deconstruct(Point=A)  # -> XComponent, YComponent, ZComponent
sort = SortList(Keys=pdecon.ZComponent, ValuesA=A)  # -> Keys, ValuesA
expression = Expression(x=sort.Keys, Expression="Format(\"{0:0.00}\", x)")
cset = CreateSet(List=expression)  # -> simplify(graft(Set)), Map
equals = Equality(FirstNumber=expression, SecondNumber=cset.Set)  # -> Equality, Inequality
cull = CullPattern(List=sort.ValuesA, CullPattern=equals.Equality)
pdecon_2 = Deconstruct(Point=cull)  # -> XComponent, YComponent, ZComponent
sort_2 = SortList(Keys=pdecon_2.YComponent, ValuesA=cull)  # -> Keys, ValuesA
pt = Point(simplify(sort_2.ValuesA))
pt_2 = Point(pt)
lng = ListLength(List=pt_2)  # -> flatten(Length)
lng_2 = ListLength(List=lng)  # -> flatten(Length)
subtraction = Subtraction(A=lng_2, B=1)
concat = Concatenate(FragmentA="{", FragmentB=subtraction, FragmentC="}")
branch = TreeBranch(Tree=pt, Path=concat, MaintainPaths=True)
B = ClusterOutput(branch)
pt_3 = ClusterOutput(pt)

# ==== cluster Cluster_6
A = ClusterInput()
pdecon = Deconstruct(Point=A)  # -> XComponent, YComponent, ZComponent
sort = SortList(Keys=pdecon.YComponent, ValuesA=A)  # -> Keys, ValuesA
expression = Expression(x=sort.Keys, Expression="Format(\"{0:0.00}\", x)")
cset = CreateSet(List=expression)  # -> simplify(graft(Set)), Map
equals = Equality(FirstNumber=expression, SecondNumber=cset.Set)  # -> Equality, Inequality
cull = CullPattern(List=sort.ValuesA, CullPattern=equals.Equality)
pdecon_2 = Deconstruct(Point=cull)  # -> XComponent, YComponent, ZComponent
sort_2 = SortList(Keys=pdecon_2.ZComponent, ValuesA=cull)  # -> Keys, ValuesA
pt = Point(simplify(sort_2.ValuesA))
pt_2 = Point(pt)
lng = ListLength(List=pt_2)  # -> flatten(Length)
lng_2 = ListLength(List=lng)  # -> flatten(Length)
subtraction = Subtraction(A=lng_2, B=1)
concat = Concatenate(FragmentA="{", FragmentB=subtraction, FragmentC="}")
branch = TreeBranch(Tree=pt, Path=["{0}", concat], MaintainPaths=True)
B = ClusterOutput(branch)
pt_3 = ClusterOutput(pt)

# ==== cluster Cluster_7
A = ClusterInput()
pdecon = Deconstruct(Point=A)  # -> XComponent, YComponent, ZComponent
sort = SortList(Keys=pdecon.YComponent, ValuesA=A)  # -> Keys, ValuesA
expression = Expression(x=sort.Keys, Expression="Format(\"{0:0.00}\", x)")
cset = CreateSet(List=expression)  # -> simplify(graft(Set)), Map
equals = Equality(FirstNumber=expression, SecondNumber=cset.Set)  # -> Equality, Inequality
cull = CullPattern(List=sort.ValuesA, CullPattern=equals.Equality)
pdecon_2 = Deconstruct(Point=cull)  # -> XComponent, YComponent, ZComponent
sort_2 = SortList(Keys=pdecon_2.ZComponent, ValuesA=cull)  # -> Keys, ValuesA
pt = Point(simplify(sort_2.ValuesA))
pt_2 = Point(pt)
lng = ListLength(List=pt_2)  # -> flatten(Length)
lng_2 = ListLength(List=lng)  # -> flatten(Length)
subtraction = Subtraction(A=lng_2, B=1)
concat = Concatenate(FragmentA="{", FragmentB=subtraction, FragmentC="}")
branch = TreeBranch(Tree=pt, Path=concat, MaintainPaths=True)
B = ClusterOutput(branch)
pt_3 = ClusterOutput(pt)

# ==== cluster VaultButtress
P = ClusterInput()
P_2 = ClusterInput()
P_3 = ClusterInput()
cluster = Cluster_8(A=P_2)  # -> pt_3, B
cluster_2 = Cluster_8(A=P_3)  # -> pt_3, B
cluster_3 = Cluster_8(A=P)  # -> pt_3, B
branch = TreeBranch(Tree=cluster_3.B, Path="{0}", MaintainPaths=True)  # -> flatten(Branch)
branch_2 = TreeBranch(Tree=cluster_2.B, Path="{0}", MaintainPaths=True)  # -> flatten(Branch)
branch_3 = TreeBranch(Tree=cluster.B, Path="{0}", MaintainPaths=True)  # -> flatten(Branch)
B = ClusterOutput(branch)
B_2 = ClusterOutput(branch_2)
B_3 = ClusterOutput(branch_3)

# ==== cluster Cluster_9
M = ClusterInput()
medges = MeshEdges(Mesh=M)  # -> NakedEdges, InteriorEdges, NonManifoldEdges
end = EndPoints(Curve=medges.NakedEdges)  # -> Start, End
cullpt = CullDuplicates(Points=flatten([end.Start, end.End]), Tolerance=0.1, CullMode=3)  # -> Points, Indices, Valence
pdecon = Deconstruct(Point=cullpt.Points)  # -> XComponent, YComponent, ZComponent
sort = SortList(Keys=pdecon.YComponent, ValuesA=cullpt.Points)  # -> Keys, ValuesA
expression = Expression(x=sort.Keys, Expression="Format(\"{0:0.00}\", x)")
item = ListItem(List=expression, Index=0, Wrap=True)
equals = Equality(FirstNumber=expression, SecondNumber=item)  # -> Equality, Inequality
cull = CullPattern(List=sort.ValuesA, CullPattern=equals.Equality)
pdecon_2 = Deconstruct(Point=cull)  # -> XComponent, YComponent, ZComponent
num = ClusterInput()
num_2 = ClusterInput()
num_3 = ClusterInput()
sort_2 = SortList(Keys=pdecon_2.XComponent, ValuesA=cull)  # -> Keys, ValuesA
intcrv = Interpolate(Vertices=sort_2.ValuesA, Degree=3, Periodic=False, KnotStyle=1)  # -> Curve, Length, Domain
num_4 = Number(num_2)
num_5 = Number(num_3)
num_6 = Number(num)
end_2 = EndPoints(Curve=intcrv.Curve)  # -> Start, End
move2pt = Move2Pt(Geometry=intcrv.Curve, PointA=end_2.End, PointB=end_2.Start)  # -> simplify(graft(Moved)), Vector, Transform
move2pt_2 = Move2Pt(Geometry=intcrv.Curve, PointA=end_2.Start, PointB=end_2.End)  # -> simplify(graft(Moved)), Vector, Transform
clscrv = CloseCurve(Curve=move2pt.Moved, CloseType=0, Bulge=0.5, Tolerance=0)  # -> Closed, R
clscrv_2 = CloseCurve(Curve=intcrv.Curve, CloseType=0, Bulge=0.5, Tolerance=0)  # -> Closed, R
clscrv_3 = CloseCurve(Curve=move2pt_2.Moved, CloseType=0, Bulge=0.5, Tolerance=0)  # -> Closed, R
area = Area(Geometry=clscrv_2.Closed)  # -> Area, Centroid
area_2 = Area(Geometry=clscrv_3.Closed)  # -> Area, Centroid
area_3 = Area(Geometry=clscrv.Closed)  # -> Area, Centroid
scale = Scale(Geometry=move2pt_2.Moved, Center=area_2.Centroid, Factor=num_6)  # -> Geometry, Transform
scale_2 = Scale(Geometry=move2pt.Moved, Center=area_3.Centroid, Factor=num_6)  # -> Geometry, Transform
scale_3 = Scale(Geometry=intcrv.Curve, Center=area.Centroid, Factor=num_6)  # -> Geometry, Transform
ext = ExtendCurve(Curve=scale_2.Geometry, Type=0, Start=expr("x*-1", num_5), End=expr("x*-1", num_5))
ext_2 = ExtendCurve(Curve=scale_3.Geometry, Type=0, Start=expr("x*-1", num_5), End=expr("x*-1", num_5))
ext_3 = ExtendCurve(Curve=scale.Geometry, Type=0, Start=expr("x*-1", num_5), End=expr("x*-1", num_5))
blendc = BlendCurve(CurveA=ext, CurveB=ext_2, BulgeA=num_4, BulgeB=num_4, Continuity=2)
blendc_2 = BlendCurve(CurveA=ext_2, CurveB=ext_3, BulgeA=num_4, BulgeB=num_4, Continuity=2)
F = ClusterInput()
join = JoinCurves(Curves=flatten([ext, blendc, ext_2, blendc_2, ext_3]), Preserve=False)
Y = UnitY(Factor=F)
extr = Extrude(Base=join, Direction=Y)
E = ClusterOutput(extr)

# ==== cluster Cluster_10
mesh = ClusterInput()
mesh_2 = Mesh(mesh)
medges = MeshEdges(Mesh=mesh_2)  # -> NakedEdges, InteriorEdges, NonManifoldEdges
demesh = DeconstructMesh(Mesh=mesh_2)  # -> Vertices, Faces, Colours, Normals
merge = Merge(Data1=medges.NakedEdges, Data2=medges.InteriorEdges, Data3=medges.NonManifoldEdges)  # -> flatten(Result)
cluster = Cluster_3(A=demesh.Vertices)  # -> flatten(pt_3), B
A = ClusterInput()
A_2 = ClusterInput()
G = ClusterInput()
supports = Point(flatten(cluster.B))
edges = Line(merge)
points = Point(cluster.pt_3)
mesh_3 = Mesh(mesh_2)
pt = Point(flatten(points))
cluster_2 = Cluster_2(A=A, A_2=A_2, pt=pt, G=G)  # -> num_2, R
pt_2 = Point(supports)
line = Line(edges)
strength = ClusterInput()
Z = UnitZ(Factor=cluster_2.R)
anchor = Anchor(Point=pt_2, Strength=1e+12)
length_line = LengthLine(Line=line, Strength=strength)
load = Load(Point=pt, ForceVector=Z)
show = Show(G=mesh_3)
data = Data([show, length_line, anchor, load])
data_2 = ClusterOutput(data)

# ==== cluster Cluster_11
data = ClusterInput()
data_2 = Data(data)
mesh = Mesh(data_2)
null = NullItem(Item=mesh)  # -> NullFlags, InvalidFlags, Description
cull = CullPattern(List=mesh, CullPattern=invert(null.NullFlags))
L = ClusterOutput(cull)

# ==== cluster Cluster_12
M = ClusterInput()
mjoin = MeshJoin(Meshes=M)
demesh = DeconstructMesh(Mesh=mjoin)  # -> Vertices, Faces, Colours, Normals
pdecon = Deconstruct(Point=demesh.Vertices)  # -> XComponent, YComponent, ZComponent
sort = SortList(Keys=pdecon.XComponent, ValuesA=demesh.Vertices)  # -> Keys, ValuesA
B = ClusterInput()
equals = Equality(FirstNumber=sort.Keys, SecondNumber=B)  # -> Equality, Inequality
cull = CullPattern(List=sort.ValuesA, CullPattern=equals.Equality)
L = ClusterOutput(cull)

# ==== cluster Cluster_13
L = ClusterInput()
i = ClusterInput()
A = ClusterInput()
G = ClusterInput()
xy = XYPlane(Origin=Point(0, 0, 0))
item = ListItem(List=L, Index=i, Wrap=True)
multiplication = Multiplication(A=A, B=-1)
F = ClusterInput()
gate = StreamGate(Stream=multiplication, Gate=G)  # -> Target0, Target1
project = Project(Geometry=item, Plane=xy)  # -> Geometry, Transform
X = UnitX(Factor=graft([gate.Target1, F]))
ln = Line(StartPoint=item, EndPoint=project.Geometry)
extr = Extrude(Base=ln, Direction=X)  # -> flatten(Extrusion)
join = BrepJoin(Breps=extr)  # -> Breps, Closed
B = ClusterOutput(join.Breps)

# ==== cluster Cluster_8
A = ClusterInput()
pdecon = Deconstruct(Point=A)  # -> XComponent, YComponent, ZComponent
sort = SortList(Keys=pdecon.ZComponent, ValuesA=A)  # -> Keys, ValuesA
expression = Expression(x=sort.Keys, Expression="Format(\"{0:0.00}\", x)")
cset = CreateSet(List=expression)  # -> simplify(graft(Set)), Map
equals = Equality(FirstNumber=expression, SecondNumber=cset.Set)  # -> Equality, Inequality
cull = CullPattern(List=sort.ValuesA, CullPattern=equals.Equality)
pdecon_2 = Deconstruct(Point=cull)  # -> XComponent, YComponent, ZComponent
sort_2 = SortList(Keys=pdecon_2.YComponent, ValuesA=cull)  # -> Keys, ValuesA
pt = Point(simplify(sort_2.ValuesA))
pt_2 = Point(pt)
lng = ListLength(List=pt_2)  # -> flatten(Length)
lng_2 = ListLength(List=lng)  # -> flatten(Length)
subtraction = Subtraction(A=lng_2, B=1)
concat = Concatenate(FragmentA="{", FragmentB=subtraction, FragmentC="}")
branch = TreeBranch(Tree=pt, Path=["{0}", concat], MaintainPaths=True)
B = ClusterOutput(branch)
pt_3 = ClusterOutput(pt)
