# Grasshopper definition BrickVault.gh (Grasshopper 1.0.7)

# ----
# This script places bricks on a
# vaulted surface in stretcher bond
number_slider = Slider(0.01, range=0..0.01)
srf = Surface(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)
python = GhPythonScript(
    srf=srf,
    brk_ht="0.057",
    brk_len="0.203",
    brk_width="0.092",
    y_spacing=number_slider,
    x_spacing=Slider(0.01, range=0..0.01))  # -> out, brick_out, curves; inputs srf: Surface
# ---------- python: Python ----------
"""Provides a scripting component.
    Inputs:
        srf: Surface of vault
        brk_ht: Height of brick
        brk_len: Length of brick
        brk_width: Width of brick
        x_spacing: Horizontal space between bricks
        y_spacing: Vertical space between bricks
    Output:
        brick_out: brick BRep output
        curves: Isocurves at brick rows"""

__author__ = "erron estrado"
__version__ = "2018.10.02"

import rhinoscriptsyntax as rs
import Rhino.Geometry as rg
import Rhino.Collections as rc
import math
from copy import copy

def CreateBrick(length, width, height):
    lenInterval = rg.Interval(0, length)
    widthInterval = rg.Interval(0, width)
    heightInterval = rg.Interval(0, height)
    
    box = rg.Box(rg.Plane.WorldXY, lenInterval, widthInterval, heightInterval)
    brk = box.ToBrep()
    return brk

brick = CreateBrick(brk_len, brk_width, brk_ht)

#set domain equal to length
workSrf = srf
testCrv = workSrf.IsoCurve(1, 0.5)
len = testCrv.GetLength()
workSrf.SetDomain(0, rg.Interval(0,len))

#Create curves for placement of bricks
max = workSrf.Domain(0).Max
i = brk_ht/2
isoCrvs = []

while(i < max):
    crv = workSrf.IsoCurve(0, i)
    isoCrvs.append(crv)
    i += brk_ht + y_spacing

# Get center point on brick
b_vol = rg.VolumeMassProperties.Compute(brick)
brick_center = b_vol.Centroid

# Create half brick(half_brk) and full brick(brk)
scale_x = (0.5 * brk_len) / (brk_len + x_spacing)
scale = rg.Transform.Scale(rg.Plane.WorldXY, scale_x, 1, 1)
half_brk = copy(brick)
half_brk.Transform(scale)
brk = brick

# Initialise lists and extension variable
points = []
bricks = []
ext = 0
brk_len += x_spacing

# Start placement loops
for crv in isoCrvs:
    # if curve is shorter than brick length then skip
    if crv.GetLength() <= brk_len:
        continue
    
    # if ext == 1 extend curve by halfbrick length and set first brick to half_brk
    # to create offset pattern and set ext back to 0
    # else set ext = 1 for next iteration
    if ext == 1:
        crv = crv.Extend(rg.CurveEnd.Start, brk_len/2, rg.CurveExtensionStyle.Line)
        crv = crv.Extend(rg.CurveEnd.End, brk_len/2, rg.CurveExtensionStyle.Line)
        brk = half_brk
        ext = 0
    else:
        ext = 1
    
    # divide curve by brick length
    t = crv.DivideByLength(brk_len, True)
   
    # rotate and move brick into position
    # set brk back to full brick for remainder of points on curve
    for i, item in enumerate(t):
        dest_pt = crv.PointAt(item)
        dir = dest_pt - brick_center
        if i == t.Count - 1 and ext == 0:
            new_brick = copy(half_brk)
            new_brick.Translate(brk_len/2, 0, 0)
        else:
            new_brick = copy(brk)
        # find surface normal at destination point
        pt = workSrf.ClosestPoint(dest_pt)
        norm = workSrf.NormalAt(pt[1], pt[2])
        norm.Reverse()
        # rotate brick to surface normal
        angle = rg.Vector3d.VectorAngle(rg.Vector3d.YAxis, norm, rg.Plane.WorldYZ)
        new_brick.Rotate(angle, rg.Vector3d.XAxis, brick_center)
        # move brick to destination
        new_brick.Translate(dir)
        #add to list
        bricks.append(new_brick)
        brk = brick


brick_out = bricks
curves = isoCrvs
# ---------- end python ----------
preview = CustomPreview(Geometry=python.brick_out, Material=ColourSwatch(SwatchColor=RGB(186, 186, 186)))
crv = Curve(python.curves)

# ----
# This give parameters
# for construction
number_slider_2 = Slider(0.03, range=0..1)
python_2 = GhPythonScript(isoCrvs=crv)  # -> out, line1, line2, length1, length2, points; inputs isoCrvs: list of Curve
# ---------- python_2: Python ----------
"""Provides a scripting component.
    Inputs:
        isoCrvs: Isocurves from surface
    Output:
        line1: Hypotenuse
        line2: Vertical
        length1: Length of hypotenuse
        length2: Length of vertical
        points: Point at row"""

__author__ = "erron"
__version__ = "2018.10.18"

import rhinoscriptsyntax as rs
import Rhino.Geometry as rg
import Rhino.Collections as rc
from copy import copy
import math

# initialise variables and lists
workingCrvs = isoCrvs
endPts = []
lines1 = []
lines2 = []
distances1 = []
distances2 = []
nums = []
plinePts = []

# get list of end points
for crv in isoCrvs:
    endPts.append(crv.PointAtStart)

# get arch base point
pt1 = endPts[0]
pt2 = endPts[endPts.Count-1]
basePt = (pt1 + pt2)/2

# determine range depending if even or odd number of curves
if endPts.Count%2 == 0:
    ptRange = int(endPts.Count/2)
else:
    ptRange = int(endPts.Count/2) + 1

# get distances
for i in range(0, ptRange):
    # length 1
    lines1.append(rg.LineCurve(basePt, endPts[i]))
    dist1 = basePt.DistanceTo(endPts[i])
    dist1 = float("{0:.3f}".format(dist1))
    distances1.append(dist1)
    
    # length 2
    vertPt = copy(endPts[i])
    vertPt.Z = basePt.Z
    lines2.append(rg.LineCurve(endPts[i], vertPt))
    dist2 = vertPt.DistanceTo(endPts[i])
    dist2 = float("{0:.3f}".format(dist2))
    distances2.append(dist2)

# return half the points
sliceObj = slice(ptRange)
Pts = endPts[sliceObj]

# outputs
line1 = lines1
line2 = lines2
length1 = distances1
length2 = distances2
points = Pts
# ---------- end python_2 ----------
hypotenuse = Line(python_2.line1)
points = PointList(Points=python_2.points, Size=number_slider_2)
vertical = Line(python_2.line2)

# ---- group: Visualize
dash = DashPattern(Curve=vertical, Pattern=[Slider(0.04, range=0..1), Slider(0.02, range=0..1)])  # -> Dashes, Gaps
preview_2 = CustomPreview(Geometry=hypotenuse, Material=ColourSwatch(SwatchColor=RGB(255, 0, 0)))
preview_3 = CustomPreview(Geometry=dash.Dashes, Material=ColourSwatch(SwatchColor=RGB(0, 119, 255)))

# ----
hypotenuse_2 = Panel(python_2.length1)
vertical_2 = Panel(python_2.length2)
