# Grasshopper definition VoxeliseTheMesh.gh (Grasshopper 1.0.7)

# ---- group: Layer
show_layer = Slider(47, range=1..100)

# ---- group: Join and weld mesh
# Note: brick size is 2*x and 4*y
mesh_input_here = Mesh([<mesh referenced from the Rhino model> x2])
mjoin = MeshJoin(Meshes=mesh_input_here)
weld = WeldMesh(Mesh=mjoin, Angle=3.141592654)

# ---- group: Voxel resolution
number_slider = Slider(0.05, range=0..1)
number_slider_2 = Slider(0.05, range=0..1)
number_slider_3 = Slider(0.06, range=0..1)

# ---- group: Make Grid
bbox = BoundingBox(Content=weld, Plane=PlaneXY(0, 0, 0), UnionBox=True)  # -> Box, Box_2
box_corners = BoxCorners(Box=bbox.Box)  # -> CornerA, CornerB, CornerC, CornerD, CornerE, CornerF, CornerG, CornerH
vec = VectorXYZ(XComponent=expr("x*-2", number_slider), YComponent=expr("x*-2", number_slider_2), ZComponent=0)  # -> Vector, Length
move = Move(Geometry=box_corners.CornerA, Motion=vec.Vector)  # -> Geometry, Transform
number_slider_4 = Slider(74, range=0..100)
number_slider_5 = Slider(36, range=0..100)
recgrid = Rectangular(Plane=move.Geometry, SizeX=number_slider, SizeY=number_slider_2, ExtentX=number_slider_4, ExtentY=number_slider_5)  # -> Cells, Points
preview = CustomPreview(Geometry=recgrid.Cells, Material=ColourSwatch(SwatchColor=RGB(255, 255, 255)))

# ---- group: Voxelise
python = GhPythonScript(Mesh=weld, x=number_slider, y=number_slider_2, z=number_slider_3, tol=Slider(0.1, range=0..1))  # -> out, voxels; inputs Mesh: Mesh
# ---------- python: Python ----------
"""Provides a scripting component.
    Inputs:
        x: Voxel resolution in x
        y: Voxel resolution in y
        z: Voxel resolution in z
        tol: Tolerance distance to mesh
    Output:
        voxels: Voxel output"""

__author__ = "erron estrado"
__version__ = "2018.10.19"

import rhinoscriptsyntax as rs
import Rhino.Geometry as rg
import Grasshopper as gh
import math
from copy import copy


def MakeBrick(orPt, xSize, ySize, zSize):
    plane = rg.Plane(orPt, rg.Vector3d.ZAxis)
    X = rg.Interval(0, xSize)
    Y = rg.Interval(0, ySize)
    Z = rg.Interval(0, zSize)
    brk = rg.Box(plane, X, Y, Z)
    return brk

def TestCloseness(testPt, testMesh, tolerance):
    meshPt = testMesh.ClosestPoint(testPt)
    dist = testPt.DistanceTo(meshPt)
    if dist <= tolerance:
        return True
    else:
        return False

def Voxelise(mesh, xRes, yRes, zRes, iTol):
    # Make bounding box to voxelise and get start position
    box = mesh.GetBoundingBox(False)
    startPt = box.Min
    
    # initialise lists and variables
    layer = 0
    bricks = []
    pt = copy(startPt)
    
    # initialise data tree
    brickTree = gh.DataTree[rg.Box]()
    
    # Z direction
    while box.Contains(pt) :
        
        # Y direction
        while box.Contains(pt): 
        
            # X direction
            while box.Contains(pt): 
                # if too far skip
                isClose = TestCloseness(pt, mesh, iTol)
                if isClose == False:
                    pt.X += xRes
                    continue
                #if even numbered layer make brick horizontal if odd vertical brick
                if layer%2 == 0:
                    b = MakeBrick(pt, 4*xRes, 2*yRes, zRes)
                    bricks.append(b)
                    pt.X += 4*xRes
                else:
                    b = MakeBrick(pt, 2*xRes, 4*yRes, zRes)
                    bricks.append(b)
                    pt.X += 2*xRes
            # reset x position and advance in y
            pt.X = startPt.X
            if layer%2 == 0:
                pt.Y += 2*yRes
                #pt.X += xRes
            else:
                pt.Y += 4*yRes
                #pt.X += xRes
        # add layer to new branch of data tree and clear list
        for v in bricks:
            brickTree.Add(v,gh.Kernel.Data.GH_Path(layer))
        bricks.Clear()
        
        # reset y position and advance in z
        if layer%2 == 0:
                pt.Y = startPt.Y + yRes
        else:
            pt.Y = startPt.Y
        #pt.Y = startPt.Y
        layer += 1
        pt.Z += zRes
    return brickTree


wrkingMesh = Mesh
brk = Voxelise(wrkingMesh, x, y, z, tol)

voxels = brk
# ---------- end python ----------
lng = ListLength(List=flatten(python.voxels))
brep = Brep(python.voxels)
no_of_bricks = Panel(lng)
preview_2 = CustomPreview(Geometry=brep, Material=ColourSwatch(SwatchColor=RGB(222, 222, 222)))

# ----
# Make voxel grid for construction
number_slider_6 = Slider(0.025, range=0..1)
flip = FlipMatrix(Data=recgrid.Cells)

# ---- group: View layer
only_show_the_selected_layer = BooleanToggle(True)
subtraction = Subtraction(A=show_layer, B=1)
ghpython_script = GhPythonScript(allBricks=python.voxels, onlyLayer=only_show_the_selected_layer, layerNum=subtraction)  # -> out, out_bricks, out_count_layers, out_prev_layer; inputs allBricks: tree, layerNum: Int32
# ---------- ghpython_script: Python ----------
"""Voxelize a mesh and gernate bricks based on these voxels
    Inputs:
        allBricks (list of boxes): All the bricks generated by the previous script
        onlyLayer (bool): Boolean when true only one layer will be showed, otherwise all bricks will be showed
        layerNum (int): Number of the layer to show
    Output:
        out_bricks (list of boxes): The bricks to be shown, either all of them or only the selected layer
        out_count_layers (int): The total amount of layers in the structure
        out_prev_layer (list of rectangles): The contours of the layer below the selected layer, it is empty if all bricks need to be shown"""

__author__ = "Jeroen de Bruijn (edited by Erron Estrado)"
__version__ = "2018.10.27"

# Import library
import Rhino.Geometry as rg
import Grasshopper as gh
import clr
clr.AddReference("Grasshopper")

def ghDataTreeToPythonList(dataTree):
    
    """ Converts a GH datatree to a nested Python list """
    
    # Create an empty Python list
    pyList = []
    
    # Add the branches of the Gh datatree to this list
    for i in range(dataTree.BranchCount):
        branch = list(dataTree.Branch(i))
        pyList.append(branch)
        
    return pyList

brickList = ghDataTreeToPythonList(allBricks)

# Variable for amount of layers
layer_count = len(brickList)-1

# Check if only the selected layer needs to be showed
if onlyLayer:
    # Check if layer input is not to big
    if layerNum > layer_count:
        layerNum = layer_count
    # Only output the selected layer
    out_bricks = brickList[layerNum]
    
    # Check if the layer number is 1 or bigger
    if layerNum >= 1:
        # Get the bricks on the layer below
        brks_below = brickList[layerNum-1]
        # Empty list to hold the countours of the bricks below
        rectangles_below = []
        # Loop trough each brick on the level below
        for brk in brks_below:
            # Get the corner points
            corners = brk.GetCorners()
            # Draw rectangle
            rectangles_below.append( rg.Rectangle3d( rg.Plane(corners[5], corners[6], corners[7]) ,corners[5], corners[7]) )
        
        # Output all countours of the bricks on the layer below
        out_prev_layer = rectangles_below
else:
    # Import library to create grasshopper tree
    import ghpythonlib.treehelpers as th
    # Output all the bricks
    out_bricks = th.list_to_tree(brickList)

# Output total amount of layers
out_count_layers = layer_count
# ---------- end ghpython_script ----------
geo = Geometry(ghpython_script.out_prev_layer)
geo_2 = Geometry(ghpython_script.out_bricks)
preview_3 = CustomPreview(Geometry=geo, Material=ColourSwatch(SwatchColor=RGB(123, 0, 255)))
preview_4 = CustomPreview(Geometry=geo_2, Material=ColourSwatch(SwatchColor=RGB(209, 192, 0)))

# ---- group: Show layer number
md_slider = MDSlider(
    SliderMode=0,
    slider_value=Point(0.267805146, 0.9021948838, 0.5),
    x_domain=Domain(-1, 1),
    y_domain=Domain(-1, 1),
    z_domain=Domain(0, 1))
expression = Expression(x=show_layer, y=ghpython_script.out_count_layers, Expression="if(x>y, \"END\", x)")
move_2 = Move(Geometry=box_corners.CornerA, Motion=md_slider)  # -> Geometry, Transform
tag = TextTag3D(Location=move_2.Geometry, Text=expression, Size=Slider(0.5, range=0..1), Justification=6)

# ---- group: Numbering in Y
item = ListItem(List=flip, Index=0, Wrap=True)  # -> Item1, Item
area = Area(Geometry=item.Item)  # -> Area, Centroid
area_2 = Area(Geometry=item.Item1)  # -> Area, Centroid
X = UnitX(Factor=Slider(-0.061, range=-1..0))
rev = Reverse(Vector=X)
move_3 = Move(Geometry=area.Centroid, Motion=X)  # -> Geometry, Transform
move_4 = Move(Geometry=area_2.Centroid, Motion=rev)  # -> Geometry, Transform
flatten = FlattenTree(Tree=move_3.Geometry, Path="{0}")
series = Series(Start=0, Step=1, Count=number_slider_5)
flatten_2 = FlattenTree(Tree=move_4.Geometry, Path="1")
tag_2 = TextTag3D(Location=[flatten_2, flatten], Text=series, Size=number_slider_6, Justification=5)

# ---- group: Numbering in X
item_2 = ListItem(List=recgrid.Cells, Index=0, Wrap=True)  # -> Item1, Item
area_3 = Area(Geometry=item_2.Item)  # -> Area, Centroid
area_4 = Area(Geometry=item_2.Item1)  # -> Area, Centroid
Y = UnitY(Factor=Slider(-0.061, range=-1..0))
rev_2 = Reverse(Vector=Y)
move_5 = Move(Geometry=area_3.Centroid, Motion=Y)  # -> Geometry, Transform
move_6 = Move(Geometry=area_4.Centroid, Motion=rev_2)  # -> Geometry, Transform
flatten_3 = FlattenTree(Tree=move_5.Geometry, Path="{0}")
series_2 = Series(Start=0, Step=1, Count=number_slider_4)
flatten_4 = FlattenTree(Tree=move_6.Geometry, Path="1")
tag_3 = TextTag3D(Location=[flatten_4, flatten_3], Text=series_2, Size=number_slider_6, Justification=5)
