# Grasshopper definition Bubble_diagram.gh (Grasshopper 1.0.7)

# ----
# DO NOT EDIT
# Room: Carpentry Workshop
# Construction hall
# Open space (Building area)
# Dry Laboratories (Electric/Plumbing)
# Storage space (Tools and machines)
# Weaving hall + Storage
# Art and craft workshop
# Tailoring Workshop
# Open Space (Courtyard)
# Computer Training Rooms
# Audio Visual rooms
# Lang room
# Open space (Reading)
# Administrative office
# Semi shaded waiting area
# Trainers office / Staff rooms
# Kitchnette
column_0 = Panel("""1
1
0.5
1
0
-1
-1
-1
0
0.5
0
0.25
0
0
0.25
0.5""")
# DO NOT EDIT
column_1 = Panel("""1
0.75
1
0
-1
-1
-1
0
0.5
0
0.25
0
0
0.25
0.5""")
column_2 = Panel("""1
1

1
1
0
-1
-1
-1
0
0.5
0
0
0
0
0.25
0.5""")
column_3 = Panel("""0.5
0.75
0.5

1
0
0
0
-1
0
0.5
0
0.25
0
0
0.25
0.5""")
column_4 = Panel("""1
1
1
0.75

0
0
0
0
0
0
0
0
0
0
0
0""")
column_5 = Panel("""0
0
0
0
0

1
0.5
0.75
0
0.5
0
0.25
0
0
0.25
0.5""")
column_6 = Panel("""-1
-1
-1
0
0
0.50

1
0.75
0
0.5
0
0.25
0
0
0.25
0.5""")
column_7 = Panel("""-1
-1
-1
0
0
0.5
0.5

0.75
0
0.5
0
0.25
0
0
0.25
0.5""")
column_8 = Panel("""-1
-1
-1
-1
0
0.75
0.75
0.75

0
0.25
0.25
0
0
0
0
0""")
column_9 = Panel("""0
0
0
0
0
0
0
0
0.25

0
0
0.5
0
0
0.25
0.5""")
column_10 = Panel("""0.5
0.5
0.5
0.5
0
0.5
0.5
0.5
0.25
0

0.75
0.5
0.5
0
0.25
0.25""")
column_11 = Panel("""0
0
0
0
0
0
0
0
0.25
0
0.75

1
0
0
0.25
0.5""")
column_12 = Panel("""0.25
0.25
0
0.25
0
0.25
0.25
0.25
0
0.5
0.5
1

0
0
0.25
0""")
column_13 = Panel("""0
0
0
0
0
0
0
0
0
0
0.5
0
0.25

1
0.5
0.5""")
point = Point(Point(-36.00493987, 236.2601367, 0))
point_2 = Point(Point(-212.4954793, 356.2390095, 0))
point_3 = Point(Point(-170.6124737, 261.6497587, 0))
point_4 = Point(Point(-75.94416228, 323.829049, 0))
point_5 = Point(Point(-259.0311333, -13.01168628, 0))
point_6 = Point(Point(-396.8416985, 61.895697, 0))
point_7 = Point(Point(-239.1124494, -143.2518493, 0))
point_8 = Point(Point(-376.4394978, -87.99728277, 0))
point_9 = Point(Point(68.654321, -12.88851395, 0))
point_10 = Point(Point(33.74894089, 108.0713095, 0))
point_11 = Point(Point(139.3400854, 78.32606033, 0))
point_12 = Point(Point(79.9669987, 182.6529709, 0))
point_13 = Point(Point(-129.0640952, -198.3860607, 0))
point_14 = Point(Point(-0.4522633249, -79.88289526, 0))
point_15 = Point(Point(-182.7022676, -84.13221078, 0))
# TO DO:
point_16 = Point(Point(-249.6270797, 196.7151459, 0))
point_17 = Point(Point(-61.239239, -49.67220531, 0))
column_14 = Panel("""0
0
0
0
0
0
0
0
0
0
0
0
0
1

0
0.25""")
# - Get data from Google Drive sheet, so no need to input everything with panels
# - The points are now just internalized points from Rhino, improve this
number = Panel("""C1
C2
C3
C4
C5
A1
A2
A3
A4
E1
E2
E3
E4
O1
O2
O3
O4""")
column_15 = Panel("""0.25
0.25
0.25
0.25
0
0.25
0.25
0.25
0
0.25
0.25
0.25
0.25
0.5
0

0.5""")
column_15_2 = Panel("""0.5
0.5
0.5
0.5
0
0.5
0.5
0.5
0
0.5
0.25
0.5
0
0.5
0.25
0.5""")
merge = Merge(
    Data1=point_16,
    Data2=point,
    Data3=point_2,
    Data4=point_3,
    Data5=point_4,
    Data6=point_5,
    Data7=point_6,
    Data8=point_7,
    Data9=point_8,
    Data10=point_9,
    Data11=point_10,
    Data12=point_11,
    Data13=point_12,
    Data14=point_13,
    Data15=point_14,
    Data16=point_15,
    Data17=point_17)
unit_z = UnitZ(Factor="11")
ghpython_script = GhPythonScript(
    points=merge,
    rooms=number,
    c0=column_0,
    c1=column_1,
    c2=column_2,
    c3=column_3,
    c4=column_4,
    c5=column_5,
    c6=column_6,
    c7=column_7,
    c8=column_8,
    c9=column_9,
    c10=column_10,
    c11=column_11,
    c12=column_12,
    c13=column_13,
    c14=column_14,
    c15=column_15,
    c16=column_15_2)  # -> out, connection_100, connection_75, connection_50, connection_25, connection_0, connection_no; inputs points: list of Point3d, rooms: list, c0: list, c1: list, c2: list, c3: list, c4: list, c5: list, c6: list, c7: list, c8: list, c9: list, c10: list, c11: list, c12: list, c13: list, c14: list, c15: list, c16: list
# ---------- ghpython_script: Python ----------
__author__ = "Laptop"
__version__ = "2018.09.13"

import rhinoscriptsyntax as rs
import Rhino.Geometry as rg

#print points
#print rooms
#print c1
#print c2

connection_100 = []
connection_75 = []
connection_50 = []
connection_25 = []
connection_0 = []
connection_no = []

all_columns = []
all_columns.append(c0)
all_columns.append(c1)
all_columns.append(c2)
all_columns.append(c3)
all_columns.append(c4)
all_columns.append(c5)
all_columns.append(c6)
all_columns.append(c7)
all_columns.append(c8)
all_columns.append(c9)
all_columns.append(c10)
all_columns.append(c11)
all_columns.append(c12)
all_columns.append(c13)
all_columns.append(c14)
all_columns.append(c15)
all_columns.append(c16)

# Loop trough each point
for i, pnt in enumerate(points):
    # Loop trough the column number equal to the point number
    for j, val in enumerate(all_columns[i]):
        # Check if val is not empty
        if val == "":
            continue
        else:
            # Prevent error
            if float(val) > 0.1:
                if float(val) == 1.0:
                    connection_100.append( rg.Line(pnt, points[j]) )
                elif float(val) == 0.75:
                    connection_75.append( rg.Line(pnt, points[j]) )
                elif float(val) == 0.5:
                    connection_50.append( rg.Line(pnt, points[j]) )
                elif float(val) == 0.25:
                    connection_25.append( rg.Line(pnt, points[j]) )
# ---------- end ghpython_script ----------
move = Move(Geometry=merge, Motion=unit_z)  # -> Geometry, Transform
m2 = Panel("""60
40
60
30
15
45
70
30
1
20
30
30
1
20
10
12
6""")
circle = Circle(Plane=move.Geometry, Radius=m2)
extrude = Extrude(Base=circle, Direction=expr("x*-1", unit_z))
cap_holes = CapHoles(Brep=extrude)
split_list = SplitList(List=cap_holes, Index="5")  # -> ListA, ListB
pipe = Pipe(Curve=ghpython_script.connection_100, Radius="4", Caps=0)
split_list_2 = SplitList(List=split_list.ListB, Index="4")  # -> ListA, ListB
pipe_2 = Pipe(Curve=ghpython_script.connection_75, Radius="3", Caps=0)
pipe_3 = Pipe(Curve=ghpython_script.connection_50, Radius="2", Caps=0)
pipe_4 = Pipe(Curve=ghpython_script.connection_25, Radius="1", Caps=0)
split_list_3 = SplitList(List=split_list_2.ListB, Index="4")  # -> ListA, ListB
entwine = Entwine(
    Branch00=split_list.ListA,
    Branch01=split_list_2.ListA,
    Branch02=split_list_3.ListA,
    Branch03=split_list_3.ListB,
    FlattenInputs=True)

# ----
# Feel free to
# edit colours
# and size of text
colour_swatch = ColourSwatch(SwatchColor=RGB(255, 0, 0))

# ----
# DO NOT EDIT
merge_2 = Merge(
    Data1=colour_swatch,
    Data2=ColourSwatch(SwatchColor=RGB(8, 255, 0)),
    Data3=ColourSwatch(SwatchColor=RGB(0, 98, 255)),
    Data4=ColourSwatch(SwatchColor=RGB(255, 0, 251)))  # -> graft(Result)
mesh_colours = MeshColours(Mesh=pipe, Colours=ColourSwatch(SwatchColor=RGB(0, 0, 0)))
mesh_colours_2 = MeshColours(Mesh=pipe_2, Colours=ColourSwatch(SwatchColor=RGBA(0, 0, 0, 114)))
mesh_colours_3 = MeshColours(Mesh=pipe_3, Colours=ColourSwatch(SwatchColor=RGBA(0, 0, 0, 66)))
mesh_colours_4 = MeshColours(Mesh=pipe_4, Colours=ColourSwatch(SwatchColor=RGBA(0, 0, 85, 50)))
mesh_colours_5 = MeshColours(Mesh=entwine, Colours=merge_2)
text_tag_3d = TextTag3D(
    Location=move.Geometry,
    Text=number,
    Size=Slider(22, range=0..100),
    Colour=ColourSwatch(SwatchColor=RGB(0, 0, 0)),
    Justification=5)
