# Grasshopper definition site_location_paramater_1.gh (Grasshopper 1.0.7)
# plug-ins: GH_CPython, ElkGHComponents

# ---- group: INPUT: fill in population per district
population_per_district = Panel("""6686
7666
5082
4605
5761
7232
7254
8164
4908
6522
8507
5699""")

# ---- group: INPUT: put here your OSM file path
file_path = FilePath("C:\Al_Zataari_Map.osm")

# ----
location = Location(FilePathText=file_path)  # -> OSMPointData, OSMFile, LongitudeDomain, LatitudeDomain

# ---- group: right click data type you need
osm_data = OSMData(
    OSMPointData=location.OSMPointData,
    OSMFilePath=location.OSMFile,
    Feature="place",
    Generate3d=False,
    IndividualOutputs=False)  # -> Ways, Buildings

# ---- group: Internalized output of districts (choose "place" in the OSM Data component)
polyline = PolyLine(
    Vertices=Tree({0;0}: [Point(1695944.071, 1538882.187, 0)], {1;0}: [Point(1110955.88, 2145717.38, 0), Point(1089045.26, 2150142.938, 0), Point(566433.2504, 2229903.059, 0), Point(596747.172, 2280941.53, 0), Point(633133.2777, 2346969.078, 0), Point(670487.5489, 2415342.838, 0), Point(745995.0629, 2535900.378, 0), Point(791545.8425, 2570126.176, 0), Point(851703.7025, 2593410.394, 0), Point(891849.6744, 2601927.925, 0), Point(1078818.423, 2641546.677, 0), Point(1272019.151, 2567735.485, 0), Point(1239618.503, 2481937.48, 0), Point(1167165.881, 2292550.281, 0), Point(1110955.88, 2145717.38, 0)], {2;0}: [Point(2049305.701, 1231650.605, 0), Point(1865297.846, 766166.4031, 0), Point(1780569.26, 551804.8235, 0), Point(1753225.633, 485199.0624, 0), Point(1499218.469, 583150.6733, 0), Point(1256208.913, 674875.3683, 0), Point(1509548.701, 1361092.619, 0), Point(1536911.128, 1428632.418, 0), Point(2049305.701, 1231650.605, 0)], {3;0}: [Point(1536911.128, 1428632.418, 0), Point(1509548.701, 1361092.619, 0), Point(1256208.913, 674875.3683, 0), Point(1119979.559, 725980.5566, 0), Point(1034470.801, 758671.865, 0), Point(848216.4266, 825833.6007, 0), Point(841580.2627, 831526.7809, 0), Point(835498.679, 836741.823, 0), Point(828900.1137, 842401.6448, 0), Point(802844.2406, 864729.586, 0), Point(802703.2456, 864762.9445, 0), Point(797025.8476, 868487.9746, 0), Point(682678.9152, 1026874.028, 0), Point(867795.9301, 1508247.985, 0), Point(887836.0172, 1564190.153, 0), Point(926797.6312, 1663120.279, 0), Point(1536911.128, 1428632.418, 0)], {4;0}: [Point(954959.0295, 1736942.591, 0), Point(946875.317, 1712401.87, 0), Point(939223.9892, 1692464.62, 0), Point(887836.0172, 1564190.153, 0), Point(867795.9301, 1508247.985, 0), Point(682678.9152, 1026874.028, 0), Point(640841.0035, 1080247.593, 0), Point(591408.162, 1138068.955, 0), Point(492561.2782, 1262673.99, 0), Point(411968.5451, 1355810.86, 0), Point(336160.2418, 1456753.614, 0), Point(308290.2333, 1507447.382, 0), Point(296296.2599, 1575109.494, 0), Point(301973.658, 1645440.286, 0), Point(328461.9157, 1790371.753, 0), Point(954959.0295, 1736942.591, 0)], {5;0}: [Point(954959.0295, 1736942.591, 0), Point(328461.9157, 1790371.753, 0), Point(342561.4141, 1821917.754, 0), Point(363973.8524, 1870176.352, 0), Point(393150.4145, 1922760.433, 0), Point(419112.291, 1966448.919, 0), Point(467229.1794, 2055727.326, 0), Point(501895.1462, 2110624.261, 0), Point(566433.2504, 2229903.059, 0), Point(1088913.664, 2149386.813, 0), Point(1110955.88, 2145717.38, 0), Point(954959.0295, 1736942.591, 0)]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),
    Closed=False)
curve = Curve(polyline)

# ---- group: OUTPUT
polyline_2 = PolyLine(Vertices=osm_data.Ways, Closed=False)

# ---- group: Get boundary of whole camp (not needed anymore)
boundary_surfaces = BoundarySurfaces(Edges=curve)  # -> flatten(Surfaces); disabled
solid_union = SolidUnion(Breps=boundary_surfaces)
brep_edges = BrepEdges(Brep=solid_union)  # -> Naked, Interior, NonManifold
boundary_surfaces_2 = BoundarySurfaces(Edges=brep_edges.Naked)

# ---- group: Get centre points of districts
boolean_toggle = BooleanToggle(True)
clean_tree = CleanTree(RemoveNulls=boolean_toggle, RemoveInvalid=True, RemoveEmpty=boolean_toggle, Tree=curve)  # -> simplify(Tree)
boundary_surfaces_3 = BoundarySurfaces(Edges=clean_tree)
area = Area(Geometry=boundary_surfaces_3)  # -> Area, Centroid

# ---- group: Multiply to make a circle which represents the population size
multiplication = Multiplication(A=population_per_district, B="25")

# ---- group: Centre points
point = Point(flatten(area.Centroid))

# ---- group: Temporary component to show order of points, rearrange them in the Python script
point_list = PointList(Points=point, Size=expr("x*5000", "25"))

# ---- group: SCRIPT
gh_cpython = GH_CPython(input=point, population=population_per_district)  # -> output, point_x, point_y; inputs input: list, population: list
#   port input: [required] - [type = int] - [default = None] Descripe your input here * bullet point. * bullet point
#   port output: indicate your output description here. refers to a new line.
# ---------- gh_cpython: Python ----------
import numpy as np

# List of points marking the center of each district
points = _input
p = population

# http://ifcuriousthenlearn.com/blog/2015/06/18/center-of-mass/

# Create list used by ordered districts
ordered = []

# This point item refers to district 01
ordered.append(points[0])
# This point item refers to district 02
ordered.append(points[4])
# This point item refers to district 03
ordered.append(points[5])
# This point item refers to district 04
ordered.append(points[6])
# This point item refers to district 05
ordered.append(points[7])
# This point item refers to district 06
ordered.append(points[8])
# This point item refers to district 07
ordered.append(points[9])
# This point item refers to district 08
ordered.append(points[10])
# This point item refers to district 09
ordered.append(points[11])
# This point item refers to district 10
ordered.append(points[1])
# This point item refers to district 11
ordered.append(points[2])
# This point item refers to district 12
ordered.append(points[3])

# Create empty lists
x_weigt = []
y_weigt = []
z_weigt = []

# Loop trough ordered list of center points of each district
# The list of points need to be ordered from district 1 to 12 so it will be multiplied with the right population p
for i, pnt in enumerate(ordered):
    # Multiply the x, y or z value of the point with the population p of the district and place it in a list
    x_weigt.append( pnt[0]*p[i] )
    y_weigt.append( pnt[1]*p[i] )
    z_weigt.append( pnt[2]*p[i] )

# Calculate x, y or z values of center point
point_x = np.sum(x_weigt)/np.sum(p)
point_y = np.sum(y_weigt)/np.sum(p)
point_z = np.sum(z_weigt)/np.sum(p)
# ---------- end gh_cpython ----------

# ---- group: OUTPUT: centre point based on population and population sizes
construct_point = ConstructPoint(XCoordinate=gh_cpython.point_x, YCoordinate=gh_cpython.point_y, ZCoordinate=0)
circle = Circle(Plane=point, Radius=multiplication)
