# Grasshopper definition Team2_Skill_Center_Vault_Radiation_Analysis(Openings).gh (Grasshopper 1.0.7)
# plug-ins: MeshEdit Components, Anemone

ladybug = Ladybug_Ladybug()  # -> out; plug-in component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
honeybee = Honeybee_Honeybee()  # -> out; plug-in component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

# ---- group: Other Inputs
elminating_higher_radiation = Slider(70, range=0..100)
controlling_openings = Slider(60, range=0..100)
north_point = Slider(20, range=0..100)
# DAYLIGHT_ANALYSIS
solar_radiation = BooleanToggle(True)
weather_data_path_epw_file = FilePath("E:\Building_Technology\Earthy\Design\Design_Script\Massing_SunLightOptimization\SYR_Damascus.400800_IWEC.epw")

# ---- group: CullPattern_Bottom_Mesh / Height of Bounding Box
number_slider = Slider(1.2, range=0..10)

# ---- group: CullPattern_Bottom_Mesh / Input
mesh = Mesh(<mesh referenced from the Rhino model>)

# ---- group: CullPattern_Bottom_Mesh
bounding_box = BoundingBox(Content=mesh, Plane=PlaneXY(0, 0, 0))  # -> Box, Box_2
mesh_explode = MeshExplode(Mesh=mesh, Interpolate=False)
deconstruct_box = DeconstructBox(Box=bounding_box.Box)  # -> Plane, X, Y, Z
area = Area(Geometry=mesh_explode)  # -> Area, Centroid
rectangle = Rectangle(Plane=deconstruct_box.Plane, XSize=deconstruct_box.X, YSize=deconstruct_box.Y, Radius=0)  # -> Rectangle, Length
unit_z = UnitZ(Factor=number_slider)
box_rectangle = BoxRectangle(Rectangle=rectangle.Rectangle, Height=unit_z)
point_in_brep = PointInBrep(Brep=box_rectangle, Point=area.Centroid, Strict=False)
gate_not = GateNot(A=point_in_brep)
cull_pattern = CullPattern(List=mesh_explode, CullPattern=gate_not)

# ---- group: Classroom
# Final_Output
input_mesh = Mesh(<mesh referenced from the Rhino model>)

# ---- group: Arts_space
# RADIATION_ANALYSIS
mesh_2 = Mesh(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)

# ---- group: Artsspace_All_Points
points_of_opening_part = Point([Point(-526.656311, -809.0452271, 1.281017741), Point(-527.8766276, -807.554423, 1.227804263), Point(-527.2254842, -808.485616, 1.265854716), Point(-527.6125895, -808.0614014, 1.293412725), Point(-527.9042358, -807.065328, 1.473365307), Point(-526.7743937, -808.7416382, 1.697306792)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])

# ---- group: Classrooms_All_Points
point = Point([Point(-549.0210571, -777.0517375, 0.09755905966), Point(-545.3798218, -777.0500081, 0.1235720416), Point(-547.201884, -776.1177165, 0.1391842378), Point(-546.5675659, -776.226298, 0.1740599697), Point(-547.8454793, -776.232015, 0.1795468479), Point(-548.4290365, -776.5139567, 0.1779710613)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])

# ---- group: Arts - Opening
point_2 = Point([Point(-526.656311, -809.0452271, 1.281017741), Point(-526.4779053, -809.0113932, 2.345316648), Point(-523.9736328, -801.5803426, 1.275059144), Point(-523.4188436, -802.1496582, 1.266569455), Point(-523.8560588, -801.8800252, 1.703723828), Point(-523.3499146, -802.4225667, 1.801207781)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])

# ---- group: Classrooms - Openings
point_3 = Point([Point(-549.0128784, -776.9196981, 1.213846564), Point(-545.3808594, -776.9430745, 1.321639538), Point(-546.6487834, -776.5621541, 1.393612027), Point(-546.0053507, -776.7860921, 1.417394121), Point(-547.3135376, -776.4397583, 1.21066312), Point(-548.1045736, -776.6407674, 1.312460899)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])

# ----
cull_pattern_2 = CullPattern(List=mesh_explode, CullPattern=point_in_brep)

# ---- group: CullPattern_Bottom_Mesh / Output
# INPUT!!
mesh_3 = Mesh(cull_pattern)

# ----
mesh_4 = Mesh(cull_pattern_2)

gradientlibrary = Ladybug_GradientLibrary(gradIndex=Slider(20, range=0..25))  # -> customColors; plug-in component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
legendpar = Ladybug_LegendParameters(
    lowBound=Slider(0, range=0..1000),
    highBound=Slider(2200, range=0..10000),
    customColors=flatten(gradientlibrary),
    decimalPlaces="1",
    removeLessThan=Toggle(True))  # -> legendPar; plug-in component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

# ---- group: Sky
gencumulativeskymtx = Ladybug_GenCumulativeSkyMtx(epwFile=weather_data_path_epw_file, skyDensity=0, useOldRes=True, runIt=Toggle(True))  # -> readMe, cumulativeSkyMtx; plug-in component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
selectskymtx = Ladybug_selectSkyMtx(cumulativeSkyMtx=gencumulativeskymtx.cumulativeSkyMtx, removeDiffuse=False, removeDirect=False)  # -> readMe, selectedSkyMtx; plug-in component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

# ----
radiationanalysis = Ladybug_RadiationAnalysis(
    north=north_point,
    geometry=flatten(mesh_3),
    gridSize="1",
    disFromBase=".01",
    selectedSkyMtx=flatten(selectskymtx.selectedSkyMtx),
    legendPar=flatten(legendpar),
    parallel=solar_radiation,
    runIt=solar_radiation)  # -> readMe, contextMesh, flatten(analysisMesh), flatten(testPts), testVec, port, flatten(radiationResult), radiationMesh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; plug-in component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

genclimatebasedsky = Honeybee_GenerateClimateBasedSky(weatherFile=weather_data_path_epw_file, month="6", day="21", hour="9")  # -> radiationValues, skyFilePath; plug-in component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

# ---- group: In example I and II I used GenerateZoneTestPt
gentestpts = Honeybee_GenerateTestPoints(gridSize=Slider(0.1, range=0..1), distBaseSrf=Slider(0.1, range=0..1), moveTestMesh=Toggle(True))  # -> readMe, simplify(testPoints), simplify(ptsVectors), simplify(facesArea), simplify(mesh); plug-in component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

# ---- group: Elminating - Higher Radiation
panel = Panel(radiationanalysis.radiationResult)
bounds = Bounds(Numbers=panel)
deconstruct_domain = DeconstructDomain(Domain=bounds)  # -> Start, End
mesh_explode_2 = MeshExplode(Mesh=radiationanalysis.radiationMesh, Interpolate=False)  # -> flatten(Faces)
multiplication = Multiplication(A=deconstruct_domain.End, B=elminating_higher_radiation)
division = Division(A=multiplication, B=100)
smaller_than = SmallerThan(FirstNumber=panel, SecondNumber=division)  # -> SmallerThan, OrEqualTo
mesh_cull_pattern = CullPattern(List=mesh_explode_2, CullPattern=smaller_than.SmallerThan)

# ---- group: Selecting_Openings_Loop
mesh_5 = Mesh(mesh_cull_pattern)
mesh_6 = Mesh(mesh_5)
# ENABLE_LOOP
mesh_explode_3 = MeshExplode(Mesh=mesh_6, Interpolate=False)
mesh_area = MeshArea(Mesh=mesh_explode_3)  # -> Area, flatten(Centroid)
loop_start = LoopStart(Repeat=Slider(1500, range=0..1700), Trigger=Button(), Data=mesh_area.Centroid)  # -> port, Counter, Data; disabled
counter = Panel(loop_start.Counter)
point_4 = Point(loop_start.Data)
list_item = ListItem(List=point_4, Index=loop_start.Counter, Wrap=True)
sphere = Sphere(Base=list_item, Radius=Slider(0.5, range=0..1))
point_in_brep_2 = PointInBrep(Brep=sphere, Point=point_4, Strict=False)
# REMOVE_THIS_BEFORE_LOOPING
gate_not_2 = GateNot(A=point_in_brep_2)
cull_pattern_3 = CullPattern(List=point_4, CullPattern=gate_not_2)
insert_items = InsertItems(List=cull_pattern_3, Item=list_item, Indices=loop_start.Counter, Wrap=True)
running = Running(port=loop_start.port, Exit=False, Data=insert_items, TimeOutVal=0, pausedState=False, state="Constant output")

# ----
# Create ground in front of the room
# for more accurate analysis
brep = Brep(<brep referenced from the Rhino model>)
brep_wireframe = BrepWireframe(Brep=brep, Density=-1)
createhbsrfs = Honeybee_createHBSrfs(geometry=brep)  # -> readMe, simplify(HBSurface); plug-in component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

# ----
# Put the recipie together!
gridbasedsimulation = Honeybee_GridBasedSimulation(
    skyFile=genclimatebasedsky.skyFilePath,
    testPoints=gentestpts.testPoints,
    ptsVectors=gentestpts.ptsVectors,
    testMesh=gentestpts.mesh,
    simulationType=0)  # -> analysisRecipe; plug-in component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
boolean_toggle = BooleanToggle(False)

points_of_opening_part_2 = Point(running)

# ---- group: Centroid_Artrooms
point_5 = Point(mesh_area.Centroid)

# ---- group: Artrooms
points_of_opening_part_3 = Point([Point(-526.656311, -809.0452271, 1.281017741), Point(-527.8766276, -807.554423, 1.227804263), Point(-527.2254842, -808.485616, 1.265854716), Point(-527.6125895, -808.0614014, 1.293412725), Point(-527.9042358, -807.065328, 1.473365307), Point(-526.7743937, -808.7416382, 1.697306792)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])

# ---- group: Finding_The_Index_of_The_Openings_Points
create_set = CreateSet(List=points_of_opening_part_3)  # -> Set, Map
member_index = MemberIndex(Set=point_5, Member=create_set.Set)  # -> flatten(Index), Count
panel_2 = Panel(member_index.Index)

# ---- group: Controlling_Openings
radiation_cull_pattern = CullPattern(List=radiationanalysis.radiationResult, CullPattern=smaller_than.SmallerThan)
radiation_list_item = ListItem(List=radiation_cull_pattern, Index=panel_2, Wrap=True)
bounds_2 = Bounds(Numbers=radiation_list_item)
deconstruct_domain_2 = DeconstructDomain(Domain=bounds_2)  # -> Start, End
multiplication_2 = Multiplication(A=deconstruct_domain_2.End, B=controlling_openings)
division_2 = Division(A=multiplication_2, B=100)
smaller_than_2 = SmallerThan(FirstNumber=division_2, SecondNumber=radiation_list_item)  # -> SmallerThan, OrEqualTo
panel_3 = Panel(smaller_than_2.OrEqualTo)

# ----
# Run the analysis
number_slider_2 = Slider(1, range=0..1)

# ---- group: make it 3D!
construct_domain = ConstructDomain(DomainStart=0, DomainEnd=number_slider_2)

# ---- group: Finding_The_Index_of_Solid_Points
cull_index = CullIndex(List=point_5, Indices=panel_2, Wrap=True)
mesh_explode_4 = MeshExplode(Mesh=mesh_cull_pattern, Interpolate=False)  # -> flatten(Faces)
create_set_2 = CreateSet(List=cull_index)  # -> Set, Map
member_index_2 = MemberIndex(Set=point_5, Member=create_set_2.Set)  # -> flatten(Index), Count

# ---- group: Outputsssss / Opening_Before_Control
list_item_2 = ListItem(List=mesh_explode_4, Index=panel_2, Wrap=True)
mesh_7 = Mesh(list_item_2)

# ----
gate_not_3 = GateNot(A=panel_3)
cull_pattern_4 = CullPattern(List=mesh_7, CullPattern=gate_not_3)
area_2 = Area(Geometry=cull_pattern_4)  # -> Area, Centroid

# ---- group: Outputsssss / Openings_After_Percentage
cull_pattern_5 = CullPattern(List=mesh_7, CullPattern=panel_3)

# ---- group: Outputsssss / Solid_Part
list_item_3 = ListItem(List=mesh_explode_4, Index=member_index_2.Index, Wrap=True)

# ---- group: Outputsssss / Openings_After_Percentage / Closing
mesh_8 = Mesh(cull_pattern_5)

# ----
point_6 = Point(area_2.Centroid)

# ---- group: Final_Form
mesh_9 = Mesh([mesh_8, list_item_3])

# ----
unit_x = UnitX(Factor=Slider(10, range=0..10))
unit_x_2 = UnitX(Factor=Slider(10, range=0..10))
move = Move(Geometry=mesh_8, Motion=unit_x)  # -> Geometry, Transform; disabled

# ---- group: Solid
createhbsrfs_2 = Honeybee_createHBSrfs(geometry=move.Geometry)  # -> readMe, simplify(HBSurface); plug-in component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

# ----
move_2 = Move(Geometry=mesh_8, Motion=unit_x_2)  # -> Geometry, Transform; disabled

# ---- group: Openings
number_slider_3 = Slider(1, range=0..1)
radglassmaterial = Honeybee_RadianceGlassMaterial(
    materialName="glass_material",
    RTransmittance=number_slider_3,
    GTransmittance=number_slider_3,
    BTransmittance=number_slider_3,
    refractiveIndex=1.52)  # -> avrgTrans, RADMaterial; plug-in component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
createhbsrfs_3 = Honeybee_createHBSrfs(geometry=move_2.Geometry, RADMaterial=radglassmaterial.RADMaterial)  # -> readMe, simplify(HBSurface); plug-in component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

# ---- group: HB Zone With Glazing
brep_2 = Brep(flatten([createhbsrfs_2.HBSurface, createhbsrfs_3.HBSurface]))

# ----
brep_wireframe_2 = BrepWireframe(Brep=brep_2, Density=-1)
rundaylightanalysis = Honeybee_RunDaylightSimulation(
    HBObjects=flatten([brep_2, createhbsrfs.HBSurface]),
    analysisRecipe=gridbasedsimulation,
    writeRad=boolean_toggle,
    runRad=boolean_toggle,
    overwriteResults=True)  # -> readMe, analysisType, resultsUnit, results, testPts, resultFiles, radGeoFile, studyFolder, done; plug-in component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

bounds_3 = Bounds(Numbers=rundaylightanalysis.results)
deconstruct_domain_3 = DeconstructDomain(Domain=bounds_3)  # -> Start, End
gradientlibrary_2 = Ladybug_GradientLibrary(gradIndex=Slider(1, range=0..10))  # -> customColors; plug-in component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
legendpar_2 = Ladybug_LegendParameters(
    lowBound=deconstruct_domain_3.Start,
    highBound=deconstruct_domain_3.End,
    numSegments=Slider(6, range=0..10),
    customColors=flatten(gradientlibrary_2))  # -> legendPar; plug-in component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

# ----
# Visualize the results
recolormesh = Ladybug_RecolorMesh(
    analysisResult=rundaylightanalysis.results,
    inputMesh=gentestpts.mesh,
    heightDomain=construct_domain,
    legendPar=legendpar_2,
    analysisTitle=rundaylightanalysis.analysisType,
    legendTitle=rundaylightanalysis.resultsUnit)  # -> readMe, newMesh, newLegend, legendBasePt, meshColors, legendColors; plug-in component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
