# Grasshopper definition Approach1_Class_Roof_Wall_Analysis.gh (Grasshopper 1.0.7)
# plug-ins: Karamba, MeshEdit Components

# ----
# Mesh generation for walls
# Roof mesh points as inclusive points
roof_mesh = Mesh(<mesh referenced from the Rhino model>)
mesh_edges = MeshEdges(Mesh=roof_mesh)  # -> NakedEdges, InteriorEdges, NonManifoldEdges
line = Line(mesh_edges.NakedEdges)
end_points = EndPoints(Curve=line)  # -> Start, End
deconstruct = Deconstruct(Point=end_points.Start)  # -> XComponent, YComponent, ZComponent
point = Point(end_points.End)
smaller_than = SmallerThan(FirstNumber=deconstruct.ZComponent, SecondNumber=Slider(0.2, range=0..1))  # -> SmallerThan, OrEqualTo
cull_pattern = CullPattern(List=point, CullPattern=smaller_than.SmallerThan)
cull_pattern_2 = CullPattern(List=line, CullPattern=smaller_than.SmallerThan)
unit_z = UnitZ(Factor="2.1")
move = Move(Geometry=cull_pattern_2, Motion=unit_z)  # -> Geometry, Transform
negative = Negative(Value=unit_z)
extrude = Extrude(Base=move.Geometry, Direction=negative)
mesh_breps_karamba3d = MeshBrepsKaramba3D(
    Brep=extrude,
    InclusionPoints=cull_pattern,
    MeshResolution=0.25,
    EdgeRefinementFactor=0.67,
    PointReduction=False,
    SmoothingStepSize=0,
    SmoothingIterations=5)  # -> Mesh, Info
move_2 = Move(Geometry=roof_mesh, Motion=unit_z)  # -> Geometry, Transform

# ----
# Corridor Meshing
corridor_mesh = Mesh(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)  # disabled
mesh_edges_2 = MeshEdges(Mesh=corridor_mesh)  # -> NakedEdges, InteriorEdges, NonManifoldEdges; disabled
number_slider = Slider(0.2, range=0..1)  # disabled
line_2 = Line(mesh_edges_2.NakedEdges)  # disabled
end_points_2 = EndPoints(Curve=line_2)  # -> Start, End; disabled
point_2 = Point(end_points_2.End)  # disabled
deconstruct_2 = Deconstruct(Point=end_points_2.Start)  # -> XComponent, YComponent, ZComponent; disabled
smaller_than_2 = SmallerThan(FirstNumber=deconstruct_2.ZComponent, SecondNumber=number_slider)  # -> SmallerThan, OrEqualTo; disabled
panel = Panel("2.1")  # disabled
panel_2 = Panel("2.1")  # disabled
unit_z_2 = UnitZ(Factor=panel)  # disabled
unit_z_3 = UnitZ(Factor=panel_2)  # disabled
cull_pattern_3 = CullPattern(List=point_2, CullPattern=smaller_than_2.SmallerThan)  # disabled
cull_pattern_4 = CullPattern(List=line_2, CullPattern=smaller_than_2.SmallerThan)  # disabled
move_3 = Move(Geometry=cull_pattern_4, Motion=unit_z_2)  # -> Geometry, Transform; disabled
move_4 = Move(Geometry=corridor_mesh, Motion=unit_z_3)  # -> Geometry, Transform; disabled
negative_2 = Negative(Value=unit_z_2)  # disabled
extrude_2 = Extrude(Base=move_3.Geometry, Direction=negative_2)  # disabled
mesh_breps_karamba3d_2 = MeshBrepsKaramba3D(
    Brep=extrude_2,
    InclusionPoints=cull_pattern_3,
    MeshResolution=1,
    EdgeRefinementFactor=0.67,
    PointReduction=False,
    SmoothingStepSize=0,
    SmoothingIterations=5)  # -> Mesh, Info; disabled
mesh_edges_3 = MeshEdges(Mesh=mesh_breps_karamba3d_2.Mesh)  # -> NakedEdges, InteriorEdges, NonManifoldEdges; disabled

# ----
# Unifying Mesh
merge = Merge(Data1=mesh_breps_karamba3d.Mesh, Data2=move_4.Geometry)
merge_2 = Merge(Data1=move_2.Geometry, Data2=mesh_breps_karamba3d_2.Mesh)  # -> simplify(Result)
merge_3 = Merge(Data1=merge, Data2=merge_2)
list_length = ListLength(List=merge)
mesh_weldvertices = MeshWeldVertices(Mesh=merge_3, Tolerance=0.01)  # -> RuntimeMessage, Mesh
series = Series(Start=0, Step=1, Count=list_length)  # -> flatten(Series)
list_item = ListItem(List=flatten(mesh_weldvertices.Mesh), Index=series, Wrap=True)
cull_index = CullIndex(List=mesh_weldvertices.Mesh, Indices=series, Wrap=True)
mesh_join = MeshJoin(Meshes=flatten([list_item, cull_index]))

# ----
# Adobe Material Properties:
# 
# Young's Modulus = 150 MPa
# Shear Modulus = 60 MPa
# SPecific Weight = 19 KN/m3
# Yield  Compressive strength = 0.5 MPa
# Yield Tensile Strength = 0.05 MPa
number_slider_2 = Slider(0.1, range=0..0.1)
cross_sections_karamba = CrossSectionsKaramba(Heights_cm=Slider(48, range=0..150), mode="Shell")
unit_z_4 = UnitZ(Factor="-1.2")
material_properties_karamba = MaterialPropertiesKaramba(
    YoungsModulus_kN_cm2="15",
    ShearModulus_kN_cm2="6",
    SpecificWeight_kN_m3="19",
    CoefficientOfThermalExpansion_1_C=1e-05,
    YieldStrength_kN_cm2="0.05",
    Name="adobe")
mesh = Mesh(mesh_join)
loads_karamba = LoadsKaramba(Vector=unit_z_4, LCase=0, mode="Gravity")
mesh_to_shell_karamba = MeshToShellKaramba(Mesh=mesh, LDist=0.005)  # -> Point, Element, Info
point_3 = Point(mesh_to_shell_karamba.Point)
deconstruct_3 = Deconstruct(Point=point_3)  # -> XComponent, YComponent, ZComponent
smaller_than_3 = SmallerThan(FirstNumber=deconstruct_3.ZComponent, SecondNumber=number_slider_2)  # -> SmallerThan, OrEqualTo
cull_pattern_5 = CullPattern(List=point_3, CullPattern=smaller_than_3.OrEqualTo)
support_karamba = SupportKaramba(PosInd=cull_pattern_5, menu=[buttons(on, on, on, off, off, off)])
cross_section_karamba = CrossSectionKaramba(cross_sections_karamba)
element_karamba = ElementKaramba(mesh_to_shell_karamba.Element)
load_karamba = LoadKaramba(loads_karamba)
material_karamba = MaterialKaramba(material_properties_karamba)
support_karamba_2 = SupportKaramba(support_karamba)
assemble_model_karamba = AssembleModelKaramba(
    Elem=flatten(element_karamba),
    Support=flatten(support_karamba_2),
    Load=flatten(load_karamba),
    CrossSection=flatten(cross_section_karamba),
    Material=flatten(material_karamba),
    LimitDistance_m=0.005)  # -> Model, Info, Mass_kg, CenterOfGravity
analyzethi_karamba = AnalyzeThIKaramba(Model=assemble_model_karamba.Model)  # -> CalculatedModel, MaximumDisplacement_m, ResultingForceOfGravity_kN, ElasticEnergy_kNm
model_view_karamba = ModelViewKaramba(Model=analyzethi_karamba.CalculatedModel, LoadCaseFactorsForLinearSuperposition=1, IndexIncrementOfVisibleLoadcase=0)  # -> Model, DeformedMesh, DeformedAxes, DeformedModel
shell_view_karamba = ShellViewKaramba(Model=model_view_karamba.Model)  # -> Model, MeshesOfRenderedShells, LegendColors, LegendTags

# ----
# DATA CONVERSION
panel_3 = Panel("0")
cull_index_2 = CullIndex(List=shell_view_karamba.LegendTags, Indices=panel_3, Wrap=True)
multiplication = Multiplication(A=cull_index_2, B="10")
insert_items = InsertItems(List=multiplication, Item="Stress[N/mm2]", Indices=0, Wrap=True)
list_length_2 = ListLength(List=insert_items)
replace_items = ReplaceItems(List=insert_items, Indices=expr("x-1", list_length_2), Wrap=False)

# ----
# Plain Adobe
# Yield Strength =1.02 N/mm2
# Stress @ 5% Strain = 0.728 N/mm2
# 
# Safety Factor= 2
# Max. Compressive Stress= 0.51 N/mm2
# Max. Tensile Stress = 0.051 N/mm2
legend = Legend(Colour=shell_view_karamba.LegendColors, Tags=replace_items, LegendType=1)
