# Grasshopper definition Approach2_Class_opening_Analysis.gh (Grasshopper 1.0.7)
# plug-ins: Karamba, MeshEdit Components

artsspace_input_mesh = Mesh(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)
# Analysis before applying the openings
# Internalised Mesh
# from Kangaroo
classroom_inputmesh = Mesh(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)

# ---- group: Arts_space
artsspace_input_mesh_2 = Mesh(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)

# ---- group: Arts - Opening
point = Point([Point(-526.656311, -809.0452271, 1.281017741), Point(-526.4779053, -809.0113932, 2.345316648), Point(-523.9736328, -801.5803426, 1.275059144), Point(-523.4188436, -802.1496582, 1.266569455), Point(-523.8560588, -801.8800252, 1.703723828), Point(-523.3499146, -802.4225667, 1.801207781)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])

# ---- group: Classroom
# Imposing lowest radiation points on the mesh
classroom_inputmesh_2 = Mesh(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)

# ---- group: Classrooms - Openings
point_2 = Point([Point(-549.0128784, -776.9196981, 1.213846564), Point(-545.3808594, -776.9430745, 1.321639538), Point(-546.6487834, -776.5621541, 1.393612027), Point(-546.0053507, -776.7860921, 1.417394121), Point(-547.3135376, -776.4397583, 1.21066312), Point(-548.1045736, -776.6407674, 1.312460899)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])

# ----
# KARAMBA Analysis
merge = Merge(Data1=flatten(classroom_inputmesh), Data2=flatten(artsspace_input_mesh))

# ----
# Removing points on  the critical arches
point_list = PointList(Points=point_2)
openings_on_critical_arch = Panel("""54
58
104
105
61
107
96
245
120
124
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""")
cull_index = CullIndex(List=point_2, Indices=openings_on_critical_arch, Wrap=True)
final_points = Point(cull_index)

# ----
# Random Reduction of openings
number_slider = Slider(0.8, range=0..1)
list_length = ListLength(List=final_points)
multiplication = Multiplication(A=list_length, B=number_slider)
random_reduce = RandomReduce(List=final_points, Reduction=multiplication, Seed=1)

point_list_2 = PointList(Points=point)
panel = Panel("""338
339
340
297
53
59
67
2
3
4
5
7
10
13
27
0
1
215
197
191
194
178
111
107
103
61
276
315
313""")
cull_index_2 = CullIndex(List=point, Indices=panel, Wrap=True)
final_points_2 = Point(cull_index_2)

# ----
# Random Reduction of openings
number_slider_2 = Slider(0.8, range=0..1)
list_length_2 = ListLength(List=final_points_2)
multiplication_2 = Multiplication(A=list_length_2, B=number_slider_2)
random_reduce_2 = RandomReduce(List=final_points_2, Reduction=multiplication_2, Seed=1)

mesh_closest_point = MeshClosestPoint(Point=cull_index, Mesh=classroom_inputmesh_2)  # -> Point, Index, Parameter
mesh_eval = MeshEval(Mesh=classroom_inputmesh_2, Parameter=mesh_closest_point.Parameter)  # -> Point, Normal, Colour
plane_normal = PlaneNormal(Origin=mesh_eval.Point, ZAxis=mesh_eval.Normal)  # -> flatten(Plane)
rectangle = Rectangle(Plane=plane_normal, XSize="0.12", YSize="0.12", Radius=0)  # -> Rectangle, Length
surface = Surface(rectangle.Rectangle)

mesh_closest_point_2 = MeshClosestPoint(Point=final_points_2, Mesh=artsspace_input_mesh_2)  # -> Point, Index, Parameter
mesh_eval_2 = MeshEval(Mesh=artsspace_input_mesh_2, Parameter=mesh_closest_point_2.Parameter)  # -> Point, Normal, Colour
plane_normal_2 = PlaneNormal(Origin=mesh_eval_2.Point, ZAxis=mesh_eval_2.Normal)  # -> flatten(Plane)
rectangle_2 = Rectangle(Plane=plane_normal_2, XSize="0.12", YSize="0.12", Radius=0)  # -> Rectangle, Length
surface_2 = Surface(rectangle_2.Rectangle)

evaluate_surface = EvaluateSurface(Surface=surface, Point=mesh_eval.Point)  # -> Point, Normal, UDirection, VDirection, Frame
amplitude = Amplitude(Vector=evaluate_surface.Normal, Amplitude=Slider(-0.1, range=-0.1..0.1))
amplitude_2 = Amplitude(Vector=evaluate_surface.Normal, Amplitude=Slider(0.1, range=-0.1..0.1))
move = Move(Geometry=rectangle.Rectangle, Motion=amplitude_2)  # -> graft(Geometry), Transform
move_2 = Move(Geometry=rectangle.Rectangle, Motion=amplitude)  # -> graft(Geometry), Transform
loft = Loft(
    Curves=[move_2.Geometry, move.Geometry],
    Options={Adjust=False, Closed=False, LoftEnds=0, LoftSimp=0, LoftType=0, Rebuild=10, Refit=0.01})  # -> flatten(Loft)

evaluate_surface_2 = EvaluateSurface(Surface=surface_2, Point=mesh_eval_2.Point)  # -> Point, Normal, UDirection, VDirection, Frame
amplitude_3 = Amplitude(Vector=evaluate_surface_2.Normal, Amplitude=Slider(-0.1, range=-0.1..0.1))
amplitude_4 = Amplitude(Vector=evaluate_surface_2.Normal, Amplitude=Slider(0.1, range=-0.1..0.1))
move_3 = Move(Geometry=rectangle_2.Rectangle, Motion=amplitude_3)  # -> graft(Geometry), Transform
move_4 = Move(Geometry=rectangle_2.Rectangle, Motion=amplitude_4)  # -> graft(Geometry), Transform
loft_2 = Loft(
    Curves=[move_3.Geometry, move_4.Geometry],
    Options={Adjust=False, Closed=False, LoftEnds=0, LoftSimp=0, LoftType=0, Rebuild=10, Refit=0.01})  # -> flatten(Loft)

mesh_split = MeshSplit(Mesh=classroom_inputmesh_2, Splitters=loft)
mesh_split_2 = MeshSplit(Mesh=artsspace_input_mesh_2, Splitters=loft_2)
sort_list = SortList(Keys=mesh_split, ValuesValuesA=mesh_split)  # -> Keys, ValuesValuesA
sort_list_2 = SortList(Keys=mesh_split_2, ValuesValuesA=mesh_split_2)  # -> Keys, ValuesValuesA
list_item = ListItem(List=sort_list.ValuesValuesA, Index="-1", Wrap=True)
list_item_2 = ListItem(List=sort_list_2.ValuesValuesA, Index="-1", Wrap=True)
mesh = Mesh([list_item, list_item_2])

# ---- group: Opening %
mesh_area = MeshArea(Mesh=list_item)  # -> Area, Centroid
mesh_area_2 = MeshArea(Mesh=classroom_inputmesh_2)  # -> Area, Centroid
panel_2 = Panel(mesh_area.Area)
panel_3 = Panel(mesh_area_2.Area)
expression = Expression(x=panel_2, y=panel_3, Expression="(y-x)/y*100")
percentage_of_openings = Panel(expression)

# ----
mesh_area_3 = MeshArea(Mesh=list_item_2)  # -> Area, Centroid
mesh_area_4 = MeshArea(Mesh=artsspace_input_mesh_2)  # -> Area, Centroid
panel_4 = Panel(mesh_area_3.Area)
panel_5 = Panel(mesh_area_4.Area)
expression_2 = Expression(x=panel_4, y=panel_5, Expression="(y-x)/y*100")
percentage_of_openings_2 = Panel(expression_2)

# ----
# Plain Adobe
# Yield Strength =1.02 N/mm2
# Stress @ 5% Strain = 0.728 N/mm2
# 
# Safety Factor= 2
# Max. Compressive Stress= 0.51 N/mm2
# Max. Tensile Stress = 0.051 N/mm2
# Adobe Material Properties:
# 
# Young's Modulus = 150 MPa
# Shear Modulus = 60 MPa
# SPecific Weight = 19 KN/m3
# Yield  Compressive strength = 0.5 MPa
# Yield Tensile Strength = 0.05 MPa
number_slider_3 = Slider(0.1, range=0..0.1)
cross_sections_karamba = CrossSectionsKaramba(Heights_cm=Slider(48, range=0..80), mode="Shell")
material_properties_karamba = MaterialPropertiesKaramba(
    YoungsModulus_kN_cm2="15",
    ShearModulus_kN_cm2="6",
    SpecificWeight_kN_m3="15",
    CoefficientOfThermalExpansion_1_C=1e-05,
    YieldStrength_kN_cm2="0.05",
    Name="adobe")
unit_z = UnitZ(Factor="-1.2")
loads_karamba = LoadsKaramba(Vector=unit_z, LCase=0, mode="Gravity")
mesh_to_shell_karamba = MeshToShellKaramba(Mesh=merge, LDist=0.005)  # -> Point, Element, Info
point_3 = Point(mesh_to_shell_karamba.Point)
deconstruct = Deconstruct(Point=point_3)  # -> XComponent, YComponent, ZComponent
smaller_than = SmallerThan(FirstNumber=deconstruct.ZComponent, SecondNumber=number_slider_3)  # -> SmallerThan, OrEqualTo
cull_pattern = CullPattern(List=point_3, CullPattern=smaller_than.OrEqualTo)
support_karamba = SupportKaramba(PosInd=cull_pattern, menu=[buttons(on, on, on, off, off, off)])
cross_section_karamba = CrossSectionKaramba(cross_sections_karamba)
element_karamba = ElementKaramba(mesh_to_shell_karamba.Element)
support_karamba_2 = SupportKaramba(support_karamba)
material_karamba = MaterialKaramba(material_properties_karamba)
load_karamba = LoadKaramba(loads_karamba)
assemble_model_karamba = AssembleModelKaramba(
    Elem=flatten(element_karamba),
    Support=flatten(support_karamba_2),
    Load=flatten(load_karamba),
    CrossSection=flatten(cross_section_karamba),
    Material=flatten(material_karamba),
    LimitDistance_m=0.005)  # -> Model, Info, Mass_kg, CenterOfGravity
analyzethi_karamba = AnalyzeThIKaramba(Model=assemble_model_karamba.Model)  # -> CalculatedModel, MaximumDisplacement_m, ResultingForceOfGravity_kN, ElasticEnergy_kNm
model_view_karamba = ModelViewKaramba(Model=analyzethi_karamba.CalculatedModel, LoadCaseFactorsForLinearSuperposition=1, IndexIncrementOfVisibleLoadcase=0)  # -> Model, DeformedMesh, DeformedAxes, DeformedModel
shell_view_karamba = ShellViewKaramba(Model=model_view_karamba.Model)  # -> Model, MeshesOfRenderedShells, LegendColors, LegendTags

# ----
# DATA CONVERSION
panel_6 = Panel("0")
cull_index_3 = CullIndex(List=shell_view_karamba.LegendTags, Indices=panel_6, Wrap=True)
multiplication_3 = Multiplication(A=cull_index_3, B="10")
insert_items = InsertItems(List=multiplication_3, Item="Stress[N/mm2]", Indices=0, Wrap=True)
list_length_3 = ListLength(List=insert_items)
replace_items = ReplaceItems(List=insert_items, Indices=expr("x-1", list_length_3), Wrap=False)

legend = Legend(Colour=shell_view_karamba.LegendColors, Tags=replace_items, LegendType=1)

# ----
# Plain Adobe
# Yield Strength =1.02 N/mm2
# Stress @ 5% Strain = 0.728 N/mm2
# 
# Safety Factor= 2
# Max. Compressive Stress= 0.51 N/mm2
# Max. Tensile Stress = 0.051 N/mm2
# Adobe Material Properties:
# 
# Young's Modulus = 150 MPa
# Shear Modulus = 60 MPa
# SPecific Weight = 19 KN/m3
# Yield  Compressive strength = 0.5 MPa
# Yield Tensile Strength = 0.05 MPa
number_slider_4 = Slider(0.1, range=0..0.1)
cross_sections_karamba_2 = CrossSectionsKaramba(Heights_cm=Slider(48, range=0..80), mode="Shell")
material_properties_karamba_2 = MaterialPropertiesKaramba(
    YoungsModulus_kN_cm2="15",
    ShearModulus_kN_cm2="6",
    SpecificWeight_kN_m3="15",
    CoefficientOfThermalExpansion_1_C=1e-05,
    YieldStrength_kN_cm2="0.05",
    Name="adobe")
unit_z_2 = UnitZ(Factor="-1.2")
loads_karamba_2 = LoadsKaramba(Vector=unit_z_2, LCase=0, mode="Gravity")
mesh_to_shell_karamba_2 = MeshToShellKaramba(Mesh=mesh, LDist=0.005)  # -> Point, Element, Info
point_4 = Point(mesh_to_shell_karamba_2.Point)
# KARAMBA Analysis
deconstruct_2 = Deconstruct(Point=point_4)  # -> XComponent, YComponent, ZComponent
smaller_than_2 = SmallerThan(FirstNumber=deconstruct_2.ZComponent, SecondNumber=number_slider_4)  # -> SmallerThan, OrEqualTo
cull_pattern_2 = CullPattern(List=point_4, CullPattern=smaller_than_2.OrEqualTo)
support_karamba_3 = SupportKaramba(PosInd=cull_pattern_2, menu=[buttons(on, on, on, off, off, off)])
cross_section_karamba_2 = CrossSectionKaramba(cross_sections_karamba_2)
element_karamba_2 = ElementKaramba(mesh_to_shell_karamba_2.Element)
support_karamba_4 = SupportKaramba(support_karamba_3)
material_karamba_2 = MaterialKaramba(material_properties_karamba_2)
load_karamba_2 = LoadKaramba(loads_karamba_2)
assemble_model_karamba_2 = AssembleModelKaramba(
    Elem=flatten(element_karamba_2),
    Support=flatten(support_karamba_4),
    Load=flatten(load_karamba_2),
    CrossSection=flatten(cross_section_karamba_2),
    Material=flatten(material_karamba_2),
    LimitDistance_m=0.005)  # -> Model, Info, Mass_kg, CenterOfGravity
analyzethi_karamba_2 = AnalyzeThIKaramba(Model=assemble_model_karamba_2.Model)  # -> CalculatedModel, MaximumDisplacement_m, ResultingForceOfGravity_kN, ElasticEnergy_kNm
model_view_karamba_2 = ModelViewKaramba(Model=analyzethi_karamba_2.CalculatedModel, LoadCaseFactorsForLinearSuperposition=1, IndexIncrementOfVisibleLoadcase=0)  # -> Model, DeformedMesh, DeformedAxes, DeformedModel
shell_view_karamba_2 = ShellViewKaramba(Model=model_view_karamba_2.Model)  # -> Model, MeshesOfRenderedShells, LegendColors, LegendTags

# ----
# DATA CONVERSION
panel_7 = Panel("0")
cull_index_4 = CullIndex(List=shell_view_karamba_2.LegendTags, Indices=panel_7, Wrap=True)
multiplication_4 = Multiplication(A=cull_index_4, B="10")
insert_items_2 = InsertItems(List=multiplication_4, Item="Stress[N/mm2]", Indices=0, Wrap=True)
list_length_4 = ListLength(List=insert_items_2)
replace_items_2 = ReplaceItems(List=insert_items_2, Indices=expr("x-1", list_length_4), Wrap=False)

legend_2 = Legend(Colour=shell_view_karamba_2.LegendColors, Tags=replace_items_2, LegendType=1)
