# Grasshopper definition Corridor_Analysis.gh (Grasshopper 1.0.7)
# plug-ins: Karamba

# ----
# Internalised Mesh
corridor_1 = Mesh([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])
corridor_2 = Mesh(Tree({0;0}: [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], {0;0;0}: [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]))

# ----
# DATA CONVERSION
# KARAMBA Analysis
merge = Merge(Data1=flatten(corridor_1), Data2=flatten(corridor_2))

# ----
# Plain Adobe
# Yield Strength =1.02 N/mm2
# Stress @ 5% Strain = 0.728 N/mm2
# 
# Safety Factor= 2
# Max. Compressive Stress= 0.51 N/mm2
# Max. Tensile Stress = 0.051 N/mm2
# Adobe Material Properties:
# 
# Young's Modulus = 150 MPa
# Shear Modulus = 60 MPa
# SPecific Weight = 19 KN/m3
# Yield  Compressive strength = 0.5 MPa
# Yield Tensile Strength = 0.05 MPa
number_slider = Slider(0.1, range=0..0.1)
material_properties_karamba = MaterialPropertiesKaramba(
    YoungsModulus_kN_cm2="15",
    ShearModulus_kN_cm2="6",
    SpecificWeight_kN_m3="15",
    CoefficientOfThermalExpansion_1_C=1e-05,
    YieldStrength_kN_cm2="0.05",
    Name="adobe")
unit_z = UnitZ(Factor="-1.2")
cross_sections_karamba = CrossSectionsKaramba(Heights_cm=Slider(24, range=0..80), mode="Shell")
mesh_to_shell_karamba = MeshToShellKaramba(Mesh=merge, LDist=0.005)  # -> Point, Element, Info
point = Point(mesh_to_shell_karamba.Point)
deconstruct = Deconstruct(Point=point)  # -> XComponent, YComponent, ZComponent
smaller_than = SmallerThan(FirstNumber=deconstruct.ZComponent, SecondNumber=number_slider)  # -> SmallerThan, OrEqualTo
cull_pattern = CullPattern(List=point, CullPattern=smaller_than.OrEqualTo)
support_karamba = SupportKaramba(PosInd=cull_pattern, menu=[buttons(on, on, on, off, off, off)])
loads_karamba = LoadsKaramba(Vector=unit_z, LCase=0, mode="Gravity")
cross_section_karamba = CrossSectionKaramba(cross_sections_karamba)
element_karamba = ElementKaramba(mesh_to_shell_karamba.Element)
support_karamba_2 = SupportKaramba(support_karamba)
material_karamba = MaterialKaramba(material_properties_karamba)
load_karamba = LoadKaramba(loads_karamba)
assemble_model_karamba = AssembleModelKaramba(
    Elem=flatten(element_karamba),
    Support=flatten(support_karamba_2),
    Load=flatten(load_karamba),
    CrossSection=flatten(cross_section_karamba),
    Material=flatten(material_karamba),
    LimitDistance_m=0.005)  # -> Model, Info, Mass_kg, CenterOfGravity
analyzethi_karamba = AnalyzeThIKaramba(Model=assemble_model_karamba.Model)  # -> CalculatedModel, MaximumDisplacement_m, ResultingForceOfGravity_kN, ElasticEnergy_kNm
model_view_karamba = ModelViewKaramba(Model=analyzethi_karamba.CalculatedModel, LoadCaseFactorsForLinearSuperposition=1, IndexIncrementOfVisibleLoadcase=0)  # -> Model, DeformedMesh, DeformedAxes, DeformedModel
shell_view_karamba = ShellViewKaramba(Model=model_view_karamba.Model)  # -> Model, MeshesOfRenderedShells, LegendColors, LegendTags

cull_index = CullIndex(List=shell_view_karamba.LegendTags, Indices="0", Wrap=True)
multiplication = Multiplication(A=cull_index, B="10")
insert_items = InsertItems(List=multiplication, Item="Stress[N/mm2]", Indices=0, Wrap=True)
list_length = ListLength(List=insert_items)
replace_items = ReplaceItems(List=insert_items, Indices=expr("x-1", list_length), Wrap=False)

legend = Legend(Colour=shell_view_karamba.LegendColors, Tags=replace_items, LegendType=1)
