# Grasshopper definition Final_3d_Model.gh (Grasshopper 1.0.7)
# plug-ins: Karamba, MeshEdit Components, Weaverbird, Kangaroo2 Components

# ----
# Classroom
fillet_radius = Slider(2, range=0..3)
curve = Curve(<curve referenced from the Rhino model>)
fillet = Fillet(Curve=curve, Radius=fillet_radius)
surface = Surface(fillet)
unit_z = UnitZ(Factor=Slider(1.2, range=0..2.5))
extrude = Extrude(Base=surface, Direction=unit_z)
deconstruct_brep = DeconstructBrep(Brep=extrude)  # -> Faces, Edges, Vertices
list_item = ListItem(List=deconstruct_brep.Faces, Index=Slider(4, range=0..10), Wrap=True)
cull_index = CullIndex(List=deconstruct_brep.Faces, Indices=[0, 4], Wrap=True)
brep = Brep(cull_index)

fillet_radius_2 = Slider(2, range=0..3)
# Admin and Canteen
curve_2 = Curve(<curve referenced from the Rhino model>)
# Arts complex
fillet_2 = Fillet(Curve=curve_2, Radius=fillet_radius_2)
surface_2 = Surface(fillet_2)
unit_z_2 = UnitZ(Factor=Slider(1.2, range=0..2.5))
extrude_2 = Extrude(Base=surface_2, Direction=unit_z_2)
deconstruct_brep_2 = DeconstructBrep(Brep=extrude_2)  # -> Faces, Edges, Vertices
list_item_2 = ListItem(List=deconstruct_brep_2.Faces, Index=Slider(4, range=0..10), Wrap=True)
cull_index_2 = CullIndex(List=deconstruct_brep_2.Faces, Indices=[0, 4], Wrap=True)
brep_2 = Brep(cull_index_2)

# ----
# Classroom
fillet_radius_3 = Slider(2, range=0..3)
curve_3 = Curve(<curve referenced from the Rhino model>)
fillet_3 = Fillet(Curve=curve_3, Radius=fillet_radius_3)
surface_3 = Surface(fillet_3)
unit_z_3 = UnitZ(Factor=Slider(1.2, range=0..2.5))
extrude_3 = Extrude(Base=surface_3, Direction=unit_z_3)
deconstruct_brep_3 = DeconstructBrep(Brep=extrude_3)  # -> Faces, Edges, Vertices
list_item_3 = ListItem(List=deconstruct_brep_3.Faces, Index=Slider(6, range=0..10), Wrap=True)
cull_index_3 = CullIndex(List=deconstruct_brep_3.Faces, Indices=[0, 2, 6], Wrap=True)
brep_3 = Brep(cull_index_3)

curve_4 = Curve(<curve referenced from the Rhino model>)
surface_4 = Surface(curve_4)
unit_z_4 = UnitZ(Factor=Slider(1.5, range=0..2.5))
extrude_4 = Extrude(Base=surface_4, Direction=unit_z_4)
deconstruct_brep_4 = DeconstructBrep(Brep=extrude_4)  # -> Faces, Edges, Vertices
list_item_4 = ListItem(List=deconstruct_brep_4.Faces, Index=Slider(4, range=0..10), Wrap=True)
cull_index_4 = CullIndex(List=deconstruct_brep_4.Faces, Indices=[0, 1, 2, 4], Wrap=True)
# Meshing
brep_4 = Brep(cull_index_4)

# ----
# Workshops complex
curve_5 = Curve(<curve referenced from the Rhino model>)
surface_5 = Surface(curve_5)
unit_z_5 = UnitZ(Factor=Slider(1.5, range=0..2.5))
extrude_5 = Extrude(Base=surface_5, Direction=unit_z_5)
deconstruct_brep_5 = DeconstructBrep(Brep=extrude_5)  # -> Faces, Edges, Vertices
list_item_5 = ListItem(List=deconstruct_brep_5.Faces, Index=Slider(3, range=0..10), Wrap=True)
cull_index_5 = CullIndex(List=deconstruct_brep_5.Faces, Indices=[0, 2, 4, 3], Wrap=True)
brep_5 = Brep(cull_index_5)

curve_6 = Curve(<curve referenced from the Rhino model>)
surface_6 = Surface(curve_6)
unit_z_6 = UnitZ(Factor=Slider(1.5, range=0..2.5))
extrude_6 = Extrude(Base=surface_6, Direction=unit_z_6)
deconstruct_brep_6 = DeconstructBrep(Brep=extrude_6)  # -> Faces, Edges, Vertices
list_item_6 = ListItem(List=deconstruct_brep_6.Faces, Index=Slider(3, range=0..10), Wrap=True)
cull_index_6 = CullIndex(List=deconstruct_brep_6.Faces, Indices=[0, 2, 4], Wrap=True)
brep_6 = Brep(cull_index_6)

# ----
# Kiosk
curve_7 = Curve(<curve referenced from the Rhino model>)
unit_z_7 = UnitZ(Factor=Slider(1.2, range=0..1.5))
boundary_surfaces = BoundarySurfaces(Edges=curve_7)
extrude_7 = Extrude(Base=boundary_surfaces, Direction=unit_z_7)
brep_7 = Brep(extrude_7)
deconstruct_brep_7 = DeconstructBrep(Brep=brep_7)  # -> Faces, Edges, Vertices
cull_index_7 = CullIndex(List=deconstruct_brep_7.Faces, Indices=[0, 2, 3, 5, 6], Wrap=True)  # -> flatten(List)

# ----
# Classroom 2
fillet_radius_4 = Slider(2, range=0..3)
curve_8 = Curve(<curve referenced from the Rhino model>)
fillet_4 = Fillet(Curve=curve_8, Radius=fillet_radius_4)
explode = Explode(Curve=fillet_4, Recursive=True)  # -> Segments, Vertices
unit_z_8 = UnitZ(Factor=Slider(1.2, range=0..1.5))
boundary_surfaces_2 = BoundarySurfaces(Edges=explode.Segments)
extrude_8 = Extrude(Base=boundary_surfaces_2, Direction=unit_z_8)
brep_8 = Brep(extrude_8)
deconstruct_brep_8 = DeconstructBrep(Brep=brep_8)  # -> Faces, Edges, Vertices
cull_index_8 = CullIndex(List=deconstruct_brep_8.Faces, Indices=[0, 2, 6], Wrap=True)  # -> flatten(List)

# ----
# Audio-Visual Room
fillet_radius_5 = Slider(2, range=0..3)
curve_9 = Curve(<curve referenced from the Rhino model>)
fillet_5 = Fillet(Curve=curve_9, Radius=fillet_radius_5)
explode_2 = Explode(Curve=fillet_5, Recursive=True)  # -> Segments, Vertices
unit_z_9 = UnitZ(Factor=Slider(1.2, range=0..1.5))
boundary_surfaces_3 = BoundarySurfaces(Edges=explode_2.Segments)
extrude_9 = Extrude(Base=boundary_surfaces_3, Direction=unit_z_9)
brep_9 = Brep(extrude_9)
deconstruct_brep_9 = DeconstructBrep(Brep=brep_9)  # -> Faces, Edges, Vertices
cull_index_9 = CullIndex(List=deconstruct_brep_9.Faces, Indices=[0, 6], Wrap=True)

point = Point(<point referenced from the Rhino model>)
curve_10 = Curve(fillet_2)
# Openings - 1.2m wide
point_2 = Point([<point referenced from the Rhino model> x3])
curve_closest_point = CurveClosestPoint(Point=point, Curve=curve_10)  # -> Point, Parameter, Distance
evaluate_curve = EvaluateCurve(Curve=curve_10, Parameter=curve_closest_point.Parameter)  # -> Point, Tangent, Angle
amplitude = Amplitude(Vector=evaluate_curve.Tangent, Amplitude=Slider(0.6, range=0..1.5))
unit_z_10 = UnitZ(Factor=Slider(0.9, range=0..1.5))
cross_product = CrossProduct(VectorA=evaluate_curve.Tangent, VectorB=unit_z_10, Unitize=False)  # -> Vector, Length
vector_display = VectorDisplay(Anchor=evaluate_curve.Point, Vector=amplitude)
multiplication = Multiplication(A=cross_product.Vector, B="-1")
multiplication_2 = Multiplication(A=unit_z_10, B="0.75")
multiplication_3 = Multiplication(A=amplitude, B="-1")
original_vector = Vector(amplitude)
cross_product_2 = Vector(multiplication)
point_3 = Point(evaluate_curve.Point)
vector = Vector(multiplication_3)
vector_2 = Vector(multiplication_2)
vector_display_2 = VectorDisplay(Anchor=point_3, Vector=cross_product_2)
move = Move(Geometry=point_3, Motion=vector)  # -> Geometry, Transform
move_2 = Move(Geometry=point_3, Motion=original_vector)  # -> Geometry, Transform
move_3 = Move(Geometry=move_2.Geometry, Motion=vector_2)  # -> Geometry, Transform
move_4 = Move(Geometry=move.Geometry, Motion=vector_2)  # -> Geometry, Transform
move_5 = Move(Geometry=point_3, Motion=unit_z_10)  # -> Geometry, Transform
line = Line(StartPoint=move_4.Geometry, EndPoint=move_5.Geometry)
line_2 = Line(StartPoint=move_2.Geometry, EndPoint=move_3.Geometry)
line_3 = Line(StartPoint=move_3.Geometry, EndPoint=move_5.Geometry)
line_4 = Line(StartPoint=move.Geometry, EndPoint=move_4.Geometry)
merge = Merge(Data1=line_2, Data2=line_4, Data3=line_3, Data4=line)
brep_10 = Brep(flatten(brep_2))
join_curves = JoinCurves(Curves=merge, Preserve=False)  # -> flatten(Curves)
extrude_10 = Extrude(Base=join_curves, Direction=cross_product_2)  # -> simplify(flatten(Extrusion))
split_brep_multiple = SplitBrepMultiple(Brep=graft(brep_10), Cutters=flatten(extrude_10))  # -> simplify(Result)
list_item_7 = ListItem(List=split_brep_multiple, Index=0, Wrap=True)  # -> flatten(Item)

# ----
# Openings - 1.8m wide
point_4 = Point(<point referenced from the Rhino model>)
point_5 = Point(<point referenced from the Rhino model>)  # disabled
curve_11 = Curve(fillet_2)
curve_closest_point_2 = CurveClosestPoint(Point=point_5, Curve=curve_11)  # -> Point, Parameter, Distance
evaluate_curve_2 = EvaluateCurve(Curve=curve_11, Parameter=curve_closest_point_2.Parameter)  # -> Point, Tangent, Angle
amplitude_2 = Amplitude(Vector=evaluate_curve_2.Tangent, Amplitude=Slider(0.9, range=0..1.5))
unit_z_11 = UnitZ(Factor=Slider(0.9, range=0..1.5))
cross_product_3 = CrossProduct(VectorA=evaluate_curve_2.Tangent, VectorB=unit_z_11, Unitize=False)  # -> Vector, Length
vector_display_3 = VectorDisplay(Anchor=evaluate_curve_2.Point, Vector=amplitude_2)
multiplication_4 = Multiplication(A=cross_product_3.Vector, B="-1")
multiplication_5 = Multiplication(A=unit_z_11, B="0.75")
multiplication_6 = Multiplication(A=amplitude_2, B="-1")
original_vector_2 = Vector(amplitude_2)
cross_product_4 = Vector(multiplication_4)
point_6 = Point(evaluate_curve_2.Point)
vector_3 = Vector(multiplication_6)
vector_4 = Vector(multiplication_5)
vector_display_4 = VectorDisplay(Anchor=point_6, Vector=cross_product_4)
move_6 = Move(Geometry=point_6, Motion=vector_3)  # -> Geometry, Transform
move_7 = Move(Geometry=point_6, Motion=original_vector_2)  # -> Geometry, Transform
move_8 = Move(Geometry=move_7.Geometry, Motion=vector_4)  # -> Geometry, Transform
move_9 = Move(Geometry=move_6.Geometry, Motion=vector_4)  # -> Geometry, Transform
move_10 = Move(Geometry=point_6, Motion=unit_z_11)  # -> Geometry, Transform
line_5 = Line(StartPoint=move_9.Geometry, EndPoint=move_10.Geometry)
line_6 = Line(StartPoint=move_7.Geometry, EndPoint=move_8.Geometry)
line_7 = Line(StartPoint=move_8.Geometry, EndPoint=move_10.Geometry)
line_8 = Line(StartPoint=move_6.Geometry, EndPoint=move_9.Geometry)
merge_2 = Merge(Data1=line_6, Data2=line_8, Data3=line_7, Data4=line_5)
brep_11 = Brep(flatten(list_item_7))
join_curves_2 = JoinCurves(Curves=merge_2, Preserve=False)  # -> flatten(Curves)
extrude_11 = Extrude(Base=join_curves_2, Direction=cross_product_4)  # -> simplify(flatten(Extrusion))
split_brep_multiple_2 = SplitBrepMultiple(Brep=flatten(brep_11), Cutters=flatten(extrude_11))  # -> simplify(Result)
list_item_8 = ListItem(List=split_brep_multiple_2, Index=0, Wrap=True)  # -> flatten(Item)

curve_12 = Curve(fillet)
# Openings - 1.2m wide
point_7 = Point(<point referenced from the Rhino model>)
point_8 = Point(<point referenced from the Rhino model>)
curve_closest_point_3 = CurveClosestPoint(Point=point_8, Curve=curve_12)  # -> Point, Parameter, Distance
evaluate_curve_3 = EvaluateCurve(Curve=curve_12, Parameter=curve_closest_point_3.Parameter)  # -> Point, Tangent, Angle
amplitude_3 = Amplitude(Vector=evaluate_curve_3.Tangent, Amplitude=Slider(0.6, range=0..1.5))
unit_z_12 = UnitZ(Factor=Slider(0.9, range=0..1.5))
cross_product_5 = CrossProduct(VectorA=evaluate_curve_3.Tangent, VectorB=unit_z_12, Unitize=False)  # -> Vector, Length
vector_display_5 = VectorDisplay(Anchor=evaluate_curve_3.Point, Vector=amplitude_3)
multiplication_7 = Multiplication(A=cross_product_5.Vector, B="-1")
multiplication_8 = Multiplication(A=unit_z_12, B="0.75")
multiplication_9 = Multiplication(A=amplitude_3, B="-1")
original_vector_3 = Vector(amplitude_3)
cross_product_6 = Vector(multiplication_7)
point_9 = Point(evaluate_curve_3.Point)
vector_5 = Vector(multiplication_9)
vector_6 = Vector(multiplication_8)
vector_display_6 = VectorDisplay(Anchor=point_9, Vector=cross_product_6)
move_11 = Move(Geometry=point_9, Motion=vector_5)  # -> Geometry, Transform
move_12 = Move(Geometry=point_9, Motion=original_vector_3)  # -> Geometry, Transform
move_13 = Move(Geometry=move_12.Geometry, Motion=vector_6)  # -> Geometry, Transform
move_14 = Move(Geometry=move_11.Geometry, Motion=vector_6)  # -> Geometry, Transform
move_15 = Move(Geometry=point_9, Motion=unit_z_12)  # -> Geometry, Transform
line_9 = Line(StartPoint=move_14.Geometry, EndPoint=move_15.Geometry)
line_10 = Line(StartPoint=move_12.Geometry, EndPoint=move_13.Geometry)
line_11 = Line(StartPoint=move_13.Geometry, EndPoint=move_15.Geometry)
line_12 = Line(StartPoint=move_11.Geometry, EndPoint=move_14.Geometry)
merge_3 = Merge(Data1=line_10, Data2=line_12, Data3=line_11, Data4=line_9)
brep_12 = Brep(flatten(brep))
join_curves_3 = JoinCurves(Curves=merge_3, Preserve=False)  # -> flatten(Curves)
extrude_12 = Extrude(Base=join_curves_3, Direction=cross_product_6)  # -> simplify(flatten(Extrusion))
split_brep_multiple_3 = SplitBrepMultiple(Brep=graft(brep_12), Cutters=flatten(extrude_12))  # -> simplify(Result)
list_item_9 = ListItem(List=split_brep_multiple_3, Index=0, Wrap=True)  # -> flatten(Item)

point_10 = Point([<point referenced from the Rhino model> x3])
point_11 = Point([<point referenced from the Rhino model> x6])
curve_13 = Curve(curve_5)
curve_closest_point_4 = CurveClosestPoint(Point=point_11, Curve=curve_13)  # -> Point, Parameter, Distance
evaluate_curve_4 = EvaluateCurve(Curve=curve_13, Parameter=curve_closest_point_4.Parameter)  # -> Point, Tangent, Angle
amplitude_4 = Amplitude(Vector=evaluate_curve_4.Tangent, Amplitude=Slider(0.6, range=0..1.5))
unit_z_13 = UnitZ(Factor=Slider(0.8, range=0..1.5))
cross_product_7 = CrossProduct(VectorA=evaluate_curve_4.Tangent, VectorB=unit_z_13, Unitize=False)  # -> Vector, Length
vector_display_7 = VectorDisplay(Anchor=evaluate_curve_4.Point, Vector=amplitude_4)
multiplication_10 = Multiplication(A=cross_product_7.Vector, B="-1")
multiplication_11 = Multiplication(A=unit_z_13, B="0.75")
multiplication_12 = Multiplication(A=amplitude_4, B="-1")
original_vector_4 = Vector(amplitude_4)
cross_product_8 = Vector(multiplication_10)
point_12 = Point(evaluate_curve_4.Point)
vector_7 = Vector(multiplication_12)
vector_8 = Vector(multiplication_11)
vector_display_8 = VectorDisplay(Anchor=point_12, Vector=cross_product_8)
move_16 = Move(Geometry=point_12, Motion=vector_7)  # -> Geometry, Transform
move_17 = Move(Geometry=point_12, Motion=original_vector_4)  # -> Geometry, Transform
move_18 = Move(Geometry=move_17.Geometry, Motion=vector_8)  # -> Geometry, Transform
move_19 = Move(Geometry=move_16.Geometry, Motion=vector_8)  # -> Geometry, Transform
move_20 = Move(Geometry=point_12, Motion=unit_z_13)  # -> Geometry, Transform
line_13 = Line(StartPoint=move_19.Geometry, EndPoint=move_20.Geometry)
line_14 = Line(StartPoint=move_17.Geometry, EndPoint=move_18.Geometry)
line_15 = Line(StartPoint=move_18.Geometry, EndPoint=move_20.Geometry)
line_16 = Line(StartPoint=move_16.Geometry, EndPoint=move_19.Geometry)
merge_4 = Merge(Data1=line_14, Data2=line_16, Data3=line_15, Data4=line_13)
brep_13 = Brep(flatten(brep_5))
join_curves_4 = JoinCurves(Curves=merge_4, Preserve=False)  # -> flatten(Curves)
extrude_13 = Extrude(Base=join_curves_4, Direction=cross_product_8)  # -> simplify(flatten(Extrusion))
split_brep_multiple_4 = SplitBrepMultiple(Brep=graft(brep_13), Cutters=flatten(extrude_13))  # -> simplify(Result)
list_item_10 = ListItem(List=split_brep_multiple_4, Index=0, Wrap=True)  # -> flatten(Item)

point_13 = Point([<point referenced from the Rhino model> x3])
point_14 = Point([<point referenced from the Rhino model> x7])
curve_14 = Curve(curve_6)
curve_closest_point_5 = CurveClosestPoint(Point=point_14, Curve=curve_14)  # -> Point, Parameter, Distance
evaluate_curve_5 = EvaluateCurve(Curve=curve_14, Parameter=curve_closest_point_5.Parameter)  # -> Point, Tangent, Angle
amplitude_5 = Amplitude(Vector=evaluate_curve_5.Tangent, Amplitude=Slider(0.6, range=0..1.5))
unit_z_14 = UnitZ(Factor=Slider(0.8, range=0..1.5))
cross_product_9 = CrossProduct(VectorA=evaluate_curve_5.Tangent, VectorB=unit_z_14, Unitize=False)  # -> Vector, Length
vector_display_9 = VectorDisplay(Anchor=evaluate_curve_5.Point, Vector=amplitude_5)
multiplication_13 = Multiplication(A=cross_product_9.Vector, B="-1")
multiplication_14 = Multiplication(A=unit_z_14, B="0.75")
multiplication_15 = Multiplication(A=amplitude_5, B="-1")
original_vector_5 = Vector(amplitude_5)
cross_product_10 = Vector(multiplication_13)
point_15 = Point(evaluate_curve_5.Point)
vector_9 = Vector(multiplication_15)
vector_10 = Vector(multiplication_14)
vector_display_10 = VectorDisplay(Anchor=point_15, Vector=cross_product_10)
move_21 = Move(Geometry=point_15, Motion=vector_9)  # -> Geometry, Transform
move_22 = Move(Geometry=point_15, Motion=original_vector_5)  # -> Geometry, Transform
move_23 = Move(Geometry=move_22.Geometry, Motion=vector_10)  # -> Geometry, Transform
move_24 = Move(Geometry=move_21.Geometry, Motion=vector_10)  # -> Geometry, Transform
move_25 = Move(Geometry=point_15, Motion=unit_z_14)  # -> Geometry, Transform
line_17 = Line(StartPoint=move_24.Geometry, EndPoint=move_25.Geometry)
line_18 = Line(StartPoint=move_22.Geometry, EndPoint=move_23.Geometry)
line_19 = Line(StartPoint=move_23.Geometry, EndPoint=move_25.Geometry)
line_20 = Line(StartPoint=move_21.Geometry, EndPoint=move_24.Geometry)
merge_5 = Merge(Data1=line_18, Data2=line_20, Data3=line_19, Data4=line_17)
brep_14 = Brep(flatten(brep_6))
join_curves_5 = JoinCurves(Curves=merge_5, Preserve=False)  # -> flatten(Curves)
extrude_14 = Extrude(Base=join_curves_5, Direction=cross_product_10)  # -> simplify(flatten(Extrusion))
split_brep_multiple_5 = SplitBrepMultiple(Brep=graft(brep_14), Cutters=flatten(extrude_14))  # -> simplify(Result)
list_item_11 = ListItem(List=split_brep_multiple_5, Index=0, Wrap=True)  # -> flatten(Item)

# ----
# Openings - 1.2m wide
brep_for_openings = Brep(flatten([cull_index_9, cull_index_8, cull_index_7]))

door_center = Point([<point referenced from the Rhino model> x3])
point_16 = Point([<point referenced from the Rhino model> x3])
curve_15 = Curve([fillet_5, fillet_4, curve_7])
curve_closest_point_6 = CurveClosestPoint(Point=door_center, Curve=curve_15)  # -> Point, Parameter, Distance
evaluate_curve_6 = EvaluateCurve(Curve=curve_15, Parameter=curve_closest_point_6.Parameter)  # -> Point, Tangent, Angle
amplitude_6 = Amplitude(Vector=evaluate_curve_6.Tangent, Amplitude=Slider(0.6, range=0..1.5))
unit_z_15 = UnitZ(Factor=Slider(1, range=0..1.5))
cross_product_11 = CrossProduct(VectorA=evaluate_curve_6.Tangent, VectorB=unit_z_15, Unitize=False)  # -> Vector, Length
vector_display_11 = VectorDisplay(Anchor=evaluate_curve_6.Point, Vector=amplitude_6)
multiplication_16 = Multiplication(A=cross_product_11.Vector, B="-1")
multiplication_17 = Multiplication(A=unit_z_15, B="0.75")
multiplication_18 = Multiplication(A=amplitude_6, B="-1")
original_vector_6 = Vector(amplitude_6)
cross_product_12 = Vector(multiplication_16)
point_17 = Point(evaluate_curve_6.Point)
vector_11 = Vector(multiplication_18)
vector_12 = Vector(multiplication_17)
vector_display_12 = VectorDisplay(Anchor=point_17, Vector=cross_product_12)
move_26 = Move(Geometry=point_17, Motion=vector_11)  # -> Geometry, Transform
move_27 = Move(Geometry=point_17, Motion=original_vector_6)  # -> Geometry, Transform
move_28 = Move(Geometry=move_27.Geometry, Motion=vector_12)  # -> Geometry, Transform
move_29 = Move(Geometry=move_26.Geometry, Motion=vector_12)  # -> Geometry, Transform
move_30 = Move(Geometry=point_17, Motion=unit_z_15)  # -> Geometry, Transform
line_21 = Line(StartPoint=move_29.Geometry, EndPoint=move_30.Geometry)
line_22 = Line(StartPoint=move_27.Geometry, EndPoint=move_28.Geometry)
line_23 = Line(StartPoint=move_28.Geometry, EndPoint=move_30.Geometry)
line_24 = Line(StartPoint=move_26.Geometry, EndPoint=move_29.Geometry)
merge_6 = Merge(Data1=line_22, Data2=line_24, Data3=line_23, Data4=line_21)
join_curves_6 = JoinCurves(Curves=merge_6, Preserve=False)  # -> flatten(Curves)
extrude_15 = Extrude(Base=join_curves_6, Direction=cross_product_12)  # -> simplify(flatten(Extrusion))
split_brep_multiple_6 = SplitBrepMultiple(Brep=graft(brep_for_openings), Cutters=flatten(extrude_15))  # -> simplify(Result)
list_item_12 = ListItem(List=split_brep_multiple_6, Index=0, Wrap=True)  # -> flatten(Item)

brep_join = BrepJoin(Breps=[list_item_10, list_item_11, brep_4])  # -> Breps, Closed

# ----
# Meshing
mesh_breps = MeshBreps(
    Brep=brep_join.Breps,
    MeshResolution=0.25,
    EdgeRefinementFactor=0.67,
    PointReduction=False,
    SmoothingStepSize=0,
    SmoothingIterations=5)  # -> flatten(Mesh), Info
mesh_join = MeshJoin(Meshes=mesh_breps.Mesh)
mesh_unifynormals = MeshUnifyNormals(Mesh=mesh_join)
unify_mesh = UnifyMesh(Mesh=mesh_unifynormals)  # -> Result, Count
mesh_weldvertices = MeshWeldVertices(Mesh=unify_mesh.Result, Tolerance=0.01)  # -> RuntimeMessage, Mesh
mesh_edges = MeshEdges(Mesh=unify_mesh.Result)  # -> NakedEdges, InteriorEdges, NonManifoldEdges
deconstruct_mesh = DeconstructMesh(Mesh=unify_mesh.Result)  # -> Vertices, Faces, Colours, Normals

deconstruct = Deconstruct(Point=deconstruct_mesh.Vertices)  # -> XComponent, YComponent, ZComponent
smaller_than = SmallerThan(FirstNumber=deconstruct.ZComponent, SecondNumber=Slider(0.1, range=0..0.1))  # -> SmallerThan, OrEqualTo
cull_pattern = CullPattern(List=deconstruct_mesh.Vertices, CullPattern=smaller_than.OrEqualTo)

line_25 = Line([mesh_edges.NakedEdges, mesh_edges.InteriorEdges])
s_point = Point(cull_pattern)

force = Slider(5, range=-20..200)  # disabled
sp_strengthortho = Slider(500, range=0..500)  # disabled
an_strength = Slider(2500, range=0..2500)  # disabled
springortho = Curve(flatten(line_25))  # disabled
particles = Point(flatten(deconstruct_mesh.Vertices))  # disabled
support = Point(flatten(s_point))  # disabled
unit_z_16 = UnitZ(Factor=force)  # disabled
load = Load(Point=particles, ForceVector=unit_z_16)  # disabled
length_line = LengthLine(Line=springortho, Strength=sp_strengthortho)  # disabled
anchor = Anchor(Point=support, Strength=an_strength)  # disabled
show = Show(G=unify_mesh.Result)  # disabled
show_2 = Show(G=springortho)  # disabled
show_3 = Show(G=particles)  # disabled
merge_7 = Merge(
    Data1=simplify(show),
    Data2=simplify(show_2),
    Data3=simplify(show_3),
    Data4=simplify(length_line),
    Data5=simplify(anchor),
    Data6=simplify(load))  # -> flatten(Result); disabled
boolean_toggle = BooleanToggle(True)  # disabled
reset_solver = Button()  # disabled
solver = Solver(GoalObjects=flatten(merge_7), Reset=reset_solver, Threshold=1e-15, Tolerance=0.01, On=boolean_toggle)  # -> I, V, O; disabled
number_slider = Slider(20, range=0..20)  # disabled
number_slider_2 = Slider(0, range=0..2)  # disabled
list_item_13 = ListItem(List=solver.O, Index=0, Wrap=True)  # disabled
weaverbird_s_laplacian_smoothing = WeaverbirdsLaplacianSmoothing(MeshCurves=list_item_13, Level=number_slider, SmoothNakedEdges=number_slider_2, Thin=1)  # disabled

final_mesh = Mesh(weaverbird_s_laplacian_smoothing)  # disabled

number_slider_3 = Slider(6, range=0..10)
explode_3 = Explode(Curve=fillet_3, Recursive=True)  # -> Segments, Vertices
list_item_14 = ListItem(List=explode_3.Vertices, Index=[5, 6], Wrap=True)

# ----
# Toilet
fillet_radius_6 = Slider(2, range=0..3)
curve_16 = Curve(<curve referenced from the Rhino model>)
fillet_6 = Fillet(Curve=curve_16, Radius=fillet_radius_6)
surface_7 = Surface(fillet_6)
unit_z_17 = UnitZ(Factor=Slider(1.2, range=0..2.5))

curve_closest_point_7 = CurveClosestPoint(Point=list_item_14, Curve=fillet_6)  # -> Point, Parameter, Distance
shatter = Shatter(Curve=fillet_6, Parameters=curve_closest_point_7.Parameter)
boundary_surfaces_4 = BoundarySurfaces(Edges=shatter)

extrude_16 = Extrude(Base=boundary_surfaces_4, Direction=unit_z_17)
deconstruct_brep_10 = DeconstructBrep(Brep=extrude_16)  # -> Faces, Edges, Vertices
cull_index_10 = CullIndex(List=deconstruct_brep_10.Faces, Indices=[0, 6, 9], Wrap=True)
brep_15 = Brep(cull_index_10)

# ----
# Openings - 1.2m wide
point_18 = Point([<point referenced from the Rhino model> x3])
point_19 = Point([<point referenced from the Rhino model> x3])
curve_17 = Curve([fillet_2, fillet_6, fillet_3])
curve_closest_point_8 = CurveClosestPoint(Point=point_19, Curve=curve_17)  # -> Point, Parameter, Distance
evaluate_curve_7 = EvaluateCurve(Curve=curve_17, Parameter=curve_closest_point_8.Parameter)  # -> Point, Tangent, Angle
amplitude_7 = Amplitude(Vector=evaluate_curve_7.Tangent, Amplitude=Slider(0.6, range=0..1.5))
unit_z_18 = UnitZ(Factor=Slider(0.9, range=0..1.5))
cross_product_13 = CrossProduct(VectorA=evaluate_curve_7.Tangent, VectorB=unit_z_18, Unitize=False)  # -> Vector, Length
vector_display_13 = VectorDisplay(Anchor=evaluate_curve_7.Point, Vector=amplitude_7)
multiplication_19 = Multiplication(A=cross_product_13.Vector, B="-1")
multiplication_20 = Multiplication(A=unit_z_18, B="0.75")
multiplication_21 = Multiplication(A=amplitude_7, B="-1")
original_vector_7 = Vector(amplitude_7)
cross_product_14 = Vector(multiplication_19)
point_20 = Point(evaluate_curve_7.Point)
vector_13 = Vector(multiplication_21)
vector_14 = Vector(multiplication_20)
vector_display_14 = VectorDisplay(Anchor=point_20, Vector=cross_product_14)
move_31 = Move(Geometry=point_20, Motion=vector_13)  # -> Geometry, Transform
move_32 = Move(Geometry=point_20, Motion=original_vector_7)  # -> Geometry, Transform
move_33 = Move(Geometry=move_32.Geometry, Motion=vector_14)  # -> Geometry, Transform
move_34 = Move(Geometry=move_31.Geometry, Motion=vector_14)  # -> Geometry, Transform
move_35 = Move(Geometry=point_20, Motion=unit_z_18)  # -> Geometry, Transform
line_26 = Line(StartPoint=move_34.Geometry, EndPoint=move_35.Geometry)
line_27 = Line(StartPoint=move_32.Geometry, EndPoint=move_33.Geometry)
line_28 = Line(StartPoint=move_33.Geometry, EndPoint=move_35.Geometry)
line_29 = Line(StartPoint=move_31.Geometry, EndPoint=move_34.Geometry)
merge_8 = Merge(Data1=line_27, Data2=line_29, Data3=line_28, Data4=line_26)
brep_16 = Brep(flatten([brep_15, brep_3]))
join_curves_7 = JoinCurves(Curves=merge_8, Preserve=False)  # -> flatten(Curves)
extrude_17 = Extrude(Base=join_curves_7, Direction=cross_product_14)  # -> simplify(flatten(Extrusion))
split_brep_multiple_7 = SplitBrepMultiple(Brep=graft(brep_16), Cutters=flatten(extrude_17))  # -> simplify(Result)
list_item_15 = ListItem(List=split_brep_multiple_7, Index=0, Wrap=True)  # -> flatten(Item)

point_21 = Point(<point referenced from the Rhino model>)
# Mirroring the geometry
brep_join_2 = BrepJoin(Breps=flatten(list_item_15))  # -> Breps, Closed
xz_plane = XZPlane(Origin=point_21)
mirror = Mirror(Geometry=brep_join_2.Breps, Plane=xz_plane)  # -> Geometry, Transform
brep_join_3 = BrepJoin(Breps=flatten(brep_join_2.Breps))  # -> Breps, Closed

brep_17 = Brep([brep_join_3.Breps, list_item_9])

mesh_breps_2 = MeshBreps(
    Brep=[list_item_8, mirror.Geometry],
    MeshResolution=0.25,
    EdgeRefinementFactor=0.67,
    PointReduction=False,
    SmoothingStepSize=0,
    SmoothingIterations=5)  # -> Mesh, Info
# Meshing
mesh_breps_3 = MeshBreps(
    Brep=brep_17,
    MeshResolution=0.25,
    EdgeRefinementFactor=0.67,
    PointReduction=False,
    SmoothingStepSize=0,
    SmoothingIterations=5)  # -> Mesh, Info
mesh_flip = MeshFlip(Mesh=mesh_breps_2.Mesh)
mesh_join_2 = MeshJoin(Meshes=[mesh_breps_3.Mesh, mesh_flip])
mesh_unifynormals_2 = MeshUnifyNormals(Mesh=mesh_join_2)
unify_mesh_2 = UnifyMesh(Mesh=mesh_unifynormals_2)  # -> Result, Count
mesh_weldvertices_2 = MeshWeldVertices(Mesh=unify_mesh_2.Result, Tolerance=0.01)  # -> RuntimeMessage, Mesh
mesh_edges_2 = MeshEdges(Mesh=mesh_weldvertices_2.Mesh)  # -> NakedEdges, InteriorEdges, NonManifoldEdges
deconstruct_mesh_2 = DeconstructMesh(Mesh=mesh_weldvertices_2.Mesh)  # -> Vertices, Faces, Colours, Normals

# ----
# Supports
deconstruct_2 = Deconstruct(Point=deconstruct_mesh_2.Vertices)  # -> XComponent, YComponent, ZComponent
smaller_than_2 = SmallerThan(FirstNumber=deconstruct_2.ZComponent, SecondNumber=Slider(0.1, range=0..0.1))  # -> SmallerThan, OrEqualTo
cull_pattern_2 = CullPattern(List=deconstruct_mesh_2.Vertices, CullPattern=smaller_than_2.OrEqualTo)

s_point_2 = Point(cull_pattern_2)
springs = Line([mesh_edges_2.NakedEdges, mesh_edges_2.InteriorEdges])

force_2 = Slider(8, range=-20..200)  # disabled
sp_strengthortho_2 = Slider(500, range=0..500)  # disabled
an_strength_2 = Slider(524, range=0..2500)  # disabled
springortho_2 = Curve(flatten(springs))  # disabled
particles_2 = Point(flatten(deconstruct_mesh_2.Vertices))  # disabled
support_2 = Point(flatten(s_point_2))  # disabled
unit_z_19 = UnitZ(Factor=force_2)  # disabled
load_2 = Load(Point=particles_2, ForceVector=unit_z_19)  # disabled
length_line_2 = LengthLine(Line=springortho_2, Strength=sp_strengthortho_2)  # disabled
anchor_2 = Anchor(Point=support_2, Strength=an_strength_2)  # disabled
show_4 = Show(G=mesh_weldvertices_2.Mesh)  # disabled
show_5 = Show(G=springortho_2)  # disabled
show_6 = Show(G=particles_2)  # disabled
merge_9 = Merge(
    Data1=simplify(show_4),
    Data2=simplify(show_5),
    Data3=simplify(show_6),
    Data4=simplify(length_line_2),
    Data5=simplify(anchor_2),
    Data6=simplify(load_2))  # -> flatten(Result); disabled
boolean_toggle_2 = BooleanToggle(True)  # disabled
reset_solver_2 = Button()  # disabled
solver_2 = Solver(GoalObjects=flatten(merge_9), Reset=reset_solver_2, Threshold=1e-15, Tolerance=0.01, On=boolean_toggle_2)  # -> I, V, reverse(O); disabled
number_slider_4 = Slider(20, range=0..20)  # disabled
number_slider_5 = Slider(0, range=0..2)  # disabled
list_item_16 = ListItem(List=solver_2.O, Index=0, Wrap=True)  # disabled
weaverbird_s_laplacian_smoothing_2 = WeaverbirdsLaplacianSmoothing(MeshCurves=list_item_16, Level=number_slider_4, SmoothNakedEdges=number_slider_5, Thin=1)  # disabled

final_mesh_2 = Mesh(weaverbird_s_laplacian_smoothing_2)  # disabled

# ----
# Reading Space
# Parameter for Shattering
fillet_radius_7 = Slider(2, range=0..3)
curve_18 = Curve(<curve referenced from the Rhino model>)
fillet_7 = Fillet(Curve=curve_18, Radius=fillet_radius_7)
explode_4 = Explode(Curve=fillet_7, Recursive=True)  # -> Segments, Vertices
unit_z_20 = UnitZ(Factor=Slider(1.2, range=0..1.5))

# ----
# Classes complex
# Classroom 1
fillet_radius_8 = Slider(2, range=0..3)
curve_19 = Curve(<curve referenced from the Rhino model>)
fillet_8 = Fillet(Curve=curve_19, Radius=fillet_radius_8)
unit_z_21 = UnitZ(Factor=Slider(1.2, range=0..1.5))

# ----
# Parameter for Shattering
explode_5 = Explode(Curve=curve_7, Recursive=True)  # -> Segments, Vertices
list_item_17 = ListItem(List=explode_5.Vertices, Index=[0, 4, 5], Wrap=True)
curve_closest_point_9 = CurveClosestPoint(Point=list_item_17, Curve=fillet_8)  # -> Point, Parameter, Distance

curve_20 = Curve(<curve referenced from the Rhino model>)
explode_6 = Explode(Curve=curve_20, Recursive=True)  # -> Segments, Vertices
list_item_18 = ListItem(List=explode_5.Vertices, Index=[1, 2, 3], Wrap=True)
list_item_19 = ListItem(List=explode_6.Vertices, Index=[1, 2, 3], Wrap=True)
curve_closest_point_10 = CurveClosestPoint(Point=list_item_19, Curve=fillet_7)  # -> Point, Parameter, Distance
curve_closest_point_11 = CurveClosestPoint(Point=list_item_18, Curve=fillet_7)  # -> Point, Parameter, Distance

shatter_2 = Shatter(Curve=fillet_8, Parameters=curve_closest_point_9.Parameter)
boundary_surfaces_5 = BoundarySurfaces(Edges=shatter_2)
extrude_18 = Extrude(Base=boundary_surfaces_5, Direction=unit_z_21)
brep_18 = Brep(extrude_18)
deconstruct_brep_11 = DeconstructBrep(Brep=brep_18)  # -> Faces, Edges, Vertices
cull_index_11 = CullIndex(List=deconstruct_brep_11.Faces, Indices=[0, 1, 2, 8], Wrap=True)  # -> flatten(List)

shatter_3 = Shatter(Curve=fillet_7, Parameters=[curve_closest_point_11.Parameter, curve_closest_point_10.Parameter])
boundary_surfaces_6 = BoundarySurfaces(Edges=shatter_3)
extrude_19 = Extrude(Base=boundary_surfaces_6, Direction=unit_z_20)
brep_19 = Brep(extrude_19)
deconstruct_brep_12 = DeconstructBrep(Brep=brep_19)  # -> Faces, Edges, Vertices
cull_index_12 = CullIndex(List=deconstruct_brep_12.Faces, Indices=[0, 1, 2, 6, 7], Wrap=True)

# ----
# Openings - 1.6m wide
point_22 = Point(<point referenced from the Rhino model>)
point_23 = Point(<point referenced from the Rhino model>)
curve_21 = Curve(fillet_7)
curve_closest_point_12 = CurveClosestPoint(Point=point_23, Curve=curve_21)  # -> Point, Parameter, Distance
evaluate_curve_8 = EvaluateCurve(Curve=curve_21, Parameter=curve_closest_point_12.Parameter)  # -> Point, Tangent, Angle
amplitude_8 = Amplitude(Vector=evaluate_curve_8.Tangent, Amplitude=Slider(0.8, range=0..1.5))
unit_z_22 = UnitZ(Factor=Slider(1, range=0..1.5))
cross_product_15 = CrossProduct(VectorA=evaluate_curve_8.Tangent, VectorB=unit_z_22, Unitize=False)  # -> Vector, Length
vector_display_15 = VectorDisplay(Anchor=evaluate_curve_8.Point, Vector=amplitude_8)
multiplication_22 = Multiplication(A=cross_product_15.Vector, B="-1")
multiplication_23 = Multiplication(A=unit_z_22, B="0.75")
multiplication_24 = Multiplication(A=amplitude_8, B="-1")
original_vector_8 = Vector(amplitude_8)
cross_product_16 = Vector(multiplication_22)
point_24 = Point(evaluate_curve_8.Point)
vector_15 = Vector(multiplication_24)
vector_16 = Vector(multiplication_23)
vector_display_16 = VectorDisplay(Anchor=point_24, Vector=cross_product_16)
move_36 = Move(Geometry=point_24, Motion=vector_15)  # -> Geometry, Transform
move_37 = Move(Geometry=point_24, Motion=original_vector_8)  # -> Geometry, Transform
move_38 = Move(Geometry=move_37.Geometry, Motion=vector_16)  # -> Geometry, Transform
move_39 = Move(Geometry=move_36.Geometry, Motion=vector_16)  # -> Geometry, Transform
move_40 = Move(Geometry=point_24, Motion=unit_z_22)  # -> Geometry, Transform
line_30 = Line(StartPoint=move_39.Geometry, EndPoint=move_40.Geometry)
line_31 = Line(StartPoint=move_37.Geometry, EndPoint=move_38.Geometry)
line_32 = Line(StartPoint=move_38.Geometry, EndPoint=move_40.Geometry)
line_33 = Line(StartPoint=move_36.Geometry, EndPoint=move_39.Geometry)
merge_10 = Merge(Data1=line_31, Data2=line_33, Data3=line_32, Data4=line_30)
brep_20 = Brep(flatten(cull_index_12))
join_curves_8 = JoinCurves(Curves=merge_10, Preserve=False)  # -> flatten(Curves)
extrude_20 = Extrude(Base=join_curves_8, Direction=cross_product_16)  # -> simplify(flatten(Extrusion))
split_brep_multiple_8 = SplitBrepMultiple(Brep=graft(brep_20), Cutters=flatten(extrude_20))  # -> simplify(Result)
list_item_20 = ListItem(List=split_brep_multiple_8, Index=0, Wrap=True)  # -> flatten(Item)

point_25 = Point(<point referenced from the Rhino model>)
# Mirroring the geometry
brep_join_4 = BrepJoin(Breps=flatten([cull_index_11, list_item_12]))  # -> Breps, Closed
yz_plane = YZPlane(Origin=point_25)
mirror_2 = Mirror(Geometry=brep_join_4.Breps, Plane=yz_plane)  # -> Geometry, Transform
brep_join_5 = BrepJoin(Breps=flatten([brep_join_4.Breps, mirror_2.Geometry, list_item_20]))  # -> Breps, Closed

brep_21 = Brep(brep_join_5.Breps)

# ----
# Meshing
mesh_breps_4 = MeshBreps(
    Brep=brep_21,
    MeshResolution=0.25,
    EdgeRefinementFactor=0.67,
    PointReduction=False,
    SmoothingStepSize=0,
    SmoothingIterations=5)  # -> Mesh, Info
mesh_join_3 = MeshJoin(Meshes=mesh_breps_4.Mesh)
mesh_unifynormals_3 = MeshUnifyNormals(Mesh=mesh_join_3)
unify_mesh_3 = UnifyMesh(Mesh=mesh_unifynormals_3)  # -> Result, Count
mesh_weldvertices_3 = MeshWeldVertices(Mesh=unify_mesh_3.Result, Tolerance=0.01)  # -> RuntimeMessage, Mesh
deconstruct_mesh_3 = DeconstructMesh(Mesh=mesh_weldvertices_3.Mesh)  # -> Vertices, Faces, Colours, Normals
mesh_edges_3 = MeshEdges(Mesh=mesh_weldvertices_3.Mesh)  # -> NakedEdges, InteriorEdges, NonManifoldEdges

# ----
# Supports
deconstruct_3 = Deconstruct(Point=deconstruct_mesh_3.Vertices)  # -> XComponent, YComponent, ZComponent
# Team2: Skills Center
# 05 Nov 2018
# ---------------
# Earthy course
# TU Delft, Building Technology Master Track
# ----------------
# Final Model Generation. Using Dynamic Relaxation in Kangaroo 2.0
# 
# For fast performance the kangaroo parts are disabled.
smaller_than_3 = SmallerThan(FirstNumber=deconstruct_3.ZComponent, SecondNumber=Slider(0.1, range=0..0.1))  # -> SmallerThan, OrEqualTo
cull_pattern_3 = CullPattern(List=deconstruct_mesh_3.Vertices, CullPattern=smaller_than_3.OrEqualTo)

line_34 = Line([mesh_edges_3.NakedEdges, mesh_edges_3.InteriorEdges])
s_point_3 = Point(cull_pattern_3)

force_3 = Slider(8, range=-20..200)  # disabled
sp_strengthortho_3 = Slider(500, range=0..500)  # disabled
an_strength_3 = Slider(2500, range=0..2500)  # disabled
springortho_3 = Curve(flatten(line_34))  # disabled
particles_3 = Point(flatten(deconstruct_mesh_3.Vertices))  # disabled
support_3 = Point(flatten(s_point_3))  # disabled
unit_z_23 = UnitZ(Factor=force_3)  # disabled
load_3 = Load(Point=particles_3, ForceVector=unit_z_23)  # disabled
length_line_3 = LengthLine(Line=springortho_3, Strength=sp_strengthortho_3)  # disabled
anchor_3 = Anchor(Point=support_3, Strength=an_strength_3)  # disabled
show_7 = Show(G=mesh_weldvertices_3.Mesh)  # disabled
show_8 = Show(G=springortho_3)  # disabled
show_9 = Show(G=particles_3)  # disabled
merge_11 = Merge(
    Data1=simplify(show_7),
    Data2=simplify(show_8),
    Data3=simplify(show_9),
    Data4=simplify(length_line_3),
    Data5=simplify(anchor_3),
    Data6=simplify(load_3))  # -> flatten(Result); disabled
boolean_toggle_3 = BooleanToggle(True)  # disabled
reset_solver_3 = Button()  # disabled
solver_3 = Solver(GoalObjects=flatten(merge_11), Reset=reset_solver_3, Threshold=1e-15, Tolerance=0.01, On=boolean_toggle_3)  # -> I, V, reverse(O); disabled
number_slider_6 = Slider(20, range=0..20)  # disabled
number_slider_7 = Slider(0, range=0..2)  # disabled
list_item_21 = ListItem(List=solver_3.O, Index=0, Wrap=True)  # disabled
weaverbird_s_laplacian_smoothing_3 = WeaverbirdsLaplacianSmoothing(MeshCurves=list_item_21, Level=number_slider_6, SmoothNakedEdges=number_slider_7, Thin=1)  # disabled

final_mesh_3 = Mesh(weaverbird_s_laplacian_smoothing_3)  # disabled
