# Grasshopper definition Task_2.gh (Grasshopper 1.0.7)

# ----
# Input
number_slider = Slider(34, range=0..100)
brep = Brep(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)

# ----
# Process
python = GhPythonScript(house=brep, distance=number_slider)  # -> out, exploded, not_exploded; inputs house: Brep
#   port house: the piglet's house brep
# ---------- python: Python ----------
import rhinoscriptsyntax as rs
import Rhino
from copy import copy

bounding_box= house.GetBoundingBox(True)
bbox_house=bounding_box.ToBrep()

area= Rhino.Geometry.AreaMassProperties.Compute(bbox_house)
bbox_center= area.Centroid

faces=house.Faces

not_exploded_faces=[]
exploded_faces=[]

for x,face in enumerate(faces):

    ext_face= faces.ExtractFace(x)
    not_exploded_faces.append(copy(ext_face))
    area= Rhino.Geometry.AreaMassProperties.Compute(ext_face)
    center= area.Centroid
    
    dir= center- bbox_center
    dir.Unitize()
    dir *= distance
    
    move= Rhino.Geometry.Transform.Translation(dir)
    ext_face.Transform(move)
    exploded_faces.append(ext_face)
    
    exploded= exploded_faces
    not_exploded= not_exploded_faces
# ---------- end python ----------

panel = Panel(python.out)

# ----
# Output
geo = Geometry(python.not_exploded)
geo_2 = Geometry(python.exploded)

# ----
# Visuals
preview = CustomPreview(Geometry=geo_2)

preview_2 = CustomPreview(Geometry=geo)
