# Grasshopper definition Task_3.gh (Grasshopper 1.0.7)

# ---- group: input
# Python logic
number_slider = Slider(4, range=0..10)
number_slider_2 = Slider(4, range=0..10)
number_slider_3 = Slider(4, range=0..10)
brep = Brep(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)

# ----
number_slider_4 = Slider(11, range=0..100)
# Grasshopper logic
bounding_box = BoundingBox(Content=brep, Plane=PlaneXY(0, 0, 0))  # -> Box, Box_2
brep_edges = BrepEdges(Brep=bounding_box.Box)  # -> Naked, Interior, NonManifold
list_item = ListItem(List=brep_edges.Interior, Index=0, Wrap=True)
length = Length(Curve=list_item)
division = Division(A=length, B=number_slider_4)
divide_curve = DivideCurve(Curve=list_item, Count=number_slider_4, Kinks=False)  # -> Points, Tangents, Parameters
division_2 = Division(A=division, B=2)
series = Series(Start=0, Step=division, Count=number_slider_4)
unit_y = UnitY(Factor=series)
unit_z = UnitZ(Factor=series)
center_box = CenterBox(Base=divide_curve.Points, X=division_2, Y=division_2, Z=division_2)
move = Move(Geometry=graft(center_box), Motion=unit_z)  # -> Geometry, Transform
move_2 = Move(Geometry=graft(move.Geometry), Motion=unit_y)  # -> Geometry, Transform
vector_xyz = VectorXYZ(XComponent=division_2, YComponent=division_2, ZComponent=division_2)  # -> Vector, Length
move_3 = Move(Geometry=move_2.Geometry, Motion=vector_xyz.Vector)  # -> simplify(Geometry), Transform
area = Area(Geometry=move_3.Geometry)  # -> Area, Centroid
brep_closest_point = BrepClosestPoint(Point=area.Centroid, Brep=brep)  # -> Point, Distance
distance = Distance(PointA=area.Centroid, PointB=brep_closest_point.Point)  # -> simplify(flatten(Distance))
bounds = Bounds(Numbers=distance)
deconstruct_domain = DeconstructDomain(Domain=bounds)  # -> Start, End
gradient = Gradient(
    LowerLimit=deconstruct_domain.Start,
    UpperLimit=deconstruct_domain.End,
    Parameter=distance,
    stops=[0: RGB(234, 38, 0), 0.257: RGB(234, 126, 0), 0.5: RGB(254, 244, 84), 0.75: RGB(173, 203, 249), 1: RGB(75, 107, 169)])
custom_preview = CustomPreview(Geometry=flatten(move_3.Geometry), Shader=gradient)

# ---- group: process
python_script = PythonScript(cone=brep, xs=number_slider, ys=number_slider_2, zs=number_slider_3)  # -> out, b, c; inputs cone: Brep
# ---------- python_script: Python ----------
import Rhino
import Rhino.Geometry as rg
import rhinoscriptsyntax
import math as math

#get bounding box for cone

bbox= cone.GetBoundingBox(True)
W= bbox.Diagonal.X
L= bbox.Diagonal.Y
H= bbox.Diagonal.Z
#XC is count of boxes 
points=[]
dist=[]

XC=int(math.ceil(W/xs))
YC=int(math.ceil(L/ys))
ZC=int(math.ceil(H/zs))

xshift = xs/2
yshift =ys/2
zshift =zs/2

bPoint= bbox.Min
bXV= rg.Vector3d.XAxis
bYV= rg.Vector3d.YAxis

bPlane= rg.Plane(bPoint, bXV, bYV)

for i in range(0,XC):
    for j in range(0,YC):
        for k in range(0,ZC):
            point= bPlane.PointAt(i*xs+xshift,j*ys+yshift,k*zs+zshift)
            points.append(point)
            cpoint= cone.ClosestPoint(point)
            distance= point.DistanceTo(cpoint)
            if (cone.IsPointInside(point,0.1,True)):
                distance= -distance
            else:
                distance= distance
            dist.append(distance)
            
b= points
c= dist

print(dist)
# ---------- end python_script ----------

# ---- group: output
xy_plane = XYPlane(Origin=python_script.b)
center_box_2 = CenterBox(Base=xy_plane, X=expr("x/2", number_slider), Y=expr("x/2", number_slider_2), Z=expr("x/2", number_slider_3))
bounds_2 = Bounds(Numbers=python_script.c)
deconstruct_domain_2 = DeconstructDomain(Domain=bounds_2)  # -> Start, End
gradient_2 = Gradient(
    LowerLimit=deconstruct_domain_2.Start,
    UpperLimit=deconstruct_domain_2.End,
    Parameter=python_script.c,
    stops=[0: RGB(234, 38, 0), 0.383: RGB(234, 126, 0), 0.577: RGB(254, 244, 84), 0.733: RGB(173, 203, 249), 1: RGB(75, 107, 169)])
panel = Panel(deconstruct_domain_2.End)
custom_preview_2 = CustomPreview(Geometry=center_box_2, Shader=gradient_2)
