# Grasshopper definition Task_4.gh (Grasshopper 0.9.76)
# plug-ins: Python Interpreter

# ---- group: Input
unit_z = UnitZ(Factor=1)
curve = Curve([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])

# Python
brep = Brep(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)
number_slider = Slider(20, range=0..100)
number_slider_2 = Slider(9.2, range=0..100)
number_slider_3 = Slider(5.2, range=0..100)

number_slider_4 = Slider(5.1, range=0..10)
number_slider_5 = Slider(9.2, range=0..10)
# GH
number_slider_6 = Slider(20.3, range=0..100)

# ---- group: Process
python_script = PythonScript(house=brep, sH=number_slider_3, sW=number_slider, sL=number_slider_2)  # -> out, contours, Cpt, brick; inputs house: Brep, sH: Int32
# ---------- python_script: Python ----------
#author:Ammar_Taher
#Date:14/09/2018
#TU_Delft_BK_BT
#student_number:4745639

import Rhino.Geometry as rg
import rhinoscriptsyntax as rs
import ghpythonlib
import math

#logic of algorithm
#contour curve create
#for curves list each item should be divided into points 
#evaluate each point to get the plane on it
#create the brick on the plane oriented with the tangent to this point parameter

#1_contour on the brep planes
height= (house.GetBoundingBox(house)).Max[2]
start= (house.GetBoundingBox(house)).Min[2]
b= rg.Point3d(0,0,start)                    #beginning of contour
e= rg.Point3d(0,0,height)                   # end of contour 
contours= house.CreateContourCurves(house,b,e,sH)

#2_divide the contours into points and create the brick at it
ptlist=[]
contourpts=[]
f=[]  
CPt=[]
bricks=[]

for i in contours:
    XC= math.ceil(i.GetLength()/((sW)**2+(sL)**2)**0.5)
    pt= i.DivideByCount(XC,True)
    ptlist.append(pt)
    for pts in pt:                          #this beacuse we want to access the points at the parameter of each point in the list
        point=i.PointAt(pts)
        CPt.append(point)
        (bool,frames)=i.FrameAt(pts)        # 3_add bool list to recieve the boolen values and frames recieve the frames
        f.append(frames)
        x=rg.Interval(0,sW)                 #creating the brick size
        y=rg.Interval(0,sL)
        z=rg.Interval(0,sH)
        brick=rg.Box(frames,x,y,z)          # 4_using frames makes it easier to align with the tangent to the curve
        bricks.append(brick)
        contourpts.append(pts)

brick= bricks
Cpt=CPt
Cpt_frame= f
# ---------- end python_script ----------

loft = Loft(Curves=curve, Options={Adjust=False, Closed=False, LoftEnds=0, LoftSimp=0, LoftType=0, Rebuild=10, Refit=0.01})
contour = Contour(Shape=loft, Point=Point(0, 0, 0), Direction=unit_z, Distance=number_slider_4)  # -> flatten(Contours)
dispatch = Dispatch(List=contour, DispatchPattern=[True, False])  # -> ListA, ListB
length = Length(Curve=dispatch.ListB)
length_2 = Length(Curve=dispatch.ListA)
division = Division(A=length_2, B=number_slider_5)
division_2 = Division(A=length, B=number_slider_5)
divide_curve = DivideCurve(Curve=flatten(dispatch.ListA), Count=flatten(division), Kinks=False)  # -> Points, Tangents, Parameters
divide_curve_2 = DivideCurve(Curve=flatten(dispatch.ListB), Count=flatten(division_2), Kinks=False)  # -> Points, Tangents, Parameters
number_slider_7 = Slider(0, range=0..10)
shift_list = ShiftList(List=divide_curve_2.Points, Shift=number_slider_7, Wrap=True)
shift_list_2 = ShiftList(List=divide_curve_2.Tangents, Shift=number_slider_7, Wrap=True)
cull_pattern = CullPattern(List=divide_curve.Points, CullPattern=[False, True])
cull_pattern_2 = CullPattern(List=divide_curve.Tangents, CullPattern=[False, True])
cull_pattern_3 = CullPattern(List=shift_list, CullPattern=[False, True])
cull_pattern_4 = CullPattern(List=shift_list_2, CullPattern=[False, True])
domain_box = DomainBox(Base=cull_pattern, X=number_slider_6, Y=number_slider_5, Z=number_slider_4)
domain_box_2 = DomainBox(Base=cull_pattern_3, X=number_slider_6, Y=number_slider_5, Z=number_slider_4)
rotate = Rotate(Geometry=domain_box, Center=cull_pattern, From=Vector(1, 0, 0), To=cull_pattern_2)  # -> Geometry, Transform
rotate_2 = Rotate(Geometry=domain_box_2, Center=cull_pattern_3, From=Vector(1, 0, 0), To=cull_pattern_4)  # -> Geometry, Transform

# ---- group: Output
brep_2 = Brep(python_script.brick)
# Author:Ammar_Taher
# Date:14/09/2018
# TUDelft_BK_BT
# Student_number:4745639
curve_2 = Curve(python_script.contours)
point = Point(python_script.Cpt)

# ----
output = Merge(Data1=rotate.Geometry, Data2=rotate_2.Geometry)
