# Grasshopper definition Task3_py_voxelisation_of_cone_Ivneet.gh (Grasshopper 1.0.7)

radius = Panel("5")
height = Panel("15")
number_slider = Slider(1, range=0..10)
cone = Cone(Base=PlaneXY(0, 0, 0), Radius=radius, Length=height)  # -> Cone, Tip
python_script = PythonScript(S=cone.Cone, xO=number_slider, yO=number_slider, zO=number_slider)  # -> out, a, b; inputs S: Brep
# ---------- python_script: Python ----------
import rhinoscriptsyntax as rs
import Rhino.Geometry as rg
import math

Bbox= S.GetBoundingBox(True)

W= Bbox.Diagonal.X
L= Bbox.Diagonal.Y
H= Bbox.Diagonal.Z

xC= int(math.ceil(W/xO))
yC= int(math.ceil(L/yO))
zC= int(math.ceil(H/zO))

xShift= xO/2
yShift= yO/2
zShift= zO/2 

points = []
dist = []

bPoint = Bbox.Min
bXV= rg.Vector3d.XAxis
bYV= rg.Vector3d.YAxis

bPlane = rg.Plane(bPoint, bXV, bYV)

for i in range(0,xC):
    for j in range(0,yC):
        for k in range(zC):
            point= bPlane.PointAt(i*xO+ xShift,j*yO + yShift,k*zO + zShift)
            points.append(point)
            cPoint= S.ClosestPoint(point)
            distance= point.DistanceTo(cPoint)
            if (S.IsPointInside(point, 0.1,True)):
                distance = -distance
            else:
                distance = distance
            dist.append(distance)
b= dist
a= points
# ---------- end python_script ----------
bounds = Bounds(Numbers=python_script.b)
xy_plane = XYPlane(Origin=python_script.a)
deconstruct_domain² = DeconstructDomain²(Domain=bounds)  # -> UComponent, VComponent
center_box = CenterBox(Base=xy_plane, X=expr("x/2", number_slider), Y=expr("x/2", number_slider), Z=expr("x/2", number_slider))
gradient = Gradient(
    LowerLimit=deconstruct_domain².UComponent,
    UpperLimit=deconstruct_domain².VComponent,
    Parameter=python_script.b,
    stops=[0: RGB(234, 38, 0), 0.25: RGB(234, 126, 0), 0.5: RGB(254, 244, 84), 0.75: RGB(173, 203, 249), 1: RGB(75, 107, 169)])
custom_preview = CustomPreview(Geometry=center_box, Shader=gradient)
