# Grasshopper definition Task4_py_rotating_bricks_Ivneet.gh (Grasshopper 0.9.76)
# plug-ins: Python Interpreter

height = Slider(9.2, range=0..10)
width = Slider(6.1, range=0..10)
length = Slider(20.3, range=0..100)
curve = Curve(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)
curve_2 = Curve(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)
python_script = PythonScript(x=curve, y=curve_2, length=length, width=height, height=width)  # -> out, a, b, c, d; inputs x: Curve, y: Curve
# ---------- python_script: Python ----------
import rhinoscriptsyntax as rs
import Rhino.Geometry as rg
import math

# Defining a function for Transforming Brick
def moving_brick(i,j,brick,trans_brick):
    #finding the closest point of the division on the contour
    _list= rg.Curve.ClosestPoint(i,j)
    t=_list[1]
    #finding the centroid
    area= rg.AreaMassProperties.Compute(brick)
    centroid= area.Centroid
    #duplicating the brick
    dup= rg.Brep.Duplicate(brick)
    #moving the origin point to center
    trans2= rg.Transform.Translation(-1*centroid.X,-1*centroid.Y,-1*centroid.Z)
    rg.Brep.Transform(dup,trans2)
    (_whatever,frame)= rg.Curve.FrameAt(i,t)
    #copying the XY plane from origin to every point to create translation of brick
    trans = rg.Transform.PlaneToPlane(rs.WorldXYPlane(),frame)
    rg.Brep.Transform(dup,trans)
    trans_brick.append(dup)

#Creating a brick box from inputs

#transforming the input values to intervals
u1 = rg.Interval(0,length)
v1 = rg.Interval(0,width)
w1 = rg.Interval(0,height)
brick= rg.Box(rs.WorldXYPlane(),u1,v1,w1)
brick=brick.ToBrep()

#creating a list of curves after input of curves
crvs = []
crvs.append(x)
crvs.append(y)


#lofting the curves to create a surface
cone= rs.AddLoftSrf(object_ids=crvs, loft_type=0)
cone = cone[0]
cone = rs.coercebrep(cone)
a= cone

#creating a bounding box around cone
bbox=rg.Surface.GetBoundingBox(cone,True)
diagonal= bbox.Diagonal
#converting the bounding box into Brep
bbox=bbox.ToBrep()
#Getting the wireframe from the Bounding Box
crv = rg.Brep.GetWireframe(bbox,0)
#Getting any edge along Z axis
crv = crv[11]

#creating contours between the 2 points of the line
point1 = crv.PointAtLength(0.0)
point2 = crv.PointAtLength(crv.GetLength())
contour= rg.Brep.CreateContourCurves(cone, point1, point2,height) 

#creating list for points on contours and translation of brick box on these points
point_brick = []
trans_brick= []
k=0

#using for loop to put bricks on every point in every curve
#using if else to cull the pattern of bricks
for i in contour:
    l=0
    small_segments= rg.Curve.DivideEquidistant(i,length)
    point_brick.append(small_segments)
    if k%2==0:
        for j in small_segments:
            if l%2==0:
                moving_brick(i,j,brick,trans_brick)
            l+=1
    else:
        for j in small_segments:
            if l%2!=0:
                moving_brick(i,j,brick,trans_brick)
            l+=1
    k+=1

b=trans_brick
c=point_brick
# ---------- end python_script ----------
