# Grasshopper definition Task_2.gh (Grasshopper 1.0.7)
# plug-ins: Wombat

# ----
# Input
brep = Brep(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)

# ----
# Process
python = GhPythonScript(house=brep, Distance=Slider(0.51, range=0..1))  # -> out, exploded, not_exploded, print; inputs house: Brep
# ---------- python: Python ----------
"""Explodes the piglet's house
    Inputs:
        house: the piglet's house brep
    Output:
        exploded: exploded faces
        not_exploded: not exploded faces"""

__author__ = "Mr. Wolf"
__version__ = "2018.09.04"

import rhinoscriptsyntax as rs
import Rhino.Geometry as rg
from copy import copy


bbox_house=house.GetBoundingBox(True)
bbox_house=bbox_house.ToBrep()  

# Area of what?
area = rg.AreaMassProperties.Compute(bbox_house)

# How do we find the center?
box_center = area.Centroid
print(box_center)
print(box_center)
# How do we get the faces of the house?
faces = house.Faces
print(house)
# What types do we need?
exploded_faces = []
not_exploded_faces = []

# What do we need to enumerate?
for i, sadface in enumerate( faces ):
    print(i, sadface)
    
    ext_face=faces.ExtractFace(i)
    #print(i , ext_face)
    not_exploded_faces.append(copy(ext_face))# saving original faces to a list for visualization
    #print(not_exploded_faces)
    area=  rg.AreaMassProperties.Compute(ext_face)
    center=area.Centroid
    
    # How do we create the vector for moving a face? (tip: compare two points)
    direction = center - box_center
    #print(direction)
    #print(box_center)
   
    
    #print(direction)
    direction = direction * Distance # distance multiplier (how far the face moves)
    #print(direction)
    move = rg.Transform.Translation(direction) # Defining the direction in terms Rhino understands
    
    # How do we move the faces?
    ext_face.Transform(move)
    
    exploded_faces.append(ext_face) # saving exploded faces to a list for visualization
    
# What do we output?
exploded = exploded_faces
not_exploded = not_exploded_faces
# ---------- end python ----------

brep_2 = Brep(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)  # disabled
bbox = BoundingBox(Content=brep_2, Plane=PlaneXY(0, 0, 0))  # -> Box, Box_2
debrep = DeconstructBrep(Brep=brep_2)  # -> Faces, Edges, Vertices

# ----
# Output
geo = Geometry(python.exploded)
geo_2 = Geometry(python.not_exploded)

# ----
# Visuals
number_slider = Slider(10, range=0..10)
randcol = RandomColor(Data=python.exploded, Seed=number_slider, FastMode=False)
preview = CustomPreview(Geometry=geo_2, Material=randcol)
preview_2 = CustomPreview(Geometry=geo, Material=randcol)

amoments = AreaMoments(Geometry=debrep.Faces)  # -> Area, Centroid, Inertia, InertiaError, Secondary, SecondaryError, Gyration
boxprop = BoxProperties(Box=bbox.Box)  # -> Center, Diagonal, Area, Volume, Degeneracy
geo_3 = Geometry(debrep.Faces)
vec2pt = Vector2Pt(PointA=boxprop.Center, PointB=amoments.Centroid, Unitize=False)  # -> Vector, Length
panel = Panel(python.out)
vdis = VectorDisplay(Anchor=amoments.Centroid, Vector=vec2pt.Vector)
multiplication = Multiplication(A=vec2pt.Vector, B=Slider(1, range=0..100))
move = Move(Geometry=debrep.Faces, Motion=multiplication)  # -> Geometry, Transform
vdis_2 = VectorDisplay(Anchor=boxprop.Center, Vector=vec2pt.Vector)
geo_4 = Geometry(debrep.Faces)
geo_5 = Geometry(move.Geometry)
randcol_2 = RandomColor(Data=geo_4, Seed=Slider(47, range=0..100), FastMode=False)
preview_3 = CustomPreview(Geometry=geo_5, Shader=randcol_2)
preview_4 = CustomPreview(Geometry=geo_4, Shader=randcol_2)
