# Grasshopper definition Task_3.gh (Grasshopper 1.0.7)

pt = ConstructPoint(XCoordinate=Slider(0, range=0..100), YCoordinate=0, ZCoordinate=0)
xy = XYPlane(Origin=pt)
number_slider = Slider(1, range=0..10)
cone = Cone(Base=xy, Radius=Slider(4.8, range=0..10), Length=Slider(10, range=0..10))  # -> Cone, Tip
xs = Integer(Slider(1, range=0..10))
ys = Integer(Slider(1, range=0..10))
zs = Integer(number_slider)
python = PythonScript(S=cone.Cone, xS=xs, yS=ys, zS=number_slider)  # -> out, a, b, c, d; inputs S: Brep
# ---------- python: Python ----------
import Rhino.Geometry as rg
import math as math
import rhinoscriptsyntax as rs

Bbox =S.GetBoundingBox(True)
W = Bbox.Diagonal.X
L = Bbox.Diagonal.Y
H = Bbox.Diagonal.Z
#print(W)
XC = int(math.ceil(W/xS))
YC = int(math.ceil(L/yS))
ZC = int(math.ceil(H/zS))

points = []
distList = []
print(Bbox)
bPoint = Bbox.Min
print(bPoint)
bXV = rg.Vector3d.XAxis
bYV = rg.Vector3d.YAxis

xShift = xS/2
yShift = yS/2
zShift = zS/2

bplane=rg.Plane(bPoint, bXV, bYV)

for i in range(0,XC):
    for j in range(0,YC):
        for k in range(0,ZC):
            point = bplane.PointAt(i*xS+xShift,j*yS+yShift,k*zS+zShift)
            points.append(point)
            cPoint = S.ClosestPoint(point)
            distance = point.DistanceTo(cPoint)
            if(S.IsPointInside(point, 0.1, True)):
                distance = -distance
            else:
                distance = distance
            distList.append(distance)
#print(distList)
b = points
c = distList
# ---------- end python ----------
xy_2 = XYPlane(Origin=python.b)
box = CenterBox(Base=xy_2, X=expr("x/2", xs), Y=expr("x/2", ys), Z=expr("x/2", zs))
bnd = Bounds(Numbers=python.c)
dedomain = DeconstructDomain(Domain=bnd)  # -> Start, End
gradient = Gradient(
    LowerLimit=dedomain.Start,
    UpperLimit=dedomain.End,
    Parameter=python.c,
    stops=[0: RGB(234, 38, 0), 0.25: RGB(234, 126, 0), 0.5: RGB(254, 244, 84), 0.75: RGB(173, 203, 249), 1: RGB(75, 107, 169)])
panel = Panel(python.c)
preview = CustomPreview(Geometry=box, Shader=gradient)
