# Grasshopper definition Task_2.gh (Grasshopper 0.9.76)
# plug-ins: Python Interpreter, Wombat

# ----
# Input
brep = Brep(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)

# ----
# Process
python = GhPythonScript(house=brep)  # -> out, exploded, not_exploded; inputs house: Brep
#   port house: the piglet's house brep
# ---------- python: Python ----------
import rhinoscriptsyntax as rs
import Rhino
from copy import copy

bbox_house = house.GetBoundingBox (True)
bbox_house = bbox_house.ToBrep()

center_of_the_box = Rhino.Geometry.AreaMassProperties.Compute(bbox_house)
centroid_box = center_of_the_box.Centroid

faces = house.Faces

exploded_faces = []
not_exploded_faces = []

for i, face in enumerate(faces):
    
    ext_face=faces.ExtractFace(i)
    not_exploded_faces.append(copy(ext_face))

    center_of_the_face = Rhino.Geometry.AreaMassProperties.Compute(ext_face)
    centroid_face = center_of_the_face.Centroid
    
    dir = centroid_face-centroid_box
    dir.Unitize()
    dir *= 10

    move = Rhino.Geometry.Transform.Translation(dir)
    ext_face.Transform(move)
    exploded_faces.append(ext_face)

exploded = exploded_faces
not_exploded = not_exploded_faces
# ---------- end python ----------

# ----
# Output
geo = Geometry(python.not_exploded)
geo_2 = Geometry(python.exploded)

# ----
# Visuals
number_slider = Slider(10, range=0..10)
randcol = RandomColor(Data=python.exploded, Seed=number_slider, FastMode=False)
preview = CustomPreview(Geometry=geo_2, Material=randcol)

preview_2 = CustomPreview(Geometry=geo, Material=randcol)
