# Grasshopper definition Task_3.gh (Grasshopper 1.0.7)

number_slider = Slider(1, range=0..100)
number_slider_2 = Slider(1, range=0..100)
number_slider_3 = Slider(1, range=0..100)
brep = Brep(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)
python_script = PythonScript(x=brep, y=number_slider, z=number_slider_2, u=number_slider_3)  # -> out, b, c; inputs x: Brep
# ---------- python_script: Python ----------
import rhinoscriptsyntax as rs
import Rhino.Geometry as rg
import math as math

#Bounding box of the brep
bbox = x.GetBoundingBox(True)

#Length, width and height of the bounding box
W = bbox.Diagonal.X
L = bbox.Diagonal.Y
H = bbox.Diagonal.Z

#diving the three axis by the dimension of the voxel

XC = int(math.ceil(W/y))
YC = int(math.ceil(L/z))
ZC = int(math.ceil(H/u))
print (ZC)

points = []
distlist = []

#Base plane
bpoint = bbox.Min
bXV = rg.Vector3d.XAxis
bYV = rg.Vector3d.YAxis

bplane = rg.Plane(bpoint, bXV, bYV)

xshift = y/2
yshift = z/2
zshift = u/2

for i in range (0,XC) :
    for j in range (0,YC) :
        for k in range (0,ZC) :
            point = bplane.PointAt(i*y + xshift, j*z + yshift, k*u + zshift)
            points.append(point)
            cpoint = x.ClosestPoint(point)
            distance = point.DistanceTo(cpoint)
            if (x.IsPointInside(point, 0.1, True)):
                distance = -distance
            else:
                distance = distance
            distlist.append(distance)
print distlist
b = points
c = distlist
# ---------- end python_script ----------
xy_plane = XYPlane(Origin=python_script.b)
center_box = CenterBox(Base=xy_plane, X=expr("x/2", number_slider), Y=expr("x/2", number_slider_2), Z=expr("x/2", number_slider_3))
number = Number(python_script.c)
bounds = Bounds(Numbers=number)
deconstruct_domain = DeconstructDomain(Domain=bounds)  # -> Start, End
gradient = Gradient(
    LowerLimit=deconstruct_domain.Start,
    UpperLimit=deconstruct_domain.End,
    Parameter=number,
    stops=[0: RGB(234, 38, 0), 0.25: RGB(234, 126, 0), 0.5: RGB(254, 244, 84), 0.75: RGB(173, 203, 249), 1: RGB(75, 107, 169)])
custom_preview = CustomPreview(Geometry=center_box, Shader=gradient)
