# Grasshopper definition Terrabayt_Karamba_Script.gh (Grasshopper 1.0.7)
# plug-ins: Karamba, Weaverbird, Kangaroo2 Components

curve = Curve(<curve referenced from the Rhino model>)
curve_2 = Curve(<curve referenced from the Rhino model>)
curve_3 = Curve(<curve referenced from the Rhino model>)
flip_curve = FlipCurve(Curve=curve)  # -> Curve, Flag
flip_curve_2 = FlipCurve(Curve=curve_2)  # -> Curve, Flag
flip_curve_3 = FlipCurve(Curve=curve_3)  # -> Curve, Flag
curve_4 = Curve(<curve referenced from the Rhino model>)
curve_5 = Curve(<curve referenced from the Rhino model>)
curve_6 = Curve(<curve referenced from the Rhino model>)
curve_7 = Curve(<curve referenced from the Rhino model>)
loft = Loft(
    Curves=[curve_4, flip_curve.Curve, curve_5, flip_curve_2.Curve, curve_6, flip_curve_3.Curve, curve_7],
    Options={Adjust=False, Closed=False, LoftEnds=0, LoftSimp=0, LoftType=0, Rebuild=10, Refit=0.01})
number_slider = Slider(25, range=0..100)
divide_curve = DivideCurve(Curve=curve_5, Count=expr("x*2", number_slider), Kinks=False)  # -> Points, Tangents, Parameters
divide_curve_2 = DivideCurve(Curve=curve_6, Count=expr("x*2", number_slider), Kinks=False)  # -> Points, Tangents, Parameters
mesh_surface = MeshSurface(Surface=loft, UCount=number_slider, VCount=number_slider, Overhang=True, Equalize=False)
nakedvertices = NakedVertices(Mesh=mesh_surface)  # -> ClothedIndex, NakedIndex, ClothedPts, NakedPts
mesh_edges = MeshEdges(Mesh=mesh_surface)  # -> NakedEdges, InteriorEdges, NonManifoldEdges
deconstruct_mesh = DeconstructMesh(Mesh=mesh_surface)  # -> Vertices, Faces, Colours, Normals
closest_point = ClosestPoint(Point=divide_curve_2.Points, Cloud=deconstruct_mesh.Vertices)  # -> ClosestPoint, CPIndex, Distance
closest_point_2 = ClosestPoint(Point=divide_curve.Points, Cloud=deconstruct_mesh.Vertices)  # -> ClosestPoint, CPIndex, Distance
cull_duplicates = CullDuplicates(Points=closest_point.ClosestPoint, Tolerance=1e-05, CullMode=3)  # -> Points, Indices, Valence
cull_duplicates_2 = CullDuplicates(Points=closest_point_2.ClosestPoint, Tolerance=1e-05, CullMode=3)  # -> Points, Indices, Valence
point = Point(nakedvertices.NakedPts)
unit_z = UnitZ(Factor=Slider(0.67, range=0..1))
merge = Merge(Data1=mesh_edges.NakedEdges, Data2=mesh_edges.InteriorEdges)
anchor = Anchor(Point=cull_duplicates.Points, Strength=Slider(8, range=0..10))
anchor_2 = Anchor(Point=point, Strength=10000)
anchor_3 = Anchor(Point=cull_duplicates_2.Points, Strength=Slider(9, range=0..10))
load = Load(Point=deconstruct_mesh.Vertices, ForceVector=unit_z)
length_line = LengthLine(Line=merge, Strength=10)
merge_2 = Merge(Data1=anchor_3, Data2=anchor, Data3=anchor_2)
merge_3 = Merge(Data1=flatten(merge_2), Data2=flatten(length_line), Data3=flatten(load))
solver = Solver(GoalObjects=merge_3, Reset=Toggle(False), Threshold=1e-15, Tolerance=0.01, On=True)  # -> I, V, O
point_2 = Point(solver.V)
line = Line(solver.O)

wbweave = WeaverbirdsMeshFromLinesWeaveBack(Lines=line, MaximumValence=4)

forcevisualize = Slider(1, range=0..8)

for_w_1kn_m2 = Number(0.707)
neg = Negative(Value=for_w_1kn_m2)  # disabled

# ----
# Dead Load
loads = LoadsKaramba(Vector=Vector(0, 0, -1), LCase=1, mode="Gravity")

# ----
# Mesh_Attributes
shell_mesh = Mesh(wbweave)
medges = MeshEdges(Mesh=shell_mesh)  # -> NakedEdges, InteriorEdges, NonManifoldEdges
naked_edges = Curve(medges.NakedEdges)

mesh = Mesh(shell_mesh)

# ----
# Element Definition
panel = Panel("shell_total")
meshtoshell = MeshToShellKaramba(Mesh=shell_mesh, Identifier=panel, LimitDistance_m=0.005)  # -> Element, Points, Info
mesh_points = Pos(meshtoshell.Points)

# ----
# NE WIND
vec = VectorXYZ(XComponent=neg, YComponent=neg, ZComponent=0)  # -> Vector, Length; disabled
line_2 = LineSDL(Start=mesh_points, Direction=vec.Vector, Length=forcevisualize)  # disabled
vdis = VectorDisplay(Anchor=mesh_points, Vector=line_2)  # disabled

# ----
# W WIND
vec_2 = VectorXYZ(XComponent=1, YComponent=0, ZComponent=0)  # -> Vector, Length; disabled
line_3 = LineSDL(Start=mesh_points, Direction=vec_2.Vector, Length=forcevisualize)  # disabled
vdis_2 = VectorDisplay(Anchor=mesh_points, Vector=line_3)  # disabled

# ----
# S WIND
vec_3 = VectorXYZ(XComponent=0, YComponent=1, ZComponent=0)  # -> Vector, Length; disabled
line_4 = LineSDL(Start=mesh_points, Direction=vec_3.Vector, Length=forcevisualize)  # disabled
vdis_3 = VectorDisplay(Anchor=mesh_points, Vector=line_4)  # disabled

# ----
# E WIND
vec_4 = VectorXYZ(XComponent=-1, YComponent=0, ZComponent=0)  # -> Vector, Length; disabled
line_5 = LineSDL(Start=mesh_points, Direction=vec_4.Vector, Length=forcevisualize)  # disabled
vdis_4 = VectorDisplay(Anchor=mesh_points, Vector=line_5)  # disabled

# ----
# NW WIND
vec_5 = VectorXYZ(XComponent=neg, YComponent=for_w_1kn_m2, ZComponent=0)  # -> Vector, Length; disabled
line_6 = LineSDL(Start=mesh_points, Direction=expr("-x", vec_5.Vector), Length=forcevisualize)  # disabled
vdis_5 = VectorDisplay(Anchor=mesh_points, Vector=line_6)  # disabled

# ----
# N WIND
vec_6 = VectorXYZ(XComponent=0, YComponent=1, ZComponent=0)  # -> Vector, Length; disabled
line_7 = LineSDL(Start=mesh_points, Direction=expr("-x", vec_6.Vector), Length=forcevisualize)  # disabled
vdis_6 = VectorDisplay(Anchor=mesh_points, Vector=line_7)  # disabled

# ----
# SE WIND
vec_7 = VectorXYZ(XComponent=neg, YComponent=for_w_1kn_m2, ZComponent=0)  # -> Vector, Length; disabled
line_8 = LineSDL(Start=mesh_points, Direction=vec_7.Vector, Length=forcevisualize)  # disabled
vdis_7 = VectorDisplay(Anchor=mesh_points, Vector=line_8)  # disabled

# ----
# SW WIND
vec_8 = VectorXYZ(XComponent=for_w_1kn_m2, YComponent=for_w_1kn_m2, ZComponent=0)  # -> Vector, Length
line_9 = LineSDL(Start=mesh_points, Direction=vec_8.Vector, Length=forcevisualize)
vdis_8 = VectorDisplay(Anchor=mesh_points, Vector=line_9)

# ----
# Sand Load
panel_2 = Panel("-1")
mesh_2 = Mesh(shell_mesh)
pos = Pos(mesh_points)
Z = UnitZ(Factor=panel_2)
loads_2 = LoadsKaramba(Vector=Z, Mesh=mesh_2, Pos=pos, LCase=2, mode="MeshLoad -Const.", menu=[buttons(off, on, off), buttons(on, on)])

pos_2 = Pos(mesh_points)

# ----
# Wind load
loads_3 = LoadsKaramba(
    Vector=vec_8.Vector,
    Mesh=mesh,
    Pos=pos_2,
    LCase=3,
    mode="MeshLoad -Const.",
    menu=[buttons(off, on, off), buttons(on, on)])

# ----
# LOADS
# OUTPUT
gravity = Load(loads)
sand = Load(loads_2)
wind = LoadKaramba(loads_3)
merge_4 = Merge(Data1=gravity, Data4=sand, Data5=wind)  # -> flatten(Result)

# ----
# inputs
pt = Point(mesh_points)
crv = Curve(naked_edges)

panel_3 = Panel(merge_4)

# ----
# Material
panel_4 = Panel("0.117")
matprops = MaterialPropertiesKaramba3D(
    FamilyOfMaterial="Adobe ",
    Name="bricks",
    YoungsModulus_kN_cm2=18.7,
    InPlaneShearModulus_kN_cm2=7.857,
    TransverseShearModulus_kN_cm2=7.857,
    SpecificWeight_kN_m3=1345,
    CoefficientOfThermalExpansion_1_C=6e-06,
    YieldStrength_kN_cm2=panel_4,
    mode="Isotrop")
material = MaterialKaramba(matprops)

pull = PullPoint(Point=pt, Geometry=crv, ClosestOnly=True)  # -> ClosestPoint, Distance
smaller = SmallerThan(FirstNumber=pull.Distance, SecondNumber="1e-5")  # -> SmallerThan, OrEqualTo
# Supports
cull = CullPattern(List=pt, CullPattern=smaller.SmallerThan)
supp = SupportKaramba(PosInd=cull, menu=[buttons(on, on, on, off, off, off)])

# ----
# Mesh to Shell & Analyze & Assemble
panel_5 = Panel("shell_total")
X = UnitX(Factor=1)
Z_2 = UnitZ(Factor=1)
orientate = OrientateElemKaramba(Shell=meshtoshell.Element, ShellIdentifier=panel_5, XOrientations=X, ZOrientations=Z_2, mode="Shell")

# ----
# outputs
support = SupportKaramba(supp)

# ----
# Verify
num = Number(expr("x/2", panel_4))
# Safety
num_2 = Number(panel_4)
allowable_compressive_stress = Panel(num_2)
allowable_tensile_stress = Panel(num)

# ----
# Usability
dist = Distance(PointA=Point(284.0214272, 31.5, 0), PointB=Point(288.5214272, 31.5, 0))
maximum_span = Panel(dist)
l_240 = Panel("240")
division = Division(A=maximum_span, B=l_240)
allowable_deflection = Panel(division)

cluster = Cluster()  # -> G_2, G_3
vdis_9 = VectorDisplay(Anchor=cluster.G_3, Vector=cluster.G_2)

range = Range(Domain=" 20 to 700", Steps="699")
int = Integer(range)
concat = Concatenate(FragmentA="shellCS", FragmentB=int, JoinSeparator="_")

thickness_cm = Slider(40, range=0..100)

# ----
# Cross Section
cross_sections = CrossSectionsKaramba(
    FamilyNameOfCrossSection="shellCS",
    NameOfCrossSection=flatten(""),
    Material=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,
    Height_cm=flatten(thickness_cm),
    mode="Shell - Const")  # -> flatten(CrossSection)
crosecselect = CrossSectionSelectorKaramba(CrossSections=cross_sections)  # -> CrossSection, Info
crosec = CrossSectionKaramba(crosecselect.CrossSection)

# ----
# Assembled Model
assemble = AssembleModelKaramba(
    Elem=orientate,
    Support=flatten(support),
    Load=flatten(merge_4),
    CrossSection=crosec,
    Material=material,
    LimitDistance_m=0.005)  # -> Model, Info, Mass_kg, CenterOfGravity
model = ModelKaramba(assemble.Model)

panel_6 = Panel(assemble.Mass_kg)
panel_7 = Panel(cross_sections)

# ----
# Reaction Forces
number_slider_2 = Slider(310, range=0..1000)

model_2 = Model(model)

# ----
# First Order Theory Analysis
# inputs
analyzethi = AnalyzeThIKaramba(Model=model_2)  # -> CalculatedModel, MaximumDisplacement_m, ResultingForceOfGravity_kN, ElasticEnergy_kNm

# ----
# inputs
model_3 = Model(analyzethi.CalculatedModel)
# Model Display
modelview = ModelViewKaramba(Model=model_3, LoadCaseFactorsForLinearSuperposition=1, IndexOfVisibleLoadcase=-1)  # -> Model, DeformedMesh, DeformedAxes, DeformedModel
shellview = ShellViewKaramba(Model=modelview.Model, IndexOfLayer=0)  # -> Model, MeshesOfRenderedShells, LegendColors, LegendTags
legend = Legend(Colour=shellview.LegendColors, Tags=shellview.LegendTags, LegendType=101)

mesh_3 = Mesh(shellview.MeshesOfRenderedShells)
stress_unit_conversion = Stress_Unit_Conversion(L=shellview.LegendTags)
panel_8 = Panel(shellview.Model)
item = ListItem(List=stress_unit_conversion, Index=17, Wrap=True)
item_2 = ListItem(List=stress_unit_conversion, Index=1, Wrap=True)
max_compressive_stress = Number(item_2)
max_tensile_stress = Number(item)

# ----
# Principle Stresses
G = Geometry(modelview.DeformedMesh)
popgeo = PopulateGeometry(Geometry=G, Count=number_slider_2, Seed=1)
shelllineresults = LineResultsOnShellsKaramba(
    AnalyzedModel=shellview.Model,
    Layer=0,
    ListOfSourcesOfPrincipalStressLinesLinesPoints=popgeo,
    SegmentLength_m=0.5,
    DA_deg=5,
    mode="PrincStress")  # -> AnalyzedModel, simplify(Lines1), simplify(Lines2)
crv_2 = Curve(shelllineresults.Lines1)
crv_3 = Curve(shelllineresults.Lines2)

panel_9 = Panel(analyzethi.MaximumDisplacement_m)
ma = MassAddition(Input=analyzethi.MaximumDisplacement_m)  # -> Result, PartialResults
smaller_2 = SmallerThan(FirstNumber=max_compressive_stress, SecondNumber=allowable_compressive_stress)  # -> SmallerThan, OrEqualTo
smaller_3 = SmallerThan(FirstNumber=max_tensile_stress, SecondNumber=allowable_tensile_stress)  # -> SmallerThan, OrEqualTo
max_deflection = Panel(ma.Result)

# ----
# outputs
model_4 = Model(analyzethi.CalculatedModel)

# ----
# Verify
smaller_4 = SmallerThan(FirstNumber=max_deflection, SecondNumber=allowable_deflection)  # -> SmallerThan, OrEqualTo
panel_10 = Panel(smaller_4.SmallerThan)

panel_11 = Panel(smaller_2.SmallerThan)
panel_12 = Panel(smaller_3.SmallerThan)

# ==== cluster Stress_Unit_Conversion
L = ClusterInput()
cull_i = CullIndex(List=L, Indices=0, Wrap=True)
panel = Panel(cull_i)
multiplication = Multiplication(A=cull_i, B=10)
ins = InsertItems(List=multiplication, Item="stress [N/mm^2]", Indices=0, Wrap=True)
L_2 = ClusterOutput(ins)
panel_2 = Panel(ins)

# ==== cluster Cluster
geo = ClusterInput()
G = ClusterInput()
vec = VectorXYZ(XComponent=0, YComponent=0, ZComponent=-0.007)  # -> Vector, Length
scale = Scale(Geometry=G, Center=Point(0, 0, 0), Factor=0.008)  # -> Geometry, Transform
geo_2 = Geometry(geo)
move = Move(Geometry=geo_2, Motion=vec.Vector)  # -> Geometry, Transform
G_2 = ClusterOutput(scale.Geometry)
G_3 = ClusterOutput(move.Geometry)
