# Grasshopper definition Terrabayt_Brick_Pattern_Script.gh (Grasshopper 1.0.7)
# plug-ins: Wombat

# ---- group: Volume
volume = Brep(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)
cap_holes = CapHoles(Brep=volume)
brep_volume = Brep(cap_holes)

# ---- group: Brick / Brick_Sizing_Int
height = Slider(40, range=0..100)
mortar = Slider(10, range=0..10)
width = Slider(90, range=0..100)
expression = Expression(x=width, y=mortar, Expression="(2*x)+y")
lenght = Integer(expression)

# ----
number_slider = Slider(10, range=0..10)  # disabled
number_slider_2 = Slider(10, range=0..10)  # disabled
number_slider_3 = Slider(10, range=0..10)  # disabled

# ---- group: Brick
rectangle = Rectangle(Plane=PlaneXY(0, 0, 0), XSize=lenght, YSize=width, Radius=0)  # -> Rectangle, Length
addition = Addition(A=lenght, B=mortar)
addition_2 = Addition(A=width, B=mortar)
addition_3 = Addition(A=height, B=mortar)
box_rectangle = BoxRectangle(Rectangle=rectangle.Rectangle, Height=height)
negative = Negative(Value=addition)
addition_4 = Addition(A=addition, B=addition_2)
rotate = Rotate(Geometry=box_rectangle, Angle=degrees(270), Plane=PlaneXY(0, 0, 0))  # -> Geometry, Transform
unit_y = UnitY(Factor=expr("x/2", lenght))
negative_2 = Negative(Value=addition_4)
move = Move(Geometry=rotate.Geometry, Motion=unit_y)  # -> Geometry, Transform

# ----
rectangle_2 = Rectangle(Plane=PlaneXY(0, 0, 0), XSize=number_slider, YSize=number_slider_2, Radius=0)  # -> Rectangle, Length; disabled
box_rectangle_2 = BoxRectangle(Rectangle=rectangle_2.Rectangle, Height=number_slider_3)  # disabled
number_slider_4 = Slider(3.166, range=0..10)  # disabled
number_slider_5 = Slider(3.436, range=0..10)  # disabled
number_slider_6 = Slider(1.875, range=0..10)  # disabled
number_slider_7 = Slider(2.654, range=0..10)  # disabled
number_slider_8 = Slider(6.768, range=0..10)  # disabled
box_corners = BoxCorners(Box=box_rectangle_2)  # -> CornerA, CornerB, CornerC, CornerD, CornerE, CornerF, CornerG, CornerH; disabled
line = Line(StartPoint=box_corners.CornerE, EndPoint=box_corners.CornerG)  # disabled
line_2 = Line(StartPoint=box_corners.CornerH, EndPoint=box_corners.CornerG)  # disabled
line_3 = Line(StartPoint=box_corners.CornerF, EndPoint=box_corners.CornerE)  # disabled
line_4 = Line(StartPoint=box_corners.CornerB, EndPoint=box_corners.CornerE)  # disabled
line_5 = Line(StartPoint=box_corners.CornerB, EndPoint=box_corners.CornerA)  # disabled

# ---- group: Brick / Integers
brick_lenght_width_2mortar_negative = Integer(negative_2)
brick_lenght_mortar_negative = Integer(negative)
brick_lenght_width_2mortar = Integer(addition_4)
brick_lenght_mortar = Integer(addition)
brick_height_mortar = Integer(addition_3)
brick_width_mortar = Integer(addition_2)
brick_width = Integer(width)

# ---- group: Brick / Breps
rotated_brick = Brep(move.Geometry)
brick = Brep(box_rectangle)

# ----
negative_3 = Negative(Value=number_slider_8)  # disabled
negative_4 = Negative(Value=number_slider_7)  # disabled
vector_xyz = VectorXYZ(XComponent=0, YComponent=number_slider_5, ZComponent=number_slider_4)  # -> Vector, Length; disabled
midpoint = Midpoint(Curve=line)  # disabled
midpoint_2 = Midpoint(Curve=line_3)  # disabled
unit_z = UnitZ(Factor=number_slider_6)  # disabled
midpoint_3 = Midpoint(Curve=line_4)  # disabled
midpoint_4 = Midpoint(Curve=line_5)  # disabled
unit_y_2 = UnitY(Factor=negative_4)  # disabled
unit_y_3 = UnitY(Factor=negative_3)  # disabled
move_2 = Move(Geometry=midpoint, Motion=vector_xyz.Vector)  # -> Geometry, Transform; disabled
move_3 = Move(Geometry=midpoint_2, Motion=unit_z)  # -> Geometry, Transform; disabled
midpoint_5 = Midpoint(Curve=line_2)  # disabled
move_4 = Move(Geometry=midpoint_3, Motion=unit_y_2)  # -> Geometry, Transform; disabled
move_5 = Move(Geometry=midpoint_4, Motion=unit_y_3)  # -> Geometry, Transform; disabled

# ---- group: Voxelisation / Integers
brick_width_mortar_2 = Integer(brick_width_mortar)
brick_height_mortar_2 = Integer(brick_height_mortar)
brick_lenght_mortar_2 = Integer(brick_lenght_mortar)

# ---- group: Voxelisation
brep_volume_2 = Brep(brep_volume)
int_voxel_size_z = Integer(brick_height_mortar_2)
int_voxel_size_y = Integer(expr("x/2", brick_width_mortar_2))
int_voxel_size_x = Integer(expr("x/4", brick_lenght_mortar_2))
python = PythonScript(S=brep_volume_2, yS=int_voxel_size_y, zS=int_voxel_size_z, xS=int_voxel_size_x)  # -> out, a, c, b; inputs S: Mesh, yS: Int32, zS: Int32, xS: Int32
# ---------- python: Python ----------
import Rhino.Geometry as rg
import math as math
#find the bounding box of the brep
Bbox= S.GetBoundingBox(True)

#find the L,W,H of the Bbox usind the diagonal vector ! the x of this vector will be out L the y the W and z the H
W= Bbox.Diagonal.X
L= Bbox.Diagonal.Y
H= Bbox.Diagonal.Z #WHEN YOU WRITE .Z python extracts Z value

#HOW MANY VOXELS? take the W of the bounding box and divide it with W of the voxel xS
XC= int(math.ceil(W/xS)) #int fot integer # math.ceil na to pianei apo tin arxi
YC= int(math.ceil(L/yS))
ZC= int(math.ceil(H/zS))

#Divide the 3 axis of the bounding box by the dimensions of the voxel
# This will gine you a U,V,W value  along the bounding box
#Turn this value into an integer by finding the text biggest integer (roundingUp)

#Create a container for your Point List
points=[]


#Create a base plane for all the geometry
#! you will create the plane (base od the voxel) usung a starting point and two vectors the x,y to create the base plane
bPoint= Bbox.Min # starting point
bXvector= rg.Vector3d.XAxis #Vector OF X DIRECTION first for the creation of the plane
bYvector= rg.Vector3d.YAxis# 2ND Vector
#NOW I can create the plane with starting point and the 2 vectors
bPlane= rg.Plane(bPoint, bXvector,bYvector)
#Due to the fact that all voxels are based  on the center points, we need to create a shift towards the voxel's center, which is half of each dimension

# Write a loop that iteraetes through all U,V,W values of the bboox
#store the points in a list


for i in range(0,XC):
    for j in range(0,YC):
        for k in range(0,ZC):
            point= bPlane.PointAt(i*xS,j*yS,k*zS) #zS fot rhe scale of the voxel 
            points.append(point)

b=points
# ---------- end python ----------
point = Point(python.b)
rectangle_3 = Rectangle(Plane=point, XSize=int_voxel_size_y, YSize=int_voxel_size_z, Radius=0)  # -> Rectangle, Length
box_rectangle_3 = BoxRectangle(Rectangle=rectangle_3.Rectangle, Height=int_voxel_size_x)
shape_in_brep = ShapeInBrep(Brep=brep_volume_2, Shape=box_rectangle_3)
member_index = MemberIndex(Set=shape_in_brep, Member=0)  # -> Index, Count
member_index_2 = MemberIndex(Set=shape_in_brep, Member=1)  # -> Index, Count
list_item = ListItem(List=point, Index=[member_index_2.Index, member_index.Index], Wrap=True)

# ----
interpolate_t = InterpolateT(
    Vertices=[midpoint_5, move_2.Geometry, move_3.Geometry, move_4.Geometry, move_5.Geometry],
    Degree=3,
    TangentStart=Vector(0, 0, 0),
    TangentEnd=Vector(0, 0, 0),
    KnotStyle=1)  # -> Curve, Length, Domain; disabled
scale_nu = ScaleNU(Geometry=interpolate_t.Curve, Plane=PlaneXY(0, 0, 0), ScaleX=100, ScaleY=100, ScaleZ=100)  # -> Geometry, Transform; disabled

# ---- group: Voxelisation / Point_list
voxelgrid_involume = Point(list_item)

# ---- group: Brick_Pattern_One_Direction / Breps
brick_2 = Brep(brick)
brep_volume_3 = Brep(brep_volume)

# ---- group: Brick_Pattern_Two_Directions / Breps
brick_3 = Brep(brick)  # disabled
rotated_brick_2 = Brep(rotated_brick)  # disabled
brep_volume_4 = Brep(brep_volume)  # disabled

# ---- group: Brick_Pattern_One_Direction / Integers
brick_width_2 = Integer(brick_width)
brick_lenght_mortar_3 = Integer(brick_lenght_mortar)
brick_width_mortar_3 = Integer(brick_width_mortar)
brick_height_mortar_3 = Integer(brick_height_mortar)
brick_lenght_mortar_negative_2 = Integer(brick_lenght_mortar_negative)

# ---- group: Brick_Pattern_One_Direction / Point_list
voxelgrid_involume_2 = Point(voxelgrid_involume)

# ---- group: Brick_Pattern_Two_Directions / Point_list
voxelgrid_involume_3 = Point(voxelgrid_involume)  # disabled

# ---- group: Brick_Pattern_Two_Directions / Integers
brick_lenght_mortar_4 = Integer(brick_lenght_mortar)  # disabled
brick_width_mortar_4 = Integer(brick_width_mortar)  # disabled
brick_height_mortar_4 = Integer(brick_height_mortar)  # disabled
brick_lenght_mortar_negative_3 = Integer(brick_lenght_mortar_negative)  # disabled
brick_lenght_width_2mortar_2 = Integer(brick_lenght_width_2mortar)  # disabled
brick_lenght_width_2mortar_negative_2 = Integer(brick_lenght_width_2mortar_negative)  # disabled

# ---- group: Brick_Pattern_One_Direction
deconstruct_brep = DeconstructBrep(Brep=brep_volume_3)  # -> Faces, Edges, Vertices
inside_surface_index = Slider(5, range=0..10)
bottom_edge_vertice_index = Slider(7, range=0..10)
list_item_2 = ListItem(List=deconstruct_brep.Faces, Index=inside_surface_index, Wrap=True)
list_item_3 = ListItem(List=deconstruct_brep.Vertices, Index=bottom_edge_vertice_index, Wrap=True)
contour = Contour(Shape=list_item_2, Point=Point(0, 0, 0), Direction=Vector(0, 0, 1), Distance=brick_height_mortar_3)  # -> flatten(Contours)
scale = Scale(Geometry=brep_volume_3, Center=list_item_3, Factor=0.999)  # -> Geometry, Transform
dispatch = Dispatch(List=contour, DispatchPattern=[True, False])  # -> ListA, ListB
division = Division(A=brick_width_2, B=-2)
division_2 = Division(A=brick_width_2, B=-1)
extend_curve = ExtendCurve(Curve=dispatch.ListA, Type=0, Start=division, End=0)
extend_curve_2 = ExtendCurve(Curve=dispatch.ListB, Type=0, Start=division_2, End=division)
estimated_tickness_in_layers = Slider(3, range=0..10)
divide_length = DivideLength(Curve=[extend_curve, extend_curve_2], Length=brick_width_mortar_3)  # -> Points, Tangents, Parameters
unit_x = UnitX(Factor=brick_lenght_mortar_negative_2)
unit_x_2 = UnitX(Factor=brick_lenght_mortar_3)
linear_array = LinearArray(Geometry=divide_length.Points, Direction=unit_x, Count=estimated_tickness_in_layers)  # -> Geometry, Transform
linear_array_2 = LinearArray(Geometry=divide_length.Points, Direction=unit_x_2, Count=estimated_tickness_in_layers)  # -> Geometry, Transform
point_2 = Point(flatten([linear_array_2.Geometry, linear_array.Geometry]))
cull_duplicates = CullDuplicates(Points=point_2, Tolerance=0.1, CullMode=3)  # -> Points, Indices, Valence
point_in_brep = PointInBrep(Brep=scale.Geometry, Point=cull_duplicates.Points, Strict=False)
dispatch_2 = Dispatch(List=cull_duplicates.Points, DispatchPattern=point_in_brep)  # -> ListA, ListB
closest_point = ClosestPoint(Point=dispatch_2.ListA, Cloud=voxelgrid_involume_2)  # -> ClosestPoint, CPIndex, Distance
vector_2pt = Vector2Pt(PointA=Point(0, 0, 0), PointB=closest_point.ClosestPoint, Unitize=False)  # -> Vector, Length
move_6 = Move(Geometry=brick_2, Motion=vector_2pt.Vector)  # -> Geometry, Transform

# ---- group: Brick_Pattern_Two_Directions
deconstruct_brep_2 = DeconstructBrep(Brep=brep_volume_4)  # -> Faces, Edges, Vertices; disabled
inside_surface_index_2 = Slider(5, range=0..10)  # disabled
bottom_edge_vertice_index_2 = Slider(7, range=0..10)  # disabled
list_item_4 = ListItem(List=deconstruct_brep_2.Faces, Index=inside_surface_index_2, Wrap=True)  # disabled
list_item_5 = ListItem(List=deconstruct_brep_2.Vertices, Index=bottom_edge_vertice_index_2, Wrap=True)  # disabled
contour_2 = Contour(Shape=list_item_4, Point=Point(0, 0, 0), Direction=Vector(0, 0, 1), Distance=brick_height_mortar_4)  # -> flatten(Contours); disabled
scale_2 = Scale(Geometry=brep_volume_4, Center=list_item_5, Factor=0.999)  # -> Geometry, Transform; disabled
dispatch_3 = Dispatch(List=contour_2, DispatchPattern=[True, False])  # -> ListA, ListB; disabled
extend_curve_3 = ExtendCurve(Curve=dispatch_3.ListA, Type=0, Start=expr("x/-2", brick_width_mortar_4), End=0)  # disabled
estimated_tickness_in_layers_2 = Slider(2, range=0..10)  # disabled
unit_x_3 = UnitX(Factor=brick_width_mortar_4)  # disabled
divide_length_2 = DivideLength(Curve=extend_curve_3, Length=brick_lenght_mortar_4)  # -> Points, Tangents, Parameters; disabled
divide_length_3 = DivideLength(Curve=dispatch_3.ListB, Length=brick_width_mortar_4)  # -> Points, Tangents, Parameters; disabled
divide_length_4 = DivideLength(Curve=dispatch_3.ListA, Length=brick_width_mortar_4)  # -> Points, Tangents, Parameters; disabled
unit_x_4 = UnitX(Factor=brick_lenght_width_2mortar_negative_2)  # disabled
unit_x_5 = UnitX(Factor=brick_lenght_width_2mortar_2)  # disabled
unit_x_6 = UnitX(Factor=brick_lenght_mortar_negative_3)  # disabled
unit_x_7 = UnitX(Factor=brick_lenght_mortar_4)  # disabled
unit_x_8 = UnitX(Factor=brick_width_mortar_4)  # disabled
negative_5 = Negative(Value=unit_x_3)  # disabled
linear_array_3 = LinearArray(Geometry=divide_length_2.Points, Direction=unit_x_4, Count=estimated_tickness_in_layers_2)  # -> Geometry, Transform; disabled
linear_array_4 = LinearArray(Geometry=divide_length_2.Points, Direction=unit_x_5, Count=estimated_tickness_in_layers_2)  # -> Geometry, Transform; disabled
linear_array_5 = LinearArray(Geometry=divide_length_3.Points, Direction=unit_x_6, Count=estimated_tickness_in_layers_2)  # -> Geometry, Transform; disabled
linear_array_6 = LinearArray(Geometry=divide_length_3.Points, Direction=unit_x_7, Count=estimated_tickness_in_layers_2)  # -> Geometry, Transform; disabled
move_7 = Move(Geometry=divide_length_4.Points, Motion=unit_x_8)  # -> Geometry, Transform; disabled
move_8 = Move(Geometry=divide_length_4.Points, Motion=negative_5)  # -> Geometry, Transform; disabled
point_3 = Point(flatten([linear_array_3.Geometry, linear_array_4.Geometry]))  # disabled
point_4 = Point(flatten([linear_array_6.Geometry, linear_array_5.Geometry]))  # disabled
point_5 = Point(flatten([move_8.Geometry, move_7.Geometry]))  # disabled
cull_duplicates_2 = CullDuplicates(Points=point_3, Tolerance=0.1, CullMode=3)  # -> Points, Indices, Valence; disabled
cull_duplicates_3 = CullDuplicates(Points=point_4, Tolerance=0.1, CullMode=3)  # -> Points, Indices, Valence; disabled
point_in_brep_2 = PointInBrep(Brep=scale_2.Geometry, Point=cull_duplicates_2.Points, Strict=False)  # disabled
point_in_brep_3 = PointInBrep(Brep=scale_2.Geometry, Point=cull_duplicates_3.Points, Strict=False)  # disabled
point_in_brep_4 = PointInBrep(Brep=scale_2.Geometry, Point=point_5, Strict=False)  # disabled
dispatch_4 = Dispatch(List=cull_duplicates_2.Points, DispatchPattern=point_in_brep_2)  # -> ListA, ListB; disabled
dispatch_5 = Dispatch(List=cull_duplicates_3.Points, DispatchPattern=point_in_brep_3)  # -> ListA, ListB; disabled
dispatch_6 = Dispatch(List=point_5, DispatchPattern=point_in_brep_4)  # -> ListA, ListB; disabled
closest_point_2 = ClosestPoint(Point=dispatch_4.ListA, Cloud=voxelgrid_involume_3)  # -> ClosestPoint, CPIndex, Distance; disabled
closest_point_3 = ClosestPoint(Point=dispatch_5.ListA, Cloud=voxelgrid_involume_3)  # -> ClosestPoint, CPIndex, Distance; disabled
closest_point_4 = ClosestPoint(Point=dispatch_6.ListA, Cloud=voxelgrid_involume_3)  # -> ClosestPoint, CPIndex, Distance; disabled
vector_2pt_2 = Vector2Pt(PointA=Point(0, 0, 0), PointB=closest_point_2.ClosestPoint, Unitize=False)  # -> Vector, Length; disabled
vector_2pt_3 = Vector2Pt(PointA=Point(0, 0, 0), PointB=closest_point_3.ClosestPoint, Unitize=False)  # -> Vector, Length; disabled
vector_2pt_4 = Vector2Pt(PointA=Point(0, 0, 0), PointB=closest_point_4.ClosestPoint, Unitize=False)  # -> Vector, Length; disabled
move_9 = Move(Geometry=rotated_brick_2, Motion=vector_2pt_2.Vector)  # -> Geometry, Transform; disabled
move_10 = Move(Geometry=brick_3, Motion=vector_2pt_3.Vector)  # -> Geometry, Transform; disabled
move_11 = Move(Geometry=brick_3, Motion=vector_2pt_4.Vector)  # -> Geometry, Transform; disabled

# ---- group: Brick_Pattern_Two_Directions / Brep_list
bricks_positioned = Brep([move_11.Geometry, move_9.Geometry, move_10.Geometry])  # disabled

# ---- group: Brick_Pattern_One_Direction / Brep_list
bricks_positioned_2 = Brep(move_6.Geometry)

# ---- group: Layer_By_Layer_Two_Directions / Brep_list
bricks_positioned_3 = Brep(bricks_positioned_2)

# ---- group: Layer_By_Layer_Two_Directions
brick_height_mortar_5 = Integer(brick_height_mortar)
deconstruct_brep_3 = DeconstructBrep(Brep=bricks_positioned_3)  # -> Faces, Edges, Vertices
list_item_6 = ListItem(List=deconstruct_brep_3.Vertices, Index=0, Wrap=True)  # -> flatten(Item)
number_slider_9 = Slider(28, range=0..100)
deconstruct = Deconstruct(Point=list_item_6)  # -> XComponent, YComponent, ZComponent
subtraction = Subtraction(A=number_slider_9, B=1)
multiplication = Multiplication(A=number_slider_9, B=brick_height_mortar_5)
multiplication_2 = Multiplication(A=subtraction, B=brick_height_mortar_5)
integer = Integer(multiplication_2)
integer_2 = Integer(deconstruct.ZComponent)
integer_3 = Integer(multiplication)
integer_4 = Integer(deconstruct.ZComponent)
member_index_3 = MemberIndex(Set=integer_2, Member=integer_3)  # -> Index, Count
member_index_4 = MemberIndex(Set=integer_4, Member=integer)  # -> Index, Count
list_item_7 = ListItem(List=bricks_positioned_3, Index=[member_index_4.Index, member_index_3.Index], Wrap=True)

# ---- group: Layer_By_Layer_Two_Directions / Brep_list
bricks_per_layer = Brep(list_item_7)
