# Grasshopper definition Terrabayt_Karamba_Script.gh (Grasshopper 1.0.7)
# plug-ins: Karamba, Kangaroo Components

# ---- group: volume 1
# Geometry
# roof mesh as input from the form script
mesh = Mesh(graft(<mesh referenced from the Rhino model>))  # disabled
# interior walls mesh as input from the form script
mesh_2 = Mesh(<mesh referenced from the Rhino model>)  # disabled
mesh_3 = Mesh(<mesh referenced from the Rhino model>)  # disabled

# ---- group: volume 3
mesh_4 = Mesh(graft(<mesh referenced from the Rhino model>))  # disabled
mesh_5 = Mesh(<mesh referenced from the Rhino model>)  # disabled
mesh_6 = Mesh(<mesh referenced from the Rhino model>)  # disabled

# ---- group: volume 1
mjoin = MeshJoin(Meshes=flatten([mesh, mesh_2, mesh_3]))  # disabled
demesh = DeconstructMesh(Mesh=mjoin)  # -> Vertices, Faces, Colours, Normals; disabled
brep = Brep(<brep referenced from the Rhino model>)  # disabled
pt = Point(demesh.Vertices)  # disabled
nv = NakedVertices(Mesh=mjoin)  # -> ClothedIndex, NakedIndex, ClothedPts, NakedPts; disabled
brepinc = PointInBrep(Brep=brep, Point=pt, Strict=False)  # disabled
mindex = MemberIndex(Set=brepinc, Member=True)  # -> Index, Count; disabled
brep_2 = Brep(<brep referenced from the Rhino model>)  # disabled
pt_2 = Point([nv.ClothedPts, nv.NakedPts])  # disabled
nv_2 = NakedVertices(Mesh=mjoin)  # -> ClothedIndex, NakedIndex, ClothedPts, NakedPts; disabled
pdecon = Deconstruct(Point=pt_2)  # -> XComponent, YComponent, ZComponent; disabled
brepsinc = PointInBreps(Brep=brep_2, Point=pt_2, Strict=False)  # -> Inside, Index; disabled
smaller = SmallerThan(FirstNumber=pdecon.ZComponent, SecondNumber=0.1)  # -> SmallerThan, OrEqualTo; disabled
mindex_2 = MemberIndex(Set=brepsinc.Inside, Member=True)  # -> Index, Count; disabled
mindex_3 = MemberIndex(Set=smaller.SmallerThan, Member=True)  # -> Index, Count; disabled
pt_3 = Point(nv_2.NakedPts)  # disabled
item = ListItem(List=pt, Index=mindex.Index, Wrap=True)  # disabled
item_2 = ListItem(List=pt_2, Index=mindex_2.Index, Wrap=True)  # disabled
item_3 = ListItem(List=pt_2, Index=[mindex_3.Index, mindex_2.Index], Wrap=True)  # disabled
cull_duplicates = CullDuplicates(Points=[item_3, item_2, item], Tolerance=0.01, CullMode=3)  # -> Points, Indices, Valence; disabled
pt_4 = Point(cull_duplicates.Points)  # disabled

# ----
box = Box({Plane=PlaneXY(3.984742845, 36.42879039, 4.683858486e-06), X=Domain(0, 2.972452982), Y=Domain(0, 6.136187725), Z=Domain(0, 6.82763918)})
box_2 = Box({Plane=PlaneXY(-2.711211576, -1.215423732, 0.003000940936), X=Domain(0, 2.711182483), Y=Domain(0, 5.073721054), Z=Domain(0, 5.138074248)})  # disabled
box_3 = Box({Plane=PlaneXY(-4.079991025, 35.92206203, 7.783300014e-06), X=Domain(0, 4.064735092), Y=Domain(0, 6.851788429), Z=Domain(0, 6.798689637)})

# ---- group: volume 2
mesh_7 = Mesh(graft(<mesh referenced from the Rhino model>))
demesh_2 = DeconstructMesh(Mesh=mesh_7)  # -> Vertices, Faces, Colours, Normals
pt_5 = Point(demesh_2.Vertices)
nv_3 = NakedVertices(Mesh=mesh_7)  # -> ClothedIndex, NakedIndex, ClothedPts, NakedPts
brepinc_2 = PointInBrep(Brep=box, Point=pt_5, Strict=False)
mindex_4 = MemberIndex(Set=brepinc_2, Member=True)  # -> Index, Count
pt_6 = Point([nv_3.ClothedPts, nv_3.NakedPts])
pdecon_2 = Deconstruct(Point=pt_6)  # -> XComponent, YComponent, ZComponent
nv_4 = NakedVertices(Mesh=mesh_7)  # -> ClothedIndex, NakedIndex, ClothedPts, NakedPts
brepsinc_2 = PointInBreps(Brep=box_3, Point=pt_6, Strict=False)  # -> Inside, Index
smaller_2 = SmallerThan(FirstNumber=pdecon_2.ZComponent, SecondNumber=0.1)  # -> SmallerThan, OrEqualTo
mindex_5 = MemberIndex(Set=brepsinc_2.Inside, Member=True)  # -> Index, Count
mindex_6 = MemberIndex(Set=smaller_2.SmallerThan, Member=True)  # -> Index, Count
pt_7 = Point(nv_4.NakedPts)
item_4 = ListItem(List=pt_5, Index=mindex_4.Index, Wrap=True)
item_5 = ListItem(List=pt_6, Index=mindex_5.Index, Wrap=True)
item_6 = ListItem(List=pt_6, Index=[mindex_6.Index, mindex_5.Index], Wrap=True)
cull_duplicates_2 = CullDuplicates(Points=[item_6, item_5, item_4], Tolerance=0.01, CullMode=3)  # -> Points, Indices, Valence
pt_8 = Point(cull_duplicates_2.Points)

# ----
box_4 = Box({Plane=Plane(origin=(7.999970907, -1.215423732, 0.003000940936), x=(0, 1, 0), y=(1, 0, 0)), X=Domain(0, 6.479809639), Y=Domain(0, 3.465528347), Z=Domain(-5.916589427, 0)})  # disabled

# ---- group: volume 3
mjoin_2 = MeshJoin(Meshes=flatten([mesh_4, mesh_5, mesh_6]))  # disabled
demesh_3 = DeconstructMesh(Mesh=mjoin_2)  # -> Vertices, Faces, Colours, Normals; disabled
pt_9 = Point(demesh_3.Vertices)  # disabled
nv_5 = NakedVertices(Mesh=mjoin_2)  # -> ClothedIndex, NakedIndex, ClothedPts, NakedPts; disabled
brepinc_3 = PointInBrep(Brep=box_2, Point=pt_9, Strict=False)  # disabled
mindex_7 = MemberIndex(Set=brepinc_3, Member=True)  # -> Index, Count; disabled
pt_10 = Point([nv_5.ClothedPts, nv_5.NakedPts])  # disabled
pdecon_3 = Deconstruct(Point=pt_10)  # -> XComponent, YComponent, ZComponent; disabled
nv_6 = NakedVertices(Mesh=mjoin_2)  # -> ClothedIndex, NakedIndex, ClothedPts, NakedPts; disabled
brepsinc_3 = PointInBreps(Brep=box_4, Point=pt_10, Strict=False)  # -> Inside, Index; disabled
smaller_3 = SmallerThan(FirstNumber=pdecon_3.ZComponent, SecondNumber=0.1)  # -> SmallerThan, OrEqualTo; disabled
mindex_8 = MemberIndex(Set=brepsinc_3.Inside, Member=True)  # -> Index, Count; disabled
mindex_9 = MemberIndex(Set=smaller_3.SmallerThan, Member=True)  # -> Index, Count; disabled
pt_11 = Point(nv_6.NakedPts)  # disabled
item_7 = ListItem(List=pt_9, Index=mindex_7.Index, Wrap=True)  # disabled
item_8 = ListItem(List=pt_10, Index=mindex_8.Index, Wrap=True)  # disabled
item_9 = ListItem(List=pt_10, Index=[mindex_9.Index, mindex_8.Index], Wrap=True)  # disabled
cull_duplicates_3 = CullDuplicates(Points=[item_9, item_8, item_7], Tolerance=0.01, CullMode=3)  # -> Points, Indices, Valence; disabled
pt_12 = Point(cull_duplicates_3.Points)  # disabled

# ----
# Mesh_Attributes
shell_mesh = Mesh(mesh_7)

# ----
# Element Definition
panel = Panel("shell_total")
meshtoshell = MeshToShellKaramba(Mesh=shell_mesh, Identifier=panel, LimitDistance_m=0.005)  # -> Element, Points, Info
mesh_points = Pos(meshtoshell.Points)

# ----
# Wind load
# wind in two different
# principal directions
_0_7_kn_m2 = Number(0.7)
_0_7_kn_m2_2 = Number(-0.7)  # disabled
Y = UnitY(Factor=[_0_7_kn_m2, _0_7_kn_m2_2])
X = UnitX(Factor=[_0_7_kn_m2, _0_7_kn_m2_2])  # disabled
mesh_8 = Mesh(shell_mesh)
vdis = VectorDisplay(Anchor=mesh_points, Vector=Y)
vdis_2 = VectorDisplay(Anchor=mesh_points, Vector=X)  # disabled
loads = LoadsKaramba(Vectors=[Y, X], Mesh=mesh_8, LCase=0, mode="MeshLoad -Variable", menu=[buttons(on, off, off), buttons(on, on)])

# ----
# Additional Sand Load
panel_2 = Panel("-0.4")
Z = UnitZ(Factor=panel_2)
mesh_9 = Mesh(shell_mesh)
pos = Pos(mesh_points)
loads_2 = LoadsKaramba(Vector=Z, Mesh=mesh_9, Pos=pos, LCase=1, mode="MeshLoad -Const.", menu=[buttons(off, on, off), buttons(on, on)])

# ----
# Supports
supp = SupportKaramba(PosInd=pt_8, menu=[buttons(on, on, on, on, on, on)])
support = SupportKaramba(supp)

# ----
# Mesh to Shell & Analyze & Assemble
panel_3 = Panel("shell_total")
Z_2 = UnitZ(Factor=1)
X_2 = UnitX(Factor=1)
orientate = OrientateElemKaramba(Shell=meshtoshell.Element, ShellIdentifier=panel_3, XOrientations=X_2, ZOrientations=Z_2, mode="Shell")

# ----
# Material
panel_4 = Panel("Adobe ")
matprops = MaterialPropertiesKaramba3D(
    FamilyOfMaterial=panel_4,
    Name="bricks",
    YoungsModulus_kN_cm2=18.7,
    InPlaneShearModulus_kN_cm2=7.857,
    TransverseShearModulus_kN_cm2=7.857,
    SpecificWeight_kN_m3=14,
    CoefficientOfThermalExpansion_1_C=6e-06,
    YieldStrength_kN_cm2="0.117",
    mode="Isotrop")
material = MaterialKaramba(matprops)

# ----
# Cross Section
thickness = Slider(32, range=0..100)
cross_sections = CrossSectionsKaramba(
    FamilyNameOfCrossSection="DefaultCroSec",
    NameOfCrossSection=flatten(""),
    Material=material,
    Height_cm=flatten(thickness),
    mode="Shell - Const")  # -> flatten(CrossSection)
crosecselect = CrossSectionSelectorKaramba(CrossSections=cross_sections)  # -> CrossSection, Info
crosec = CrossSectionKaramba(crosecselect.CrossSection)

# ----
# LOADS
vdis_3 = VectorDisplay(Anchor=mesh_points, Vector=Z)

# ----
# Dead Load
loads_3 = LoadsKaramba(Vector=Vector(0, 0, -1), LCase=0, mode="Gravity")

# ----
# OUTPUT
gravity = Load(loads_3)
sand = Load(loads_2)
wind = LoadKaramba(loads)
merge = Merge(Data1=gravity, Data3=sand, Data4=wind)  # -> flatten(Result)

# ----
# Assembled Model
assemble = AssembleModelKaramba(
    Elem=orientate,
    Support=flatten(support),
    Load=flatten(merge),
    CrossSection=crosec,
    Material=material,
    LimitDistance_m=0.005)  # -> Model, Info, Mass_kg, CenterOfGravity
model = ModelKaramba(assemble.Model)

mass_kg = Panel(assemble.Mass_kg)

# ----
# Usability
dist = Distance(PointA=Point(284.0214272, 31.5, 0), PointB=Point(288.5214272, 31.5, 0))
maximum_span = Panel(dist)
l_240 = Panel("240")
division = Division(A=maximum_span, B=l_240)
allowable_deflection = Panel(division)

# ----
# σmax applying SF of 3.5
division_2 = Division(A="0.117", B=3.5)
division_3 = Division(A=division_2, B=10)
allowable_compressive_stress = Panel(division_2)
allowable_tensile_stress = Panel(division_3)

model_2 = Model(model)

# ----
# First Order Theory Analysis
# outputs
# inputs
analyzethi = AnalyzeThIKaramba(Model=model_2)  # -> CalculatedModel, MaximumDisplacement_m, ResultingForceOfGravity_kN, ElasticEnergy_kNm
ma = MassAddition(Input=analyzethi.MaximumDisplacement_m)  # -> Result, PartialResults
max_deflection = Panel(ma.Result)

model_3 = Model(analyzethi.CalculatedModel)

# ----
# Model Display
model_4 = Model(model_3)
modelview = ModelViewKaramba(Model=model_4, LoadCaseFactorsForLinearSuperposition=1, IndexOfVisibleLoadcase=-1)  # -> Model, DeformedMesh, DeformedAxes, DeformedModel
shellview = ShellViewKaramba(Model=modelview.Model, IndexOfLayer=0)  # -> Model, MeshesOfRenderedShells, LegendColors, LegendTags
legend = Legend(Colour=shellview.LegendColors, Tags=shellview.LegendTags, LegendType=101)

# ----
# Principle Lines
G = Geometry(modelview.DeformedMesh)
popgeo = PopulateGeometry(Geometry=G, Count=Slider(100, range=0..1000), Seed=1)
shelllineresults = LineResultsOnShellsKaramba(
    AnalyzedModel=shellview.Model,
    Layer=0,
    ListOfSourcesOfPrincipalStressLinesLinesPoints=popgeo,
    SegmentLength_m=0.5,
    DA_deg=5,
    mode="PrincStress")  # -> AnalyzedModel, simplify(Lines1), simplify(Lines2)
crv = Curve(shelllineresults.Lines1)
crv_2 = Curve(shelllineresults.Lines2)

# ----
# σmax check
# Verify
panel_5 = Panel(shellview.LegendTags)
item_10 = ListItem(List=panel_5, MaxCompressiveStress=1, Wrap=True)
item_11 = ListItem(List=panel_5, MaxTensileStress=17, Wrap=True)
smaller_4 = SmallerThan(FirstNumber=item_10, SecondNumber=allowable_compressive_stress)  # -> SmallerThan, OrEqualTo
smaller_5 = SmallerThan(FirstNumber=item_11, SecondNumber=allowable_tensile_stress)  # -> SmallerThan, OrEqualTo
panel_6 = Panel(smaller_4.SmallerThan)
panel_7 = Panel(smaller_5.SmallerThan)

# ----
# Verify
smaller_6 = SmallerThan(FirstNumber=max_deflection, SecondNumber=allowable_deflection)  # -> SmallerThan, OrEqualTo
panel_8 = Panel(smaller_6.SmallerThan)
