# Grasshopper definition Terrabayt_Topology_and_Geometry_Script.gh (Grasshopper 1.0.7)
# plug-ins: Weaverbird, Kangaroo2 Components

# ---- group: Layout
no_caravans = Slider(3, range=1..4)
no_couples = Slider(3, range=0..3)
no_children = Slider(11, range=0..20)
inputs = GhPythonScript(No_caravans=no_caravans, No_couples=no_couples, No_children=no_children, Run=Toggle(True))  # -> out, output; inputs No_caravans: Int32, No_couples: Int32, No_children: Int32
# ---------- inputs: Python ----------
"""Provides the inputs to the main script.
    Inputs:
        No_caravans: The number of caravans
        No_couples: The number of couples
        No_children: The number of children
    Output:
        output: A list of the spaces to render, along with render info"""

import rhinoscriptsyntax as rs
import math 

No_persons= 2*No_couples+No_children

# Formulas to calculate the room areas based on the inputs
areas = {
    "courtyard": No_caravans*25,
    "kitchen": 6 + 0.5*No_persons,
    "bathroom": 4 + 0.5*No_persons,
    "winter living room": 6 + 1*No_persons
}

# The heights of the rooms
heights = {
    'courtyard': 0,
    'kitchen': 3.5,
    'bathroom': 3,
    'entrance': 3.6,
    'winter living room': 3.5,
    'added bedroom': 3.5
}

# Function which determini the room dimension based on the inputs
def getDimensions(room):
    area = areas[room]
    length = math.floor(math.sqrt(area))
    depth = math.ceil(area/length)
    return [int(length), int(depth), heights[room]]

def getCourtyard():
    if No_caravans > 2 or No_caravans == 1:
        return getDimensions('courtyard')
    return [5, 5]

def getEntranceDimensions():
    if No_caravans > 2:
        return [2, 2, heights['entrance']]
    return [2, 2, heights['entrance']]

def getExtraRoomNumber():
    return max(0, int(No_couples + math.ceil(No_children/4.0) - No_caravans));


spaces = [
    {'name': 'courtyard','dimensions': getCourtyard(), 'color': '', 'number': 1},
    {'name': 'caravan','dimensions': [5, 3], 'color': (203, 187, 160), 'number': No_caravans},
    {'name': 'liwan','dimensions': [2, 3], 'color': '', 'number': No_caravans},
    {'name': 'entrance', 'dimensions': getEntranceDimensions(), 'color': (0, 0, 0), 'number': 1},
    {'name': 'kitchen', 'dimensions': getDimensions('kitchen'), 'color': (29, 113, 184), 'number': 1},
    {'name': 'bathroom', 'dimensions': getDimensions('bathroom'), 'color': (0, 159, 227), 'number': 1},
    {'name': 'winter living room', 'dimensions': getDimensions('winter living room'), 'color': (135, 135, 135), 'number': 1},
]

# Extra controls to conditionally add come spaces based on inputs
if (No_persons > 5):
    iwan_dimensions = [3, 3]
else:
    iwan_dimensions = [4, 4]

if No_caravans > 2:
    spaces.insert(3, {'name': 'iwan', 'dimensions': iwan_dimensions, 'color': (243, 146, 0), 'number': 1})

if getExtraRoomNumber() > 0:
    spaces.append({'name': 'added bedroom', 'dimensions': [3, 3], 'color': (0, 0, 0), 'number': getExtraRoomNumber()})

    # Block which controls the output of the script based on the Run boolean input
if Run:
    rs.DeleteObjects(rs.AllObjects())
    output = spaces
else:
    output = []
# ---------- end inputs ----------
master_script = GhPythonScript(spaces=inputs.output)  # -> out, RoomsPerSideIndexed, CourtyardAndCaravans, RoomCircles, CourtyardSize; inputs priority_list: list, spaces: list
# ---------- master_script: Python ----------
"""Provides the positions of the rooms, along with additional geometry info.
    Input:
        spaces: A list of rooms to be positioned around the courtyard
    Outputs:
        RoomsPerSideIndexed:
            A list of room indexes per side, as they(indexes) came up during the execution
        CourtyardAndCaravans:
            A joined BREP of the courtyard and caravans to be used to later trim the room surfaces
        RoomCircles:
            A circle drawn around its positioned room, to be later used for relaxation script
        CourtyardSize:
            The dimensions of the courtyard
        """

"""
The logic for positioning the rooms is as follows:
    1) We define a grid starting from the southwest corner of the courtyard, and "looping" back at it
    2) We place the appropriate number of caravans in randomly selected corners
    3) We place a liwan adjacent to each caravan
    4) The script now starts by rendering the rooms provided in the input in order,
        scanning for availability on the grid_status in counter-clockwise direction, 
        starting from the southwest corner.
    5) After every room is positioned, the grid status is updated and geometry is generated based on
        input dimensions and translated accordingly around the courtyard.

If a room does not fit in the grid, its positioning is skipped and next in order room is positioned.

"""

__author__ = "anna"
__version__ = "2018.10.03"

import rhinoscriptsyntax as rs
import scriptcontext as sc
import Rhino
import Rhino.Geometry as rg
import random
import math
import itertools
from copy import copy
sc.doc = Rhino.RhinoDoc.ActiveDoc
# Initialize variables
roomIndexRendered = 0
CourtyardAndCaravans = []
plane = rs.WorldXYPlane()
RoomCircles = []
liwanIndexes = [[], [], [], []]  #per side
roomIndexes = [[], [], [], []]   #per side
grid_status = [] # main data structure showing information about if a grid index is occupied ba room or not
RoomsPerSideIndexed = []
# calculate courtyard parameters
courtyard = filter(lambda s: s['name'] == 'courtyard', spaces)[0]
width = courtyard['dimensions'][0]
length = courtyard['dimensions'][1]
CourtyardSize = [length, width]
courtyard_rectangle = rg.Box(plane, rg.Interval(0, length), rg.Interval(0, width), rg.Interval(0, 10))
CourtyardAndCaravans.append(courtyard_rectangle.ToBrep())
perimeter = 2 * (width + length)


# courtayrd corners along with info about their overflow
corners = [
    {'name': 'WS', 'index': 0, 'overflow': False},
    {'name': 'SE', 'index': length, 'overflow': False},
    {'name': 'EN', 'index': length+width, 'overflow': False},
    {'name': 'NW', 'index': 2*length+width, 'overflow': False},
]

corner_indexes = map(lambda c: c['index'], corners)

# coodinate information to translate the caravans to the correct position when rendered
HtoBottomX = -5.0
HtoBottomY = -3.0
VtoBottomX = -3.0
VtoBottomY = -5.0
toTopX = -5.0
toTopY = float(width)

caravans = filter(lambda s: s['name'] == 'caravan', spaces)[0]

# Initializes the grid_status
for i in range(perimeter + 1):
    grid_status.append({'index': i, 'spaces' : []})

# Determine indexed sides based on their size
south_side = range(0,length + 1)
east_side = range(length,length+width+1)
north_side = range(length+width, 2*length+width+1)
west_side = range(2*length+width,perimeter)
west_side.append(0)

sides = [south_side, east_side, north_side, west_side]

# Returns the previous corner index of the input
def get_prev_corner(index):
    difs = map(lambda c: index-c, corner_indexes)
    positives = filter(lambda d: d>0, difs)
    return index - min(positives)
    
# Similarly returns the next corner index of the input
def get_next_corner(index):
    difs = map(lambda c: c-index, corner_indexes)
    positives = filter(lambda d: d>0, difs)
    if len(positives) > 0:
        return index + min(positives)
    return 0;

# Next two functions are used to check whether a room is overflowing a corner
def add_side(point):
    point_in_sides = ''
    if point in south_side:
        point_in_sides += 'S'
    if point in east_side:
        point_in_sides += 'E'
    if point in north_side:
        point_in_sides += 'N'
    if point in west_side:
        point_in_sides += 'W'
    if point < 0:
        point_in_sides += 'W'
    return point_in_sides

def check_overflow(start, end):
    sides = ''
    if add_side(start) != add_side(end):
        sides = add_side(start) + add_side(end)
        map(lambda c: c if c['name'] != sides else c.update({'overflow': True}), corners)

# function to render a caravan on the south or north side
def horizontal_caravan(caravan, translation):
    length = caravan['dimensions'][0]
    depth = caravan['dimensions'][1]
    color = caravan['color']
    caravan_rectangle = rg.Box(plane, rg.Interval(0, length), rg.Interval(0, depth), rg.Interval(0, 2.8))
    caravan_rectangle_moved = caravan_rectangle.ToBrep()
    caravan_rectangle_moved.Transform(translation)
    caravan_box = rs.AddBox([rg.Point3d(0, 0, 0), rg.Point3d(5, 0, 0), rg.Point3d(5, 3, 0), rg.Point3d(0, 3, 0), rg.Point3d(0, 0, 2.8), rg.Point3d(5, 0, 2.8), rg.Point3d(5, 3, 2.8), rg.Point3d(0, 3, 2.8)])
    rs.TransformObject(caravan_box, translation)
    CourtyardAndCaravans.append(caravan_rectangle_moved)
    return rs.ObjectColor(rs.TransformObject(rs.AddPlaneSurface(plane, length, depth), translation), color)

# function to render a caravan on the east or west side
def vertical_caravan(caravan, translation):
    length = caravan['dimensions'][0]
    depth = caravan['dimensions'][1]
    color = caravan['color']
    caravan_rectangle = rg.Box(plane, rg.Interval(0, depth), rg.Interval(0, length), rg.Interval(0, 2.8))
    caravan_rectangle_moved = caravan_rectangle.ToBrep()
    caravan_rectangle_moved.Transform(translation)
    caravan_box = rs.AddBox([rg.Point3d(0, 0, 0), rg.Point3d(3, 0, 0), rg.Point3d(3, 5, 0), rg.Point3d(0, 5, 0), rg.Point3d(0, 0, 2.8), rg.Point3d(3, 0, 2.8), rg.Point3d(3, 5, 2.8), rg.Point3d(0, 5, 2.8)])
    rs.TransformObject(caravan_box, translation)
    CourtyardAndCaravans.append(caravan_rectangle_moved)
    return rs.ObjectColor(rs.TransformObject(rs.AddPlaneSurface(plane, depth, length), translation), color)

# function to be called when adding a caravan.
def add_caravan(end, caravan):
    start = end - caravan['dimensions'][0]
    if end in corner_indexes or end == perimeter:
        if end == perimeter/2:
            translation = rg.Transform.Translation(courtyard['dimensions'][1] , 0.0, 0.0)
            vertical_caravan(caravan, translation)
        elif end == perimeter:
            translation = rg.Transform.Translation(-caravan['dimensions'][1] , 0.0, 0.0)
            vertical_caravan(caravan, translation)
    elif (end in south_side):
        translation = rg.Transform.Translation(HtoBottomX + end, HtoBottomY, 0.0)
        horizontal_caravan(caravan, translation)
    elif (end in east_side):
        translation = rg.Transform.Translation(courtyard['dimensions'][1] , VtoBottomY + end - corner_indexes[1], 0.0)
        vertical_caravan(caravan, translation)
    elif (end in north_side):
        translation = rg.Transform.Translation(courtyard['dimensions'][1] - end + corner_indexes[2], toTopY, 0.0)
        horizontal_caravan(caravan, translation)
    elif (end in west_side):
        translation = rg.Transform.Translation(-3, width - end + corner_indexes[3], 0)
        vertical_caravan(caravan, translation)
    check_overflow(start, end)
    updated_start = get_prev_corner(end)
    for i in range(updated_start, end + 1):
        if i < 0:
            continue
        grid_status[i]['spaces'].append('caravan')

# Function that determines whether a corner is empty or not
def is_free_corner(index):
    corner = filter(lambda c: c['index'] == index, corners)
    if corner == []:
        return False
    return not corner[0]['overflow']

# Helper function that scans the grid and returns whether every index is occupied or not
def get_occupation_grid(grid):
    occupied = []
    for i,g in enumerate(grid):
        if i == 0:
            occupied.append(grid[0]['spaces'] == [])
        elif i == perimeter:
            occupied.append(grid[perimeter]['spaces'] == [])
        elif (grid[i+1]['spaces'] == [] or grid[i-1]['spaces'] == [] or grid[i]['spaces'] == []
        or (len(grid[i]['spaces']) == 1 and len(grid[i+1]['spaces']) == 1 and grid[i]['spaces'][0] != grid[i+1]['spaces'][0])
        or (len(grid[i]['spaces']) == 1 and len(grid[i-1]['spaces']) == 1 and grid[i]['spaces'][0] != grid[i-1]['spaces'][0])):
            occupied.append(True)
        else:
            occupied.append(False)
    return occupied

# Function which uses the info returned by get_occupation_grid and returns more information
# about space availability for every side
def check_availability(grid):
    occupation_grid = get_occupation_grid(grid)
    pos, max_len, cum_pos = 0, 0, 0
    sides = []
    sides.append(occupation_grid[slice(0,length)])
    sides.append(occupation_grid[slice(length,length + width)])
    sides.append(occupation_grid[slice(length + width,2*length + width)])
    sides.append(occupation_grid[slice(2*length + width,perimeter + 1)])
    space = []
    for side in sides:
        lengths=[]
        positions=[]
        for k, g in itertools.groupby(side):
            if k == True:
                pat = len(list(g))
                if cum_pos in corner_indexes:
                    lengths.append(pat)
                    positions.append(cum_pos)
                elif cum_pos + pat == perimeter:
                    lengths.append(pat)
                    positions.append(cum_pos)
                else:
                    lengths.append(pat)
                    positions.append(cum_pos)
                cum_pos += pat
            else:
                cum_pos += len(list(g))
        if lengths != []:
            if lengths[0] + positions[0] in corner_indexes:
                    lengths[0] += 1
        space.append({'max': lengths, 'from': positions})
    return space

# Function that gets the dimensions and start point of a room and returns info for its rendering such as
# its orientation and translation values.
def get_render_info(length, depth, start):
    if start in corner_indexes:
        corner = corner_indexes.index(start)
        if corner == 0:
            return {'orientation': 'horizontal', 'x_trans': 0, 'y_trans': -depth + 1,'side': 0}
        elif corner == 2:
            return {'orientation': 'horizontal', 'x_trans': courtyard['dimensions'][1] - length + 1, 'y_trans': courtyard['dimensions'][0], 'side': 2}
        elif corner == 1:
            return {'orientation': 'vertical', 'x_trans': courtyard['dimensions'][1], 'y_trans': 0,  'side': 1}
        else:
            return {'orientation': 'vertical', 'x_trans': -depth + 1, 'y_trans': courtyard['dimensions'][0] - length + 1, 'side': 3}
    if start in south_side:
        return {'orientation': 'horizontal', 'x_trans': start, 'y_trans': -depth + 1,  'side': 0}
    elif start in east_side:
        return {'orientation': 'vertical', 'x_trans': courtyard['dimensions'][1], 'y_trans': start- corner_indexes[1],  'side': 1}
    elif start in north_side:
        return {'orientation': 'horizontal', 'x_trans': courtyard['dimensions'][1] - start + corner_indexes[2] - length + 1, 'y_trans': courtyard['dimensions'][0],  'side': 2}
    else:
        return {'orientation': 'vertical', 'x_trans': -depth + 1, 'y_trans': courtyard['dimensions'][0] - start + corner_indexes[3] - length + 1, 'side': 3}

# Function that draws a circle around the area of a rectangle representation fo a room
def getCircle(rectangle):
    center = rectangle.Center
    radius = math.sqrt(pow(rectangle.Width, 2) + pow(rectangle.Height, 2))/2
    return rg.Circle(center, radius)

# Function that updates the per side indexes for every room
def updateSideIndexes(tag, side):
    global roomIndexRendered
    if tag == 'liwan':
        liwanIndexes[side].append(roomIndexRendered)
    else:
        roomIndexes[side].append(roomIndexRendered)
    roomIndexRendered += 1

# Functions that renders the room
def render_space(length, depth, start, color, tag):
    render_info = get_render_info(length, depth, start)
    updateSideIndexes(tag, render_info['side'])
    translation = rg.Transform.Translation(render_info['x_trans'], render_info['y_trans'], 0.0)
    if render_info['orientation'] == 'horizontal':
        rect = rs.TransformObject(rs.AddPlaneSurface(plane, length-1, depth-1), translation)
        if tag != 'caravan':
            toCircle = rg.Rectangle3d(plane, length - 1, depth - 1)
            center = toCircle.Center
            if render_info['y_trans'] > 0:
                circle_y_trans = width + 1 - center.Y
            else: 
                circle_y_trans = -1 - center.Y
            circleTrans = rg.Transform.Translation(render_info['x_trans'], circle_y_trans, 0.0)
            toCircle.Transform(translation)
            circle = getCircle(toCircle)
            RoomCircles.append(circle)
        rs.ObjectColor(rect, color)
    else:
        rect = rs.TransformObject(rs.AddPlaneSurface(plane, depth -1, length-1), translation)
        if tag != 'caravan':
            toCircle = rg.Rectangle3d(plane, depth - 1, length - 1)
            center = toCircle.Center
            if render_info['x_trans'] > 0:
                circle_x_trans = courtyard['dimensions'][1] + 1 - center.X
            else: 
                circle_x_trans = -1 - center.X
            circleTrans = rg.Transform.Translation(circle_x_trans, render_info['y_trans'], 0.0)
            toCircle.Transform(translation)
            circle = getCircle(toCircle)
            RoomCircles.append(circle)
        rs.ObjectColor(rect, color)

# function to upgrade the grid after positioning a room
def update_grid_status(start, end, tag):
    for i in range(start, end):
       if i > perimeter:
           break
       else:
           grid_status[i]['spaces'].append(tag)

# Main function for rendering a room
# It checks grid availability, decides on the start position,
# and renders room along with updating the grid.
def add_space(space):
    length = space['dimensions'][0] + 1
    depth = space['dimensions'][1] + 1
    tag = space['name']
    color = space['color']
    availables = check_availability(grid_status)
    for side in availables:
        if len(side['from']) == 0:
            continue
        if len(side['max']) > 0 and side['max'][0] + side['from'][0] - 1 == perimeter:
            next_corner_index = [0]
        else:
            next_corner_index = filter(lambda c: len(side['max']) > 0 and c == side['max'][0] + side['from'][0] - 1, corner_indexes)
        if len(side['max']) > 0 and side['max'][0] >= length:
            update_grid_status(side['from'][0], side['from'][0] + length, tag)
            render_space(length, depth, side['from'][0], color, tag)
            break
        elif (len(next_corner_index) > 0) and (is_free_corner(next_corner_index[0])):
            if next_corner_index[0] == 0:
                fill_until = perimeter + 1
            else:
                fill_until = next_corner_index[0] + 1
            for i in range(side['from'][0], fill_until):
                grid_status[i]['spaces'].append('occupied')
            render_space(length, depth, side['from'][0], color, tag)
            break

# Function that adds the liwan to the geometry
def add_liwan(start):
    render_info = get_render_info(2, 3, start)
    translation = rg.Transform.Translation(render_info['x_trans'], render_info['y_trans'], 0.0)
    rs.ObjectColor(rs.TransformObject(rs.AddPlaneSurface(plane, 2, 3), translation), (120, 80, 80))

# Function that renders the caravans
def render_caravans(No_caravans):
    add_liwans = True
    offset = 2
    caravan_corners = random.sample(corner_indexes, caravans['number'])
    if No_caravans == 2:
        offset = 5
        add_liwans = False
        caravan_corners = [corner_indexes[1], corner_indexes[3]]
    elif No_caravans == 3:
        caravan_corners = [corner_indexes[0], corner_indexes[1], corner_indexes[2]]
    for c in caravan_corners:
        add_caravan(c + offset, spaces[1])
        if add_liwans:
            liwan_start = c-2
            if liwan_start < 0 :
                liwan_start = perimeter - 2
            render_space(3,4,liwan_start,spaces[3]['color'], 'liwan')
            update_grid_status(liwan_start, liwan_start + 3, 'liwan')

# Ths spaces to be rendered after caravans and liwans are positioned
spaces_to_render = filter(lambda s: s['name'] not in ['caravan', 'courtyard', 'liwan'], spaces)

render_caravans(caravans['number'])
map(lambda space: add_space(space), spaces_to_render)

# Joins the liwan indexes and room indexes per side, putting the liwans at the end
for index, liwanIndex in enumerate(liwanIndexes):
    RoomsPerSideIndexed.append(roomIndexes[index] + liwanIndex)
# ---------- end master_script ----------
courtyard_and_caravans = Brep(flatten(master_script.CourtyardAndCaravans))
align_circles = GhPythonScript(Circles=master_script.RoomCircles, courtyard_size=master_script.CourtyardSize)  # -> out, aligned_circles; inputs Circles: list, courtyard_size: list
# ---------- align_circles: Python ----------
__author__ = "TOI"
__version__ = "2018.10.28"

import rhinoscriptsyntax as rs
import Rhino
import Rhino.Geometry as rg

underY = 100
topY = 100
leftX = 100
rightX = 100

for circle in Circles:
    center = circle.Center
    if center.Y > courtyard_size[1]:
        print 'panw {}'.format(center)
        topY = min(center.Y, topY)
    elif center.Y < 0:
        print 'katw {}'.format(center)
        underY = min(underY, abs(center.Y))
    elif center.X > courtyard_size[0]:
        print 'dexia {}'.format(center)
        rightX = min(rightX, center.X)
    else:
        print 'aristera {}'.format(center)
        leftX = min(leftX, abs(center.X))
"""
    if center.Y < 0:
        underY = min(underY, abs(center.Y))
    elif center.Y > 0 and center.X <= courtyard_size[0]:
        topY = min(topY, center.Y)
    elif center.X < 0:
        print center.X
        leftX = max(leftX, center.X)
    else:
        rightX = min(rightX, center.X)
"""
print 'oria {} {} {} {}'.format(underY, topY, leftX, rightX)
center = Circles[0].Center
aligned_circles = []

for circle in Circles:
    center = circle.Center
    if center.Y > courtyard_size[1]:
        translation = rg.Vector3d(0, topY - center.Y, 0)
        circle.Translate(translation)
    elif center.Y < 0:
        translation = rg.Vector3d(0, -underY - center.Y, 0)
        circle.Translate(translation)
    elif center.X > courtyard_size[0]:
        translation = rg.Vector3d(rightX - center.X, 0, 0)
        circle.Translate(translation)
    else:
        translation = rg.Vector3d(-leftX - center.X, 0, 0)
        circle.Translate(translation)


aligned_circles = Circles

print aligned_circles
# ---------- end align_circles ----------

# ---- group: Relaxation
height = Slider(1.31, range=-1.01..2)
cluster = Cluster(curve=align_circles.aligned_circles, distance=Slider(0.1, range=0..1), strength=height)  # -> A, spring, L, wind_3
reset_relaxation = Button()
solver = Solver(
    GoalObjects=flatten([cluster.A, cluster.spring, cluster.L, cluster.wind_3]),
    Reset=reset_relaxation,
    Threshold=1e-15,
    Tolerance=0.01,
    On=True)  # -> I, V, O

# ---- group: ToSurface
weaverbird_s_mesh_from_lines_weave_back = WeaverbirdsMeshFromLinesWeaveBack(Lines=flatten(solver.O), MaximumValence=4)
disjoint = DisjointMesh(Mesh=weaverbird_s_mesh_from_lines_weave_back)
faceb = FaceBoundaries(Mesh=disjoint)
disc = Discontinuity(Curve=faceb, Level=1)  # -> Points, Parameters
item = ListItem(List=disc.Points, Index=0, Wrap=True)  # -> Item, Item1, Item2, Item3
srf4pt = _4PointSurface(CornerA=item.Item, CornerB=item.Item1, CornerC=item.Item2, CornerD=item.Item3)  # -> flatten(Surface)
python = GhPythonScript(RoomsSurfaces=srf4pt)  # -> out, joinedRooms; inputs NoRooms: Int32, RoomsSurfaces: list of Brep, RoomsPerSideIndexed: list
# ---------- python: Python ----------
__author__ = "TOI"
__version__ = "2018.10.28"

import rhinoscriptsyntax as rs
import Rhino
import Rhino.Geometry as rg
import math
NoRooms = 8
def chunks(l, n):
    # For item i in a range that is a length of l,
    for i in range(0, len(l), n):
        # Create an index range for l of n items:
        yield l[i:i+n]

roomBreps = list(chunks(RoomsSurfaces, int(len(RoomsSurfaces)/NoRooms)))



rooms = rg.Brep.JoinBreps(RoomsSurfaces, 0.01)
print len(rooms)
joinedRooms = []
for room in rooms:
    closed = room.CapPlanarHoles(0.01)
    joinedRooms.append(closed)

joinedRooms = rg.Brep.JoinBreps(joinedRooms, 0.01)
"""
for room in roomBreps:
    joined = rg.Brep.JoinBreps(room, 0.01)
    #closed = joined[0].CapPlanarHoles(0.01)
    joinedRooms.append(joined[0])


print joinedRooms
print RoomsPerSideIndexed

joinedRooms[2].Flip()
a = joinedRooms[4].Trim(joinedRooms[2], 0.01)
joinedRooms[2].Flip()
joinedRooms[4].Flip()
c = joinedRooms[2].Trim(joinedRooms[4], 0.01)
#c[0].Join(a[0], 0.01, True)

c = []
for side in [RoomsPerSideIndexed[0]]:
    if len(side) == 0:
        continue
    sideBrep = joinedRooms[side[0]]
    i=0
    while i < len(side)-1:
        if sideBrep.SolidOrientation == rg.BrepSolidOrientation.Inward:
            sideBrep.Flip()
        if joinedRooms[side[i+1]].SolidOrientation == rg.BrepSolidOrientation.Outward:
            joinedRooms[side[i+1]].Flip()
        temp1 = sideBrep.Trim(joinedRooms[side[i+1]], 0.01)
        print temp1
        if len(temp1) == 0:
            print 'rip'
            i +=1
            continue
        print 'yoo'
        a = temp1
        east_side = a
        sideBrep.Flip()
        joinedRooms[side[i+1]].Flip()
        b = joinedRooms[side[i+1]].Trim(sideBrep, 0.01)
        west_side = b
        print b
        sideBrep = rg.Brep.JoinBreps(a + b, 0.01)
        sideBrep = sideBrep[0]
        i += 1
    c.append(sideBrep)


north_side = []
south_side = []
north1 = joinedRooms[RoomsPerSideIndexed[2][0]]
north2 =  joinedRooms[RoomsPerSideIndexed[2][1]]
if north1.SolidOrientation == rg.BrepSolidOrientation.Inward:
    north1.Flip()
elif north2.SolidOrientation == rg.BrepSolidOrientation.Outward:
    north2.Flip()
south1 = joinedRooms[RoomsPerSideIndexed[0][0]]
south2 =  joinedRooms[RoomsPerSideIndexed[0][1]]
if south1.SolidOrientation == rg.BrepSolidOrientation.Inward:
    south1.Flip()
elif south2.SolidOrientation == rg.BrepSolidOrientation.Outward:
    south2.Flip()
north_side.append([north1, north2])
south_side.append([south1, south2])


west_side = joinedRooms

"""
# ---------- end python ----------

# ---- group: Results
trim = TrimSolid(Shape=python.joinedRooms, Cutters=courtyard_and_caravans)  # -> flatten(Result)
mesh = MeshBrep(
    Brep=trim,
    Settings={GridMaxCount=0, GridMinCount=16, JaggedSeams=False, MaxEdgeLength=0, MinEdgeLength=0.0001, MinTolerance=0, Refine=True, RefineAngle=0, RelativeTolerance=0.65, SimplePlanes=True, Tolerance=0})
munion = MeshUnion(Meshes=mesh)

# ==== cluster Cluster
curve = ClusterInput()
distance = ClusterInput()

offset_curve = OffsetCurve(Curve=curve, Distance=distance, Plane=PlaneXY(0, 0, 0), Corners=1)
boundary_surfaces = BoundarySurfaces(Edges=offset_curve)
number_slider = Slider(14, range=0..100)
area = Area(Geometry=boundary_surfaces)  # -> Area, Centroid
wind = Slider(-0.707, range=-10..10)
integer = Integer(expr("x", area.Area))
vector_xyz = VectorXYZ(XComponent=wind, YComponent=wind, ZComponent=0)  # -> Vector, Length

strength = ClusterInput()

mesh_surface = MeshSurface(Surface=boundary_surfaces, UCount=number_slider, VCount=number_slider, Overhang=True, Equalize=False)
nakedvertices = NakedVertices(Mesh=mesh_surface)  # -> ClothedIndex, NakedIndex, ClothedPts, NakedPts
mesh_edges = MeshEdges(Mesh=mesh_surface)  # -> NakedEdges, InteriorEdges, NonManifoldEdges
point = Point(nakedvertices.NakedPts)
wind_2 = Wind(Mesh=mesh_surface, WindVector=vector_xyz.Vector)
length_line = LengthLine(Line=[mesh_edges.NakedEdges, mesh_edges.InteriorEdges], Strength=10)
vertexloads = VertexLoads(Mesh=mesh_surface, Strength=strength)
anchor = Anchor(Point=point, Strength=10000)
merge = Merge(Data1=flatten(anchor), Data2=flatten(length_line), Data4=flatten(wind_2), Data5=flatten(vertexloads))

L = ClusterOutput(vertexloads)
wind_3 = ClusterOutput(wind_2)
A = ClusterOutput(anchor)
spring = ClusterOutput(length_line)
