# Grasshopper definition Terrabayt_Urban_Script.gh (Grasshopper 1.0.7)

block_outline = Curve(<curve referenced from the Rhino model>)
block_outline_2 = Curve(<curve referenced from the Rhino model>)

# ---- group: Houses Belonging Together
crv = Curve([<curve referenced from the Rhino model> x2])
crv_2 = Curve([<curve referenced from the Rhino model> x2])
crv_3 = Curve(<curve referenced from the Rhino model>)
crv_4 = Curve(<curve referenced from the Rhino model>)
crv_5 = Curve(<curve referenced from the Rhino model>)
crv_6 = Curve(<curve referenced from the Rhino model>)
crv_7 = Curve([<curve referenced from the Rhino model> x4])
crv_8 = Curve([<curve referenced from the Rhino model> x3])
crv_9 = Curve([<curve referenced from the Rhino model> x2])
crv_10 = Curve([<curve referenced from the Rhino model> x2])
crv_11 = Curve(<curve referenced from the Rhino model>)
crv_12 = Curve(<curve referenced from the Rhino model>)
crv_13 = Curve([<curve referenced from the Rhino model> x4])
crv_14 = Curve([<curve referenced from the Rhino model> x2])
crv_15 = Curve(<curve referenced from the Rhino model>)
crv_16 = Curve([<curve referenced from the Rhino model> x2])
crv_17 = Curve([<curve referenced from the Rhino model> x2])
crv_18 = Curve(<curve referenced from the Rhino model>)
crv_19 = Curve([<curve referenced from the Rhino model> x3])
crv_20 = Curve([<curve referenced from the Rhino model> x2])
crv_21 = Curve([<curve referenced from the Rhino model> x4])
crv_22 = Curve(<curve referenced from the Rhino model>)
crv_23 = Curve([<curve referenced from the Rhino model> x2])
crv_24 = Curve([<curve referenced from the Rhino model> x2])
crv_25 = Curve([<curve referenced from the Rhino model> x2])
crv_26 = Curve([<curve referenced from the Rhino model> x2])
crv_27 = Curve([<curve referenced from the Rhino model> x2])
crv_28 = Curve(<curve referenced from the Rhino model>)
crv_29 = Curve(<curve referenced from the Rhino model>)
crv_30 = Curve(<curve referenced from the Rhino model>)
crv_31 = Curve(<curve referenced from the Rhino model>)
crv_32 = Curve([<curve referenced from the Rhino model> x2])
crv_33 = Curve([<curve referenced from the Rhino model> x3])
crv_34 = Curve([<curve referenced from the Rhino model> x2])
crv_35 = Curve([<curve referenced from the Rhino model> x4])
crv_36 = Curve(<curve referenced from the Rhino model>)
crv_37 = Curve([<curve referenced from the Rhino model> x2])
crv_38 = Curve([<curve referenced from the Rhino model> x3])
crv_39 = Curve([<curve referenced from the Rhino model> x4])
crv_40 = Curve([<curve referenced from the Rhino model> x4])
crv_41 = Curve([<curve referenced from the Rhino model> x2])
crv_42 = Curve([<curve referenced from the Rhino model> x4])
crv_43 = Curve([<curve referenced from the Rhino model> x2])
crv_44 = Curve(<curve referenced from the Rhino model>)
crv_45 = Curve(<curve referenced from the Rhino model>)
crv_46 = Curve([<curve referenced from the Rhino model> x2])
crv_47 = Curve(<curve referenced from the Rhino model>)
crv_48 = Curve([<curve referenced from the Rhino model> x3])
crv_49 = Curve([<curve referenced from the Rhino model> x3])
crv_50 = Curve(<curve referenced from the Rhino model>)
crv_51 = Curve(<curve referenced from the Rhino model>)
crv_52 = Curve(<curve referenced from the Rhino model>)
crv_53 = Curve(<curve referenced from the Rhino model>)
crv_54 = Curve(<curve referenced from the Rhino model>)
crv_55 = Curve([<curve referenced from the Rhino model> x2])
crv_56 = Curve([<curve referenced from the Rhino model> x2])
crv_57 = Curve([<curve referenced from the Rhino model> x2])
crv_58 = Curve([<curve referenced from the Rhino model> x5])
crv_59 = Curve(<curve referenced from the Rhino model>)
crv_60 = Curve(<curve referenced from the Rhino model>)
crv_61 = Curve([<curve referenced from the Rhino model> x4])
crv_62 = Curve([<curve referenced from the Rhino model> x4])
crv_63 = Curve([<curve referenced from the Rhino model> x4])
crv_64 = Curve([<curve referenced from the Rhino model> x4])
crv_65 = Curve([<curve referenced from the Rhino model> x2])
crv_66 = Curve(<curve referenced from the Rhino model>)
crv_67 = Curve([<curve referenced from the Rhino model> x3])
crv_68 = Curve(<curve referenced from the Rhino model>)
crv_69 = Curve(<curve referenced from the Rhino model>)
crv_70 = Curve([<curve referenced from the Rhino model> x2])
crv_71 = Curve([<curve referenced from the Rhino model> x2])
crv_72 = Curve(<curve referenced from the Rhino model>)
crv_73 = Curve([<curve referenced from the Rhino model> x3])
crv_74 = Curve(<curve referenced from the Rhino model>)

# ---- group: Urban Pointgrid Generator (Compact)
pointgrid_settings = PointgridSettings(C=block_outline, R=block_outline)  # -> pt_2, X, Y, R_2
arrrec = RectangularArray(Geometry=pointgrid_settings.pt_2, Cell=pointgrid_settings.R_2, XCount=pointgrid_settings.X, YCount=pointgrid_settings.Y)  # -> Geometry, Transform
# Urban Block Pointgrid Generator
# Compact
pointgrid = Point(arrrec.Geometry)

# ---- group: Urban Block Pointgrid Generator
drec = DeconstuctRectangle(Rectangle=block_outline_2)  # -> BasePlane, XInterval, YInterval
number_slider = Slider(1, range=1..1500)
bbox = BoundingBox(Content=block_outline_2, Plane=drec.BasePlane)  # -> Box, Box_2
drec_2 = DeconstuctRectangle(Rectangle=bbox.Box)  # -> BasePlane, XInterval, YInterval
debrep = DeconstructBrep(Brep=bbox.Box)  # -> Faces, Edges, Vertices
rectangle = Rectangle(Plane=drec.BasePlane, XSize=number_slider, YSize=number_slider, Radius=0)  # -> Rectangle, Length
# Test
item = ListItem(List=debrep.Vertices, Index=Slider(4, range=0..10), Wrap=True)
pt = Point(item)
# Urban Block Pointgrid Generator
arrrec_2 = RectangularArray(Geometry=pt, Cell=rectangle.Rectangle, XCount=drec_2.XInterval, YCount=drec_2.YInterval)  # -> Geometry, Transform

# ---- group: Courtyard Centerpoint Generator
python = PythonScript(
    house1=crv,
    house2=crv_2,
    house3=crv_3,
    house4=crv_4,
    house5=crv_5,
    house6=crv_6,
    house7=crv_7,
    house8=crv_8,
    house9=crv_9,
    house10=crv_10,
    house11=crv_11,
    house12=crv_65,
    house13=crv_66,
    house14=crv_12,
    house15=crv_13,
    house16=crv_14,
    house17=crv_15,
    house18=crv_16,
    house19=crv_17,
    house20=crv_18,
    house21=crv_19,
    house22=crv_20,
    house23=crv_21,
    house24=crv_22,
    house25=crv_67,
    house26=crv_23,
    house27=crv_24,
    house28=crv_25,
    house29=crv_26,
    house30=crv_27,
    house31=crv_68,
    house32=crv_28,
    house33=crv_29,
    house34=crv_30,
    house35=crv_31,
    house36=crv_32,
    house37=crv_33,
    house38=crv_34,
    house39=crv_35,
    house40=crv_36,
    house41=crv_37,
    house42=crv_38,
    house43=crv_39,
    house44=crv_40,
    house45=crv_41,
    house46=crv_69,
    house47=crv_42,
    house48=crv_70,
    house49=crv_71,
    house50=crv_72,
    house51=crv_73,
    house52=crv_43,
    house53=crv_74,
    house54=crv_44,
    house55=crv_45,
    house56=crv_46,
    house57=crv_47,
    house58=crv_48,
    house59=crv_49,
    house60=crv_50,
    house61=crv_51,
    house62=crv_52,
    house63=crv_53,
    house64=crv_54,
    house65=crv_55,
    house66=crv_56,
    house67=crv_57,
    house68=crv_58,
    house69=crv_59,
    house70=crv_60,
    house71=crv_61,
    house72=crv_62,
    house73=crv_63,
    house74=crv_64)  # -> splits; inputs house1: list of Curve, house2: list of Curve, house3: list of Curve, house4: list of Curve, house5: list of Curve, house6: list of Curve, house7: list of Curve, house8: list of Curve, house9: list of Curve, house10: list of Curve, house11: list of Curve, house12: list of Curve, house13: list of Curve, house14: list of Curve, house15: list of Curve, house16: list of Curve, house17: list of Curve, house18: list of Curve, house19: list of Curve, house20: list of Curve, house21: list of Curve, house22: list of Curve, house23: list of Curve, house24: list of Curve, house25: list of Curve, house26: list of Curve, house27: list of Curve, house28: list of Curve, house29: list of Curve, house30: list of Curve, house31: list of Curve, house32: list of Curve, house33: list of Curve, house34: list, house35: list of Curve, house36: list of Curve, house37: list of Curve, house38: list of Curve, house39: list of Curve, house40: list of Curve, house41: list of Curve, house42: list of Curve, house43: list of Curve, house44: list of Curve, house45: list of Curve, house46: list of Curve, house47: list of Curve, house48: list of Curve, house49: list of Curve, house50: list of Curve, house51: list of Curve, house52: list of Curve, house53: list of Curve, house54: list of Curve, house55: list of Curve, house56: list of Curve, house57: list of Curve, house58: list of Curve, house59: list of Curve, house60: list of Curve, house61: list of Curve, house62: list of Curve, house63: list of Curve, house64: list of Curve, house65: list of Curve, house66: list of Curve, house67: list of Curve, house68: list of Curve, house69: list of Curve, house70: list of Curve, house71: list of Curve, house72: list of Curve, house73: list of Curve, house74: list of Curve
# ---------- python: Python ----------
indexes = []

print dir()
for count in range(99):
    if 'house{}'.format(count+1) in dir():
        indexes.append(len(eval('house{}'.format(count+1))))
    else:
        break

splits=indexes
# ---------- end python ----------
partition = PartitionList(
    List=[crv, crv_2, crv_3, crv_4, crv_5, crv_6, crv_7, crv_8, crv_9, crv_10, crv_11, crv_65, crv_66, crv_12, crv_13, crv_14, crv_15, crv_16, crv_17, crv_18, crv_19, crv_20, crv_21, crv_22, crv_67, crv_23, crv_24, crv_25, crv_26, crv_27, crv_68, crv_28, crv_29, crv_30, crv_31, crv_32, crv_33, crv_34, crv_35, crv_36, crv_37, crv_38, crv_39, crv_40, crv_41, crv_69, crv_42, crv_70, crv_71, crv_72, crv_73, crv_43, crv_74, crv_44, crv_45, crv_46, crv_47, crv_48, crv_49, crv_50, crv_51, crv_52, crv_53, crv_54, crv_55, crv_56, crv_57, crv_58, crv_59, crv_60, crv_61, crv_62, crv_63, crv_64],
    Size=python)
python_2 = PythonScript(curves=partition)  # -> center, caravans; inputs curves: tree of Curve
# ---------- python_2: Python ----------
import rhinoscriptsyntax as rs
import Rhino
import math

print curves.Branches[0]

points = []

for branch in curves.Branches:
    caravan_centers = []
    no_caravans = len(branch)
    for curve in branch:
        bb = curve.GetBoundingBox(True)
        caravan_centers.append(bb.Center)
    if no_caravans < 6:
        polyline = Rhino.Geometry.Polyline(caravan_centers)
        points.append(polyline.CenterPoint())

center = points
# ---------- end python_2 ----------
# Courtyard Centerpoint Finder
pt_2 = Point(python_2.center)

# ----
crv_75 = Curve(<curve referenced from the Rhino model>)
crv_76 = Curve(<curve referenced from the Rhino model>)
crv_77 = Curve([<curve referenced from the Rhino model> x4])
crv_78 = Curve([<curve referenced from the Rhino model> x3])
crv_79 = Curve([<curve referenced from the Rhino model> x2])
crv_80 = Curve(<curve referenced from the Rhino model>)
crv_81 = Curve(<curve referenced from the Rhino model>)
crv_82 = Curve([<curve referenced from the Rhino model> x2])
crv_83 = Curve(<curve referenced from the Rhino model>)
crv_84 = Curve([<curve referenced from the Rhino model> x2])
crv_85 = Curve([<curve referenced from the Rhino model> x4])
crv_86 = Curve([<curve referenced from the Rhino model> x2])
crv_87 = Curve([<curve referenced from the Rhino model> x2])
crv_88 = Curve([<curve referenced from the Rhino model> x2])
crv_89 = Curve(<curve referenced from the Rhino model>)
crv_90 = Curve(<curve referenced from the Rhino model>)
crv_91 = Curve([<curve referenced from the Rhino model> x2])
crv_92 = Curve([<curve referenced from the Rhino model> x2])
crv_93 = Curve(<curve referenced from the Rhino model>)
crv_94 = Curve([<curve referenced from the Rhino model> x2])
crv_95 = Curve([<curve referenced from the Rhino model> x4])
crv_96 = Curve(<curve referenced from the Rhino model>)
crv_97 = Curve([<curve referenced from the Rhino model> x3])
crv_98 = Curve(<curve referenced from the Rhino model>)
crv_99 = Curve(<curve referenced from the Rhino model>)
crv_100 = Curve([<curve referenced from the Rhino model> x2])
crv_101 = Curve([<curve referenced from the Rhino model> x5])
crv_102 = Curve([<curve referenced from the Rhino model> x4])
crv_103 = Curve([<curve referenced from the Rhino model> x4])
crv_104 = Curve([<curve referenced from the Rhino model> x2])
crv_105 = Curve([<curve referenced from the Rhino model> x2])
crv_106 = Curve(<curve referenced from the Rhino model>)
crv_107 = Curve(<curve referenced from the Rhino model>)
crv_108 = Curve([<curve referenced from the Rhino model> x2])
crv_109 = Curve([<curve referenced from the Rhino model> x2])
crv_110 = Curve(<curve referenced from the Rhino model>)
crv_111 = Curve([<curve referenced from the Rhino model> x4])
crv_112 = Curve(<curve referenced from the Rhino model>)
crv_113 = Curve([<curve referenced from the Rhino model> x2])
crv_114 = Curve([<curve referenced from the Rhino model> x2])
crv_115 = Curve([<curve referenced from the Rhino model> x3])
crv_116 = Curve(<curve referenced from the Rhino model>)
crv_117 = Curve([<curve referenced from the Rhino model> x3])
crv_118 = Curve([<curve referenced from the Rhino model> x2])
crv_119 = Curve([<curve referenced from the Rhino model> x2])
crv_120 = Curve(<curve referenced from the Rhino model>)
crv_121 = Curve(<curve referenced from the Rhino model>)
crv_122 = Curve(<curve referenced from the Rhino model>)
crv_123 = Curve([<curve referenced from the Rhino model> x3])
crv_124 = Curve([<curve referenced from the Rhino model> x4])
crv_125 = Curve([<curve referenced from the Rhino model> x3])
crv_126 = Curve([<curve referenced from the Rhino model> x4])
crv_127 = Curve([<curve referenced from the Rhino model> x4])
crv_128 = Curve([<curve referenced from the Rhino model> x2])
crv_129 = Curve(<curve referenced from the Rhino model>)
crv_130 = Curve([<curve referenced from the Rhino model> x2])
crv_131 = Curve([<curve referenced from the Rhino model> x2])
crv_132 = Curve(<curve referenced from the Rhino model>)
crv_133 = Curve([<curve referenced from the Rhino model> x3])
crv_134 = Curve([<curve referenced from the Rhino model> x2])
crv_135 = Curve(<curve referenced from the Rhino model>)
crv_136 = Curve(<curve referenced from the Rhino model>)
crv_137 = Curve(<curve referenced from the Rhino model>)
crv_138 = Curve([<curve referenced from the Rhino model> x2])
crv_139 = Curve([<curve referenced from the Rhino model> x3])
crv_140 = Curve(<curve referenced from the Rhino model>)
crv_141 = Curve(<curve referenced from the Rhino model>)
crv_142 = Curve(<curve referenced from the Rhino model>)
crv_143 = Curve([<curve referenced from the Rhino model> x2])
crv_144 = Curve([<curve referenced from the Rhino model> x2])
crv_145 = Curve(<curve referenced from the Rhino model>)
crv_146 = Curve(<curve referenced from the Rhino model>)
crv_147 = Curve([<curve referenced from the Rhino model> x4])
crv_148 = Curve([<curve referenced from the Rhino model> x4])
# Design
python_3 = PythonScript(
    house1=crv_104,
    house2=crv_105,
    house3=crv_75,
    house4=crv_76,
    house5=crv_106,
    house6=crv_107,
    house7=crv_77,
    house8=crv_78,
    house9=crv_79,
    house10=crv_108,
    house11=crv_80,
    house12=crv_109,
    house13=crv_110,
    house14=crv_81,
    house15=crv_111,
    house16=crv_82,
    house17=crv_112,
    house18=crv_113,
    house19=crv_114,
    house20=crv_83,
    house21=crv_115,
    house22=crv_84,
    house23=crv_85,
    house24=crv_116,
    house25=crv_117,
    house26=crv_118,
    house27=crv_86,
    house28=crv_87,
    house29=crv_88,
    house30=crv_119,
    house31=crv_120,
    house32=crv_121,
    house33=crv_89,
    house34=crv_90,
    house35=crv_122,
    house36=crv_91,
    house37=crv_123,
    house38=crv_92,
    house39=crv_124,
    house40=crv_93,
    house41=crv_94,
    house42=crv_125,
    house43=crv_126,
    house44=crv_127,
    house45=crv_128,
    house46=crv_129,
    house47=crv_95,
    house48=crv_130,
    house49=crv_131,
    house50=crv_132,
    house51=crv_133,
    house52=crv_134,
    house53=crv_135,
    house54=crv_136,
    house55=crv_137,
    house56=crv_138,
    house57=crv_96,
    house58=crv_97,
    house59=crv_139,
    house60=crv_140,
    house61=crv_141,
    house62=crv_98,
    house63=crv_142,
    house64=crv_99,
    house65=crv_143,
    house66=crv_144,
    house67=crv_100,
    house68=crv_101,
    house69=crv_145,
    house70=crv_146,
    house71=crv_147,
    house72=crv_102,
    house73=crv_103,
    house74=crv_148)  # -> splits; inputs house1: list of Curve, house2: list of Curve, house3: list of Curve, house4: list of Curve, house5: list of Curve, house6: list of Curve, house7: list of Curve, house8: list of Curve, house9: list of Curve, house10: list of Curve, house11: list of Curve, house12: list of Curve, house13: list of Curve, house14: list of Curve, house15: list of Curve, house16: list of Curve, house17: list of Curve, house18: list of Curve, house19: list of Curve, house20: list of Curve, house21: list of Curve, house22: list of Curve, house23: list of Curve, house24: list of Curve, house25: list of Curve, house26: list of Curve, house27: list of Curve, house28: list of Curve, house29: list of Curve, house30: list of Curve, house31: list of Curve, house32: list of Curve, house33: list of Curve, house34: list, house35: list of Curve, house36: list of Curve, house37: list of Curve, house38: list of Curve, house39: list of Curve, house40: list of Curve, house41: list of Curve, house42: list of Curve, house43: list of Curve, house44: list of Curve, house45: list of Curve, house46: list of Curve, house47: list of Curve, house48: list of Curve, house49: list of Curve, house50: list of Curve, house51: list of Curve, house52: list of Curve, house53: list of Curve, house54: list of Curve, house55: list of Curve, house56: list of Curve, house57: list of Curve, house58: list of Curve, house59: list of Curve, house60: list of Curve, house61: list of Curve, house62: list of Curve, house63: list of Curve, house64: list of Curve, house65: list of Curve, house66: list of Curve, house67: list of Curve, house68: list of Curve, house69: list of Curve, house70: list of Curve, house71: list of Curve, house72: list of Curve, house73: list of Curve, house74: list of Curve; same code as python
block_outline_3 = Curve(<curve referenced from the Rhino model>)
partition_2 = PartitionList(
    List=[crv_104, crv_105, crv_75, crv_76, crv_106, crv_107, crv_77, crv_78, crv_79, crv_108, crv_80, crv_109, crv_110, crv_81, crv_111, crv_82, crv_112, crv_113, crv_114, crv_83, crv_115, crv_84, crv_85, crv_116, crv_117, crv_118, crv_86, crv_87, crv_88, crv_119, crv_120, crv_121, crv_89, crv_90, crv_122, crv_91, crv_123, crv_92, crv_124, crv_93, crv_94, crv_125, crv_126, crv_127, crv_128, crv_129, crv_95, crv_130, crv_131, crv_132, crv_133, crv_134, crv_135, crv_136, crv_137, crv_138, crv_96, crv_97, crv_139, crv_140, crv_141, crv_98, crv_142, crv_99, crv_143, crv_144, crv_100, crv_101, crv_145, crv_146, crv_147, crv_102, crv_103, crv_148],
    Size=python_3)
pointgrid_settings_2 = PointgridSettings(C=block_outline_3, R=block_outline_3)  # -> pt_2, X, Y, R_2
python_4 = PythonScript(curves=partition_2)  # -> center, caravans; inputs curves: tree of Curve; same code as python_2
arrrec_3 = RectangularArray(
    Geometry=pointgrid_settings_2.pt_2,
    Cell=pointgrid_settings_2.R_2,
    XCount=pointgrid_settings_2.X,
    YCount=pointgrid_settings_2.Y)  # -> Geometry, Transform
courtyard_centerpoints_not_on_grid = Point(python_4.center)
pointgrid_2 = Point(arrrec_3.Geometry)
pull = PullPoint(Point=courtyard_centerpoints_not_on_grid, Geometry=pointgrid_2, ClosestOnly=True)  # -> ClosestPoint, Distance
courtyard_centerpoints_on_grid = Point(pull.ClosestPoint)

# ==== cluster PointgridSettings
R = ClusterInput()
drec = DeconstuctRectangle(Rectangle=R)  # -> BasePlane, XInterval, YInterval
C = ClusterInput()
number_slider = Slider(1, range=1..1500)
bbox = BoundingBox(Content=C, Plane=drec.BasePlane)  # -> Box, Box_2
drec_2 = DeconstuctRectangle(Rectangle=bbox.Box)  # -> BasePlane, XInterval, YInterval
debrep = DeconstructBrep(Brep=bbox.Box)  # -> Faces, Edges, Vertices
rectangle = Rectangle(Plane=drec.BasePlane, XSize=number_slider, YSize=number_slider, Radius=0)  # -> Rectangle, Length
item = ListItem(List=debrep.Vertices, Index=Slider(4, range=0..10), Wrap=True)
X = ClusterOutput(drec_2.XInterval)
Y = ClusterOutput(drec_2.YInterval)
R_2 = ClusterOutput(rectangle.Rectangle)
pt = Point(item)
pt_2 = ClusterOutput(pt)
